# Grasshopper definition Syntactic_bubble-diagram.gh (Grasshopper 1.0.7)
# plug-ins: SpaceSyntaxDesign_GH

panel = Panel("""Library
Meeting/conference
Al aghabani """)
panel_2 = Panel("""Lobby
Shops
Exhibition
Child care
Office
Toilet
Main storage
Kitchenette
Public square""")
panel_3 = Panel("""Secondary court
Wood workshop
Construction 
Storage 2(wood+cons)""")
panel_4 = Panel("""Multipurpose Hall
Main courtyard
Pottery 
Weaving 
Firing room
Storage 1(pott+weaving)""")
d1 = Point([<point referenced from the Rhino model> x6])
d2 = Point([<point referenced from the Rhino model> x4])
d2_2 = Point([<point referenced from the Rhino model> x9])
d2_3 = Point([<point referenced from the Rhino model> x3])
merge = Merge(Data1=panel_4, Data2=panel_3, Data3=panel_2)
gene_pool = GenePool(Decimals=0, Maximum=200, Minimum=0, Value=[120, 164, 40, 40, 10, 21])
gene_pool_2 = GenePool(Decimals=0, Maximum=150, Minimum=0, Value=[100, 40, 40, 20])
gene_pool_3 = GenePool(Decimals=0, Maximum=150, Minimum=0, Value=[40, 35, 60, 40, 20, 20, 10, 10, 130])
gene_pool_4 = GenePool(Decimals=0, Maximum=150, Minimum=0, Value=[60, 40, 30])
merge_2 = Merge(Data1=d1, Data2=d2, Data3=d2_2)
curve = Curve([<curve referenced from the Rhino model> x21])
totalarea = TotalArea(Slider(1000, range=0..1000))
merge_3 = Merge(Data1=gene_pool, Data2=gene_pool_2, Data3=gene_pool_3)
graphfromnodes_links = GraphFromNodesLinks(Points=merge_2, Links=curve, Labels=merge, Areas=merge_3, TotalArea=totalarea)  # -> Graph, GraphVertices, Attributes
forcedirecteddrawing = ForceDirectedDrawing(
    Graph=graphfromnodes_links.Graph,
    Vertices=graphfromnodes_links.GraphVertices,
    Attributes=graphfromnodes_links.Attributes,
    AttractionStrength=0.25,
    RepulsionStrength=1.4,
    ConvergenceTolearnce=0.001,
    MaximumIterations=4000,
    Active=Toggle(True))  # -> NewGraphVertices, IterationCount
diskographdrawing = DiskoGraphDrawing(
    Plane=PlaneXY(112.2460032, 4.093088752, 0),
    Graph=graphfromnodes_links.Graph,
    Vertices=forcedirecteddrawing.NewGraphVertices,
    Attributes=graphfromnodes_links.Attributes,
    Thickness=1)
