# Grasshopper definition Syntactic_bubble-diagram_Draft.gh (Grasshopper 0.9.76)
# plug-ins: SpaceSyntaxDesign_GH

communal_spaces = Panel("""Lobby
Multipurpose Hall
Main Courtyard
Secondary Courtyard""")
services = Panel("""Toilet
Storage
Kitchenette""")
workshops = Panel("""Textile Workshop
Pottery Workshop
Wood Work Workshop
Workshop Storage
Construction Workshop
 Prototyping Space
Construction Storage""")
communal_spaces_sqm = Panel("""30
100
100
60""")
miscellaneous = Panel("""Shop
Exhibition Room
Childcare
Office
Conference/Meeting Room""")
workshops_sqm = Panel("""60
60
60
20
60
40
20""")
miscellaneous_2 = Panel("""30
20
32.5
14
16""")
services_2 = Panel("""10
10
10""")
communal_pts = Point([<point referenced from the Rhino model> x4])
workshop_pts = Point([<point referenced from the Rhino model> x7])
crv = Curve([<curve referenced from the Rhino model> x28])
service_pts = Point([<point referenced from the Rhino model> x3])
misc_pts = Point([<point referenced from the Rhino model> x5])
merge = Merge(Data1=communal_pts, Data2=workshop_pts, Data3=misc_pts, Data4=service_pts)
merge_2 = Merge(Data1=communal_spaces, Data2=workshops, Data3=miscellaneous, Data4=services)
merge_3 = Merge(Data1=communal_spaces_sqm, Data2=workshops_sqm, Data3=miscellaneous_2, Data4=services_2)
num = Number(merge_3)
nodelinkgraph = GraphFromNodesLinks(Points=merge, Links=crv, Labels=merge_2, Areas=num, TotalArea=Slider(100, range=0..1000))  # -> Graph, GraphVertices, Attributes
xy = XYPlane(Origin=Point(0, 0, 0))
forcedirecteddrawing = ForceDirectedDrawing(
    Graph=nodelinkgraph.Graph,
    Vertices=nodelinkgraph.GraphVertices,
    Attributes=nodelinkgraph.Attributes,
    AttractionStrength=0.25,
    RepulsionStrength=1.4,
    ConvergenceTolearnce=0.001,
    MaximumIterations=4000,
    Active=Toggle(True))  # -> NewGraphVertices, IterationCount
diskograph = DiskoGraphDrawing(
    Plane=xy,
    Graph=nodelinkgraph.Graph,
    Vertices=forcedirecteddrawing.NewGraphVertices,
    Attributes=nodelinkgraph.Attributes,
    Thickness=Slider(6, range=0..10))
