# Grasshopper definition muqarnas_dome.gh (Grasshopper 0.9.76)
# plug-ins: Python Interpreter

# # AR3B011 EARTHY (2020/21 Q1)
# # Zaatari Refugee Camp Heritage Center Project: "Bayt alturath"
# # Group Members: Selina Bitting, Barbara Foolen de Oliveira, Inaka Sema, Yamini Patidar, Maimuna Bala Shehu
panel = Panel("0")

# ---- group: pair pattern orders
panel_2 = Panel("order = [[0,1], [1,2], [2,3], [3,5],[4,6],[5,7],[6,9],[7,10],[9,11],[10,12],[11,14],[12,13],[13,17],[14,16],[16,21],[17,20],[18,22],[19,23],[20,25],[21,24],[22,28],[23,27],[25,26],[27,31]]")
panel_3 = Panel("[[0,1], [1,2], [2,3], [3,5],[5,7],[7,10],[10,12],[12,13],[13,17],[17,20],[20,25],[25,26],[4,6],[6,9],[9,11],[11,14],[14,16],[16,21],[21,24],[18,22],[22,28],[19,23],[23,27],[27,31]]")

# ----
construct_point = ConstructPoint(XCoordinate=panel, YCoordinate=panel, ZCoordinate=panel)

# ---- group: You can experiment, but the proportioning doesnt work well outside of 10
number_slider = Slider(6, range=0..10)

# ---- group: blockHeight
number = Number(".25")

# ----
number_2 = Number("6.6")
point = Point(construct_point)

# ---- group: create penrose
python_script = PythonScript(origin=point, diameter=number_2, subDiv=Slider(5, range=0..5), numSides=number_slider)  # -> out, allTri, redTri, bluTri, tri_info, tri, triangles, c_coord, c_points; inputs origin: Point3d
# ---------- python_script: Python ----------
# AR3B011 EARTHY (2020/21 Q1)
# Zaatari Refugee Camp Heritage Center Project: "Bayt alturath"
# Group Members: Selina Bitting, Barbara Foolen de Oliveira, Inaka Sema, Yamini Patidar, Maimuna Bala Shehu

# Please refer to the final report for more in-depth explanations of each element of the script. 

import rhinoscriptsyntax as rs
import Rhino.Geometry as rg
import math
import cmath


numSides = int(numSides)
subDiv = int(subDiv)
diam = diameter

goldenRatio = (1 + math.sqrt(5)) / 2

#red triangle is 36 degree angle at apex
#blue triangle is 108 angle at apex
#color, 0 is red and 1 is blue

#triangles as tuples in form (color,A,B,C)

#Complex numbers work well here since they can represent any point on the 2D plane 
#– the real component gives the x co-ordinate, while the imaginary component 
#gives the y co-ordinate


def subdivide(triangles):
    result = []
    for color, A, B, C in triangles:
        if color == 0:
            # Subdivide red triangle
            P = A + (B - A) / goldenRatio
            result += [(0, C, P, B), (1, P, C, A)]
        else:
            # Subdivide blue triangle
            Q = B + (A - B) / goldenRatio
            R = B + (C - B) / goldenRatio
            result += [(1, R, C, A), (1, Q, R, B), (0, R, Q, A)]
    return result

# Create wheel of red triangles around the origin
triangles = []
for i in range(numSides):
    B = cmath.rect(1, (2*i - 1) * math.pi / numSides)
    B = B*(diameter/2)
    C = cmath.rect(1, (2*i + 1) * math.pi / numSides)
    C = C*(diameter/2)
    if i % 2 == 0:
        B, C = C, B  # Make sure to mirror every second triangle
    triangles.append((0, 0j, B, C))


# Perform subdivisions
for i in range(subDiv):
    triangles = subdivide(triangles)



tri = []
tri_info = []

c_coord = []
c_points = []
# centroid https://www.mathopenref.com/coordcentroid.html

for color, A, B, C in triangles:
    Apt = rg.Point3d(-A.imag, A.real, 0)
    Bpt = rg.Point3d(-B.imag, B.real, 0)
    Cpt = rg.Point3d(-C.imag, C.real, 0)
    
    
    c_coord.append([-C.imag, C.real, 0])
    c_points.append(Cpt)
    Dy = ((A.real+B.real+C.real)/3)
    Dx = -((A.imag+B.imag+C.imag)/3)
    Dpt = rg.Point3d(Dx, Dy, 0)

    distToCenter = origin.DistanceTo(Dpt)
    
    Dsin = Dy / distToCenter
    Dcos = Dx / distToCenter
    DSa = math.asin(Dsin)
    DCa = math.acos(Dcos)
    singleTri = rg.Polyline([Apt,Bpt,Cpt,Apt])

    tri.append(singleTri)
    tri_info.append([distToCenter, DSa, DCa])
# ---------- end python_script ----------

# ---- group: tri_info
data = Data(python_script.tri_info)

# ---- group: tri
data_2 = Data(python_script.tri)

# ---- group: triangles
data_3 = Data(python_script.triangles)

# ---- group: sort triangles radially
python_script_2 = PythonScript(tri_info=data, tri=data_2, triangles=data_3)  # -> out, order, dists_sorted, tri_sorted; inputs tri_info: list, tri: list of Curve, triangles: list
# ---------- python_script_2: Python ----------
# AR3B011 EARTHY (2020/21 Q1)
# Zaatari Refugee Camp Heritage Center Project: "Bayt alturath"
# Group Members: Selina Bitting, Barbara Foolen de Oliveira, Inaka Sema, Yamini Patidar, Maimuna Bala Shehu


import rhinoscriptsyntax as rs
import math
import cmath



# This section is explained with diagrams in the report, however to summarize the arccos and arcsin
# are used to map out locations of the triangles by distance and angle so distance comes first, and 
# then the order moves counterclockwise from the horizontal 'seam' in the pattern on the right.


#ORDERING
############
aw = 1
dw = 100000000000
order_values = []
degs = []
dists = []
for ti in tri_info:
    sdeg = math.degrees(ti[1])
    cdeg = math.degrees(ti[2])
    if 90 >= sdeg >= 0 and 90>=cdeg>=0:
        deg = sdeg
    elif 90 >= sdeg >= 0 and 180>=cdeg>=90:
        deg = cdeg
    elif 0 >= sdeg >= -90 and 180>=cdeg>=90:
        deg = 360 - cdeg
    elif 0 >= sdeg >= -90 and 90>=cdeg>=0:
        deg = 360 + sdeg
    
    order_value = aw * deg + dw * ti[0]
    order_values.append(order_value)
    degs.append(deg)
    dists.append(ti[0])
    
def argsort(seq):
    #http://stackoverflow.com/questions/3382352/equivalent-of-numpy-argsort-in-basic-python/3382369#3382369
    #by unutbu
    return sorted(range(len(seq)), key=seq.__getitem__)

order = argsort(order_values)


tri_sorted = [tri[id] for id in order]
degs_sorted = [degs[id] for id in order]
dists_sorted = [dists[id] for id in order]
sorted_info = [(order_values[id], degs[id], dists[id]) for id in order]
# ---------- end python_script_2 ----------

# ---- group: order
data_4 = Data(python_script_2.order)

# ---- group: dists_sorted
data_5 = Data(python_script_2.dists_sorted)

# ---- group: tri_sorted
data_6 = Data(python_script_2.tri_sorted)

# ---- group: group triangles into 'rings'
python_script_3 = PythonScript(order=data_4, dists_sorted=data_5)  # -> out, levels; inputs order: list, dists_sorted: list
# ---------- python_script_3: Python ----------
# AR3B011 EARTHY (2020/21 Q1)
# Zaatari Refugee Camp Heritage Center Project: "Bayt alturath"
# Group Members: Selina Bitting, Barbara Foolen de Oliveira, Inaka Sema, Yamini Patidar, Maimuna Bala Shehu


import rhinoscriptsyntax as rs
import math
import cmath


# Checking if the previous distance is equal, and then appending i (the ring id/number)
# to later identify how far to displace the blocks.

levels = []
prev_d = dists_sorted[0]
i = 0
for d in dists_sorted:
    if abs(d - prev_d) > 0.0001:
        i += 1
        levels.append(i)
    else:
        levels.append(i)
    prev_d = d
# ---------- end python_script_3 ----------

# ---- group: levels
data_7 = Data(python_script_3.levels)

# ---- group: blockHeight
number_3 = Number(number)

# ---- group: Get the pairs of triangles
python_script_4 = PythonScript(levels=data_7, tris=data_6, sel=Slider(13, range=0..25))  # -> out, enum, list, manual, selected_pairs, all_pairs; inputs levels: list, tris: list of Polyline, sel: Int32
# ---------- python_script_4: Python ----------
# AR3B011 EARTHY (2020/21 Q1)
# Zaatari Refugee Camp Heritage Center Project: "Bayt alturath"
# Group Members: Selina Bitting, Barbara Foolen de Oliveira, Inaka Sema, Yamini Patidar, Maimuna Bala Shehu


import rhinoscriptsyntax as rs
import Rhino.Geometry as rg
import math
import cmath


levels = levels
tris = tris

# Here the triangles are numbered within their rings, such that ring/level 1 has triangle 0,1,2,3 and ring/level2 has triangle 0,1,2,3 in order
# to later pair them up with the order pattern



tris_leveled = []
this_level = []
for i, t in enumerate(tris):
    this_level.append(t)
    if levels[i] != levels[(i+1)%len(tris)]:
        tris_leveled.append(this_level)
        this_level = []

# The below order is found by manually going through the pattern and finding the pairs according to the defined logic. 

order = [[0,1], [1,2], [2,3], [3,5],[5,7],[7,10],[10,12],[12,13],[13,17],[17,20],[20,25],[25,26],[4,6],[6,9],[9,11],[11,14],[14,16],[16,21],[21,24],[18,22],[22,28],[19,23],[23,27],[27,31], [15,20],[14,15]]
all_pairs = []


# Here the pattern is fed to a loop, which then pulls the relevant triangles and gets (for example):
# triangle 0 of ring 0 and pairs it with triangle 0 of ring/level 1

for o in order:
    first_pairs = tris_leveled[o[0]]
    second_pairs = tris_leveled[o[1]]
    this_pairs = zip(first_pairs, second_pairs)
    all_pairs.append(this_pairs)

    

selected_pairs=[item for sublist in all_pairs[sel] for item in sublist]
# ---------- end python_script_4 ----------

# ----
python_script_5 = PythonScript(selected_level=Slider(29, range=0..30), levels=data_7, tris=data_6)  # -> out, sel_tri; inputs levels: list, tris: list of Curve
# ---------- python_script_5: Python ----------
# AR3B011 EARTHY (2020/21 Q1)
# Zaatari Refugee Camp Heritage Center Project: "Bayt alturath"
# Group Members: Selina Bitting, Barbara Foolen de Oliveira, Inaka Sema, Yamini Patidar, Maimuna Bala Shehu

sel_tri = []
for i in range(len(levels)):
    if levels[i]==selected_level:
        sel_tri.append(tris[i])
# ---------- end python_script_5 ----------

# ---- group: triangle pairs
data_8 = Data(python_script_4.all_pairs)

# ---- group: show rings of tris
curve = Curve(python_script_5.sel_tri)

# ---- group: account for 'strings'
python_script_6 = PythonScript(all_pairs=data_8, bH=number_3)  # -> out, adj_levels; inputs all_pairs: list
# ---------- python_script_6: Python ----------
# AR3B011 EARTHY (2020/21 Q1)
# Zaatari Refugee Camp Heritage Center Project: "Bayt alturath"
# Group Members: Selina Bitting, Barbara Foolen de Oliveira, Inaka Sema, Yamini Patidar, Maimuna Bala Shehu


import Rhino.Geometry as rg
import Rhino as rh
import rhinoscriptsyntax as rs

import ghpythonlib.components as ghc


import math



adj_levels = []
test = []



# The pattern for the i values and ranges was found by trial and error
# the report elaborates on these strings, but basically the displacement must be adjusted for certain
# groups of triangles. This is where that happens.

for i in range(len(all_pairs)):
    if 0<= i <= 11:
        for j in range(len(all_pairs[i])):
            x = (i)
            adj_levels.append(x)
    elif 12<= i <= 15:
        i = i-9
        for j in range(len(all_pairs[i])):
            x =(i)
            adj_levels.append(x)

    elif 16<= i <= 18:
        i = i-7
        for j in range(len(all_pairs[i])):
            x =(i)
            adj_levels.append(x)
    elif i==19:
        i = i -9
        for j in range(len(all_pairs[i])):
            x = (i)
            adj_levels.append(x)

    elif i==20:
        i = i -9
        for j in range(len(all_pairs[i])):
            x = (i)
            adj_levels.append(x)
    elif 21<= i <= 23:
        i = i -12
        for j in range(len(all_pairs[i])):
            x = (i)
            adj_levels.append(x)
    elif i==24:
        i = 0
        for j in range(len(all_pairs[i])):
            x = (i)+8
            adj_levels.append(x)
#wrong point
    elif i==25:
        i = 1
        for j in range(len(all_pairs[i])):
            x = (i)+6
            adj_levels.append(x)
# ---------- end python_script_6 ----------

# ---- group: origin point
point_2 = Point(point)

# ---- group: adjusted levels
number_4 = Number(python_script_6.adj_levels)

# ---- group: Make Geometry & Displace
python_script_7 = PythonScript(origin=point_2, levels=number_4, all_pairs=data_8, bH=number_3)  # -> out, modules, vertical_modules, new_modules; inputs origin: Point3d, levels: list of Int32, all_pairs: list
# ---------- python_script_7: Python ----------
# AR3B011 EARTHY (2020/21 Q1)
# Zaatari Refugee Camp Heritage Center Project: "Bayt alturath"
# Group Members: Selina Bitting, Barbara Foolen de Oliveira, Inaka Sema, Yamini Patidar, Maimuna Bala Shehu


import Rhino.Geometry as rg
import Rhino as rh
import rhinoscriptsyntax as rs

import ghpythonlib.components as ghc


import math

origin = rs.AddPoint(origin)


# This portion takes the triangle and gets its vertices. Then, the vertices are tested to find which is closest
# to the origin point. This is then returned separately from the other points.

def getCorners (curve):
    seg = rg.Polyline.GetSegments(curve)
    corners = []
    
    dist = []
    for i in seg:
        lineseg = rg.Line.ToNurbsCurve(i)
        pt = rg.NurbsCurve.PointAtEnd.GetValue(lineseg)
        corners.append(pt)
    new = rs.AddPolyline([corners[0],corners[1],corners[2],corners[0]])
    pts = rs.PolylineVertices(new)
    pts = rs.CullDuplicatePoints(pts)
    test = rs.Distance(origin,pts)
    minDist = min(test)
    #print(minDist)
    index = test.index(minDist)
    minPoint = pts[index]
    #print(minPoint)
    del pts[index]
    cornerPoints = pts
    #print(len(cornerPoints))
    return cornerPoints[0],cornerPoints[1], minPoint

# This picks an arbitrary point of the triangle

def getOneCorner (curve):
    seg = rg.Polyline.GetSegments(curve)
    lineseg = rg.Line.ToNurbsCurve(seg[0])
    pt = rg.NurbsCurve.PointAtEnd.GetValue(lineseg)
    corner = pt
    return corner

# The points are displaced by the brick height, and then all added to one list with the four corners.

def duplicatePoints(corner_one,corner_two):
    corner_one = rs.AddPoint(corner_one)
    corner_two = rs.AddPoint(corner_two)
    one = rs.PointCoordinates(corner_one)
    z_one = one[2]-bH
    new_corner_one = rs.AddPoint(one[0],one[1],z_one)
    #new_corner_one = rs.CreatePoint(one[0],one[1],z_one)
    two = rs.PointCoordinates(corner_two)
    z_two = two[2]-bH
    new_corner_two = rs.AddPoint(two[0],two[1],z_two)
    #new_corner_two = rs.CreatePoint(two[0],two[1],z_two)
    four_corners = []
    four_corners.append(corner_one)
    four_corners.append(corner_two)
    four_corners.append(new_corner_two)
    four_corners.append(new_corner_one)
    return four_corners

# Duplicate one point and displace by the brick height 

def duplicatePoint(point):
    base = rs.AddPoint(point)
    coord = rs.PointCoordinates(base)
    z_move = coord[2]-bH
    new_base = rs.AddPoint(coord[0],coord[1],z_move)
    return new_base


modules = []
points = []

vector_base = []
angle_piece = []
flat_piece = []


# an inner rectangular face is created to be used for the extrude to point command, which extrudes this 
# new rectangle toward the point closest to the origin


# the flat face is simply extruded straight

for i in range(len(all_pairs)):
    for angle,flat in all_pairs[i]:
        facet_points = getCorners(angle)
        rectangle = duplicatePoints(facet_points[0],facet_points[1])
        rectangle = rs.AddPolyline([rectangle[0],rectangle[1],rectangle[2],rectangle[3],rectangle[0]])
        angle_ext = rs.ExtrudeCurvePoint(rectangle,facet_points[2])
        flat_pointOne = getOneCorner(flat)
        flat_pointTwo = duplicatePoint(flat_pointOne)
        flat = rs.AddPolyline(flat)
        flat_ext = rs.ExtrudeCurveStraight(flat,flat_pointOne,flat_pointTwo)

        vector_base.append(flat_pointOne)
        modules.append([angle_ext,flat_ext])
        angle_piece.append(angle_ext)
        flat_piece.append(flat_ext)
        #print(flat_piece)
        
        



vertical_modules = []

new_modules = []

# the modules are displaced according to the level value multiplied by the brick height

for i in range(len(modules)):
    h = -(levels[i]*bH)
    new_angle = rs.MoveObject(angle_piece[i],[0,0,h])
    new_modules.append(new_angle)
    new_flat = rs.MoveObject(flat_piece[i],[0,0,h])
    new_modules.append(new_flat)
# ---------- end python_script_7 ----------

# ---- group: final modules
brep = Brep(python_script_7.new_modules)

# ---- group: cap all geometries
cap_holes = CapHoles(Brep=brep)

# ----
# Final Muqarnas
# Dome
data_9 = Data(cap_holes)
