# Grasshopper definition Group_4_space_layout.gh (Grasshopper 1.0.7)
# plug-ins: LunchBox, Wallacei, Kangaroo2 Components

# ----
# Pull Data from Excel
# The following excel file needs to
# be open when running the code :
# "Program of requirements _run3"
boolean_toggle = BooleanToggle(True)
panel = Panel("""1
2
3
4""")
excel_reader_legacy = ExcelReaderLEGACY(ReadToggle=boolean_toggle, Worksheet=1, Column=panel, RowStart=3, RowEnd=18)  # -> Exceptions, ExcelData
explode_tree = ExplodeTree(Data=excel_reader_legacy.ExcelData)  # -> Branch0, Branch1, Branch2, Branch3
panel_2 = Panel(explode_tree.Branch0)
panel_3 = Panel(explode_tree.Branch1)
panel_4 = Panel(explode_tree.Branch2)
panel_5 = Panel(explode_tree.Branch3)
python_count_spaces_in_regions = GhPythonScript(x=panel_3)  # -> out, n, s, w, e; inputs x: list
# ---------- python_count_spaces_in_regions: Python ----------
__author__ = "Maimuna B. Shehu"
__version__ = "2020.09.19"

import rhinoscriptsyntax as rs

n=0
s=0
e=0
w=0

for i in x:
    
    if i == 'N':
        n = n+1
    if i == 'S':
        s = s+1
    if i == 'E':
        e = e+1
    if i == 'W':
        w = w+1
        
print (n,s,e,w)
# ---------- end python_count_spaces_in_regions ----------
rectangle = Rectangle(Plane=PlaneXY(0, 0, 0), XSize=panel_4, YSize=panel_5, Radius=0)  # -> Rectangle, Length

# ----
# Draw the Main Courtyard
# Equation obtains courtyard size
wlc_secondarysize = Slider(6, range=6..7)
expression = Expression(x=wlc_secondarysize, Expression="1.8 + (0.65 * x)")
division = Division(A=expression, B=1.2)
division_2 = Division(A=wlc_secondarysize, B=1.2)
round = Round(Number=[division_2, division])  # -> Nearest, Floor, Ceiling
origin_public_square = Point(<point referenced from the Rhino model>)
wlc_secondaryrotation = Slider(7, range=0..9)
multiplication = Multiplication(A=round.Ceiling, B=1.2)
list_item = ListItem(List=multiplication, Index=0, Wrap=True)  # -> Item, Item1
construct_plane = ConstructPlane(Origin=origin_public_square, XAxis=Vector(1, 0, 0), YAxis=Vector(0, 1, 0))
multiplication_2 = Multiplication(A=wlc_secondaryrotation, B=10)
construct_domain = ConstructDomain(DomainStart=list_item.Item, DomainEnd=expr("-x", list_item.Item))
construct_domain_2 = ConstructDomain(DomainStart=list_item.Item1, DomainEnd=expr("-x", list_item.Item1))
rotate_plane = RotatePlane(Plane=construct_plane, Angle=degrees(multiplication_2))
rectangle_2 = Rectangle(Plane=rotate_plane, XSize=construct_domain, YSize=construct_domain_2, Radius=0)  # -> Rectangle, Length

# ----
# Draw the Secondary Courtyard
# Equation obtains courtyard size
wlc_mainboolean = Slider(1, range=0..1)
wlc_mainsize = Slider(7, range=7..10)
expression_2 = Expression(x=wlc_mainsize, Expression="1.8 + (0.65 * x)")
filter = StreamFilter(Gate=wlc_mainboolean, Stream0=expression_2, Stream1=wlc_mainsize)
filter_2 = StreamFilter(Gate=wlc_mainboolean, Stream0=wlc_mainsize, Stream1=expression_2)
division_3 = Division(A=filter_2, B=1.2)
division_4 = Division(A=filter, B=1.2)
round_2 = Round(Number=[division_4, division_3])  # -> Nearest, Floor, Ceiling
wlc_mainrotation = Slider(1, range=0..9)
multiplication_3 = Multiplication(A=round_2.Ceiling, B=1.2)
list_item_2 = ListItem(List=multiplication_3, Index=0, Wrap=True)  # -> Item, Item1
construct_plane_2 = ConstructPlane(Origin=origin_public_square, XAxis=Vector(1, 0, 0), YAxis=Vector(0, 1, 0))
multiplication_4 = Multiplication(A=wlc_mainrotation, B=10)
construct_domain_3 = ConstructDomain(DomainStart=list_item_2.Item, DomainEnd=expr("-x", list_item_2.Item))
construct_domain_4 = ConstructDomain(DomainStart=list_item_2.Item1, DomainEnd=expr("-x", list_item_2.Item1))
rotate_plane_2 = RotatePlane(Plane=construct_plane_2, Angle=degrees(multiplication_4))
rectangle_3 = Rectangle(Plane=rotate_plane_2, XSize=construct_domain_3, YSize=construct_domain_4, Radius=0)  # -> Rectangle, Length

# ----
# Create N,W,E,S regions
# The following rhino file needs to
# be open when running the code :
# "GROUP 4 SPACE LAYOUT"
site_boundary = Curve(<curve referenced from the Rhino model>)
north_curve = Curve(<curve referenced from the Rhino model>)
area = Area(Geometry=site_boundary)  # -> Area, Centroid
end_points = EndPoints(Curve=north_curve)  # -> Start, End
xy_plane = XYPlane(Origin=Point(0, 0, 0))
vector_2pt = Vector2Pt(PointA=end_points.Start, PointB=end_points.End, Unitize=False)  # -> Vector, Length
rotate = Rotate(Geometry=vector_2pt.Vector, Angle=degrees("90"), Plane=xy_plane)  # -> Geometry, Transform
multiplication_5 = Multiplication(A=vector_2pt.Vector, B="7")
multiplication_6 = Multiplication(A="7", B=rotate.Geometry)
move = Move(Geometry=area.Centroid, Motion=multiplication_5)  # -> Geometry, Transform
move_2 = Move(Geometry=area.Centroid, Motion=expr("-x", multiplication_5))  # -> Geometry, Transform
move_3 = Move(Geometry=area.Centroid, Motion=multiplication_6)  # -> Geometry, Transform
move_4 = Move(Geometry=area.Centroid, Motion=expr("-x", multiplication_6))  # -> Geometry, Transform
rectangle_n = Rectangle(Plane=move.Geometry, XSize=Domain(-1, 1), YSize=Domain(-2, 2), Radius=0)  # -> Rectangle, Length
rectangle_s = Rectangle(Plane=move_2.Geometry, XSize=Domain(-1, 1), YSize=Domain(-2, 2), Radius=0)  # -> Rectangle, Length
rectangle_w = Rectangle(Plane=move_3.Geometry, XSize=Domain(-1, 1), YSize=Domain(-2, 2), Radius=0)  # -> Rectangle, Length
rectangle_e = Rectangle(Plane=move_4.Geometry, XSize=Domain(-1, 1), YSize=Domain(-2, 2), Radius=0)  # -> Rectangle, Length

# ----
# Distribute spaces
# to cardinal regions
populate_east = Populate2D(Region=rectangle_e.Rectangle, Count=python_count_spaces_in_regions.e, Seed=1)
populate_north = Populate2D(Region=rectangle_n.Rectangle, Count=python_count_spaces_in_regions.n, Seed=1)
populate_south = Populate2D(Region=rectangle_s.Rectangle, Count=python_count_spaces_in_regions.s, Seed=1)
populate_west = Populate2D(Region=rectangle_w.Rectangle, Count=python_count_spaces_in_regions.w, Seed=1)
python_move_spaces_to_region = GhPythonScript(
    x=flatten(rectangle.Rectangle),
    y=panel_3,
    Region_N=populate_north,
    Region_S=populate_south,
    Region_W=populate_west,
    Region_E=populate_east)  # -> out, a; inputs x: list of Brep, y: list, Region_N: list of Point3d, Region_S: list of Point3d, Region_W: list of Point3d, Region_E: list of Point3d
# ---------- python_move_spaces_to_region: Python ----------
__author__ = "ronwi"
__version__ = "2019.09.24"

import rhinoscriptsyntax as rs
import Grasshopper as gh
from Grasshopper import DataTree as DT
import ghpythonlib as th
import Rhino.Geometry as rh

newPoints = []
new_Centroid = []
print(y)
point = rh.Point3d(0,0,0)
point_temp = rh.Point3d(0,0,0)
count_N = 0
count_S = 0
count_E = 0
count_W = 0
print(Region_N)
for i in range(len(x)):
    if y[i] =='N':
        point = rh.AreaMassProperties.Compute(x[i]).Centroid
        point_temp = Region_N[count_N]
        vect = rh.Vector3d(point_temp - point)
        x[i].Translate(vect)
        count_N = count_N+1
    if y[i] =='S':
        point = rh.AreaMassProperties.Compute(x[i]).Centroid
        point_temp = Region_S[count_S]
        vect = rh.Vector3d(point_temp - point)
        x[i].Translate(vect)
        count_S = count_S+1
    if y[i] =='E':
        point = rh.AreaMassProperties.Compute(x[i]).Centroid
        point_temp = Region_E[count_E]
        vect = rh.Vector3d(point_temp - point)
        x[i].Translate(vect)
        count_E = count_E+1
    if y[i] =='W':
        point = rh.AreaMassProperties.Compute(x[i]).Centroid
        point_temp = Region_W[count_W]
        vect = rh.Vector3d(point_temp - point)
        x[i].Translate(vect)
        count_W = count_W+1
        
a = x
# ---------- end python_move_spaces_to_region ----------
room_curves = Curve(flatten(python_move_spaces_to_region.a))

# ----
# Distribute Courtyards
# Variable x & y distances
explode = Explode(Curve=rectangle_2.Rectangle, Recursive=True)  # -> Segments, Vertices
explode_2 = Explode(Curve=rectangle_3.Rectangle, Recursive=True)  # -> Segments, Vertices
origin_public_square_2 = Point(origin_public_square)
wlc_secondaryxaxis = Slider(-1, range=-5..5)
wlc_mainxaxis = Slider(-1, range=-5..5)
wlc_secondaryyaxis = Slider(3, range=0..5)
wlc_mainyaxis = Slider(3, range=0..5)
item = ListItem(List=explode.Vertices, Index=0, Wrap=True)
item_2 = ListItem(List=explode_2.Vertices, Index=0, Wrap=True)
dist = Distance(PointA=origin_public_square_2, PointB=item)
dist_2 = Distance(PointA=origin_public_square_2, PointB=item_2)
longest_secondarycourtyard = Data(dist)
longest_maincourtyard = Data(dist_2)
squares_origin = Point(origin_public_square)
multiplication_7 = Multiplication(A=wlc_secondaryxaxis, B=2)
multiplication_8 = Multiplication(A=wlc_mainxaxis)
addition = Addition(A=longest_secondarycourtyard, B=longest_maincourtyard)
pdecon = Deconstruct(Point=squares_origin)  # -> XComponent, YComponent, ZComponent
addition_2 = Addition(A=longest_maincourtyard, B=0.5)
moveofxaxis_secondary = Data(multiplication_7)
moveofxfaxis_main = Data(multiplication_8)
moveoffyaxis_secondary = Data(wlc_secondaryyaxis)
moveoffyaxis_main = Data(wlc_mainyaxis)
addition_3 = Addition(A=moveoffyaxis_main, B=addition_2)
addition_4 = Addition(A=moveoffyaxis_secondary, B=addition)
dist_btwn_main_secondary = Number(addition)

# ---- group: main_X&Yaxis
addition_5 = Addition(A=pdecon.YComponent, B=addition_3)
addition_6 = Addition(A=pdecon.XComponent, B=moveofxfaxis_main)
pt = ConstructPoint(XCoordinate=addition_6, YCoordinate=addition_5, ZCoordinate=pdecon.ZComponent)

# ---- group: min. dist btwn the courtyards
wlc_dist_btwn_main_secondary = Number(flatten(dist_btwn_main_secondary))

# ----
pdecon_2 = Deconstruct(Point=pt)  # -> XComponent, YComponent, ZComponent
vector_2pt_2 = Vector2Pt(PointA=squares_origin, PointB=pt, Unitize=False)  # -> Vector, Length
move_5 = Move(Geometry=rectangle_3.Rectangle, Motion=vector_2pt_2.Vector)  # -> Geometry, Transform
maincourtyard = Curve(move_5.Geometry)

# ---- group: secondary_Yaxis
addition_7 = Addition(A=addition_4, B=pdecon_2.YComponent)
addition_8 = Addition(A=moveofxaxis_secondary, B=pdecon.XComponent)
pt_2 = ConstructPoint(XCoordinate=addition_8, YCoordinate=addition_7, ZCoordinate=pdecon.ZComponent)

# ----
vector_2pt_3 = Vector2Pt(PointA=squares_origin, PointB=pt_2, Unitize=False)  # -> Vector, Length
move_6 = Move(Geometry=rectangle_2.Rectangle, Motion=vector_2pt_3.Vector)  # -> Geometry, Transform
secondarycourtyard = Curve(move_6.Geometry)

# ----
# Attraction between the rooms
area_2 = Area(Geometry=room_curves)  # -> Area, Centroid
geometry_list = ListItem(List=area_2.Centroid, Index=0, Wrap=True)  # -> Item, Item1, Item2, Item3, Item4, Item5, Item6, Item7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
range_for_strong_connection = Slider(200, range=0..1000)
range_for_strong_connection_2 = Slider(500, range=0..1000)
number_slider = Slider(50, range=0..50)
strength_strong_connection = Slider(20, range=0..500)
strength_strong_connection_2 = Slider(80, range=0..500)
strength_weak_connection = Slider(6, range=0..200)

# ---- group: WEAVING/STORAGE 1/S
number_slider_2 = Slider(400, range=0..1000)
magnetsnap = MagnetSnap(Points=[geometry_list.Item11, geometry_list.Item8, geometry_list.Item9], Range=number_slider_2, Strength=number_slider)

# ---- group: WOOD-WOOD /S
magnetsnap_2 = MagnetSnap(
    Points=[geometry_list.Item15, geometry_list.Item12],
    Range=range_for_strong_connection,
    Strength=Slider(1000, range=0..1000))

# ---- group: KITCH-MULTI/S
magnetsnap_3 = MagnetSnap(Points=[geometry_list.Item6, geometry_list.Item3], Range=number_slider_2, Strength=Slider(4, range=0..10))

# ---- group: MAIN S-OFFICE /S
magnetsnap_4 = MagnetSnap(Points=[geometry_list.Item5, geometry_list.Item3], Range=range_for_strong_connection_2, Strength=Slider(24, range=0..50))

# ----
magnetsnap_5 = MagnetSnap(
    Points=[geometry_list.Item10, geometry_list.Item2],
    Range=range_for_strong_connection,
    Strength=Slider(1, range=-200..100))

# ---- group: OFFICE-TOILET/S
magnetsnap_6 = MagnetSnap(
    Points=[geometry_list.Item3, geometry_list.Item4],
    Range=range_for_strong_connection,
    Strength=strength_strong_connection_2)

# ---- group: POTTERY/FIRING/S
magnetsnap_7 = MagnetSnap(
    Points=[geometry_list.Item9, geometry_list.Item10],
    Range=range_for_strong_connection,
    Strength=strength_strong_connection_2)

# ---- group: LOBBY -EXH /S
magnetsnap_8 = MagnetSnap(Points=[geometry_list.Item, geometry_list.Item1], Range=range_for_strong_connection, Strength=strength_strong_connection)

# ---- group: STORAGE 2-WOOD/S
magnetsnap_9 = MagnetSnap(
    Points=[geometry_list.Item14, geometry_list.Item15, geometry_list.Item13],
    Range=range_for_strong_connection_2,
    Strength=number_slider)

# ---- group: LOBBY-OFFICE /S
magnetsnap_10 = MagnetSnap(Points=[geometry_list.Item, geometry_list.Item3], Range=range_for_strong_connection, Strength=strength_strong_connection)

# ---- group: CHILDCARE-MULTI /W
magnetsnap_11 = MagnetSnap(Points=[geometry_list.Item7, geometry_list.Item2], Range=0.5, Strength=strength_weak_connection)

# ---- group: EXH-CHILDCARE /W
magnetsnap_12 = MagnetSnap(Points=[geometry_list.Item2, geometry_list.Item1], Range=0.5, Strength=strength_weak_connection)

# ---- group: WOOD-CONSTRUCTION /W
magnetsnap_13 = MagnetSnap(Points=[geometry_list.Item12, geometry_list.Item13], Range=0.5, Strength=strength_weak_connection)

# ---- group: POTTERY-CONSTRUCTION /W
magnetsnap_14 = MagnetSnap(Points=[geometry_list.Item9, geometry_list.Item13], Range=0.5, Strength=strength_weak_connection)

# ----
relationships = Data([magnetsnap_10, magnetsnap_8, magnetsnap_14, magnetsnap_13, magnetsnap_12, magnetsnap_11, magnetsnap_6, magnetsnap_7, magnetsnap, magnetsnap_2, magnetsnap_4, magnetsnap_9, magnetsnap_3, magnetsnap_5])

# ----
# Attraction rooms to the courtyard
geometry_list_2 = ListItem(List=room_curves, Index=0, Wrap=True)  # -> Item, Item1, Item2, Item3, Item4, Item5, Item6, Item7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
main_courtyard = Curve(maincourtyard)
courtyard_2 = Curve(secondarycourtyard)

# ---- group: SLIGHT SECONDARY ATTRACTION
curve = Curve([geometry_list_2.Item14, geometry_list_2.Item11])
area_3 = Area(Geometry=curve)  # -> Area, Centroid
onplane = OnPlane(Points=area_3.Centroid, Plane=PlaneXY(0, 0, 0), Strength=10000)
oncurve = OnCurve(Points=area_3.Centroid, SPACES=courtyard_2, Strength=Slider(8, range=0..200))

# ---- group: SLIGHT MAIN ATTRACTION
curve_2 = Curve([geometry_list_2.Item4, geometry_list_2.Item6, geometry_list_2.Item11])
area_4 = Area(Geometry=curve_2)  # -> Area, Centroid
main_courtyard_2 = Curve(maincourtyard)
onplane_2 = OnPlane(Points=area_4.Centroid, Plane=PlaneXY(0, 0, 0), Strength=10000)
oncurve_2 = OnCurve(Points=area_4.Centroid, SPACES=main_courtyard_2, Strength=Slider(8, range=0..200))

# ---- group: MULTI&WEAV&PTT&FIR -- MAIN
main_courtyard_3 = Curve(maincourtyard)
curve_3 = Curve([geometry_list_2.Item7, geometry_list_2.Item9, geometry_list_2.Item10, geometry_list_2.Item8])
area_5 = Area(Geometry=curve_3)  # -> Area, Centroid
explode_3 = Explode(Curve=main_courtyard_3, Recursive=True)  # -> Segments, Vertices
onplane_3 = OnPlane(Points=area_5.Centroid, Plane=PlaneXY(0, 0, 0), Strength=10000)
oncurve_3 = OnCurve(Points=area_5.Centroid, SPACES=[main_courtyard_3, explode_3.Segments], Strength=Slider(40, range=0..200))  # -> flatten(P)

# ---- group: EXH&CHILD -- MAIN
curve_4 = Curve([geometry_list_2.Item2, geometry_list_2.Item1])
area_6 = Area(Geometry=curve_4)  # -> Area, Centroid
main_courtyard_4 = Curve(maincourtyard)
onplane_4 = OnPlane(Points=area_6.Centroid, Plane=PlaneXY(0, 0, 0), Strength=10000)
oncurve_4 = OnCurve(Points=area_6.Centroid, SPACES=main_courtyard_4, Strength=Slider(40, range=0..200))

# ---- group: WEAV&WOOD&CON&WOOD(2) -- CRT 2
curve_5 = Curve([geometry_list_2.Item12, geometry_list_2.Item13, geometry_list_2.Item15, geometry_list_2.Item8])
courtyard_2_2 = Curve(secondarycourtyard)
area_7 = Area(Geometry=curve_5)  # -> Area, Centroid
explode_4 = Explode(Curve=courtyard_2_2, Recursive=True)  # -> Segments, Vertices
onplane_5 = OnPlane(Points=area_7.Centroid, Plane=PlaneXY(0, 0, 0), Strength=10000)
oncurve_5 = OnCurve(Points=area_7.Centroid, SPACES=[explode_4.Segments, courtyard_2_2], Strength=Slider(55, range=0..200))  # -> flatten(P)

# ---- group: SLIGHT PUBLIC SQUARE ATTRACTION
curve_6 = Curve([geometry_list_2.Item6, geometry_list_2.Item1, geometry_list_2.Item2])
area_8 = Area(Geometry=curve_6)  # -> Area, Centroid
onplane_6 = OnPlane(Points=area_8.Centroid, Plane=PlaneXY(0, 0, 0), Strength=10000)

# ---- group: EXH&CHILD -- MAIN
curve_7 = Curve(geometry_list_2.Item1)
area_9 = Area(Geometry=curve_7)  # -> Area, Centroid
onplane_7 = OnPlane(Points=area_9.Centroid, Plane=PlaneXY(0, 0, 0), Strength=10000)

# ---- group: OFFICE -- PUBLIC
curve_8 = Curve(geometry_list_2.Item3)
area_10 = Area(Geometry=curve_8)  # -> Area, Centroid
onplane_8 = OnPlane(Points=area_10.Centroid, Plane=PlaneXY(0, 0, 0), Strength=10000)

# ---- group: LOBBY -- MAIN & CRT 2
curve_9 = Curve(geometry_list_2.Item)
area_11 = Area(Geometry=curve_9)  # -> Area, Centroid
main_courtyard_5 = Curve(maincourtyard)
onplane_9 = OnPlane(Points=area_11.Centroid, Plane=PlaneXY(0, 0, 0), Strength=10000)

# ----
# Prevent overlaping
# Do not place over the road!
number_slider_3 = Slider(20000, range=0..100000)
roads = Curve(<curve referenced from the Rhino model>)
shops = Curve([<curve referenced from the Rhino model> x2])

# ----
# Zombie Zangaroo
relationships_2 = Data(relationships)

# ----
# Optimizer: Wallacei
siteboundary_medium = Curve(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)
public_square = Curve(<curve referenced from the Rhino model>)

# ---- group: OFFICE -- PUBLIC (continued)
public_square_2 = Curve(public_square)
oncurve_6 = OnCurve(Points=area_10.Centroid, SPACES=[public_square_2, main_courtyard], Strength=Slider(100, range=0..500))  # -> flatten(P)

# ----
curvecollide = CurveCollide(
    Curves=flatten(room_curves),
    PassiveCurves=flatten([courtyard_2_2, main_courtyard_3, public_square_2, shops, roads]),
    BasePlane=PlaneXY(0, 0, 0),
    Strength=number_slider_3)  # -> Goal, Frames
preventoverlap = Data(curvecollide.Goal)

# ---- group: courtyard surfaces
boundary_surfaces = BoundarySurfaces(Edges=[maincourtyard, secondarycourtyard, public_square])  # -> flatten(Surfaces)

# ----
public_square_3 = Curve(public_square)
public_square_4 = Curve(public_square)
public_square_5 = Curve(public_square)

# ---- group: SLIGHT PUBLIC SQUARE ATTRACTION (continued)
oncurve_7 = OnCurve(Points=area_8.Centroid, SPACES=public_square_4, Strength=Slider(8, range=0..200))

# ---- group: EXH&CHILD -- MAIN (continued)
oncurve_8 = OnCurve(Points=area_9.Centroid, SPACES=public_square_3, Strength=Slider(10, range=0..200))

# ---- group: LOBBY -- MAIN & CRT 2 (continued)
oncurve_9 = OnCurve(Points=area_11.Centroid, SPACES=[main_courtyard_5, public_square_5], Strength=Slider(300, range=0..1000))  # -> flatten(P)

# ----
courtyardgoals = Data([onplane_7, oncurve_8, onplane_4, oncurve_4, onplane_8, oncurve_6, onplane_3, oncurve_3, onplane_5, oncurve_5, onplane_9, oncurve_9, oncurve_2, onplane_2, oncurve, onplane, oncurve_7, onplane_6])

preventoverlap_2 = Data(preventoverlap)
courtyardgoals_2 = Data(courtyardgoals)
zombiesolver = ZombieSolver(
    GoalObjects=flatten([preventoverlap_2, relationships_2, courtyardgoals_2]),
    Threshold=1e-10,
    Tolerance=1e-07,
    MaxIterations=3000)  # -> I, V, O
iterations = Number(zombiesolver.I)
clean_tree = CleanTree(RemoveNulls=True, RemoveInvalid=True, RemoveEmpty=False, Tree=zombiesolver.O)
spacepoints = Point(zombiesolver.V)
c_script = CSharpScript(x=clean_tree)  # -> out, A
# ---------- c_script: C# ----------
    A = x as Curve[];
# ---------- end c_script ----------
curve_10 = Curve(c_script.A)

# ---- group: fromKangaroo
finalcurves = Curve(curve_10)

# ---- group: room surfaces
boundary_surfaces_2 = BoundarySurfaces(Edges=curve_10)  # -> flatten(Surfaces)

# ----
explode_5 = Explode(Curve=finalcurves, Recursive=True)  # -> Segments, flatten(Vertices)
incurve = PointInCurve(Point=explode_5.Vertices, Curve=siteboundary_medium)  # -> Relationship, Point
larger = LargerThan(FirstNumber=incurve.Relationship, SecondNumber=1)  # -> LargerThan, OrEqualTo
cull = CullPattern(List=incurve.Relationship, CullPattern=larger.LargerThan)
lng = ListLength(List=cull)
one_over_x = OneOverX(Value=lng)
wlc_number_vertices_within_site_boundary = Number(flatten(one_over_x))
merge = Merge(Data1=boundary_surfaces_2, Data2=boundary_surfaces)
srf = Surface(merge)
wallacei_x = WallaceiX(
    Genes=[wlc_mainboolean, wlc_mainrotation, wlc_mainsize, wlc_mainxaxis, wlc_mainyaxis, wlc_secondaryrotation, wlc_secondarysize, wlc_secondaryxaxis, wlc_secondaryyaxis],
    Objectives=[wlc_dist_btwn_main_secondary, wlc_number_vertices_within_site_boundary],
    Phenotype=srf,
    allFitness="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",
    allFrontIdx="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",
    allGenomes="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",
    curFrontIdx="49|0;49|1;49|2;49|3;49|4;49|5;49|6;49|7;49|8;49|9;49|10;49|11;49|12;49|13;49|14;49|15;49|16;49|17;49|18;49|19;49|20;49|21;49|22;49|23;49|24",
    curFrontIdxSave="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",
    popGen="25,50",
    total="19450313",
    wlcDone=True)  # -> WallaceiGenomes, FitnessValues, Data, WPhenotypes
pdecoder = DecodePhenotype(WallaceiPhenotype=wallacei_x.WPhenotypes)  # -> GeometriesList, MeshesList, NumbersList, TextList

# ----
# Dynamic Kangaroo
# Change to 'True' to run the solver
boolean_toggle_2 = BooleanToggle(True)
data = Data([courtyardgoals_2, preventoverlap_2, relationships_2])
bouncysolver = BouncySolver(
    GoalObjects=flatten(data),
    Reset=Button(),
    Threshold=1e-07,
    Tolerance=0.01,
    Damping=0.6,
    Iterations=10,
    On=boolean_toggle_2)  # -> I, V, O
clean_tree_2 = CleanTree(RemoveNulls=True, RemoveInvalid=True, RemoveEmpty=False, Tree=bouncysolver.O)
spacepoints_2 = Point(bouncysolver.V)
c_script_2 = CSharpScript(x=clean_tree_2)  # -> out, A; same code as c_script
curve_11 = Curve(c_script_2.A)

# ---- group: ASSIGNING COLOURS
# Visualize and Color Code
# Assigning colours and text to the spaces
# The following excel file needs to
# be open when running the code :
# "Program of requirements _run3"
boolean_toggle_3 = BooleanToggle(True)
panel_6 = Panel("""8
9
10""")
excel_reader_legacy_2 = ExcelReaderLEGACY(ReadToggle=boolean_toggle_3, Worksheet=1, Column=panel_6, RowStart=3, RowEnd=19)  # -> Exceptions, ExcelData
explode_tree_2 = ExplodeTree(Data=excel_reader_legacy_2.ExcelData)  # -> Branch0, Branch1, Branch2
panel_7 = Panel(panel_2)
spaces = Panel(explode_tree_2.Branch0)
direction_of_spaces = Panel(explode_tree_2.Branch1)
length_of_spaces_modules = Panel(explode_tree_2.Branch2)
area_12 = Area(Geometry=curve_10)  # -> Area, flatten(Centroid)
colour_rgb = ColourRGB(Alpha=255, Red=spaces, Green=direction_of_spaces, Blue=length_of_spaces_modules)
secondarycourtyard_2 = Curve(secondarycourtyard)
text_tag = TextTag(Location=area_12.Centroid, Text=panel_7)
public_square_6 = Curve(public_square)
maincourtyard_2 = Curve(maincourtyard)
boundary_surfaces_3 = BoundarySurfaces(Edges=curve_10)
point_list = PointList(Points=area_12.Centroid, Size=2)
boundary_surfaces_4 = BoundarySurfaces(Edges=[maincourtyard_2, secondarycourtyard_2, public_square_6])
colour_rgb_2 = ColourRGB(
    Alpha=Slider(72, range=0..1000),
    Red=Slider(0, range=0..1000),
    Green=Slider(214, range=0..1000),
    Blue=Slider(0, range=0..1000))
custom_preview = CustomPreview(Geometry=boundary_surfaces_3, Material=colour_rgb)
custom_preview_2 = CustomPreview(Geometry=boundary_surfaces_4, Material=colour_rgb_2)
area_13 = Area(Geometry=curve_11)  # -> Area, flatten(Centroid)
boundary_surfaces_5 = BoundarySurfaces(Edges=curve_11)
custom_preview_3 = CustomPreview(Geometry=boundary_surfaces_5, Material=colour_rgb)
text_tag_2 = TextTag(Location=area_13.Centroid, Text=panel_7)
point_list_2 = PointList(Points=area_13.Centroid, Size=2)
