# Grasshopper definition DomesFinalShape.gh (Grasshopper 1.0.7)
# plug-ins: Pufferfish, Weaverbird, Kangaroo2 Components

button = Button()

# ---- group: Multipurpose hal Circular Dome 1
cir = Circle(Plane=Plane(origin=(215.917022, 200.0731971, 3.6), x=(0, 1, 0), y=(1, 0, 0)), Radius=4.2)
mesh = Mesh(cir)
wbloop = WeaverbirdsLoopSubdivision(MeshCurves=mesh, Level=1, SmoothNakedEdges=1)
mesh_2 = Mesh(wbloop)
nakedvertices = NakedVertices(Mesh=mesh_2)  # -> ClothedIndex, NakedIndex, ClothedPts, NakedPts
edgelengths = EdgeLengths(Mesh=mesh_2, LengthFactor=1, Strength=Slider(15, range=1..200))
anchor = Anchor(Point=nakedvertices.NakedPts, Strength="10000")
vertexloads = VertexLoads(Mesh=mesh_2, Strength=Slider(5, range=0.01..5))
show = Show(G=mesh_2)
solver = Solver(GoalObjects=[show, edgelengths, anchor, vertexloads], Reset=Button(), Threshold=1e-15, Tolerance=0.01, On=True)  # -> I, V, O
list_item = ListItem(List=solver.O, Index=0, Wrap=True)  # -> flatten(Item), Item1
split = SplitList(List=list_item.Item, Index=1)  # -> ListA, ListB
mesh_3 = Mesh(split.ListA)

# ---- group: Public Square Circular Dome 3
cir_2 = Circle(Plane=Plane(origin=(232.117022, 164.6731971, 7.2), x=(0, 1, 0), y=(-1, 0, 0)), Radius=4.8)
mesh_4 = Mesh(cir_2)
wbloop_2 = WeaverbirdsLoopSubdivision(MeshCurves=mesh_4, Level=1, SmoothNakedEdges=1)
mesh_5 = Mesh(wbloop_2)
nakedvertices_2 = NakedVertices(Mesh=mesh_5)  # -> ClothedIndex, NakedIndex, ClothedPts, NakedPts
edgelengths_2 = EdgeLengths(Mesh=mesh_5, LengthFactor=1, Strength=Slider(25, range=1..200))
anchor_2 = Anchor(Point=nakedvertices_2.NakedPts, Strength="10000")
vertexloads_2 = VertexLoads(Mesh=mesh_5, Strength=Slider(5, range=0.01..5))
show_2 = Show(G=mesh_5)
solver_2 = Solver(GoalObjects=[show_2, edgelengths_2, anchor_2, vertexloads_2], Reset=Button(), Threshold=1e-15, Tolerance=0.01, On=True)  # -> I, V, O
list_item_2 = ListItem(List=solver_2.O, Index=0, Wrap=True)  # -> flatten(Item), Item1
split_2 = SplitList(List=list_item_2.Item, Index=1)  # -> ListA, ListB
mesh_6 = Mesh(split_2.ListA)

# ---- group: Public Square Circular Dome 1
cir_3 = Circle(Plane=Plane(origin=(218.317022, 175.4731971, 7.2), x=(0, 1, 0), y=(-1, 0, 0)), Radius=3.6)
mesh_7 = Mesh(cir_3)
wbloop_3 = WeaverbirdsLoopSubdivision(MeshCurves=mesh_7, Level=1, SmoothNakedEdges=1)
mesh_8 = Mesh(wbloop_3)
nakedvertices_3 = NakedVertices(Mesh=mesh_8)  # -> ClothedIndex, NakedIndex, ClothedPts, NakedPts
edgelengths_3 = EdgeLengths(Mesh=mesh_8, LengthFactor=1, Strength=Slider(22, range=1..200))
anchor_3 = Anchor(Point=nakedvertices_3.NakedPts, Strength="10000")
vertexloads_3 = VertexLoads(Mesh=mesh_8, Strength=Slider(5, range=0.01..5))
show_3 = Show(G=mesh_8)
solver_3 = Solver(GoalObjects=[show_3, edgelengths_3, anchor_3, vertexloads_3], Reset=Button(), Threshold=1e-15, Tolerance=0.01, On=True)  # -> I, V, O
list_item_3 = ListItem(List=solver_3.O, Index=0, Wrap=True)  # -> flatten(Item), Item1
split_3 = SplitList(List=list_item_3.Item, Index=1)  # -> ListA, ListB
mesh_9 = Mesh(split_3.ListA)

# ---- group: Multipurpose hal Circular Dome 2
pt = Point(Point(215.917022, 203.6731971, 3))
pt_2 = Point(Point(215.917022, 195.8731971, 3))
move2pt = MoveToPoint(Geometry=mesh_3, PointA=pt, PointB=pt_2)  # -> Moved, Vector, Transform

# ---- group: Public Square Circular Dome 2
pt_3 = Point(Point(221.917022, 175.4731971, 7.2))
pt_4 = Point(Point(249.517022, 175.4731971, 7.2))
move2pt_2 = MoveToPoint(Geometry=mesh_9, PointA=pt_3, PointB=pt_4)  # -> Moved, Vector, Transform

# ----
wbedges = WeaverbirdsMeshEdges(MeshOrPolylines=[move2pt.Moved, mesh_3, move2pt_2.Moved, mesh_9, mesh_6])

# ---- group: Multipurpose hal Muqarnas Dome 1
list = ValueList({"Four": 4, "Eight": 8, "Twelve": 12}, selected="Eight")
polygon = Polygon(Plane=PlaneXY(215.917022, 200.0731971, 3), Radius=3.6, Segments=list, FilletRadius=0)  # -> Polygon, Length
curve = Curve(polygon.Polygon)
crv = Curve([<curve referenced from the Rhino model> x128])
wbweave = WeaverbirdsMeshFromLinesWeaveBack(Lines=crv, MaximumValence=4)
weaverbird_s_split_triangles_subdivision = WeaverbirdsSplitTrianglesSubdivision(MeshCurves=wbweave, Level=Slider(10, range=10..25))
mesh_10 = Mesh(weaverbird_s_split_triangles_subdivision)
nakedvertices_4 = NakedVertices(Mesh=mesh_10)  # -> ClothedIndex, NakedIndex, ClothedPts, NakedPts
edgelengths_4 = EdgeLengths(Mesh=mesh_10, LengthFactor=1, Strength=Slider(50, range=50..200))
vertexloads_4 = VertexLoads(Mesh=mesh_10, Strength=Slider(2.48, range=0..5))
show_4 = Show(G=mesh_10)
button_2 = Button()

# ---- group: maybe make it python
crv_2 = Curve([<curve referenced from the Rhino model> x16])
join = JoinCurves(Curves=crv_2, Preserve=False)
point_in_curve = PointInCurve(Point=nakedvertices_4.NakedPts, Curve=join)  # -> Relationship, Point
smaller_than = SmallerThan(FirstNumber=point_in_curve.Relationship, SecondNumber="1")  # -> SmallerThan, OrEqualTo
cull_pattern = CullPattern(List=nakedvertices_4.NakedPts, CullPattern=smaller_than.SmallerThan)
cull_pattern_2 = CullPattern(List=nakedvertices_4.NakedPts, CullPattern=smaller_than.OrEqualTo)
difference = SetDifference(SetA=cull_pattern_2, SetB=cull_pattern)
pt_5 = Point(difference)
anchor_4 = Anchor(Point=pt_5, Strength=Slider(10, range=0..50))

# ---- group: failed script
python = GhPythonScript(v=nakedvertices_4.NakedPts, guideCrv=join)  # -> out, a; inputs v: Point3d, guideCrv: Curve
# ---------- python: Python ----------
author = "pnourian"
version = "2020.08.21"

import rhinoscriptsyntax as rs
import Rhino.Geometry as rg
tolerance=10E-3
chosenVertices=[]
chosenIndices=[]

for i in range(v.Count):#vertex in v:
    vertex=v[i]
    #these are all the points coming from other script
    chosen=False
    for j in range(selectionCurves.Count):
        #insideInside=(selectionCurves[j].Contains(vertex, rg.Plane.WorldXY,tolerance)==rg.PointContainment.Inside)
        a = rg.Curve.ClosestPoint(selectionCurves[j],vertex,tolerance)
        print(a)
        if a[0]==False:
                continue
        else:
            chosenVertices.append(vertex)
            chosenIndices.append(i)
    #if chosen:
        #chosenVertices.append(vertex)
        #chosenIndices.append(i)
inBandVertices=chosenVertices
inBandIndices=chosenIndices
# ---------- end python ----------
python_2 = GhPythonScript(v=nakedvertices_4.NakedPts)  # -> outside, coinsident, inside
# ---------- python_2: Python ----------
__author__ = "barba"
__version__ = "2020.09.30"

import rhinoscriptsyntax as rs

outside=0
coincident=0
inside=0

for i in v:
    
    if i == '0':
        outside = outside+1
    if i == '1':
        coincident = coincident+1
    if i == '2':
        inside = inside+1
print (outside, coinsident, inside)
# ---------- end python_2 ----------

# ---- group: maybe make it python
crv_3 = Curve([<curve referenced from the Rhino model> x16])
join_2 = JoinCurves(Curves=crv_3, Preserve=False)
point_in_curve_2 = PointInCurve(Point=nakedvertices_4.NakedPts, Curve=join_2)  # -> Relationship, Point
smaller_than_2 = SmallerThan(FirstNumber=point_in_curve_2.Relationship, SecondNumber="1")  # -> SmallerThan, OrEqualTo
cull_pattern_3 = CullPattern(List=nakedvertices_4.NakedPts, CullPattern=smaller_than_2.SmallerThan)
cull_pattern_4 = CullPattern(List=nakedvertices_4.NakedPts, CullPattern=smaller_than_2.OrEqualTo)
difference_2 = SetDifference(SetA=cull_pattern_4, SetB=cull_pattern_3)
pt_6 = Point(difference_2)
anchor_5 = Anchor(Point=pt_6, Strength=Slider(4, range=0..50))

# ---- group: Multipurpose hal Muqarnas Dome 1 / maybe make it python
point_in_curve_3 = PointInCurve(Point=nakedvertices_4.NakedPts, Curve=curve)  # -> Relationship, Point
smaller_than_3 = SmallerThan(FirstNumber=point_in_curve_3.Relationship, SecondNumber="1")  # -> SmallerThan, OrEqualTo
cull_pattern_5 = CullPattern(List=nakedvertices_4.NakedPts, CullPattern=smaller_than_3.OrEqualTo)

# ---- group: Multipurpose hal Muqarnas Dome 1 (continued)
anchor_6 = Anchor(Point=cull_pattern_5, Strength="10000")
solver_4 = Solver(
    GoalObjects=[show_4, edgelengths_4, anchor_6, vertexloads_4, anchor_4, anchor_5],
    Reset=button,
    Threshold=1e-15,
    Tolerance=0.01,
    On=True)  # -> I, V, O
list_item_4 = ListItem(List=solver_4.O, Index=0, Wrap=True)  # -> flatten(Item), Item1
split_4 = SplitList(List=list_item_4.Item, Index=1)  # -> ListA, ListB
mesh_11 = Mesh(split_4.ListA)

# ---- group: Multipurpose hal Muqarnas Dome 2
pt_7 = Point(Point(215.917022, 196.4731971, 3))
pt_8 = Point(Point(215.917022, 188.6731971, 3))
move2pt_3 = MoveToPoint(Geometry=mesh_11, PointA=pt_7, PointB=pt_8)  # -> Moved, Vector, Transform

# ----
wbedges_2 = WeaverbirdsMeshEdges(MeshOrPolylines=[move2pt_3.Moved, mesh_11])

# ---- group: Public Square Muqarnas Dome 1
list_2 = ValueList({"Four": 4, "Eight": 8, "Twelve": 12}, selected="Eight")
polygon_2 = Polygon(
    Plane=Plane(origin=(232.117022, 164.6731971, 7.2), x=(0, -1, 0), y=(-1, 0, 0)),
    Radius=4.2,
    Segments=list_2,
    FilletRadius=0)  # -> Polygon, Length
curve_2 = Curve(polygon_2.Polygon)
crv_4 = Curve([<curve referenced from the Rhino model> x128])
wbweave_2 = WeaverbirdsMeshFromLinesWeaveBack(Lines=crv_4, MaximumValence=4)
weaverbird_s_split_triangles_subdivision_2 = WeaverbirdsSplitTrianglesSubdivision(MeshCurves=wbweave_2, Level=Slider(10, range=10..25))
mesh_12 = Mesh(weaverbird_s_split_triangles_subdivision_2)
nakedvertices_5 = NakedVertices(Mesh=mesh_12)  # -> ClothedIndex, NakedIndex, ClothedPts, NakedPts
edgelengths_5 = EdgeLengths(Mesh=mesh_12, LengthFactor=1, Strength=Slider(102, range=50..200))
vertexloads_5 = VertexLoads(Mesh=mesh_12, Strength=Slider(4.18, range=0..5))
show_5 = Show(G=mesh_12)
button_3 = Button()

# ---- group: maybe make it python
crv_5 = Curve([<curve referenced from the Rhino model> x16])
join_3 = JoinCurves(Curves=crv_5, Preserve=False)
point_in_curve_4 = PointInCurve(Point=nakedvertices_5.NakedPts, Curve=join_3)  # -> Relationship, Point
smaller_than_4 = SmallerThan(FirstNumber=point_in_curve_4.Relationship, SecondNumber="1")  # -> SmallerThan, OrEqualTo
cull_pattern_6 = CullPattern(List=nakedvertices_5.NakedPts, CullPattern=smaller_than_4.SmallerThan)
cull_pattern_7 = CullPattern(List=nakedvertices_5.NakedPts, CullPattern=smaller_than_4.OrEqualTo)
difference_3 = SetDifference(SetA=cull_pattern_7, SetB=cull_pattern_6)
pt_9 = Point(difference_3)
anchor_7 = Anchor(Point=pt_9, Strength=Slider(17, range=0..50))

crv_6 = Curve([<curve referenced from the Rhino model> x16])
join_4 = JoinCurves(Curves=crv_6, Preserve=False)
point_in_curve_5 = PointInCurve(Point=nakedvertices_5.NakedPts, Curve=join_4)  # -> Relationship, Point
smaller_than_5 = SmallerThan(FirstNumber=point_in_curve_5.Relationship, SecondNumber="1")  # -> SmallerThan, OrEqualTo
cull_pattern_8 = CullPattern(List=nakedvertices_5.NakedPts, CullPattern=smaller_than_5.SmallerThan)
cull_pattern_9 = CullPattern(List=nakedvertices_5.NakedPts, CullPattern=smaller_than_5.OrEqualTo)
difference_4 = SetDifference(SetA=cull_pattern_9, SetB=cull_pattern_8)
pt_10 = Point(difference_4)
anchor_8 = Anchor(Point=pt_10, Strength=Slider(10, range=0..50))

# ---- group: Public Square Muqarnas Dome 1 / maybe make it python
point_in_curve_6 = PointInCurve(Point=nakedvertices_5.NakedPts, Curve=curve_2)  # -> Relationship, Point
smaller_than_6 = SmallerThan(FirstNumber=point_in_curve_6.Relationship, SecondNumber="1")  # -> SmallerThan, OrEqualTo
cull_pattern_10 = CullPattern(List=nakedvertices_5.NakedPts, CullPattern=smaller_than_6.OrEqualTo)

# ---- group: Public Square Muqarnas Dome 1 (continued)
anchor_9 = Anchor(Point=cull_pattern_10, Strength="10000")
solver_5 = Solver(
    GoalObjects=[show_5, edgelengths_5, anchor_9, vertexloads_5, anchor_7, anchor_8],
    Reset=button,
    Threshold=1e-15,
    Tolerance=0.01,
    On=True)  # -> I, V, O
list_item_5 = ListItem(List=solver_5.O, Index=0, Wrap=True)  # -> flatten(Item), Item1
split_5 = SplitList(List=list_item_5.Item, Index=1)  # -> ListA, ListB
mesh_13 = Mesh(split_5.ListA)

list_3 = ValueList({"Four": 4, "Eight": 8, "Twelve": 12}, selected="Eight")
polygon_3 = Polygon(Plane=Plane(origin=(218.317022, 175.4731971, 7.2), x=(-1, 0, 0), y=(0, 1, 0)), Radius=3, Segments=list_3, FilletRadius=0)  # -> Polygon, Length
curve_3 = Curve(polygon_3.Polygon)
crv_7 = Curve([<curve referenced from the Rhino model> x128])
wbweave_3 = WeaverbirdsMeshFromLinesWeaveBack(Lines=crv_7, MaximumValence=4)
weaverbird_s_split_triangles_subdivision_3 = WeaverbirdsSplitTrianglesSubdivision(MeshCurves=wbweave_3, Level=Slider(10, range=10..25))
mesh_14 = Mesh(weaverbird_s_split_triangles_subdivision_3)
nakedvertices_6 = NakedVertices(Mesh=mesh_14)  # -> ClothedIndex, NakedIndex, ClothedPts, NakedPts
edgelengths_6 = EdgeLengths(Mesh=mesh_14, LengthFactor=1, Strength=Slider(102, range=50..200))
vertexloads_6 = VertexLoads(Mesh=mesh_14, Strength=Slider(4.18, range=0..5))
show_6 = Show(G=mesh_14)
button_4 = Button()

# ---- group: maybe make it python
crv_8 = Curve([<curve referenced from the Rhino model> x16])
join_5 = JoinCurves(Curves=crv_8, Preserve=False)
point_in_curve_7 = PointInCurve(Point=nakedvertices_6.NakedPts, Curve=join_5)  # -> Relationship, Point
smaller_than_7 = SmallerThan(FirstNumber=point_in_curve_7.Relationship, SecondNumber="1")  # -> SmallerThan, OrEqualTo
cull_pattern_11 = CullPattern(List=nakedvertices_6.NakedPts, CullPattern=smaller_than_7.SmallerThan)
cull_pattern_12 = CullPattern(List=nakedvertices_6.NakedPts, CullPattern=smaller_than_7.OrEqualTo)
difference_5 = SetDifference(SetA=cull_pattern_12, SetB=cull_pattern_11)
pt_11 = Point(difference_5)
anchor_10 = Anchor(Point=pt_11, Strength=Slider(17, range=0..50))

crv_9 = Curve([<curve referenced from the Rhino model> x16])
join_6 = JoinCurves(Curves=crv_9, Preserve=False)
point_in_curve_8 = PointInCurve(Point=nakedvertices_6.NakedPts, Curve=join_6)  # -> Relationship, Point
smaller_than_8 = SmallerThan(FirstNumber=point_in_curve_8.Relationship, SecondNumber="1")  # -> SmallerThan, OrEqualTo
cull_pattern_13 = CullPattern(List=nakedvertices_6.NakedPts, CullPattern=smaller_than_8.SmallerThan)
cull_pattern_14 = CullPattern(List=nakedvertices_6.NakedPts, CullPattern=smaller_than_8.OrEqualTo)
difference_6 = SetDifference(SetA=cull_pattern_14, SetB=cull_pattern_13)
pt_12 = Point(difference_6)
anchor_11 = Anchor(Point=pt_12, Strength=Slider(10, range=0..50))

# ---- group: Public Square Muqarnas Dome 1 / maybe make it python
point_in_curve_9 = PointInCurve(Point=nakedvertices_6.NakedPts, Curve=curve_3)  # -> Relationship, Point
smaller_than_9 = SmallerThan(FirstNumber=point_in_curve_9.Relationship, SecondNumber="1")  # -> SmallerThan, OrEqualTo
cull_pattern_15 = CullPattern(List=nakedvertices_6.NakedPts, CullPattern=smaller_than_9.OrEqualTo)

# ---- group: Public Square Muqarnas Dome 1 (continued)
anchor_12 = Anchor(Point=cull_pattern_15, Strength="10000")
solver_6 = Solver(
    GoalObjects=[show_6, edgelengths_6, anchor_12, vertexloads_6, anchor_10, anchor_11],
    Reset=button,
    Threshold=1e-15,
    Tolerance=0.01,
    On=True)  # -> I, V, O
list_item_6 = ListItem(List=solver_6.O, Index=0, Wrap=True)  # -> flatten(Item), Item1
split_6 = SplitList(List=list_item_6.Item, Index=1)  # -> ListA, ListB
mesh_15 = Mesh(split_6.ListA)

# ---- group: Public Square Muqarnas Dome 2
pt_13 = Point(Point(221.917022, 175.4731971, 7.2))
pt_14 = Point(Point(249.517022, 175.4731971, 7.2))
move2pt_4 = MoveToPoint(Geometry=mesh_15, PointA=pt_13, PointB=pt_14)  # -> Moved, Vector, Transform

# ----
wbedges_3 = WeaverbirdsMeshEdges(MeshOrPolylines=[mesh_13, move2pt_4.Moved, mesh_15])
