# Grasshopper definition doubleStory.gh (Grasshopper 0.9.76)
# plug-ins: Python Interpreter, Weaverbird, GH_CPython, Kangaroo2 Components

officerectangle = Curve(<curve referenced from the Rhino model>)
kitchenrectangle = Curve(<curve referenced from the Rhino model>)
toilets_01_rectangle = Curve(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)
officewalls_polyline = Curve(<curve referenced from the Rhino model>)
toilets_01_polyline = Curve([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])
kitchenwalls_polyline = Curve([<curve referenced from the Rhino model> x3])
toilet_02_rectangle = Curve(<curve referenced from the Rhino model>)
mainstoragerectangle = Curve(<curve referenced from the Rhino model>)
mainstoragewalls_polyline = Curve(<curve referenced from the Rhino model>)
toilet_02_polyline = Curve([<curve referenced from the Rhino model> x3])
childcare_01_rectangle = Curve(<curve referenced from the Rhino model>)
childcare_02__rectangle = Curve(<curve referenced from the Rhino model>)
library_rectangle = Curve(<curve referenced from the Rhino model>)
lobby = Curve([<curve referenced from the Rhino model> x21])
library_polyline = Curve([<curve referenced from the Rhino model> x4])
childcar_02_polyline = Curve([<curve referenced from the Rhino model> x3])
childcare_02_walls_polyline = Curve([<curve referenced from the Rhino model> x2])
finaltesselation = Curve([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])
conference_01_rectangle = Curve(<curve referenced from the Rhino model>)
lobby_anchors = Curve([<curve referenced from the Rhino model> x2])
conference_01_polyline = Curve([<curve referenced from the Rhino model> x5])
final_wallboundaries = Curve([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])
alaghabani_rectangle = Curve(<curve referenced from the Rhino model>)
alaghabaniwalls_polyline = Curve([<curve referenced from the Rhino model> x5])

# ----
# Second Floor : Long Vault Option
number_slider = Slider(0, range=0..100)
wbweave = WeaverbirdsMeshFromLinesWeaveBack(Lines=finaltesselation, MaximumValence=4)
wbsplitquads = WeaverbirdsConstantQuadsSplitSubdivision(MeshCurves=wbweave, Level=Slider(3, range=0..10), SmoothNakedEdges=number_slider)
wbedges = WeaverbirdsMeshEdges(MeshOrPolylines=wbsplitquads)
mesh = Mesh(wbsplitquads)
border = GhPythonScript(M=mesh)  # -> out, a; inputs M: Mesh
# ---------- border: Python ----------
borders=M.GetNakedEdges()
CurveBorders=[]
for border in borders:
    CurveBorders.append(border.ToNurbsCurve())
a=CurveBorders
# ---------- end border ----------
mesh_input = GhPythonScript(M=mesh)  # -> out, v, e, f; inputs M: Mesh
# ---------- mesh_input: Python ----------
__author__ = "pnourian"
__version__ = "2020.08.21"

import rhinoscriptsyntax as rs
import Rhino.Geometry as rg
import math
#####################################
#input validation: weldedness, manifoldness, cleanness
#####################################
if not M.IsManifold(True):
    raise Exception("the input mesh is non-mannifold and this method is not designed to work with non-manifold meshes!")
M.Weld(math.pi)
M.Vertices.CombineIdentical(True,True)
M.Vertices.CullUnused()
if not M.Vertices.Count==M.TopologyVertices.Count:
    raise Exception("the input mesh must be completely welded; although we tried our best, the given mesh seems to have a problem not allowing it to be fully welded!")
#####################################
#exporting vertices as a list of rg.Point3f
#####################################
v=M.Vertices.ToPoint3fArray()
#####################################
#exporting edges as a list of tuples
#####################################
edges=[]
for edgeIndex in range(M.TopologyEdges.Count):
    IJ=M.TopologyEdges.GetTopologyVertices(edgeIndex)
    edges.append((IJ.I,IJ.J))
e=edges
#####################################
#exporting faces as a list of tuples
#####################################
faces=[]
if M.Faces.QuadCount==M.Faces.Count:
    print("a fully quadrilateral mesh")
    for face in M.Faces:
        faces.append((face.A,face.B,face.C,face.D))
elif M.Faces.TriangleCount==M.Faces.Count:
    print("a fully triangular mesh")
    for face in M.Faces:
        faces.append((face.A,face.B,face.C))
else:
    raise Exception("this method only works for meshes that are either fully quadrilateral or fully triangular!")

f=faces
# ---------- end mesh_input ----------
crv = Curve(border.a)
P = Point(mesh_input.v)
python = GhPythonScript(v=mesh_input.v, guideCrv=crv)  # -> out, Indices, Vertices; inputs v: list of Point3d, guideCrv: Curve
# ---------- python: Python ----------
__author__ = "pnourian"
__version__ = "2020.08.21"

import rhinoscriptsyntax as rs
#import clr
#import System
import Rhino.Geometry as rg
maxDistance=10E6
minDistance=10E-6
CloseVertices=[]
CloseIndices=[]
for i in range(v.Count):
    vertex=v[i]
    #t=clr.References[System.Double]()#https://developer.rhino3d.com/guides/rhinopython/python-reference/
    CP=guideCrv.ClosestPoint(vertex,maxDistance)
    #print(CP) how to deal with 'out' (output) parameters and 'ref'(by reference) parameters: IronPython will return the output of such methods as tuples including these parameters! Note that we skipped the argument t in the signature of the function altogether!
    closestPoint=guideCrv.PointAt(CP[1])
    distance=closestPoint.DistanceTo(vertex)
    if distance<minDistance:
        CloseIndices.append(i)
        CloseVertices.append(vertex)
Indices=CloseIndices
Vertices=CloseVertices
# ---------- end python ----------
points_in_a_band = GhPythonScript(v=P, selectionCurves=final_wallboundaries)  # -> out, inBandVertices, inBandIndices; inputs v: list of Point3d, selectionCurves: list of Curve
# ---------- points_in_a_band: Python ----------
__author__ = "pnourian"
__version__ = "2020.08.21"

import rhinoscriptsyntax as rs
import Rhino.Geometry as rg
tolerance=10E-3
chosenVertices=[]
chosenIndices=[]

for i in range(v.Count):#vertex in v:
    vertex=v[i]
    #these are all the points coming from other script
    chosen=False
    for j in range(selectionCurves.Count):
        #insideInside=(selectionCurves[j].Contains(vertex, rg.Plane.WorldXY,tolerance)==rg.PointContainment.Inside)
        a = rg.Curve.ClosestPoint(selectionCurves[j],vertex,tolerance)
        print(a)
        if a[0]==False:
                continue
        else:
            chosenVertices.append(vertex)
            chosenIndices.append(i)
    #if chosen:
        #chosenVertices.append(vertex)
        #chosenIndices.append(i)
inBandVertices=chosenVertices
inBandIndices=chosenIndices
# ---------- end points_in_a_band ----------
pt = Point(points_in_a_band.inBandVertices)
mesh_2 = Mesh(mesh)
toggle = BooleanToggle(False)  # disabled
button = Button()  # disabled
number_slider_2 = Slider(0.9, range=0..1)  # disabled
number_slider_3 = Slider(25, range=0..100)  # disabled
number_slider_4 = Slider(15, range=0..100)  # disabled
number_slider_5 = Slider(0.08, range=0..1)  # disabled
number_slider_6 = Slider(150, range=0..1000)  # disabled
number_slider_7 = Slider(2, range=0..10)  # disabled
edgelengths = EdgeLengths(Mesh=mesh_2, LengthFactor=Slider(0.28, range=0..1), Strength=Slider(1, range=0..10))
anchor = Anchor(Point=pt, Strength=10000)
vertexloads = VertexLoads(Mesh=mesh_2, Strength=Slider(0.1, range=0..0.1))
show = Show(G=mesh_2)
dynamicrelaxation_cpython = GH_CPython(
    input=button,
    v=mesh_input.v,
    e=mesh_input.e,
    f=mesh_input.f,
    justRelax=toggle,
    contraction=number_slider_2,
    fixed=points_in_a_band.inBandIndices,
    damp=number_slider_3,
    IterCount=number_slider_6,
    Elasticity=number_slider_4,
    timeInterval=number_slider_5,
    vertexMass=number_slider_7)  # -> output, a, b, c, X, Y, Z; inputs input: list, v: list, e: list, f: list, justRelax: list, externalLoad: list, contraction: list, fixed: list, damp: list, IterCount: list, Elasticity: list, timeInterval: list, vertexMass: list; disabled
#   port input: [required] - [type = int] - [default = None] Descripe your input here * bullet point. * bullet point
#   port output: indicate your output description here. refers to a new line.
# ---------- dynamicrelaxation_cpython: Python ----------
########################
#Dynamic Relaxation, by Pirouz Nourian & Shervin Azadi, last edited on 22-08-2020
#Licence and citation information on https://zenodo.org/record/3459223#.X0FG58gzZPY
########################
# Dynamic relaxation
### Input data:
# vertices: a list of unique xyz coordinates
# edges: a list of pairs of vertex indices
# points: index list of fixed vertices
### Output data:
# xyzFS : Final state of the system
import numpy as np
verts=np.array(v)
edges=np.array(e)
faces=np.array(f)# unused for the moment, however in principle faces as 2D elements can ave elasticity as well. Right now, weare simiulating this mesh as a fishnet, as if it doesn't have faces!
#####################
#advanced setting parameters
#####################
c = damp# adamp : Acceleration damp controls the stability of the system
MaximumIterations = IterCount
k = Elasticity# K : Elasticity Constant in Hooke's law
dt = timeInterval# dt : Time intervals
m = vertexMass

vertexCount = len(verts)
edgeCount = len(edges)
freeIndices = list(set(range(vertexCount)) - set(fixed))#indices of free points
xyz = np.copy(verts)
p=np.zeros((vertexCount, 3), dtype=np.float64)
p=np.array(externalLoad)

if externalLoad==None and not justRelax:
    p=np.tile(np.multiply(m,np.array([0,0,9.81])),(vertexCount,1))
elif justRelax:
    p=np.zeros((vertexCount, 3), dtype=np.float64)
if((not p.shape[0]==vertexCount)):
    raise Exception('the length of the list of external loads is not the same as the list of vertices!')

# v : Velosity
v = np.zeros((vertexCount, 3), dtype=np.float64)
# restlength : Rest Length of the springs
edgeVectors = xyz[edges[:,1]] - xyz[edges[:,0]]#np.array([(xyz[edges[i][1]] - xyz[edges[i][0]]) for i in range(edgeCount)])
restlength = np.linalg.norm(edgeVectors,axis=1,keepdims=True)#np.array([np.sqrt(diff[i,0]*diff[i,0] + diff[i,1]*diff[i,1] + diff[i,2]*diff[i,2]) for i in range(edgeCount)])
if(justRelax):
    restlength=np.multiply(contraction,restlength)
###################
#the main loop, must be changed to a while loop but for now this is ok
###################
#xyz0 = xyz.copy()# xyz0 : Initial Position
differance=1
tolerance=10E-3
t=0
while((differance>tolerance)and t<=MaximumIterations):#for t in range(MaximumIterations):

    R = np.zeros((vertexCount, 3), dtype=np.float64)# R : Final Forces
    vp = v.copy()# vp : Initial Velocity
    xyz0 = xyz.copy()#previous positions

    edgeVectors_t = xyz[edges[:,1]] - xyz[edges[:,0]]
    edgeLengths_t = (np.linalg.norm(edgeVectors_t,axis=1,keepdims=True))
    EdgeForce = ((edgeLengths_t - restlength) * k)#.reshape((edgeCount,1))# f_{i,j} at the iteration time t, note that this is only the magnitude of these forces, i.e. |f_{i,j}=k\Delta l|  
    EdgeForceVectors = np.multiply(EdgeForce,np.divide(edgeVectors_t,edgeLengths_t))#EdgeForce*(edgeVectors_t/edgeLengths_t)
    
    graph_force = np.zeros((vertexCount,vertexCount, 3))
    graph_force[edges[:,0],edges[:,1]] += EdgeForceVectors

    # S : Sum of Stiffness Force on vertices
    S = np.sum(graph_force, axis=0) - np.sum(graph_force, axis=1)
    R[freeIndices] = p[freeIndices] - S[freeIndices]
    
    A = 1/(1 + c * dt * 0.5)
    B = (1 - c * dt * 0.5 ) / (1 + c * dt * 0.5)
    v[freeIndices] = A * dt * R[freeIndices] / m + B * vp[freeIndices]# updating the velocity
    xyz[freeIndices] = xyz0[freeIndices] + dt * v[freeIndices]# updating the position
    differance=np.linalg.norm(xyz-xyz0,'fro')

    t+=1

print(t)
print(differance)

X=xyz[:,0].tolist()
Y=xyz[:,1].tolist()
Z=xyz[:,2].tolist()
# ---------- end dynamicrelaxation_cpython ----------
pt_2 = ConstructPoint(
    XCoordinate=dynamicrelaxation_cpython.X,
    YCoordinate=dynamicrelaxation_cpython.Y,
    ZCoordinate=dynamicrelaxation_cpython.Z)  # disabled
solver = Solver(GoalObjects=[edgelengths, anchor, vertexloads, show], Reset=Button(), Threshold=1e-15, Tolerance=0.01, On=Toggle(True))  # -> I, V, O
reconstructmesh = GhPythonScript(v=pt_2, f=mesh_input.f)  # -> out, a; inputs v: list of Point3d, f: list; disabled
# ---------- reconstructmesh: Python ----------
__author__ = "pnourian"
__version__ = "2020.08.21"

import Rhino.Geometry as rg
import System
m=rg.Mesh()
for faceTuple in f:
    if len(faceTuple)==4:
        m.Faces.AddFace(faceTuple[0],faceTuple[1],faceTuple[2],faceTuple[3])
    elif len(faceTuple)==3:
        m.Faces.AddFace(faceTuple[0],faceTuple[1],faceTuple[2])
IEV=System.Array[rg.Point3d](v)
m.Vertices.AddVertices(IEV)
a=m
# ---------- end reconstructmesh ----------
wbcatmullclark = WeaverbirdsCatmullClarkSubdivision(MeshCurves=reconstructmesh.a, Level=3, SmoothNakedEdges=0)  # disabled
branch = TreeBranch(Tree=simplify(solver.O), Path=Slider(0, range=0..100), MaintainPaths=True)
secondfloor_large_mesh = Mesh(branch)

points_in_a_band_2 = GhPythonScript()  # -> out, inBandVertices, inBandIndices; inputs v: list of Point3d, selectionCurves: list of Curve; disabled; same code as points_in_a_band

# ---- group: on hold
number_slider_8 = Slider(5, range=0..10)  # disabled
weightload = WeightLoad(mass=number_slider_8)  # disabled
# elasticity is too high
# 
# different elasicty for diff
# 
# manipulate rest lenghth - multiply by certain number so can go higher
# 
# accommodate within tesselation for opening.
# 
# present this way so you can see everthing.
# 
# show: relaxed version on the ground
# 
# uniform method.
# 
# also show failures.
external_load = Data(weightload)  # disabled

# ----
# Lobby : Free form
number_slider_9 = Slider(0, range=0..100)
wbweave_2 = WeaverbirdsMeshFromLinesWeaveBack(Lines=lobby, MaximumValence=4)
wbsplitquads_2 = WeaverbirdsConstantQuadsSplitSubdivision(MeshCurves=wbweave_2, Level=Slider(3, range=0..10), SmoothNakedEdges=number_slider_9)
wbedges_2 = WeaverbirdsMeshEdges(MeshOrPolylines=wbsplitquads_2)
mesh_3 = Mesh(wbsplitquads_2)
border_2 = GhPythonScript(M=mesh_3)  # -> out, a; inputs M: Mesh; same code as border
mesh_input_2 = GhPythonScript(M=mesh_3)  # -> out, v, e, f; inputs M: Mesh; same code as mesh_input
crv_2 = Curve(border_2.a)
P_2 = Point(mesh_input_2.v)
python_2 = GhPythonScript(v=mesh_input_2.v, guideCrv=crv_2)  # -> out, Indices, Vertices; inputs v: list of Point3d, guideCrv: Curve; same code as python
points_in_a_band_3 = GhPythonScript(v=P_2, selectionCurves=lobby_anchors)  # -> out, inBandVertices, inBandIndices; inputs v: list of Point3d, selectionCurves: list of Curve; same code as points_in_a_band
pt_3 = Point(points_in_a_band_3.inBandVertices)
mesh_4 = Mesh(mesh_3)
edgelengths_2 = EdgeLengths(Mesh=mesh_4, LengthFactor=Slider(0.18, range=0..1), Strength=Slider(2, range=0..10))
anchor_2 = Anchor(Point=pt_3, Strength=10000)
vertexloads_2 = VertexLoads(Mesh=mesh_4, Strength=Slider(0.1, range=0..0.1))
show_2 = Show(G=mesh_4)
solver_2 = Solver(
    GoalObjects=[edgelengths_2, anchor_2, vertexloads_2, show_2],
    Reset=Button(),
    Threshold=1e-15,
    Tolerance=0.01,
    On=Toggle(True))  # -> I, V, O
branch_2 = TreeBranch(Tree=simplify(solver_2.O), Path=Slider(0, range=0..100), MaintainPaths=True)
mesh_5 = Mesh(branch_2)
wbedges_3 = WeaverbirdsMeshEdges(MeshOrPolylines=mesh_5)

# ---- group: Vector to Move Linework for Second Floor into Place
stair_anchor_point_second = Point(<point referenced from the Rhino model>)
stair_anchor_point_first = Point(<point referenced from the Rhino model>)
vec2pt = Vector2Pt(PointA=stair_anchor_point_second, PointB=stair_anchor_point_first, Unitize=False)  # -> Vector, Length

# ----
# Final Meshes Merged
secondfloor_large_mesh_2 = Mesh(secondfloor_large_mesh)

linework_vector = Vector(vec2pt.Vector)

# ---- group: Tessellation Iterations & Moving lines to Correct Location
linework_vector_2 = Vector(linework_vector)
tessellation_04 = Curve([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])
tessellation_01 = Curve([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])
tessellation_02 = Curve([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])
tessellation_03 = Curve([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])
tessellation_05 = Curve([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])
tessellation_06 = Curve([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])
tessellation_07 = Curve([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])
tessellation_08 = Curve([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])
tessellation_09 = Curve([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])
firstflooropenings = Curve([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])
firstfloorrectangle = Curve([<curve referenced from the Rhino model> x7])
tessellation_01_walls = Curve([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])
tessellation_new_walls = Curve([<curve referenced from the Rhino model> x9])
move = Move(Geometry=tessellation_05, Motion=linework_vector_2)  # -> Geometry, Transform
move_2 = Move(Motion=linework_vector_2)  # -> Geometry, Transform
move_3 = Move(Geometry=tessellation_01_walls, Motion=linework_vector_2)  # -> Geometry, Transform
move_4 = Move(Geometry=move_3.Geometry, Motion=linework_vector_2)  # -> Geometry, Transform
move_5 = Move(Geometry=tessellation_09, Motion=linework_vector_2)  # -> Geometry, Transform
move_6 = Move(Geometry=tessellation_new_walls, Motion=linework_vector_2)  # -> Geometry, Transform

# ----
move_7 = Move(Geometry=secondfloor_large_mesh_2, Motion=vec2pt.Vector)  # -> Geometry, Transform

# ----
# Office: Nubian Vault
officerectangle_2 = Curve(officerectangle)
boundary = BoundarySurfaces(Edges=officerectangle_2)
officewalls_polyline_2 = Curve(officewalls_polyline)

# ---- group: test_data : simple mesh
storekitchenlobby_surface = Surface(boundary)
smooth = SettingsQuality()
mesh_6 = MeshBrep(Brep=storekitchenlobby_surface, Settings=smooth)
mesh_uv = MeshSurface(
    Surface=storekitchenlobby_surface,
    UCount=Slider(20, range=0..100),
    VCount=Slider(12, range=0..100),
    Overhang=True,
    Equalize=False)
medges = MeshEdges(Mesh=mesh_6)  # -> NakedEdges, InteriorEdges, NonManifoldEdges

# ----
mesh_7 = Mesh(mesh_uv)
border_3 = GhPythonScript(M=mesh_7)  # -> out, a; inputs M: Mesh; same code as border
mesh_input_3 = GhPythonScript(M=mesh_7)  # -> out, v, e, f; inputs M: Mesh; same code as mesh_input
crv_3 = Curve(border_3.a)
P_3 = Point(mesh_input_3.v)
python_3 = GhPythonScript(v=mesh_input_3.v, guideCrv=crv_3)  # -> out, Indices, Vertices; inputs v: list of Point3d, guideCrv: Curve; same code as python
points_on_a_line = GhPythonScript(v=P_3, selectionCurves=officewalls_polyline_2)  # -> out, inBandVertices, inBandIndices; inputs v: list of Point3d, selectionCurves: list of Curve; same code as points_in_a_band
dynamicrelaxation_cpython_2 = GH_CPython(
    input=Button(),
    v=mesh_input_3.v,
    e=mesh_input_3.e,
    f=mesh_input_3.f,
    justRelax=Toggle(False),
    contraction=Slider(0.2, range=0..1),
    fixed=points_on_a_line.inBandIndices,
    damp=Slider(10, range=0..100),
    IterCount=Slider(90, range=0..1000),
    Elasticity=Slider(80, range=0..100),
    timeInterval=Slider(0.02, range=0..1),
    vertexMass=Slider(1, range=0..10),
    adj_restlength=Slider(0.35, range=0..1))  # -> output, a, b, c, X, Y, Z; inputs input: list, v: list, e: list, f: list, justRelax: list, externalLoad: list, contraction: list, fixed: list, damp: list, IterCount: list, Elasticity: list, timeInterval: list, vertexMass: list, adj_restlength: list
#   port input: [required] - [type = int] - [default = None] Descripe your input here * bullet point. * bullet point
#   port output: indicate your output description here. refers to a new line.
# ---------- dynamicrelaxation_cpython_2: Python ----------
########################
#Dynamic Relaxation, by Pirouz Nourian & Shervin Azadi, last edited on 22-08-2020
#Licence and citation information on https://zenodo.org/record/3459223#.X0FG58gzZPY
########################
# Dynamic relaxation
### Input data:
# vertices: a list of unique xyz coordinates
# edges: a list of pairs of vertex indices
# points: index list of fixed vertices
### Output data:
# xyzFS : Final state of the system
import numpy as np
verts=np.array(v)
edges=np.array(e)
faces=np.array(f)# unused for the moment, however in principle faces as 2D elements can ave elasticity as well. Right now, weare simiulating this mesh as a fishnet, as if it doesn't have faces!
#####################
#advanced setting parameters
#####################
c = damp# adamp : Acceleration damp controls the stability of the system
MaximumIterations = IterCount
k = Elasticity# K : Elasticity Constant in Hooke's law
dt = timeInterval# dt : Time intervals
m = vertexMass

vertexCount = len(verts)
edgeCount = len(edges)
freeIndices = list(set(range(vertexCount)) - set(fixed))#indices of free points
xyz = np.copy(verts)
p=np.zeros((vertexCount, 3), dtype=np.float64)
p=np.array(externalLoad)

if externalLoad==None and not justRelax:
    p=np.tile(np.multiply(m,np.array([0,0,9.81])),(vertexCount,1))
elif justRelax:
    p=np.zeros((vertexCount, 3), dtype=np.float64)
if((not p.shape[0]==vertexCount)):
    raise Exception('the length of the list of external loads is not the same as the list of vertices!')

# v : Velosity
v = np.zeros((vertexCount, 3), dtype=np.float64)
# restlength : Rest Length of the springs
edgeVectors = xyz[edges[:,1]] - xyz[edges[:,0]]#np.array([(xyz[edges[i][1]] - xyz[edges[i][0]]) for i in range(edgeCount)])
restlength = np.linalg.norm(edgeVectors,axis=1,keepdims=True)
restlength = restlength*adj_restlength
#print(restlength)
#np.array([np.sqrt(diff[i,0]*diff[i,0] + diff[i,1]*diff[i,1] + diff[i,2]*diff[i,2]) for i in range(edgeCount)])

if(justRelax):
    restlength=np.multiply(contraction,restlength)
###################
#the main loop, must be changed to a while loop but for now this is ok
###################
#xyz0 = xyz.copy()# xyz0 : Initial Position
differance=1
tolerance=10E-3
t=0
while((differance>tolerance)and t<=MaximumIterations):#for t in range(MaximumIterations):

    R = np.zeros((vertexCount, 3), dtype=np.float64)# R : Final Forces
    vp = v.copy()# vp : Initial Velocity
    xyz0 = xyz.copy()#previous positions

    edgeVectors_t = xyz[edges[:,1]] - xyz[edges[:,0]]
    edgeLengths_t = (np.linalg.norm(edgeVectors_t,axis=1,keepdims=True))
    EdgeForce = ((edgeLengths_t - restlength) * k)#.reshape((edgeCount,1))# f_{i,j} at the iteration time t, note that this is only the magnitude of these forces, i.e. |f_{i,j}=k\Delta l|  
    EdgeForceVectors = np.multiply(EdgeForce,np.divide(edgeVectors_t,edgeLengths_t))#EdgeForce*(edgeVectors_t/edgeLengths_t)
    
    graph_force = np.zeros((vertexCount,vertexCount, 3))
    graph_force[edges[:,0],edges[:,1]] += EdgeForceVectors

    # S : Sum of Stiffness Force on vertices
    S = np.sum(graph_force, axis=0) - np.sum(graph_force, axis=1)
    R[freeIndices] = p[freeIndices] - S[freeIndices]
    
    A = 1/(1 + c * dt * 0.5)
    B = (1 - c * dt * 0.5 ) / (1 + c * dt * 0.5)
    v[freeIndices] = A * dt * R[freeIndices] / m + B * vp[freeIndices]# updating the velocity
    xyz[freeIndices] = xyz0[freeIndices] + dt * v[freeIndices]# updating the position
    differance=np.linalg.norm(xyz-xyz0,'fro')

    t+=1

print(t)
print(differance)

X=xyz[:,0].tolist()
Y=xyz[:,1].tolist()
Z=xyz[:,2].tolist()
# ---------- end dynamicrelaxation_cpython_2 ----------
pt_4 = ConstructPoint(
    XCoordinate=dynamicrelaxation_cpython_2.X,
    YCoordinate=dynamicrelaxation_cpython_2.Y,
    ZCoordinate=dynamicrelaxation_cpython_2.Z)
reconstructmesh_2 = GhPythonScript(v=pt_4, f=mesh_input_3.f)  # -> out, a; inputs v: list of Point3d, f: list; same code as reconstructmesh
wbcatmullclark_2 = WeaverbirdsCatmullClarkSubdivision(MeshCurves=reconstructmesh_2.a, Level=Slider(1, range=0..1), SmoothNakedEdges=0)

wbedges_4 = WeaverbirdsMeshEdges(MeshOrPolylines=wbcatmullclark_2)

# ----
# Kitchen: Nubian Vault
officerectangle_3 = Curve(kitchenrectangle)
boundary_2 = BoundarySurfaces(Edges=officerectangle_3)
officewalls_polyline_3 = Curve(kitchenwalls_polyline)

# ---- group: test_data : simple mesh
storekitchenlobby_surface_2 = Surface(boundary_2)
smooth_2 = SettingsQuality()
mesh_8 = MeshBrep(Brep=storekitchenlobby_surface_2, Settings=smooth_2)
mesh_uv_2 = MeshSurface(
    Surface=storekitchenlobby_surface_2,
    UCount=Slider(18, range=0..100),
    VCount=Slider(12, range=0..100),
    Overhang=True,
    Equalize=False)
medges_2 = MeshEdges(Mesh=mesh_8)  # -> NakedEdges, InteriorEdges, NonManifoldEdges

# ----
mesh_9 = Mesh(mesh_uv_2)
border_4 = GhPythonScript(M=mesh_9)  # -> out, a; inputs M: Mesh; same code as border
mesh_input_4 = GhPythonScript(M=mesh_9)  # -> out, v, e, f; inputs M: Mesh; same code as mesh_input
crv_4 = Curve(border_4.a)
P_4 = Point(mesh_input_4.v)
python_4 = GhPythonScript(v=mesh_input_4.v, guideCrv=crv_4)  # -> out, Indices, Vertices; inputs v: list of Point3d, guideCrv: Curve; same code as python
points_on_a_line_2 = GhPythonScript(v=P_4, selectionCurves=officewalls_polyline_3)  # -> out, inBandVertices, inBandIndices; inputs v: list of Point3d, selectionCurves: list of Curve; same code as points_in_a_band
dynamicrelaxation_cpython_3 = GH_CPython(
    input=Button(),
    v=mesh_input_4.v,
    e=mesh_input_4.e,
    f=mesh_input_4.f,
    justRelax=Toggle(False),
    contraction=Slider(0.2, range=0..1),
    fixed=points_on_a_line_2.inBandIndices,
    damp=Slider(10, range=0..100),
    IterCount=Slider(90, range=0..1000),
    Elasticity=Slider(80, range=0..100),
    timeInterval=Slider(0.02, range=0..1),
    vertexMass=Slider(1, range=0..10),
    adj_restlength=Slider(0.35, range=0..1))  # -> output, a, b, c, X, Y, Z; inputs input: list, v: list, e: list, f: list, justRelax: list, externalLoad: list, contraction: list, fixed: list, damp: list, IterCount: list, Elasticity: list, timeInterval: list, vertexMass: list, adj_restlength: list; same code as dynamicrelaxation_cpython_2
pt_5 = ConstructPoint(
    XCoordinate=dynamicrelaxation_cpython_3.X,
    YCoordinate=dynamicrelaxation_cpython_3.Y,
    ZCoordinate=dynamicrelaxation_cpython_3.Z)
reconstructmesh_3 = GhPythonScript(v=pt_5, f=mesh_input_4.f)  # -> out, a; inputs v: list of Point3d, f: list; same code as reconstructmesh
wbcatmullclark_3 = WeaverbirdsCatmullClarkSubdivision(MeshCurves=reconstructmesh_3.a, Level=Slider(1, range=0..1), SmoothNakedEdges=0)

wbedges_5 = WeaverbirdsMeshEdges(MeshOrPolylines=[mesh_uv, mesh_uv_2])
wbedges_6 = WeaverbirdsMeshEdges(MeshOrPolylines=wbcatmullclark_3)

# ----
# Toilets 01 : Nubian Vault
officerectangle_4 = Curve(toilets_01_rectangle)
boundary_3 = BoundarySurfaces(Edges=officerectangle_4)
officewalls_polyline_4 = Curve(toilets_01_polyline)

# ---- group: test_data : simple mesh
storekitchenlobby_surface_3 = Surface(boundary_3)
smooth_3 = SettingsQuality()
mesh_10 = MeshBrep(Brep=storekitchenlobby_surface_3, Settings=smooth_3)
mesh_uv_3 = MeshSurface(
    Surface=storekitchenlobby_surface_3,
    UCount=Slider(18, range=0..100),
    VCount=Slider(12, range=0..100),
    Overhang=True,
    Equalize=False)
medges_3 = MeshEdges(Mesh=mesh_10)  # -> NakedEdges, InteriorEdges, NonManifoldEdges

# ----
mesh_11 = Mesh(mesh_uv_3)
border_5 = GhPythonScript(M=mesh_11)  # -> out, a; inputs M: Mesh; same code as border
mesh_input_5 = GhPythonScript(M=mesh_11)  # -> out, v, e, f; inputs M: Mesh; same code as mesh_input
crv_5 = Curve(border_5.a)
P_5 = Point(mesh_input_5.v)
python_5 = GhPythonScript(v=mesh_input_5.v, guideCrv=crv_5)  # -> out, Indices, Vertices; inputs v: list of Point3d, guideCrv: Curve; same code as python
points_on_a_line_3 = GhPythonScript(v=P_5, selectionCurves=officewalls_polyline_4)  # -> out, inBandVertices, inBandIndices; inputs v: list of Point3d, selectionCurves: list of Curve; same code as points_in_a_band
dynamicrelaxation_cpython_4 = GH_CPython(
    input=Button(),
    v=mesh_input_5.v,
    e=mesh_input_5.e,
    f=mesh_input_5.f,
    justRelax=Toggle(False),
    contraction=Slider(0.2, range=0..1),
    fixed=points_on_a_line_3.inBandIndices,
    damp=Slider(10, range=0..100),
    IterCount=Slider(90, range=0..1000),
    Elasticity=Slider(80, range=0..100),
    timeInterval=Slider(0.02, range=0..1),
    vertexMass=Slider(1, range=0..10),
    adj_restlength=Slider(0.35, range=0..1))  # -> output, a, b, c, X, Y, Z; inputs input: list, v: list, e: list, f: list, justRelax: list, externalLoad: list, contraction: list, fixed: list, damp: list, IterCount: list, Elasticity: list, timeInterval: list, vertexMass: list, adj_restlength: list; same code as dynamicrelaxation_cpython_2
pt_6 = ConstructPoint(
    XCoordinate=dynamicrelaxation_cpython_4.X,
    YCoordinate=dynamicrelaxation_cpython_4.Y,
    ZCoordinate=dynamicrelaxation_cpython_4.Z)
reconstructmesh_4 = GhPythonScript(v=pt_6, f=mesh_input_5.f)  # -> out, a; inputs v: list of Point3d, f: list; same code as reconstructmesh
wbcatmullclark_4 = WeaverbirdsCatmullClarkSubdivision(MeshCurves=reconstructmesh_4.a, Level=Slider(1, range=0..1), SmoothNakedEdges=0)

wbedges_7 = WeaverbirdsMeshEdges(MeshOrPolylines=wbcatmullclark_4)

# ----
# Main Storage: Nubian Vault
officerectangle_5 = Curve(mainstoragerectangle)
boundary_4 = BoundarySurfaces(Edges=officerectangle_5)
officewalls_polyline_5 = Curve(mainstoragewalls_polyline)

# ---- group: test_data : simple mesh
storekitchenlobby_surface_4 = Surface(boundary_4)
smooth_4 = SettingsQuality()
mesh_12 = MeshBrep(Brep=storekitchenlobby_surface_4, Settings=smooth_4)
mesh_uv_4 = MeshSurface(
    Surface=storekitchenlobby_surface_4,
    UCount=Slider(18, range=0..100),
    VCount=Slider(12, range=0..100),
    Overhang=True,
    Equalize=False)
medges_4 = MeshEdges(Mesh=mesh_12)  # -> NakedEdges, InteriorEdges, NonManifoldEdges

# ----
mesh_13 = Mesh(mesh_uv_4)
border_6 = GhPythonScript(M=mesh_13)  # -> out, a; inputs M: Mesh; same code as border
mesh_input_6 = GhPythonScript(M=mesh_13)  # -> out, v, e, f; inputs M: Mesh; same code as mesh_input
crv_6 = Curve(border_6.a)
P_6 = Point(mesh_input_6.v)
python_6 = GhPythonScript(v=mesh_input_6.v, guideCrv=crv_6)  # -> out, Indices, Vertices; inputs v: list of Point3d, guideCrv: Curve; same code as python
points_on_a_line_4 = GhPythonScript(v=P_6, selectionCurves=officewalls_polyline_5)  # -> out, inBandVertices, inBandIndices; inputs v: list of Point3d, selectionCurves: list of Curve; same code as points_in_a_band
dynamicrelaxation_cpython_5 = GH_CPython(
    input=Button(),
    v=mesh_input_6.v,
    e=mesh_input_6.e,
    f=mesh_input_6.f,
    justRelax=Toggle(False),
    contraction=Slider(0.2, range=0..1),
    fixed=points_on_a_line_4.inBandIndices,
    damp=Slider(10, range=0..100),
    IterCount=Slider(90, range=0..1000),
    Elasticity=Slider(80, range=0..100),
    timeInterval=Slider(0.02, range=0..1),
    vertexMass=Slider(1, range=0..10),
    adj_restlength=Slider(0.35, range=0..1))  # -> output, a, b, c, X, Y, Z; inputs input: list, v: list, e: list, f: list, justRelax: list, externalLoad: list, contraction: list, fixed: list, damp: list, IterCount: list, Elasticity: list, timeInterval: list, vertexMass: list, adj_restlength: list; same code as dynamicrelaxation_cpython_2
pt_7 = ConstructPoint(
    XCoordinate=dynamicrelaxation_cpython_5.X,
    YCoordinate=dynamicrelaxation_cpython_5.Y,
    ZCoordinate=dynamicrelaxation_cpython_5.Z)
reconstructmesh_5 = GhPythonScript(v=pt_7, f=mesh_input_6.f)  # -> out, a; inputs v: list of Point3d, f: list; same code as reconstructmesh
wbcatmullclark_5 = WeaverbirdsCatmullClarkSubdivision(MeshCurves=reconstructmesh_5.a, Level=Slider(1, range=0..1), SmoothNakedEdges=0)

wbedges_8 = WeaverbirdsMeshEdges(MeshOrPolylines=wbcatmullclark_5)

# ----
# Toilets 02 : Nubian Vault
officerectangle_6 = Curve(toilet_02_rectangle)
boundary_5 = BoundarySurfaces(Edges=officerectangle_6)
officewalls_polyline_6 = Curve(toilet_02_polyline)

# ---- group: test_data : simple mesh
storekitchenlobby_surface_5 = Surface(boundary_5)
smooth_5 = SettingsQuality()
mesh_14 = MeshBrep(Brep=storekitchenlobby_surface_5, Settings=smooth_5)
mesh_uv_5 = MeshSurface(
    Surface=storekitchenlobby_surface_5,
    UCount=Slider(18, range=0..100),
    VCount=Slider(12, range=0..100),
    Overhang=True,
    Equalize=False)
medges_5 = MeshEdges(Mesh=mesh_14)  # -> NakedEdges, InteriorEdges, NonManifoldEdges

# ----
mesh_15 = Mesh(mesh_uv_5)
border_7 = GhPythonScript(M=mesh_15)  # -> out, a; inputs M: Mesh; same code as border
mesh_input_7 = GhPythonScript(M=mesh_15)  # -> out, v, e, f; inputs M: Mesh; same code as mesh_input
crv_7 = Curve(border_7.a)
P_7 = Point(mesh_input_7.v)
python_7 = GhPythonScript(v=mesh_input_7.v, guideCrv=crv_7)  # -> out, Indices, Vertices; inputs v: list of Point3d, guideCrv: Curve; same code as python
points_on_a_line_5 = GhPythonScript(v=P_7, selectionCurves=officewalls_polyline_6)  # -> out, inBandVertices, inBandIndices; inputs v: list of Point3d, selectionCurves: list of Curve; same code as points_in_a_band
dynamicrelaxation_cpython_6 = GH_CPython(
    input=Button(),
    v=mesh_input_7.v,
    e=mesh_input_7.e,
    f=mesh_input_7.f,
    justRelax=Toggle(False),
    contraction=Slider(0.2, range=0..1),
    fixed=points_on_a_line_5.inBandIndices,
    damp=Slider(10, range=0..100),
    IterCount=Slider(90, range=0..1000),
    Elasticity=Slider(80, range=0..100),
    timeInterval=Slider(0.02, range=0..1),
    vertexMass=Slider(1, range=0..10),
    adj_restlength=Slider(0.35, range=0..1))  # -> output, a, b, c, X, Y, Z; inputs input: list, v: list, e: list, f: list, justRelax: list, externalLoad: list, contraction: list, fixed: list, damp: list, IterCount: list, Elasticity: list, timeInterval: list, vertexMass: list, adj_restlength: list; same code as dynamicrelaxation_cpython_2
pt_8 = ConstructPoint(
    XCoordinate=dynamicrelaxation_cpython_6.X,
    YCoordinate=dynamicrelaxation_cpython_6.Y,
    ZCoordinate=dynamicrelaxation_cpython_6.Z)
reconstructmesh_6 = GhPythonScript(v=pt_8, f=mesh_input_7.f)  # -> out, a; inputs v: list of Point3d, f: list; same code as reconstructmesh
wbcatmullclark_6 = WeaverbirdsCatmullClarkSubdivision(MeshCurves=reconstructmesh_6.a, Level=Slider(1, range=0..1), SmoothNakedEdges=0)

wbedges_9 = WeaverbirdsMeshEdges(MeshOrPolylines=wbcatmullclark_6)

# ----
# Childcare 01: Nubian Vault
officerectangle_7 = Curve(childcare_01_rectangle)
boundary_6 = BoundarySurfaces(Edges=officerectangle_7)
officewalls_polyline_7 = Curve(childcar_02_polyline)

# ---- group: test_data : simple mesh
storekitchenlobby_surface_6 = Surface(boundary_6)
smooth_6 = SettingsQuality()
mesh_16 = MeshBrep(Brep=storekitchenlobby_surface_6, Settings=smooth_6)
mesh_uv_6 = MeshSurface(
    Surface=storekitchenlobby_surface_6,
    UCount=Slider(18, range=0..100),
    VCount=Slider(12, range=0..100),
    Overhang=True,
    Equalize=False)
medges_6 = MeshEdges(Mesh=mesh_16)  # -> NakedEdges, InteriorEdges, NonManifoldEdges

# ----
wbedges_10 = WeaverbirdsMeshEdges(MeshOrPolylines=mesh_uv_6)

mesh_17 = Mesh(mesh_uv_6)
border_8 = GhPythonScript(M=mesh_17)  # -> out, a; inputs M: Mesh; same code as border
mesh_input_8 = GhPythonScript(M=mesh_17)  # -> out, v, e, f; inputs M: Mesh; same code as mesh_input
crv_8 = Curve(border_8.a)
P_8 = Point(mesh_input_8.v)
python_8 = GhPythonScript(v=mesh_input_8.v, guideCrv=crv_8)  # -> out, Indices, Vertices; inputs v: list of Point3d, guideCrv: Curve; same code as python
points_on_a_line_6 = GhPythonScript(v=P_8, selectionCurves=officewalls_polyline_7)  # -> out, inBandVertices, inBandIndices; inputs v: list of Point3d, selectionCurves: list of Curve; same code as points_in_a_band
dynamicrelaxation_cpython_7 = GH_CPython(
    input=Button(),
    v=mesh_input_8.v,
    e=mesh_input_8.e,
    f=mesh_input_8.f,
    justRelax=Toggle(False),
    contraction=Slider(0.2, range=0..1),
    fixed=points_on_a_line_6.inBandIndices,
    damp=Slider(10, range=0..100),
    IterCount=Slider(90, range=0..1000),
    Elasticity=Slider(80, range=0..100),
    timeInterval=Slider(0.02, range=0..1),
    vertexMass=Slider(1, range=0..10),
    adj_restlength=Slider(0.35, range=0..1))  # -> output, a, b, c, X, Y, Z; inputs input: list, v: list, e: list, f: list, justRelax: list, externalLoad: list, contraction: list, fixed: list, damp: list, IterCount: list, Elasticity: list, timeInterval: list, vertexMass: list, adj_restlength: list; same code as dynamicrelaxation_cpython_2
pt_9 = ConstructPoint(
    XCoordinate=dynamicrelaxation_cpython_7.X,
    YCoordinate=dynamicrelaxation_cpython_7.Y,
    ZCoordinate=dynamicrelaxation_cpython_7.Z)
reconstructmesh_7 = GhPythonScript(v=pt_9, f=mesh_input_8.f)  # -> out, a; inputs v: list of Point3d, f: list; same code as reconstructmesh
wbcatmullclark_7 = WeaverbirdsCatmullClarkSubdivision(MeshCurves=reconstructmesh_7.a, Level=Slider(1, range=0..1), SmoothNakedEdges=0)

wbedges_11 = WeaverbirdsMeshEdges(MeshOrPolylines=wbcatmullclark_7)

# ----
# Childcare 02: Nubian Vault
officerectangle_8 = Curve(childcare_02__rectangle)
boundary_7 = BoundarySurfaces(Edges=officerectangle_8)
officewalls_polyline_8 = Curve(childcare_02_walls_polyline)

# ---- group: test_data : simple mesh
storekitchenlobby_surface_7 = Surface(boundary_7)
smooth_7 = SettingsQuality()
mesh_18 = MeshBrep(Brep=storekitchenlobby_surface_7, Settings=smooth_7)
mesh_uv_7 = MeshSurface(
    Surface=storekitchenlobby_surface_7,
    UCount=Slider(18, range=0..100),
    VCount=Slider(12, range=0..100),
    Overhang=True,
    Equalize=False)
medges_7 = MeshEdges(Mesh=mesh_18)  # -> NakedEdges, InteriorEdges, NonManifoldEdges

# ----
mesh_19 = Mesh(mesh_uv_7)
border_9 = GhPythonScript(M=mesh_19)  # -> out, a; inputs M: Mesh; same code as border
mesh_input_9 = GhPythonScript(M=mesh_19)  # -> out, v, e, f; inputs M: Mesh; same code as mesh_input
crv_9 = Curve(border_9.a)
P_9 = Point(mesh_input_9.v)
python_9 = GhPythonScript(v=mesh_input_9.v, guideCrv=crv_9)  # -> out, Indices, Vertices; inputs v: list of Point3d, guideCrv: Curve; same code as python
points_on_a_line_7 = GhPythonScript(v=P_9, selectionCurves=officewalls_polyline_8)  # -> out, inBandVertices, inBandIndices; inputs v: list of Point3d, selectionCurves: list of Curve; same code as points_in_a_band
dynamicrelaxation_cpython_8 = GH_CPython(
    input=Button(),
    v=mesh_input_9.v,
    e=mesh_input_9.e,
    f=mesh_input_9.f,
    justRelax=Toggle(False),
    contraction=Slider(0.2, range=0..1),
    fixed=points_on_a_line_7.inBandIndices,
    damp=Slider(10, range=0..100),
    IterCount=Slider(90, range=0..1000),
    Elasticity=Slider(100, range=0..100),
    timeInterval=Slider(0.02, range=0..1),
    vertexMass=Slider(1, range=0..10),
    adj_restlength=Slider(0.14, range=0..1))  # -> output, a, b, c, X, Y, Z; inputs input: list, v: list, e: list, f: list, justRelax: list, externalLoad: list, contraction: list, fixed: list, damp: list, IterCount: list, Elasticity: list, timeInterval: list, vertexMass: list, adj_restlength: list; same code as dynamicrelaxation_cpython_2
pt_10 = ConstructPoint(
    XCoordinate=dynamicrelaxation_cpython_8.X,
    YCoordinate=dynamicrelaxation_cpython_8.Y,
    ZCoordinate=dynamicrelaxation_cpython_8.Z)
reconstructmesh_8 = GhPythonScript(v=pt_10, f=mesh_input_9.f)  # -> out, a; inputs v: list of Point3d, f: list; same code as reconstructmesh
wbcatmullclark_8 = WeaverbirdsCatmullClarkSubdivision(MeshCurves=reconstructmesh_8.a, Level=Slider(1, range=0..1), SmoothNakedEdges=0)

wbedges_12 = WeaverbirdsMeshEdges(MeshOrPolylines=wbcatmullclark_8)

# ---- group: firstFloor_Meshes
merge = Merge(
    Data1=wbcatmullclark_2,
    Data2=wbcatmullclark_3,
    Data3=wbcatmullclark_5,
    Data4=wbcatmullclark_4,
    Data5=wbcatmullclark_6,
    Data6=wbcatmullclark_7,
    Data7=wbcatmullclark_8,
    Data8=mesh_5)

# ----
firstfloor_meshes = Mesh(merge)

# ----
# Second Floor : Library
officerectangle_9 = Curve(library_rectangle)
boundary_8 = BoundarySurfaces(Edges=officerectangle_9)
officewalls_polyline_9 = Curve(library_polyline)

# ---- group: test_data : simple mesh
storekitchenlobby_surface_8 = Surface(boundary_8)
smooth_8 = SettingsQuality()
mesh_20 = MeshBrep(Brep=storekitchenlobby_surface_8, Settings=smooth_8)
mesh_uv_8 = MeshSurface(
    Surface=storekitchenlobby_surface_8,
    UCount=Slider(20, range=0..100),
    VCount=Slider(24, range=0..100),
    Overhang=True,
    Equalize=False)
medges_8 = MeshEdges(Mesh=mesh_20)  # -> NakedEdges, InteriorEdges, NonManifoldEdges

# ----
mesh_21 = Mesh(mesh_uv_8)
border_10 = GhPythonScript(M=mesh_21)  # -> out, a; inputs M: Mesh; same code as border
mesh_input_10 = GhPythonScript(M=mesh_21)  # -> out, v, e, f; inputs M: Mesh; same code as mesh_input
crv_10 = Curve(border_10.a)
P_10 = Point(mesh_input_10.v)
python_10 = GhPythonScript(v=mesh_input_10.v, guideCrv=crv_10)  # -> out, Indices, Vertices; inputs v: list of Point3d, guideCrv: Curve; same code as python
points_on_a_line_8 = GhPythonScript(v=P_10, selectionCurves=officewalls_polyline_9)  # -> out, inBandVertices, inBandIndices; inputs v: list of Point3d, selectionCurves: list of Curve; same code as points_in_a_band
dynamicrelaxation_cpython_9 = GH_CPython(
    input=Button(),
    v=mesh_input_10.v,
    e=mesh_input_10.e,
    f=mesh_input_10.f,
    justRelax=Toggle(False),
    contraction=Slider(0.2, range=0..1),
    fixed=points_on_a_line_8.inBandIndices,
    damp=Slider(10, range=0..100),
    IterCount=Slider(90, range=0..1000),
    Elasticity=Slider(90, range=0..100),
    timeInterval=Slider(0.04, range=0..1),
    vertexMass=Slider(1, range=0..10),
    adj_restlength=Slider(0.35, range=0..1))  # -> output, a, b, c, X, Y, Z; inputs input: list, v: list, e: list, f: list, justRelax: list, externalLoad: list, contraction: list, fixed: list, damp: list, IterCount: list, Elasticity: list, timeInterval: list, vertexMass: list, adj_restlength: list; same code as dynamicrelaxation_cpython_2
pt_11 = ConstructPoint(
    XCoordinate=dynamicrelaxation_cpython_9.X,
    YCoordinate=dynamicrelaxation_cpython_9.Y,
    ZCoordinate=dynamicrelaxation_cpython_9.Z)
reconstructmesh_9 = GhPythonScript(v=pt_11, f=mesh_input_10.f)  # -> out, a; inputs v: list of Point3d, f: list; same code as reconstructmesh
wbcatmullclark_9 = WeaverbirdsCatmullClarkSubdivision(MeshCurves=reconstructmesh_9.a, Level=Slider(1, range=0..1), SmoothNakedEdges=0)

wbedges_13 = WeaverbirdsMeshEdges(MeshOrPolylines=wbcatmullclark_9)

# ----
# Second Floor : Conference Room
officerectangle_10 = Curve(conference_01_rectangle)
boundary_9 = BoundarySurfaces(Edges=officerectangle_10)
officewalls_polyline_10 = Curve(conference_01_polyline)

# ---- group: test_data : simple mesh
storekitchenlobby_surface_9 = Surface(boundary_9)
smooth_9 = SettingsQuality()
mesh_22 = MeshBrep(Brep=storekitchenlobby_surface_9, Settings=smooth_9)
mesh_uv_9 = MeshSurface(
    Surface=storekitchenlobby_surface_9,
    UCount=Slider(20, range=0..100),
    VCount=Slider(24, range=0..100),
    Overhang=True,
    Equalize=False)
medges_9 = MeshEdges(Mesh=mesh_22)  # -> NakedEdges, InteriorEdges, NonManifoldEdges

# ----
mesh_23 = Mesh(mesh_uv_9)
border_11 = GhPythonScript(M=mesh_23)  # -> out, a; inputs M: Mesh; same code as border
mesh_input_11 = GhPythonScript(M=mesh_23)  # -> out, v, e, f; inputs M: Mesh; same code as mesh_input
crv_11 = Curve(border_11.a)
P_11 = Point(mesh_input_11.v)
python_11 = GhPythonScript(v=mesh_input_11.v, guideCrv=crv_11)  # -> out, Indices, Vertices; inputs v: list of Point3d, guideCrv: Curve; same code as python
points_on_a_line_9 = GhPythonScript(v=P_11, selectionCurves=officewalls_polyline_10)  # -> out, inBandVertices, inBandIndices; inputs v: list of Point3d, selectionCurves: list of Curve; same code as points_in_a_band
dynamicrelaxation_cpython_10 = GH_CPython(
    input=Button(),
    v=mesh_input_11.v,
    e=mesh_input_11.e,
    f=mesh_input_11.f,
    justRelax=Toggle(False),
    contraction=Slider(0.2, range=0..1),
    fixed=points_on_a_line_9.inBandIndices,
    damp=Slider(10, range=0..100),
    IterCount=Slider(90, range=0..1000),
    Elasticity=Slider(90, range=0..100),
    timeInterval=Slider(0.04, range=0..1),
    vertexMass=Slider(1, range=0..10),
    adj_restlength=Slider(0.35, range=0..1))  # -> output, a, b, c, X, Y, Z; inputs input: list, v: list, e: list, f: list, justRelax: list, externalLoad: list, contraction: list, fixed: list, damp: list, IterCount: list, Elasticity: list, timeInterval: list, vertexMass: list, adj_restlength: list; same code as dynamicrelaxation_cpython_2
pt_12 = ConstructPoint(
    XCoordinate=dynamicrelaxation_cpython_10.X,
    YCoordinate=dynamicrelaxation_cpython_10.Y,
    ZCoordinate=dynamicrelaxation_cpython_10.Z)
reconstructmesh_10 = GhPythonScript(v=pt_12, f=mesh_input_11.f)  # -> out, a; inputs v: list of Point3d, f: list; same code as reconstructmesh
wbcatmullclark_10 = WeaverbirdsCatmullClarkSubdivision(MeshCurves=reconstructmesh_10.a, Level=Slider(1, range=0..1), SmoothNakedEdges=0)

wbedges_14 = WeaverbirdsMeshEdges(MeshOrPolylines=wbcatmullclark_10)

# ----
# Second Floor : Al Aghabani
officerectangle_11 = Curve(alaghabani_rectangle)
boundary_10 = BoundarySurfaces(Edges=officerectangle_11)
officewalls_polyline_11 = Curve(alaghabaniwalls_polyline)

# ---- group: test_data : simple mesh
storekitchenlobby_surface_10 = Surface(boundary_10)
smooth_10 = SettingsQuality()
mesh_24 = MeshBrep(Brep=storekitchenlobby_surface_10, Settings=smooth_10)
mesh_uv_10 = MeshSurface(
    Surface=storekitchenlobby_surface_10,
    UCount=Slider(20, range=0..100),
    VCount=Slider(24, range=0..100),
    Overhang=True,
    Equalize=False)
medges_10 = MeshEdges(Mesh=mesh_24)  # -> NakedEdges, InteriorEdges, NonManifoldEdges

# ----
mesh_25 = Mesh(mesh_uv_10)
border_12 = GhPythonScript(M=mesh_25)  # -> out, a; inputs M: Mesh; same code as border
mesh_input_12 = GhPythonScript(M=mesh_25)  # -> out, v, e, f; inputs M: Mesh; same code as mesh_input
crv_12 = Curve(border_12.a)
P_12 = Point(mesh_input_12.v)
python_12 = GhPythonScript(v=mesh_input_12.v, guideCrv=crv_12)  # -> out, Indices, Vertices; inputs v: list of Point3d, guideCrv: Curve; same code as python
points_on_a_line_10 = GhPythonScript(v=P_12, selectionCurves=officewalls_polyline_11)  # -> out, inBandVertices, inBandIndices; inputs v: list of Point3d, selectionCurves: list of Curve; same code as points_in_a_band
dynamicrelaxation_cpython_11 = GH_CPython(
    input=Button(),
    v=mesh_input_12.v,
    e=mesh_input_12.e,
    f=mesh_input_12.f,
    justRelax=Toggle(False),
    contraction=Slider(0.2, range=0..1),
    fixed=points_on_a_line_10.inBandIndices,
    damp=Slider(10, range=0..100),
    IterCount=Slider(90, range=0..1000),
    Elasticity=Slider(90, range=0..100),
    timeInterval=Slider(0.04, range=0..1),
    vertexMass=Slider(1, range=0..10),
    adj_restlength=Slider(0.35, range=0..1))  # -> output, a, b, c, X, Y, Z; inputs input: list, v: list, e: list, f: list, justRelax: list, externalLoad: list, contraction: list, fixed: list, damp: list, IterCount: list, Elasticity: list, timeInterval: list, vertexMass: list, adj_restlength: list; same code as dynamicrelaxation_cpython_2
pt_13 = ConstructPoint(
    XCoordinate=dynamicrelaxation_cpython_11.X,
    YCoordinate=dynamicrelaxation_cpython_11.Y,
    ZCoordinate=dynamicrelaxation_cpython_11.Z)
reconstructmesh_11 = GhPythonScript(v=pt_13, f=mesh_input_12.f)  # -> out, a; inputs v: list of Point3d, f: list; same code as reconstructmesh
wbcatmullclark_11 = WeaverbirdsCatmullClarkSubdivision(MeshCurves=reconstructmesh_11.a, Level=Slider(1, range=0..1), SmoothNakedEdges=0)

wbedges_15 = WeaverbirdsMeshEdges(MeshOrPolylines=wbcatmullclark_11)

# ---- group: secondFloor_tripleDomes
merge_2 = Merge(Data1=wbcatmullclark_9, Data2=wbcatmullclark_10, Data3=wbcatmullclark_11)

# ----
secondfloor_triple = Mesh(merge_2)
move_8 = Move(Geometry=secondfloor_triple, Motion=vec2pt.Vector)  # -> Geometry, Transform

# ----
# Move Geometries to correct x,y,z
number_slider_10 = Slider(1.5, range=0..10)
basewallheight_firstfloor = Data(number_slider_10)
firstfloor_wallrectangles = Curve([<curve referenced from the Rhino model> x29])
Z = UnitZ(Factor=basewallheight_firstfloor)
group = Group(Objects=firstfloor_meshes)
addition = Addition(A=number_slider_10, B=Slider(3, range=0..4))
floortofloor = Data(addition)
extr = Extrude(Base=firstfloor_wallrectangles, Direction=Z)
move_9 = Move(Geometry=group, Motion=Z)  # -> Geometry, Transform
Z_2 = UnitZ(Factor=floortofloor)
group_2 = Group(Objects=[extr, move_9.Geometry])
move_10 = Move(Geometry=move_8.Geometry, Motion=Z_2)  # -> Geometry, Transform
move_11 = Move(Geometry=move_7.Geometry, Motion=Z_2)  # -> Geometry, Transform

firstfloor_final = Data(group_2)
secondfloor_triple_final = Data(move_10.Geometry)
secondfloor_triple_final_2 = Data(move_11.Geometry)

# ---- group: option 1
# Final Geometries
group_3 = Group(Objects=[firstfloor_final, secondfloor_triple_final])

# ---- group: option 2
group_4 = Group(Objects=[firstfloor_final, secondfloor_triple_final_2])

# ==== cluster WeightLoad
mass = ClusterInput()
v = ClusterInput()
panel = Panel("{0.0,0.0,9.81]")
mass_2 = Number(mass)
v_2 = Point(v)
lng = ListLength(List=v_2)
repeat = RepeatData(Data=<missing>, Length=lng)
weightload = Vector(repeat)
weightload_2 = ClusterOutput(weightload)
