# Grasshopper definition Shops_and_Riwaqs_dynamicRelaxation_mid_term.gh (Grasshopper 1.0.7)
# plug-ins: Weaverbird, Kangaroo2 Components

# Original Scripts from Base File
base_surface = Surface(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)
# Original Scripts from Base File
base_surface_2 = Surface(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)
base_surface_3 = Surface(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)

# ---- group: test_data
smooth = SettingsQuality()
mesh = MeshBrep(Brep=base_surface_2, Settings=smooth)
medges = MeshEdges(Mesh=mesh)  # -> NakedEdges, InteriorEdges, NonManifoldEdges
mesh_uv = MeshSurface(Surface=base_surface_2, UCount=Slider(50, range=0..100), VCount=Slider(50, range=0..100), Overhang=True, Equalize=False)

smooth_2 = SettingsQuality()
mesh_2 = MeshBrep(Brep=base_surface, Settings=smooth_2)
medges_2 = MeshEdges(Mesh=mesh_2)  # -> NakedEdges, InteriorEdges, NonManifoldEdges
mesh_uv_2 = MeshSurface(Surface=base_surface, UCount=Slider(100, range=0..100), VCount=Slider(100, range=0..100), Overhang=True, Equalize=False)

# ----
number_slider = Slider(66, range=0..100)

# ---- group: test_data
smooth_3 = SettingsQuality()
number_slider_2 = Slider(86, range=0..100)
number_slider_3 = Slider(90, range=0..100)
mesh_3 = MeshBrep(Brep=base_surface_3, Settings=smooth_3)
medges_3 = MeshEdges(Mesh=mesh_3)  # -> NakedEdges, InteriorEdges, NonManifoldEdges
mesh_uv_3 = MeshSurface(Surface=base_surface_3, UCount=number_slider, VCount=number_slider, Overhang=True, Equalize=False)

# ----
number_slider_4 = Slider(132, range=0..1000)
mesh_4 = Mesh([<mesh referenced from the Rhino model> x16])
wbedges = WeaverbirdsMeshEdges(MeshOrPolylines=mesh_uv)

# ----
# Main courtyard
mesh_5 = Mesh(mesh_uv_2)
border = GhPythonScript(M=mesh_5)  # -> out, a; inputs M: Mesh
# ---------- border: Python ----------
borders=M.GetNakedEdges()
CurveBorders=[]
for border in borders:
    CurveBorders.append(border.ToNurbsCurve())
a=CurveBorders
# ---------- end border ----------
mesh_input = GhPythonScript(M=mesh_5)  # -> out, v, e, f; inputs M: Mesh
# ---------- mesh_input: Python ----------
__author__ = "pnourian"
__version__ = "2020.08.21"

import rhinoscriptsyntax as rs
import Rhino.Geometry as rg
import math
#####################################
#input validation: weldedness, manifoldness, cleanness
#####################################
if not M.IsManifold(True):
    raise Exception("the input mesh is non-mannifold and this method is not designed to work with non-manifold meshes!")
M.Weld(math.pi)
M.Vertices.CombineIdentical(True,True)
M.Vertices.CullUnused()
if not M.Vertices.Count==M.TopologyVertices.Count:
    raise Exception("the input mesh must be completely welded; although we tried our best, the given mesh seems to have a problem not allowing it to be fully welded!")
#####################################
#exporting vertices as a list of rg.Point3f
#####################################
v=M.Vertices.ToPoint3fArray()
#####################################
#exporting edges as a list of tuples
#####################################
edges=[]
for edgeIndex in range(M.TopologyEdges.Count):
    IJ=M.TopologyEdges.GetTopologyVertices(edgeIndex)
    edges.append((IJ.I,IJ.J))
e=edges
#####################################
#exporting faces as a list of tuples
#####################################
faces=[]
if M.Faces.QuadCount==M.Faces.Count:
    print("a fully quadrilateral mesh")
    for face in M.Faces:
        faces.append((face.A,face.B,face.C,face.D))
elif M.Faces.TriangleCount==M.Faces.Count:
    print("a fully triangular mesh")
    for face in M.Faces:
        faces.append((face.A,face.B,face.C))
else:
    raise Exception("this method only works for meshes that are either fully quadrilateral or fully triangular!")

f=faces
# ---------- end mesh_input ----------
selectionregions = Curve([<curve referenced from the Rhino model> x41])
crv = Curve(border.a)
P = Point(mesh_input.v)
python = GhPythonScript(v=mesh_input.v, guideCrv=crv)  # -> out, Indices, Vertices; inputs v: list of Point3d, guideCrv: Curve
# ---------- python: Python ----------
__author__ = "pnourian"
__version__ = "2020.08.21"

import rhinoscriptsyntax as rs
#import clr
#import System
import Rhino.Geometry as rg
maxDistance=10E6
minDistance=10E-6
CloseVertices=[]
CloseIndices=[]
for i in range(v.Count):
    vertex=v[i]
    #t=clr.References[System.Double]()#https://developer.rhino3d.com/guides/rhinopython/python-reference/
    CP=guideCrv.ClosestPoint(vertex,maxDistance)
    #print(CP) how to deal with 'out' (output) parameters and 'ref'(by reference) parameters: IronPython will return the output of such methods as tuples including these parameters! Note that we skipped the argument t in the signature of the function altogether!
    closestPoint=guideCrv.PointAt(CP[1])
    distance=closestPoint.DistanceTo(vertex)
    if distance<minDistance:
        CloseIndices.append(i)
        CloseVertices.append(vertex)
Indices=CloseIndices
Vertices=CloseVertices
# ---------- end python ----------
weightload = WeightLoad(mass=Slider(5, range=0..10), v=mesh_input.v)
external_load = Data(weightload)

wbedges_2 = WeaverbirdsMeshEdges(MeshOrPolylines=mesh_uv_2)
crv_2 = Curve([<curve referenced from the Rhino model> x8])
wbedges_3 = WeaverbirdsMeshEdges(MeshOrPolylines=mesh_4)
wbjoin = WeaverbirdsJoinMeshesAndWeld(Mesh=flatten(mesh_uv), Weld=False)

# ----
# Barrel shops
mesh_6 = Mesh(mesh_uv)
border_2 = GhPythonScript(M=wbjoin)  # -> out, a; inputs M: Mesh; same code as border
mesh_input_2 = GhPythonScript(M=wbjoin)  # -> out, v, e, f; inputs M: Mesh; same code as mesh_input
selectionregions_2 = Curve([<curve referenced from the Rhino model> x7])
crv_3 = Curve(border_2.a)
P_2 = Point(mesh_input_2.v)
python_2 = GhPythonScript(v=mesh_input_2.v, guideCrv=crv_3)  # -> out, Indices, Vertices; inputs v: list of Point3d, guideCrv: Curve; same code as python
points_in_a_band = GhPythonScript(v=P_2, selectionCurves=selectionregions_2)  # -> out, inBandVertices, inBandIndices; inputs v: list of Point3d, selectionCurves: list of Curve
# ---------- points_in_a_band: Python ----------
__author__ = "pnourian"
__version__ = "2020.08.21"

import rhinoscriptsyntax as rs
import Rhino.Geometry as rg
tolerance=10E-3
chosenVertices=[]
chosenIndices=[]
for i in range(v.Count):#vertex in v:
    vertex=v[i]
    chosen=False
    for j in range(selectionCurves.Count):
        insideInside=(selectionCurves[j].Contains(vertex, rg.Plane.WorldXY,tolerance)==rg.PointContainment.Inside)
        chosen=chosen or insideInside
    if chosen:
        chosenVertices.append(vertex)
        chosenIndices.append(i)
inBandVertices=chosenVertices
inBandIndices=chosenIndices
# ---------- end points_in_a_band ----------
weightload_2 = WeightLoad(mass=Slider(5, range=0..10), v=mesh_input_2.v)
external_load_2 = Data(weightload_2)

points_in_a_band_2 = GhPythonScript(v=P, selectionCurves=selectionregions)  # -> out, inBandVertices, inBandIndices; inputs v: list of Point3d, selectionCurves: list of Curve
# ---------- points_in_a_band_2: Python ----------
__author__ = "pnourian"
__version__ = "2020.08.21"

import rhinoscriptsyntax as rs
import Rhino.Geometry as rg
tolerance=10E-3
chosenVertices=[]
chosenIndices=[]

for i in range(v.Count):#vertex in v:
    vertex=v[i]
    #these are all the points coming from other script
    chosen=False
    for j in range(selectionCurves.Count):
        #insideInside=(selectionCurves[j].Contains(vertex, rg.Plane.WorldXY,tolerance)==rg.PointContainment.Inside)
        a = rg.Curve.ClosestPoint(selectionCurves[j],vertex,tolerance)
        print(a)
        if a[0]==False:
                continue
        else:
            chosenVertices.append(vertex)
            chosenIndices.append(i)
    #if chosen:
        #chosenVertices.append(vertex)
        #chosenIndices.append(i)
inBandVertices=chosenVertices
inBandIndices=chosenIndices
# ---------- end points_in_a_band_2 ----------
panel = Panel(wbjoin)

mesh_7 = Mesh(mesh_5)
pt = Point(points_in_a_band_2.inBandVertices)  # disabled
number_slider_5 = Slider(0.72, range=0..1)  # disabled
number_slider_6 = Slider(2, range=0..10)  # disabled
number_slider_7 = Slider(0.1, range=0..0.1)  # disabled
edgelengths = EdgeLengths(Mesh=mesh_7, LengthFactor=number_slider_5, Strength=number_slider_6)  # disabled
anchor = Anchor(Point=pt, Strength=10000)  # disabled
vertexloads = VertexLoads(Mesh=mesh_7, Strength=number_slider_7)  # disabled
show = Show(G=mesh_7)  # disabled
toggle = BooleanToggle(False)  # disabled
button = Button()  # disabled
solver = Solver(GoalObjects=[edgelengths, anchor, vertexloads, show], Reset=button, Threshold=1e-15, Tolerance=0.01, On=toggle)  # -> I, V, O; disabled
panel_2 = Panel("0")  # disabled
data = Data(solver.O)  # disabled

mesh_8 = Mesh(wbjoin)  # disabled
pt_2 = Point(points_in_a_band.inBandVertices)  # disabled
number_slider_8 = Slider(1, range=0..1)  # disabled
number_slider_9 = Slider(6, range=0..10)  # disabled
number_slider_10 = Slider(0.1, range=0..0.1)  # disabled
edgelengths_2 = EdgeLengths(Mesh=mesh_8, LengthFactor=number_slider_8, Strength=number_slider_9)  # disabled
anchor_2 = Anchor(Point=pt_2, Strength=10000)  # disabled
vertexloads_2 = VertexLoads(Mesh=mesh_8, Strength=number_slider_10)  # disabled
show_2 = Show(G=mesh_8)  # disabled
toggle_2 = BooleanToggle(False)  # disabled
button_2 = Button()  # disabled
solver_2 = Solver(
    GoalObjects=[edgelengths_2, anchor_2, vertexloads_2, show_2],
    Reset=button_2,
    Threshold=1e-15,
    Tolerance=0.01,
    On=toggle_2)  # -> I, V, O; disabled
panel_3 = Panel("0")  # disabled

branch = TreeBranch(Tree=flatten(solver_2.O), Path=panel_3, MaintainPaths=True)
branch_2 = TreeBranch(Tree=flatten(solver.O), Path=panel_2, MaintainPaths=True)  # disabled

# ---- group: Create column extrusion
Z = UnitZ(Factor=Slider(1, range=0..1))
crv_4 = Curve([<curve referenced from the Rhino model> x37])
number_slider_11 = Slider(20, range=0..100)
extr = Extrude(Base=crv_4, Direction=Z)
number_slider_12 = Slider(34, range=0..100)
move = Move(Geometry=crv_4, Motion=Z)  # -> Geometry, Transform
cull_i = CullIndex(List=move.Geometry, Indices=[number_slider_11, number_slider_12], Wrap=True)
item = ListItem(List=move.Geometry, Index=[number_slider_11, number_slider_12], Wrap=True)
mesh_9 = MeshBrep(
    Brep=extr,
    Settings={GridMaxCount=0, GridMinCount=16, JaggedSeams=False, MaxEdgeLength=0, MinEdgeLength=0.0001, MinTolerance=0, Refine=True, RefineAngle=0, RelativeTolerance=0.65, SimplePlanes=True, Tolerance=0})

# ----
# Original Scripts from Base File
selectionregions_3 = Curve(cull_i)
mesh_10 = Mesh(mesh_uv_3)
border_3 = GhPythonScript(M=mesh_10)  # -> out, a; inputs M: Mesh; same code as border
mesh_input_3 = GhPythonScript(M=mesh_10)  # -> out, v, e, f; inputs M: Mesh; same code as mesh_input
P_3 = Point(mesh_input_3.v)
crv_5 = Curve(border_3.a)
python_3 = GhPythonScript(v=mesh_input_3.v, guideCrv=crv_5)  # -> out, Indices, Vertices; inputs v: list of Point3d, guideCrv: Curve; same code as python
number_slider_13 = Slider(5, range=0..10)  # disabled
weightload_3 = WeightLoad(mass=number_slider_13, v=mesh_input_3.v)  # disabled
external_load_3 = Data(weightload_3)  # disabled

panel_4 = Panel(move.Geometry)
points_in_a_band_3 = GhPythonScript(v=P_3, selectionCurves=selectionregions_3)  # -> out, inBandVertices, inBandIndices; inputs v: list of Point3d, selectionCurves: list of Curve; same code as points_in_a_band_2
points_in_a_band_4 = GhPythonScript(v=P_3, selectionCurves=item)  # -> out, inBandVertices, inBandIndices; inputs v: list of Point3d, selectionCurves: list of Curve; same code as points_in_a_band_2

# ---- group: Create column extrusion (continued)
wbedges_4 = WeaverbirdsMeshEdges(MeshOrPolylines=mesh_10)

# ----
mesh_11 = Mesh(mesh_10)  # disabled
pt_3 = Point(points_in_a_band_3.inBandVertices)  # disabled
pt_4 = Point(points_in_a_band_4.inBandVertices)  # disabled
number_slider_14 = Slider(56235, range=0..100000)  # disabled
number_slider_15 = Slider(0.86, range=0..1)  # disabled
number_slider_16 = Slider(2, range=0..10)  # disabled
number_slider_17 = Slider(0.1, range=0..0.1)  # disabled
number_slider_18 = Slider(5000, range=0..10000)  # disabled
anchor_3 = Anchor(Point=pt_4, Strength=number_slider_14)  # disabled
edgelengths_3 = EdgeLengths(Mesh=mesh_11, LengthFactor=number_slider_15, Strength=number_slider_16)  # disabled
anchor_4 = Anchor(Point=pt_3, Strength=number_slider_18)  # disabled
vertexloads_3 = VertexLoads(Mesh=mesh_11, Strength=number_slider_17)  # disabled
show_3 = Show(G=mesh_11)  # disabled
toggle_3 = BooleanToggle(False)  # disabled
button_3 = Button()  # disabled
solver_3 = Solver(
    GoalObjects=[edgelengths_3, anchor_4, vertexloads_3, show_3, anchor_3],
    Reset=button_3,
    Threshold=1e-15,
    Tolerance=0.01,
    On=toggle_3)  # -> I, V, O; disabled
panel_5 = Panel("0")  # disabled
data_2 = Data(solver_3.O)  # disabled

branch_3 = TreeBranch(Tree=flatten(solver_3.O), Path=panel_5, MaintainPaths=True)

# ==== cluster WeightLoad
mass = ClusterInput()
v = ClusterInput()
panel = Panel("{0.0,0.0,9.81]")
mass_2 = Number(mass)
v_2 = Point(v)
lng = ListLength(List=v_2)
repeat = RepeatData(Data=<missing>, Length=lng)
weightload = Vector(repeat)
weightload_2 = ClusterOutput(weightload)
