# Grasshopper definition Workshops_domes.gh (Grasshopper 1.0.7)
# plug-ins: Weaverbird, Kangaroo2 Components

# ---- group: Mesh division
surface = Brep([<brep referenced from the Rhino model> x21])
mesh = MeshBrep(
    Brep=surface,
    Settings={GridMaxCount=0, GridMinCount=16, JaggedSeams=True, MaxEdgeLength=0, MinEdgeLength=0.0001, MinTolerance=0, Refine=True, RefineAngle=0, RelativeTolerance=0.65, SimplePlanes=True, Tolerance=0})
wbsplitquads = WeaverbirdsConstantQuadsSplitSubdivision(MeshCurves=mesh, Level=Slider(2, range=1..10), SmoothNakedEdges="0.4")  # -> flatten(OutputMeshCurves)
wbedges = WeaverbirdsMeshEdges(MeshOrPolylines=wbsplitquads)
wbsplitquads_2 = WeaverbirdsConstantQuadsSplitSubdivision(MeshCurves=wbsplitquads, Level=Slider(2, range=1..10), SmoothNakedEdges="0.4")  # -> flatten(OutputMeshCurves)
wbedges_2 = WeaverbirdsMeshEdges(MeshOrPolylines=wbsplitquads_2)
mesh_2 = Mesh(wbsplitquads_2)

# ---- group: Anchor point selection
nakedvertices = NakedVertices(Mesh=wbsplitquads_2)  # -> ClothedIndex, NakedIndex, ClothedPts, NakedPts
anchor_lines = Curve([<curve referenced from the Rhino model> x3])
P = Point([nakedvertices.ClothedPts, nakedvertices.NakedPts])
points_in_a_band = GhPythonScript(v=P, selectionCurves=anchor_lines)  # -> out, inBandVertices, inBandIndices; inputs v: list of Point3d, selectionCurves: list of Curve
# ---------- points_in_a_band: Python ----------
__author__ = "pnourian"
__version__ = "2020.08.21"

import rhinoscriptsyntax as rs
import Rhino.Geometry as rg
tolerance=10E-3
chosenVertices=[]
chosenIndices=[]
for i in range(v.Count):#vertex in v:
    vertex=v[i]
    #these are all the points coming from other script
    chosen=False
    for j in range(selectionCurves.Count):
        #insideInside=(selectionCurves[j].Contains(vertex, rg.Plane.WorldXY,tolerance)==rg.PointContainment.Inside)
        a = rg.Curve.ClosestPoint(selectionCurves[j],vertex,tolerance)
        print(a)
        if a[0]==False:
                continue
        else:
            chosenVertices.append(vertex)
            chosenIndices.append(i)
    #if chosen:
        #chosenVertices.append(vertex)
        #chosenIndices.append(i)
inBandVertices=chosenVertices
inBandIndices=chosenIndices
# ---------- end points_in_a_band ----------
point = Point(points_in_a_band.inBandVertices)

# ---- group: Dynamic relaxation through kangaroo solver
edgelengths = EdgeLengths(Mesh=mesh_2, LengthFactor=1, Strength=Slider(110, range=0..1000))
vertexloads = VertexLoads(Mesh=mesh_2, Strength=Slider(1, range=0..10))
show = Show(G=mesh_2)
anchor = Anchor(Point=point, Strength=Slider(5000, range=0..5000))
solver = Solver(GoalObjects=[show, edgelengths, anchor, vertexloads], Reset=Button(), Threshold=1e-15, Tolerance=0.01, On=Toggle(False))  # -> I, V, graft(O)
list_item = ListItem(List=solver.O, Index=0, Wrap=True)
