# Grasshopper definition Brick_laying_wall.gh (Grasshopper 1.0.7)
# plug-ins: LunchBox

# ---- group: Input Brick size
# Always start at default origin in rhino
number_slider = Slider(29, range=0..100)
number_slider_2 = Slider(14, range=0..30)
number_slider_3 = Slider(6.5, range=0..10)
brick_height = Data(number_slider_3)
brick_depth = Data(number_slider_2)
brick_width = Data(number_slider)

# ---- group: Input corner Y Axis
# Surface with the same lenght as the thickness of the wall. Positioned on the right side (looking from inside the room) of the main surface. The origin should be on the botom left.
# Curve of half of the surface furthest away from main surface. Start the curve in the middle of the botom.
input_surface = Brep(<brep referenced from the Rhino model>)
input_curve = Curve(<curve referenced from the Rhino model>)

# ---- group: Input corner X Axis
# Surface with the same lenght as the thickness of the wall. Positioned on the right side (looking from inside the room) of the main surface. The origin should be on the botom left.
# Curve of half of the surface furthest away from main surface. Start the curve in the middle of the botom.
input_surface_2 = Brep(<brep referenced from the Rhino model>)
input_curve_2 = Curve(<curve referenced from the Rhino model>)

# ---- group: Input wall Y Axis
# To have the correct input surface subtract the thickness of the wall 2 times the lenght. That is the input_surface. The origin point should be on the botom near the input_curve.
# To delete the extra points on the left side (looking from inside the room) a closed curve needs to be created with the thickness of the wall
input_surface_3 = Brep(<brep referenced from the Rhino model>)
input_curve_3 = Curve(<curve referenced from the Rhino model>)

# ---- group: Input wall X Axis
# To have the correct input surface subtract the thickness of the wall 2 times the lenght. That is the input_surface. The origin point should be on the botom near the input_curve.
# To delete the extra points on the left side (looking from inside the room) a closed curve needs to be created with the thickness of the wall
input_surface_4 = Brep(<brep referenced from the Rhino model>)
input_curve_4 = Curve(<curve referenced from the Rhino model>)

# ----
brick_height_2 = Data(brick_height)
Z = UnitZ(Factor=1)
brick_height_3 = Data(brick_height)
contour = Contour(Shape=input_surface, Point=Point(0, 0, 0), Direction=Z, Distance=brick_height_2)  # -> flatten(Contours)
Z_2 = UnitZ(Factor=1)
brick_height_4 = Data(brick_height)
Z_3 = UnitZ(Factor=1)
brick_height_5 = Data(brick_height)
Z_4 = UnitZ(Factor=1)
contour_2 = Contour(Shape=input_surface_2, Point=Point(0, 0, 0), Direction=Z_2, Distance=brick_height_3)  # -> flatten(Contours)
contour_3 = Contour(Shape=input_surface_4, Point=Point(0, 0, 0), Direction=Z_3, Distance=brick_height_4)  # -> flatten(Contours)
contour_4 = Contour(Shape=input_surface_3, Point=Point(0, 0, 0), Direction=Z_4, Distance=brick_height_5)  # -> flatten(Contours)
python = GhPythonScript(BrickRows=contour)  # -> out, a; inputs BrickRows: list of Curve
# ---------- python: Python ----------
__author__ = "barba"
__version__ = "2020.10.21"

import rhinoscriptsyntax as rs
import Rhino.Geometry as rg
import math


for i in range(len(BrickRows)):
    if i % 2 == 0:
        print(i)
# ---------- end python ----------
python_2 = GhPythonScript(BrickRows=contour_2)  # -> out, a; inputs BrickRows: list of Curve
# ---------- python_2: Python ----------
__author__ = "barba"
__version__ = "2020.10.21"

import rhinoscriptsyntax as rs
import Rhino.Geometry as rg
import math


for i in range(len(BrickRows)):
    if i % 2 != 0:
        print(i)
# ---------- end python_2 ----------

python_3 = GhPythonScript(BrickRows=contour_3)  # -> out, a; inputs BrickRows: list of Curve; same code as python_2
brick_width_2 = Data(brick_width)
brick_height_6 = Data(brick_height)
sqr = Square(Value=brick_width_2)
sqr_2 = Square(Value=brick_height_6)
cull_i = CullIndex(List=contour_3, Indices=python_3.out, Wrap=True)
addition = Addition(A=sqr, B=sqr_2)
len = Length(Curve=cull_i)
sqrt = SquareRoot(Value=addition)
item = ListItem(List=len, Index=0, Wrap=True)
division = Division(A=item, B=sqrt)
divide = DivideCurve(Curve=flatten(cull_i), Count=flatten(division), Kinks=False, UseTasks=True)  # -> Points, Tangents, Parameters
input_curve_5 = Curve(input_curve_4)
point_in_curve = PointInCurve(Point=divide.Points, Curve=input_curve_5)  # -> Relationship, Point
smaller_than = SmallerThan(FirstNumber=point_in_curve.Relationship, SecondNumber="1")  # -> SmallerThan, OrEqualTo
cull_pattern = CullPattern(List=divide.Points, CullPattern=smaller_than.SmallerThan)
brick_height_7 = Data(number_slider_3)
brick_depth_2 = Data(number_slider_2)
brick_width_3 = Data(number_slider)
box = DomainBox(Base=cull_pattern, X=brick_width_3, Y=brick_depth_2, Z=brick_height_7)
rotate = Rotate(Geometry=box, Center=cull_pattern, From=Vector(1, 0, 0), To=divide.Tangents)  # -> Geometry, Transform
sort_brep = SortDuplicateBreps(Breps=rotate.Geometry)  # -> UniqueBreps, Indices

python_4 = GhPythonScript(BrickRows=contour_4)  # -> out, a; inputs BrickRows: list of Curve; same code as python
brick_height_8 = Data(brick_height)
brick_width_4 = Data(brick_width)
sqr_3 = Square(Value=brick_width_4)
sqr_4 = Square(Value=brick_height_8)
cull_i_2 = CullIndex(List=contour_4, Indices=python_4.out, Wrap=True)
len_2 = Length(Curve=cull_i_2)
addition_2 = Addition(A=sqr_3, B=sqr_4)
sqrt_2 = SquareRoot(Value=addition_2)
item_2 = ListItem(List=len_2, Index=0, Wrap=True)
division_2 = Division(A=item_2, B=sqrt_2)
divide_2 = DivideCurve(Curve=flatten(cull_i_2), Count=flatten(division_2), Kinks=False)  # -> Points, Tangents, Parameters
input_curve_6 = Curve(input_curve_3)
point_in_curve_2 = PointInCurve(Point=divide_2.Points, Curve=input_curve_6)  # -> Relationship, Point
smaller_than_2 = SmallerThan(FirstNumber=point_in_curve_2.Relationship, SecondNumber="1")  # -> SmallerThan, OrEqualTo
cull_pattern_2 = CullPattern(List=divide_2.Points, CullPattern=smaller_than_2.SmallerThan)
brick_height_9 = Data(brick_height)
brick_depth_3 = Data(brick_depth)
brick_width_5 = Data(brick_width)
box_2 = DomainBox(Base=cull_pattern_2, X=brick_width_5, Y=brick_depth_3, Z=brick_height_9)
rotate_2 = Rotate(Geometry=box_2, Center=cull_pattern_2, From=Vector(1, 0, 0), To=divide_2.Tangents)  # -> Geometry, Transform
sort_brep_2 = SortDuplicateBreps(Breps=rotate_2.Geometry)  # -> UniqueBreps, Indices

cull_i_3 = CullIndex(List=contour, Indices=python.out, Wrap=True)

python_5 = GhPythonScript(BrickRows=contour_3)  # -> out, a; inputs BrickRows: list of Curve; same code as python
cull_i_4 = CullIndex(List=contour_3, Indices=python_5.out, Wrap=True)
len_3 = Length(Curve=cull_i_4)
brick_depth_4 = Data(brick_depth)
item_3 = ListItem(List=len_3, Index=0, Wrap=True)
addition_3 = Addition(A=brick_depth_4, B=1)
division_3 = Division(A=item_3, B=addition_3)
division_4 = Division(A=addition_3, B=2)
divide_3 = DivideCurve(Curve=flatten(cull_i_4), Count=flatten(division_3), Kinks=False)  # -> Points, Tangents, Parameters
neg = Negative(Value=division_4)
vec = VectorXYZ(XComponent=neg, YComponent=0, ZComponent=0)  # -> Vector, Length
brick_height_10 = Data(number_slider_3)
brick_depth_5 = Data(number_slider_2)
brick_width_6 = Data(number_slider)
box_3 = DomainBox(Base=divide_3.Points, X=brick_depth_5, Y=brick_width_6, Z=brick_height_10)
move = Move(Geometry=box_3, Motion=vec.Vector)  # -> Geometry, Transform
rotate_3 = Rotate(Geometry=move.Geometry, Center=divide_3.Points, From=Vector(1, 0, 0), To=divide_3.Tangents)  # -> Geometry, Transform

python_6 = GhPythonScript(BrickRows=contour_4)  # -> out, a; inputs BrickRows: list of Curve; same code as python_2
cull_i_5 = CullIndex(List=contour_4, Indices=python_6.out, Wrap=True)
brick_depth_6 = Data(brick_depth)
len_4 = Length(Curve=cull_i_5)
addition_4 = Addition(A=brick_depth_6, B=1)
item_4 = ListItem(List=len_4, Index=0, Wrap=True)
division_5 = Division(A=item_4, B=addition_4)
division_6 = Division(A=addition_4, B=2)
divide_4 = DivideCurve(Curve=flatten(cull_i_5), Count=flatten(division_5), Kinks=False)  # -> Points, Tangents, Parameters
neg_2 = Negative(Value=division_6)
vec_2 = VectorXYZ(XComponent=neg_2, YComponent=0, ZComponent=0)  # -> Vector, Length
brick_height_11 = Data(brick_height)
brick_depth_7 = Data(brick_depth)
brick_width_7 = Data(brick_width)
box_4 = DomainBox(Base=divide_4.Points, X=brick_depth_7, Y=brick_width_7, Z=brick_height_11)
move_2 = Move(Geometry=box_4, Motion=vec_2.Vector)  # -> Geometry, Transform
rotate_4 = Rotate(Geometry=move_2.Geometry, Center=divide_4.Points, From=Vector(1, 0, 0), To=divide_4.Tangents)  # -> Geometry, Transform

cull_i_6 = CullIndex(List=contour_2, Indices=python_2.out, Wrap=True)
len_5 = Length(Curve=cull_i_3)

brick_depth_8 = Data(brick_depth)
addition_5 = Addition(A=brick_depth_8, B=1)
division_7 = Division(A=len_5, B=addition_5)
divide_5 = DivideCurve(Curve=flatten(cull_i_3), Count=flatten(division_7), Kinks=False)  # -> Points, Tangents, Parameters
input_curve_7 = Curve(input_curve)
point_in_curve_3 = PointInCurve(Point=divide_5.Points, Curve=input_curve_7)  # -> Relationship, Point
smaller_than_3 = SmallerThan(FirstNumber=point_in_curve_3.Relationship, SecondNumber="1")  # -> SmallerThan, OrEqualTo
brick_depth_9 = Data(brick_depth)
cull_pattern_3 = CullPattern(List=divide_5.Points, CullPattern=smaller_than_3.SmallerThan)
addition_6 = Addition(A=brick_depth_9, B=1)
input_surface_5 = Brep(input_surface)
neg_3 = Negative(Value=addition_6)
pt = PointOriented(BasePlane=input_surface_5, UComponent=0, VComponent=1, WComponent=neg_3)
deplane = DeconstructPlane(Plane=input_surface_5)  # -> Origin, XAxis, YAxis, ZAxis
vec2pt = Vector2Pt(PointA=deplane.Origin, PointB=pt, Unitize=False)  # -> Vector, Length
move_3 = Move(Geometry=cull_pattern_3, Motion=vec2pt.Vector)  # -> Geometry, Transform
brick_height_12 = Data(brick_height)
brick_depth_10 = Data(brick_depth)
brick_width_8 = Data(brick_width)
box_5 = DomainBox(Base=move_3.Geometry, X=brick_width_8, Y=brick_depth_10, Z=brick_height_12)

len_6 = Length(Curve=cull_i_6)

brick_depth_11 = Data(brick_depth)
addition_7 = Addition(A=brick_depth_11, B=1)
division_8 = Division(A=len_6, B=addition_7)
divide_6 = DivideCurve(Curve=flatten(cull_i_6), Count=flatten(division_8), Kinks=False)  # -> Points, Tangents, Parameters
input_curve_8 = Curve(input_curve_2)
point_in_curve_4 = PointInCurve(Point=divide_6.Points, Curve=input_curve_8)  # -> Relationship, Point
smaller_than_4 = SmallerThan(FirstNumber=point_in_curve_4.Relationship, SecondNumber="1")  # -> SmallerThan, OrEqualTo
brick_depth_12 = Data(brick_depth)
cull_pattern_4 = CullPattern(List=divide_6.Points, CullPattern=smaller_than_4.SmallerThan)
addition_8 = Addition(A=brick_depth_12, B=1)
input_surface_6 = Brep(input_surface_2)
neg_4 = Negative(Value=addition_8)
pt_2 = PointOriented(BasePlane=input_surface_6, UComponent=0, VComponent=addition_8, WComponent=neg_4)
deplane_2 = DeconstructPlane(Plane=input_surface_6)  # -> Origin, XAxis, YAxis, ZAxis
vec2pt_2 = Vector2Pt(PointA=deplane_2.Origin, PointB=pt_2, Unitize=False)  # -> Vector, Length
move_4 = Move(Geometry=cull_pattern_4, Motion=vec2pt_2.Vector)  # -> Geometry, Transform
brick_height_13 = Data(brick_height)
brick_depth_13 = Data(brick_depth)
brick_width_9 = Data(brick_width)
box_6 = DomainBox(Base=move_4.Geometry, X=brick_depth_13, Y=brick_width_9, Z=brick_height_13)

brick_width_10 = Data(brick_width)
addition_9 = Addition(A=brick_width_10, B=1)
input_curve_9 = Curve(input_curve)
division_9 = Division(A=len_5, B=addition_9)
explode = Explode(Curve=input_curve_9, Recursive=True)  # -> Segments, Vertices
divide_7 = DivideCurve(Curve=flatten(cull_i_3), Count=flatten(division_9), Kinks=False)  # -> Points, Tangents, Parameters
item_5 = ListItem(List=explode.Vertices, Index=3, Wrap=True)
pl = ConstructPlane(Origin=item_5, XAxis=Vector(1, 0, 0), YAxis=Vector(0, 1, 0))
rotate_5 = Rotate(Geometry=input_curve_9, Angle=degrees(180), Plane=pl)  # -> Geometry, Transform
point_in_curve_5 = PointInCurve(Point=divide_7.Points, Curve=rotate_5.Geometry)  # -> Relationship, Point
smaller_than_5 = SmallerThan(FirstNumber=point_in_curve_5.Relationship, SecondNumber="1")  # -> SmallerThan, OrEqualTo
cull_pattern_5 = CullPattern(List=divide_7.Points, CullPattern=smaller_than_5.SmallerThan)
input_surface_7 = Brep(input_surface)
pt_3 = PointOriented(BasePlane=input_surface_7, UComponent=0, VComponent=1, WComponent=0)
deplane_3 = DeconstructPlane(Plane=input_surface_7)  # -> Origin, XAxis, YAxis, ZAxis
vec2pt_3 = Vector2Pt(PointA=deplane_3.Origin, PointB=pt_3, Unitize=False)  # -> Vector, Length
move_5 = Move(Geometry=cull_pattern_5, Motion=vec2pt_3.Vector)  # -> Geometry, Transform
brick_height_14 = Data(brick_height)
brick_depth_14 = Data(brick_depth)
brick_width_11 = Data(brick_width)
box_7 = DomainBox(Base=move_5.Geometry, X=brick_depth_14, Y=brick_width_11, Z=brick_height_14)

brick_depth_15 = Data(brick_depth)
subtraction = Subtraction(A=brick_depth_15, B=1)
brick_height_15 = Data(brick_height)
end = EndPoints(Curve=cull_i_3)  # -> Start, End
division_10 = Division(A=subtraction, B=2)
brick_width_12 = Data(brick_width)
box_8 = DomainBox(Base=end.Start, X=division_10, Y=brick_width_12, Z=brick_height_15)
brick_depth_16 = Data(brick_depth)
brick_width_13 = Data(brick_width)
addition_10 = Addition(A=brick_depth_16, B=1)
input_surface_8 = Brep(input_surface)
neg_5 = Negative(Value=addition_10)
neg_6 = Negative(Value=brick_width_13)
pt_4 = PointOriented(BasePlane=input_surface_8, UComponent=0, VComponent=neg_6, WComponent=neg_5)
deplane_4 = DeconstructPlane(Plane=input_surface_8)  # -> Origin, XAxis, YAxis, ZAxis
vec2pt_4 = Vector2Pt(PointA=deplane_4.Origin, PointB=pt_4, Unitize=False)  # -> Vector, Length
move_6 = Move(Geometry=box_8, Motion=vec2pt_4.Vector)  # -> Geometry, Transform

brick_width_14 = Data(brick_width)
addition_11 = Addition(A=brick_width_14, B=1)
division_11 = Division(A=len_6, B=addition_11)
divide_8 = DivideCurve(Curve=flatten(cull_i_6), Count=flatten(division_11), Kinks=False)  # -> Points, Tangents, Parameters
input_curve_10 = Curve(input_curve_2)
explode_2 = Explode(Curve=input_curve_10, Recursive=True)  # -> Segments, Vertices
item_6 = ListItem(List=explode_2.Vertices, Index=2, Wrap=True)
pl_2 = ConstructPlane(Origin=item_6, XAxis=Vector(1, 0, 0), YAxis=Vector(0, 1, 0))
rotate_6 = Rotate(Geometry=input_curve_10, Angle=degrees(180), Plane=pl_2)  # -> Geometry, Transform
point_in_curve_6 = PointInCurve(Point=divide_8.Points, Curve=rotate_6.Geometry)  # -> Relationship, Point
smaller_than_6 = SmallerThan(FirstNumber=point_in_curve_6.Relationship, SecondNumber="1")  # -> SmallerThan, OrEqualTo
cull_pattern_6 = CullPattern(List=divide_8.Points, CullPattern=smaller_than_6.SmallerThan)
input_surface_9 = Brep(input_surface_2)
pt_5 = PointOriented(BasePlane=input_surface_9, UComponent=0, VComponent=0, WComponent=-1)
deplane_5 = DeconstructPlane(Plane=input_surface_9)  # -> Origin, XAxis, YAxis, ZAxis
vec2pt_5 = Vector2Pt(PointA=deplane_5.Origin, PointB=pt_5, Unitize=False)  # -> Vector, Length
move_7 = Move(Geometry=cull_pattern_6, Motion=vec2pt_5.Vector)  # -> Geometry, Transform
brick_height_16 = Data(brick_height)
brick_depth_17 = Data(brick_depth)
brick_width_15 = Data(brick_width)
box_9 = DomainBox(Base=move_7.Geometry, X=brick_depth_17, Y=brick_width_15, Z=brick_height_16)
rotate_7 = Rotate(Geometry=box_9, Center=cull_pattern_6, From=Vector(1, 0, 0), To=vec2pt_5.Vector)  # -> Geometry, Transform

divide_9 = DivideCurve(Curve=flatten(cull_i_2), Count=flatten(division_5), Kinks=False)  # -> Points, Tangents, Parameters
input_curve_11 = Curve(input_curve_3)
point_in_curve_7 = PointInCurve(Point=divide_9.Points, Curve=input_curve_11)  # -> Relationship, Point
smaller_than_7 = SmallerThan(FirstNumber=point_in_curve_7.Relationship, SecondNumber="1")  # -> SmallerThan, OrEqualTo
cull_pattern_7 = CullPattern(List=divide_9.Points, CullPattern=smaller_than_7.SmallerThan)
brick_height_17 = Data(brick_height)
brick_depth_18 = Data(brick_depth)
brick_width_16 = Data(brick_width)
brick_depth_19 = Data(brick_depth)
box_10 = DomainBox(Base=cull_pattern_7, X=brick_depth_18, Y=brick_width_16, Z=brick_height_17)
addition_12 = Addition(A=brick_depth_19, B=1)
input_surface_10 = Brep(input_surface_3)
rotate_8 = Rotate(Geometry=box_10, Center=cull_pattern_7, From=Vector(1, 0, 0), To=divide_9.Tangents)  # -> Geometry, Transform
neg_7 = Negative(Value=addition_12)
pt_6 = PointOriented(BasePlane=input_surface_10, UComponent=0, VComponent=0, WComponent=neg_7)
deplane_6 = DeconstructPlane(Plane=input_surface_10)  # -> Origin, XAxis, YAxis, ZAxis
sort_brep_3 = SortDuplicateBreps(Breps=rotate_8.Geometry)  # -> UniqueBreps, Indices
vec2pt_6 = Vector2Pt(PointA=deplane_6.Origin, PointB=pt_6, Unitize=False)  # -> Vector, Length
move_8 = Move(Geometry=sort_brep_3.UniqueBreps, Motion=vec2pt_6.Vector)  # -> Geometry, Transform

divide_10 = DivideCurve(Curve=flatten(cull_i), Count=flatten(division_3), Kinks=False)  # -> Points, Tangents, Parameters
input_curve_12 = Curve(input_curve_4)
point_in_curve_8 = PointInCurve(Point=divide_10.Points, Curve=input_curve_12)  # -> Relationship, Point
smaller_than_8 = SmallerThan(FirstNumber=point_in_curve_8.Relationship, SecondNumber="1")  # -> SmallerThan, OrEqualTo
cull_pattern_8 = CullPattern(List=divide_10.Points, CullPattern=smaller_than_8.SmallerThan)
brick_height_18 = Data(number_slider_3)
brick_depth_20 = Data(number_slider_2)
brick_width_17 = Data(number_slider)
brick_depth_21 = Data(number_slider_2)
box_11 = DomainBox(Base=cull_pattern_8, X=brick_depth_20, Y=brick_width_17, Z=brick_height_18)
addition_13 = Addition(A=brick_depth_21, B=1)
input_surface_11 = Brep(input_surface_4)
rotate_9 = Rotate(Geometry=box_11, Center=cull_pattern_8, From=Vector(1, 0, 0), To=divide_10.Tangents)  # -> Geometry, Transform
neg_8 = Negative(Value=addition_13)
pt_7 = PointOriented(BasePlane=input_surface_11, UComponent=0, VComponent=0, WComponent=neg_8)
deplane_7 = DeconstructPlane(Plane=input_surface_11)  # -> Origin, XAxis, YAxis, ZAxis
sort_brep_4 = SortDuplicateBreps(Breps=rotate_9.Geometry)  # -> UniqueBreps, Indices
vec2pt_7 = Vector2Pt(PointA=deplane_7.Origin, PointB=pt_7, Unitize=False)  # -> Vector, Length
move_9 = Move(Geometry=sort_brep_4.UniqueBreps, Motion=vec2pt_7.Vector)  # -> Geometry, Transform

brick_width_18 = Data(number_slider)
addition_14 = Addition(A=brick_width_18, B=1)
input_surface_12 = Brep(input_surface_4)
neg_9 = Negative(Value=addition_14)
pt_8 = PointOriented(BasePlane=input_surface_12, UComponent=0, VComponent=0, WComponent=neg_9)
deplane_8 = DeconstructPlane(Plane=input_surface_12)  # -> Origin, XAxis, YAxis, ZAxis
vec2pt_8 = Vector2Pt(PointA=deplane_8.Origin, PointB=pt_8, Unitize=False)  # -> Vector, Length
move_10 = Move(Geometry=rotate_3.Geometry, Motion=vec2pt_8.Vector)  # -> Geometry, Transform

brick_width_19 = Data(brick_width)
addition_15 = Addition(A=brick_width_19, B=1)
input_surface_13 = Brep(input_surface_3)
neg_10 = Negative(Value=addition_15)
pt_9 = PointOriented(BasePlane=input_surface_13, UComponent=0, VComponent=0, WComponent=neg_10)
deplane_9 = DeconstructPlane(Plane=input_surface_13)  # -> Origin, XAxis, YAxis, ZAxis
vec2pt_9 = Vector2Pt(PointA=deplane_9.Origin, PointB=pt_9, Unitize=False)  # -> Vector, Length
move_11 = Move(Geometry=rotate_4.Geometry, Motion=vec2pt_9.Vector)  # -> Geometry, Transform

brick_width_20 = Data(brick_width)
addition_16 = Addition(A=brick_width_20, B=1)
input_surface_14 = Brep(input_surface)
neg_11 = Negative(Value=addition_16)
deplane_10 = DeconstructPlane(Plane=input_surface_14)  # -> Origin, XAxis, YAxis, ZAxis
pt_10 = PointOriented(BasePlane=input_surface_14, UComponent=0, VComponent=neg_11, WComponent=neg_11)
vec2pt_10 = Vector2Pt(PointA=deplane_10.Origin, PointB=pt_10, Unitize=False)  # -> Vector, Length
move_12 = Move(Geometry=move_6.Geometry, Motion=vec2pt_10.Vector)  # -> Geometry, Transform

brick_height_19 = Data(brick_height)
brick_depth_22 = Data(brick_depth)
input_curve_13 = Curve(input_curve)
addition_17 = Addition(A=brick_depth_22, B=brick_height_19, C=2)
input_surface_15 = Brep(input_surface)
explode_3 = Explode(Curve=input_curve_13, Recursive=True)  # -> Segments, Vertices
neg_12 = Negative(Value=addition_17)
neg_13 = Negative(Value=brick_depth_22)
pt_11 = PointOriented(BasePlane=input_surface_15, UComponent=0, VComponent=neg_13, WComponent=neg_12)
deplane_11 = DeconstructPlane(Plane=input_surface_15)  # -> Origin, XAxis, YAxis, ZAxis
item_7 = ListItem(List=explode_3.Segments, Index=0, Wrap=True)
rotax = RotateAxis(Geometry=box_5, Angle=degrees(90), Axis=item_7)  # -> Geometry, Transform
vec2pt_11 = Vector2Pt(PointA=deplane_11.Origin, PointB=pt_11, Unitize=False)  # -> Vector, Length
move_13 = Move(Geometry=rotax.Geometry, Motion=vec2pt_11.Vector)  # -> Geometry, Transform

brick_depth_23 = Data(brick_depth)
brick_width_21 = Data(brick_width)
addition_18 = Addition(A=brick_depth_23, B=brick_width_21, C=2)
input_surface_16 = Brep(input_surface_3)
neg_14 = Negative(Value=addition_18)
pt_12 = PointOriented(BasePlane=input_surface_16, UComponent=0, VComponent=0, WComponent=neg_14)
deplane_12 = DeconstructPlane(Plane=input_surface_16)  # -> Origin, XAxis, YAxis, ZAxis
vec2pt_12 = Vector2Pt(PointA=deplane_12.Origin, PointB=pt_12, Unitize=False)  # -> Vector, Length
move_14 = Move(Geometry=sort_brep_2.UniqueBreps, Motion=vec2pt_12.Vector)  # -> Geometry, Transform

brick_depth_24 = Data(number_slider_2)
brick_width_22 = Data(number_slider)
addition_19 = Addition(A=brick_depth_24, B=brick_width_22, C=2)
input_surface_17 = Brep(input_surface_4)
neg_15 = Negative(Value=addition_19)
pt_13 = PointOriented(BasePlane=input_surface_17, UComponent=0, VComponent=0, WComponent=neg_15)
deplane_13 = DeconstructPlane(Plane=input_surface_17)  # -> Origin, XAxis, YAxis, ZAxis
vec2pt_13 = Vector2Pt(PointA=deplane_13.Origin, PointB=pt_13, Unitize=False)  # -> Vector, Length
move_15 = Move(Geometry=sort_brep.UniqueBreps, Motion=vec2pt_13.Vector)  # -> Geometry, Transform

brick_depth_25 = Data(brick_depth)
brick_width_23 = Data(brick_width)
brick_height_20 = Data(brick_height)
input_curve_14 = Curve(input_curve_2)
addition_20 = Addition(A=brick_width_23, B=brick_depth_25, C=1)
addition_21 = Addition(A=brick_height_20, B=1)
input_surface_18 = Brep(input_surface_2)
neg_16 = Negative(Value=addition_20)
explode_4 = Explode(Curve=input_curve_14, Recursive=True)  # -> Segments, Vertices
item_8 = ListItem(List=explode_4.Segments, Index=2, Wrap=True)
pt_14 = PointOriented(BasePlane=input_surface_18, UComponent=0, VComponent=neg_16, WComponent=addition_21)
deplane_14 = DeconstructPlane(Plane=input_surface_18)  # -> Origin, XAxis, YAxis, ZAxis
rotax_2 = RotateAxis(Geometry=box_6, Angle=-1.570796327, Axis=item_8)  # -> Geometry, Transform
vec2pt_14 = Vector2Pt(PointA=deplane_14.Origin, PointB=pt_14, Unitize=False)  # -> Vector, Length
move_16 = Move(Geometry=rotax_2.Geometry, Motion=vec2pt_14.Vector)  # -> Geometry, Transform

brep = Brep([move_13.Geometry, box_5, move_12.Geometry, move_6.Geometry, box_7])

brick_width_24 = Data(brick_width)
multiplication = Multiplication(A=brick_width_24, B=2)
addition_22 = Addition(A=multiplication, B=2)
input_surface_19 = Brep(input_surface)
brick_height_21 = Data(brick_height)
neg_17 = Negative(Value=addition_22)
pt_15 = PointOriented(BasePlane=input_surface_19, UComponent=brick_height_21, VComponent=addition_22, WComponent=neg_17)
mirror = Mirror(Geometry=brep, Plane=PlaneYZ(0, 0, 0))  # -> Geometry, Transform
deplane_15 = DeconstructPlane(Plane=input_surface_19)  # -> Origin, XAxis, YAxis, ZAxis
rotate_10 = Rotate(Geometry=mirror.Geometry, Angle=1.570796327, Plane=deplane_15.Origin)  # -> Geometry, Transform
vec2pt_15 = Vector2Pt(PointA=deplane_15.Origin, PointB=pt_15, Unitize=False)  # -> Vector, Length
move_17 = Move(Geometry=rotate_10.Geometry, Motion=vec2pt_15.Vector)  # -> Geometry, Transform

# ---- group: Output Wall Y Axis
brep_2 = Brep([move_14.Geometry, rotate_4.Geometry, move_11.Geometry, move_8.Geometry, sort_brep_2.UniqueBreps])

# ---- group: Output Wall X Axis
brep_3 = Brep([move_15.Geometry, rotate_3.Geometry, move_10.Geometry, move_9.Geometry, sort_brep.UniqueBreps])

# ---- group: Output Corner Y Axis
brep_4 = Brep([brep, move_17.Geometry])

# ---- group: Output Y Axis
brep_5 = Brep([brep_2, brep_4])

# ----
input_surface_corner_xaxis = Brep(input_surface_2)
input_surface_wall_xaxis = Brep(input_surface_4)
edges = BrepEdges(Brep=input_surface_corner_xaxis)  # -> Naked, Interior, NonManifold
edges_2 = BrepEdges(Brep=input_surface_wall_xaxis)  # -> Naked, Interior, NonManifold
item_9 = ListItem(List=edges.Naked, Index=0, Wrap=True)
item_10 = ListItem(List=edges_2.Naked, Index=0, Wrap=True)
len_7 = Length(Curve=item_9)
len_8 = Length(Curve=item_10)
multiplication_2 = Multiplication(A=len_7, B=2)
addition_23 = Addition(A=len_8, B=multiplication_2)
neg_18 = Negative(Value=addition_23)

input_surface_wall_yaxis = Brep(input_surface_3)
edges_3 = BrepEdges(Brep=input_surface_wall_yaxis)  # -> Naked, Interior, NonManifold
item_11 = ListItem(List=edges_3.Naked, Index=0, Wrap=True)
len_9 = Length(Curve=item_11)
addition_24 = Addition(A=multiplication_2, B=len_9)
neg_19 = Negative(Value=addition_24)

input_surface_20 = Brep(input_surface_4)
pt_16 = PointOriented(BasePlane=input_surface_20, UComponent=0, VComponent=neg_18, WComponent=neg_19)
deplane_16 = DeconstructPlane(Plane=input_surface_20)  # -> Origin, XAxis, YAxis, ZAxis
vec2pt_16 = Vector2Pt(PointA=deplane_16.Origin, PointB=pt_16, Unitize=False)  # -> Vector, Length

brick_depth_26 = Data(brick_depth)
subtraction_2 = Subtraction(A=brick_depth_26, B=1)
brick_height_22 = Data(brick_height)
brick_width_25 = Data(brick_width)
division_12 = Division(A=subtraction_2, B=2)
end_2 = EndPoints(Curve=cull_i_6)  # -> Start, End
brick_width_26 = Data(brick_width)
box_12 = DomainBox(Base=end_2.Start, X=division_12, Y=brick_width_25, Z=brick_height_22)
brick_depth_27 = Data(brick_depth)
addition_25 = Addition(A=brick_depth_27, B=brick_width_26, C=2)
rotate_11 = Rotate(Geometry=box_12, Center=end_2.Start, From=Vector(1, 0, 0), To=Vector(0, 1, 0))  # -> Geometry, Transform
input_surface_21 = Brep(input_surface_2)
neg_20 = Negative(Value=addition_25)
deplane_17 = DeconstructPlane(Plane=input_surface_21)  # -> Origin, XAxis, YAxis, ZAxis

multiplication_3 = Multiplication(A=brick_width_26, B=2)
addition_26 = Addition(A=multiplication_3, B=1)
neg_21 = Negative(Value=addition_26)

pt_17 = PointOriented(BasePlane=input_surface_21, UComponent=0, VComponent=neg_21, WComponent=neg_20)
vec2pt_17 = Vector2Pt(PointA=deplane_17.Origin, PointB=pt_17, Unitize=False)  # -> Vector, Length
move_18 = Move(Geometry=rotate_11.Geometry, Motion=vec2pt_17.Vector)  # -> Geometry, Transform

brick_depth_28 = Data(brick_depth)
brick_width_27 = Data(brick_width)
addition_27 = Addition(A=brick_depth_28, B=1)
input_surface_22 = Brep(input_surface_2)
neg_22 = Negative(Value=brick_width_27)
neg_23 = Negative(Value=addition_27)
pt_18 = PointOriented(BasePlane=input_surface_22, UComponent=0, VComponent=neg_22, WComponent=neg_23)
deplane_18 = DeconstructPlane(Plane=input_surface_22)  # -> Origin, XAxis, YAxis, ZAxis
vec2pt_18 = Vector2Pt(PointA=deplane_18.Origin, PointB=pt_18, Unitize=False)  # -> Vector, Length
move_19 = Move(Geometry=rotate_11.Geometry, Motion=vec2pt_18.Vector)  # -> Geometry, Transform

brep_6 = Brep([rotate_7.Geometry, move_16.Geometry, box_6, move_19.Geometry, move_18.Geometry])

brick_height_23 = Data(brick_height)
input_surface_23 = Brep(input_surface_2)
neg_24 = Negative(Value=brick_height_23)
pt_19 = PointOriented(BasePlane=input_surface_23, UComponent=neg_24, VComponent=0, WComponent=0)
deplane_19 = DeconstructPlane(Plane=input_surface_23)  # -> Origin, XAxis, YAxis, ZAxis
rotate_12 = Rotate(Geometry=brep_6, Angle=1.570796327, Plane=PlaneXY(0, 0, 0))  # -> Geometry, Transform
mirror_2 = Mirror(Geometry=rotate_12.Geometry, Plane=PlaneYZ(0, 0, 0))  # -> Geometry, Transform
vec2pt_19 = Vector2Pt(PointA=deplane_19.Origin, PointB=pt_19, Unitize=False)  # -> Vector, Length
move_20 = Move(Geometry=mirror_2.Geometry, Motion=vec2pt_19.Vector)  # -> Geometry, Transform

# ---- group: Output Corner X Axis
brep_7 = Brep([move_20.Geometry, brep_6])

# ---- group: Output X Axis
brep_8 = Brep([brep_7, brep_3])

# ----
rotate_13 = Rotate(Geometry=[brep_8, brep_5], Angle=3.141592654, Plane=PlaneXY(0, 0, 0))  # -> Geometry, Transform

# ---- group: Output 2nd X&Y axis walls
move_21 = Move(Geometry=rotate_13.Geometry, Motion=vec2pt_16.Vector)  # -> Geometry, Transform

# ---- group: Output walls room
brep_9 = Brep([brep_8, brep_5, move_21.Geometry])
