# Grasshopper definition Mashrabiya_Diagonal.gh (Grasshopper 1.0.7)
# plug-ins: LunchBox

# ---- group: Input Brick size
number_slider = Slider(14, range=0..30)
number_slider_2 = Slider(29, range=0..100)
number_slider_3 = Slider(6.5, range=0..10)
brick_height = Data(number_slider_3)
brick_depth = Data(number_slider)
brick_width = Data(number_slider_2)

# ----
# To have the correct input surface subtract the thickness of the wall 2 times the lenght. That is the input_surface. The origin point should be on the botom near the input_curve.
brep = Brep(<brep referenced from the Rhino model>)

# ---- group: Input wall X Axis
# To have the correct input surface subtract the thickness of the wall 2 times the lenght. That is the input_surface. The origin point should be on the botom near the input_curve.
input_surface = Brep(<brep referenced from the Rhino model>)

# ----
bbox = BoundingBox(Content=brep, Plane=PlaneXY(0, 0, 0))  # -> Box, Box_2

# ---- group: Input Brick size
number_slider_4 = Slider(0.1, range=0..0.1)
brick_width_2 = Data(Slider(0.3, range=0..1))
brick_depth_2 = Data(Slider(0.14, range=0..1))
brick_height_2 = Data(Slider(0.065, range=0..0.1))
mortar = Data(Slider(0, range=0..0.01))

# ----
debrep = DeconstructBrep(Brep=bbox.Box_2)  # -> Faces, Edges, Vertices

# ---- group: Input Brick size
number_slider_5 = Slider(6.5, range=0..30)
number_slider_6 = Slider(29, range=0..100)
number_slider_7 = Slider(6.5, range=0..10)
brick_height_3 = Data(number_slider_7)
brick_depth_3 = Data(number_slider_5)
brick_width_3 = Data(number_slider_6)

brick_height_4 = Data(Slider(6.5, range=0..10))
brick_depth_4 = Data(Slider(6.5, range=0..30))
brick_width_4 = Data(Slider(29, range=0..100))

# ----
# To have the correct input surface subtract the thickness of the wall 2 times the lenght. That is the input_surface. The origin point should be on the botom near the input_curve.
input_surface_2 = Brep(<brep referenced from the Rhino model>)
item = ListItem(List=debrep.Vertices, Index=Slider(1, range=0..10), Wrap=True)
item_2 = ListItem(List=debrep.Vertices, Index=Slider(0, range=0..10), Wrap=True)
item_3 = ListItem(List=debrep.Vertices, Index=Slider(4, range=0..10), Wrap=True)
ln = Line(StartPoint=item_2, EndPoint=item)
planesrf = PlaneSurface(Plane=PlaneXY(0, 0, 0), XSize=Domain(-10, 10), YSize=Domain(-10, 10))
planesrf_2 = PlaneSurface(Plane=PlaneXY(0, 0, 0), XSize=Domain(-10, 10), YSize=Domain(-10, 10))
brick_height_5 = Data(brick_height)
Z = UnitZ(Factor=1)
data = Data(ln)
ln_2 = Line(StartPoint=item_3, EndPoint=item_2)
edges = BrepEdges(Brep=input_surface_2)  # -> graft(Naked), Interior, NonManifold
contour = Contour(Shape=input_surface, Point=Point(0, 0, 0), Direction=Z, Distance=brick_height_5)  # -> flatten(Contours)
addition = Addition(A=brick_width_2, B=mortar)
area = Area(Geometry=planesrf)  # -> Area, Centroid
area_2 = Area(Geometry=planesrf_2)  # -> Area, Centroid
bang = ExplodeTree(Data=edges.Naked)  # -> Branch0, Branch1, Branch2, Branch3

python = GhPythonScript(BrickRows=contour)  # -> out, a; inputs BrickRows: list of Curve
# ---------- python: Python ----------
__author__ = "barba"
__version__ = "2020.10.21"

import rhinoscriptsyntax as rs
import Rhino.Geometry as rg
import math


for i in range(len(BrickRows)):
    if i % 2 == 0:
        print(i)
# ---------- end python ----------
cull_i = CullIndex(List=contour, Indices=python.out, Wrap=True)
python_2 = GhPythonScript(BrickRows=cull_i)  # -> out, a; inputs BrickRows: list of Curve; same code as python
cull_i_2 = CullIndex(List=cull_i, Indices=python_2.out, Wrap=True)
brick_depth_5 = Data(brick_depth)
len = Length(Curve=cull_i_2)
brick_width_5 = Data(number_slider_2)
item_4 = ListItem(List=len, Index=0, Wrap=True)
addition_2 = Addition(A=brick_width_5, B=1)
addition_3 = Addition(A=brick_depth_5, B=1)
division = Division(A=item_4, B=addition_2)
division_2 = Division(A=addition_3, B=2)
divide = DivideCurve(Curve=flatten(cull_i), Count=flatten(division), Kinks=False)  # -> Points, Tangents, Parameters
neg = Negative(Value=division_2)
vec = VectorXYZ(XComponent=neg, YComponent=0, ZComponent=0)  # -> Vector, Length
brick_height_6 = Data(number_slider_3)
brick_depth_6 = Data(number_slider)
brick_width_6 = Data(number_slider_2)
box = DomainBox(Base=divide.Points, X=brick_depth_6, Y=brick_width_6, Z=brick_height_6)
move = Move(Geometry=box, Motion=vec.Vector)  # -> Geometry, Transform

len_2 = Length(Curve=ln_2)
divide_2 = DivideCurve(Curve=data, Count=brick_width_2, Kinks=False)  # -> graft(Points), Tangents, Parameters
divide_3 = DivideCurve(Curve=data, Count=addition, Kinks=False)  # -> Points, Tangents, Parameters
move_2 = Move(Motion=area.Centroid)  # -> Geometry, Transform
divlength = DivideLength(Curve=data, Length=addition)  # -> Points, Tangents, Parameters
box_2 = DomainBox(Base=divlength.Points, X=brick_width_2, Y=brick_depth_2, Z=brick_height_2)
move_3 = Move(Geometry=input_surface_2, Motion=area_2.Centroid)  # -> Geometry, Transform
data_2 = Data(bang.Branch3)
len_3 = Length(Curve=data_2)
division_3 = Division(A=len_3, B=brick_width_3)

python_3 = GhPythonScript(BrickRows=contour)  # -> out, a; inputs BrickRows: list of Curve
# ---------- python_3: Python ----------
__author__ = "barba"
__version__ = "2020.10.21"

import rhinoscriptsyntax as rs
import Rhino.Geometry as rg
import math


for i in range(len(BrickRows)):
    if i % 2 != 0:
        print(i)
# ---------- end python_3 ----------
brick_width_7 = Data(brick_width)
brick_height_7 = Data(brick_height)
sqr = Square(Value=brick_width_7)
sqr_2 = Square(Value=brick_height_7)
cull_i_3 = CullIndex(List=contour, Indices=python_3.out, Wrap=True)
addition_4 = Addition(A=sqr, B=sqr_2)
len_4 = Length(Curve=cull_i_3)
sqrt = SquareRoot(Value=addition_4)
item_5 = ListItem(List=len_4, Index=0, Wrap=True)
division_4 = Division(A=item_5, B=sqrt)
divide_4 = DivideCurve(Curve=flatten(cull_i_3), Count=flatten(division_4), Kinks=False, UseTasks=True)  # -> Points, Tangents, Parameters
brick_height_8 = Data(number_slider_3)
brick_depth_7 = Data(number_slider)
brick_width_8 = Data(number_slider_2)
box_3 = DomainBox(Base=divide_4.Points, X=brick_width_8, Y=brick_depth_7, Z=brick_height_8)

python_4 = GhPythonScript(BrickRows=cull_i)  # -> out, a; inputs BrickRows: list of Curve; same code as python_3
cull_i_4 = CullIndex(List=cull_i, Indices=python_4.out, Wrap=True)
len_5 = Length(Curve=cull_i_4)
brick_depth_8 = Data(brick_depth)
item_6 = ListItem(List=len_5, Index=0, Wrap=True)
addition_5 = Addition(A=brick_depth_8, B=1)
division_5 = Division(A=item_6, B=addition_5)
division_6 = Division(A=addition_5, B=2)
divide_5 = DivideCurve(Curve=flatten(cull_i_4), Count=flatten(division_5), Kinks=False)  # -> Points, Tangents, Parameters
neg_2 = Negative(Value=division_6)
vec_2 = VectorXYZ(XComponent=neg_2, YComponent=0, ZComponent=0)  # -> Vector, Length
brick_height_9 = Data(number_slider_3)
brick_depth_9 = Data(number_slider)
brick_width_9 = Data(number_slider_2)
box_4 = DomainBox(Base=divide_5.Points, X=brick_depth_9, Y=brick_width_9, Z=brick_height_9)
move_4 = Move(Geometry=box_4, Motion=vec_2.Vector)  # -> Geometry, Transform

brick_height_10 = Data(brick_height_3)
brick_height_11 = Data(brick_height_3)
Z_2 = UnitZ(Factor=1)
Z_3 = UnitZ(Factor=1)
contour_2 = Contour(Shape=move_3.Geometry, Point=Point(0, 0, 0), Direction=Z_2, Distance=brick_height_10)  # -> flatten(Contours)
contour_3 = Contour(Shape=move_3.Geometry, Point=Point(0, 0, 0), Direction=Z_3, Distance=brick_height_11)  # -> flatten(Contours)
contour_4 = Contour(Shape=move_3.Geometry, Point=Point(0, 0, 0), Direction=Vector(0, 0, 1), Distance=13)  # -> flatten(Contours)
len_6 = Length(Curve=contour_2)  # -> flatten(Length)
len_7 = Length(Curve=contour_3)  # -> flatten(Length)
panel = Panel(contour_4)
subtraction = Subtraction(A=len_6, B=Slider(-8, range=-100..10))
subtraction_2 = Subtraction(A=len_7, B=Slider(-5, range=-100..10))

# ---- group: Get box geometry
brick_height_12 = Data(brick_height_4)
python_5 = GhPythonScript(BrickRows=contour_2)  # -> out, a; inputs BrickRows: list of Curve; same code as python_3
brick_width_10 = Data(brick_width_4)
sqr_3 = Square(Value=brick_width_10)
sqr_4 = Square(Value=brick_height_12)
cull_i_5 = CullIndex(List=contour_2, Indices=python_5.out, Wrap=True)
addition_6 = Addition(A=sqr_3, B=sqr_4)
len_8 = Length(Curve=cull_i_5)
sqrt_2 = SquareRoot(Value=addition_6)
item_7 = ListItem(List=len_8, Index=0, Wrap=True)
division_7 = Division(A=item_7, B=sqrt_2)
divide_6 = DivideCurve(Curve=flatten(cull_i_5), Count=flatten(division_7), Kinks=False, UseTasks=True)  # -> Points, Tangents, Parameters
brick_height_13 = Data(brick_height_4)
brick_depth_10 = Data(brick_depth_4)
brick_width_11 = Data(brick_width_4)
box_5 = DomainBox(Base=divide_6.Points, X=brick_width_11, Y=brick_depth_10, Z=brick_height_13)

# ----
number_slider_8 = Slider(1, range=0..1)
number_slider_9 = Slider(10, range=0..10)
brep_2 = Brep(<brep referenced from the Rhino model>)
negative = Negative(Value=number_slider_9)
offset_surface = OffsetSurface(Surface=graft(brep_2), Distance=[number_slider_9, negative], Retrim=True)
deconstruct_brep = DeconstructBrep(Brep=offset_surface)  # -> Faces, Edges, Vertices
join_curves = JoinCurves(Curves=deconstruct_brep.Edges, Preserve=False)
loft = Loft(
    Curves=flatten(join_curves),
    Options={Adjust=False, Closed=False, LoftEnds=0, LoftSimp=0, LoftType=0, Rebuild=10, Refit=0.01})
brep_join = BrepJoin(Breps=flatten([offset_surface, loft]))  # -> Breps, Closed

item_8 = ListItem(List=box_2, Index=Slider(0, range=0..100), Wrap=True)

# ---- group: Rotate along point
debrep_2 = DeconstructBrep(Brep=item_8)  # -> Faces, Edges, Vertices
item_9 = ListItem(List=debrep_2.Vertices, Index=0, Wrap=True)
item_10 = ListItem(List=debrep_2.Vertices, Index=Slider(5, range=0..10), Wrap=True)
ln_3 = Line(StartPoint=item_10, EndPoint=item_9)
midpt = CurveMiddle(Curve=ln_3)
xz = XZPlane(Origin=midpt)
rotate = Rotate(Geometry=debrep_2.Faces, Angle=degrees(Slider(47, range=0..100)), Plane=xz)  # -> flatten(Geometry), Transform

# ----
debrep_3 = DeconstructBrep(Brep=rotate.Geometry)  # -> Faces, Edges, flatten(Vertices)
item_11 = ListItem(List=debrep_3.Vertices, Index=Slider(4, range=0..10), Wrap=True)
item_12 = ListItem(List=debrep_3.Vertices, Index=Slider(5, range=0..10), Wrap=True)
ln_4 = Line(StartPoint=item_11, EndPoint=item_12)
midpt_2 = CurveMiddle(Curve=ln_4)
yz = YZPlane(Origin=midpt_2)
move_5 = Move(Motion=Vector(0, 0, 10))  # -> Geometry, Transform

dispatch = Dispatch(List=divide_6.Points, DispatchPattern=[True, False])  # -> graft(ListA), graft(ListB)

brick_depth_11 = Data(number_slider)
input_surface_3 = Brep(input_surface)
addition_7 = Addition(A=brick_depth_11, B=1)
pt = PointOriented(BasePlane=input_surface_3, UComponent=0, VComponent=0, WComponent=addition_7)
deplane = DeconstructPlane(Plane=input_surface_3)  # -> Origin, XAxis, YAxis, ZAxis
vec2pt = Vector2Pt(PointA=deplane.Origin, PointB=pt, Unitize=False)  # -> Vector, Length
move_6 = Move(Geometry=box_3, Motion=vec2pt.Vector)  # -> Geometry, Transform

data_3 = Data(dispatch.ListB)
multiplication = Multiplication(A=division_7, B=2)
data_4 = Data(dispatch.ListA)
brep_3 = Brep([move.Geometry, move_4.Geometry])
sort_brep = SortDuplicateBreps(Breps=brep_3)  # -> UniqueBreps, Indices
flip = FlipMatrix(Data=box_5)
panel_2 = Panel(flip)
cull = CullPattern(List=flip, CullPattern=[True, False])
item_13 = ListItem(List=flatten(cull), Index=0, Wrap=True)
data_5 = Data(cull)
lng = ListLength(List=data_5)  # -> flatten(Length)

# ---- group: Mirror geometry and move to right location
debrep_4 = DeconstructBrep(Brep=rotate.Geometry)  # -> Faces, Edges, flatten(Vertices)
join = BrepJoin(Breps=rotate.Geometry)  # -> flatten(Breps), Closed
item_14 = ListItem(List=debrep_4.Vertices, Index=Slider(0, range=0..100), Wrap=True)
ln_5 = Line(StartPoint=item_14, EndPoint=item_9)
vec_3 = Vector(ln_5)
mirror = Mirror(Geometry=join.Breps, Plane=yz)  # -> Geometry, Transform
Z_4 = UnitZ(Factor=brick_height_2)
data_6 = Data([mirror.Geometry, join.Breps])
move_7 = Move(Geometry=data_6, Motion=vec_3)  # -> Geometry, Transform
move_8 = Move(Geometry=move_7.Geometry, Motion=Z_4)  # -> Geometry, Transform
debrep_5 = DeconstructBrep(Brep=move_8.Geometry)  # -> Faces, Edges, Vertices
join_2 = BrepJoin(Breps=move_8.Geometry)  # -> Breps, Closed

# ----
item_15 = ListItem(List=lng, Index=0, Wrap=True)

# ---- group: Move brick pattern so grout lines do not collide
addition_8 = Addition(A=brick_depth_4, B=0.1)
data_7 = Data(cull)
Y = UnitY(Factor=addition_8)
addition_9 = Addition(A=brick_depth_4, B=0.1)
division_8 = Division(A=brick_width_4, B=2)
Y_2 = UnitY(Factor=addition_9)
X = UnitX(Factor=division_8)
neg_3 = Negative(Value=Y_2)
move_9 = Move(Geometry=data_7, Motion=neg_3)  # -> Geometry, Transform
move_10 = Move(Geometry=move_9.Geometry, Motion=X)  # -> Geometry, Transform; disabled
move_11 = Move(Geometry=data_7, Motion=Y)  # -> Geometry, Transform

# ---- group: Less Light Mashrabiya
brep_4 = Brep([move_6.Geometry, box_3, sort_brep.UniqueBreps])

# ---- group: More Light Mashrabiya
brep_5 = Brep([move_6.Geometry, box_3, move.Geometry])

# ----
panel_3 = Panel(item_15)
subtraction_3 = Subtraction(A=panel_3, B=1)
divide_7 = DivideCurve(Curve=data_2, Count=subtraction_3, Kinks=False)  # -> Points, Tangents, Parameters

# ---- group: Get box geometry
brick_height_14 = Data(brick_height_3)
python_6 = GhPythonScript(BrickRows=contour_3)  # -> out, a; inputs BrickRows: list of Curve; same code as python_3
brick_width_12 = Data(brick_width_3)
sqr_5 = Square(Value=brick_width_12)
sqr_6 = Square(Value=brick_height_14)
cull_i_6 = CullIndex(List=contour_3, Indices=python_6.out, Wrap=True)
addition_10 = Addition(A=sqr_5, B=sqr_6)
len_9 = Length(Curve=cull_i_6)
sqrt_3 = SquareRoot(Value=addition_10)
item_16 = ListItem(List=len_9, Index=0, Wrap=True)
division_9 = Division(A=item_16, B=sqrt_3)
divide_8 = DivideCurve(Curve=flatten(cull_i_6), Count=flatten(division_9), Kinks=False, UseTasks=True)  # -> simplify(Points), Tangents, Parameters
brick_height_15 = Data(number_slider_7)
brick_depth_12 = Data(number_slider_5)
brick_width_13 = Data(number_slider_6)
box_6 = DomainBox(Base=divide_7.Points, X=brick_width_13, Y=brick_depth_12, Z=brick_height_15)

# ----
dispatch_2 = Dispatch(List=divide_8.Points, DispatchPattern=[True, False, False, False, False, False, False, False, False, False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])  # -> ListA, ListB
data_8 = Data(move_4.Geometry)
data_9 = Data(move_4.Geometry)
yz_2 = YZPlane(Origin=Point(0, 0, 0))

brep_6 = Brep(brep)
number_slider_10 = Slider(1, range=0..1)
number_slider_11 = Slider(10, range=0..10)
negative_2 = Negative(Value=number_slider_11)
offset_surface_2 = OffsetSurface(Surface=graft(brep_6), Distance=[number_slider_11, negative_2], Retrim=True)
deconstruct_brep_2 = DeconstructBrep(Brep=offset_surface_2)  # -> Faces, Edges, Vertices
join_curves_2 = JoinCurves(Curves=deconstruct_brep_2.Edges, Preserve=False)
loft_2 = Loft(
    Curves=flatten(join_curves_2),
    Options={Adjust=False, Closed=False, LoftEnds=0, LoftSimp=0, LoftType=0, Rebuild=10, Refit=0.01})
brep_join_2 = BrepJoin(Breps=flatten([offset_surface_2, loft_2]))  # -> Breps, Closed

deconstruct_brep_3 = DeconstructBrep(Brep=offset_surface_2)  # -> Faces, Edges, Vertices
len_10 = Length(Curve=ln_2)
X_2 = UnitX(Factor=Slider(-0.314436, range=-0.5..1))

# ---- group: Rotate along point
data_10 = Data(box_6)
debrep_6 = DeconstructBrep(Brep=data_10)  # -> Faces, Edges, Vertices
data_11 = Data(debrep_6.Vertices)
item_17 = ListItem(List=data_11, Index=Slider(8, range=0..10), Wrap=True)
item_18 = ListItem(List=data_11, Index=Slider(5, range=0..10), Wrap=True)
data_12 = Data(flatten(item_17))

# ----
item_19 = ListItem(List=data_11, Index=Slider(3, range=0..10), Wrap=True)
ln_6 = Line(StartPoint=item_19, EndPoint=item_17)
midpt_3 = CurveMiddle(Curve=ln_6)

# ---- group: Rotate along point (continued)
xz_2 = XZPlane(Origin=midpt_3)
rotate_2 = Rotate(Geometry=debrep_6.Faces, Angle=degrees(Slider(40, range=0..100)), Plane=xz_2)  # -> flatten(Geometry), Transform

# ---- group: Mirror geometry and move to right location
join_3 = BrepJoin(Breps=rotate_2.Geometry)  # -> flatten(Breps), Closed
join_4 = BrepJoin(Breps=rotate_2.Geometry)  # -> flatten(Breps), Closed
mirror_2 = Mirror(Geometry=join_3.Breps, Plane=data_12)  # -> Geometry, Transform
X_3 = UnitX(Factor=Slider(25.76, range=0..100))
Z_5 = UnitZ(Factor=Slider(25.157, range=0..100))
move_12 = Move(Geometry=mirror_2.Geometry, Motion=X_3)  # -> Geometry, Transform
move_13 = Move(Geometry=move_12.Geometry, Motion=Z_5)  # -> Geometry, Transform

# ----
move_14 = Move(Geometry=move_12.Geometry, Motion=Z_5)  # -> Geometry, Transform

# ---- group: Array diagonal bricks
number_slider_12 = Slider(50, range=0..100)
data_13 = Data([rotate_2.Geometry, move_13.Geometry])
neg_4 = Negative(Value=number_slider_12)
X_4 = UnitX(Factor=number_slider_12)
arrlinear = LinearArray(Geometry=data_13, Direction=X_4, Count=Slider(14, range=0..100))  # -> Geometry, Transform

# ----
data_14 = Data(arrlinear.Geometry)
data_15 = Data(flatten([move_11.Geometry, arrlinear.Geometry, move_10.Geometry]))
join_5 = BrepJoin(Breps=data_15)  # -> Breps, Closed; disabled
solid_intersection = SolidIntersection(BrepsA=join_5.Breps, BrepsB=brep_join.Breps)  # disabled
jaali = Brep(solid_intersection)

item_20 = ListItem(List=flatten(debrep_5.Vertices), Index=Slider(7, range=0..10), Wrap=True)
item_21 = ListItem(List=flatten(debrep_5.Vertices), Index=Slider(6, range=0..10), Wrap=True)
Z_6 = UnitZ(Factor=1)
X_5 = UnitX(Factor=1)
neg_5 = Negative(Value=Z_6)
ln_7 = Line(StartPoint=item_20, EndPoint=item_21)  # -> flatten(Line)
line = LineSDL(Start=item_20, Direction=neg_5, Length=1)  # -> flatten(Line)
line_2 = LineSDL(Start=item_21, Direction=X_5, Length=1)
join_6 = JoinCurves(Curves=[line, line_2, ln_7], Preserve=False)
boundary = BoundarySurfaces(Edges=[line_2, line, ln_7])
explode = Explode(Curve=boundary, Recursive=True)  # -> Segments, graft(Vertices)
bang_2 = ExplodeTree(Data=explode.Vertices)  # -> Branch0, Branch1, Branch2, Branch3
data_16 = Data(bang_2.Branch1)
data_17 = Data(bang_2.Branch2)
data_18 = Data(bang_2.Branch0)
ln_8 = Line(StartPoint=data_18, EndPoint=data_17)
len_11 = Length(Curve=ln_8)
addition_11 = Addition(A=len_11, B=brick_height_2)
Z_7 = UnitZ(Factor=len_11)
neg_6 = Negative(Value=Z_7)

item_22 = ListItem(List=debrep_5.Vertices, Index=Slider(4, range=0..10), Wrap=True)
item_23 = ListItem(List=flatten(debrep_5.Vertices), Index=Slider(6, range=0..10), Wrap=True)
Z_8 = UnitZ(Factor=1)
X_6 = UnitX(Factor=1)
ln_9 = Line(StartPoint=item_22, EndPoint=item_23)
neg_7 = Negative(Value=Z_8)
neg_8 = Negative(Value=X_6)
ln_10 = Line(StartPoint=item_22, EndPoint=item_23)  # -> flatten(Line)
line_3 = LineSDL(Start=item_22, Direction=neg_7, Length=1)  # -> flatten(Line)
line_4 = LineSDL(Start=item_23, Direction=neg_8, Length=1)
join_7 = JoinCurves(Curves=[line_3, line_4, ln_10], Preserve=False)
boundary_2 = BoundarySurfaces(Edges=[line_4, line_3, ln_10])
explode_2 = Explode(Curve=boundary_2, Recursive=True)  # -> Segments, graft(Vertices)
bang_3 = ExplodeTree(Data=explode_2.Vertices)  # -> Branch0, Branch1, Branch2, Branch3
data_19 = Data(bang_3.Branch0)
data_20 = Data(bang_3.Branch1)
data_21 = Data(bang_3.Branch2)
ln_11 = Line(StartPoint=data_19, EndPoint=data_21)
len_12 = Length(Curve=ln_11)
addition_12 = Addition(A=len_12, B=brick_height_2)
subtraction_4 = Subtraction(A=addition_12, B=len_11)
Z_9 = UnitZ(Factor=subtraction_4)

item_24 = ListItem(List=flatten(debrep_5.Vertices), Index=Slider(14, range=0..100), Wrap=True)
item_25 = ListItem(List=flatten(debrep_5.Vertices), Index=Slider(6, range=0..10), Wrap=True)
ln_12 = Line(StartPoint=data_16, EndPoint=data_18)
ln_13 = Line(StartPoint=item_24, EndPoint=item_25)
len_13 = Length(Curve=ln_12)
len_14 = Length(Curve=data)
len_15 = Length(Curve=ln_13)
X_7 = UnitX(Factor=Slider(0.505, range=0..1))
multiplication_2 = Multiplication(A=len_13, B=2)
addition_13 = Addition(A=multiplication_2, B=len_15)
division_10 = Division(A=len_14, B=addition_13)
round = Round(Number=division_10)  # -> flatten(Nearest), Floor, Ceiling
panel_4 = Panel(round.Nearest)
panel_5 = Panel(addition_13)
addition_14 = Addition(A=panel_4, B=1)
data_22 = Data(box_2)
arrlinear_2 = LinearArray(Geometry=join_2.Breps, Direction=X_7, Count=addition_14)  # -> flatten(Geometry), Transform

move_15 = Move(Geometry=arrlinear_2.Geometry, Motion=neg_6)  # -> Geometry, Transform

division_11 = Division(A=len_10, B=len_12)
round_2 = Round(Number=division_11)  # -> Nearest, Floor, Ceiling
arrlinear_3 = LinearArray(Geometry=[data_22, move_15.Geometry], Direction=Z_9, Count=round_2.Nearest)  # -> Geometry, Transform
move_16 = Move(Geometry=arrlinear_3.Geometry, Motion=X_2)  # -> Geometry, Transform
join_8 = BrepJoin(Breps=move_16.Geometry)  # -> flatten(Breps), Closed
solid_intersection_2 = SolidIntersection(BrepsA=join_8.Breps, BrepsB=brep_join_2.Breps)
jaali_2 = Brep(solid_intersection_2)
mesh = Mesh(jaali_2)
