# Grasshopper definition Ribbed_vault.gh (Grasshopper 1.0.7)

brick_height = Data("0.065")
brick_length = Data("0.29")
brick_width = Data("0.14")
mortar = Data("0.01")
brep = Brep(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)
addition = Addition(A=brick_width, B=mortar)
addition_2 = Addition(A=brick_height, B=mortar)
addition_3 = Addition(A=brick_length, B=mortar)
deconstruct_brep = DeconstructBrep(Brep=brep)  # -> Faces, Edges, Vertices
point = Point(Point(54.72290968, 33.7649123, 1.2))
list_item = ListItem(List=deconstruct_brep.Edges, Index=0, Wrap=True)  # -> Item, Item1, Item2, Item3
divide_distance = DivideDistance(Curve=list_item.Item, Distance=addition_2)  # -> Points, Tangents, Parameters
# Central vault
xy_plane = XYPlane(Origin=divide_distance.Points)
vector_2pt = Vector2Pt(PointA=xy_plane, PointB=point, Unitize=False)  # -> Vector, Length
unit_x = UnitX(Factor=1)
amplitude = Amplitude(Vector=vector_2pt.Vector, Amplitude=Slider(0.2, range=0..1))
vector_display = VectorDisplay(Anchor=xy_plane, Vector=amplitude)
angle = Angle(VectorA=unit_x, VectorB=vector_2pt.Vector)  # -> Angle, Reflex
unit_y = UnitY(Factor=1)
perp_frame = PerpFrame(Curve=list_item.Item, Parameter=divide_distance.Parameters)
division = Division(A=brick_length, B=Slider(2, range=0..2))
rotate_3d = Rotate3D(Geometry=xy_plane, Angle=angle.Angle, Center=xy_plane, Axis=unit_y)  # -> Geometry, Transform
dispatch = Dispatch(List=rotate_3d.Geometry, DispatchPattern=[True, False])  # -> ListA, ListB
negative = Negative(Value=division)
data = Data(dispatch.ListB)
data_2 = Data(dispatch.ListA)
unit_y_2 = UnitY(Factor=negative)
move = Move(Geometry=data, Motion=unit_y_2)  # -> Geometry, Transform
construct_domain = ConstructDomain(DomainStart=0, DomainEnd=expr("-x", brick_length))
construct_domain_2 = ConstructDomain(DomainStart=expr("-x", addition), DomainEnd=expr("-x", brick_length))
construct_domain_3 = ConstructDomain(DomainStart=0, DomainEnd=expr("-x", brick_width))
negative_2 = Negative(Value=Slider(0.065, range=0..0.1))
# Get the vertical stack of the bricks
# Rotate the bricks
# Generate similar data structure as the rotation points
# Trim the surface/brep
# Rotation points
# Get the rotation angle of each brick
# Get the center of brick rotation angle
construct_domain_4 = ConstructDomain(DomainStart=0, DomainEnd=expr("-x", brick_width))
construct_domain_5 = ConstructDomain(DomainStart=0, DomainEnd=expr("-x", brick_length))
construct_domain_6 = ConstructDomain(DomainStart=expr("-x", Slider(0.15, range=0..1)), DomainEnd=expr("-x", brick_length))
construct_domain_7 = ConstructDomain(DomainStart=0, DomainEnd=expr("-x", brick_width))
construct_domain_8 = ConstructDomain(DomainStart=0, DomainEnd=expr("-x", brick_length))
construct_domain_9 = ConstructDomain(DomainStart=0, DomainEnd=expr("-x", brick_length))
domain_box = DomainBox(Base=data_2, X=construct_domain_2, Y=construct_domain, Z=negative_2)
domain_box_2 = DomainBox(Base=data_2, X=construct_domain_3, Y=construct_domain, Z=negative_2)
domain_box_3 = DomainBox(Base=data, X=construct_domain_5, Y=construct_domain_4, Z=negative_2)
domain_box_4 = DomainBox(Base=move.Geometry, X=construct_domain_6, Y=construct_domain_8, Z=negative_2)
domain_box_5 = DomainBox(Base=move.Geometry, X=construct_domain_7, Y=construct_domain_9, Z=negative_2)
negative_3 = Negative(Value=addition_3)
negative_4 = Negative(Value=addition_3)
brep_2 = Brep([domain_box_5, domain_box_4])
unit_y_3 = UnitY(Factor=negative_3)
unit_y_4 = UnitY(Factor=negative_4)
linear_array = LinearArray(Geometry=brep_2, Direction=unit_y_4, Count=Slider(16, range=0..100))  # -> Geometry, Transform
linear_array_2 = LinearArray(Geometry=[domain_box_2, domain_box], Direction=unit_y_3, Count=Slider(17, range=0..100))  # -> Geometry, Transform
final_geometry = Brep([linear_array_2.Geometry, linear_array.Geometry, domain_box_3])
mesh = Mesh(final_geometry)

brick_height_2 = Data("0.065")
brick_length_2 = Data("0.29")
brick_width_2 = Data("0.14")
mortar_2 = Data("0.01")
addition_4 = Addition(A=brick_height_2, B=mortar_2)
# Central Ribs
curve = Curve(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)
divide_distance_2 = DivideDistance(Curve=curve, Distance=addition_4)  # -> Points, Tangents, Parameters
xy_plane_2 = XYPlane(Origin=divide_distance_2.Points)
point_2 = Point(Point(54.72290968, 34.0649123, 1.200010949))
vector_2pt_2 = Vector2Pt(PointA=xy_plane_2, PointB=point_2, Unitize=False)  # -> Vector, Length
unit_x_2 = UnitX(Factor=1)
angle_2 = Angle(VectorA=unit_x_2, VectorB=vector_2pt_2.Vector)  # -> Angle, Reflex
amplitude_2 = Amplitude(Vector=vector_2pt_2.Vector, Amplitude=Slider(0.2, range=0..1))
unit_y_5 = UnitY(Factor=1)
vector_display_2 = VectorDisplay(Anchor=divide_distance_2.Points, Vector=amplitude_2)
rotate_3d_2 = Rotate3D(Geometry=xy_plane_2, Angle=angle_2.Angle, Center=xy_plane_2, Axis=unit_y_5)  # -> Geometry, Transform
dispatch_2 = Dispatch(List=rotate_3d_2.Geometry, DispatchPattern=[True, False])  # -> ListA, ListB
data_3 = Data(dispatch_2.ListB)
data_4 = Data(dispatch_2.ListA)
construct_domain_10 = ConstructDomain(DomainStart=0, DomainEnd=expr("-x", Slider(0.29, range=0..1)))
construct_domain_11 = ConstructDomain(DomainStart=0, DomainEnd=expr("-x", Slider(0.29, range=0..1)))
construct_domain_12 = ConstructDomain(DomainStart=expr("-x", Slider(0.15, range=0..1)), DomainEnd=expr("-x", Slider(0.29, range=0..1)))
construct_domain_13 = ConstructDomain(DomainStart=0, DomainEnd=expr("-x", Slider(0.14, range=0..1)))
construct_domain_14 = ConstructDomain(DomainStart=0, DomainEnd=expr("-x", Slider(0.14, range=0..1)))
construct_domain_15 = ConstructDomain(DomainStart=0, DomainEnd=expr("-x", Slider(0.29, range=0..1)))
construct_domain_16 = ConstructDomain(DomainStart=expr("-x", Slider(0.15, range=0..1)), DomainEnd=expr("-x", brick_length_2))
negative_5 = Negative(Value=Slider(0.065, range=0..0.1))
construct_domain_17 = ConstructDomain(DomainStart=0, DomainEnd=expr("-x", Slider(0.29, range=0..1)))
domain_box_6 = DomainBox(Base=data_4, X=construct_domain_15, Y=construct_domain_13, Z=negative_5)
domain_box_7 = DomainBox(Base=data_3, X=construct_domain_12, Y=construct_domain_10, Z=negative_5)
domain_box_8 = DomainBox(Base=data_4, X=construct_domain_17, Y=construct_domain_16, Z=negative_5)
domain_box_9 = DomainBox(Base=data_3, X=construct_domain_14, Y=construct_domain_11, Z=negative_5)
brep_3 = Brep([domain_box_6, domain_box_8, domain_box_9, domain_box_7])
curve_2 = Curve(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)
length = Length(Curve=curve_2)
negative_6 = Negative(Value=length)
unit_y_6 = UnitY(Factor=negative_6)
move_2 = Move(Geometry=brep_3, Motion=unit_y_6)  # -> Geometry, Transform
brep_4 = Brep([move_2.Geometry, brep_3])
mesh_2 = Mesh(brep_4)

brick_length_3 = Data("0.29")
brick_height_3 = Data("0.065")
brick_width_3 = Data("0.14")
mortar_3 = Data("0.01")
addition_5 = Addition(A=brick_width_3, B=mortar_3)
addition_6 = Addition(A=brick_height_3, B=mortar_3)
addition_7 = Addition(A=brick_length_3, B=mortar_3)
# side vaults
negative_7 = Negative(Value=addition_5)
surface = Surface(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)
offset_surface = OffsetSurface(Surface=surface, Distance=addition_5, Retrim=True)
deconstruct_brep_2 = DeconstructBrep(Brep=[offset_surface, surface])  # -> Faces, Edges, Vertices
list_item_2 = ListItem(List=deconstruct_brep_2.Edges, Index="1", Wrap=True)
divide_distance_3 = DivideDistance(Curve=list_item_2, Distance=Slider(0.08, range=0..0.1))  # -> Points, Tangents, Parameters
unit_y_7 = UnitY(Factor=1)
negative_8 = Negative(Value=unit_y_7)
line_sdl = LineSDL(Start=divide_distance_3.Points, Direction=unit_y_7, Length=Slider(7, range=0..10))
trim_with_region = TrimWithRegion(Curve=line_sdl, Region=deconstruct_brep_2.Faces)  # -> Inside, Outside
curve_3 = Curve(flatten(trim_with_region.Inside))
length_2 = Length(Curve=curve_3)
division_2 = Division(A=length_2, B=Slider(0.15, range=0..1))
round = Round(Number=division_2)  # -> Nearest, Floor, Ceiling
divide_curve = DivideCurve(Curve=curve_3, Count=expr("x", round.Nearest), Kinks=False)  # -> simplify(Points), simplify(Tangents), Parameters
curve_4 = Curve(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)
curve_closest_point = CurveClosestPoint(Point=divide_curve.Points, Curve=curve_4)  # -> Point, Parameter, Distance
align_plane = AlignPlane(Plane=divide_curve.Points, Direction=divide_curve.Tangents)  # -> Plane, Angle
vector_2pt_3 = Vector2Pt(PointA=align_plane.Plane, PointB=curve_closest_point.Point, Unitize=False)  # -> Vector, Length
adjust_plane = AdjustPlane(Plane=align_plane.Plane, Normal=vector_2pt_3.Vector)
dispatch_3 = Dispatch(List=adjust_plane, DispatchPattern=[True, False])  # -> ListA, ListB
vector_display_3 = VectorDisplay(Anchor=divide_curve.Points, Vector=vector_2pt_3.Vector)
flip_matrix = FlipMatrix(Data=dispatch_3.ListA)
flip_matrix_2 = FlipMatrix(Data=dispatch_3.ListB)
dispatch_4 = Dispatch(List=flip_matrix, DispatchPattern=[True, False])  # -> ListA, ListB
dispatch_5 = Dispatch(List=flip_matrix_2, DispatchPattern=[True, False])  # -> ListA, ListB
data_5 = Data([dispatch_4.ListA, dispatch_5.ListB])
number_slider = Slider(0.14, range=0..1)
number_slider_2 = Slider(0.29, range=0..1)
number_slider_3 = Slider(0.065, range=0..0.1)
construct_domain_18 = ConstructDomain(DomainStart=expr("-x/2", number_slider), DomainEnd=expr("x/2", number_slider))
construct_domain_19 = ConstructDomain(DomainStart=expr("-x/2", number_slider_2), DomainEnd=expr("x/2", number_slider_2))
negative_9 = Negative(Value=number_slider)
domain_box_10 = DomainBox(Base=data_5, X=construct_domain_19, Y=number_slider_3, Z=negative_9)
negative_10 = Negative(Value=number_slider_3)
mesh_3 = Mesh(domain_box_10)
curve_5 = Curve(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)
curve_middle = CurveMiddle(Curve=curve_5)
xz_plane = XZPlane(Origin=curve_middle)
mirror = Mirror(Geometry=domain_box_10, Plane=xz_plane)  # -> Geometry, Transform
curve_6 = Curve(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)
curve_middle_2 = CurveMiddle(Curve=curve_6)
yz_plane = YZPlane(Origin=curve_middle_2)
mirror_2 = Mirror(Geometry=[domain_box_10, mirror.Geometry], Plane=yz_plane)  # -> Geometry, Transform
final_geometry_2 = Brep([mirror_2.Geometry, domain_box_10, mirror.Geometry])
mesh_4 = Mesh(final_geometry_2)

brick_length_4 = Data("0.29")
brick_height_4 = Data("0.065")
brick_width_4 = Data("0.14")
mortar_4 = Data("0.01")
addition_8 = Addition(A=brick_width_4, B=mortar_4)
addition_9 = Addition(A=brick_height_4, B=mortar_4)
addition_10 = Addition(A=brick_length_4, B=mortar_4)
# side vaults
negative_11 = Negative(Value=addition_8)
surface_2 = Surface(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)
offset_surface_2 = OffsetSurface(Surface=surface_2, Distance=addition_8, Retrim=True)
deconstruct_brep_3 = DeconstructBrep(Brep=[offset_surface_2, surface_2])  # -> Faces, Edges, Vertices
list_item_3 = ListItem(List=deconstruct_brep_3.Edges, Index="2", Wrap=True)
flip_curve = FlipCurve(Curve=list_item_3)  # -> Curve, Flag
divide_distance_4 = DivideDistance(Curve=flip_curve.Curve, Distance=Slider(0.08, range=0..0.1))  # -> Points, Tangents, Parameters
unit_x_3 = UnitX(Factor=1)
negative_12 = Negative(Value=unit_x_3)
line_sdl_2 = LineSDL(Start=divide_distance_4.Points, Direction=unit_x_3, Length=Slider(7, range=0..10))
trim_with_region_2 = TrimWithRegion(Curve=line_sdl_2, Region=deconstruct_brep_3.Faces)  # -> Inside, Outside
curve_7 = Curve(flatten(trim_with_region_2.Inside))
length_3 = Length(Curve=curve_7)
division_3 = Division(A=length_3, B=Slider(0.15, range=0..1))
round_2 = Round(Number=division_3)  # -> Nearest, Floor, Ceiling
divide_curve_2 = DivideCurve(Curve=curve_7, Count=expr("x", round_2.Nearest), Kinks=False)  # -> simplify(Points), simplify(Tangents), Parameters
curve_8 = Curve(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)
curve_closest_point_2 = CurveClosestPoint(Point=divide_curve_2.Points, Curve=curve_8)  # -> Point, Parameter, Distance
align_plane_2 = AlignPlane(Plane=divide_curve_2.Points, Direction=divide_curve_2.Tangents)  # -> Plane, Angle
vector_2pt_4 = Vector2Pt(PointA=align_plane_2.Plane, PointB=curve_closest_point_2.Point, Unitize=False)  # -> Vector, Length
adjust_plane_2 = AdjustPlane(Plane=align_plane_2.Plane, Normal=vector_2pt_4.Vector)
dispatch_6 = Dispatch(List=adjust_plane_2, DispatchPattern=[True, False])  # -> ListA, ListB
vector_display_4 = VectorDisplay(Anchor=divide_curve_2.Points, Vector=vector_2pt_4.Vector)
flip_matrix_3 = FlipMatrix(Data=dispatch_6.ListA)
flip_matrix_4 = FlipMatrix(Data=dispatch_6.ListB)
dispatch_7 = Dispatch(List=flip_matrix_3, DispatchPattern=[True, False])  # -> ListA, ListB
dispatch_8 = Dispatch(List=flip_matrix_4, DispatchPattern=[True, False])  # -> ListA, ListB
data_6 = Data([dispatch_7.ListA, dispatch_8.ListB])
number_slider_4 = Slider(0.14, range=0..1)
number_slider_5 = Slider(0.29, range=0..1)
construct_domain_20 = ConstructDomain(DomainStart=expr("-x/2", number_slider_4), DomainEnd=expr("x/2", number_slider_4))
construct_domain_21 = ConstructDomain(DomainStart=expr("-x/2", number_slider_5), DomainEnd=expr("x/2", number_slider_5))
negative_13 = Negative(Value=number_slider_4)
negative_14 = Negative(Value=Slider(0.065, range=0..0.1))
domain_box_11 = DomainBox(Base=data_6, X=construct_domain_21, Y=negative_14, Z=negative_13)
mesh_5 = Mesh(domain_box_11)
curve_9 = Curve(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)
curve_middle_3 = CurveMiddle(Curve=curve_9)
xz_plane_2 = XZPlane(Origin=curve_middle_3)
mirror_3 = Mirror(Geometry=domain_box_11, Plane=xz_plane_2)  # -> Geometry, Transform
final_geometry_3 = Brep([mirror_3.Geometry, domain_box_11])
mesh_6 = Mesh(final_geometry_3)

surface_3 = Surface(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)
surface_4 = Surface(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)
# curved ribs
deconstruct_brep_4 = DeconstructBrep(Brep=surface_4)  # -> Faces, Edges, Vertices
deconstruct_brep_5 = DeconstructBrep(Brep=surface_3)  # -> Faces, Edges, Vertices
list_item_4 = ListItem(List=deconstruct_brep_4.Edges, Index="2", Wrap=True)
list_item_5 = ListItem(List=deconstruct_brep_5.Edges, Index="2", Wrap=True)
flip_curve_2 = FlipCurve(Curve=list_item_4)  # -> Curve, Flag
flip_curve_3 = FlipCurve(Curve=list_item_5)  # -> Curve, Flag
divide_distance_5 = DivideDistance(Curve=flip_curve_3.Curve, Distance=Slider(0.08, range=0..0.1))  # -> Points, Tangents, Parameters
divide_distance_6 = DivideDistance(Curve=flip_curve_2.Curve, Distance=Slider(0.08, range=0..0.1))  # -> Points, Tangents, Parameters
align_plane_3 = AlignPlane(Plane=divide_distance_5.Points, Direction=divide_distance_5.Tangents)  # -> Plane, Angle
align_plane_4 = AlignPlane(Plane=divide_distance_6.Points, Direction=divide_distance_6.Tangents)  # -> Plane, Angle
point_3 = Point(<point referenced from the Rhino model>)
point_4 = Point(<point referenced from the Rhino model>)
vector_2pt_5 = Vector2Pt(PointA=point_3, PointB=align_plane_3.Plane, Unitize=False)  # -> Vector, Length
vector_2pt_6 = Vector2Pt(PointA=point_4, PointB=align_plane_4.Plane, Unitize=False)  # -> Vector, Length
adjust_plane_3 = AdjustPlane(Plane=align_plane_3.Plane, Normal=vector_2pt_5.Vector)
vector_display_5 = VectorDisplay(Anchor=divide_distance_5.Points, Vector=vector_2pt_5.Vector)
adjust_plane_4 = AdjustPlane(Plane=align_plane_4.Plane, Normal=vector_2pt_6.Vector)
vector_display_6 = VectorDisplay(Anchor=divide_distance_6.Points, Vector=vector_2pt_6.Vector)
dispatch_9 = Dispatch(List=adjust_plane_3, DispatchPattern=[True, False])  # -> ListA, ListB
dispatch_10 = Dispatch(List=adjust_plane_4, DispatchPattern=[True, False])  # -> ListA, ListB
data_7 = Data([dispatch_9.ListA, dispatch_10.ListA])
data_8 = Data([dispatch_10.ListB, dispatch_9.ListB])
number_slider_6 = Slider(0.14, range=0..1)
number_slider_7 = Slider(0.29, range=0..1)
# Result
number_slider_8 = Slider(0.3, range=0..1)
number_slider_9 = Slider(0.065, range=0..0.1)
construct_domain_22 = ConstructDomain(DomainStart=expr("-x", Slider(0.15, range=0..1)), DomainEnd=expr("-x", number_slider_8))
construct_domain_23 = ConstructDomain(DomainStart=Slider(0.15, range=0..1), DomainEnd=expr("x*2", number_slider_6))
construct_domain_24 = ConstructDomain(DomainStart=0, DomainEnd=expr("-x", number_slider_7))
construct_domain_25 = ConstructDomain(DomainStart=expr("-2*x/3", 0), DomainEnd=number_slider_6)
construct_domain_26 = ConstructDomain(DomainStart=expr("x/30", 0), DomainEnd=expr("-x", Slider(0.14, range=0..1)))
construct_domain_27 = ConstructDomain(DomainStart=expr("-2*x/6", 0), DomainEnd=Slider(0.3, range=0..1))
construct_domain_28 = ConstructDomain(DomainStart=0, DomainEnd=expr("-x", number_slider_7))
negative_15 = Negative(Value=construct_domain_26)
domain_box_12 = DomainBox(Base=data_7, X=number_slider_9, Y=construct_domain_28, Z=construct_domain_23)
domain_box_13 = DomainBox(Base=data_7, X=number_slider_9, Y=construct_domain_24, Z=construct_domain_25)
domain_box_14 = DomainBox(Base=data_8, X=Slider(0.065, range=0..0.1), Y=construct_domain_26, Z=construct_domain_27)
domain_box_15 = DomainBox(Base=data_8, X=Slider(0.065, range=0..0.1), Y=construct_domain_22, Z=construct_domain_27)
pavilion_vault_rib = Brep([domain_box_15, domain_box_14, domain_box_13, domain_box_12])
curve_10 = Curve(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)
curve_middle_4 = CurveMiddle(Curve=curve_10)
yz_plane_2 = YZPlane(Origin=curve_middle_4)
mirror_4 = Mirror(Geometry=pavilion_vault_rib, Plane=yz_plane_2)  # -> Geometry, Transform
curve_11 = Curve(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)
curve_middle_5 = CurveMiddle(Curve=curve_11)
xz_plane_3 = XZPlane(Origin=curve_middle_5)
mirror_5 = Mirror(Geometry=[mirror_4.Geometry, pavilion_vault_rib], Plane=xz_plane_3)  # -> Geometry, Transform
final_geometry_4 = Brep([mirror_5.Geometry, pavilion_vault_rib, mirror_4.Geometry])
mesh_7 = Mesh(final_geometry_4)
