# Grasshopper definition penroseBlocks_assignment03.gh (Grasshopper 0.9.76)
# plug-ins: Python Interpreter

# # AR3B011 EARTHY (2020/21 Q1)
# # Zaatari Refugee Camp Heritage Center Project: "Bayt alturath"
# # Group Members: Selina Bitting, Barbara Foolen de Oliveira, Inaka Sema, Yamini Patidar, Maimuna Bala Shehu
panel = Panel("0")
construct_point = ConstructPoint(XCoordinate=panel, YCoordinate=panel, ZCoordinate=panel)

# ---- group: You can experiment, but the proportioning doesnt work well outside of 10
number_slider = Slider(10, range=0..10)

# ---- group: select triangles by level group
number_slider_2 = Slider(0, range=0..14)

# ---- group: blockHeight
number = Number(".3")

# ----
point = Point(construct_point)

# ---- group: create penrose
python_script = PythonScript(origin=point, diameter=Slider(8, range=0..10), subDiv=Slider(3, range=0..5), numSides=number_slider)  # -> out, allTri, redTri, bluTri, tri_info, tri, triangles
# ---------- python_script: Python ----------
# AR3B011 EARTHY (2020/21 Q1)
# Zaatari Refugee Camp Heritage Center Project: "Bayt alturath"
# Group Members: Selina Bitting, Barbara Foolen de Oliveira, Inaka Sema, Yamini Patidar, Maimuna Bala Shehu


import rhinoscriptsyntax as rs
import math
import cmath


numSides = int(numSides)
subDiv = int(subDiv)
diam = diameter

goldenRatio = (1 + math.sqrt(5)) / 2

#red triangle is 36 degree angle at apex
#blue triangle is 108 angle at apex
#color, 0 is red and 1 is blue

#triangles as tuples in form (color,A,B,C)

#Complex numbers work well here since they can represent any point on the 2D plane 
#– the real component gives the x co-ordinate, while the imaginary component 
#gives the y co-ordinate


def subdivide(triangles):
    result = []
    for color, A, B, C in triangles:
        if color == 0:
            # Subdivide red triangle
            P = A + (B - A) / goldenRatio
            result += [(0, C, P, B), (1, P, C, A)]
        else:
            # Subdivide blue triangle
            Q = B + (A - B) / goldenRatio
            R = B + (C - B) / goldenRatio
            result += [(1, R, C, A), (1, Q, R, B), (0, R, Q, A)]
    return result

# Create wheel of red triangles around the origin
triangles = []
for i in range(numSides):
    B = cmath.rect(1, (2*i - 1) * math.pi / numSides)
    B = B*(diameter/2)
    C = cmath.rect(1, (2*i + 1) * math.pi / numSides)
    C = C*(diameter/2)
    if i % 2 == 0:
        B, C = C, B  # Make sure to mirror every second triangle
    triangles.append((0, 0j, B, C))


# Perform subdivisions
for i in range(subDiv):
    triangles = subdivide(triangles)



tri = []
tri_info = []
# centroid https://www.mathopenref.com/coordcentroid.html
redTri = []
for color, A, B, C in triangles:
    if color == 0:
        Apt = rs.AddPoint(A.real, A.imag, 0)
        Bpt = rs.AddPoint(B.real, B.imag, 0)
        Cpt = rs.AddPoint(C.real, C.imag, 0)
        Dx = ((A.real+B.real+C.real)/3)
        Dy = ((A.imag+B.imag+C.imag)/3)
        Dpt = rs.AddPoint(Dx, Dy, 0)
        distToCenter = rs.Distance(origin, Dpt)
        Dsin = Dy / distToCenter
        Dcos = Dx / distToCenter
        DSa = math.asin(Dsin)
        DCa = math.acos(Dcos)
        singleTri = rs.AddPolyline((Apt,Bpt,Cpt,Apt))
        redTri.append(singleTri)
        tri.append(singleTri)
        tri_info.append([distToCenter, DSa, DCa])

bluTri = []
for color, A, B, C in triangles:
    if color == 1:
        Apt = rs.AddPoint(A.real, A.imag, 0)
        Bpt = rs.AddPoint(B.real, B.imag, 0)
        Cpt = rs.AddPoint(C.real, C.imag, 0)
        Dx = ((A.real+B.real+C.real)/3)
        Dy = ((A.imag+B.imag+C.imag)/3)
        Dpt = rs.AddPoint(Dx, Dy, 0)
        distToCenter = rs.Distance(origin, Dpt)
        Dsin = Dy / distToCenter
        Dcos = Dx / distToCenter
        DSa = math.asin(Dsin)
        DCa = math.acos(Dcos)
        singleTri = rs.AddPolyline((Apt,Bpt,Cpt,Apt))
        bluTri.append(singleTri)
        tri.append(singleTri)
        tri_info.append([distToCenter, DSa, DCa])

allTri = redTri + bluTri
# ---------- end python_script ----------

# ---- group: tri_info
data = Data(python_script.tri_info)

# ---- group: tri
data_2 = Data(python_script.tri)

# ---- group: triangles
data_3 = Data(python_script.triangles)

# ---- group: sort triangles radially
python_script_2 = PythonScript(tri_info=data, tri=data_2, triangles=data_3)  # -> out, complexTri_sorted, order, dists_sorted, tri_sorted; inputs tri_info: list, tri: list of Curve, triangles: list
# ---------- python_script_2: Python ----------
# AR3B011 EARTHY (2020/21 Q1)
# Zaatari Refugee Camp Heritage Center Project: "Bayt alturath"
# Group Members: Selina Bitting, Barbara Foolen de Oliveira, Inaka Sema, Yamini Patidar, Maimuna Bala Shehu


import rhinoscriptsyntax as rs
import math
import cmath


#ORDERING
############
aw = 1
dw = 100000
order_values = []
degs = []
dists = []
for ti in tri_info:
    sdeg = math.degrees(ti[1])
    cdeg = math.degrees(ti[2])
    if 90 >= sdeg >= 0 and 90>=cdeg>=0:
        deg = sdeg
    elif 90 >= sdeg >= 0 and 180>=cdeg>=90:
        deg = cdeg
    elif 0 >= sdeg >= -90 and 180>=cdeg>=90:
        deg = 360 - cdeg
    elif 0 >= sdeg >= -90 and 90>=cdeg>=0:
        deg = 360 + sdeg
    
    order_value = aw * deg + dw * ti[0]
    order_values.append(order_value)
    degs.append(deg)
    dists.append(ti[0])
    
def argsort(seq):
    #http://stackoverflow.com/questions/3382352/equivalent-of-numpy-argsort-in-basic-python/3382369#3382369
    #by unutbu
    return sorted(range(len(seq)), key=seq.__getitem__)

order = argsort(order_values)


tri_sorted = [tri[id] for id in order]
degs_sorted = [degs[id] for id in order]
dists_sorted = [dists[id] for id in order]
sorted_info = [(order_values[id], degs[id], dists[id]) for id in order]  


complexTri_sorted = [triangles[id] for id in order]
# ---------- end python_script_2 ----------

# ---- group: order
data_4 = Data(python_script_2.order)

# ---- group: dists_sorted
data_5 = Data(python_script_2.dists_sorted)

# ---- group: tri_sorted
data_6 = Data(python_script_2.tri_sorted)

# ---- group: group triangles into 'rings'
python_script_3 = PythonScript(order=data_4, dists_sorted=data_5)  # -> out, levels; inputs order: list, dists_sorted: list
# ---------- python_script_3: Python ----------
# AR3B011 EARTHY (2020/21 Q1)
# Zaatari Refugee Camp Heritage Center Project: "Bayt alturath"
# Group Members: Selina Bitting, Barbara Foolen de Oliveira, Inaka Sema, Yamini Patidar, Maimuna Bala Shehu


import rhinoscriptsyntax as rs
import math
import cmath


levels = []
prev_d = dists_sorted[0]
i = 0
for d in dists_sorted:
    if abs(d - prev_d) > 0.0001:
        i += 1
        levels.append(i)
    else:
        levels.append(i)
    prev_d = d
# ---------- end python_script_3 ----------

# ---- group: levels
data_7 = Data(python_script_3.levels)

# ---- group: adjust facet on face
python_script_4 = PythonScript(levels=data_7, triangles=data_3, blockHeight=number)  # -> out, sel_tri, newTri; inputs tris: list of Curve, levels: list of Int32, triangles: list, complexTri_sorted: list
# ---------- python_script_4: Python ----------
# AR3B011 EARTHY (2020/21 Q1)
# Zaatari Refugee Camp Heritage Center Project: "Bayt alturath"
# Group Members: Selina Bitting, Barbara Foolen de Oliveira, Inaka Sema, Yamini Patidar, Maimuna Bala Shehu


import rhinoscriptsyntax as rs
import math
import cmath

levels = levels



def addToBlock(slice,step):
    z = slice+step
    return z

###Create upwards triangles
#####################################
triangles = complexTri_sorted
blockLevel = sel_tri

bH = blockHeight
newTri = []
for i in range(len(levels)):
    horiz = bH*levels[i]
    stepUp = horiz + bH
    for color, A, B, C in triangles:
        Apt = rs.AddPoint(A.real, A.imag, addToBlock(horiz,stepUp))
        Bpt = rs.AddPoint(B.real, B.imag, addToBlock(horiz,stepUp))
        Cpt = rs.AddPoint(C.real, C.imag, addToBlock(horiz,stepUp))
        singleTri = rs.AddPolyline((Apt,Bpt,Cpt,Apt))
        newTri.append(singleTri)


"""
levels = []
prev_d = dists_sorted[0]
i = 0
for d in dists_sorted:
    if abs(d - prev_d) > 0.0001:
        i += 1
        levels.append(i)
    else:
        levels.append(i)
    prev_d = d
print(levels)



#now iterate over the triangles and rebuild them
redTri = []
stepZ = 0

for color, A, B, C in triangles:
    Apt = rs.AddPoint(A.real, A.imag, stepZ)
    Bpt = rs.AddPoint(B.real, B.imag, 0)
    Cpt = rs.AddPoint(C.real, C.imag, 0)
    singleTri = rs.AddPolyline((Apt,Bpt,Cpt,Apt))
    redTri.append(singleTri)
    stepZ += 0.01

"""

"""



Count - amount of identical distances ... 

go either top down or bottom up so that layers steps down in loop


bH = blockHeight
layers = numDistinctDistances

totalHeight = height of dome
numLayers = totalHeight/bH

numTri = number of triangles per layer (so dont step down within one triangle layer)

for triangles index a-b (distance1) :
    Apt = AddPoint(A.real+bH, A.imag+bH, 0+bH+facetHeight)

for triangles index b-c (distance2) :
    Apt = AddPoint(A.real+(bH*layersPrior), A.imag+(bH*layersPrior), 0+(bH*layersPrior)+facetHeight)


"""



"""
for color, A, B, C in triangles:
    if color == 0:
        Apt = rs.AddPoint(A.real, A.imag, zR)
        Bpt = rs.AddPoint(B.real, B.imag, 0)
        Cpt = rs.AddPoint(C.real, C.imag, 0)
        singleTri = rs.AddPolyline((Apt,Bpt,Cpt,Apt))
        redTri.append(singleTri)
        zR += 0.01

bluTri = []
for color, A, B, C in triangles:
    if color == 1:
        Apt = rs.AddPoint(A.real, A.imag, zB)
        Bpt = rs.AddPoint(B.real, B.imag, 0)
        Cpt = rs.AddPoint(C.real, C.imag, 0)
        singleTri = rs.AddPolyline((Apt,Bpt,Cpt,Apt))
        bluTri.append(singleTri)
        zB += 0.04

allTri = redTri + bluTri

"""
# ---------- end python_script_4 ----------

# ----
python_script_5 = PythonScript(selected_level=number_slider_2, levels=data_7, tris=data_6)  # -> out, sel_tri; inputs levels: list, tris: list of Curve
# ---------- python_script_5: Python ----------
# AR3B011 EARTHY (2020/21 Q1)
# Zaatari Refugee Camp Heritage Center Project: "Bayt alturath"
# Group Members: Selina Bitting, Barbara Foolen de Oliveira, Inaka Sema, Yamini Patidar, Maimuna Bala Shehu

sel_tri = []
for i in range(len(levels)):
    if levels[i]==selected_level:
        sel_tri.append(tris[i])
# ---------- end python_script_5 ----------
curve = Curve(python_script_4.newTri)

# ---- group: show rings of tris
curve_2 = Curve(python_script_5.sel_tri)

# ---- group: relocate vertically
python_script_6 = PythonScript()  # -> out, sel_tri, newTri
# ---------- python_script_6: Python ----------
# AR3B011 EARTHY (2020/21 Q1)
# Zaatari Refugee Camp Heritage Center Project: "Bayt alturath"
# Group Members: Selina Bitting, Barbara Foolen de Oliveira, Inaka Sema, Yamini Patidar, Maimuna Bala Shehu


import rhinoscriptsyntax as rs
import math
import cmath

levels = levels


sel_tri = []
for i in range(len(levels)):
    if levels[i]==selected_level:
        sel_tri.append(tris[i])


def addToBlock(slice,step):
    z = slice+step
    return z

###Create upwards triangles
#####################################
triangles = complexTri_sorted
blockLevel = sel_tri

bH = blockHeight
newTri = []
for i in range(len(levels)):
    horiz = bH*levels[i]
    stepUp = horiz + bH
    for color, A, B, C in triangles:
        Apt = rs.AddPoint(A.real, A.imag, addToBlock(horiz,stepUp))
        Bpt = rs.AddPoint(B.real, B.imag, addToBlock(horiz,stepUp))
        Cpt = rs.AddPoint(C.real, C.imag, addToBlock(horiz,stepUp))
        singleTri = rs.AddPolyline((Apt,Bpt,Cpt,Apt))
        newTri.append(singleTri)


"""
levels = []
prev_d = dists_sorted[0]
i = 0
for d in dists_sorted:
    if abs(d - prev_d) > 0.0001:
        i += 1
        levels.append(i)
    else:
        levels.append(i)
    prev_d = d
print(levels)



#now iterate over the triangles and rebuild them
redTri = []
stepZ = 0

for color, A, B, C in triangles:
    Apt = rs.AddPoint(A.real, A.imag, stepZ)
    Bpt = rs.AddPoint(B.real, B.imag, 0)
    Cpt = rs.AddPoint(C.real, C.imag, 0)
    singleTri = rs.AddPolyline((Apt,Bpt,Cpt,Apt))
    redTri.append(singleTri)
    stepZ += 0.01

"""

"""



Count - amount of identical distances ... 

go either top down or bottom up so that layers steps down in loop


bH = blockHeight
layers = numDistinctDistances

totalHeight = height of dome
numLayers = totalHeight/bH

numTri = number of triangles per layer (so dont step down within one triangle layer)

for triangles index a-b (distance1) :
    Apt = AddPoint(A.real+bH, A.imag+bH, 0+bH+facetHeight)

for triangles index b-c (distance2) :
    Apt = AddPoint(A.real+(bH*layersPrior), A.imag+(bH*layersPrior), 0+(bH*layersPrior)+facetHeight)


"""



"""
for color, A, B, C in triangles:
    if color == 0:
        Apt = rs.AddPoint(A.real, A.imag, zR)
        Bpt = rs.AddPoint(B.real, B.imag, 0)
        Cpt = rs.AddPoint(C.real, C.imag, 0)
        singleTri = rs.AddPolyline((Apt,Bpt,Cpt,Apt))
        redTri.append(singleTri)
        zR += 0.01

bluTri = []
for color, A, B, C in triangles:
    if color == 1:
        Apt = rs.AddPoint(A.real, A.imag, zB)
        Bpt = rs.AddPoint(B.real, B.imag, 0)
        Cpt = rs.AddPoint(C.real, C.imag, 0)
        singleTri = rs.AddPolyline((Apt,Bpt,Cpt,Apt))
        bluTri.append(singleTri)
        zB += 0.04

allTri = redTri + bluTri

"""
# ---------- end python_script_6 ----------
