# Grasshopper definition Structural_analysis_Riwak_Double_storey_Final.gh (Grasshopper 1.0.7)
# plug-ins: MeshEdit Components, Weaverbird, MetaHopper, Kangaroo2 Components, karambaGH

# ---- group: Long module
u_count_long_module = Slider(64, range=0..1000)  # disabled

edge_length_strength = Slider(7.302, range=0..10)  # disabled
vertex_load_strength = Slider(0.1, range=0..0.1)  # disabled

anchor = Curve(flatten([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]))  # disabled
brep = Brep(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)  # disabled
brep_2 = Brep(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)  # disabled

anchor_2 = Curve(flatten([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]))  # disabled
brep_3 = Brep(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)  # disabled

# ----
u_count_short_module = Slider(20, range=0..1000)  # disabled
edge_length_strength_2 = Slider(9.252, range=0..10)  # disabled
number_slider = Slider(42, range=0..100)  # disabled
vertex_load_strength_2 = Slider(0.047, range=0..0.1)  # disabled
edge_length_factor = Slider(1, range=0..1)  # disabled
number_slider_2 = Slider(0, range=0..100)  # disabled
number_slider_3 = Slider(3, range=0..10)  # disabled
wall_height = Slider(1, range=0..10)  # disabled

edge_length_strength_3 = Slider(9.252, range=0..10)  # disabled
number_slider_4 = Slider(60, range=0..1000)  # disabled
vertex_load_strength_3 = Slider(0.004, range=0..0.1)  # disabled
edge_length_factor_2 = Slider(1, range=0..1)  # disabled
number_slider_5 = Slider(66, range=0..100)  # disabled
number_slider_6 = Slider(0, range=0..100)  # disabled
number_slider_7 = Slider(3, range=0..10)  # disabled
wall_height_2 = Slider(2.4, range=0..10)  # disabled

toggle = BooleanToggle(False)  # disabled
button = Button()  # disabled

anchor_3 = Curve(graft([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]))  # disabled
brep_4 = Brep([<brep referenced from the Rhino model> x3])  # disabled

anchor_4 = Curve(graft([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]))

# ---- group: Short module
anchor_5 = Curve(graft([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]))  # disabled
brep_5 = Brep([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])  # disabled

# ----
edge_length_strength_4 = Slider(1.987, range=0..10)  # disabled
vertex_load_strength_4 = Slider(0.089, range=0..0.1)  # disabled
edge_length_factor_3 = Slider(1, range=0..1)  # disabled

toggle_2 = BooleanToggle(False)  # disabled
button_2 = Button()  # disabled

u_count_short_module_2 = Slider(20, range=0..1000)  # disabled
number_slider_8 = Slider(42, range=0..100)  # disabled
edge_length_factor_4 = Slider(1, range=0..1)  # disabled
number_slider_9 = Slider(0, range=0..100)  # disabled
number_slider_10 = Slider(3, range=0..10)  # disabled
wall_height_3 = Slider(1.2, range=0..10)  # disabled

# ---- group: Short module
edge_length_strength_5 = Slider(8.356, range=0..10)  # disabled
vertex_load_strength_5 = Slider(0.026, range=0..0.1)  # disabled

anchor_6 = Curve(graft([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]))  # disabled
brep_6 = Brep(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)  # disabled

# ----
anchor_7 = Curve(graft([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]))  # disabled
mesh = Mesh([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])  # disabled

number_slider_11 = Slider(0, range=0..100)  # disabled
vertex_load_strength_6 = Slider(0.021, range=0..0.1)  # disabled
number_slider_12 = Slider(1.484, range=0..10)  # disabled
number_slider_13 = Slider(0.95, range=0..1)  # disabled
number_slider_14 = Slider(3, range=0..10)  # disabled

# ----
# Riwak vaults
group_toggle = GroupToggle(ToggleActive=True, ToggleVisible=False)  # disabled

toggle_3 = BooleanToggle(True)  # disabled
button_3 = Button()  # disabled

toggle_4 = BooleanToggle(True)  # disabled
button_4 = Button()  # disabled

number_slider_15 = Slider(36, range=0..100)  # disabled
number_slider_16 = Slider(33, range=0..1000)  # disabled
edge_length_strength_6 = Slider(8.525, range=0..10)  # disabled
edge_length_factor_5 = Slider(1, range=0..1)  # disabled
wall_height_4 = Slider(0, range=0..10)  # disabled
vertex_load_strength_7 = Slider(0.093, range=0..0.1)  # disabled

toggle_5 = BooleanToggle(False)  # disabled
button_5 = Button()  # disabled

anchor_8 = Curve(graft([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]))  # disabled
brep_7 = Brep([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])  # disabled

brep_8 = Brep([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])

# ----
# Output
mesh_2 = Mesh(brep_4)  # disabled
mesh_uv = MeshSurface(Surface=brep_4, UCount=number_slider_4, VCount=number_slider_5, Overhang=True, Equalize=False)  # disabled
Z = UnitZ(Factor=wall_height_2)  # disabled
mesh_3 = Mesh(mesh_uv)  # disabled
move = Move(Geometry=mesh_3, Motion=Z)  # -> Geometry, Transform; disabled
move_2 = Move(Geometry=anchor_3, Motion=Z)  # -> Geometry, Transform; disabled

mesh_uv_2 = MeshSurface(Surface=brep_8, UCount=Slider(1, range=0..100), VCount=number_slider_15, Overhang=True, Equalize=False)

# ----
# Output
# Meshing the geometry and moving it to the wall height
mesh_uv_3 = MeshSurface(Surface=brep_7, UCount=number_slider_16, VCount=number_slider_15, Overhang=True, Equalize=False)  # disabled
wbedges = WeaverbirdsMeshEdges(MeshOrPolylines=[mesh_uv_3, mesh_uv_2])  # disabled
weld = WeldMesh(Mesh=[mesh_uv_3, mesh_uv_2], Angle=3.141592654)  # disabled
mesh_4 = Mesh(weld)  # disabled

# ----
# Meshing the geometry and moving it to the wall height
wbsplitquads = WeaverbirdsConstantQuadsSplitSubdivision(MeshCurves=mesh, Level=number_slider_14, SmoothNakedEdges=number_slider_11)  # disabled
weld_2 = WeldMesh(Mesh=wbsplitquads, Angle=3.141592654)  # disabled
wbedges_2 = WeaverbirdsMeshEdges(MeshOrPolylines=wbsplitquads)  # disabled
number_slider_17 = Slider(2.4, range=0..10)  # disabled
Z_2 = UnitZ(Factor=number_slider_17)  # disabled
mesh_5 = Mesh(weld_2)  # disabled
move_3 = Move(Geometry=mesh_5, Motion=Z_2)  # -> Geometry, Transform; disabled
move_4 = Move(Geometry=anchor_7, Motion=Z_2)  # -> Geometry, Transform; disabled

# ----
# Extrude inner wall
crv = Curve(anchor_8)  # disabled
extr = Extrude(Base=crv)  # disabled

# ----
# Anchor curve points
mesh_input = GhPythonScript(M=move_3.Geometry)  # -> out, flatten(v), e, f; inputs M: Mesh; disabled
# ---------- mesh_input: Python ----------
__author__ = "pnourian"
__version__ = "2020.08.21"

import rhinoscriptsyntax as rs
import Rhino.Geometry as rg
import math
#####################################
#input validation: weldedness, manifoldness, cleanness
#####################################
if not M.IsManifold(True):
    raise Exception("the input mesh is non-mannifold and this method is not designed to work with non-manifold meshes!")
M.Weld(math.pi)
M.Vertices.CombineIdentical(True,True)
M.Vertices.CullUnused()
if not M.Vertices.Count==M.TopologyVertices.Count:
    raise Exception("the input mesh must be completely welded; although we tried our best, the given mesh seems to have a problem not allowing it to be fully welded!")
#####################################
#exporting vertices as a list of rg.Point3f
#####################################
v=M.Vertices.ToPoint3fArray()
#####################################
#exporting edges as a list of tuples
#####################################
edges=[]
for edgeIndex in range(M.TopologyEdges.Count):
    IJ=M.TopologyEdges.GetTopologyVertices(edgeIndex)
    edges.append((IJ.I,IJ.J))
e=edges
#####################################
#exporting faces as a list of tuples
#####################################
faces=[]
if M.Faces.QuadCount==M.Faces.Count:
    print("a fully quadrilateral mesh")
    for face in M.Faces:
        faces.append((face.A,face.B,face.C,face.D))
elif M.Faces.TriangleCount==M.Faces.Count:
    print("a fully triangular mesh")
    for face in M.Faces:
        faces.append((face.A,face.B,face.C))
else:
    raise Exception("this method only works for meshes that are either fully quadrilateral or fully triangular!")

f=faces
# ---------- end mesh_input ----------
P = Point(mesh_input.v)  # disabled
points_in_a_band = GhPythonScript(v=P, selectionCurves=move_4.Geometry)  # -> out, inBandVertices, inBandIndices; inputs v: list of Point3d, selectionCurves: list of Curve; disabled
# ---------- points_in_a_band: Python ----------
__author__ = "pnourian"
__version__ = "2020.08.21"

import rhinoscriptsyntax as rs
import Rhino.Geometry as rg
tolerance=10E-3
chosenVertices=[]
chosenIndices=[]

for i in range(v.Count):#vertex in v:
    vertex=v[i]
    #these are all the points coming from other script
    chosen=False
    for j in range(selectionCurves.Count):
        #insideInside=(selectionCurves[j].Contains(vertex, rg.Plane.WorldXY,tolerance)==rg.PointContainment.Inside)
        a = rg.Curve.ClosestPoint(selectionCurves[j],vertex,tolerance)
        print(a)
        if a[0]==False:
                continue
        else:
            chosenVertices.append(vertex)
            chosenIndices.append(i)
    #if chosen:
        #chosenVertices.append(vertex)
        #chosenIndices.append(i)
inBandVertices=chosenVertices
inBandIndices=chosenIndices
# ---------- end points_in_a_band ----------

mesh_input_2 = GhPythonScript(M=move.Geometry)  # -> out, flatten(v), e, f; inputs M: Mesh; disabled; same code as mesh_input
P_2 = Point(mesh_input_2.v)  # disabled
points_in_a_band_2 = GhPythonScript(v=P_2, selectionCurves=move_2.Geometry)  # -> out, inBandVertices, inBandIndices; inputs v: list of Point3d, selectionCurves: list of Curve; disabled; same code as points_in_a_band

# ----
# Anchor curve points
mesh_input_3 = GhPythonScript(M=mesh_4)  # -> out, flatten(v), e, f; inputs M: Mesh; disabled; same code as mesh_input
P_3 = Point(mesh_input_3.v)  # disabled
points_in_a_band_3 = GhPythonScript(v=P_3, selectionCurves=anchor_8)  # -> out, inBandVertices, inBandIndices; inputs v: list of Point3d, selectionCurves: list of Curve; disabled; same code as points_in_a_band

# ----
# Selected mesh and points
mesh_6 = Mesh(flatten(move_3.Geometry))  # disabled
pt = Point(flatten(points_in_a_band.inBandVertices))  # disabled

pt_2 = Point(flatten(points_in_a_band_2.inBandVertices))  # disabled
mesh_7 = Mesh(flatten(move.Geometry))  # disabled

# ----
# Selected mesh and points
pt_3 = Point(flatten(points_in_a_band_3.inBandVertices))  # disabled
mesh_8 = Mesh(flatten(mesh_4))  # disabled

# ----
# Solver inputs
edgelengths = EdgeLengths(Mesh=mesh_6, LengthFactor=number_slider_13, Strength=number_slider_12)  # disabled
vertexloads = VertexLoads(Mesh=mesh_6, Strength=vertex_load_strength_6)  # disabled
anchor_9 = Anchor(Point=pt, Strength=10000)  # disabled
show = Show(G=mesh_6)  # disabled

edgelengths_2 = EdgeLengths(Mesh=mesh_7, LengthFactor=edge_length_factor_2, Strength=edge_length_strength_3)  # disabled
anchor_10 = Anchor(Point=pt_2, Strength=10000)  # disabled
vertexloads_2 = VertexLoads(Mesh=mesh_7, Strength=vertex_load_strength_3)  # disabled
show_2 = Show(G=mesh_7)  # disabled

# ----
# Solver inputs
edgelengths_3 = EdgeLengths(Mesh=mesh_8, LengthFactor=edge_length_factor_5, Strength=edge_length_strength_6)  # disabled
anchor_11 = Anchor(Point=pt_3, Strength=10000)  # disabled
vertexloads_3 = VertexLoads(Mesh=mesh_8, Strength=vertex_load_strength_7)  # disabled
show_3 = Show(G=mesh_8)  # disabled

group_toggle_2 = GroupToggle(ToggleActive=True, ToggleVisible=False)  # disabled
solver = Solver(
    GoalObjects=flatten([edgelengths, anchor_9, vertexloads, show]),
    Reset=button_4,
    Threshold=1e-15,
    Tolerance=0.01,
    On=toggle_4)  # -> I, V, flatten(O); disabled

group_toggle_3 = GroupToggle(ToggleActive=True, ToggleVisible=False)  # disabled
solver_2 = Solver(
    GoalObjects=flatten([edgelengths_2, anchor_10, vertexloads_2, show_2]),
    Reset=button,
    Threshold=1e-15,
    Tolerance=0.01,
    On=toggle)  # -> I, V, flatten(O); disabled

swatch = ColourSwatch(SwatchColor=RGB(255, 255, 255))  # disabled
wbedges_3 = WeaverbirdsMeshEdges(MeshOrPolylines=mesh_3)  # disabled
mesh_9 = Mesh(solver_2.O)  # disabled
mesh_10 = Data(graft(mesh_9))  # disabled
preview = CustomPreview(Geometry=solver_2.O, Material=swatch)  # disabled
medges = MeshEdges(Mesh=mesh_uv)  # -> flatten(NakedEdges), InteriorEdges, NonManifoldEdges; disabled
medges_2 = MeshEdges(Mesh=mesh_10)  # -> flatten(NakedEdges), InteriorEdges, NonManifoldEdges; disabled
data = Data(flatten(medges.NakedEdges))  # disabled
data_2 = Data(flatten(medges_2.NakedEdges))  # disabled

# ----
# Groups
# External input
# Parameters
# Ground floor vault
group_toggle_4 = GroupToggle(ToggleActive=True, ToggleVisible=False)  # disabled
preview_2 = CustomPreview(Geometry=solver_2.O, Material=swatch)  # disabled
wbedges_4 = WeaverbirdsMeshEdges(MeshOrPolylines=mesh_uv)  # disabled

# ----
# Solver
solver_3 = Solver(
    GoalObjects=flatten([edgelengths_3, anchor_11, vertexloads_3, show_3]),
    Reset=button_5,
    Threshold=1e-15,
    Tolerance=0.01,
    On=toggle_5)  # -> I, V, flatten(O); disabled

swatch_2 = ColourSwatch(SwatchColor=RGB(255, 255, 255))  # disabled
mesh_11 = Mesh(solver.O)  # disabled
mesh_12 = Data(graft(mesh_11))
# Bake the mesh, cut the portion for analysis.
preview_3 = CustomPreview(Geometry=solver.O, Material=swatch_2)  # disabled

wbedges_5 = WeaverbirdsMeshEdges(MeshOrPolylines=weld_2)  # disabled

swatch_3 = ColourSwatch(SwatchColor=RGB(255, 255, 255))  # disabled
mesh_13 = Mesh(flatten(solver_3.O))  # disabled
wbedges_6 = WeaverbirdsMeshEdges(MeshOrPolylines=weld)  # disabled
# Bake the mesh, cut doors for analysis.
preview_4 = CustomPreview(Geometry=solver_3.O, Material=swatch_3)  # disabled

# ----
# Groups
# External input
# Parameters
# First floor vault
group_toggle_5 = GroupToggle(ToggleActive=True, ToggleVisible=False)  # disabled
preview_5 = CustomPreview(Geometry=[solver_3.O, extr], Material=swatch_3)  # disabled
mesh_14 = Mesh(extr)  # disabled

mesh_15 = Data(graft(mesh_13))  # disabled

rulesrf = RuledSurface(CurveA=data, CurveB=data_2)  # disabled
brep_9 = Brep(rulesrf)
# Bake the mesh add openings and feed it into the karamba script
mesh_16 = Mesh([brep_9, mesh_10, rulesrf])

# ---- group: Short module
exterior_walls_with_openings = Brep([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])  # disabled
exterior_walls_straight = Brep(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)  # disabled
floor_anchor = Curve([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])  # disabled
vault = Mesh([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])  # disabled

# ----
number_slider_18 = Slider(0, range=0..100)  # disabled
number_slider_19 = Slider(66, range=0..100)  # disabled
number_slider_20 = Slider(48, range=0..100)  # disabled

number_slider_21 = Slider(66, range=0..100)  # disabled
number_slider_22 = Slider(66, range=0..100)  # disabled

vault_supports = Curve([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])  # disabled
vault_1 = Mesh([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])  # disabled

number_slider_23 = Slider(16, range=0..100)  # disabled
number_slider_24 = Slider(2, range=0..10)  # disabled
number_slider_25 = Slider(3, range=0..100)  # disabled
number_slider_26 = Slider(4, range=0..100)  # disabled

number_slider_27 = Slider(1, range=0..10)  # disabled
number_slider_28 = Slider(0, range=0..100)  # disabled
number_slider_29 = Slider(0, range=0..10)  # disabled
number_slider_30 = Slider(1, range=0..10)  # disabled

curved_walls = Brep([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])  # disabled
straight_walls = Brep([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])  # disabled

crv_2 = Curve([<curve referenced from the Rhino model> x2])  # disabled
brep_10 = Brep([<brep referenced from the Rhino model> x2])  # disabled

number_slider_31 = Slider(6, range=0..100)  # disabled
number_slider_32 = Slider(3, range=0..100)  # disabled

number_slider_33 = Slider(4, range=0..100)  # disabled
number_slider_34 = Slider(8, range=0..100)  # disabled

number_slider_35 = Slider(20, range=0..100)  # disabled
number_slider_36 = Slider(3, range=0..100)  # disabled

number_slider_37 = Slider(4, range=0..100)  # disabled
number_slider_38 = Slider(3, range=0..100)  # disabled

crv_3 = Curve([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])  # disabled
crv_4 = Curve([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])  # disabled
crv_5 = Curve([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])  # disabled
crv_6 = Curve([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])  # disabled
crv_7 = Curve([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])  # disabled

number_slider_39 = Slider(0, range=0..10)  # disabled
number_slider_40 = Slider(0, range=0..100)  # disabled

# ----
# Making the mesh and supports for structural analysis.
# It is important that the tessellation lines are continuous
vault_2 = Mesh([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])  # disabled

# ---- group: Vault support
crv_8 = Curve([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])  # disabled

# ---- group: Long module
exterior_wall_3 = Brep([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])  # disabled
exterior_wall_2 = Brep([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])  # disabled
exterior_curved_wall = Brep([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])  # disabled
interior_wall = Brep([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])  # disabled
exterior_wall = Brep([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])  # disabled
vault4_final = Mesh(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)  # disabled
floor_anchor_2 = Curve([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])  # disabled

# ----
interior_wall_2 = Slider(6, range=0..100)  # disabled
interior_wall_2_2 = Slider(29, range=0..100)  # disabled
exterior_wall_2_2 = Slider(20, range=0..100)  # disabled
exterior_wall_4 = Slider(4, range=0..100)  # disabled
exterior_wall_5 = Slider(8, range=0..100)  # disabled
exterior_wall_2_3 = Slider(3, range=0..100)  # disabled
number_slider_41 = Slider(0, range=0..10)  # disabled
number_slider_42 = Slider(0, range=0..100)  # disabled
interior_wall_3 = Slider(3, range=0..100)  # disabled
interior_wall_4 = Slider(18, range=0..100)  # disabled

# ---- group: Short module
exterior_curved_wall_2 = Brep([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])  # disabled
floor_anchor_3 = Curve([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])  # disabled
vault_3 = Mesh(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)  # disabled
exterior_wall_6 = Brep([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])  # disabled
exterior_wall_2_4 = Brep(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)  # disabled

# ----
# Making the mesh and supports for structural analysis.
# It is important that the tessellation lines are continuous
mesh_uv_4 = MeshSurface(Surface=straight_walls, UCount=number_slider_20, VCount=number_slider_20, Overhang=True, Equalize=False)  # disabled
mesh_17 = Mesh(curved_walls)  # disabled
divide = DivideCurve(Curve=crv_2, Count=number_slider_22, Kinks=False)  # -> Points, Tangents, Parameters; disabled
mesh_uv_5 = MeshSurface(Surface=brep_10, UCount=number_slider_21, VCount=number_slider_21, Overhang=True, Equalize=False)  # disabled
divide_2 = DivideCurve(Curve=crv_5, Count=number_slider_25, Kinks=False)  # -> Points, Tangents, Parameters; disabled
divide_3 = DivideCurve(Curve=crv_4, Count=number_slider_20, Kinks=False)  # -> Points, Tangents, Parameters; disabled
divide_4 = DivideCurve(Curve=crv_3, Count=number_slider_26, Kinks=False)  # -> Points, Tangents, Parameters; disabled
m_loop = WeightedLoopSubdivision(M=mesh_17, L=1, E=number_slider_18, TE=1, TV=1)  # -> out, A; inputs M: Mesh, TE: list, TV: list; disabled
# ---------- m_loop: VB ----------
    Component.Params.Input(0).Name = "Mesh"
    Component.Params.Input(0).Description = "An open or closed mesh whose faces should be triangular, all quad faces will be triangulated automatically"
    Component.Params.Input(1).Name = "Loops"
    Component.Params.Input(1).Description = "The number of iterations applied to each face"
    Component.Params.Input(2).Name = "Edge Type"
    Component.Params.Input(2).Description = "0=Fixed, 1=Smooth, 2=Fixed Corners"
    Component.Params.Input(3).Name = "Edge Weight [Vertex]"
    Component.Params.Input(3).Description = "An optional list of double values which overides the percent between the existing edge midpoint and the new smoothed vertex (1=Default)"
    Component.Params.Input(4).Name = "Vertex Weight [Vertex]"
    Component.Params.Input(4).Description = "An optional list of double values which overides the percent between the existing vertex and the new smoothed vertex (1=Default)"

    Component.Params.Output(1).Name = "Mesh"
    Component.Params.Output(1).Description = "If successful, a valid mesh"

    If m IsNot Nothing Then
      Dim ma As New mesh
      Dim i,lp As Integer
      Dim txV,txE As New list(Of Double)
      Dim xV(),xE() As Double
      Dim bn As Boolean
      Dim cb As Boolean

      'input mesh to the looped mesh
      m.weld(math.pi)
      If m.Faces.QuadCount() > 0 Then m.Faces.ConvertQuadsToTriangles
      ma = m

      ' match multiplier and color values to vertex count
      xV = TV.toarray()
      xE = TE.toarray()
      For i = 0 To m.Vertices.count() - 1 Step 1
        txV.add(xV(bC(xV, i)))
        txE.add(xE(bC(xE, i)))
      Next
      xV = txV.toarray()
      xE = txE.toarray()

      bn = m.IsClosed() = False

      For lp = 0 To L - 1 Step 1

        Dim mv As Rhino.Geometry.Collections.MeshVertexList
        Dim mf As Rhino.Geometry.Collections.MeshFaceList
        Dim mfn As Rhino.Geometry.Collections.MeshFaceNormalList
        Dim mc As Rhino.Geometry.Collections.MeshVertexColorList
        Dim mte As Rhino.Geometry.Collections.MeshTopologyEdgeList
        Dim mtv As Rhino.Geometry.Collections.MeshTopologyVertexList
        Dim mnv() As Boolean
        Dim nes As New list(Of Boolean)
        Dim pv() As point3d

        If ma.VertexColors.Count() > 0 Then
          cb = True
        Else
          cb = False
          ma.VertexColors.CreateMonotoneMesh(color.LightBlue)
        End If

        mv = ma.Vertices
        mf = ma.Faces
        mfn = ma.FaceNormals
        mc = ma.VertexColors
        mte = ma.TopologyEdges
        mtv = ma.TopologyVertices

        pv = mv.ToPoint3dArray
        mnv = ma.GetNakedEdgePointStatus

        Dim vo,vt As New list(Of point3d)
        Dim fo As New list(Of MeshFace)
        Dim j,k,u,v,cf,ce,cv As Integer
        Dim fi() As Integer
        Dim p(3) As point3d
        Dim mvi(3) As Integer
        Dim rv,re As New list(Of Double)
        Dim oc As New list(Of color)

        cv = mv.count()
        ce = mte.count()
        cf = mf.count()

        'Faces
        For i = 0 To cf - 1 Step 1
          fi = mtv.IndicesFromFace(i)
          mvi(0) = mtv.MeshVertexIndices(fi(0))(0)
          mvi(1) = mtv.MeshVertexIndices(fi(1))(0)
          mvi(2) = mtv.MeshVertexIndices(fi(2))(0)

          fo.add(New meshface(mte.GetEdgeIndex(fi(0), fi(1)), mte.GetEdgeIndex(fi(1), fi(2)), mte.GetEdgeIndex(fi(2), fi(0))))

          fo.add(New meshface(mte.GetEdgeIndex(fi(0), fi(1)), ce + mvi(1), mte.GetEdgeIndex(fi(1), fi(2))))
          fo.add(New meshface(mte.GetEdgeIndex(fi(1), fi(2)), ce + mvi(2), mte.GetEdgeIndex(fi(2), fi(0))))
          fo.add(New meshface(mte.GetEdgeIndex(fi(2), fi(0)), ce + mvi(0), mte.GetEdgeIndex(fi(0), fi(1))))
        Next

        'Edges
        For i = 0 To ce - 1 Step 1
          Dim cfi() As Integer
          Dim ta,tb As New list(Of Integer)
          Dim cei As Rhino.IndexPair

          cfi = mte.GetConnectedFaces(i)
          cei = mte.GetTopologyVertices(i)
          u = mtv.MeshVertexIndices(cei.I)(0)
          v = mtv.MeshVertexIndices(cei.J)(0)
          p(0) = (pv(u) + pv(v)) / 2

          If ubound(cfi) > 0 Then
            ta = mf.GetTopologicalVertices(cfi(0)).tolist()
            ta.remove(cei.I)
            ta.remove(cei.J)

            tb = mf.GetTopologicalVertices(cfi(1)).tolist()
            tb.remove(cei.I)
            tb.remove(cei.J)

            p(1) = pv(mtv.meshvertexindices(ta(0))(0))
            p(2) = pv(mtv.meshvertexindices(tb(0))(0))
            p(3) = evalP(p(0), pv(u) * 3 / 8 + pv(v) * 3 / 8 + p(1) / 8 + p(2) / 8, (xe(u) + xe(v)) / 2)

            nes.add(False)
          Else
            p(3) = p(0)
            nes.add(True)
          End If

          vo.add(p(3))
          vt.add(p(3))
          rv.add((xV(u) + xV(v)) / 2)
          re.add((xE(u) + xE(v)) / 2)
          oc.add(avgC2(mc(u), mc(v)))
        Next

        'Vertices
        For i = 0 To cv - 1 Step 1
          Dim tvi As Integer
          Dim cvi As New list(Of Integer)
          Dim q(2) As point3d
          Dim bne As Boolean = False

          tvi = mtv.TopologyVertexIndex(i)

          mtv.SortEdges(tvi)

          cvi = mtv.ConnectedTopologyVertices(tvi).tolist()
          cvi.remove(tvi)
          k = cvi.count()

          For j = 0 To k - 1 Step 1
            u = mte.GetEdgeIndex(tvi, cvi.item(j))
            q(0) += pv(mtv.MeshVertexIndices(cvi.item(j))(0))

            If nes(u) Then
              bne = True
              q(2) += pv(mtv.MeshVertexIndices(cvi.item(j))(0))
            End If
          Next

          If bne Then
            If e = 0 Then
              q(1) = pv(i)
            ElseIf e = 2 Then
              If k = 2 Then
                q(1) = pv(i)
              Else
                q(1) = evalP(pv(i), q(2) / 2, 0.25)
              End If
            Else
              q(1) = evalP(pv(i), q(2) / 2, 0.25)
            End If
          Else
            If k = 3 Then
              q(1) = evalp(pv(i), q(0) / k, xv(i) * 9 / 16)
            Else
              q(1) = evalp(pv(i), q(0) / k, xv(i) * 3 / 8)
            End If
          End If


          vo.add(q(1))
          rv.add(xV(i))
          re.add(xE(i))
          oc.add(mc(i))

        Next

        Dim mo As New mesh
        mo.Vertices.AddVertices(vo)
        mo.Faces.AddFaces(fo)
        If cb Then mo.VertexColors.AppendColors(oc.toarray())
        mo.FaceNormals.ComputeFaceNormals()
        mo.Normals.ComputeNormals()

        ma = mo
        xV = rv.toarray()
        xE = re.toarray()

        'Loop
      Next
      A = ma
    End If
# ---------- m_loop: VB additional code ----------
  Private Function bC(ByVal arrObj() As Double, ByVal t As Integer)
    Dim intOut As Integer
    If t > uBound(arrObj) Then intOut = uBound(arrObj) Else intOut = t
    Return intOut
  End Function

  Private Function evalP(ByVal op As point3d, ByVal tp As Point3d, ByVal t As Double)
    Return New point3d(op + (tp - op) * t)
  End Function

  Private Function avgC2(ByVal c0 As color, ByVal c1 As color)
    Dim r,g,b As Integer
    r = CInt(((CInt(c0.R) + CInt(c1.R)) / 2))
    g = CInt(((CInt(c0.G) + CInt(c1.G)) / 2))
    b = CInt(((CInt(c0.B) + CInt(c1.B)) / 2))

    If R < 0 Then r = 0 Else If r > 255 Then r = 255
    If G < 0 Then g = 0 Else If r > 255 Then g = 255
    If B < 0 Then b = 0 Else If r > 255 Then b = 255

    Return color.FromArgb(r, g, b)
  End Function
# ---------- end m_loop ----------
mesh_18 = Mesh([mesh_uv_4, m_loop.A])  # disabled

# ----
# Making the mesh and supports for structural analysis.
# It is important that the tessellation lines are continuous
mesh_19 = Mesh(exterior_curved_wall)  # disabled
wbedges_7 = WeaverbirdsMeshEdges(MeshOrPolylines=vault4_final)  # disabled
mesh_uv_6 = MeshSurface(Surface=[exterior_wall, exterior_wall_6], UCount=exterior_wall_4, VCount=exterior_wall_5, Overhang=True, Equalize=False)  # disabled
mesh_uv_7 = MeshSurface(Surface=exterior_wall_2_4, UCount=exterior_wall_2_3, VCount=exterior_wall_2_2, Overhang=True, Equalize=False)  # disabled
mesh_uv_8 = MeshSurface(Surface=exterior_wall_2, UCount=interior_wall_3, VCount=interior_wall_4, Overhang=True, Equalize=False)  # disabled
mesh_uv_9 = MeshSurface(Surface=exterior_wall_3, UCount=interior_wall_2, VCount=interior_wall_2_2, Overhang=True, Equalize=False)  # disabled
m_loop_2 = WeightedLoopSubdivision(M=[vault4_final, vault_3], L=number_slider_41, E=number_slider_42, TE=1, TV=1)  # -> out, A; inputs M: Mesh, TE: list, TV: list; disabled; same code as m_loop
m_loop_3 = WeightedLoopSubdivision(M=[mesh_19, exterior_curved_wall_2], L=number_slider_41, E=number_slider_42, TE=1, TV=1)  # -> out, A; inputs M: Mesh, TE: list, TV: list; disabled; same code as m_loop
m_loop_4 = WeightedLoopSubdivision(M=mesh_uv_6, L=number_slider_41, E=number_slider_42, TE=1, TV=1)  # -> out, A; inputs M: Mesh, TE: list, TV: list; disabled; same code as m_loop
m_loop_5 = WeightedLoopSubdivision(M=mesh_uv_7, L=number_slider_41, E=number_slider_42, TE=1, TV=1)  # -> out, A; inputs M: Mesh, TE: list, TV: list; disabled; same code as m_loop
m_loop_6 = WeightedLoopSubdivision(M=mesh_uv_8, L=number_slider_41, E=number_slider_42, TE=1, TV=1)  # -> out, A; inputs M: Mesh, TE: list, TV: list; disabled; same code as m_loop
m_loop_7 = WeightedLoopSubdivision(M=mesh_uv_9, L=number_slider_41, E=number_slider_42, TE=1, TV=1)  # -> out, A; inputs M: Mesh, TE: list, TV: list; disabled; same code as m_loop
wbedges_8 = WeaverbirdsMeshEdges(MeshOrPolylines=[m_loop_4.A, m_loop_3.A, m_loop_2.A, m_loop_6.A, m_loop_7.A])  # disabled

mesh_input_4 = GhPythonScript(M=vault_2)  # -> out, flatten(v), e, f; inputs M: Mesh; same code as mesh_input
P_4 = Point(mesh_input_4.v)  # disabled
points_in_a_band_4 = GhPythonScript(v=P_4, selectionCurves=crv_8)  # -> out, inBandVertices, inBandIndices; inputs v: list of Point3d, selectionCurves: list of Curve; disabled; same code as points_in_a_band
removeduplicatepts = RemoveDuplicatePts(Points=flatten(points_in_a_band_4.inBandVertices), Tolerance=0.01)  # -> flatten(UniquePoints); disabled
support_karamba3d = SupportKaramba3D(PosInd=removeduplicatepts, menu=[buttons(on, on, on, on, on, on)])  # -> flatten(Support); disabled

# ----
# material properties
adobe_density_kg_m3 = Panel("1500")  # disabled
youngs_module_mpa = Panel("150")  # disabled
expression = Expression(d=adobe_density_kg_m3, Expression="d*0.01")  # disabled
expression_2 = Expression(E=youngs_module_mpa, Expression="E/10")  # disabled
panel = Panel("Adobe")  # disabled
panel_2 = Panel(expression)  # disabled
panel_3 = Panel("0.015")  # disabled
material_properties_karamba3d = MaterialPropertiesKaramba3D(
    FamilyOfMaterial=panel,
    Name=panel,
    YoungsModulus_kN_cm2=expression_2,
    InPlaneShearModulus_kN_cm2=expr("x/2.5", expression_2),
    TransverseShearModulus_kN_cm2=8076,
    SpecificWeight_kN_m3=panel_2,
    CoefficientOfThermalExpansion_1_C=1e-05,
    YieldStrength_kN_cm2=panel_3,
    mode="Isotrop")  # disabled

number_slider_43 = Slider(-1, range=-10..2)  # disabled
multiplication = Multiplication(A=number_slider_43, B=1.2)  # disabled
unit_z = UnitZ(Factor=multiplication)  # disabled
panel_4 = Panel("1")  # disabled
loads = LoadsKaramba3D(Vector=unit_z, Mesh=vault_2, LCase=panel_4, mode="MeshLoad -Const.", menu=[buttons(on, off, off), buttons(on, on)])  # disabled

# ----
# material properties
adobe_density_kg_m3_2 = Panel("1500")  # disabled
youngs_module_mpa_2 = Panel("150")  # disabled
expression_3 = Expression(d=adobe_density_kg_m3_2, Expression="d*0.01")  # disabled
expression_4 = Expression(E=youngs_module_mpa_2, Expression="E/10")  # disabled
panel_5 = Panel("Adobe")  # disabled
panel_6 = Panel(expression_3)  # disabled
panel_7 = Panel("0.015")  # disabled
material_properties_karamba3d_2 = MaterialPropertiesKaramba3D(
    FamilyOfMaterial=panel_5,
    Name=panel_5,
    YoungsModulus_kN_cm2=expression_4,
    InPlaneShearModulus_kN_cm2=expr("x/2.5", expression_4),
    TransverseShearModulus_kN_cm2=8076,
    SpecificWeight_kN_m3=panel_6,
    CoefficientOfThermalExpansion_1_C=1e-05,
    YieldStrength_kN_cm2=panel_7,
    mode="Isotrop")  # disabled

# ----
# material properties
adobe_density_kg_m3_3 = Panel("1500")  # disabled
youngs_module_mpa_3 = Panel("150")  # disabled
expression_5 = Expression(d=adobe_density_kg_m3_3, Expression="d*0.01")  # disabled
expression_6 = Expression(E=youngs_module_mpa_3, Expression="E/10")  # disabled
panel_8 = Panel("Adobe")  # disabled
panel_9 = Panel(expression_5)  # disabled
panel_10 = Panel("0.015")  # disabled
material_properties_karamba3d_3 = MaterialPropertiesKaramba3D(
    FamilyOfMaterial=panel_8,
    Name=panel_8,
    YoungsModulus_kN_cm2=expression_6,
    InPlaneShearModulus_kN_cm2=expr("x/2.5", expression_6),
    TransverseShearModulus_kN_cm2=8076,
    SpecificWeight_kN_m3=panel_9,
    CoefficientOfThermalExpansion_1_C=1e-05,
    YieldStrength_kN_cm2=panel_10,
    mode="Isotrop")  # disabled

# ----
# material properties
adobe_density_kg_m3_4 = Panel("1500")  # disabled
youngs_module_mpa_4 = Panel("150")  # disabled
expression_7 = Expression(d=adobe_density_kg_m3_4, Expression="d*0.01")  # disabled
expression_8 = Expression(E=youngs_module_mpa_4, Expression="E/10")  # disabled
panel_11 = Panel("Adobe")  # disabled
panel_12 = Panel(expression_7)  # disabled
panel_13 = Panel("0.015")  # disabled
material_properties_karamba3d_4 = MaterialPropertiesKaramba3D(
    FamilyOfMaterial=panel_11,
    Name=panel_11,
    YoungsModulus_kN_cm2=expression_8,
    InPlaneShearModulus_kN_cm2=expr("x/2.5", expression_8),
    TransverseShearModulus_kN_cm2=8076,
    SpecificWeight_kN_m3=panel_12,
    CoefficientOfThermalExpansion_1_C=1e-05,
    YieldStrength_kN_cm2=panel_13,
    mode="Isotrop")  # disabled

panel_14 = Panel("0")  # disabled
loads_2 = LoadsKaramba3D(Vector=Vector(0, 0, -1), LCase=panel_14, mode="Gravity")  # disabled

# ----
# material properties
adobe_density_kg_m3_5 = Panel("1500")  # disabled
youngs_module_mpa_5 = Panel("150")  # disabled
expression_9 = Expression(d=adobe_density_kg_m3_5, Expression="d*0.01")  # disabled
expression_10 = Expression(E=youngs_module_mpa_5, Expression="E/10")  # disabled
panel_15 = Panel("Adobe")  # disabled
panel_16 = Panel(expression_9)  # disabled
panel_17 = Panel("0.015")  # disabled
material_properties_karamba3d_5 = MaterialPropertiesKaramba3D(
    FamilyOfMaterial=panel_15,
    Name=panel_15,
    YoungsModulus_kN_cm2=expression_10,
    InPlaneShearModulus_kN_cm2=expr("x/2.5", expression_10),
    TransverseShearModulus_kN_cm2=8076,
    SpecificWeight_kN_m3=panel_16,
    CoefficientOfThermalExpansion_1_C=1e-05,
    YieldStrength_kN_cm2=panel_17,
    mode="Isotrop")  # disabled

# ---- group: Gravity
loads_3 = LoadsKaramba3D(Vector=Vector(0, 0, -1), LCase="0", mode="Gravity")

panel_18 = Panel("0")  # disabled
loads_4 = LoadsKaramba3D(Vector=Vector(0, 0, -1), LCase=panel_18, mode="Gravity")  # disabled

panel_19 = Panel("0")  # disabled
loads_5 = LoadsKaramba3D(Vector=Vector(0, 0, -1), LCase=panel_19, mode="Gravity")  # disabled

panel_20 = Panel("0")  # disabled
loads_6 = LoadsKaramba3D(Vector=Vector(0, 0, -1), LCase=panel_20, mode="Gravity")  # disabled

# ----
swatch_4 = ColourSwatch(SwatchColor=RGB(235, 23, 0))
X = UnitX(Factor=Slider(90, range=0..100))
mesh_20 = Mesh([<mesh referenced from the Rhino model> x4])

# ----
# Mesh creation
number_slider_44 = Slider(-0.3, range=-10..1)

brep_11 = Brep([<brep referenced from the Rhino model> x16])

# ---- group: OFFSET MESH
boolean_toggle = BooleanToggle(True)
mesh_21 = Mesh(mesh_15)
mesh_offset_extrude = MeshOffsetExtrude(M=mesh_21, B=False, E=boolean_toggle, C0=boolean_toggle, C1=True, D=Slider(0.3, range=0..1))  # -> out, A; inputs M: Mesh, V: list of Vector3d, D: list
# ---------- mesh_offset_extrude: VB ----------
    Component.Params.Input(0).Name = "Mesh"
    Component.Params.Input(0).Description = "Open or closed mesh"
    Component.Params.Input(1).Name = "Both Sides"
    Component.Params.Input(1).Description = "If true the mesh is offset in both directions along the vertex normals"
    Component.Params.Input(2).Name = "Edges"
    Component.Params.Input(2).Description = "If true the mesh will contain faces on the edges between the two offset mesh faces"
    Component.Params.Input(3).Name = "Closed Bottom"
    Component.Params.Input(3).Description = "If true the mesh will be closed on the origin face"
    Component.Params.Input(4).Name = "Closed Top"
    Component.Params.Input(4).Description = "If true the mesh will be closed on the offset face"
    Component.Params.Input(5).Name = "Vector [Vertex]"
    Component.Params.Input(5).Description = "An optional vector that sets the direction of extrusion, if empty, the new mesh will be offset along the vertex normals"
    Component.Params.Input(6).Name = "Distance [Vertex, Rh Units]"
    Component.Params.Input(6).Description = "A single number or list of numbers corresponding to each vertex of a mesh which sets the Rhino unit based distance that the new geometry is offset from each mesh face"

    Component.Params.Output(1).Name = "Mesh"
    Component.Params.Output(1).Description = "If successful, a valid mesh"

    If m IsNot Nothing Then

      Dim mf As Rhino.Geometry.Collections.MeshFaceList = Nothing
      Dim mv As Rhino.Geometry.Collections.MeshVertexList = Nothing
      Dim mtv As Rhino.Geometry.Collections.MeshTopologyVertexList = Nothing
      Dim mte As Rhino.Geometry.Collections.MeshTopologyEdgeList = Nothing
      Dim mn As Rhino.Geometry.Collections.MeshVertexNormalList = Nothing
      Dim mc As Rhino.Geometry.Collections.MeshVertexColorList = Nothing

      mf = m.Faces
      mv = m.Vertices
      mtv = m.TopologyVertices
      mte = m.TopologyEdges
      mn = m.Normals
      mc = m.VertexColors

      Dim clrB As Boolean = False
      If mc.count() > 0 Then clrB = True

      Dim i,cv,cf,u(1),hd As Integer
      Dim blnV As Boolean
      Dim vec As vector3d
      Dim ova, ovb As New list(Of point3d)
      Dim vf As New list(Of Vector3f)
      Dim ofc As New list(Of MeshFace)
      If b Then hd = 2 Else hd = 1
      
      cv = mv.count()
      cf = mf.count()

      If (D.count() - 1) < cv Then D = matchDbl(D, cv)

      If v.count() > 0 Then
        blnV = True
        If (V.count() - 1) < cv Then V = matchVec(V, cv)
      End If

      'Define Base Vertices
      For i = 0 To cv - 1 Step 1
        If blnV Then vec = V(i) Else vec = mn(i)
        vec.Unitize()
        vec *= (D(i) / hd)

        ovb.add(New point3d(mv(i)) + vec)
        If Not b Then vec *= 0
        vec.Reverse()
        ova.add(New point3d(mv(i)) + vec)
      Next

      If (c0 Or (((Not c0) And (Not e)) And c1)) Then ofc = mf.ToList()

      If ((e or c0) And c1) Then
        For i = 0 To cf - 1 Step 1
          If mf(i).isquad() Then
            ofc.add(New meshface(mf(i).A + cv, mf(i).B + cv, mf(i).C + cv, mf(i).D + cv))
          Else
            ofc.add(New meshface(mf(i).A + cv, mf(i).B + cv, mf(i).C + cv))
          End If
        Next
      End If

      If e Then
        For i = 0 To mte.count() - 1 Step 1

          u(0) = mtv.MeshVertexIndices(mte.GetTopologyVertices(i).I)(0)
          u(1) = mtv.MeshVertexIndices(mte.GetTopologyVertices(i).J)(0)

          If uBound(mte.GetConnectedFaces(i)) < 1 Then
            ofc.add(New meshface(u(0), u(1), u(1) + cv, u(0) + cv))
          End If
        Next
      End If

      Dim mo As New mesh

      If (c0 Or e) Then
        mo.Vertices.AddVertices(ova.toarray())
        If clrB Then mo.VertexColors.AppendColors(mc.ToArray())
      End If
      If (c1 Or e) Then
        mo.Vertices.AddVertices(ovb.toarray())
        If clrB Then mo.VertexColors.AppendColors(mc.ToArray())
      End If

      mo.Faces.AddFaces(ofc)

      A = mo
    End If
# ---------- mesh_offset_extrude: VB additional code ----------
  Private Function matchDbl(ByVal a As list(Of Double), ByVal t As Integer)
    Dim i,k As Integer
    k = a.count()
    For i = 0 To ((t + 1) - k) - 1 Step 1
      a.add(a.item(k - 1))
    Next
    Return a
  End Function

  Private Function matchVec(ByVal a As list(Of vector3d), ByVal t As Integer)
    Dim i,k As Integer
    k = a.count()
    For i = 0 To ((t + 1) - k) - 1 Step 1
      a.add(a.item(k - 1))
    Next
    Return a
  End Function
# ---------- end mesh_offset_extrude ----------
mesh_unifynormals = MeshUnifyNormals(Mesh=mesh_offset_extrude.A)

# ----
edges = BrepEdges(Brep=brep_11)  # -> Naked, flatten(Interior), NonManifold
medges_3 = MeshEdges(Mesh=mesh_20)  # -> NakedEdges, InteriorEdges, NonManifoldEdges
data_3 = Data(medges_3.InteriorEdges)

# ---- group: OUTPUT
shape_gf = Mesh(mesh_unifynormals)

# ----
# Output
# Groups
# External input
# Parameters
# Ground floor vault 2
u_count_long_module_2 = Slider(105, range=0..1000)  # disabled
number_slider_45 = Slider(18, range=0..100)  # disabled
group_toggle_6 = GroupToggle(ToggleActive=True, ToggleVisible=False)  # disabled
brep_12 = Brep([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])  # disabled

mesh_uv_10 = MeshSurface(Surface=brep_12, UCount=u_count_short_module, VCount=number_slider_45, Overhang=True, Equalize=False)  # disabled
weld_3 = WeldMesh(Mesh=mesh_uv_10, Angle=3.141592654)  # disabled
wbedges_9 = WeaverbirdsMeshEdges(MeshOrPolylines=weld_3)  # disabled

Z_3 = UnitZ(Factor=wall_height)  # disabled
mesh_22 = Mesh(weld_3)  # disabled
move_5 = Move(Geometry=mesh_22, Motion=Z_3)  # -> Geometry, Transform; disabled
move_6 = Move(Geometry=anchor_5, Motion=Z_3)  # -> Geometry, Transform; disabled

mesh_input_5 = GhPythonScript(M=move_5.Geometry)  # -> out, flatten(v), e, f; inputs M: Mesh; disabled; same code as mesh_input
P_5 = Point(mesh_input_5.v)  # disabled
points_in_a_band_5 = GhPythonScript(v=P_5, selectionCurves=move_6.Geometry)  # -> out, inBandVertices, inBandIndices; inputs v: list of Point3d, selectionCurves: list of Curve; disabled; same code as points_in_a_band

pt_4 = Point(flatten(points_in_a_band_5.inBandVertices))  # disabled
mesh_23 = Mesh(flatten(move_5.Geometry))  # disabled

edgelengths_4 = EdgeLengths(Mesh=mesh_23, LengthFactor=edge_length_factor_3, Strength=edge_length_strength_4)  # disabled
anchor_12 = Anchor(Point=pt_4, Strength=10000)  # disabled
vertexloads_4 = VertexLoads(Mesh=mesh_23, Strength=vertex_load_strength_4)  # disabled
show_4 = Show(G=mesh_23)  # disabled

# ----
# Ground floor vault final
number_slider_46 = Slider(18, range=0..100)  # disabled
group_toggle_7 = GroupToggle(ToggleActive=True, ToggleVisible=False)  # disabled

mesh_uv_11 = MeshSurface(Surface=brep_5, UCount=u_count_short_module, VCount=number_slider, Overhang=True, Equalize=False)  # disabled
Z_4 = UnitZ(Factor=wall_height)  # disabled
move_7 = Move(Geometry=anchor_5, Motion=Z_4)  # -> Geometry, Transform; disabled

weld_4 = WeldMesh(Mesh=mesh_uv_11, Angle=3.141592654)  # disabled
wbedges_10 = WeaverbirdsMeshEdges(MeshOrPolylines=weld_4)  # disabled

mesh_24 = Mesh(weld_4)  # disabled
move_8 = Move(Geometry=mesh_24, Motion=Z_4)  # -> Geometry, Transform; disabled

mesh_input_6 = GhPythonScript(M=move_8.Geometry)  # -> out, flatten(v), e, f; inputs M: Mesh; disabled; same code as mesh_input
P_6 = Point(mesh_input_6.v)  # disabled
points_in_a_band_6 = GhPythonScript(v=P_6, selectionCurves=move_7.Geometry)  # -> out, inBandVertices, inBandIndices; inputs v: list of Point3d, selectionCurves: list of Curve; disabled; same code as points_in_a_band

pt_5 = Point(flatten(points_in_a_band_6.inBandVertices))  # disabled
mesh_25 = Mesh(flatten(move_8.Geometry))  # disabled

edgelengths_5 = EdgeLengths(Mesh=mesh_25, LengthFactor=edge_length_factor, Strength=edge_length_strength_2)  # disabled
anchor_13 = Anchor(Point=pt_5, Strength=10000)  # disabled
vertexloads_5 = VertexLoads(Mesh=mesh_25, Strength=vertex_load_strength_2)  # disabled
show_5 = Show(G=mesh_25)  # disabled

# ----
# Solver
solver_4 = Solver(
    GoalObjects=flatten([edgelengths_5, anchor_13, vertexloads_5, show_5, edgelengths_4, anchor_12, vertexloads_4, show_4]),
    Reset=button_2,
    Threshold=1e-15,
    Tolerance=0.01,
    On=toggle_2)  # -> I, V, flatten(O); disabled

swatch_5 = ColourSwatch(SwatchColor=RGB(255, 255, 255))  # disabled
mesh_26 = Mesh(flatten(solver_4.O))  # disabled
mesh_27 = Data(flatten(mesh_26))  # disabled
wbedges_11 = WeaverbirdsMeshEdges(MeshOrPolylines=graft(solver_4.O))  # disabled

preview_6 = CustomPreview(Geometry=solver_4.O, Material=swatch_5)  # disabled
# Bake the mesh add openings and feed it into the karamba script
preview_7 = CustomPreview(Geometry=solver_4.O, Material=swatch_5)  # disabled

mesh_uv_12 = MeshSurface(Surface=brep_6, UCount=u_count_short_module_2, VCount=number_slider_8, Overhang=True, Equalize=False)  # disabled
Z_5 = UnitZ(Factor=wall_height_3)  # disabled
move_9 = Move(Geometry=anchor_6, Motion=Z_5)  # -> Geometry, Transform; disabled

weld_5 = WeldMesh(Mesh=mesh_uv_12, Angle=3.141592654)  # disabled
wbedges_12 = WeaverbirdsMeshEdges(MeshOrPolylines=weld_5)  # disabled

mesh_28 = Mesh(weld_5)  # disabled
move_10 = Move(Geometry=mesh_28, Motion=Z_5)  # -> Geometry, Transform; disabled

mesh_input_7 = GhPythonScript(M=move_10.Geometry)  # -> out, flatten(v), e, f; inputs M: Mesh; disabled; same code as mesh_input
P_7 = Point(mesh_input_7.v)  # disabled
points_in_a_band_7 = GhPythonScript(v=P_7, selectionCurves=move_9.Geometry)  # -> out, inBandVertices, inBandIndices; inputs v: list of Point3d, selectionCurves: list of Curve; disabled; same code as points_in_a_band

pt_6 = Point(flatten(points_in_a_band_7.inBandVertices))  # disabled
mesh_29 = Mesh(flatten(move_10.Geometry))  # disabled

edgelengths_6 = EdgeLengths(Mesh=mesh_29, LengthFactor=edge_length_factor_4, Strength=edge_length_strength_5)  # disabled
anchor_14 = Anchor(Point=pt_6, Strength=10000)  # disabled
vertexloads_6 = VertexLoads(Mesh=mesh_29, Strength=vertex_load_strength_5)  # disabled
show_6 = Show(G=mesh_29)  # disabled

# ----
# Solver
solver_5 = Solver(
    GoalObjects=flatten([edgelengths_6, anchor_14, vertexloads_6, show_6]),
    Reset=button_3,
    Threshold=1e-15,
    Tolerance=0.01,
    On=toggle_3)  # -> I, V, flatten(O); disabled

swatch_6 = ColourSwatch(SwatchColor=RGB(255, 255, 255))  # disabled
mesh_30 = Mesh(flatten(solver_5.O))  # disabled
mesh_31 = Data(flatten(mesh_30))  # disabled
wbedges_13 = WeaverbirdsMeshEdges(MeshOrPolylines=graft(solver_5.O))  # disabled

preview_8 = CustomPreview(Geometry=solver_5.O, Material=swatch_6)  # disabled
# Bake the mesh, add openings and feed it into the karamba script
preview_9 = CustomPreview(Geometry=solver_5.O, Material=swatch_6)  # disabled

# ---- group: OFFSET MESH
boolean_toggle_2 = BooleanToggle(True)
mesh_32 = Mesh(mesh_31)
mesh_offset_extrude_2 = MeshOffsetExtrude(M=mesh_32, B=False, E=boolean_toggle_2, C0=boolean_toggle_2, C1=True, D=number_slider_44)  # -> out, A; inputs M: Mesh, V: list of Vector3d, D: list; same code as mesh_offset_extrude
mesh_unifynormals_2 = MeshUnifyNormals(Mesh=mesh_offset_extrude_2.A)

# ---- group: OUTPUT
shape_gf_2 = Mesh(mesh_unifynormals_2)

# ----
# Output
# Groups
# External input
# Parameters
# Riwaks
# Deformation result
# Making the mesh and supports for structural analysis.
# It is important that the tessellation lines are continuous
# Analysis result selection
# Analysis result selection
group_toggle_8 = GroupToggle(ToggleActive=True, ToggleVisible=False)  # disabled
number_slider_47 = Slider(6, range=0..100)  # disabled
number_slider_48 = Slider(32, range=0..100)  # disabled
number_slider_49 = Slider(1, range=0..100)  # disabled
number_slider_50 = Slider(2, range=0..100)  # disabled
mesh_uv_13 = MeshSurface(Surface=exterior_walls_straight, UCount=number_slider_48, VCount=number_slider_48, Overhang=True, Equalize=False)  # disabled
m_loop_8 = WeightedLoopSubdivision(M=mesh_uv_13, L=number_slider_29, E=number_slider_30, TE=1, TV=1)  # -> out, A; inputs M: Mesh, TE: list, TV: list; disabled; same code as m_loop
number_slider_51 = Slider(30, range=0..100)  # disabled
number_slider_52 = Slider(60, range=0..100)  # disabled
X_2 = UnitX(Factor=number_slider_51)  # disabled
X_3 = UnitX(Factor=number_slider_52)  # disabled
panel_21 = Panel("1")  # disabled

# ---- group: Shell
m_loop_9 = WeightedLoopSubdivision(M=vault, L=number_slider_50, E=number_slider_28, TE=1, TV=1)  # -> out, A; inputs M: Mesh, TE: list, TV: list; disabled; same code as m_loop

# ----
# Shell
number_slider_53 = Slider(15, range=0..30)  # disabled
panel_22 = Panel("shell")  # disabled
# Support placement
cross_section_vault = CrossSectionKaramba3D(
    FamilyNameOfCrossSection="DefaultCroSec",
    ElementIdentifier=panel_22,
    Material=material_properties_karamba3d_3,
    Height_cm=number_slider_53,
    mode="Shell - Const")  # disabled
mesh_to_shell_karamba3d = MeshToShellKaramba3D(Mesh=m_loop_9.A, Identifier=panel_22, CrossSection=cross_section_vault, LimitDistance_m=0.005)  # -> Element, Points, Info; disabled

# ---- group: Filling load
number_slider_54 = Slider(-1, range=-10..2)  # disabled
multiplication_2 = Multiplication(A=number_slider_54, B=1.2)  # disabled
unit_z_2 = UnitZ(Factor=multiplication_2)  # disabled
panel_23 = Panel("1")  # disabled
loads_7 = LoadsKaramba3D(Vector=unit_z_2, Mesh=m_loop_9.A, LCase=panel_23, mode="MeshLoad -Const.", menu=[buttons(on, off, off), buttons(on, on)])  # disabled

# ----
# First floor vault
# IF STRUCTURAL TEST RESULTS ARE SATISFYING
# ENABLE THIS COMPONENT FOR OFFSETING
group_toggle_9 = GroupToggle(ToggleActive=True, ToggleVisible=False)  # disabled
number_slider_55 = Slider(30, range=0..100)  # disabled
number_slider_56 = Slider(30, range=0..100)  # disabled
number_slider_57 = Slider(60, range=0..100)  # disabled
X_4 = UnitX(Factor=number_slider_56)  # disabled
X_5 = UnitX(Factor=number_slider_57)  # disabled

# ----
# Shell
panel_24 = Panel("shell")  # disabled
# Support placement
cross_section_vault_2 = CrossSectionKaramba3D(
    FamilyNameOfCrossSection="DefaultCroSec",
    ElementIdentifier=panel_24,
    Material=material_properties_karamba3d_2,
    Height_cm=number_slider_55,
    mode="Shell - Const")  # disabled
mesh_to_shell_karamba3d_2 = MeshToShellKaramba3D(Mesh=vault_2, Identifier=panel_24, CrossSection=cross_section_vault_2, LimitDistance_m=0.005)  # -> Element, Points, Info; disabled

# ----
# Output
# Groups
# External input
# Parameters
# Karamba Analysis
# Ground floor vault
group_toggle_10 = GroupToggle(ToggleActive=True, ToggleVisible=False)  # disabled
number_slider_58 = Slider(8, range=0..100)  # disabled
crv_9 = Curve([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])  # disabled
divide_5 = DivideCurve(Curve=crv_6, Count=number_slider_23, Kinks=False)  # -> flatten(Points), Tangents, Parameters; disabled
divide_6 = DivideCurve(Curve=crv_7, Count=number_slider_24, Kinks=False)  # -> flatten(Points), Tangents, Parameters; disabled
divide_7 = DivideCurve(Curve=crv_9, Count=number_slider_58, Kinks=False)  # -> Points, Tangents, Parameters; disabled
pt_7 = Point([divide_4.Points, divide_7.Points, divide_3.Points, divide_2.Points, divide_6.Points, divide_5.Points])  # disabled
mesh_33 = Mesh([mesh_18, vault_1, mesh_uv_5])  # disabled
point = Point(divide.Points)  # disabled
divide_8 = DivideCurve(Curve=vault_supports, Count=number_slider_19, Kinks=False)  # -> Points, Tangents, Parameters; disabled
removeduplicatepts_2 = RemoveDuplicatePts(Points=divide_8.Points, Tolerance=0.01)  # disabled

# ----
# Exterior wall
panel_25 = Panel("exterior walls")  # disabled
thickness = Slider(60, range=0..100)  # disabled
cross_section_karamba3d = CrossSectionKaramba3D(
    FamilyNameOfCrossSection="DefaultCroSec",
    ElementIdentifier=panel_25,
    Material=material_properties_karamba3d,
    Height_cm=thickness,
    mode="Shell - Const")  # disabled
removeduplicatepts_3 = RemoveDuplicatePts(Points=flatten(pt_7), Tolerance=0.01)  # disabled
mesh_to_shell_karamba3d_3 = MeshToShellKaramba3D(Mesh=mesh_18, Identifier=panel_25, CrossSection=cross_section_karamba3d, LimitDistance_m=0.005)  # -> Element, Points, Info; disabled
support_karamba3d_2 = SupportKaramba3D(PosInd=removeduplicatepts_3, menu=[buttons(on, on, on, on, on, on)])  # disabled

# ----
# Shell
number_slider_59 = Slider(30, range=0..30)  # disabled
panel_26 = Panel("shell")  # disabled
# Support placement
cross_section_vault_3 = CrossSectionKaramba3D(
    FamilyNameOfCrossSection="DefaultCroSec",
    ElementIdentifier=panel_26,
    Material=material_properties_karamba3d,
    Height_cm=number_slider_59,
    mode="Shell - Const")  # disabled
mesh_to_shell_karamba3d_4 = MeshToShellKaramba3D(Mesh=vault_1, Identifier=panel_26, CrossSection=cross_section_vault_3, LimitDistance_m=0.005)  # -> Element, Points, Info; disabled
support_karamba3d_3 = SupportKaramba3D(PosInd=removeduplicatepts_2, menu=[buttons(off, on, on, off, off, off)])  # disabled

# ----
# Interior wall
panel_27 = Panel("interior walls")  # disabled
thickness_2 = Slider(60, range=0..100)  # disabled
cross_section_exterior_walls = CrossSectionKaramba3D(
    FamilyNameOfCrossSection="DefaultCroSec",
    ElementIdentifier=panel_27,
    Material=material_properties_karamba3d,
    Height_cm=thickness_2,
    mode="Shell - Const")  # disabled
removeduplicatepts_4 = RemoveDuplicatePts(Points=flatten(point), Tolerance=0.01)  # disabled
mesh_to_shell_karamba3d_5 = MeshToShellKaramba3D(Mesh=mesh_uv_5, Identifier=panel_27, CrossSection=cross_section_exterior_walls, LimitDistance_m=0.005)  # -> Element, Points, Info; disabled
support_karamba3d_4 = SupportKaramba3D(PosInd=removeduplicatepts_4, menu=[buttons(on, off, on, on, on, on)])  # disabled

# ---- group: Slab load and sand load
multiplication_3 = Multiplication(A=Slider(-7.2, range=-10..2), B=1.2)
unit_z_3 = UnitZ(Factor=multiplication_3)
loads_8 = LoadsKaramba3D(Vector=unit_z_3, Mesh=mesh_33, LCase="3", mode="MeshLoad -Const.", menu=[buttons(off, off, on), buttons(on, on)])

# ---- group: Live load
multiplication_4 = Multiplication(A=Slider(-4, range=-10..2), B=1.5)
unit_z_4 = UnitZ(Factor=multiplication_4)
loads_9 = LoadsKaramba3D(Vector=unit_z_4, Mesh=mesh_33, LCase="2", mode="MeshLoad -Const.", menu=[buttons(off, off, on), buttons(on, on)])

# ---- group: Filling load
# Load
number_slider_60 = Slider(-1, range=-10..2)
multiplication_5 = Multiplication(A=number_slider_60, B=1.2)
unit_z_5 = UnitZ(Factor=multiplication_5)
panel_28 = Panel("1")  # disabled
loads_10 = LoadsKaramba3D(Vector=unit_z_5, Mesh=mesh_33, LCase=panel_28, mode="MeshLoad -Const.", menu=[buttons(on, off, off), buttons(on, on)])

# ----
# Ground floor vault 2
floor_anchor_4 = Curve([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])  # disabled
exterior_curved_wall_3 = Brep([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])  # disabled
vault_2_2 = Mesh([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])  # disabled
interior_wall_5 = Brep([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])  # disabled
interior_wall_2_3 = Brep(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)  # disabled
exterior_wall_7 = Brep([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])  # disabled
# Output
# Groups
# External input
# Parameters
group_toggle_11 = GroupToggle(ToggleActive=True, ToggleVisible=False)  # disabled
interior_wall_3_2 = Brep(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)  # disabled
number_slider_61 = Slider(60, range=0..100)  # disabled
panel_29 = Panel("2")  # disabled
swatch_7 = ColourSwatch(SwatchColor=RGB(255, 0, 0))  # disabled
swatch_8 = ColourSwatch(SwatchColor=RGB(255, 0, 0))  # disabled
swatch_9 = ColourSwatch(SwatchColor=RGB(255, 255, 255))  # disabled
swatch_10 = ColourSwatch(SwatchColor=RGB(0, 0, 255))  # disabled
swatch_11 = ColourSwatch(SwatchColor=RGB(0, 0, 255))  # disabled
number_slider_62 = Slider(9, range=0..100)  # disabled
number_slider_63 = Slider(60, range=0..100)  # disabled
X_6 = UnitX(Factor=number_slider_62)  # disabled
X_7 = UnitX(Factor=number_slider_63)  # disabled

# ----
# Making the mesh and supports for structural analysis.
# It is important that the tessellation lines are continuous
mesh_34 = Mesh(exterior_curved_wall_3)  # disabled
wbedges_14 = WeaverbirdsMeshEdges(MeshOrPolylines=vault_2_2)  # disabled
mesh_uv_14 = MeshSurface(Surface=interior_wall_5, UCount=number_slider_37, VCount=number_slider_38, Overhang=True, Equalize=False)  # disabled
mesh_uv_15 = MeshSurface(Surface=interior_wall_3_2, UCount=number_slider_36, VCount=number_slider_35, Overhang=True, Equalize=False)  # disabled
mesh_uv_16 = MeshSurface(Surface=interior_wall_2_3, UCount=number_slider_31, VCount=number_slider_32, Overhang=True, Equalize=False)  # disabled
mesh_uv_17 = MeshSurface(Surface=exterior_wall_7, UCount=number_slider_33, VCount=number_slider_34, Overhang=True, Equalize=False)  # disabled
m_loop_10 = WeightedLoopSubdivision(M=vault_2_2, L=number_slider_39, E=number_slider_40, TE=1, TV=1)  # -> out, A; inputs M: Mesh, TE: list, TV: list; disabled; same code as m_loop
m_loop_11 = WeightedLoopSubdivision(M=mesh_34, L=number_slider_39, E=number_slider_40, TE=1, TV=1)  # -> out, A; inputs M: Mesh, TE: list, TV: list; disabled; same code as m_loop
m_loop_12 = WeightedLoopSubdivision(M=mesh_uv_14, L=number_slider_39, E=number_slider_40, TE=1, TV=1)  # -> out, A; inputs M: Mesh, TE: list, TV: list; disabled; same code as m_loop
m_loop_13 = WeightedLoopSubdivision(M=mesh_uv_17, L=number_slider_39, E=number_slider_40, TE=1, TV=1)  # -> out, A; inputs M: Mesh, TE: list, TV: list; disabled; same code as m_loop
m_loop_14 = WeightedLoopSubdivision(M=mesh_uv_16, L=number_slider_39, E=number_slider_40, TE=1, TV=1)  # -> out, A; inputs M: Mesh, TE: list, TV: list; disabled; same code as m_loop
m_loop_15 = WeightedLoopSubdivision(M=mesh_uv_15, L=number_slider_39, E=number_slider_40, TE=1, TV=1)  # -> out, A; inputs M: Mesh, TE: list, TV: list; disabled; same code as m_loop
wbedges_15 = WeaverbirdsMeshEdges(MeshOrPolylines=[m_loop_10.A, m_loop_13.A, m_loop_12.A, m_loop_14.A, m_loop_15.A, m_loop_11.A])  # disabled

# ----
# Ground floor vault final
group_toggle_12 = GroupToggle(ToggleActive=True, ToggleVisible=False)  # disabled
m_loop_16 = WeightedLoopSubdivision(M=interior_wall, L=number_slider_41, E=number_slider_42, TE=1, TV=1)  # -> out, A; inputs M: Mesh, TE: list, TV: list; disabled; same code as m_loop
wbedges_16 = WeaverbirdsMeshEdges()  # disabled
number_slider_64 = Slider(60, range=0..100)  # disabled
panel_30 = Panel("2")  # disabled
swatch_12 = ColourSwatch(SwatchColor=RGB(255, 0, 0))  # disabled
swatch_13 = ColourSwatch(SwatchColor=RGB(255, 0, 0))  # disabled
swatch_14 = ColourSwatch(SwatchColor=RGB(255, 255, 255))  # disabled
swatch_15 = ColourSwatch(SwatchColor=RGB(0, 0, 255))  # disabled
swatch_16 = ColourSwatch(SwatchColor=RGB(0, 0, 255))  # disabled
number_slider_65 = Slider(30, range=0..100)  # disabled
number_slider_66 = Slider(60, range=0..100)  # disabled
X_8 = UnitX(Factor=number_slider_65)  # disabled
X_9 = UnitX(Factor=number_slider_66)  # disabled

# ---- group: Disable for short module analysis
exterior_walls_curved = Data(m_loop_3.A)  # disabled
exterior_walls = Data([m_loop_3.A, m_loop_4.A, m_loop_7.A, m_loop_6.A])  # disabled
shell = Data(m_loop_2.A)  # disabled
interior_walls = Data(m_loop_16.A)  # disabled
mesh_35 = Mesh([interior_walls, shell, exterior_walls, exterior_walls_curved])  # disabled
exterior_walls_mesh = Data([exterior_walls, exterior_walls_curved])  # disabled

# ---- group: Disable for long module analysis
exterior_walls_mesh_2 = Data([m_loop_3.A, m_loop_4.A, m_loop_5.A])  # disabled
shell_2 = Data(m_loop_2.A)  # disabled
mesh_36 = Mesh([exterior_walls_mesh_2, interior_walls, shell_2])  # disabled

# ----
# Interior wall
group_toggle_13 = GroupToggle(ToggleActive=True, ToggleVisible=False)  # disabled
panel_31 = Panel("Interior walls")  # disabled
thickness_3 = Slider(90, range=0..100)  # disabled
mesh_input_8 = GhPythonScript(M=interior_walls)  # -> out, flatten(v), e, f; inputs M: Mesh; disabled; same code as mesh_input
P_8 = Point(mesh_input_8.v)  # disabled
cross_section_karamba3d_2 = CrossSectionKaramba3D(
    FamilyNameOfCrossSection="DefaultCroSec",
    ElementIdentifier=panel_31,
    Material=material_properties_karamba3d_5,
    Height_cm=thickness_3,
    mode="Shell - Const")  # disabled
points_in_a_band_8 = GhPythonScript(v=P_8, selectionCurves=[floor_anchor_2, floor_anchor_3])  # -> out, inBandVertices, inBandIndices; inputs v: list of Point3d, selectionCurves: list of Curve; disabled; same code as points_in_a_band
removeduplicatepts_5 = RemoveDuplicatePts(Points=flatten(points_in_a_band_8.inBandVertices), Tolerance=0.01)  # -> flatten(UniquePoints); disabled
mesh_to_shell_karamba3d_6 = MeshToShellKaramba3D(Mesh=interior_walls, Identifier=panel_31, CrossSection=cross_section_karamba3d_2, LimitDistance_m=0.005)  # -> Element, Points, Info; disabled
support_karamba3d_5 = SupportKaramba3D(PosInd=removeduplicatepts_5, menu=[buttons(on, on, on, on, on, on)])  # -> flatten(Support); disabled

# ----
# Shell
number_slider_67 = Slider(30, range=0..30)  # disabled
panel_32 = Panel("shell")  # disabled
# Support placement
cross_section_vault_4 = CrossSectionKaramba3D(
    FamilyNameOfCrossSection="DefaultCroSec",
    ElementIdentifier=panel_32,
    Material=material_properties_karamba3d_5,
    Height_cm=number_slider_67,
    mode="Shell - Const")  # disabled
mesh_to_shell_karamba3d_7 = MeshToShellKaramba3D(Mesh=[shell, shell_2], Identifier=panel_32, CrossSection=cross_section_vault_4, LimitDistance_m=0.005)  # -> Element, Points, Info; disabled

# ---- group: Live load
number_slider_68 = Slider(-4, range=-10..2)  # disabled
multiplication_6 = Multiplication(A=number_slider_68, B=1.5)  # disabled
unit_z_6 = UnitZ(Factor=multiplication_6)  # disabled
loads_11 = LoadsKaramba3D(Vector=unit_z_6, Mesh=mesh_35, LCase=panel_30, mode="MeshLoad -Const.", menu=[buttons(off, off, on), buttons(on, on)])  # disabled

# ---- group: Slab load and sand load
number_slider_69 = Slider(-7.2, range=-10..2)  # disabled
multiplication_7 = Multiplication(A=number_slider_69, B=1.2)  # disabled
unit_z_7 = UnitZ(Factor=multiplication_7)  # disabled
panel_33 = Panel("3")  # disabled
loads_12 = LoadsKaramba3D(Vector=unit_z_7, Mesh=mesh_35, LCase=panel_33, mode="MeshLoad -Const.", menu=[buttons(off, on, off), buttons(on, on)])  # disabled

# ---- group: Filling load
# Load
number_slider_70 = Slider(-1, range=-10..2)  # disabled
multiplication_8 = Multiplication(A=number_slider_70, B=1.2)  # disabled
unit_z_8 = UnitZ(Factor=multiplication_8)  # disabled
panel_34 = Panel("1")  # disabled
loads_13 = LoadsKaramba3D(Vector=unit_z_8, Mesh=mesh_35, LCase=panel_34, mode="MeshLoad -Const.", menu=[buttons(on, off, off), buttons(on, on)])  # disabled

# ----
mesh_37 = Mesh(exterior_walls_straight)  # disabled
mesh_38 = Mesh(exterior_walls_with_openings)  # disabled
wbcatmullclark = WeaverbirdsCatmullClarkSubdivision(MeshCurves=mesh_37, Level=number_slider_27, SmoothNakedEdges=number_slider_28)  # disabled

m_loop_17 = WeightedLoopSubdivision(M=mesh_38, L=number_slider_29, E=number_slider_28, TE=1, TV=1)  # -> out, A; inputs M: Mesh, TE: list, TV: list; disabled; same code as m_loop
wbcatmullclark_2 = WeaverbirdsCatmullClarkSubdivision(MeshCurves=mesh_38, Level=number_slider_50, SmoothNakedEdges=number_slider_28)  # disabled
wbedges_17 = WeaverbirdsMeshEdges(MeshOrPolylines=wbcatmullclark)  # disabled

wbedges_18 = WeaverbirdsMeshEdges(MeshOrPolylines=[m_loop_8.A, m_loop_17.A, m_loop_9.A, mesh_uv_13])  # disabled

# ---- group: Mesh for live loads
mesh_39 = Mesh(flatten([m_loop_9.A, m_loop_17.A, m_loop_8.A]))  # disabled

# ----
exterior_walls_2 = Data([m_loop_11.A, m_loop_15.A, m_loop_13.A])  # disabled
shell_3 = Data(m_loop_10.A)  # disabled
interior_walls_2 = Data([m_loop_14.A, m_loop_12.A])  # disabled
mesh_40 = Mesh([exterior_walls_2, interior_walls_2])  # disabled

# ----
# Interior wall
group_toggle_14 = GroupToggle(ToggleActive=True, ToggleVisible=False)  # disabled
panel_35 = Panel("Interior walls")  # disabled
thickness_4 = Slider(30, range=0..100)  # disabled
mesh_input_9 = GhPythonScript(M=interior_walls_2)  # -> out, flatten(v), e, f; inputs M: Mesh; disabled; same code as mesh_input
P_9 = Point(mesh_input_9.v)  # disabled
cross_section_karamba3d_3 = CrossSectionKaramba3D(
    FamilyNameOfCrossSection="DefaultCroSec",
    ElementIdentifier=panel_35,
    Material=material_properties_karamba3d_4,
    Height_cm=number_slider_61,
    mode="Shell - Const")  # disabled
points_in_a_band_9 = GhPythonScript(v=P_9, selectionCurves=floor_anchor_4)  # -> out, inBandVertices, inBandIndices; inputs v: list of Point3d, selectionCurves: list of Curve; disabled; same code as points_in_a_band
removeduplicatepts_6 = RemoveDuplicatePts(Points=flatten(points_in_a_band_9.inBandVertices), Tolerance=0.01)  # -> flatten(UniquePoints); disabled
mesh_to_shell_karamba3d_8 = MeshToShellKaramba3D(Mesh=interior_walls_2, Identifier=panel_35, CrossSection=cross_section_karamba3d_3, LimitDistance_m=0.005)  # -> Element, Points, Info; disabled
support_karamba3d_6 = SupportKaramba3D(PosInd=removeduplicatepts_6, menu=[buttons(on, on, on, on, on, on)])  # -> flatten(Support); disabled

# ----
# Shell
number_slider_71 = Slider(30, range=0..30)  # disabled
panel_36 = Panel("shell")  # disabled
# Support placement
cross_section_vault_5 = CrossSectionKaramba3D(
    FamilyNameOfCrossSection="DefaultCroSec",
    ElementIdentifier=panel_36,
    Material=material_properties_karamba3d_4,
    Height_cm=number_slider_61,
    mode="Shell - Const")  # disabled
mesh_to_shell_karamba3d_9 = MeshToShellKaramba3D(Mesh=shell_3, Identifier=panel_36, CrossSection=cross_section_vault_5, LimitDistance_m=0.005)  # -> Element, Points, Info; disabled

# ---- group: Live load
number_slider_72 = Slider(-4, range=-10..2)  # disabled
multiplication_9 = Multiplication(A=number_slider_72, B=1.5)  # disabled
unit_z_9 = UnitZ(Factor=multiplication_9)  # disabled
loads_14 = LoadsKaramba3D(Vector=unit_z_9, Mesh=mesh_40, LCase=panel_29, mode="MeshLoad -Const.", menu=[buttons(off, off, on), buttons(on, on)])  # disabled

# ---- group: Slab load and sand load
number_slider_73 = Slider(-7.2, range=-10..2)  # disabled
multiplication_10 = Multiplication(A=number_slider_73, B=1.2)  # disabled
unit_z_10 = UnitZ(Factor=multiplication_10)  # disabled
panel_37 = Panel("3")  # disabled
loads_15 = LoadsKaramba3D(Vector=unit_z_10, Mesh=mesh_40, LCase=panel_37, mode="MeshLoad -Const.", menu=[buttons(off, off, on), buttons(on, on)])  # disabled

# ---- group: Filling load
# Load
number_slider_74 = Slider(-1, range=-10..2)  # disabled
multiplication_11 = Multiplication(A=number_slider_74, B=1.2)  # disabled
unit_z_11 = UnitZ(Factor=multiplication_11)  # disabled
panel_38 = Panel("1")  # disabled
loads_16 = LoadsKaramba3D(Vector=unit_z_11, Mesh=mesh_40, LCase=panel_38, mode="MeshLoad -Const.", menu=[buttons(on, off, off), buttons(on, on)])  # disabled

# ----
wbedges_19 = WeaverbirdsMeshEdges(MeshOrPolylines=mesh_39)  # disabled

# ----
# Riwak walls
panel_39 = Panel("exterior walls")  # disabled
thickness_5 = Slider(30, range=0..100)  # disabled
mesh_input_10 = GhPythonScript(M=mesh_39)  # -> out, flatten(v), e, f; inputs M: Mesh; disabled; same code as mesh_input
P_10 = Point(mesh_input_10.v)  # disabled
cross_section_karamba3d_4 = CrossSectionKaramba3D(
    FamilyNameOfCrossSection="DefaultCroSec",
    ElementIdentifier=panel_39,
    Material=material_properties_karamba3d_3,
    Height_cm=thickness_5,
    mode="Shell - Const")  # disabled
mesh_to_shell_karamba3d_10 = MeshToShellKaramba3D(Mesh=mesh_39, Identifier=panel_39, CrossSection=cross_section_karamba3d_4, LimitDistance_m=0.005)  # -> Element, Points, Info; disabled

# ----
# Exterior wall
panel_40 = Panel("exterior walls")  # disabled
thickness_6 = Slider(30, range=0..100)  # disabled
mesh_input_11 = GhPythonScript(M=exterior_walls_2)  # -> out, flatten(v), e, f; inputs M: Mesh; disabled; same code as mesh_input
P_11 = Point(mesh_input_11.v)  # disabled
cross_section_karamba3d_5 = CrossSectionKaramba3D(
    FamilyNameOfCrossSection="DefaultCroSec",
    ElementIdentifier=panel_40,
    Material=material_properties_karamba3d_4,
    Height_cm=number_slider_61,
    mode="Shell - Const")  # disabled
mesh_to_shell_karamba3d_11 = MeshToShellKaramba3D(Mesh=exterior_walls_2, Identifier=panel_40, CrossSection=cross_section_karamba3d_5, LimitDistance_m=0.005)  # -> Element, Points, Info; disabled

points_in_a_band_10 = GhPythonScript(v=P_11, selectionCurves=floor_anchor_4)  # -> out, inBandVertices, inBandIndices; inputs v: list of Point3d, selectionCurves: list of Curve; disabled; same code as points_in_a_band
load_karamba3d = LoadKaramba3D(flatten([loads_16, loads_5, loads_14, loads_15]))  # disabled

removeduplicatepts_7 = RemoveDuplicatePts(Points=flatten(points_in_a_band_10.inBandVertices), Tolerance=0.01)  # -> flatten(UniquePoints); disabled
support_karamba3d_7 = SupportKaramba3D(PosInd=removeduplicatepts_7, menu=[buttons(on, on, on, on, on, on)])  # -> flatten(Support); disabled

# ----
# Solver
assemble_model_karamba3d = AssembleModelKaramba3D(
    Elem=flatten([mesh_to_shell_karamba3d_9.Element, mesh_to_shell_karamba3d_11.Element, mesh_to_shell_karamba3d_8.Element]),
    Support=flatten([support_karamba3d_7, support_karamba3d_6]),
    Load=flatten(load_karamba3d),
    Material=material_properties_karamba3d_4,
    LimitDistance_m=0.005)  # -> Model, Info, Mass_kg, CenterOfGravity; disabled
total_mass = Panel(assemble_model_karamba3d.Mass_kg)  # disabled

number_slider_75 = Slider(7, range=0..10)  # disabled
analyze_karamba3d = AnalyzeKaramba3D(Model=assemble_model_karamba3d.Model)  # -> CalculatedModel, flatten(MaximumDisplacement_cm), ResultingForceOfGravity_kN, ElasticEnergy_kNm; disabled
model_view_karamba3d = ModelViewKaramba3D(Model=analyze_karamba3d.CalculatedModel, LoadCaseFactorsForLinearSuperposition=1, IndexOfVisibleLoadcase=-1)  # -> Model, DeformedMesh, DeformedAxes, DeformedModel; disabled

# ----
# Deformation result
deformation_result = Panel(analyze_karamba3d.MaximumDisplacement_cm)  # disabled

# ----
# Analysis result selection
shell_view_karamba3d = ShellViewKaramba3D(Model=model_view_karamba3d.Model, IndexOfLayer=0)  # -> Model, MeshesOfRenderedShells, LegendColors, LegendTags; disabled
multiplication_12 = Multiplication(A=shell_view_karamba3d.LegendTags, B=10)  # disabled
panel_41 = Panel("Displacement [mm]")  # disabled
panel_42 = Panel("""0
18""")  # disabled
replace = ReplaceItems(List=multiplication_12, Item=panel_41, Indices=panel_42, Wrap=False)  # disabled
legend = Legend(Colour=shell_view_karamba3d.LegendColors, Tags=replace, LegendType=1)  # disabled

stresses = Move(Geometry=shell_view_karamba3d.MeshesOfRenderedShells, Motion=X_7)  # -> Geometry, Transform; disabled
displacement = Move(Geometry=shell_view_karamba3d.MeshesOfRenderedShells, Motion=X_6)  # -> Geometry, Transform; disabled
bnd = Bounds(Numbers=shell_view_karamba3d.LegendTags)  # disabled
dedomain = DeconstructDomain(Domain=bnd)  # -> Start, End; disabled
item = ListItem(List=shell_view_karamba3d.LegendTags, Index=0, Wrap=True)  # disabled
max = Maximum(A=flatten(dedomain.Start), B=dedomain.End)  # -> flatten(Result); disabled
min = Minimum(A=flatten(dedomain.Start), B=dedomain.End)  # -> flatten(Result); disabled

multiplication_13 = Multiplication(A=max, B=10)  # disabled
multiplication_14 = Multiplication(A=min, B=10)  # disabled
data_4 = Data(analyze_karamba3d.MaximumDisplacement_cm)  # disabled

# ---- group: Dome Stresses and displacement
displ_cm = Panel(data_4)  # disabled
max_2 = Panel(multiplication_13)  # disabled
min_2 = Panel(multiplication_14)  # disabled

# ---- group: Sand load
# Load
number_slider_76 = Slider(-2, range=-10..2)  # disabled
panel_43 = Panel("3")  # disabled

# ----
multiplication_15 = Multiplication(A=number_slider_76, B=1.2)  # disabled

# ---- group: Sand load (continued)
unit_z_12 = UnitZ(Factor=multiplication_15)  # disabled
loads_17 = LoadsKaramba3D(Vector=unit_z_12, Mesh=vault_2, LCase=panel_43, mode="MeshLoad -Const.", menu=[buttons(off, on, off), buttons(on, on)])  # disabled

# ----
load_karamba3d_2 = LoadKaramba3D(flatten([loads, loads_2, loads_17]))  # disabled

# ----
# Solver
assemble_model_karamba3d_2 = AssembleModelKaramba3D(
    Elem=flatten(mesh_to_shell_karamba3d_2.Element),
    Support=flatten(support_karamba3d),
    Load=flatten(load_karamba3d_2),
    Material=material_properties_karamba3d_2,
    LimitDistance_m=0.005)  # -> Model, Info, Mass_kg, CenterOfGravity; disabled
total_mass_2 = Panel(assemble_model_karamba3d_2.Mass_kg)  # disabled

number_slider_77 = Slider(7, range=0..10)  # disabled
analyze_karamba3d_2 = AnalyzeKaramba3D(Model=assemble_model_karamba3d_2.Model)  # -> CalculatedModel, flatten(MaximumDisplacement_cm), ResultingForceOfGravity_kN, ElasticEnergy_kNm; disabled
model_view_karamba3d_2 = ModelViewKaramba3D(Model=analyze_karamba3d_2.CalculatedModel, LoadCaseFactorsForLinearSuperposition=1, IndexOfVisibleLoadcase=-1)  # -> Model, DeformedMesh, DeformedAxes, DeformedModel; disabled

# ----
# Deformation result
deformation_result_2 = Panel(analyze_karamba3d_2.MaximumDisplacement_cm)  # disabled

# ----
# Analysis result selection
shell_view_karamba3d_2 = ShellViewKaramba3D(Model=model_view_karamba3d_2.Model, IndexOfLayer=0)  # -> Model, MeshesOfRenderedShells, LegendColors, LegendTags; disabled
multiplication_16 = Multiplication(A=shell_view_karamba3d_2.LegendTags, B=10)  # disabled
panel_44 = Panel("Displacement [mm]")  # disabled
panel_45 = Panel("""0
18""")  # disabled
replace_2 = ReplaceItems(List=multiplication_16, Item=panel_44, Indices=panel_45, Wrap=False)  # disabled
legend_2 = Legend(Colour=shell_view_karamba3d_2.LegendColors, Tags=replace_2, LegendType=1)  # disabled

displacement_2 = Move(Geometry=shell_view_karamba3d_2.MeshesOfRenderedShells, Motion=X_5)  # -> Geometry, Transform; disabled
stresses_2 = Move(Geometry=shell_view_karamba3d_2.MeshesOfRenderedShells, Motion=X_4)  # -> Geometry, Transform; disabled
bnd_2 = Bounds(Numbers=shell_view_karamba3d_2.LegendTags)  # disabled
dedomain_2 = DeconstructDomain(Domain=bnd_2)  # -> Start, End; disabled
# IF STRUCTURAL TEST RESULTS ARE SATISFYING
# ENABLE THIS COMPONENT FOR OFFSETING
item_2 = ListItem(List=shell_view_karamba3d_2.LegendTags, Index=0, Wrap=True)  # disabled
max_3 = Maximum(A=flatten(dedomain_2.Start), B=dedomain_2.End)  # -> flatten(Result); disabled
min_3 = Minimum(A=flatten(dedomain_2.Start), B=dedomain_2.End)  # -> flatten(Result); disabled

multiplication_17 = Multiplication(A=max_3, B=10)  # disabled
multiplication_18 = Multiplication(A=min_3, B=10)  # disabled
data_5 = Data(deformation_result_2)  # disabled

# ---- group: Dome Stresses and displacement
displ_cm_2 = Panel(data_5)  # disabled
max_4 = Panel(multiplication_17)  # disabled
min_4 = Panel(multiplication_18)  # disabled

# ---- group: Sand load
# Load
number_slider_78 = Slider(-1, range=-10..2)  # disabled
panel_46 = Panel("3")  # disabled

# ----
# Exterior wall
panel_47 = Panel("exterior walls")  # disabled
thickness_7 = Slider(30, range=0..100)  # disabled
mesh_input_12 = GhPythonScript(M=[exterior_walls_curved, exterior_walls_mesh_2])  # -> out, flatten(v), e, f; inputs M: Mesh; disabled; same code as mesh_input
mesh_input_13 = GhPythonScript(M=[exterior_walls, exterior_walls_mesh_2])  # -> out, flatten(v), e, f; inputs M: Mesh; disabled; same code as mesh_input
P_12 = Point(mesh_input_12.v)  # disabled
P_13 = Point(mesh_input_13.v)  # disabled
points_in_a_band_11 = GhPythonScript(v=P_12, selectionCurves=[floor_anchor_2, floor_anchor_3])  # -> out, inBandVertices, inBandIndices; inputs v: list of Point3d, selectionCurves: list of Curve; disabled; same code as points_in_a_band
cross_section_karamba3d_6 = CrossSectionKaramba3D(
    FamilyNameOfCrossSection="DefaultCroSec",
    ElementIdentifier=panel_47,
    Material=material_properties_karamba3d_5,
    Height_cm=number_slider_64,
    mode="Shell - Const")  # disabled
mesh_to_shell_karamba3d_12 = MeshToShellKaramba3D(
    Mesh=[exterior_walls_mesh, exterior_walls_mesh_2],
    Identifier=panel_47,
    CrossSection=cross_section_karamba3d_6,
    LimitDistance_m=0.005)  # -> Element, Points, Info; disabled

points_in_a_band_12 = GhPythonScript(v=P_13, selectionCurves=floor_anchor_2)  # -> out, inBandVertices, inBandIndices; inputs v: list of Point3d, selectionCurves: list of Curve; disabled; same code as points_in_a_band
load_karamba3d_3 = LoadKaramba3D(flatten([loads_13, loads_6, loads_11, loads_12]))  # disabled

removeduplicatepts_8 = RemoveDuplicatePts(Points=flatten([points_in_a_band_12.inBandVertices, points_in_a_band_11.inBandVertices]), Tolerance=0.01)  # -> flatten(UniquePoints); disabled
support_karamba3d_8 = SupportKaramba3D(PosInd=removeduplicatepts_8, menu=[buttons(on, on, on, on, on, on)])  # -> flatten(Support); disabled

# ----
# Solver
assemble_model_karamba3d_3 = AssembleModelKaramba3D(
    Elem=flatten([mesh_to_shell_karamba3d_7.Element, mesh_to_shell_karamba3d_12.Element, mesh_to_shell_karamba3d_6.Element]),
    Support=flatten([support_karamba3d_8, support_karamba3d_5]),
    Load=flatten(load_karamba3d_3),
    Material=material_properties_karamba3d_5,
    LimitDistance_m=0.005)  # -> Model, Info, Mass_kg, CenterOfGravity; disabled
total_mass_3 = Panel(assemble_model_karamba3d_3.Mass_kg)  # disabled

number_slider_79 = Slider(7, range=0..10)  # disabled
analyze_karamba3d_3 = AnalyzeKaramba3D(Model=assemble_model_karamba3d_3.Model)  # -> CalculatedModel, flatten(MaximumDisplacement_cm), ResultingForceOfGravity_kN, ElasticEnergy_kNm; disabled
model_view_karamba3d_3 = ModelViewKaramba3D(Model=analyze_karamba3d_3.CalculatedModel, LoadCaseFactorsForLinearSuperposition=1, IndexOfVisibleLoadcase=-1)  # -> Model, DeformedMesh, DeformedAxes, DeformedModel; disabled

# ----
# Deformation result
deformation_result_3 = Panel(analyze_karamba3d_3.MaximumDisplacement_cm)  # disabled

# ----
# Analysis result selection
shell_view_karamba3d_3 = ShellViewKaramba3D(Model=model_view_karamba3d_3.Model, IndexOfLayer=0)  # -> Model, MeshesOfRenderedShells, LegendColors, LegendTags; disabled
multiplication_19 = Multiplication(A=shell_view_karamba3d_3.LegendTags, B=10)  # disabled
panel_48 = Panel("Displacement [mm]")  # disabled
panel_49 = Panel("""0
18""")  # disabled
replace_3 = ReplaceItems(List=multiplication_19, Item=panel_48, Indices=panel_49, Wrap=False)  # disabled
legend_3 = Legend(Colour=shell_view_karamba3d_3.LegendColors, Tags=replace_3, LegendType=1)  # disabled

stresses_3 = Move(Geometry=shell_view_karamba3d_3.MeshesOfRenderedShells, Motion=X_9)  # -> Geometry, Transform; disabled
displacement_3 = Move(Geometry=shell_view_karamba3d_3.MeshesOfRenderedShells, Motion=X_8)  # -> Geometry, Transform; disabled
bnd_3 = Bounds(Numbers=shell_view_karamba3d_3.LegendTags)  # disabled
dedomain_3 = DeconstructDomain(Domain=bnd_3)  # -> Start, End; disabled
item_3 = ListItem(List=shell_view_karamba3d_3.LegendTags, Index=0, Wrap=True)  # disabled
max_5 = Maximum(A=flatten(dedomain_3.Start), B=dedomain_3.End)  # -> flatten(Result); disabled
min_5 = Minimum(A=flatten(dedomain_3.Start), B=dedomain_3.End)  # -> flatten(Result); disabled

stresses_4 = Move(Geometry=shell_view_karamba3d_3.MeshesOfRenderedShells, Motion=X)  # -> Geometry, Transform

multiplication_20 = Multiplication(A=max_5, B=10)  # disabled
multiplication_21 = Multiplication(A=min_5, B=10)  # disabled
data_6 = Data(analyze_karamba3d_3.MaximumDisplacement_cm)  # disabled

# ---- group: Dome Stresses and displacement
displ_cm_3 = Panel(data_6)  # disabled
max_6 = Panel(multiplication_20)  # disabled
min_6 = Panel(multiplication_21)  # disabled

# ----
multiplication_22 = Multiplication(A=number_slider_78, B=1.2)  # disabled
points_in_a_band_13 = GhPythonScript(v=P_10, selectionCurves=floor_anchor)  # -> out, inBandVertices, inBandIndices; inputs v: list of Point3d, selectionCurves: list of Curve; disabled; same code as points_in_a_band

# ---- group: Sand load (continued)
unit_z_13 = UnitZ(Factor=multiplication_22)  # disabled
loads_18 = LoadsKaramba3D(Vector=unit_z_13, Mesh=mesh_39, LCase=panel_46, mode="MeshLoad -Const.", menu=[buttons(off, on, off), buttons(on, on)])  # disabled

# ----
removeduplicatepts_9 = RemoveDuplicatePts(Points=flatten(points_in_a_band_13.inBandVertices), Tolerance=0.01)  # -> flatten(UniquePoints); disabled
support_karamba3d_9 = SupportKaramba3D(PosInd=removeduplicatepts_9, menu=[buttons(on, on, on, on, on, on)])  # -> flatten(Support); disabled

load_karamba3d_4 = LoadKaramba3D(flatten([loads_7, loads_4, loads_18]))  # disabled

# ----
# Solver
assemble_model_karamba3d_4 = AssembleModelKaramba3D(
    Elem=flatten([mesh_to_shell_karamba3d.Element, mesh_to_shell_karamba3d_10.Element]),
    Support=flatten(support_karamba3d_9),
    Load=flatten(load_karamba3d_4),
    Material=material_properties_karamba3d_3,
    LimitDistance_m=0.005)  # -> Model, Info, Mass_kg, CenterOfGravity; disabled
total_mass_4 = Panel(assemble_model_karamba3d_4.Mass_kg)  # disabled

number_slider_80 = Slider(7, range=0..10)  # disabled
analyze_karamba3d_4 = AnalyzeKaramba3D(Model=assemble_model_karamba3d_4.Model)  # -> CalculatedModel, flatten(MaximumDisplacement_cm), ResultingForceOfGravity_kN, ElasticEnergy_kNm; disabled
model_view_karamba3d_4 = ModelViewKaramba3D(Model=analyze_karamba3d_4.CalculatedModel, LoadCaseFactorsForLinearSuperposition=1, IndexOfVisibleLoadcase=-1)  # -> Model, DeformedMesh, DeformedAxes, DeformedModel; disabled

# ----
# Deformation result
deformation_result_4 = Panel(analyze_karamba3d_4.MaximumDisplacement_cm)  # disabled

# ----
# Analysis result selection
shell_view_karamba3d_4 = ShellViewKaramba3D(Model=model_view_karamba3d_4.Model, IndexOfLayer=0)  # -> Model, MeshesOfRenderedShells, LegendColors, LegendTags; disabled
multiplication_23 = Multiplication(A=shell_view_karamba3d_4.LegendTags, B=10)  # disabled
panel_50 = Panel("Displacement [mm]")  # disabled
panel_51 = Panel("""0
18""")  # disabled
replace_4 = ReplaceItems(List=multiplication_23, Item=panel_50, Indices=panel_51, Wrap=False)  # disabled
legend_4 = Legend(Colour=shell_view_karamba3d_4.LegendColors, Tags=replace_4, LegendType=1)  # disabled

stresses_5 = Move(Geometry=shell_view_karamba3d_4.MeshesOfRenderedShells, Motion=X_2)  # -> Geometry, Transform; disabled
displacement_4 = Move(Geometry=shell_view_karamba3d_4.MeshesOfRenderedShells, Motion=X_3)  # -> Geometry, Transform; disabled
bnd_4 = Bounds(Numbers=shell_view_karamba3d_4.LegendTags)  # disabled
dedomain_4 = DeconstructDomain(Domain=bnd_4)  # -> Start, End; disabled
item_4 = ListItem(List=shell_view_karamba3d_4.LegendTags, Index=0, Wrap=True)  # disabled
max_7 = Maximum(A=flatten(dedomain_4.Start), B=dedomain_4.End)  # -> flatten(Result); disabled
min_7 = Minimum(A=flatten(dedomain_4.Start), B=dedomain_4.End)  # -> flatten(Result); disabled

multiplication_24 = Multiplication(A=max_7, B=10)  # disabled
multiplication_25 = Multiplication(A=min_7, B=10)  # disabled
data_7 = Data(analyze_karamba3d_4.MaximumDisplacement_cm)  # disabled

# ---- group: Dome Stresses and displacement
displ_cm_4 = Panel(data_7)  # disabled
max_8 = Panel(multiplication_24)  # disabled
min_8 = Panel(multiplication_25)  # disabled

# ----
load_karamba3d_5 = LoadKaramba3D(flatten([loads_10, loads_3, loads_9, loads_8]))  # disabled

# ----
# Solver
assemble_model_karamba3d_5 = AssembleModelKaramba3D(
    Elem=flatten([mesh_to_shell_karamba3d_3.Element, mesh_to_shell_karamba3d_4.Element, mesh_to_shell_karamba3d_5.Element]),
    Support=flatten([support_karamba3d_2, support_karamba3d_3, support_karamba3d_4]),
    Load=flatten(load_karamba3d_5),
    Material=material_properties_karamba3d,
    LimitDistance_m=0.005)  # -> Model, Info, Mass_kg, CenterOfGravity; disabled
total_mass_5 = Panel(assemble_model_karamba3d_5.Mass_kg)  # disabled

number_slider_81 = Slider(1, range=0..10)  # disabled
analyze_karamba3d_5 = AnalyzeKaramba3D(Model=assemble_model_karamba3d_5.Model)  # -> CalculatedModel, flatten(MaximumDisplacement_cm), ResultingForceOfGravity_kN, ElasticEnergy_kNm; disabled
beso_for_shells_karamba3d = BESOForShellsKaramba3D(
    Model=assemble_model_karamba3d_5.Model,
    ElemIds=panel_26,
    LCases=0,
    TargetMassRatio=number_slider_81,
    MaxIter=10,
    ER=-1,
    ARmax=0.05,
    Nhist=3,
    Conv=0.01,
    Rmin=-1,
    Rexp=1,
    KillThick=1e-05)  # -> BSEOModel, ModelHistory, CHistory, VHistory, Info; disabled
shell_view_karamba3d_5 = ShellViewKaramba3D(Model=beso_for_shells_karamba3d.BSEOModel, IndexOfLayer=0)  # -> Model, MeshesOfRenderedShells, LegendColors, LegendTags; disabled
model_view_karamba3d_5 = ModelViewKaramba3D(Model=analyze_karamba3d_5.CalculatedModel, LoadCaseFactorsForLinearSuperposition=1, IndexOfVisibleLoadcase=-1)  # -> Model, DeformedMesh, DeformedAxes, DeformedModel; disabled

# ----
# Deformation result
deformation_result_5 = Panel(analyze_karamba3d_5.MaximumDisplacement_cm)  # disabled

# ----
# Analysis result selection
shell_view_karamba3d_6 = ShellViewKaramba3D(Model=model_view_karamba3d_5.Model, IndexOfLayer=0)  # -> Model, MeshesOfRenderedShells, LegendColors, LegendTags; disabled
multiplication_26 = Multiplication(A=shell_view_karamba3d_6.LegendTags, B=10)  # disabled
panel_52 = Panel("Displacement [mm]")  # disabled
panel_53 = Panel("""0
18""")  # disabled
replace_5 = ReplaceItems(List=multiplication_26, Item=panel_52, Indices=panel_53, Wrap=False)  # disabled
legend_5 = Legend(Colour=shell_view_karamba3d_6.LegendColors, Tags=replace_5, LegendType=1)

stresses_6 = Move(Geometry=shell_view_karamba3d_6.MeshesOfRenderedShells, Motion=Vector(0, 10, 0))  # -> Geometry, Transform; disabled
displacement_5 = Move(Geometry=shell_view_karamba3d_6.MeshesOfRenderedShells, Motion=Vector(0, 20, 0))  # -> Geometry, Transform; disabled
bnd_5 = Bounds(Numbers=shell_view_karamba3d_6.LegendTags)  # disabled
dedomain_5 = DeconstructDomain(Domain=bnd_5)  # -> Start, End; disabled
item_5 = ListItem(List=shell_view_karamba3d_6.LegendTags, Index=0, Wrap=True)  # disabled
max_9 = Maximum(A=flatten(dedomain_5.Start), B=dedomain_5.End)  # -> flatten(Result); disabled
min_9 = Minimum(A=flatten(dedomain_5.Start), B=dedomain_5.End)  # -> flatten(Result); disabled

data_8 = Data(shell_view_karamba3d_6.MeshesOfRenderedShells)  # disabled

multiplication_27 = Multiplication(A=min_9, B=10)  # disabled
multiplication_28 = Multiplication(A=max_9, B=10)  # disabled
data_9 = Data(analyze_karamba3d_5.MaximumDisplacement_cm)  # disabled

# ---- group: Dome Stresses and displacement
displ_cm_5 = Panel(data_9)  # disabled
max_10 = Panel(multiplication_28)  # disabled
min_10 = Panel(multiplication_27)  # disabled
