# Grasshopper definition Workshop_analysis.gh (Grasshopper 1.0.7)
# plug-ins: Weaverbird, MetaHopper, Kangaroo2 Components, karambaGH

exterior_shorter_walls = Brep([<brep referenced from the Rhino model> x4])
exterior_shorter_walls_2 = Brep([<brep referenced from the Rhino model> x2])
exterior_shorter_walls_3 = Brep([<brep referenced from the Rhino model> x4])
doorway_shorter_wall = Brep(<brep referenced from the Rhino model>)
mesh = Mesh(doorway_shorter_wall)
mesh_surface = MeshSurface(
    Surface=exterior_shorter_walls,
    UCount=Slider(16, range=0..100),
    VCount=Slider(22, range=0..50),
    Overhang=True,
    Equalize=False)
mesh_surface_2 = MeshSurface(
    Surface=exterior_shorter_walls_2,
    UCount=Slider(4, range=0..100),
    VCount=Slider(22, range=0..50),
    Overhang=True,
    Equalize=False)
mesh_surface_3 = MeshSurface(
    Surface=exterior_shorter_walls_3,
    UCount=Slider(12, range=0..100),
    VCount=Slider(22, range=0..50),
    Overhang=True,
    Equalize=False)
weighted_loop_subdivision = WeightedLoopSubdivision(M=mesh, L=1, E=Slider(1, range=-5..100), TE=1, TV=1)  # -> out, A; inputs M: Mesh, TE: list, TV: list
# ---------- weighted_loop_subdivision: VB ----------
    Component.Params.Input(0).Name = "Mesh"
    Component.Params.Input(0).Description = "An open or closed mesh whose faces should be triangular, all quad faces will be triangulated automatically"
    Component.Params.Input(1).Name = "Loops"
    Component.Params.Input(1).Description = "The number of iterations applied to each face"
    Component.Params.Input(2).Name = "Edge Type"
    Component.Params.Input(2).Description = "0=Fixed, 1=Smooth, 2=Fixed Corners"
    Component.Params.Input(3).Name = "Edge Weight [Vertex]"
    Component.Params.Input(3).Description = "An optional list of double values which overides the percent between the existing edge midpoint and the new smoothed vertex (1=Default)"
    Component.Params.Input(4).Name = "Vertex Weight [Vertex]"
    Component.Params.Input(4).Description = "An optional list of double values which overides the percent between the existing vertex and the new smoothed vertex (1=Default)"

    Component.Params.Output(1).Name = "Mesh"
    Component.Params.Output(1).Description = "If successful, a valid mesh"

    If m IsNot Nothing Then
      Dim ma As New mesh
      Dim i,lp As Integer
      Dim txV,txE As New list(Of Double)
      Dim xV(),xE() As Double
      Dim bn As Boolean
      Dim cb As Boolean

      'input mesh to the looped mesh
      m.weld(math.pi)
      If m.Faces.QuadCount() > 0 Then m.Faces.ConvertQuadsToTriangles
      ma = m

      ' match multiplier and color values to vertex count
      xV = TV.toarray()
      xE = TE.toarray()
      For i = 0 To m.Vertices.count() - 1 Step 1
        txV.add(xV(bC(xV, i)))
        txE.add(xE(bC(xE, i)))
      Next
      xV = txV.toarray()
      xE = txE.toarray()

      bn = m.IsClosed() = False

      For lp = 0 To L - 1 Step 1

        Dim mv As Rhino.Geometry.Collections.MeshVertexList
        Dim mf As Rhino.Geometry.Collections.MeshFaceList
        Dim mfn As Rhino.Geometry.Collections.MeshFaceNormalList
        Dim mc As Rhino.Geometry.Collections.MeshVertexColorList
        Dim mte As Rhino.Geometry.Collections.MeshTopologyEdgeList
        Dim mtv As Rhino.Geometry.Collections.MeshTopologyVertexList
        Dim mnv() As Boolean
        Dim nes As New list(Of Boolean)
        Dim pv() As point3d

        If ma.VertexColors.Count() > 0 Then
          cb = True
        Else
          cb = False
          ma.VertexColors.CreateMonotoneMesh(color.LightBlue)
        End If

        mv = ma.Vertices
        mf = ma.Faces
        mfn = ma.FaceNormals
        mc = ma.VertexColors
        mte = ma.TopologyEdges
        mtv = ma.TopologyVertices

        pv = mv.ToPoint3dArray
        mnv = ma.GetNakedEdgePointStatus

        Dim vo,vt As New list(Of point3d)
        Dim fo As New list(Of MeshFace)
        Dim j,k,u,v,cf,ce,cv As Integer
        Dim fi() As Integer
        Dim p(3) As point3d
        Dim mvi(3) As Integer
        Dim rv,re As New list(Of Double)
        Dim oc As New list(Of color)

        cv = mv.count()
        ce = mte.count()
        cf = mf.count()

        'Faces
        For i = 0 To cf - 1 Step 1
          fi = mtv.IndicesFromFace(i)
          mvi(0) = mtv.MeshVertexIndices(fi(0))(0)
          mvi(1) = mtv.MeshVertexIndices(fi(1))(0)
          mvi(2) = mtv.MeshVertexIndices(fi(2))(0)

          fo.add(New meshface(mte.GetEdgeIndex(fi(0), fi(1)), mte.GetEdgeIndex(fi(1), fi(2)), mte.GetEdgeIndex(fi(2), fi(0))))

          fo.add(New meshface(mte.GetEdgeIndex(fi(0), fi(1)), ce + mvi(1), mte.GetEdgeIndex(fi(1), fi(2))))
          fo.add(New meshface(mte.GetEdgeIndex(fi(1), fi(2)), ce + mvi(2), mte.GetEdgeIndex(fi(2), fi(0))))
          fo.add(New meshface(mte.GetEdgeIndex(fi(2), fi(0)), ce + mvi(0), mte.GetEdgeIndex(fi(0), fi(1))))
        Next

        'Edges
        For i = 0 To ce - 1 Step 1
          Dim cfi() As Integer
          Dim ta,tb As New list(Of Integer)
          Dim cei As Rhino.IndexPair

          cfi = mte.GetConnectedFaces(i)
          cei = mte.GetTopologyVertices(i)
          u = mtv.MeshVertexIndices(cei.I)(0)
          v = mtv.MeshVertexIndices(cei.J)(0)
          p(0) = (pv(u) + pv(v)) / 2

          If ubound(cfi) > 0 Then
            ta = mf.GetTopologicalVertices(cfi(0)).tolist()
            ta.remove(cei.I)
            ta.remove(cei.J)

            tb = mf.GetTopologicalVertices(cfi(1)).tolist()
            tb.remove(cei.I)
            tb.remove(cei.J)

            p(1) = pv(mtv.meshvertexindices(ta(0))(0))
            p(2) = pv(mtv.meshvertexindices(tb(0))(0))
            p(3) = evalP(p(0), pv(u) * 3 / 8 + pv(v) * 3 / 8 + p(1) / 8 + p(2) / 8, (xe(u) + xe(v)) / 2)

            nes.add(False)
          Else
            p(3) = p(0)
            nes.add(True)
          End If

          vo.add(p(3))
          vt.add(p(3))
          rv.add((xV(u) + xV(v)) / 2)
          re.add((xE(u) + xE(v)) / 2)
          oc.add(avgC2(mc(u), mc(v)))
        Next

        'Vertices
        For i = 0 To cv - 1 Step 1
          Dim tvi As Integer
          Dim cvi As New list(Of Integer)
          Dim q(2) As point3d
          Dim bne As Boolean = False

          tvi = mtv.TopologyVertexIndex(i)

          mtv.SortEdges(tvi)

          cvi = mtv.ConnectedTopologyVertices(tvi).tolist()
          cvi.remove(tvi)
          k = cvi.count()

          For j = 0 To k - 1 Step 1
            u = mte.GetEdgeIndex(tvi, cvi.item(j))
            q(0) += pv(mtv.MeshVertexIndices(cvi.item(j))(0))

            If nes(u) Then
              bne = True
              q(2) += pv(mtv.MeshVertexIndices(cvi.item(j))(0))
            End If
          Next

          If bne Then
            If e = 0 Then
              q(1) = pv(i)
            ElseIf e = 2 Then
              If k = 2 Then
                q(1) = pv(i)
              Else
                q(1) = evalP(pv(i), q(2) / 2, 0.25)
              End If
            Else
              q(1) = evalP(pv(i), q(2) / 2, 0.25)
            End If
          Else
            If k = 3 Then
              q(1) = evalp(pv(i), q(0) / k, xv(i) * 9 / 16)
            Else
              q(1) = evalp(pv(i), q(0) / k, xv(i) * 3 / 8)
            End If
          End If


          vo.add(q(1))
          rv.add(xV(i))
          re.add(xE(i))
          oc.add(mc(i))

        Next

        Dim mo As New mesh
        mo.Vertices.AddVertices(vo)
        mo.Faces.AddFaces(fo)
        If cb Then mo.VertexColors.AppendColors(oc.toarray())
        mo.FaceNormals.ComputeFaceNormals()
        mo.Normals.ComputeNormals()

        ma = mo
        xV = rv.toarray()
        xE = re.toarray()

        'Loop
      Next
      A = ma
    End If
# ---------- weighted_loop_subdivision: VB additional code ----------
  Private Function bC(ByVal arrObj() As Double, ByVal t As Integer)
    Dim intOut As Integer
    If t > uBound(arrObj) Then intOut = uBound(arrObj) Else intOut = t
    Return intOut
  End Function

  Private Function evalP(ByVal op As point3d, ByVal tp As Point3d, ByVal t As Double)
    Return New point3d(op + (tp - op) * t)
  End Function

  Private Function avgC2(ByVal c0 As color, ByVal c1 As color)
    Dim r,g,b As Integer
    r = CInt(((CInt(c0.R) + CInt(c1.R)) / 2))
    g = CInt(((CInt(c0.G) + CInt(c1.G)) / 2))
    b = CInt(((CInt(c0.B) + CInt(c1.B)) / 2))

    If R < 0 Then r = 0 Else If r > 255 Then r = 255
    If G < 0 Then g = 0 Else If r > 255 Then g = 255
    If B < 0 Then b = 0 Else If r > 255 Then b = 255

    Return color.FromArgb(r, g, b)
  End Function
# ---------- end weighted_loop_subdivision ----------
mesh_2 = Mesh(weighted_loop_subdivision.A)
exterior_shorter_wall = Mesh([mesh_surface_2, mesh_2, mesh_surface_3, mesh_surface])

doorway = Brep([<brep referenced from the Rhino model> x2])
mesh_3 = Mesh(doorway)
weighted_loop_subdivision_2 = WeightedLoopSubdivision(M=mesh_3, L=1, E=Slider(1, range=-5..100), TE=1, TV=1)  # -> out, A; inputs M: Mesh, TE: list, TV: list; same code as weighted_loop_subdivision
mesh_4 = Mesh(weighted_loop_subdivision_2.A)

doorway_longer_wall = Brep(<brep referenced from the Rhino model>)
exterior_longer_walls = Brep([<brep referenced from the Rhino model> x22])
mesh_5 = Mesh(doorway_longer_wall)
weighted_loop_subdivision_3 = WeightedLoopSubdivision(M=mesh_5, L=1, E=Slider(1, range=-5..100), TE=1, TV=1)  # -> out, A; inputs M: Mesh, TE: list, TV: list; same code as weighted_loop_subdivision
mesh_surface_4 = MeshSurface(
    Surface=exterior_longer_walls,
    UCount=Slider(16, range=0..100),
    VCount=Slider(22, range=0..50),
    Overhang=True,
    Equalize=False)
mesh_6 = Mesh(weighted_loop_subdivision_3.A)
exterior_longer_wall = Mesh([mesh_6, mesh_surface_4])

walls = Brep([<brep referenced from the Rhino model> x32])
mesh_surface_5 = MeshSurface(Surface=walls, UCount=Slider(16, range=0..100), VCount=Slider(22, range=0..50), Overhang=True, Equalize=False)

interior_walls = Brep([<brep referenced from the Rhino model> x4])
mesh_surface_6 = MeshSurface(Surface=interior_walls, UCount=Slider(16, range=0..100), VCount=Slider(22, range=0..50), Overhang=True, Equalize=False)
interior_wall = Mesh(mesh_surface_6)

# ----
# Output
# Groups
# External input
# Parameters
# Workshop-workshop module
ceiling = Mesh([<mesh referenced from the Rhino model> x20])
mesh_join = MeshJoin(Meshes=[mesh_4, mesh_surface_5, ceiling])
weaverbird_s_mesh_edges = WeaverbirdsMeshEdges(MeshOrPolylines=mesh_join)

# ----
# Material properties
adobe_density_kg_m3 = Panel("1500")
youngs_module_mpa = Panel("150")
expression = Expression(d=adobe_density_kg_m3, Expression="d*0.01")
expression_2 = Expression(E=youngs_module_mpa, Expression="E/10")
panel = Panel(expression)
material_properties_karamba3d = MaterialPropertiesKaramba3D(
    FamilyOfMaterial="Adobe",
    Name="Adobe",
    YoungsModulus_kN_cm2=expression_2,
    InPlaneShearModulus_kN_cm2=expr("x/2.5", expression_2),
    TransverseShearModulus_kN_cm2=8076,
    SpecificWeight_kN_m3=panel,
    CoefficientOfThermalExpansion_1_C=1e-05,
    YieldStrength_kN_cm2="0.1",
    mode="Isotrop")

thickness_cm = Panel("60")
cross_section_karamba3d = CrossSectionKaramba3D(
    FamilyNameOfCrossSection="DefaultCroSec",
    Material=material_properties_karamba3d,
    Height_cm=thickness_cm,
    mode="Shell - Const")
mesh_to_shell_karamba3d = MeshToShellKaramba3D(Mesh=mesh_join, CrossSection=cross_section_karamba3d, LimitDistance_m=0.005)  # -> Element, Points, Info

# ----
# Supports
nakedvertices = NakedVertices(Mesh=mesh_join)  # -> ClothedIndex, NakedIndex, ClothedPts, NakedPts
anchor_lines = Curve([<curve referenced from the Rhino model> x2])
P = Point([nakedvertices.ClothedPts, nakedvertices.NakedPts])
points_in_a_band = GhPythonScript(v=P, selectionCurves=anchor_lines)  # -> out, inBandVertices, inBandIndices; inputs v: list of Point3d, selectionCurves: list of Curve
# ---------- points_in_a_band: Python ----------
__author__ = "pnourian"
__version__ = "2020.08.21"

import rhinoscriptsyntax as rs
import Rhino.Geometry as rg
tolerance=10E-3
chosenVertices=[]
chosenIndices=[]
for i in range(v.Count):#vertex in v:
    vertex=v[i]
    #these are all the points coming from other script
    chosen=False
    for j in range(selectionCurves.Count):
        #insideInside=(selectionCurves[j].Contains(vertex, rg.Plane.WorldXY,tolerance)==rg.PointContainment.Inside)
        a = rg.Curve.ClosestPoint(selectionCurves[j],vertex,tolerance)
        print(a)
        if a[0]==False:
                continue
        else:
            chosenVertices.append(vertex)
            chosenIndices.append(i)
    #if chosen:
        #chosenVertices.append(vertex)
        #chosenIndices.append(i)
inBandVertices=chosenVertices
inBandIndices=chosenIndices
# ---------- end points_in_a_band ----------
point = Point(points_in_a_band.inBandVertices)
closest_point = ClosestPoint(Point=point, Cloud=mesh_to_shell_karamba3d.Points)  # -> ClosestPoint, CPIndex, Distance
remove_duplicate_points_karamba3d = RemoveDuplicatePointsKaramba3D(Point=flatten(closest_point.ClosestPoint), LimitDistance=0.005)  # -> OutPoint, Info, Indexes
support_karamba3d = SupportKaramba3D(PosInd=remove_duplicate_points_karamba3d.OutPoint, menu=[buttons(on, on, on, on, on, on)])

unit_z = UnitZ(Factor=Slider(-1, range=-2..2))
loads_karamba3d = LoadsKaramba3D(Vector=unit_z, LCase="0", mode="Gravity")

# ---- group: Sand Load
unit_z_2 = UnitZ(Factor=Slider(-1, range=-2..2))
loads_karamba3d_2 = LoadsKaramba3D(Vector=unit_z_2, Mesh=mesh_join, LCase="1", mode="MeshLoad -Const.", menu=[buttons(off, on, off), buttons(on, on)])

# ----
# Material properties
adobe_density_kg_m3_2 = Panel("1500")
youngs_module_mpa_2 = Panel("150")
expression_3 = Expression(d=adobe_density_kg_m3_2, Expression="d*0.01")
expression_4 = Expression(E=youngs_module_mpa_2, Expression="E/10")
panel_2 = Panel(expression_3)
material_properties_karamba3d_2 = MaterialPropertiesKaramba3D(
    FamilyOfMaterial="Adobe",
    Name="Adobe",
    YoungsModulus_kN_cm2=expression_4,
    InPlaneShearModulus_kN_cm2=expr("x/2.5", expression_4),
    TransverseShearModulus_kN_cm2=8076,
    SpecificWeight_kN_m3=panel_2,
    CoefficientOfThermalExpansion_1_C=1e-05,
    YieldStrength_kN_cm2="0.1",
    mode="Isotrop")

thickness_cm_2 = Panel("30")
cross_section_karamba3d_2 = CrossSectionKaramba3D(
    FamilyNameOfCrossSection="DefaultCroSec",
    ElementIdentifier="interior wall",
    Material=material_properties_karamba3d_2,
    Height_cm=thickness_cm_2,
    mode="Shell - Const")
mesh_to_shell_karamba3d_2 = MeshToShellKaramba3D(Mesh=interior_wall, Identifier="interior wall", CrossSection=cross_section_karamba3d_2, LimitDistance_m=0.005)  # -> Element, Points, Info

thickness_cm_3 = Panel("60")
cross_section_karamba3d_3 = CrossSectionKaramba3D(
    FamilyNameOfCrossSection="DefaultCroSec",
    ElementIdentifier="Exterior longer wall",
    Material=material_properties_karamba3d_2,
    Height_cm=thickness_cm_3,
    mode="Shell - Const")
mesh_to_shell_karamba3d_3 = MeshToShellKaramba3D(
    Mesh=exterior_longer_wall,
    Identifier="Exterior longer wall",
    CrossSection=cross_section_karamba3d_3,
    LimitDistance_m=0.005)  # -> Element, Points, Info

unit_z_3 = UnitZ(Factor=Slider(-1, range=-2..2))
loads_karamba3d_3 = LoadsKaramba3D(Vector=unit_z_3, LCase="0", mode="Gravity")

thickness_cm_4 = Panel("60")
cross_section_karamba3d_4 = CrossSectionKaramba3D(
    FamilyNameOfCrossSection="DefaultCroSec",
    ElementIdentifier="Exterior shorter wall",
    Material=material_properties_karamba3d_2,
    Height_cm=thickness_cm_4,
    mode="Shell - Const")
mesh_to_shell_karamba3d_4 = MeshToShellKaramba3D(
    Mesh=exterior_shorter_wall,
    Identifier="Exterior shorter wall",
    CrossSection=cross_section_karamba3d_4,
    LimitDistance_m=0.005)  # -> Element, Points, Info

exterior_longer_walls_2 = Brep([<brep referenced from the Rhino model> x6])
exterior_longer_walls_3 = Brep([<brep referenced from the Rhino model> x24])
# Groups
doorway_longer_wall_2 = Brep([<brep referenced from the Rhino model> x4])
mesh_7 = Mesh(doorway_longer_wall_2)
mesh_surface_7 = MeshSurface(
    Surface=exterior_longer_walls_3,
    UCount=Slider(16, range=0..100),
    VCount=Slider(22, range=0..50),
    Overhang=True,
    Equalize=False)
mesh_surface_8 = MeshSurface(
    Surface=exterior_longer_walls_2,
    UCount=Slider(4, range=0..100),
    VCount=Slider(22, range=0..50),
    Overhang=True,
    Equalize=False)
weighted_loop_subdivision_4 = WeightedLoopSubdivision(M=mesh_7, L=1, E=Slider(1, range=-5..100), TE=1, TV=1)  # -> out, A; inputs M: Mesh, TE: list, TV: list; same code as weighted_loop_subdivision
mesh_8 = Mesh(weighted_loop_subdivision_4.A)
exterior_longer_wall_2 = Mesh([mesh_surface_7, mesh_surface_8, mesh_8])

exterior_shorter_walls_4 = Brep([<brep referenced from the Rhino model> x4])
interior_walls_2 = Brep([<brep referenced from the Rhino model> x4])
mesh_surface_9 = MeshSurface(Surface=interior_walls_2, UCount=Slider(16, range=0..100), VCount=Slider(22, range=0..50), Overhang=True, Equalize=False)
mesh_surface_10 = MeshSurface(
    Surface=exterior_shorter_walls_4,
    UCount=Slider(16, range=0..100),
    VCount=Slider(22, range=0..50),
    Overhang=True,
    Equalize=False)
inner_wall = Mesh(mesh_surface_9)

exterior_shorter_walls_5 = Brep([<brep referenced from the Rhino model> x4])
exterior_shorter_walls_6 = Brep([<brep referenced from the Rhino model> x2])
doorway_shorter_wall_2 = Brep(<brep referenced from the Rhino model>)
mesh_9 = Mesh(doorway_shorter_wall_2)
mesh_surface_11 = MeshSurface(
    Surface=exterior_shorter_walls_5,
    UCount=Slider(12, range=0..100),
    VCount=Slider(22, range=0..50),
    Overhang=True,
    Equalize=False)
mesh_surface_12 = MeshSurface(
    Surface=exterior_shorter_walls_6,
    UCount=Slider(4, range=0..100),
    VCount=Slider(22, range=0..50),
    Overhang=True,
    Equalize=False)
weighted_loop_subdivision_5 = WeightedLoopSubdivision(M=mesh_9, L=1, E=Slider(1, range=-5..100), TE=1, TV=1)  # -> out, A; inputs M: Mesh, TE: list, TV: list; same code as weighted_loop_subdivision
mesh_10 = Mesh(weighted_loop_subdivision_5.A)
exterior_shorter_wall_2 = Mesh([mesh_surface_10, mesh_10, mesh_surface_12, mesh_surface_11])

# ----
# Material properties
adobe_density_kg_m3_3 = Panel("1500")
youngs_module_mpa_3 = Panel("150")
expression_5 = Expression(d=adobe_density_kg_m3_3, Expression="d*0.01")
expression_6 = Expression(E=youngs_module_mpa_3, Expression="E/10")
panel_3 = Panel(expression_5)
material_properties_karamba3d_3 = MaterialPropertiesKaramba3D(
    FamilyOfMaterial="Adobe",
    Name="Adobe",
    YoungsModulus_kN_cm2=expression_6,
    InPlaneShearModulus_kN_cm2=expr("x/2.5", expression_6),
    TransverseShearModulus_kN_cm2=8076,
    SpecificWeight_kN_m3=panel_3,
    CoefficientOfThermalExpansion_1_C=1e-05,
    YieldStrength_kN_cm2="0.1",
    mode="Isotrop")

# ----
# Exterior walls
thickness_cm_5 = Panel("60")
cross_section_karamba3d_5 = CrossSectionKaramba3D(
    FamilyNameOfCrossSection="DefaultCroSec",
    ElementIdentifier="longer exterior walls",
    Material=material_properties_karamba3d_3,
    Height_cm=thickness_cm_5,
    mode="Shell - Const")
mesh_to_shell_karamba3d_5 = MeshToShellKaramba3D(
    Mesh=exterior_longer_wall_2,
    Identifier="longer exterior walls",
    CrossSection=cross_section_karamba3d_5,
    LimitDistance_m=0.005)  # -> Element, Points, Info

# ----
# Interior walls
panel_4 = Panel("inner walls")
thickness_cm_6 = Panel("60")
cross_section_karamba3d_6 = CrossSectionKaramba3D(
    FamilyNameOfCrossSection="DefaultCroSec",
    ElementIdentifier=panel_4,
    Material=material_properties_karamba3d_3,
    Height_cm=thickness_cm_6,
    mode="Shell - Const")
mesh_to_shell_karamba3d_6 = MeshToShellKaramba3D(Mesh=inner_wall, Identifier=panel_4, CrossSection=cross_section_karamba3d_6, LimitDistance_m=0.005)  # -> Element, Points, Info

# ----
# Exterior walls
thickness_cm_7 = Panel("60")
cross_section_karamba3d_7 = CrossSectionKaramba3D(
    FamilyNameOfCrossSection="DefaultCroSec",
    ElementIdentifier="shorter exterior walls",
    Material=material_properties_karamba3d_3,
    Height_cm=thickness_cm_7,
    mode="Shell - Const")
mesh_to_shell_karamba3d_7 = MeshToShellKaramba3D(
    Mesh=exterior_shorter_wall_2,
    Identifier="shorter exterior walls",
    CrossSection=cross_section_karamba3d_7,
    LimitDistance_m=0.005)  # -> Element, Points, Info

# ----
# Workshop-store
ceiling_2 = Mesh([<mesh referenced from the Rhino model> x20])
mesh_join_2 = MeshJoin(Meshes=[ceiling_2, exterior_longer_wall, exterior_shorter_wall, interior_wall])
weaverbird_s_mesh_edges_2 = WeaverbirdsMeshEdges(MeshOrPolylines=mesh_join_2)

thickness_cm_8 = Panel("60")
cross_section_karamba3d_8 = CrossSectionKaramba3D(
    FamilyNameOfCrossSection="DefaultCroSec",
    ElementIdentifier="ceiling",
    Material=material_properties_karamba3d_2,
    Height_cm=thickness_cm_8,
    mode="Shell - Const")
mesh_to_shell_karamba3d_8 = MeshToShellKaramba3D(
    Mesh=[exterior_longer_wall, ceiling_2],
    Identifier="ceiling",
    CrossSection=cross_section_karamba3d_8,
    LimitDistance_m=0.005)  # -> Element, Points, Info

# ----
# Supports
nakedvertices_2 = NakedVertices(Mesh=mesh_join_2)  # -> ClothedIndex, NakedIndex, ClothedPts, NakedPts
anchor_lines_2 = Curve([<curve referenced from the Rhino model> x2])
P_2 = Point([nakedvertices_2.ClothedPts, nakedvertices_2.NakedPts])
points_in_a_band_2 = GhPythonScript(v=P_2, selectionCurves=anchor_lines_2)  # -> out, inBandVertices, inBandIndices; inputs v: list of Point3d, selectionCurves: list of Curve; same code as points_in_a_band
point_2 = Point(points_in_a_band_2.inBandVertices)
closest_point_2 = ClosestPoint(
    Point=point_2,
    Cloud=[mesh_to_shell_karamba3d_3.Points, mesh_to_shell_karamba3d_4.Points, mesh_to_shell_karamba3d_2.Points, mesh_to_shell_karamba3d_8.Points])  # -> ClosestPoint, CPIndex, Distance
remove_duplicate_points_karamba3d_2 = RemoveDuplicatePointsKaramba3D(Point=flatten(closest_point_2.ClosestPoint), LimitDistance=0.005)  # -> OutPoint, Info, Indexes
support_karamba3d_2 = SupportKaramba3D(PosInd=remove_duplicate_points_karamba3d_2.OutPoint, menu=[buttons(on, on, on, on, on, on)])
point_3 = Point(remove_duplicate_points_karamba3d_2.OutPoint)

# ---- group: Sand Load
unit_z_4 = UnitZ(Factor=Slider(-1, range=-2..2))
loads_karamba3d_4 = LoadsKaramba3D(Vector=unit_z_4, Mesh=mesh_join_2, LCase="1", mode="MeshLoad -Const.", menu=[buttons(off, on, off), buttons(on, on)])

unit_z_5 = UnitZ(Factor=Slider(-1.5, range=-2..2))

# ----
# Loads
mesh_11 = Mesh([<mesh referenced from the Rhino model> x4])

# ---- group: Sand Load (continued)
loads_karamba3d_5 = LoadsKaramba3D(Vector=unit_z_5, Mesh=mesh_11, LCase="2", mode="MeshLoad -Const.", menu=[buttons(off, on, off), buttons(on, on)])

# ----
load_karamba3d = LoadKaramba3D(flatten([loads_karamba3d_2, loads_karamba3d, loads_karamba3d_5]))

# ----
# Solver
assemble_model_karamba3d = AssembleModelKaramba3D(
    Elem=flatten(mesh_to_shell_karamba3d.Element),
    Support=flatten(support_karamba3d),
    Load=load_karamba3d,
    CrossSection=cross_section_karamba3d,
    Material=material_properties_karamba3d,
    LimitDistance_m=0.005)  # -> Model, Info, Mass_kg, CenterOfGravity
analyze_karamba3d = AnalyzeKaramba3D(Model=assemble_model_karamba3d.Model)  # -> CalculatedModel, MaximumDisplacement_cm, ResultingForceOfGravity_kN, ElasticEnergy_kNm

modelview = ModelViewKaramba3D(Model=analyze_karamba3d.CalculatedModel, ResultFactors=1, ResultCase=-1)  # -> Model, DeformedMesh, DeformedAxes, DeformedModel
shellview = ShellViewKaramba3D(Model=modelview.Model, IndexOfLayer=0)  # -> Model, MeshesOfRenderedShells, LegendColors, LegendTags
legend = Legend(Colour=shellview.LegendColors, Tags=shellview.LegendTags, LegendType=1)
group_toggle = GroupToggle(ToggleActive=True, ToggleVisible=False)  # disabled
unit_convert = UnitConvert(L=shellview.LegendTags)
legend_2 = Legend(Colour=shellview.LegendColors, Tags=unit_convert, LegendType=1)

mesh_12 = Mesh(shellview.MeshesOfRenderedShells)

# ---- group: Sand Load
unit_z_6 = UnitZ(Factor=Slider(-1.5, range=-2..2))

# ----
# Loads
mesh_13 = Mesh([<mesh referenced from the Rhino model> x4])

# ---- group: Sand Load (continued)
loads_karamba3d_6 = LoadsKaramba3D(Vector=unit_z_6, Mesh=mesh_13, LCase="2", mode="MeshLoad -Const.", menu=[buttons(off, on, off), buttons(on, on)])

# ----
load_karamba3d_2 = LoadKaramba3D(flatten([loads_karamba3d_4, loads_karamba3d_3, loads_karamba3d_6]))

# ----
# Solver
assemble_model_karamba3d_2 = AssembleModelKaramba3D(
    Elem=flatten([mesh_to_shell_karamba3d_8.Element, mesh_to_shell_karamba3d_3.Element, mesh_to_shell_karamba3d_4.Element, mesh_to_shell_karamba3d_2.Element]),
    Support=flatten(support_karamba3d_2),
    Load=load_karamba3d_2,
    Material=material_properties_karamba3d_2,
    LimitDistance_m=0.005)  # -> Model, Info, Mass_kg, CenterOfGravity
analyze_karamba3d_2 = AnalyzeKaramba3D(Model=assemble_model_karamba3d_2.Model)  # -> CalculatedModel, MaximumDisplacement_cm, ResultingForceOfGravity_kN, ElasticEnergy_kNm

modelview_2 = ModelViewKaramba3D(Model=analyze_karamba3d_2.CalculatedModel, ResultFactors=1, ResultCase=-1)  # -> Model, DeformedMesh, DeformedAxes, DeformedModel
shellview_2 = ShellViewKaramba3D(Model=modelview_2.Model, IndexOfLayer=0)  # -> Model, MeshesOfRenderedShells, LegendColors, LegendTags
mesh_14 = Mesh(modelview_2.DeformedMesh)
legend_3 = Legend(Colour=shellview_2.LegendColors, Tags=shellview_2.LegendTags, LegendType=1)
group_toggle_2 = GroupToggle(ToggleActive=True, ToggleVisible=False)  # disabled
unit_convert_2 = UnitConvert(L=shellview_2.LegendTags)
legend_4 = Legend(Colour=shellview_2.LegendColors, Tags=unit_convert_2, LegendType=1)

mesh_15 = Mesh(shellview_2.MeshesOfRenderedShells)

# ----
# Workshop-exhibition
ceiling_3 = Mesh([<mesh referenced from the Rhino model> x24])
mesh_join_3 = MeshJoin(Meshes=[exterior_longer_wall_2, exterior_shorter_wall_2, ceiling_3, inner_wall])
weaverbird_s_mesh_edges_3 = WeaverbirdsMeshEdges(MeshOrPolylines=mesh_join_3)

# ----
# Loads
number_slider = Slider(-1, range=-2..2)
unit_z_7 = UnitZ(Factor=number_slider)
unit_z_8 = UnitZ(Factor=Slider(-1.5, range=-2..2))
unit_z_9 = UnitZ(Factor=Slider(-1, range=-2..2))
mesh_16 = Mesh([<mesh referenced from the Rhino model> x4])
loads_karamba3d_7 = LoadsKaramba3D(Vector=unit_z_8, Mesh=mesh_16, LCase="2", mode="MeshLoad -Const.", menu=[buttons(off, on, off), buttons(on, on)])
loads_karamba3d_8 = LoadsKaramba3D(Vector=unit_z_7, LCase="0", mode="Gravity")
loads_karamba3d_9 = LoadsKaramba3D(Vector=unit_z_9, Mesh=mesh_join_3, LCase="1", mode="MeshLoad -Const.", menu=[buttons(off, on, off), buttons(on, on)])
load_karamba3d_3 = LoadKaramba3D(flatten([loads_karamba3d_9, loads_karamba3d_8, loads_karamba3d_7]))

# ----
# Ceiling
panel_5 = Panel("ceiling")
thickness_cm_9 = Panel("30")
cross_section_karamba3d_9 = CrossSectionKaramba3D(
    FamilyNameOfCrossSection="DefaultCroSec",
    NameOfCrossSection=panel_5,
    Material=material_properties_karamba3d_3,
    Height_cm=thickness_cm_9,
    mode="Shell - Const")
mesh_to_shell_karamba3d_9 = MeshToShellKaramba3D(Mesh=ceiling_3, Identifier=panel_5, CrossSection=cross_section_karamba3d_9, LimitDistance_m=0.005)  # -> Element, Points, Info

# ----
# Supports
nakedvertices_3 = NakedVertices(Mesh=mesh_join_3)  # -> ClothedIndex, NakedIndex, ClothedPts, NakedPts
anchor_lines_3 = Curve([<curve referenced from the Rhino model> x2])
P_3 = Point([nakedvertices_3.ClothedPts, nakedvertices_3.NakedPts])
points_in_a_band_3 = GhPythonScript(v=P_3, selectionCurves=anchor_lines_3)  # -> out, inBandVertices, inBandIndices; inputs v: list of Point3d, selectionCurves: list of Curve; same code as points_in_a_band
point_4 = Point(points_in_a_band_3.inBandVertices)
closest_point_3 = ClosestPoint(
    Point=point_4,
    Cloud=[mesh_to_shell_karamba3d_9.Points, mesh_to_shell_karamba3d_5.Points, mesh_to_shell_karamba3d_7.Points, mesh_to_shell_karamba3d_6.Points])  # -> ClosestPoint, CPIndex, Distance
remove_duplicate_points_karamba3d_3 = RemoveDuplicatePointsKaramba3D(Point=flatten(closest_point_3.ClosestPoint), LimitDistance=0.005)  # -> OutPoint, Info, Indexes
point_5 = Point(remove_duplicate_points_karamba3d_3.OutPoint)
support_karamba3d_3 = SupportKaramba3D(PosInd=remove_duplicate_points_karamba3d_3.OutPoint, menu=[buttons(on, on, on, on, on, on)])

# ----
# Solver
assemble_model_karamba3d_3 = AssembleModelKaramba3D(
    Elem=flatten([mesh_to_shell_karamba3d_7.Element, mesh_to_shell_karamba3d_9.Element, mesh_to_shell_karamba3d_6.Element, mesh_to_shell_karamba3d_5.Element]),
    Support=flatten(support_karamba3d_3),
    Load=load_karamba3d_3,
    Material=material_properties_karamba3d_3,
    LimitDistance_m=0.005)  # -> Model, Info, Mass_kg, CenterOfGravity
analyze_karamba3d_3 = AnalyzeKaramba3D(Model=assemble_model_karamba3d_3.Model)  # -> CalculatedModel, MaximumDisplacement_cm, ResultingForceOfGravity_kN, ElasticEnergy_kNm

modelview_3 = ModelViewKaramba3D(Model=analyze_karamba3d_3.CalculatedModel, ResultFactors=1, ResultCase=-1)  # -> Model, DeformedMesh, DeformedAxes, DeformedModel
shellview_3 = ShellViewKaramba3D(Model=modelview_3.Model, IndexOfLayer=0)  # -> Model, MeshesOfRenderedShells, LegendColors, LegendTags
legend_5 = Legend(Colour=shellview_3.LegendColors, Tags=shellview_3.LegendTags, LegendType=1)
group_toggle_3 = GroupToggle(ToggleActive=True, ToggleVisible=False)  # disabled
unit_convert_3 = UnitConvert(L=shellview_3.LegendTags)
legend_6 = Legend(Colour=shellview_3.LegendColors, Tags=unit_convert_3, LegendType=1)

mesh_17 = Mesh(shellview_3.MeshesOfRenderedShells)

# ==== cluster UnitConvert
L = ClusterInput()

cull_i = CullIndex(List=L, Indices="0", Wrap=True)
multiplication = Multiplication(A=cull_i, B="10")
ins = InsertItems(List=multiplication, Item="Stress[MPa]", Indices="0", Wrap=True)

L_2 = ClusterOutput(ins)
