# Grasshopper definition [Configuring]Placing&Connecting-Centralities.gh (Grasshopper 1.0.7)

# Group 1
# Makers Bazaar
# 
# Abhishek Hola
# Anastasia Florou
# Daniel Simon
# Leonardo Caldoni
# Max Ketelaar
# Definition for placing and connecting the 2 main centralities of the bazaar
panel = Panel("""AR3B011 EARTHY

October 2020""")

# ---- group: Entrances
pt = Point([Point(115672.2944, -2828.75018, 0), Point(114036.8083, -1453.017687, 0), Point(113094.1377, -2945.735661, 0)])
preview = CustomPreview(Geometry=pt, Material=ColourSwatch(SwatchColor=RGB(87, 186, 185)))

# ---- group: Youth centers
pt_2 = Point([Point(112845.0339, -2751.858586, 0), Point(113530.2298, -2353.86913, 0), Point(113412.4921, -2134.928412, 0), Point(113598.7455, -1876.932565, 0), Point(113618.0975, -1697.919189, 0), Point(115048.2933, -2931.112515, 0), Point(114981.738, -3480.6174, 0), Point(115281.3935, -3516.064487, 0), Point(114319.0341, -2590.691682, 0), Point(114759.3589, -3807.698507, 0)])
preview_2 = CustomPreview(Geometry=pt_2, Material=ColourSwatch(SwatchColor=RGB(240, 117, 65)))

# ---- group: Distribution centers
pt_3 = Point([Point(113579.2424, -3325.877818, 0), Point(113474.2067, -2063.793457, 0), Point(113519.0001, -1950.836007, 0), Point(114931.6558, -1829.43429, 0), Point(115225.5237, -2013.472729, 0)])
preview_3 = CustomPreview(Geometry=pt_3, Material=ColourSwatch(SwatchColor=RGB(196, 33, 8)))

# ---- group: Mosques
mosques = Point([Point(115131.2117, -3665.020048, 0), Point(114592.9819, -3464.498854, 0), Point(114363.4753, -3381.952445, 0), Point(114217.4604, -3451.214823, 0), Point(114029.6889, -3207.951099, 0), Point(113781.7771, -3143.685117, 0)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])
preview_4 = CustomPreview(Geometry=mosques, Material=ColourSwatch(SwatchColor=RGB(220, 222, 84)))

# ---- group: Roads
secondary_roads = Curve([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])
primary_roads = Curve([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])
preview_5 = CustomPreview(Geometry=primary_roads, Material=ColourSwatch(SwatchColor=RGB(0, 0, 0)))
preview_6 = CustomPreview(Geometry=secondary_roads, Material=ColourSwatch(SwatchColor=RGB(89, 89, 89)))

# ---- group: Schools
schools = Point([Point(115048.3149, -2986.222277, 0), Point(114993.647, -3047.80627, 0), Point(115453.3614, -3133.889351, 0), Point(114093.2078, -2949.856421, 0), Point(113498.1316, -3034.652704, 0), Point(112786.6112, -2417.496487, 0), Point(113666.6623, -2151.179627, 0), Point(113666.9492, -2384.070872, 0), Point(113915.028, -2482.365117, 0), Point(115343.3884, -2164.431087, 0), Point(113862.8382, -3415.111336, 0), Point(113684.9194, -3351.910545, 0), Point(113660.9652, -1352.478485, 0), Point(114962.3787, -2322.715883, 0)])
preview_7 = CustomPreview(Geometry=schools, Material=ColourSwatch(SwatchColor=RGB(96, 145, 121)))

# ---- group: Radius of influence
small_influence = Slider(250, range=100..300)
big_influence = Slider(400, range=200..400)

# ----
ab_refinement = Slider(61, range=20..150)

# ---- group: Vector forces weighting factors
schools_weighting_factor = Slider(1, range=0.5..2)
mosques_weighting_factor = Slider(1.2, range=0.5..2)
distribution_centers_weighting_factor = Slider(1.5, range=0.5..2)
youth_centers_weighting_factor = Slider(1.5, range=0.5..2)

# ---- group: Areas of influence
# Placing centralities A & B
circle = CircleCNR(Center=schools, Normal=Vector(0, 0, 1), Radius=small_influence)
circle_2 = CircleCNR(Center=pt_2, Normal=Vector(0, 0, 1), Radius=small_influence)
circle_3 = CircleCNR(Center=pt_3, Normal=Vector(0, 0, 1), Radius=big_influence)
merge = Merge(Data1=circle, Data2=circle_2, Data3=circle_3)
runion = RegionUnion(Curves=merge)

# ---- group: Distance from gates
multiplication = Multiplication(A=big_influence, B="2")
circle_4 = CircleCNR(Center=pt, Normal=Vector(0, 0, 1), Radius=multiplication)
item = ListItem(List=circle_4, Index=0, Wrap=True)  # -> Item, Item1, Item2

# ---- group: Find junctions
merge_2 = Merge(Data1=primary_roads, Data2=secondary_roads)
disc = Discontinuity(Curve=merge_2, Level=1)  # -> flatten(Points), Parameters

# ----
number_slider = Slider(35, range=10..100)
swatch = ColourSwatch(SwatchColor=RGB(138, 41, 41))

# ---- group: Camp perimeter
join = JoinCurves(Curves=primary_roads, Preserve=False)
# Connecting centralities A & B
len = Length(Curve=join)
sort = SortList(Keys=len, ValuesA=join)  # -> Keys, ValuesA
item_2 = ListItem(List=reverse(sort.ValuesA), Index=0, Wrap=True)

crv = Curve(item_2)

srf = Surface(crv)

# ---- group: Area without infrastructure
rdiff = RegionDifference(CurvesA=srf, CurvesB=runion)
srf_2 = Surface(rdiff)
area = Area(Geometry=srf_2)  # -> Area, Centroid
smaller = SmallerThan(FirstNumber=area.Area, SecondNumber=Slider(5000, range=0..10000))  # -> SmallerThan, OrEqualTo
dispatch = Dispatch(List=rdiff, DispatchPattern=smaller.SmallerThan)  # -> ListA, ListB
crv_2 = Curve(dispatch.ListB)

# ---- group: Possible areas
rint = RegionIntersection(CurvesA=item.Item, CurvesB=graft(crv_2))
rint_2 = RegionIntersection(CurvesA=item.Item1, CurvesB=graft(crv_2))
rint_3 = RegionIntersection(CurvesA=item.Item2, CurvesB=graft(crv_2))
clean = CleanTree(RemoveNulls=True, RemoveInvalid=True, RemoveEmpty=True, Tree=rint)
clean_2 = CleanTree(RemoveNulls=True, RemoveInvalid=True, RemoveEmpty=True, Tree=rint_2)
clean_3 = CleanTree(RemoveNulls=True, RemoveInvalid=True, RemoveEmpty=True, Tree=rint_3)
len_2 = Length(Curve=flatten(clean))
len_3 = Length(Curve=flatten(clean_2))
len_4 = Length(Curve=flatten(clean_3))
larger = LargerThan(FirstNumber=len_2, SecondNumber="1000")  # -> LargerThan, OrEqualTo
larger_2 = LargerThan(FirstNumber=len_3, SecondNumber="1000")  # -> LargerThan, OrEqualTo
larger_3 = LargerThan(FirstNumber=len_4, SecondNumber="1000")  # -> LargerThan, OrEqualTo
cull = CullPattern(List=flatten(clean), CullPattern=larger.LargerThan)
cull_2 = CullPattern(List=flatten(clean_2), CullPattern=larger_2.LargerThan)
cull_3 = CullPattern(List=flatten(clean_3), CullPattern=larger_3.LargerThan)
crv_3 = Curve(cull)
crv_4 = Curve(cull_2)
crv_5 = Curve(cull_3)

# ---- group: Manual selection of two areas
merge_3 = Merge(Data1=crv_3, Data2=crv_4, Data3=crv_5)
item_3 = ListItem(List=merge_3, Index=Slider(0, range=0..4), Wrap=True)
item_4 = ListItem(List=merge_3, Index=Slider(2, range=0..4), Wrap=True)

# ---- group: Manual selection of centralities
incurve = PointInCurve(Point=disc.Points, Curve=item_3)  # -> Relationship, Point
incurve_2 = PointInCurve(Point=disc.Points, Curve=item_4)  # -> Relationship, Point
cull_4 = CullPattern(List=disc.Points, CullPattern=incurve.Relationship)
cull_5 = CullPattern(List=disc.Points, CullPattern=incurve_2.Relationship)
item_5 = ListItem(List=cull_4, Index=Slider(15, range=0..40), Wrap=True)
item_6 = ListItem(List=cull_5, Index=Slider(5, range=0..40), Wrap=True)

# ---- group: Centrality B
pt_4 = Point(item_6)

# ---- group: Centrality A
pt_5 = Point(item_5)

# ----
circle_5 = CircleCNR(Center=pt_5, Normal=Vector(0, 0, 1), Radius=number_slider)
circle_6 = CircleCNR(Center=pt_4, Normal=Vector(0, 0, 1), Radius=number_slider)
boundary = BoundarySurfaces(Edges=circle_5)
boundary_2 = BoundarySurfaces(Edges=circle_6)
preview_8 = CustomPreview(Geometry=boundary, Material=swatch)
preview_9 = CustomPreview(Geometry=boundary_2, Material=swatch)

# ---- group: Create vector forces field
ln = Line(StartPoint=pt_5, EndPoint=pt_4)

# ---- group: Create vector forces field / AB line
crv_6 = Curve(ln)

# ---- group: Create vector forces field (continued)
divide = DivideCurve(Curve=crv_6, Count=ab_refinement, Kinks=False)  # -> Points, Tangents, Parameters
ln_2 = Line(StartPoint=schools, EndPoint=graft(divide.Points))
ln_3 = Line(StartPoint=mosques, EndPoint=graft(divide.Points))
ln_4 = Line(StartPoint=graft(divide.Points), EndPoint=pt_2)
ln_5 = Line(StartPoint=graft(divide.Points), EndPoint=pt_3)
end = EndPoints(Curve=ln_2)  # -> Start, End
end_2 = EndPoints(Curve=ln_3)  # -> Start, End
end_3 = EndPoints(Curve=ln_4)  # -> Start, End
end_4 = EndPoints(Curve=ln_5)  # -> Start, End
scale = Scale(Geometry=ln_2, Center=end.Start, Factor=schools_weighting_factor)  # -> Geometry, Transform
scale_2 = Scale(Geometry=ln_3, Center=end_2.Start, Factor=mosques_weighting_factor)  # -> Geometry, Transform
scale_3 = Scale(Geometry=ln_4, Center=end_3.Start, Factor=youth_centers_weighting_factor)  # -> Geometry, Transform
scale_4 = Scale(Geometry=ln_5, Center=end_4.Start, Factor=distribution_centers_weighting_factor)  # -> Geometry, Transform
fvector = VectorForce(Line=scale.Geometry)
fvector_2 = VectorForce(Line=scale_2.Geometry)
fvector_3 = VectorForce(Line=scale_3.Geometry)
fvector_4 = VectorForce(Line=scale_4.Geometry)
merge_4 = Merge(Data1=simplify(fvector), Data2=simplify(fvector_2), Data3=simplify(fvector_3), Data4=simplify(fvector_4))
mergef = MergeFields(Fields=merge_4)
fline = FieldLine(Field=mergef, Point=graft(divide.Points), Steps=1000, Accuracy=0.1, Method=3)

# ---- group: Repositioned points
crv_7 = Curve(fline)
end_5 = EndPoints(Curve=crv_7)  # -> Start, End
pt_6 = Point(end_5.End)

# ---- group: Remove points outside AB area
crv_cp = CurveClosestPoint(Point=graft([pt_5, pt_4]), Curve=primary_roads)  # -> Point, Parameter, Distance
sort_2 = SortList(Keys=crv_cp.Distance)  # -> Keys, ValuesA
item_7 = ListItem(List=sort_2.Keys, Index=0, Wrap=True)
mindex = MemberIndex(Set=crv_cp.Distance, Member=item_7)  # -> Index, Count
item_8 = ListItem(List=primary_roads, Index=flatten(mindex.Index), Wrap=True)
loft = Loft(Curves=item_8, Options={Adjust=False, Closed=False, LoftEnds=0, LoftSimp=0, LoftType=0, Rebuild=10, Refit=0.01})
wires = BrepWireframe(Brep=loft, Density=-1)
join_2 = JoinCurves(Curves=wires, Preserve=False)
incurve_3 = PointInCurve(Point=flatten(pt_6), Curve=join_2)  # -> Relationship, Point
cull_6 = CullPattern(List=flatten(pt_6), CullPattern=incurve_3.Relationship)

# ---- group: Add centralities A & B
merge_5 = Merge(Data1=pt_5, Data2=pt_4)
panel_2 = Panel("""0
-1""")
ins = InsertItems(List=cull_6, Item=merge_5, Indices=panel_2, Wrap=True)

# ---- group: Snap points to road network
merge_6 = Merge(Data1=primary_roads, Data2=secondary_roads)
pull = PullPoint(Point=graft(ins), Geometry=merge_6, ClosestOnly=True)  # -> ClosestPoint, Distance
pt_7 = Point(pull.ClosestPoint)

# ---- group: Create roads and courtyards
shift = ShiftList(List=flatten(pt_7), Shift=1, Wrap=False)
rec_2pt = Rectangle2Pt(Plane=loft, PointA=pt_7, PointB=graft(shift), Radius=0)  # -> Rectangle, Length
boundary_3 = BoundarySurfaces(Edges=flatten(rec_2pt.Rectangle))
sunion = SolidUnion(Breps=boundary_3)

# ----
preview_10 = CustomPreview(Geometry=sunion, Material=ColourSwatch(SwatchColor=RGB(240, 117, 65)))
