# Grasshopper definition [Configuration]SpaceSyntax.gh (Grasshopper 1.0.7)
# plug-ins: SpaceSyntaxDesign_GH

panel = Panel("""Street
Caravanserai
Courtyard
Atrium
Workshop
Learning space
Retail food
Retail tech
Retail craft
Recreational space""")
pt = Point([<point referenced from the Rhino model> x14])
crv = Curve([<curve referenced from the Rhino model> x14])
genes = GenePool(Decimals=1, Maximum=400, Minimum=0, Value=[100, 400, 400, 200.7, 150.2, 70.5, 20.5, 20, 20.4, 20.9])
nodelinkgraph = GraphFromNodesLinks(Points=pt, Links=crv, Labels=panel, Areas=genes, TotalArea=Slider(1000, range=0..1000))  # -> Graph, GraphVertices, Attributes
forcedirecteddrawing = ForceDirectedDrawing(
    Graph=nodelinkgraph.Graph,
    Vertices=nodelinkgraph.GraphVertices,
    Attributes=nodelinkgraph.Attributes,
    AttractionStrength=0.25,
    RepulsionStrength=1.4,
    ConvergenceTolearnce=0.001,
    MaximumIterations=4000,
    Active=Toggle(False))  # -> NewGraphVertices, IterationCount
att = Data(nodelinkgraph.Attributes)
graph = Data(nodelinkgraph.Graph)
panel_2 = Panel(forcedirecteddrawing.NewGraphVertices)
integration = IntegrationAnalysis(Graph=graph, Attributes=att)  # -> DepthTable, DepthMap, RelativeASymetry, Integration, IntegrationRelativeColors, IntegrationTags
diskograph = DiskoGraphDrawing(
    Plane=PlaneXY(45.43794271, -29.76093707, 0),
    Graph=nodelinkgraph.Graph,
    Vertices=forcedirecteddrawing.NewGraphVertices,
    Attributes=nodelinkgraph.Attributes,
    Thickness=Slider(2.57, range=1..3))
sort = SortList(Keys=integration.Integration, ValuesA=integration.IntegrationRelativeColors, ValuesB=integration.IntegrationTags)  # -> Keys, ValuesA, ValuesB
legend = Legend(Colour=sort.ValuesA, Tags=sort.ValuesB, LegendType=1)
