# Grasshopper definition [Configuration]LayoutTool-latestVer_03-11.gh (Grasshopper 1.0.7)
# plug-ins: LunchBox, Kangaroo2 Components

# Group 1
# Makers Bazaar
# 
# Abhishek Hola
# Anastasia Florou
# Daniel Simon
# Leonardo Caldoni
# Max Ketelaar
# Layout Tool
# Phase 1 - Function elements
# Phase 2 - Building modules
panel = Panel("""AR3B011 EARTHY

October 2020""")

# ---- group: User input
how_many_per_function = Panel("""1
1
1
1
1
0
0
0""")
program_of_functions = Panel("""Caravanserai
Courtyard big
Atrium
Workshop
Learning space
Small shop
Big shop
Cafe""")
frequency_of_cafes = Slider(20, range=15..25)
extend_road_side_1 = Slider(60, range=5..100)
extend_road_side_2 = Slider(30, range=5..100)
layout_alternative = Slider(2, range=0..50)
grid_size = Slider(3.9, range=3..5)
min_area_per_function = Panel("""450
310
245
190
95
20
20
40""")

# ---- group: User input / Reset configuration
button = Button()

# ---- group: User input / Run solver
toggle = BooleanToggle(False)

# ---- group: Translate functions into XxY grid options
python = GhPythonScript(grid_size=grid_size, functions=program_of_functions, areas=min_area_per_function)  # -> out, tree_x, tree_y, tree_pairs; inputs functions: list, areas: list of Int32
# ---------- python: Python ----------
import rhinoscriptsyntax as rs
import Rhino.Geometry as rg
import Grasshopper as gh

grid_cell_area = grid_size ** 2 

#create a dictionary with area per function
program = {function:area for function,area in zip(functions, areas)}

#calculate how many grid cells per function
number_cells = []
for i in range(len(areas)):
    a = int(areas[i] / grid_cell_area)
    #print(a)
    if a > 4:
        divisors = 0
        for x in range(1, a):
            if a % x == 0:
                divisors += 1
        #make sure that there are enough XxY grid options for large areas
        if divisors < 3: 
            a += 1
        number_cells.append(a)
    elif a == 0:
        a = 1
        number_cells.append(a)
    else:
        if a % 2 != 0:
            a += 1
        number_cells.append(a)
#print(number_cells)

#find "pairs" of divisors for grid options
grid_pair_opt = []
grid_x = []
grid_y = []
for c in number_cells:
    pair_options = []
    x_options = []
    y_options = []
    if c > 6:
        for a in range(1, c):
            if c % a == 0:
                pair_options.append((int(a), int(c/a)))
                x_options.append(int(a))
                y_options.append(int(c/a))
    elif c == 1:
        pair_options.append((1 , 1))
        x_options.append(1)
        y_options.append(1)
    else:
        for a in range(1, c+1):
            if c % a == 0:
                pair_options.append((int(a), int(c/a)))
                x_options.append(int(a))
                y_options.append(int(c/a))
    grid_pair_opt.append(pair_options)
    grid_x.append(x_options)
    grid_y.append(y_options)

#print(grid_pair_opt)
#print(grid_x)
#print(grid_y)

# Convert the nested python lists to a gh data trees
def ListToTree(nestedList): 
    dt = gh.DataTree[object]()
    for i,l in enumerate(nestedList):
        dt.AddRange(l, gh.Kernel.Data.GH_Path(i))
    return dt

tree_x = ListToTree(grid_x)
tree_y = ListToTree(grid_y)
tree_pairs = ListToTree(grid_pair_opt)
# ---------- end python ----------

# ---- group: Remove "extreme" XxY ratios
flatten = FlattenTree(Tree=python.tree_x, Path="{0}")
flatten_2 = FlattenTree(Tree=python.tree_y, Path="{0}")
division = Division(A=flatten, B=flatten_2)
python_2 = GhPythonScript(x=division)  # -> cull_pattern; inputs x: list
# ---------- python_2: Python ----------
import rhinoscriptsyntax as rs

cull_pattern = []

for i in x:
    if i > 0.4 and i < 1.6:
        cull_pattern.append("True")
    else:
        cull_pattern.append("False")
# ---------- end python_2 ----------
lng = ListLength(List=python.tree_x)
partition = PartitionList(List=python_2, Size=flatten(lng))
cull = CullPattern(List=simplify(python.tree_x), CullPattern=simplify(partition))
cull_2 = CullPattern(List=simplify(python.tree_y), CullPattern=simplify(partition))

# ---- group: Roads & Grid / Pedestrian road (horizontal)
P = Curve(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)

# ---- group: Roads & Grid / Pedestrian road (vertical)
P_2 = Curve(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)

# ---- group: Cerate surface options per function
flatten_3 = FlattenTree(Tree=cull_2, Path="{0}")
flatten_4 = FlattenTree(Tree=cull, Path="{0}")
lng_2 = ListLength(List=cull_2)  # -> flatten(Length)
multiplication = Multiplication(A=flatten_4, B=grid_size)
multiplication_2 = Multiplication(A=flatten_3, B=grid_size)
planesrf = PlaneSurface(Plane=PlaneXY(0, 0, 0), XSize=graft(multiplication), YSize=graft(multiplication_2))  # -> simplify(flatten(Plane))
partition_2 = PartitionList(List=planesrf, Size=lng_2)  # -> simplify(Chunks)

# ---- group: Randomly choose from surface options
bnd = Bounds(Numbers=lng_2)
dedomain = DeconstructDomain(Domain=bnd)  # -> Start, End
dom = ConstructDomain(DomainStart=0, DomainEnd=expr("x-1", dedomain.End))
random = Random(Range=dom, Number="5", Seed=layout_alternative, Integers=True)
item = ListItem(List=partition_2, Index=graft(random), Wrap=True)

# ---- group: Functions modules
# Set initial function spaces
bang = ExplodeTree(Data=simplify(item))  # -> Branch0, Branch1, Branch2, Branch3, Branch4, Branch5, Branch6, Branch7

# ---- group: Functions modules / Caravanserai
srf = Surface(bang.Branch0)

# ---- group: Functions modules / Big courtyard
srf_2 = Surface(bang.Branch1)

# ---- group: Functions modules / Atrium
srf_3 = Surface(bang.Branch2)

# ---- group: Functions modules / Learning space
srf_4 = Surface(bang.Branch4)

# ---- group: Functions modules / Big shop
srf_5 = Surface(bang.Branch6)

# ---- group: Functions modules / Cafe
srf_6 = Surface(bang.Branch7)

# ---- group: Functions modules / Workshop
srf_7 = Surface(bang.Branch3)

# ---- group: Functions modules / Small shop
srf_8 = Surface(bang.Branch5)

# ---- group: Big courtyard center
area = Area(Geometry=srf_2)  # -> Area, Centroid
pt = Point(area.Centroid)

# ---- group: Atrium center
area_2 = Area(Geometry=srf_3)  # -> Area, Centroid
pt_2 = Point(area_2.Centroid)

# ---- group: Workshop center
area_3 = Area(Geometry=srf_7)  # -> Area, Centroid
pt_3 = Point(area_3.Centroid)

# ---- group: Learning space center
area_4 = Area(Geometry=srf_4)  # -> Area, Centroid
pt_4 = Point(area_4.Centroid)

# ----
oncurve = OnCurve(Points=pt_2, Curve=P, Strength=Slider(60, range=5..200))

# ---- group: Workshop - Learning space [distance range]
debrep = DeconstructBrep(Brep=srf_2)  # -> Faces, Edges, Vertices
len = Length(Curve=debrep.Edges)
avr = Average(Input=len)
ln = Line(StartPoint=pt_3, EndPoint=pt_4)
clamplength = ClampLength(Line=ln, LowerLimit=expr("x*1.0", avr), UpperLimit=expr("x*3.0", avr), Strength=Slider(50, range=5..200))

# ---- group: Courtyard - Learning space [distance goal]
cluster = Cluster_5(B=srf_2, B_2=srf_4)
ln_2 = Line(StartPoint=pt, EndPoint=pt_4)
length_line = LengthLine(Line=ln_2, Length=cluster, Strength=Slider(45, range=5..200))

# ---- group: Atrium - Courtyard [distance goal]
cluster_2 = Cluster_4(B=srf_2, B_2=srf_3)
ln_3 = Line(StartPoint=pt_2, EndPoint=pt)
length_line_2 = LengthLine(Line=ln_3, Length=expr("x*0.6", cluster_2), Strength=Slider(100, range=5..200))

# ---- group: Atrium - Workshop [distance goal]
cluster_3 = Cluster_4(B=srf_3, B_2=srf_7)
ln_4 = Line(StartPoint=pt_2, EndPoint=pt_3)
length_line_3 = LengthLine(Line=ln_4, Length=cluster_3, Strength=Slider(5, range=5..200))

# ---- group: Atrium - Learning space [distance goal]
cluster_4 = Cluster_5(B=srf_3, B_2=srf_4)
ln_5 = Line(StartPoint=pt_2, EndPoint=pt_4)
length_line_4 = LengthLine(Line=ln_5, Length=cluster_4, Strength=Slider(40, range=5..200))

# ---- group: Workshop - Courtyard [distance goal]
cluster_5 = Cluster_2(B=srf_2, B_2=srf_7)
ln_6 = Line(StartPoint=pt, EndPoint=pt_3)
length_line_5 = LengthLine(Line=ln_6, Length=cluster_5, Strength=Slider(50, range=5..200))

# ----
path = FilePath("D:\UNI\Master\AR3B011 Earthy\RELinexcel.xlsx")

# ---- group: importing REL chart
excelread = ExcelReader(ReadExcelData=Toggle(True), WorkbookPath=path, WorksheetName="Blad2")  # -> Exceptions, ExcelData
convert_to_nested_list = GhPythonScript(x=excelread.ExcelData)  # -> out, nestedList; inputs x: tree of Int32
# ---------- convert_to_nested_list: Python ----------
__author__ = "maxke"
__version__ = "2020.10.26"

import rhinoscriptsyntax as rs
print type(x)

nestedList = []
for i in range(x.BranchCount):
    branchList = x.Branch(i)
    branchPath = x.Path(i)
    temporaryList = []
    for j in range(branchList.Count):
        temporaryList.append(branchList[j])
    nestedList.append(temporaryList)

print type(nestedList)
print(nestedList)
# ---------- end convert_to_nested_list ----------

# ---- group: Number of stairs in Caravanserai
strairs_b = Slider(2, range=0..4)

# ---- group: Number of stairs in Workshop
strairs_c = Slider(2, range=0..2)

# ----
neg = Negative(Value=Slider(0.6, range=0.1..1))

# ---- group: Redirect pedestrian road if necessary (workshop)
merge = Merge(Data1=P, Data2=P_2)
int = Integer("0")

# ---- group: Redirect pedestrian road if necessary (learning space)
merge_2 = Merge(Data1=P, Data2=P_2)
int_2 = Integer("0")

# ---- group: Snap Workshop
int_3 = Integer("0")
vec = Vector(Vector(0, 0, 0))

# ---- group: Roads & Grid
vehicular_road = Curve(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)
ccx = CurveCurve(CurveA=P_2, CurveB=P)  # -> Points, ParamsA, ParamsB

# ---- group: Roads & Grid / Create grid
number_slider = Slider(40, range=10..100)
sqgrid = Square(Plane=PlaneXY(0, 0, 0), Size=grid_size, ExtentX=number_slider, ExtentY=number_slider)  # -> Cells, Points
area_5 = Area(Geometry=flatten(sqgrid.Cells))  # -> Area, Centroid
avr_2 = Average(Input=area_5.Centroid)
vec2pt = Vector2Pt(PointA=avr_2, PointB=ccx.Points, Unitize=False)  # -> Vector, Length
move = Move(Geometry=sqgrid.Cells, Motion=vec2pt.Vector)  # -> Geometry, Transform
debrep_2 = DeconstructBrep(Brep=move.Geometry)  # -> Faces, Edges, Vertices

# ---- group: Preview roads
neg_2 = Negative(Value="0.4")
neg_3 = Negative(Value="0.2")
offset = OffsetCurve(Curve=vehicular_road, Distance=["0.4", neg_2], Plane=PlaneXY(0, 0, 0), Corners=1)
offset_2 = OffsetCurve(Curve=P_2, Distance=["0.2", neg_3], Plane=PlaneXY(0, 0, 0), Corners=1)
offset_3 = OffsetCurve(Curve=P, Distance=["0.2", neg_3], Plane=PlaneXY(0, 0, 0), Corners=1)
loft = Loft(Curves=flatten(offset), Options={Adjust=False, Closed=False, LoftEnds=0, LoftSimp=0, LoftType=0, Rebuild=10, Refit=0.01})
loft_2 = Loft(
    Curves=flatten(offset_2),
    Options={Adjust=False, Closed=False, LoftEnds=0, LoftSimp=0, LoftType=0, Rebuild=10, Refit=0.01})
swatch = ColourSwatch(SwatchColor=RGB(138, 79, 74))
loft_3 = Loft(
    Curves=flatten(offset_3),
    Options={Adjust=False, Closed=False, LoftEnds=0, LoftSimp=0, LoftType=0, Rebuild=10, Refit=0.01})
preview = CustomPreview(Geometry=loft, Material=ColourSwatch(SwatchColor=RGB(201, 173, 115)))
preview_2 = CustomPreview(Geometry=loft_3, Material=swatch)
preview_3 = CustomPreview(Geometry=loft_2, Material=swatch)

# ---- group: Roads & Grid (continued)
area_6 = Area(Geometry=flatten(move.Geometry))  # -> Area, Centroid

# ---- group: Move caravanserai to vehicular road
ccx_2 = CurveCurve(CurveA=vehicular_road, CurveB=P)  # -> Points, ParamsA, ParamsB
multiplication_3 = Multiplication(A=grid_size, B="2")
Y = UnitY(Factor=multiplication_3)
neg_4 = Negative(Value=Y)
merge_3 = Merge(Data1=Y, Data2=neg_4)
item_2 = ListItem(List=random, Index=2, Wrap=True)
move_2 = Move(Geometry=ccx_2.Points, Motion=merge_3)  # -> Geometry, Transform
item_3 = ListItem(List=move_2.Geometry, Index=item_2, Wrap=True)  # -> Item, Item1
area_7 = Area(Geometry=srf)  # -> Area, Centroid
pdecon = Deconstruct(Point=item_3.Item)  # -> XComponent, YComponent, ZComponent
pdecon_2 = Deconstruct(Point=item_3.Item1)  # -> XComponent, YComponent, ZComponent
vec2pt_2 = Vector2Pt(PointA=area_7.Centroid, PointB=item_3.Item, Unitize=False)  # -> Vector, Length
move_3 = Move(Geometry=srf, Motion=vec2pt_2.Vector)  # -> Geometry, Transform
debrep_3 = DeconstructBrep(Brep=move_3.Geometry)  # -> Faces, Edges, Vertices
pdecon_3 = Deconstruct(Point=debrep_3.Vertices)  # -> XComponent, YComponent, ZComponent
python_3 = GhPythonScript(y1=pdecon.YComponent, y2=pdecon_2.YComponent)  # -> out, chosen_y
# ---------- python_3: Python ----------
chosen_y = []
if y1 < y2:
    chosen_y = [-1, -2]
else:
    chosen_y = [0, 1]
# ---------- end python_3 ----------
sort = SortList(Keys=pdecon_3.YComponent, ValuesA=debrep_3.Vertices)  # -> Keys, ValuesA
item_4 = ListItem(List=sort.ValuesA, Index=python_3.chosen_y, Wrap=True)
item_5 = ListItem(List=item_4, Index=item_2, Wrap=True)
vec2pt_3 = Vector2Pt(PointA=item_5, PointB=item_3.Item, Unitize=False)  # -> Vector, Length
move_4 = Move(Geometry=move_3.Geometry, Motion=vec2pt_3.Vector)  # -> Geometry, Transform
srf_9 = Surface(move_4.Geometry)

# ---- group: Caravanserai center
area_8 = Area(Geometry=srf_9)  # -> Area, Centroid
snapped_caravanserai_center = Point(area_8.Centroid)

# ---- group: Cross road
pt_5 = Point(ccx.Points)

# ---- group: Junction - Learning space [distance range]
debrep_4 = DeconstructBrep(Brep=srf_4)  # -> Faces, Edges, Vertices
len_2 = Length(Curve=debrep_4.Edges)
avr_3 = Average(Input=len_2)
ln_7 = Line(StartPoint=pt_4, EndPoint=pt_5)
clamplength_2 = ClampLength(Line=ln_7, LowerLimit=expr("x*2.0", avr_3), UpperLimit=expr("x*3", avr_3), Strength=Slider(40, range=5..200))

# ---- group: Caravanserai - Junction [distance goal]
debrep_5 = DeconstructBrep(Brep=srf)  # -> Faces, Edges, Vertices
len_3 = Length(Curve=debrep_5.Edges)
avr_4 = Average(Input=len_3)
ln_8 = Line(StartPoint=snapped_caravanserai_center, EndPoint=pt_5)
length_line_6 = LengthLine(Line=ln_8, Length=expr("x*2", avr_4), Strength=Slider(5, range=5..200))

# ---- group: Fix caravanserai location
anchor = Anchor(Point=snapped_caravanserai_center, Strength=Slider(200, range=5..200))

# ---- group: Caravanserai - Workshop [distance goal]
ln_9 = Line(StartPoint=snapped_caravanserai_center, EndPoint=pt_3)
cluster_6 = Cluster(B=srf_9, B_2=srf_7)
length_line_7 = LengthLine(Line=ln_9, Length=cluster_6, Strength=Slider(35, range=5..200))

# ---- group: Caravanserai - Courtyard [distance goal]
cluster_7 = Cluster_3(B=srf, B_2=srf_2, B_3=srf_7)
ln_10 = Line(StartPoint=snapped_caravanserai_center, EndPoint=pt)
length_line_8 = LengthLine(Line=ln_10, Length=cluster_7, Strength=Slider(5, range=5..200))

# ---- group: Anchor Junction
anchor_2 = Anchor(Point=pt_5, Strength=Slider(100, range=5..200))

# ---- group: Snap Caravanserai
crv_cp = CurveClosestPoint(Point=flatten(debrep_2.Vertices), Curve=vehicular_road)  # -> Point, Parameter, Distance
smaller = SmallerThan(FirstNumber=crv_cp.Distance, SecondNumber="2")  # -> SmallerThan, OrEqualTo
cull_3 = CullPattern(List=flatten(debrep_2.Vertices), CullPattern=smaller.SmallerThan)
pt_6 = Point(flatten(cull_3))

# ----
# Snap modules to grid and redirect pedestrian roads (if necessary)
panel_2 = Panel("2")
int_4 = Integer(panel_2)

# ---- group: Circulation cells
rec = Rectangle(flatten(move.Geometry))
area_9 = Area(Geometry=rec)  # -> Area, Centroid
int_5 = Integer("2")

# ---- group: Vehicular road cells
rec_2 = Rectangle(flatten(move.Geometry))
pt_7 = Point(flatten(area_6.Centroid))
int_6 = Integer("2")

# ---- group: Courtyard shops
rec_3 = Rectangle(flatten(move.Geometry))
pt_8 = Point(area_6.Centroid)
int_7 = Integer("2")

# ---- group: Define entrance
multiplication_4 = Multiplication(A="2", B=grid_size)

# ---- group: Create bounding box around area
int_8 = Integer("2")

# ---- group: Atrium - Junction [distance goal]
debrep_6 = DeconstructBrep(Brep=srf_3)  # -> Faces, Edges, Vertices
len_4 = Length(Curve=debrep_6.Edges)
avr_5 = Average(Input=len_4)
ln_11 = Line(StartPoint=pt_2, EndPoint=pt_5)

# ----
# Set kangaroo solver
panel_3 = Panel("0")

# ---- group: Atrium - Junction [distance goal] (continued)
length_line_9 = LengthLine(Line=ln_11, Length=panel_3, Strength=Slider(60, range=5..200))

# ----
merge_4 = Merge(
    Data1=anchor,
    Data2=length_line_7,
    Data3=length_line_5,
    Data4=length_line_8,
    Data5=length_line_2,
    Data6=length_line_3,
    Data7=length_line,
    Data8=clamplength,
    Data9=length_line_4,
    Data10=length_line_9,
    Data11=anchor_2,
    Data12=length_line_6,
    Data13=clamplength_2,
    Data14=oncurve)  # -> flatten(Result)
bouncysolver = BouncySolver(GoalObjects=merge_4, Reset=button, Threshold=1e-15, Tolerance=0.01, Damping=0.99, Iterations=10, On=toggle)  # -> I, V, O

# ----
# Solver results
item_6 = ListItem(List=bouncysolver.V, Index=0, Wrap=True)  # -> Item, Item1, Item2, Item3, Item4, Item5
vec2pt_4 = Vector2Pt(PointA=pt_2, PointB=item_6.Item, Unitize=False)  # -> Vector, Length
vec2pt_5 = Vector2Pt(PointA=pt_4, PointB=item_6.Item2, Unitize=False)  # -> Vector, Length
vec2pt_6 = Vector2Pt(PointA=snapped_caravanserai_center, PointB=item_6.Item3, Unitize=False)  # -> Vector, Length
vec2pt_7 = Vector2Pt(PointA=pt, PointB=item_6.Item4, Unitize=False)  # -> Vector, Length
vec2pt_8 = Vector2Pt(PointA=pt_3, PointB=item_6.Item5, Unitize=False)  # -> Vector, Length
move_5 = Move(Geometry=srf_3, Motion=vec2pt_4.Vector)  # -> Geometry, Transform
move_6 = Move(Geometry=srf_4, Motion=vec2pt_5.Vector)  # -> Geometry, Transform
move_7 = Move(Geometry=srf_9, Motion=vec2pt_6.Vector)  # -> Geometry, Transform
move_8 = Move(Geometry=srf_2, Motion=vec2pt_7.Vector)  # -> Geometry, Transform
move_9 = Move(Geometry=srf_7, Motion=vec2pt_8.Vector)  # -> Geometry, Transform
line = Line(bouncysolver.O)
preview_4 = CustomPreview(Geometry=line, Material=ColourSwatch(SwatchColor=RGB(255, 255, 255)))

# ---- group: Atrium [kangaroo solver]
srf_10 = Surface(move_5.Geometry)

# ---- group: Snap Atrium
debrep_7 = DeconstructBrep(Brep=srf_10)  # -> Faces, Edges, Vertices
dist = Distance(PointA=graft(debrep_7.Vertices), PointB=flatten(debrep_2.Vertices))
bnd_2 = Bounds(Numbers=flatten(dist))
dedomain_2 = DeconstructDomain(Domain=bnd_2)  # -> Start, End
mindex = MemberIndex(Set=dist, Member=dedomain_2.End)  # -> Index, Count
null = NullItem(Item=mindex.Index)  # -> NullFlags, InvalidFlags, Description
dispatch = Dispatch(List=debrep_7.Vertices, DispatchPattern=flatten(null.NullFlags))  # -> ListA, ListB
dist_2 = Distance(PointA=dispatch.ListB, PointB=flatten(debrep_2.Vertices))
sort_2 = SortList(Keys=dist_2, ValuesA=flatten(debrep_2.Vertices))  # -> Keys, ValuesA
item_7 = ListItem(List=sort_2.ValuesA, Index=0, Wrap=True)
vec2pt_9 = Vector2Pt(PointA=dispatch.ListB, PointB=item_7, Unitize=False)  # -> Vector, Length
move_10 = Move(Geometry=srf_10, Motion=vec2pt_9.Vector)  # -> Geometry, Transform

# ---- group: Atrium [snapped]
srf_11 = Surface(move_10.Geometry)

# ---- group: Learning space [kangaroo solver]
srf_12 = Surface(move_6.Geometry)

# ---- group: Caravanserai [kangaroo solver]
srf_13 = Surface(move_7.Geometry)

# ---- group: Courtyard [kangaroo solver]
srf_14 = Surface(move_8.Geometry)

# ---- group: Workshop [kangaroo solver]
srf_15 = Surface(move_9.Geometry)

# ---- group: Snap Workshop (continued)
debrep_8 = DeconstructBrep(Brep=srf_15)  # -> Faces, Edges, Vertices

# ---- group: Snap courtyard
debrep_9 = DeconstructBrep(Brep=srf_14)  # -> Faces, Edges, Vertices
debrep_10 = DeconstructBrep(Brep=srf_11)  # -> Faces, Edges, Vertices
join = JoinCurves(Curves=debrep_10.Edges, Preserve=False)
divlength = DivideLength(Curve=join, Length=grid_size)  # -> Points, Tangents, Parameters
dist_3 = Distance(PointA=graft(debrep_9.Vertices), PointB=divlength.Points)
bnd_3 = Bounds(Numbers=flatten(dist_3))
dedomain_3 = DeconstructDomain(Domain=bnd_3)  # -> Start, End
mindex_2 = MemberIndex(Set=dist_3, Member=dedomain_3.Start)  # -> Index, Count
null_2 = NullItem(Item=mindex_2.Index)  # -> NullFlags, InvalidFlags, Description
dispatch_2 = Dispatch(List=debrep_9.Vertices, DispatchPattern=flatten(null_2.NullFlags))  # -> ListA, ListB
item_8 = ListItem(List=dispatch_2.ListB, Index=0, Wrap=True)
dist_4 = Distance(PointA=item_8, PointB=divlength.Points)
sort_3 = SortList(Keys=dist_4, ValuesA=divlength.Points)  # -> Keys, ValuesA
item_9 = ListItem(List=sort_3.ValuesA, Index=0, Wrap=True)
vec2pt_10 = Vector2Pt(PointA=item_8, PointB=item_9, Unitize=False)  # -> Vector, Length
move_11 = Move(Geometry=srf_14, Motion=vec2pt_10.Vector)  # -> Geometry, Transform
debrep_11 = DeconstructBrep(Brep=move_11.Geometry)  # -> Faces, Edges, Vertices

# ---- group: Snap learning space
debrep_12 = DeconstructBrep(Brep=srf_12)  # -> Faces, Edges, Vertices

# ---- group: Snap Caravanserai (continued)
debrep_13 = DeconstructBrep(Brep=srf_13)  # -> Faces, Edges, Vertices
dist_5 = Distance(PointA=pt_6, PointB=graft(debrep_13.Vertices))
sort_4 = SortList(Keys=flatten(dist_5))  # -> Keys, ValuesA
item_10 = ListItem(List=sort_4.Keys, Index=0, Wrap=True)
mindex_3 = MemberIndex(Set=dist_5, Member=item_10)  # -> Index, Count
item_11 = ListItem(List=mindex_3.Index, Index=0, Wrap=True)
null_3 = NullItem(Item=item_11)  # -> NullFlags, InvalidFlags, Description
dispatch_3 = Dispatch(List=debrep_13.Vertices, DispatchPattern=flatten(null_3.NullFlags))  # -> ListA, ListB

# ----
item_12 = ListItem(List=dispatch_3.ListB, Index=0, Wrap=True)

# ---- group: Snap Caravanserai (continued)
dist_6 = Distance(PointA=item_12, PointB=pt_6)
sort_5 = SortList(Keys=dist_6, ValuesA=pt_6)  # -> Keys, ValuesA
item_13 = ListItem(List=sort_5.ValuesA, Index=0, Wrap=True)
vec2pt_11 = Vector2Pt(PointA=item_12, PointB=item_13, Unitize=False)  # -> Vector, Length
move_12 = Move(Geometry=srf_13, Motion=vec2pt_11.Vector)  # -> Geometry, Transform

# ---- group: Caravanserai [snapped]
srf_16 = Surface(move_12.Geometry)

# ---- group: Snap Workshop (continued)
edges = BrepEdges(Brep=srf_16)  # -> Naked, Interior, NonManifold
join_2 = JoinCurves(Curves=edges.Naked, Preserve=False)
divlength_2 = DivideLength(Curve=join_2, Length=grid_size)  # -> Points, Tangents, Parameters
dist_7 = Distance(PointA=graft(debrep_8.Vertices), PointB=divlength_2.Points)
bnd_4 = Bounds(Numbers=flatten(dist_7))
dedomain_4 = DeconstructDomain(Domain=bnd_4)  # -> Start, End
mindex_4 = MemberIndex(Set=dist_7, Member=dedomain_4.Start)  # -> Index, Count
null_4 = NullItem(Item=mindex_4.Index)  # -> NullFlags, InvalidFlags, Description
dispatch_4 = Dispatch(List=debrep_8.Vertices, DispatchPattern=flatten(null_4.NullFlags))  # -> ListA, ListB
item_14 = ListItem(List=flatten(dispatch_4.ListB), Index=0, Wrap=True)
dist_8 = Distance(PointA=item_14, PointB=flatten(debrep_2.Vertices))
sort_6 = SortList(Keys=dist_8, ValuesA=flatten(debrep_2.Vertices))  # -> Keys, ValuesA
item_15 = ListItem(List=sort_6.ValuesA, Index=0, Wrap=True)
vec2pt_12 = Vector2Pt(PointA=item_14, PointB=item_15, Unitize=False)  # -> Vector, Length
move_13 = Move(Geometry=srf_15, Motion=vec2pt_12.Vector)  # -> Geometry, Transform
debrep_14 = DeconstructBrep(Brep=move_13.Geometry)  # -> Faces, Edges, Vertices
crv_cp_2 = CurveClosestPoint(Point=debrep_14.Vertices, Curve=join_2)  # -> Point, Parameter, Distance
mindex_5 = MemberIndex(Set=crv_cp_2.Distance, Member=int_3)  # -> Index, Count
sort_7 = SortList(Keys=crv_cp_2.Distance, ValuesA=debrep_14.Vertices, ValuesB=crv_cp_2.Point)  # -> Keys, ValuesA, ValuesB
item_16 = ListItem(List=sort_7.ValuesA, Index=0, Wrap=True)
item_17 = ListItem(List=sort_7.ValuesB, Index=0, Wrap=True)
expression = Expression(x=mindex_5.Count, Expression="if(x=0, 0, 1)")
vec2pt_13 = Vector2Pt(PointA=item_16, PointB=item_17, Unitize=False)  # -> Vector, Length
merge_5 = Merge(Data1=vec2pt_13.Vector, Data2=vec)  # -> flatten(Result)
int_9 = Integer(expression)
item_18 = ListItem(List=reverse(merge_5), Index=int_9, Wrap=True)
move_14 = Move(Geometry=move_13.Geometry, Motion=item_18)  # -> Geometry, Transform

# ---- group: Redirect pedestrian road if necessary (workshop) (continued)
debrep_15 = DeconstructBrep(Brep=move_14.Geometry)  # -> Faces, Edges, Vertices
midpt = CurveMiddle(Curve=debrep_15.Edges)
area_10 = Area(Geometry=move_12.Geometry)  # -> Area, Centroid
dist_9 = Distance(PointA=area_10.Centroid, PointB=midpt)
sort_8 = SortList(Keys=dist_9, ValuesA=debrep_15.Edges)  # -> Keys, ValuesA
ccx_3 = CurveCurve(CurveA=move_14.Geometry, CurveB=merge)  # -> Points, ParamsA, ParamsB
item_19 = ListItem(List=reverse(sort_8.ValuesA), Index=0, Wrap=True)
item_20 = ListItem(List=flatten(ccx_3.Points), Index=0, Wrap=True)  # -> Item, Item1
end = EndPoints(Curve=item_19)  # -> Start, End
lng_3 = ListLength(List=ccx_3.Points)
merge_6 = Merge(Data1=end.Start, Data2=end.End)
ln_12 = Line(StartPoint=item_20.Item, EndPoint=item_20.Item1)
mindex_6 = MemberIndex(Set=flatten(lng_3), Member=int)  # -> Index, Count
crv_cp_3 = CurveClosestPoint(Point=merge_6, Curve=ln_12)  # -> Point, Parameter, Distance
item_21 = ListItem(List=crv_cp_3.Point, Index=0, Wrap=True)  # -> Item, Item1
ln_13 = Line(StartPoint=end.Start, EndPoint=item_21.Item)
ln_14 = Line(StartPoint=end.End, EndPoint=item_21.Item1)
vec2pt_14 = Vector2Pt(PointA=item_21.Item1, PointB=item_21.Item, Unitize=False)  # -> Vector, Length
vec2pt_15 = Vector2Pt(PointA=item_21.Item, PointB=item_21.Item1, Unitize=False)  # -> Vector, Length
amp = Amplitude(Vector=vec2pt_14.Vector, Amplitude=extend_road_side_1)
amp_2 = Amplitude(Vector=vec2pt_15.Vector, Amplitude=extend_road_side_2)
crv = Curve(item_19)
crv_2 = Curve(ln_14)
crv_3 = Curve(ln_13)
move_15 = Move(Geometry=item_21.Item, Motion=amp)  # -> Geometry, Transform
move_16 = Move(Geometry=item_21.Item1, Motion=amp_2)  # -> Geometry, Transform
join_3 = JoinCurves(Curves=[crv, crv_3, crv_2], Preserve=False)
lng_4 = ListLength(List=mindex_6.Index)
ln_15 = Line(StartPoint=move_15.Geometry, EndPoint=item_21.Item)
ln_16 = Line(StartPoint=item_21.Item1, EndPoint=move_16.Geometry)
expression_2 = Expression(x=lng_4, Expression="if(x=2, 0, 1)")
merge_7 = Merge(Data1=ln_15, Data2=join_3, Data3=ln_16)
join_4 = JoinCurves(Curves=flatten(merge_7), Preserve=False)
item_22 = ListItem(List=merge, Index=mindex_6.Index, Wrap=True)
merge_8 = Merge(Data1=join_4, Data2=item_22)
entwine = Entwine(Branch00=merge, Branch01=merge_8, FlattenInputs=True)
branch = TreeBranch(Tree=simplify(entwine), Path=expression_2, MaintainPaths=True)

# ---- group: Workshop [snapped]
srf_17 = Surface(move_14.Geometry)

# ---- group: Snap courtyard (continued)
debrep_16 = DeconstructBrep(Brep=srf_17)  # -> Faces, Edges, Vertices
join_5 = JoinCurves(Curves=debrep_16.Edges, Preserve=False)
divlength_3 = DivideLength(Curve=join_5, Length=grid_size)  # -> Points, Tangents, Parameters
dist_10 = Distance(PointA=graft(debrep_11.Vertices), PointB=divlength_3.Points)
bnd_5 = Bounds(Numbers=flatten(dist_10))
dedomain_5 = DeconstructDomain(Domain=bnd_5)  # -> Start, End
mindex_7 = MemberIndex(Set=dist_10, Member=dedomain_5.Start)  # -> Index, Count
null_5 = NullItem(Item=mindex_7.Index)  # -> NullFlags, InvalidFlags, Description
dispatch_5 = Dispatch(List=debrep_11.Vertices, DispatchPattern=flatten(null_5.NullFlags))  # -> ListA, ListB
item_23 = ListItem(List=dispatch_5.ListB, Index=0, Wrap=True)
dist_11 = Distance(PointA=item_23, PointB=divlength_3.Points)
sort_9 = SortList(Keys=dist_11, ValuesA=divlength_3.Points)  # -> Keys, ValuesA
item_24 = ListItem(List=sort_9.ValuesA, Index=0, Wrap=True)
vec2pt_16 = Vector2Pt(PointA=item_23, PointB=item_24, Unitize=False)  # -> Vector, Length
move_17 = Move(Geometry=move_11.Geometry, Motion=vec2pt_16.Vector)  # -> Geometry, Transform

# ---- group: Courtyard [snapped]
srf_18 = Surface(move_17.Geometry)

# ---- group: Snap learning space (continued)
edges_2 = BrepEdges(Brep=srf_18)  # -> Naked, Interior, NonManifold
sunion = SolidUnion(Breps=flatten([srf_11, srf_16, srf_17, srf_18]))
join_6 = JoinCurves(Curves=edges_2.Naked, Preserve=False)
edges_3 = BrepEdges(Brep=sunion)  # -> Naked, Interior, NonManifold
divlength_4 = DivideLength(Curve=join_6, Length=grid_size)  # -> Points, Tangents, Parameters
join_7 = JoinCurves(Curves=edges_3.Naked, Preserve=False)
divlength_5 = DivideLength(Curve=join_7, Length=grid_size)  # -> Points, Tangents, Parameters
shatter = Shatter(Curve=join_6, Parameters=divlength_4.Parameters)
shatter_2 = Shatter(Curve=join_7, Parameters=divlength_5.Parameters)
midpt_2 = CurveMiddle(Curve=shatter)
midpt_3 = CurveMiddle(Curve=shatter_2)
dist_12 = Distance(PointA=graft(midpt_2), PointB=midpt_3)
sort_10 = SortList(Keys=flatten(dist_12))  # -> Keys, ValuesA
item_25 = ListItem(List=sort_10.Keys, Index=0, Wrap=True)
mindex_8 = MemberIndex(Set=dist_12, Member=item_25)  # -> Index, Count
cset = CreateSet(List=flatten(mindex_8.Index))  # -> Set, Map
item_26 = ListItem(List=shatter_2, Index=flatten(cset.Set), Wrap=True)
eval = EvaluateCurve(Curve=reparameterize(item_26), Parameter="0")  # -> Point, Tangent, Angle
cset_2 = CreateSet(List=eval.Tangent)  # -> Set, Map
mindex_9 = MemberIndex(Set=eval.Tangent, Member=cset_2.Set)  # -> Index, Count
item_27 = ListItem(List=item_26, Index=mindex_9.Index, Wrap=True)
join_8 = JoinCurves(Curves=item_27, Preserve=False)
end_2 = EndPoints(Curve=join_8)  # -> Start, End
dist_13 = Distance(PointA=end_2.Start, PointB=graft(debrep_12.Vertices))
sort_11 = SortList(Keys=flatten(dist_13))  # -> Keys, ValuesA
item_28 = ListItem(List=sort_11.Keys, Index=0, Wrap=True)
mindex_10 = MemberIndex(Set=dist_13, Member=item_28)  # -> Index, Count
null_6 = NullItem(Item=mindex_10.Index)  # -> NullFlags, InvalidFlags, Description
dispatch_6 = Dispatch(List=debrep_12.Vertices, DispatchPattern=flatten(null_6.NullFlags))  # -> ListA, ListB
item_29 = ListItem(List=dispatch_6.ListB, Index=0, Wrap=True)
dist_14 = Distance(PointA=item_29, PointB=divlength_4.Points)
sort_12 = SortList(Keys=dist_14, ValuesA=divlength_4.Points)  # -> Keys, ValuesA
item_30 = ListItem(List=sort_12.ValuesA, Index=0, Wrap=True)
vec2pt_17 = Vector2Pt(PointA=item_29, PointB=item_30, Unitize=False)  # -> Vector, Length
move_18 = Move(Geometry=srf_12, Motion=vec2pt_17.Vector)  # -> Geometry, Transform

# ---- group: Redirect pedestrian road if necessary (learning space) (continued)
debrep_17 = DeconstructBrep(Brep=move_18.Geometry)  # -> Faces, Edges, Vertices
area_11 = Area(Geometry=move_17.Geometry)  # -> Area, Centroid
midpt_4 = CurveMiddle(Curve=debrep_17.Edges)
dist_15 = Distance(PointA=area_11.Centroid, PointB=midpt_4)
sort_13 = SortList(Keys=dist_15, ValuesA=debrep_17.Edges)  # -> Keys, ValuesA
ccx_4 = CurveCurve(CurveA=move_18.Geometry, CurveB=merge_2)  # -> Points, ParamsA, ParamsB
item_31 = ListItem(List=reverse(sort_13.ValuesA), Index=0, Wrap=True)
item_32 = ListItem(List=flatten(ccx_4.Points), Index=0, Wrap=True)  # -> Item, Item1
end_3 = EndPoints(Curve=item_31)  # -> Start, End
lng_5 = ListLength(List=ccx_4.Points)
merge_9 = Merge(Data1=end_3.Start, Data2=end_3.End)
ln_17 = Line(StartPoint=item_32.Item, EndPoint=item_32.Item1)
mindex_11 = MemberIndex(Set=flatten(lng_5), Member=int_2)  # -> Index, Count
crv_cp_4 = CurveClosestPoint(Point=merge_9, Curve=ln_17)  # -> Point, Parameter, Distance
item_33 = ListItem(List=crv_cp_4.Point, Index=0, Wrap=True)  # -> Item, Item1
ln_18 = Line(StartPoint=end_3.Start, EndPoint=item_33.Item)
ln_19 = Line(StartPoint=end_3.End, EndPoint=item_33.Item1)
vec2pt_18 = Vector2Pt(PointA=item_33.Item1, PointB=item_33.Item, Unitize=False)  # -> Vector, Length
vec2pt_19 = Vector2Pt(PointA=item_33.Item, PointB=item_33.Item1, Unitize=False)  # -> Vector, Length
amp_3 = Amplitude(Vector=vec2pt_18.Vector, Amplitude=extend_road_side_1)
amp_4 = Amplitude(Vector=vec2pt_19.Vector, Amplitude=extend_road_side_2)
crv_4 = Curve(item_31)
crv_5 = Curve(ln_19)
crv_6 = Curve(ln_18)
move_19 = Move(Geometry=item_33.Item, Motion=amp_3)  # -> Geometry, Transform
move_20 = Move(Geometry=item_33.Item1, Motion=amp_4)  # -> Geometry, Transform
join_9 = JoinCurves(Curves=[crv_4, crv_6, crv_5], Preserve=False)
ln_20 = Line(StartPoint=move_19.Geometry, EndPoint=item_33.Item)
ln_21 = Line(StartPoint=item_33.Item1, EndPoint=move_20.Geometry)
merge_10 = Merge(Data1=ln_20, Data2=join_9, Data3=ln_21)
join_10 = JoinCurves(Curves=flatten(merge_10), Preserve=False)
ccx_5 = CurveCurve(CurveA=graft(branch), CurveB=join_10)  # -> Points, ParamsA, ParamsB
lng_6 = ListLength(List=ccx_5.Points)
smaller_2 = SmallerThan(FirstNumber=flatten(lng_6), SecondNumber=int_4)  # -> SmallerThan, OrEqualTo
lng_7 = ListLength(List=mindex_11.Index)
cull_4 = CullPattern(List=branch, CullPattern=smaller_2.SmallerThan)
expression_3 = Expression(x=lng_7, Expression="if(x=2, 0, 1)")
merge_11 = Merge(Data1=cull_4, Data2=join_10)  # -> flatten(Result)
entwine_2 = Entwine(Branch00=merge_2, Branch01=merge_11, FlattenInputs=True)
branch_2 = TreeBranch(Tree=simplify(entwine_2), Path=expression_3, MaintainPaths=True)

# ---- group: Learning space [snapped]
srf_19 = Surface(move_18.Geometry)

# ---- group: Circulation cells (continued)
# Circulation, Shops & Cafes
sunion_2 = SolidUnion(Breps=simplify([srf_16, srf_17, srf_19, srf_18]))
join_11 = BrepJoin(Breps=sunion_2)  # -> Breps, Closed
edges_4 = BrepEdges(Brep=flatten(join_11.Breps))  # -> Naked, Interior, NonManifold
join_12 = JoinCurves(Curves=edges_4.Naked, Preserve=False)
crv_7 = Curve(join_12)
incurve = PointInCurve(Point=area_9.Centroid, Curve=crv_7)  # -> Relationship, Point
mindex_12 = MemberIndex(Set=incurve.Relationship, Member=int_5)  # -> Index, Count
cull_i = CullIndex(List=rec, Indices=flatten(mindex_12.Index), Wrap=True)
area_12 = Area(Geometry=cull_i)  # -> Area, Centroid
pt_9 = Point(area_12.Centroid)

# ---- group: Shops around circulation
rec_4 = Rectangle(cull_i)
sunion_3 = SolidUnion(Breps=[srf_11, srf_18])
debrep_18 = DeconstructBrep(Brep=sunion_3)  # -> Faces, Edges, Vertices
join_13 = JoinCurves(Curves=debrep_18.Edges, Preserve=False)

# ---- group: Define entrance (continued)
area_13 = Area(Geometry=srf_16)  # -> Area, Centroid
area_14 = Area(Geometry=srf_17)  # -> Area, Centroid
area_15 = Area(Geometry=srf_18)  # -> Area, Centroid
area_16 = Area(Geometry=srf_19)  # -> Area, Centroid
debrep_19 = DeconstructBrep(Brep=srf_11)  # -> Faces, Edges, Vertices
avr_6 = Average(Input=flatten([area_13.Centroid, area_14.Centroid, area_15.Centroid, area_16.Centroid]))
midpt_5 = CurveMiddle(Curve=debrep_19.Edges)
dist_16 = Distance(PointA=avr_6, PointB=midpt_5)
sort_14 = SortList(Keys=dist_16, ValuesA=debrep_19.Edges)  # -> Keys, ValuesA
item_34 = ListItem(List=reverse(sort_14.ValuesA), Index=0, Wrap=True)
area_17 = Area(Geometry=srf_11)  # -> Area, Centroid
srf_20 = Surface(srf_11)
wires = BrepWireframe(Brep=srf_20, Density=-1)
join_14 = JoinCurves(Curves=wires, Preserve=False)

# ---- group: Define entrance / Entrance side
crv_8 = Curve(item_34)

# ---- group: Create cafes
area_18 = Area(Geometry=srf_11)  # -> Area, Centroid

# ---- group: Check if there is extra space for Caravanserai - Distribution space
area_19 = Area(Geometry=srf_11)  # -> Area, Centroid
debrep_20 = DeconstructBrep(Brep=srf_16)  # -> Faces, Edges, Vertices
dist_17 = Distance(PointA=debrep_20.Vertices, PointB=area_19.Centroid)
sort_15 = SortList(Keys=dist_17, ValuesA=debrep_20.Vertices)  # -> Keys, ValuesA
item_35 = ListItem(List=reverse(sort_15.ValuesA), Index=0, Wrap=True)
rec_2pt = Rectangle2Pt(Plane=PlaneXY(0, 0, 0), PointA=item_35, PointB=area_19.Centroid, Radius=0)  # -> Rectangle, Length

# ---- group: Create bounding box around area (continued)
end_4 = EndPoints(Curve=branch_2)  # -> Start, End
item_36 = ListItem(List=end_4.Start, Index=0, Wrap=True)  # -> Item, Item1
item_37 = ListItem(List=end_4.End, Index=0, Wrap=True)  # -> Item, Item1
ln_22 = Line(StartPoint=item_36.Item, EndPoint=item_37.Item)
ln_23 = Line(StartPoint=item_36.Item1, EndPoint=item_37.Item1)
ccx_6 = CurveCurve(CurveA=ln_22, CurveB=ln_23)  # -> Points, ParamsA, ParamsB
vec2pt_20 = Vector2Pt(PointA=ccx_6.Points, PointB=item_37.Item1, Unitize=False)  # -> Vector, Length
vec2pt_21 = Vector2Pt(PointA=ccx_6.Points, PointB=item_36.Item1, Unitize=False)  # -> Vector, Length
move_21 = Move(Geometry=ln_22, Motion=vec2pt_20.Vector)  # -> Geometry, Transform
move_22 = Move(Geometry=ln_22, Motion=vec2pt_21.Vector)  # -> Geometry, Transform
loft_4 = Loft(
    Curves=[move_21.Geometry, move_22.Geometry],
    Options={Adjust=False, Closed=False, LoftEnds=0, LoftSimp=0, LoftType=0, Rebuild=10, Refit=0.01})
wires_2 = BrepWireframe(Brep=loft_4, Density=-1)
join_15 = JoinCurves(Curves=wires_2, Preserve=False)

# ---- group: Define entrance (continued)
midpt_6 = CurveMiddle(Curve=crv_8)
vec2pt_22 = Vector2Pt(PointA=area_17.Centroid, PointB=midpt_6, Unitize=False)  # -> Vector, Length
amp_5 = Amplitude(Vector=vec2pt_22.Vector, Amplitude=multiplication_4)
amp_6 = Amplitude(Vector=vec2pt_22.Vector, Amplitude=expr("x*6", multiplication_4))
move_23 = Move(Geometry=crv_8, Motion=amp_5)  # -> Geometry, Transform
move_24 = Move(Geometry=move_23.Geometry, Motion=amp_6)  # -> Geometry, Transform
loft_5 = Loft(
    Curves=[move_23.Geometry, move_24.Geometry],
    Options={Adjust=False, Closed=False, LoftEnds=0, LoftSimp=0, LoftType=0, Rebuild=10, Refit=0.01})
wires_3 = BrepWireframe(Brep=loft_5, Density=-1)
join_16 = JoinCurves(Curves=wires_3, Preserve=False)
merge_12 = Merge(Data1=join_16, Data2=join_14)

# ---- group: Courtyard shops (continued)
debrep_21 = DeconstructBrep(Brep=srf_18)  # -> Faces, Edges, Vertices
join_17 = JoinCurves(Curves=debrep_21.Edges, Preserve=False)

# ----
srf_21 = Surface(srf_11)
wires_4 = BrepWireframe(Brep=srf_21, Density=-1)
join_18 = JoinCurves(Curves=wires_4, Preserve=False)

# ---- group: Vehicular road cells (continued)
area_20 = Area(Geometry=srf_16)  # -> Area, Centroid
side = CurveSide(Curve=vehicular_road, Point=area_20.Centroid)  # -> Side, Left, Right

# ----
# Visualizing Results
swatch_2 = ColourSwatch(SwatchColor=RGB(79, 79, 79))
small_text_size = Slider(0.5, range=0.5..2)
big_text_size = Slider(1, range=0.5..2)
panel_4 = Panel("""Big
Courtyard""")
panel_5 = Panel("""Learning
Space""")
area_21 = Area(Geometry=srf_11)  # -> Area, Centroid
area_22 = Area(Geometry=srf_16)  # -> Area, Centroid
area_23 = Area(Geometry=srf_17)  # -> Area, Centroid
area_24 = Area(Geometry=srf_18)  # -> Area, Centroid
area_25 = Area(Geometry=srf_19)  # -> Area, Centroid
preview_5 = CustomPreview(Geometry=srf_11, Material=ColourSwatch(SwatchColor=RGB(219, 159, 103)))
preview_6 = CustomPreview(Geometry=srf_16, Material=ColourSwatch(SwatchColor=RGB(178, 138, 100)))
preview_7 = CustomPreview(Geometry=srf_17, Material=ColourSwatch(SwatchColor=RGB(135, 107, 80)))
preview_8 = CustomPreview(Geometry=srf_18, Material=ColourSwatch(SwatchColor=RGB(130, 79, 55)))
preview_9 = CustomPreview(Geometry=srf_19, Material=ColourSwatch(SwatchColor=RGB(189, 111, 75)))
tag = TextTag3D(Location=area_21.Centroid, Text="Atrium", Size=big_text_size, Colour=swatch_2, Justification=5)
tag_2 = TextTag3D(Location=area_22.Centroid, Text="Caravanserai", Size=big_text_size, Colour=swatch_2, Justification=5)
tag_3 = TextTag3D(Location=area_23.Centroid, Text="Workshop", Size=big_text_size, Colour=swatch_2, Justification=5)
tag_4 = TextTag3D(Location=area_24.Centroid, Text=panel_4, Size=big_text_size, Colour=swatch_2, Justification=8)
tag_5 = TextTag3D(Location=area_25.Centroid, Text=panel_5, Size=big_text_size, Colour=swatch_2, Justification=8)

# ---- group: Raods
item_38 = ListItem(List=branch_2, Index=0, Wrap=True)  # -> Item, Item1
neg_5 = Negative(Value="0.1")
swatch_3 = ColourSwatch(SwatchColor=RGB(138, 79, 74))

# ---- group: Raods / Pedestrian road 1
crv_9 = Curve(item_38.Item)

crv_10 = Curve(item_38.Item1)

# ---- group: Circulation cells (continued)
crv_cp_5 = CurveClosestPoint(Point=pt_9, Curve=crv_9)  # -> Point, Parameter, Distance
crv_cp_6 = CurveClosestPoint(Point=pt_9, Curve=crv_10)  # -> Point, Parameter, Distance
sort_16 = SortList(Keys=crv_cp_5.Distance)  # -> Keys, ValuesA
item_39 = ListItem(List=sort_16.Keys, Index=0, Wrap=True)
smaller_3 = SmallerThan(FirstNumber=crv_cp_5.Distance, SecondNumber=expr("x*1.5", item_39))  # -> SmallerThan, OrEqualTo
smaller_4 = SmallerThan(FirstNumber=crv_cp_6.Distance, SecondNumber=expr("x*1.5", item_39))  # -> SmallerThan, OrEqualTo
cull_5 = CullPattern(List=cull_i, CullPattern=smaller_3.SmallerThan)
cull_6 = CullPattern(List=cull_i, CullPattern=smaller_4.SmallerThan)
merge_13 = Merge(Data1=cull_5, Data2=cull_6)
boundary = BoundarySurfaces(Edges=merge_13)

# ---- group: Shops around circulation (continued)
python_4 = GhPythonScript(listx=smaller_3.SmallerThan, listy=smaller_4.SmallerThan)  # -> out, pattern; inputs listx: list of Boolean, listy: list of Boolean
# ---------- python_4: Python ----------
__author__ = "Anastasia"
__version__ = "2020.10.22"

import rhinoscriptsyntax as rs

pattern = []

for a, b in zip (listx, listy):
    if a == True or b == True:
        pattern.append(False)
    else:
        pattern.append(True)
# ---------- end python_4 ----------
cull_7 = CullPattern(List=rec_4, CullPattern=python_4.pattern)
area_26 = Area(Geometry=cull_7)  # -> Area, Centroid
pt_10 = Point(area_26.Centroid)
crv_11 = Curve(crv_9)
crv_12 = Curve(crv_10)
crv_cp_7 = CurveClosestPoint(Point=pt_10, Curve=crv_11)  # -> Point, Parameter, Distance
crv_cp_8 = CurveClosestPoint(Point=pt_10, Curve=crv_12)  # -> Point, Parameter, Distance
sort_17 = SortList(Keys=crv_cp_7.Distance)  # -> Keys, ValuesA
item_40 = ListItem(List=sort_17.Keys, Index=0, Wrap=True)
smaller_5 = SmallerThan(FirstNumber=crv_cp_7.Distance, SecondNumber=expr("x*1.7", item_40))  # -> SmallerThan, OrEqualTo
smaller_6 = SmallerThan(FirstNumber=crv_cp_8.Distance, SecondNumber=expr("x*1.7", item_40))  # -> SmallerThan, OrEqualTo
cull_8 = CullPattern(List=cull_7, CullPattern=smaller_5.SmallerThan)
cull_9 = CullPattern(List=cull_7, CullPattern=smaller_6.SmallerThan)
merge_14 = Merge(Data1=cull_8, Data2=cull_9)
area_27 = Area(Geometry=merge_14)  # -> Area, Centroid
incurve_2 = PointInCurve(Point=area_27.Centroid, Curve=join_13)  # -> Relationship, Point
mindex_13 = MemberIndex(Set=incurve_2.Relationship, Member=int_5)  # -> Index, Count
cull_i_2 = CullIndex(List=merge_14, Indices=flatten(mindex_13.Index), Wrap=True)
rec_5 = Rectangle(cull_i_2)

# ----
area_28 = Area(Geometry=merge_13)  # -> Area, Centroid
incurve_3 = PointInCurve(Point=area_28.Centroid, Curve=join_18)  # -> Relationship, Point
mindex_14 = MemberIndex(Set=incurve_3.Relationship, Member=int_5)  # -> Index, Count
cull_i_3 = CullIndex(List=merge_13, Indices=flatten(mindex_14.Index), Wrap=True)
rec_6 = Rectangle(cull_i_3)

# ---- group: Define entrance (continued)
area_29 = Area(Geometry=rec_5)  # -> Area, Centroid
incurve_4 = PointInCurve(Point=area_29.Centroid, Curve=join_16)  # -> Relationship, Point
mindex_15 = MemberIndex(Set=incurve_4.Relationship, Member=int_5)  # -> Index, Count
cull_i_4 = CullIndex(List=rec_5, Indices=flatten(mindex_15.Index), Wrap=True)
rec_7 = Rectangle(cull_i_4)

# ---- group: Create bounding box around area (continued)
area_30 = Area(Geometry=rec_6)  # -> Area, Centroid
area_31 = Area(Geometry=rec_7)  # -> Area, Centroid
incurve_5 = PointInCurve(Point=area_30.Centroid, Curve=join_15)  # -> Relationship, Point
incurve_6 = PointInCurve(Point=area_31.Centroid, Curve=join_15)  # -> Relationship, Point
mindex_16 = MemberIndex(Set=incurve_5.Relationship, Member=int_8)  # -> Index, Count
mindex_17 = MemberIndex(Set=incurve_6.Relationship, Member=int_8)  # -> Index, Count
item_41 = ListItem(List=rec_6, Index=mindex_16.Index, Wrap=True)
item_42 = ListItem(List=rec_7, Index=mindex_17.Index, Wrap=True)

# ---- group: Create bounding box around area / Circulation cells
rec_8 = Rectangle(item_41)

# ---- group: Create bounding box around area / Shop & Cafe cells
rec_9 = Rectangle(item_42)

# ---- group: Raods / Circulation cells
circula = Surface(rec_8)

# ---- group: Create cafes (continued)
area_32 = Area(Geometry=rec_9)  # -> Area, Centroid
dist_18 = Distance(PointA=area_18.Centroid, PointB=area_32.Centroid)
lng_8 = ListLength(List=area_32.Centroid)
division_2 = Division(A=lng_8, B=frequency_of_cafes)
sort_18 = SortList(Keys=dist_18, ValuesA=rec_9)  # -> Keys, ValuesA
series = Series(Start=0, Step=frequency_of_cafes, Count=division_2)
item_43 = ListItem(List=sort_18.ValuesA, Index=series, Wrap=True)

# ---- group: Create cafes / First cafe cell
rec_10 = Rectangle(flatten(item_43))

# ---- group: Create cafes (continued)
area_33 = Area(Geometry=rec_10)  # -> Area, Centroid
dist_19 = Distance(PointA=graft(area_33.Centroid), PointB=area_32.Centroid)
mindex_18 = MemberIndex(Set=dist_19, Member=grid_size)  # -> Index, Count
item_44 = ListItem(List=mindex_18.Index, Index=0, Wrap=True)
item_45 = ListItem(List=rec_9, Index=flatten(item_44), Wrap=True)

# ---- group: Create cafes / Second cafe cell
rec_11 = Rectangle(flatten(item_45))

# ---- group: Create cafes (continued)
merge_15 = Merge(Data1=simplify(graft(rec_10)), Data2=simplify(graft(rec_11)))  # -> simplify(Result)
sunion_4 = SolidUnion(Breps=merge_15)

# ---- group: Create cafes / Cafes
rec_12 = Rectangle(sunion_4)

# ---- group: Final shops
wires_5 = BrepWireframe(Brep=rec_12, Density=-1)
area_34 = Area(Geometry=rec_9)  # -> Area, Centroid
join_19 = JoinCurves(Curves=wires_5, Preserve=False)
incurve_7 = PointInCurve(Point=area_34.Centroid, Curve=join_19)  # -> Relationship, Point
mindex_19 = MemberIndex(Set=incurve_7.Relationship, Member=int_8)  # -> Index, Count
cull_i_5 = CullIndex(List=rec_9, Indices=flatten(mindex_19.Index), Wrap=True)

# ---- group: Final shops / Shops Bazaar
rec_13 = Rectangle(cull_i_5)

# ---- group: Shops & Cafes / Shops Bazaar
srf_22 = Surface(flatten(rec_13))

# ---- group: Shops & Cafes / Cafe
srf_23 = Surface(flatten(rec_12))

# ---- group: Courtyard shops (continued)
merge_16 = Merge(Data1=srf_11, Data2=srf_16, Data3=srf_17, Data4=srf_18, Data5=srf_19, Data6=srf_23, Data7=srf_22, Data8=circula)  # -> flatten(Result)
sunion_5 = SolidUnion(Breps=merge_16)
edges_5 = BrepEdges(Brep=sunion_5)  # -> Naked, Interior, NonManifold
join_20 = JoinCurves(Curves=edges_5.Naked, Preserve=False)
incurve_8 = PointInCurve(Point=pt_8, Curve=join_20)  # -> Relationship, Point
mindex_20 = MemberIndex(Set=incurve_8.Relationship, Member=int_7)  # -> Index, Count
cull_i_6 = CullIndex(List=rec_3, Indices=mindex_20.Index, Wrap=True)
area_35 = Area(Geometry=cull_i_6)  # -> Area, Centroid
crv_cp_9 = CurveClosestPoint(Point=area_35.Centroid, Curve=join_17)  # -> Point, Parameter, Distance
sort_19 = SortList(Keys=crv_cp_9.Distance)  # -> Keys, ValuesA
item_46 = ListItem(List=sort_19.Keys, Index=0, Wrap=True)
smaller_7 = SmallerThan(FirstNumber=crv_cp_9.Distance, SecondNumber=expr("x*1.5", item_46))  # -> SmallerThan, OrEqualTo
cull_10 = CullPattern(List=cull_i_6, CullPattern=smaller_7.SmallerThan)

# ---- group: Vehicular road cells (continued)
sunion_6 = SolidUnion(Breps=simplify(flatten([srf_11, srf_16, srf_17, srf_18, srf_19, srf_23, srf_22, circula])))
edges_6 = BrepEdges(Brep=sunion_6)  # -> Naked, Interior, NonManifold
crv_13 = Curve(edges_6.Naked)
join_21 = JoinCurves(Curves=crv_13, Preserve=False)
incurve_9 = PointInCurve(Point=pt_7, Curve=join_21)  # -> Relationship, Point
mindex_21 = MemberIndex(Set=incurve_9.Relationship, Member=int_6)  # -> Index, Count
cull_i_7 = CullIndex(List=rec_2, Indices=mindex_21.Index, Wrap=True)
rec_14 = Rectangle(cull_i_7)
area_36 = Area(Geometry=rec_14)  # -> Area, Centroid
side_2 = CurveSide(Curve=vehicular_road, Point=area_36.Centroid)  # -> Side, Left, Right
mindex_22 = MemberIndex(Set=side_2.Side, Member=side.Side)  # -> Index, Count
cull_i_8 = CullIndex(List=rec_14, Indices=mindex_22.Index, Wrap=True)
area_37 = Area(Geometry=cull_i_8)  # -> Area, Centroid
crv_cp_10 = CurveClosestPoint(Point=area_37.Centroid, Curve=vehicular_road)  # -> Point, Parameter, Distance
sort_20 = SortList(Keys=crv_cp_10.Distance)  # -> Keys, ValuesA
item_47 = ListItem(List=sort_20.Keys, Index=0, Wrap=True)
smaller_8 = SmallerThan(FirstNumber=crv_cp_10.Distance, SecondNumber=expr("x*1.1", item_47))  # -> SmallerThan, OrEqualTo
cull_11 = CullPattern(List=cull_i_8, CullPattern=smaller_8.SmallerThan)

# ---- group: Courtyard shops / Shops Courtyard
rec_15 = Rectangle(cull_10)

# ---- group: Vehicular road cells / Veh. road cells
rec_16 = Rectangle(cull_11)

# ---- group: Shops & Cafes / Shops Courtyard
srf_24 = Surface(flatten(rec_15))

# ---- group: Raods / Veh. road cells
srf_25 = Surface(rec_16)

# ---- group: Check if there is extra space for Caravanserai - Distribution space (continued)
merge_17 = Merge(
    Data1=srf_11,
    Data2=srf_16,
    Data3=srf_17,
    Data4=srf_18,
    Data5=srf_19,
    Data6=srf_23,
    Data7=srf_22,
    Data8=srf_24,
    Data9=circula,
    Data10=srf_25)  # -> flatten(Result)
sunion_7 = SolidUnion(Breps=merge_17)
rint = RegionIntersection(CurvesA=rec_2pt.Rectangle, CurvesB=sunion_7)
rdiff = RegionDifference(CurvesA=rec_2pt.Rectangle, CurvesB=rint)

# ---- group: Check if there is extra space for Caravanserai - Distribution space / Caravanserai extra space
srf_26 = Surface(rdiff)

# ---- group: Distribution - Buffer space
srf_27 = Surface(srf_26)

# ---- group: Shops & Cafes
lng_9 = ListLength(List=flatten(srf_22))
lng_10 = ListLength(List=flatten(srf_24))
area_38 = Area(Geometry=srf_22)  # -> Area, Centroid
area_39 = Area(Geometry=srf_24)  # -> Area, Centroid
series_2 = Series(Start=0, Step=1, Count=lng_9)
series_3 = Series(Start=0, Step=1, Count=lng_10)
expression_4 = Expression(x=series_2, Expression="Format(\"Shop {0}\", x+1)")
expression_5 = Expression(x=series_3, Expression="Format(\"Shop {0}\", x+1)")
area_40 = Area(Geometry=srf_23)  # -> Area, Centroid
preview_10 = CustomPreview(Geometry=srf_23, Material=ColourSwatch(SwatchColor=RGB(61, 130, 83)))
preview_11 = CustomPreview(Geometry=srf_22, Material=ColourSwatch(SwatchColor=RGB(36, 128, 109)))
preview_12 = CustomPreview(Geometry=srf_24, Material=ColourSwatch(SwatchColor=RGB(9, 92, 75)))
tag_6 = TextTag3D(Location=area_40.Centroid, Text="Cafe", Size=small_text_size, Colour=swatch_2, Justification=5)
tag_7 = TextTag3D(Location=area_38.Centroid, Text=expression_4, Size=small_text_size, Colour=swatch_2, Justification=5)
tag_8 = TextTag3D(Location=area_39.Centroid, Text=expression_5, Size=small_text_size, Colour=swatch_2, Justification=5)

# ---- group: Raods (continued)
offset_4 = OffsetCurve(Curve=crv_9, Distance=["0.1", neg_5], Plane=PlaneXY(0, 0, 0), Corners=1)
offset_5 = OffsetCurve(Curve=crv_10, Distance=["0.1", neg_5], Plane=PlaneXY(0, 0, 0), Corners=1)
loft_6 = Loft(
    Curves=flatten(offset_4),
    Options={Adjust=False, Closed=False, LoftEnds=0, LoftSimp=0, LoftType=0, Rebuild=10, Refit=0.01})
loft_7 = Loft(
    Curves=flatten(offset_5),
    Options={Adjust=False, Closed=False, LoftEnds=0, LoftSimp=0, LoftType=0, Rebuild=10, Refit=0.01})
preview_13 = CustomPreview(Geometry=circula, Material=ColourSwatch(SwatchColor=RGBA(133, 153, 145, 231)))
preview_14 = CustomPreview(Geometry=srf_25, Material=ColourSwatch(SwatchColor=RGBA(217, 114, 93, 231)))
preview_15 = CustomPreview(Geometry=loft_6, Material=swatch_3)
preview_16 = CustomPreview(Geometry=loft_7, Material=swatch_3)

# ----
area_41 = Area(Geometry=srf_27)  # -> Area, Centroid
preview_17 = CustomPreview(Geometry=srf_27, Material=ColourSwatch(SwatchColor=RGB(191, 161, 132)))
tag_9 = TextTag3D(Location=area_41.Centroid, Text="Distribution", Size=big_text_size, Colour=swatch_2, Justification=5)

# ----
# Set up input for python
sunion_8 = SolidUnion(Breps=circula)
sunion_9 = SolidUnion(Breps=srf_22)
sunion_10 = SolidUnion(Breps=flatten(srf_24))
area_42 = Area(Geometry=sunion_8)  # -> Area, Centroid
sunion_11 = SolidUnion(Breps=flatten(srf_25))
area_43 = Area(Geometry=sunion_9)  # -> Area, Centroid
scale = Scale(Geometry=sunion_8, Center=area_42.Centroid, Factor="1.02")  # -> Geometry, Transform
scale_2 = Scale(Geometry=sunion_9, Center=area_43.Centroid, Factor="1.02")  # -> Geometry, Transform
edges_7 = BrepEdges(Brep=sunion_10)  # -> flatten(Naked), Interior, NonManifold
edges_8 = BrepEdges(Brep=sunion_11)  # -> flatten(Naked), Interior, NonManifold
edges_9 = BrepEdges(Brep=srf_27)  # -> flatten(Naked), Interior, NonManifold
edges_10 = BrepEdges(Brep=scale_2.Geometry)  # -> flatten(Naked), Interior, NonManifold
edges_11 = BrepEdges(Brep=scale.Geometry)  # -> flatten(Naked), Interior, NonManifold
debrep_22 = DeconstructBrep(Brep=srf_11)  # -> Faces, Edges, Vertices
debrep_23 = DeconstructBrep(Brep=srf_16)  # -> Faces, Edges, Vertices
debrep_24 = DeconstructBrep(Brep=srf_17)  # -> Faces, Edges, Vertices
debrep_25 = DeconstructBrep(Brep=srf_18)  # -> Faces, Edges, Vertices
debrep_26 = DeconstructBrep(Brep=srf_19)  # -> Faces, Edges, Vertices
debrep_27 = DeconstructBrep(Brep=srf_23)  # -> Faces, Edges, Vertices
join_22 = JoinCurves(Curves=edges_11.Naked, Preserve=False)
join_23 = JoinCurves(Curves=debrep_22.Edges, Preserve=False)
join_24 = JoinCurves(Curves=debrep_23.Edges, Preserve=False)
join_25 = JoinCurves(Curves=debrep_24.Edges, Preserve=False)
join_26 = JoinCurves(Curves=debrep_25.Edges, Preserve=False)
join_27 = JoinCurves(Curves=debrep_26.Edges, Preserve=False)
join_28 = JoinCurves(Curves=debrep_27.Edges, Preserve=False)
join_29 = JoinCurves(Curves=edges_10.Naked, Preserve=False)
join_30 = JoinCurves(Curves=edges_9.Naked, Preserve=False)
join_31 = JoinCurves(Curves=edges_7.Naked, Preserve=False)
join_32 = JoinCurves(Curves=edges_8.Naked, Preserve=False)

# ---- group: Cafe perimeter
crv_14 = Curve(flatten(join_28))

# ---- group: Atrium perimeter
crv_15 = Curve(join_23)

# ---- group: Caravanserai perimeter
crv_16 = Curve(join_24)

# ---- group: Workshop perimeter
crv_17 = Curve(join_25)

# ---- group: Learning space perimeter
crv_18 = Curve(join_27)

# ---- group: Shop perimeter
crv_19 = Curve(join_29)

# ---- group: Shops courtyard perimeter
crv_20 = Curve(join_31)

# ---- group: Distribution perimeter
crv_21 = Curve(join_30)

# ---- group: Courtyard perimeter
crv_22 = Curve(join_26)

# ---- group: Circulation perimeter
crv_23 = Curve(join_22)

# ---- group: Veh. road perimeter
crv_24 = Curve(join_32)

# ---- group: Show optional grid
merge_18 = Merge(Data1=srf_11, Data2=srf_16, Data3=srf_17, Data4=srf_18, Data5=srf_19, Data6=srf_23, Data8=srf_22)  # -> flatten(Result)
join_33 = BrepJoin(Breps=merge_18)  # -> Breps, Closed
bbox = BoundingBox(Content=join_33.Breps, Plane=PlaneXY(0, 0, 0), UnionBox=True)  # -> Box, Box_2
edges_12 = BrepEdges(Brep=bbox.Box)  # -> Naked, Interior, NonManifold
join_34 = JoinCurves(Curves=edges_12.Naked, Preserve=False)
wall_thickness = Slider(0.5, range=0..1)
offset_6 = OffsetCurve(Curve=join_34, Distance=grid_size, Plane=PlaneXY(0, 0, 0), Corners=1)
incurve_10 = PointInCurve(Point=area_6.Centroid, Curve=offset_6)  # -> Relationship, Point
int_10 = Integer("2")
mindex_23 = MemberIndex(Set=incurve_10.Relationship, Member=int_10)  # -> Index, Count
item_48 = ListItem(List=flatten(move.Geometry), Index=mindex_23.Index, Wrap=True)
division_3 = Division(A=wall_thickness, B="2")
neg_6 = Negative(Value=division_3)

# ---- group: Show optional grid / Cells around config
rec_17 = Rectangle(item_48)

# ---- group: number of rows
item_49 = ListItem(List=flatten(edges_12.Naked), Index=1, Wrap=True)
len_5 = Length(Curve=item_49)
division_4 = Division(A=len_5, B=grid_size)
addition = Addition(A=division_4, B=2)

# ---- group: Cells as curves
debrep_28 = DeconstructBrep(Brep=rec_17)  # -> Faces, Edges, Vertices
join_35 = JoinCurves(Curves=debrep_28.Edges, Preserve=False)  # -> flatten(Curves)
crv_25 = Curve(join_35)

# ----
python_5 = GhPythonScript(
    grid_size=grid_size,
    cells=crv_25,
    A_per=crv_15,
    B_per=crv_16,
    C_per=crv_17,
    D_per=crv_22,
    E_per=crv_18,
    F_per=crv_14,
    G_per=crv_23,
    H_per=crv_19,
    I_per=crv_20,
    J_per=crv_21,
    V_per=crv_24)  # -> out, cell_centr, cell_func, center_dist; inputs cells: list of Curve, A_per: Curve, B_per: Curve, C_per: Curve, D_per: Curve, E_per: Curve, F_per: list of Curve, G_per: list of Curve, H_per: list of Curve, I_per: list of Curve, J_per: list of Curve, V_per: list of Curve
# ---------- python_5: Python ----------
import rhinoscriptsyntax as rs
import Rhino.Geometry as rg
import math


######## Check if a point is inside a function ########
def FuncIncl(perimeter, check_pt):
    if type(perimeter) is not list:
        if str(rg.Curve.Contains(perimeter, cent_pt)) == "Inside":
            return True
    else:
        for per in perimeter:
            if str(rg.Curve.Contains(per, cent_pt)) == "Inside":
                return True
    return False


######## Calculate distance between two points ########
def PtDist(pt_a, pt_b):
    dist = math.sqrt( ((pt_a[0]-pt_b[0])**2) + ((pt_a[1]-pt_b[1])**2) )
    return dist

#list for the centroids of the cells
cell_centr = []

for cell in cells:
    centr = rs.CurveAreaCentroid(cell)
    cell_centr.append(centr[0])

#list for each cell's function
cell_func = []
#list for the distance of the centroid of each cell from the centroid of its function
center_dist = []

for cent_pt in cell_centr:
    if FuncIncl(A_per, cent_pt):
        cell_func.append("A")
        f_ct = rs.CurveAreaCentroid(A_per)[0]
        dist = PtDist(f_ct, cent_pt)
        center_dist.append(dist)
    elif FuncIncl(B_per, cent_pt):
        cell_func.append("B")
        f_ct = rs.CurveAreaCentroid(B_per)[0]
        dist = PtDist(f_ct, cent_pt)
        center_dist.append(dist)
    elif FuncIncl(C_per, cent_pt):
        cell_func.append("C")
        f_ct = rs.CurveAreaCentroid(C_per)[0]
        dist = PtDist(f_ct, cent_pt)
        center_dist.append(dist)
    elif FuncIncl(D_per, cent_pt):
        cell_func.append("D")
        f_ct = rs.CurveAreaCentroid(D_per)[0]
        dist = PtDist(f_ct, cent_pt)
        center_dist.append(dist)
    elif FuncIncl(E_per, cent_pt):
        cell_func.append("E")
        f_ct = rs.CurveAreaCentroid(E_per)[0]
        dist = PtDist(f_ct, cent_pt)
        center_dist.append(dist)
    elif FuncIncl(F_per, cent_pt):
        cell_func.append("F")
        dist = grid_size
        center_dist.append(dist)
    elif FuncIncl(G_per, cent_pt):
        cell_func.append("G")
        center_dist.append(0)
    elif FuncIncl(H_per, cent_pt):
        cell_func.append("H")
        center_dist.append(0)
    elif FuncIncl(I_per, cent_pt):
        cell_func.append("I")
        center_dist.append(0)
    elif FuncIncl(J_per, cent_pt):
        cell_func.append("J")
        center_dist.append(0)
    elif FuncIncl(V_per, cent_pt):
        cell_func.append("V")
        center_dist.append(0)
    else:
        cell_func.append("X")
        center_dist.append(0)
# ---------- end python_5 ----------

area_44 = Area(Geometry=rec_17)  # -> Area, Centroid
tag_10 = TextTag3D(Location=flatten(area_44.Centroid), Text=python_5.cell_func, Size=1, Justification=7)

# ---- group: cell number (helps with user input)
index = ItemIndex(List=python_5.cell_centr, Item=python_5.cell_centr)
tag_11 = TextTag3D(Location=flatten(area_44.Centroid), Text=index, Size=0.33, Justification=7)

# ----
python_6 = GhPythonScript(
    u=Slider(426, range=0..620),
    x=addition,
    y=python_5.cell_func,
    z=python_5.center_dist,
    stairs_B=strairs_b,
    stairs_C=strairs_c,
    REL=convert_to_nested_list.nestedList)  # -> out, a, b, c, d, e, f, g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; inputs u: Int32, y: list, z: list of Int32, REL: list
# ---------- python_6: Python ----------
import rhinoscriptsyntax as rs
import Grasshopper as gh
from itertools import islice

class Cells: 
    def __init__(self, index):
        self.id = index

    def function(self):
        f = functionslist[self.id]
        return f

    def distance(self):
        d = distanceslist[self.id]
        return d

    def neighbour(self):
        nb = newNeighbours(newfunctionslist, self.id)
        return nb

    def walltype(self): # TO BE UPDATED, no longer relevant, could still be useful for finding corners etc.
        neighbour = list(newNeighbours(newfunctionslist, self.id))
        a = neighbour[-1] # the function of the cell
        for i, _ in enumerate(neighbour[0:4]): # making sure no invalid values are in the cells around the checked cell
            if type(neighbour[i]) == int:
                if functionslist[neighbour[i]] != a:
                    neighbour[i] = empty
        n = 4 - neighbour.count(empty)
        orientation = 0
        if neighbour[4] != empty:
            if n == 4:
                w = 'internal'
                orientation = 0
            elif n == 0:
                w = 'external'
                orientation = 0
            elif n == 1:
                w = 'U shape'
                orientation =  [p for p, side in enumerate(neighbour[0:4]) if side != empty][0]
            elif n == 3:
                w = 'I shape'
                orientation = [p for p, side in enumerate(neighbour[0:4]) if side == empty][0]
            elif n == 2: # differentiate between II and L shape
                indices = [p for p, side in enumerate(neighbour[0:4]) if side == empty]
                value = indices[0] - indices[1]
                if value%2 == 0:
                    w = 'II shape'
                else:
                    w = 'L shape'
                    orientation = indices
        else:
            w = 'no wall'
            orientation = 'NA'
        return [w, orientation]

    def inside(self): # maybe add conditional to only do this for certain functions
        f = newNeighbours(newfunctionslist, self.id)
        ins = True # default value
        if any(flag == empty for flag in f):
            ins = False
        else:
            indices = f[0:4]
            neighbouringfunctions = [functionslist[i] for i in indices]
            if any(flag2 != f[-1] for flag2 in neighbouringfunctions):
                ins = False
        return ins

empty = 'X' # unoccupied cell

def newindex(indA, grid): # get the column and row index from a grid corresponding to a simple index in a single list 
    width = len(grid[0])
    rowid = int(indA//(width))
    colid = indA%(width)
    return rowid,colid

def newgrid(grid, row): # create a nested list from a simple list and the known width of the target grid
    new_list = [grid[i:i+row] for i in range(0, len(grid), row)]
    return new_list

def newNeighbours(grid, ind): # returns the index of the neighbouring cells, returns 'empty' when the neighbouring cell falls outside of the grid
    m = newindex(ind, grid)[0]
    n = newindex(ind, grid)[1]
    row = len(grid)
    col = len(grid[0])
    
    if m != 0: left = ind-col 
    else: left = 0
    
    if m != row-1: right = ind+col 
    else: right = 0
    
    if n != 0: below = ind-1
    else: below = 0
    
    if n != col-1: above = ind+1
    else: above = 0
    
    self = grid[m][n]
    return left, above, right, below, self
    

###################### Coverting nested list to data tree ###########################
def listToTree(nestedList):
    
    dt = gh.DataTree[object]()
    for i,l in enumerate(nestedList):
        dt.AddRange(l,gh.Kernel.Data.GH_Path(i))
        
    return dt


############################### Outside of the class: ############################### 
# prepared lists:
grid_width = x # the number of rows in the grid
functionslist = y # the functions
distanceslist = z # distance from cell to function's centroid
newdistanceslist = newgrid(distanceslist,grid_width) # nested list of distances
newfunctionslist = newgrid(functionslist,grid_width) # nested list of functions

############################### Using the class: ####################################

a = [] # empty list for the instances of the class
for p, _ in enumerate(functionslist): # filling the list with the instances 
    cell = Cells(p)
    a.append(cell)

########################### Importing the REL chart: ################################

# REL table, imported from excel

# Convert it to a dictionary
rel_d = {'A':0, 'B':1, 'C':2, 'D':3, 'E':4, 'F':5, 'G':6, 'H':7, 'I':8, 'J':9, 'V':10, 'X':11}

"""
A = 0 # the atrium
B = 1 # the carevanserai
C = 2 # the workshops
D = 3 # the courtyard
E = 4 # the learning space
F = 5 # the café
G = 6 # the circulation (pedestrian)
H = 7 # the shops - bazaar
I = 8 # the shops - courtyard
J = 9 # the buffer spaces/distribution
V = 10 # the circulation (vehicular)
X = 11 # empty areas
"""

##################### Iteration 1 - Outer cells & REL chart ########################

closedlist = ['e','e','e','e'] # assign as "e" empty every edge that is not assigned yet
wallist = [] 

for i, _ in enumerate(a):
    if not a[i].inside():
        cur_func = a[i].function()
        temporarylist = []
        for p, j in islice(enumerate(a[i].neighbour()),0,4):
            if functionslist[j] is not cur_func:
                rel_val = REL[rel_d[cur_func]][rel_d[functionslist[j]]]
                if rel_val == 4:
                    temporarylist.append('o')
                elif rel_val == 3:
                    temporarylist.append('s')
                else:
                    temporarylist.append('c')
            else:
                temporarylist.append('e')
        wallist.append(temporarylist)
    else:
        wallist.append(closedlist)
        

walls = listToTree(wallist)

###################### Iteration 2 - self-standing units: #########################

emptyEdge = 'e'
openEdge = 'o'
closedEdge = 'c'
semiOpenEdge = 's'

def contact(index): # finds the neighbouring cell edge corresponding with the current cell's edges
    neighbours = a[index].neighbour()[0:4]
    value = []
    for i in range(4):
        neighbouredge = (i+2)%4 # finds the neighbouring side corresponding to the current cell edge
        wallID = neighbours[i]
        value.append(wallist[wallID][neighbouredge])
    return value

secondwallist = wallist

for i, _ in enumerate(a):
    if a[i].function() == 'A':
        for j in range(4):
            if contact(i)[j] != emptyEdge: # is the edge in contact with an assigned edge?
                secondwallist[i][j] = contact(i)[j] # assign same value
            else:
                neighbouringfunction = functionslist[a[i].neighbour()[j]] # find neighbouring functions
                if neighbouringfunction == 'G' or neighbouringfunction == 'F': # edge is in contact with G or F
                    secondwallist[i][j] = semiOpenEdge # assign semi-open edge
                else: # edge is not in contact with G or F
                    secondwallist[i][j] = openEdge # assign open edge
    
    elif a[i].function() == 'F' or a[i].function() == 'H':
        for j in range(4):
            if contact(i)[j] != emptyEdge: # is the edge in contact with an assigned edge?
                secondwallist[i][j] = contact(i)[j] # assign same value
            else:
                secondwallist[i][j] = semiOpenEdge # assign semi-open edge
    
    elif a[i].function() == 'G':
        for j in range(4):
            if contact(i)[j] != emptyEdge: # is the edge in contact with an assigned edge?
                secondwallist[i][j] = contact(i)[j] # assign same value
            else:
                neighbouringfunction = functionslist[a[i].neighbour()[j]] # find neighbouring functions
                if neighbouringfunction == 'G': # edge is in contact with another G
                    secondwallist[i][j] = openEdge # assign open edge
                else: # edge is not in contact with another G
                    secondwallist[i][j] = semiOpenEdge # assign semi-open edge



########################### extra extra! - closing off ###########################
dist_count = 3
distlist = [] # distribution/buffer is J
distid = []
worksh_count = 1
workshlist = [] # workshops is C
workshid = []
road_count = 3
roadlist = [] # roads is V
roadid = []

for i, _ in enumerate(a):
    if a[i].function() == 'B':
        neighbours = a[i].neighbour()[0:4] # finds all cells around the carevanserai
        for j in range(4):
            if functionslist[neighbours[j]] == 'J':
                distlist.append(distanceslist[i])
                distid.append([i,j])
            elif functionslist[neighbours[j]] == 'C':
                workshlist.append(distanceslist[i])
                workshid.append([i,j])
            elif functionslist[neighbours[j]] == 'V':
                roadlist.append(distanceslist[i])
                roadid.append([i,j])

sortedJ = [i[0] for i in sorted(enumerate(distlist), key = lambda x:x[1])]
Jcells = [distid[i] for i in sortedJ[dist_count:]] # cells to be altered
for i, cell in Jcells:
    secondwallist[i][cell] = 'c'
    index = a[i].neighbour()[cell] # cell to be also changed
    side = (cell+2)%4 # the cell's side to be changed
    secondwallist[index][side] = 'c'


sortedC = [i[0] for i in sorted(enumerate(workshlist), key = lambda x:x[1])]
Ccells = [workshid[i] for i in sortedC[worksh_count:]]
for i, cell in Ccells:
    secondwallist[i][cell] = 'c'
    index = a[i].neighbour()[cell] # cell to be also changed
    side = (cell+2)%4 # the cell's side to be changed
    secondwallist[index][side] = 'c'


sortedV = [i[0] for i in sorted(enumerate(roadlist), key = lambda x:x[1])]
Vcells = [roadid[i] for i in sortedV[road_count:]]
for i, cell in Vcells:
    secondwallist[i][cell] = 'c'
    index = a[i].neighbour()[cell] # cell to be also changed
    side = (cell+2)%4 # the cell's side to be changed
    secondwallist[index][side] = 'c'

b = listToTree(secondwallist)



############################# Iteration 3 - stairs: ###############################
# functions B and C need a second floor
thirdwallist = secondwallist
stairoptions = []

for i, _ in enumerate(a):
    if a[i].walltype()[0] == 'L shape' and (a[i].function() == 'B' or a[i].function() == 'C'):
        stairoptions.append(i)
for i, corner in enumerate(stairoptions):
    sides = thirdwallist[corner]
    num_c = sides.count('c')
    if num_c < 2:
        stairoptions[i] = 'no'

stairoptions = [i for i in stairoptions if i != 'no']
stairfunctions = [functionslist[i] for i in stairoptions]

stair_countB = stairs_B # should be 2
stair_countC = stairs_C # should be 1

B_options = stairfunctions.count('B')
C_options = stairfunctions.count('C')

while B_options > stair_countB:
    indices = ([i for i in stairoptions if functionslist[i] == 'B'])
    item_remove = input("too many options in B. These cells have stairs in B: {} remove by index?".format(indices)) # input in rhino console
    stairoptions.pop(item_remove)
    B_options = B_options-1

while C_options > stair_countC:
    indices = ([i for i in stairoptions if functionslist[i] == 'C'])
    item_remove = input("too many options in C. These cells have stairs in C: {} remove by index?".format(indices)) # input in rhino console
    stairoptions.pop(item_remove)
    C_options = C_options-1

stairsrotation = []
for i, index in enumerate(stairoptions):
    rotation = input("stair rotation of cell {} (0,1,2,3)?".format(index)) # input in rhino console
    stairsrotation.append(rotation)

for i, index in enumerate(stairoptions):
    for j in range(4):
        if j != stairsrotation[i]:
            thirdwallist[index][j] = 'c'
            print thirdwallist[index]

c = stairoptions
d = listToTree(thirdwallist)

####################### Iteration 4 - function-specific: ##########################

fourthwallist = thirdwallist
for i, _ in enumerate(a):
    if a[i].function() == 'C' or a[i].function() == 'D' or a[i].function() == 'E' or a[i].function() == 'I' or a[i].function() == 'J':
        for edge in range(4):
            if thirdwallist[i][edge] == 'e':
                hit = contact(i)[edge]
                if hit != 'e':
                    fourthwallist[i][edge] = hit
                else:
                    if a[i].function() == 'I':
                        fourthwallist[i][edge] = 's'
                    else:
                        fourthwallist[i][edge] = 'o'

e = listToTree(fourthwallist)

########################## Iteration 5 - carevanserai: ############################

fifthwallist = fourthwallist

for i, _ in enumerate(a):
    if a[i].function() == 'B': # for every B cell
        neighbouringIDs = a[i].neighbour()[0:4]
        if a[i].inside() is True: # cell is inner
            templist = []
            for j in range(4):
                dir = j%2 # 0 for vertical, 1 for horizontal
                if a[neighbouringIDs[j]].inside() is True: # edge is not in contact with outer cell
                    val = openEdge
                else: # edge is in contact with outer cell
                    if dir == 0: # edge is parallel to the road
                        val = openEdge
                    else: # edge is perpendicular to the road
                        val = semiOpenEdge
                templist.append(val)
            fifthwallist[i] = templist

for i, _ in enumerate(a): # had to break up this loop to refer back to itself
    if a[i].function() == 'B': # for every B cell
        neighbouringIDs = a[i].neighbour()[0:4]
        if a[i].inside() is False: # cell is outer
            templist = []
            for k in range(4):
                if fourthwallist[i][k] != 'e': # edge is already assigned
                    val = fourthwallist[i][k] # keep assigned edge
                    templist.append(val)
                else:
                    hit = fifthwallist[neighbouringIDs[k]][(k+2)%4]
                    if hit != 'e':
                        val = hit
                        templist.append(val)
                    else:
                        valuelist = []
                        for l in range(4):
                            valuelist.append(fifthwallist[i][l])
                        if 'o' in valuelist: # there is at least one open edge in the cell
                            val = 'o'
                            templist.append(val)
                        else:
                            val = 's'
                            templist.append(val)
            fifthwallist[i] = templist

f = listToTree(fifthwallist)
g = fifthwallist
# ---------- end python_6 ----------
item_50 = ListItem(List=python_5.cell_centr, Index=python_6.c, Wrap=True)
offset_7 = OffsetCurve(Curve=crv_25, Distance=neg, Plane=PlaneXY(0, 0, 0), Corners=1)
panel_6 = Panel(python_6.c)
debrep_29 = DeconstructBrep(Brep=offset_7)  # -> Faces, Edges, Vertices
midpt_7 = CurveMiddle(Curve=debrep_29.Edges)  # -> simplify(Midpoint)
rev = ReverseList(List=python_6.d)
rev_2 = ReverseList(List=python_6.e)
rev_3 = ReverseList(List=python_6.f)
rev_4 = ReverseList(List=python_6.b)
rev_5 = ReverseList(List=python_6.walls)
shift = ShiftList(List=rev_5, Shift="3", Wrap=True)
shift_2 = ShiftList(List=rev_4, Shift="3", Wrap=True)
shift_3 = ShiftList(List=rev, Shift="3", Wrap=True)
shift_4 = ShiftList(List=rev_2, Shift="3", Wrap=True)
shift_5 = ShiftList(List=rev_3, Shift="3", Wrap=True)

# ---- group: first iteration
tag_12 = TextTag3D(Location=graft(midpt_7), Text=graft(shift), Size=1, Justification=7)

# ---- group: second iteration
tag_13 = TextTag3D(Location=graft(midpt_7), Text=graft(shift_2), Size=1, Justification=7)

# ---- group: third iteration
tag_14 = TextTag3D(Location=graft(midpt_7), Text=graft(shift_3), Size=1, Justification=7)

# ---- group: fourth iteration
tag_15 = TextTag3D(Location=graft(midpt_7), Text=graft(shift_4), Size=1, Justification=7)

# ---- group: fifth iteration
tag_16 = TextTag3D(Location=graft(midpt_7), Text=graft(shift_5), Size=1, Justification=7)

# ---- group: Building module generating (WIP)
data_target_points = Data(python_5.cell_centr)
data_walls = Data(shift_5)
geo_closed = Geometry(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)
geo_semi_open = Geometry(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)
python_7 = GhPythonScript(w=data_target_points, x=data_walls, y=grid_size, z=geo_closed, u=geo_semi_open)  # -> out, a, b, flatten(c), d; inputs w: list, z: Brep, u: Brep
# ---------- python_7: Python ----------
"""Provides a*scripting component.
    Inputs:
        x: The x script variable
        y: The y script variable
    Output:
        a: The a output variable"""

__author__ = "maxke"
__version__ = "2020.10.29"

import rhinoscriptsyntax as rs
import Rhino.Geometry as rg

wallthickness = 0.3
wallength = y
origin = (0.0,0.0,0.0)
plane = rs.PlaneFromPoints((0.0, 0.0, 0.0),(1.0, 0.0, 0.0),(0.0, 1.0, 0.0))
semi = u
closed = z

sample = []
sample = ['c','c','o','s'],['e','s','c','s']

builtclosed = []
builtsemi = []

targets = w


# Here, the building modules are added to the grid. Unfortunately, this does not work yet
for cell,type in enumerate(sample):
    for side in range(4):
        if side == 0:
            point = (-0.5*wallength,0.0,0.0)
        elif side == 1:
            point = (0.0,0.5*wallength,0.0)
        elif side == 2:
            point = (0.5*wallength,0.0,0.0)
        elif side == 3:
            point = (0.0, -0.5*wallength,0.0,0.0)
        
        rotation = 90*side
        translation = point
        
        if type[side] == 'c':
            walltype = closed
            wallrot = rs.RotateObject(walltype, origin, rotation, 0, 1)
            wallmov = rs.MoveObject(wallrot, translation)
            wall = rs.MoveObject(wallmov, targets[cell])
            builtclosed.append(wall)
            """
        if type[side] == 's':
            semiwall = semi
            wallrot = rs.RotateObject(semiwall, origin, rotation, 0, 1)
            wallmov = rs.MoveObject(wallrot, translation)
            wall = rs.MoveObject(wallmov, targets[cell])
            builtsemi.append(wall)
            """


c = builtclosed
d = builtsemi
# ---------- end python_7 ----------
geo = Geometry(python_7.a)
geo_2 = Geometry(python_7.d)
geo_3 = Geometry(python_7.c)

# ---- group: Show optional grid (continued)
offset_8 = OffsetCurve(Curve=rec_17, Distance=neg_6, Plane=PlaneXY(0, 0, 0), Corners=1)
preview_18 = CustomPreview(Geometry=rec_17, Material=ColourSwatch(SwatchColor=RGBA(255, 255, 255, 200)))

# ---- group: Show optional grid / Inner offsets
crv_26 = Curve(offset_8)

# ---- group: Show optional grid (continued)
preview_19 = CustomPreview(Geometry=crv_26, Material=ColourSwatch(SwatchColor=RGBA(255, 255, 255, 120)))

# ==== cluster Cluster
B = ClusterInput()
B_2 = ClusterInput()
debrep = DeconstructBrep(Brep=B)  # -> Faces, Edges, Vertices
debrep_2 = DeconstructBrep(Brep=B_2)  # -> Faces, Edges, Vertices
len = Length(Curve=debrep.Edges)
len_2 = Length(Curve=debrep_2.Edges)
avr = Average(Input=len)
avr_2 = Average(Input=len_2)
division = Division(A=avr, B="1.8")
division_2 = Division(A=avr_2, B="1.8")
addition = Addition(A=division, B=division_2)
R = ClusterOutput(addition)

# ==== cluster Cluster_2
B = ClusterInput()
B_2 = ClusterInput()
debrep = DeconstructBrep(Brep=B)  # -> Faces, Edges, Vertices
debrep_2 = DeconstructBrep(Brep=B_2)  # -> Faces, Edges, Vertices
len = Length(Curve=debrep.Edges)
len_2 = Length(Curve=debrep_2.Edges)
avr = Average(Input=len)
avr_2 = Average(Input=len_2)
division = Division(A=avr, B="1.7")
division_2 = Division(A=avr_2, B="1.7")
addition = Addition(A=division, B=division_2)
R = ClusterOutput(addition)

# ==== cluster Cluster_3
B = ClusterInput()
B_2 = ClusterInput()
B_3 = ClusterInput()
debrep = DeconstructBrep(Brep=B)  # -> Faces, Edges, Vertices
debrep_2 = DeconstructBrep(Brep=B_2)  # -> Faces, Edges, Vertices
debrep_3 = DeconstructBrep(Brep=B_3)  # -> Faces, Edges, Vertices
len = Length(Curve=debrep.Edges)
len_2 = Length(Curve=debrep_2.Edges)
len_3 = Length(Curve=debrep_3.Edges)
avr = Average(Input=len)
avr_2 = Average(Input=len_2)
division = Division(A=avr, B="1.6")
avr_3 = Average(Input=len_3)
division_2 = Division(A=avr_2, B="1.6")
addition = Addition(A=division, B=division_2, C=avr_3)
R = ClusterOutput(addition)

# ==== cluster Cluster_4
B = ClusterInput()
B_2 = ClusterInput()
debrep = DeconstructBrep(Brep=B)  # -> Faces, Edges, Vertices
debrep_2 = DeconstructBrep(Brep=B_2)  # -> Faces, Edges, Vertices
len = Length(Curve=debrep.Edges)
len_2 = Length(Curve=debrep_2.Edges)
avr = Average(Input=len)
avr_2 = Average(Input=len_2)
division = Division(A=avr, B="1.0")
division_2 = Division(A=avr_2, B="1.0")
addition = Addition(A=division, B=division_2)
R = ClusterOutput(addition)

# ==== cluster Cluster_5
B = ClusterInput()
B_2 = ClusterInput()
debrep = DeconstructBrep(Brep=B)  # -> Faces, Edges, Vertices
debrep_2 = DeconstructBrep(Brep=B_2)  # -> Faces, Edges, Vertices
len = Length(Curve=debrep.Edges)
len_2 = Length(Curve=debrep_2.Edges)
avr = Average(Input=len)
avr_2 = Average(Input=len_2)
division = Division(A=avr_2, B="1.1")
division_2 = Division(A=avr, B="1.1")
addition = Addition(A=division_2, B=division)
R = ClusterOutput(addition)
