# Grasshopper definition [Shaping]StairGenerationAlgorithm.gh (Grasshopper 1.0.7)

# Group 1
# Makers Bazaar
# 
# Abhishek Hola
# Anastasia Florou
# Daniel Simon
# Leonardo Caldoni
# Max Ketelaar
# Definition for the creation of stairs within a cell of the grid, for a given starting and ending point
panel = Panel("""AR3B011 EARTHY

October 2020""")

# ---- group: Select starting and ending point
starting_cell = Slider(8, range=0..12)
starting_point = Slider(1, range=0..1)
ending_cell = Slider(3, range=0..12)
ending_point = Slider(0, range=0..1)

# ---- group: User input
number_of_sub_divisions = Panel("4")
number_slider = Slider(3, range=2.8..4)
step_height = Slider(0.19, range=0.16..0.22)
number_slider_2 = Slider(3.6, range=3.2..4.6)

# ---- group: Basic calculations
python = GhPythonScript(grid_size=number_slider_2, divisions_numb=number_of_sub_divisions, floor_height=number_slider, step_height=step_height)  # -> out, subcell_edge, steps_numb, steps_per_cell; inputs divisions_numb: Int32
# ---------- python: Python ----------
import rhinoscriptsyntax as rs
from math import ceil

#edge size of sub-cell
subcell_edge = grid_size / divisions_numb

#how many steps fit in a cell
steps_per_cell = subcell_edge // 0.3

#calculate exact step width
step_width = subcell_edge / steps_per_cell

#number of steps needed
steps_numb = ceil(floor_height / step_height)
# ---------- end python ----------

# ---- group: Navigate through the alternatives
button = Button()

# ----
# Create grid and select start and end
sqgrid = Square(Plane=PlaneXY(0, 0, 0), Size=python.subcell_edge, ExtentX=number_of_sub_divisions, ExtentY=number_of_sub_divisions)  # -> Cells, Points
sunion = SolidUnion(Breps=flatten(sqgrid.Cells))
area = Area(Geometry=flatten(sqgrid.Cells))  # -> Area, Centroid
area_2 = Area(Geometry=sunion)  # -> Area, Centroid
dist = Distance(PointA=area_2.Centroid, PointB=area.Centroid)
sort = SortList(Keys=dist)  # -> Keys, ValuesA
item = ListItem(List=sort.Keys, Index="-1", Wrap=True)
larger = LargerThan(FirstNumber=dist, SecondNumber=expr("x/1.5", item))  # -> LargerThan, OrEqualTo
dispatch = Dispatch(List=flatten(sqgrid.Cells), DispatchPattern=larger.OrEqualTo)  # -> ListA, ListB
edges = BrepEdges(Brep=sunion)  # -> Naked, Interior, NonManifold
midpt = CurveMiddle(Curve=edges.Naked)

# ---- group: Outer cells
srf = Surface(dispatch.ListA)

# ----
item_2 = ListItem(List=srf, Index=starting_cell, Wrap=True)
item_3 = ListItem(List=srf, Index=ending_cell, Wrap=True)

# ---- group: Ending cell
srf_2 = Surface(item_3)

# ---- group: Starting cell
srf_3 = Surface(item_2)

# ----
area_3 = Area(Geometry=srf_2)  # -> Area, Centroid
area_4 = Area(Geometry=srf_3)  # -> Area, Centroid
dist_2 = Distance(PointA=area_4.Centroid, PointB=midpt)
dist_3 = Distance(PointA=area_3.Centroid, PointB=midpt)
sort_2 = SortList(Keys=dist_2, ValuesA=midpt)  # -> Keys, ValuesA
sort_3 = SortList(Keys=dist_3, ValuesA=midpt)  # -> Keys, ValuesA
item_4 = ListItem(List=sort_2.Keys, Index=0, Wrap=True)
item_5 = ListItem(List=sort_3.Keys, Index=0, Wrap=True)
mindex = MemberIndex(Set=dist_2, Member=item_4)  # -> Index, Count
mindex_2 = MemberIndex(Set=dist_3, Member=item_5)  # -> Index, Count
item_6 = ListItem(List=midpt, Index=mindex.Index, Wrap=True)
item_7 = ListItem(List=midpt, Index=mindex_2.Index, Wrap=True)
item_8 = ListItem(List=item_6, Index=starting_point, Wrap=True)
item_9 = ListItem(List=item_7, Index=ending_point, Wrap=True)

# ---- group: Starting mid point
pt = Point(item_8)

# ---- group: Ending mid point
pt_2 = Point(item_9)

# ---- group: Find the route of the stair
# Stair solver
pt_3 = Point(area_4.Centroid)
pt_4 = Point(area_3.Centroid)
pt_5 = Point(area.Centroid)
stairsolver = GhPythonScript(
    start_point=pt_3,
    end_point=pt_4,
    start_mid_pt=pt,
    end_mid_pt=pt_2,
    all_points=pt_5,
    min_steps=python.steps_numb,
    subcell_edge=python.subcell_edge,
    x=button)  # -> out, route, step_type; inputs start_point: Point3d, end_point: Point3d, start_mid_pt: Point3d, end_mid_pt: Point3d, all_points: list of Point3d, min_steps: Int32
# ---------- stairsolver: Python ----------
import rhinoscriptsyntax as rs
import random
import Grasshopper as gh
import sys
import copy

# definition to find the closest points to a particular point
def closest_points(check_point, points_cloud):
    clos_points = []
    for point in points_cloud:
        if (round(point.X, 2) == round(check_point.X, 2)) and (round(abs(point.Y - check_point.Y), 2) == subcell_edge):
            clos_points.append(point)
        if (round(point.Y, 2) == round(check_point.Y, 2)) and (round(abs(point.X - check_point.X), 2) == subcell_edge):
            clos_points.append(point)
    return clos_points


# definition to remove coincidence points
def remove_coincide(check_point, points_cloud):
    for point in points_cloud:
        if (round(point.X, 2) == round(check_point.X, 2)) and (round(point.Y, 2) == round(check_point.Y, 2)):
            points_cloud.remove(point)
    return points_cloud


# check for coincidence of points
def check_coinc(pointA, pointB):
    coincidence = False
    if (round(pointA.X, 2) == round(pointB.X, 2)) and (round(pointA.Y, 2) == round(pointB.Y, 2)):
        coincidence = True
    return coincidence


"""
#convert a nested python list to a datatree
def ListToTree(nestedList):
    dt = gh.DataTree[object]()
    for i,  l in enumerate(nestedList):
        dt.AddRange(l, gh.Kernel.Data.GH_Path(i))
    return dt
"""


# remove start point from the "availability list"
default_avail_points = remove_coincide(start_point, all_points)

steps_count = 0

attempts = 0
limit = 10000  # limit of attempts to find a "route"

test = []
while steps_count < min_steps and attempts < limit:

    seed = random.randrange(sys.maxsize)
    rnd = random.Random(seed)
    #print("Seed was:", seed)
    current_point = start_point
    
    # make a deep copy of the avilable points
    avail_points = copy.deepcopy(default_avail_points)
    # initiate a list for the sequencial points as the "route" of the stairs
    route = []
    # set the start of the route on our starting point
    route.append(current_point)

    last_met = False  # check if we have reached the last cell

    zero_route = False  # check if we reached a point that the route cannot continue

    while not last_met:

        poss_points = closest_points(current_point, avail_points)

        while len(poss_points) == 0:
            route.remove(current_point)
            if len(route) == 0:
                zero_route = True
                attempts += 1
                break
            current_point = route[-1]
            poss_points = closest_points(current_point, avail_points)

        if zero_route:
            if attempts == limit:
                print(
                    "No solution found! Press the button to generate an alternative solution.")
            break

        else:
            # selected_point = poss_points[rnd.randint(0, len(poss_points) - 1)]
            # selected_point = rnd.choice(poss_points)
            # current_point = selected_point
            current_point = rnd.choice(poss_points)
            route.append(current_point)
            avail_points.remove(current_point)
            last_met = check_coinc(current_point, end_point)

    if not zero_route:

        step_type = []  # step type = 3 for cells that can have steps and 1 for landings

        for i in range(0, len(route)):

            # check if the first cell can have steps
            if i == 0:
                if (round(route[i+1].X, 2) == round(start_mid_pt.X, 2)) or (round(route[i+1].Y, 2) == round(start_mid_pt.Y, 2)):
                    step_type.append(3)
                else:
                    step_type.append(1)

            # check if the last cell can have steps
            elif i == int(len(route)-1):
                if (round(route[i-1].X, 2) == round(end_mid_pt.X, 2)) or (round(route[i-1].Y, 2) == round(end_mid_pt.Y, 2)):
                    step_type.append(3)
                else:
                    step_type.append(1)

            # check if the rest of the cells can have steps
            else:
                if round(route[i].X, 2) == round(route[i-1].X, 2) and round(route[i].X, 2) == round(route[i+1].X, 2):
                    # small_steps_ind.append(i)
                    step_type.append(3)
                elif round(route[i].Y, 2) == round(route[i-1].Y, 2) and round(route[i].Y, 2) == round(route[i+1].Y, 2):
                    # small_steps_ind.append(i)
                    step_type.append(3)
                else:
                    # landings_ind.append(i)
                    step_type.append(1)

        steps_count = sum(step_type)
        test.append(steps_count)

if attempts < limit:
    print("Solution generated")
# ---------- end stairsolver ----------

# ---- group: Navigate through the alternatives (continued)
solver_s_result = Panel(stairsolver.out)

# ----
# "Orient" the steps
pt_6 = Point(stairsolver.route)
dist_4 = Distance(PointA=graft(pt_6), PointB=pt_5)
num = Number("0")
mindex_3 = MemberIndex(Set=dist_4, Member=num)  # -> Index, Count
lng = ListLength(List=pt_6)
cull_i = CullIndex(List=pt_6, Indices=expr("x-1", lng), Wrap=True)
item_10 = ListItem(List=flatten(sqgrid.Cells), Index=flatten(mindex_3.Index), Wrap=True)
shift = ShiftList(List=pt_6, Shift=1, Wrap=False)
debrep = DeconstructBrep(Brep=item_10)  # -> Faces, Edges, Vertices
ln = Line(StartPoint=cull_i, EndPoint=shift)
eval = EvaluateCurve(Curve=reparameterize(debrep.Edges), Parameter="0")  # -> Point, Tangent, Angle
eval_2 = EvaluateCurve(Curve=reparameterize(ln), Parameter="0")  # -> Point, Tangent, Angle
mindex_4 = MemberIndex(Set=eval.Tangent, Member=graft(eval_2.Tangent))  # -> Index, Count
lng_2 = ListLength(List=flatten(mindex_4.Index))
addition = Addition(A=mindex_4.Index, B="1")
addition_2 = Addition(A=mindex_4.Index, B="3")
dup = DuplicateData(Data="1", Number=lng_2, Order=True)
ins = InsertItems(List=addition, Item=addition_2, Indices=graft(dup), Wrap=True)
item_11 = ListItem(List=debrep.Edges, Index=ins, Wrap=True)
midpt_2 = CurveMiddle(Curve=item_11)

# ----
# Create steps and landings
item_12 = ListItem(List=midpt_2, Index=0, Wrap=True)  # -> simplify(Item), Item1
item_13 = ListItem(List=item_11, Index=0, Wrap=True)  # -> simplify(Item1), Item
ln_2 = Line(StartPoint=item_12.Item1, EndPoint=item_12.Item)
divide = DivideCurve(Curve=ln_2, Count=graft(stairsolver.step_type), Kinks=False)  # -> Points, Tangents, Parameters
item_14 = ListItem(List=divide.Points, Index=0, Wrap=True)
vec2pt = Vector2Pt(PointA=item_14, PointB=divide.Points, Unitize=False)  # -> Vector, Length
move = Move(Geometry=item_13.Item1, Motion=vec2pt.Vector)  # -> Geometry, Transform
lng_3 = ListLength(List=move.Geometry)  # -> expr("x-1", Length)
shift_2 = ShiftList(List=move.Geometry, Shift=1, Wrap=False)  # -> graft(List)
cull_i_2 = CullIndex(List=move.Geometry, Indices=lng_3, Wrap=True)  # -> graft(List)
loft = Loft(
    Curves=[cull_i_2, shift_2],
    Options={Adjust=False, Closed=False, LoftEnds=0, LoftSimp=0, LoftType=0, Rebuild=10, Refit=0.01})

# ----
# Assign heights to steps
lng_4 = ListLength(List=flatten(loft))
python_2 = GhPythonScript(
    num_poss_steps=lng_4,
    steps_numb=python.steps_numb,
    steps_per_cell=python.steps_per_cell,
    step_type=stairsolver.step_type,
    floor_height=number_slider,
    step_height=step_height)  # -> out, final_heights; inputs num_poss_steps: Int32, steps_numb: Int32, steps_per_cell: Int32, step_type: list of Int32
# ---------- python_2: Python ----------
#create a list from the step heights
steps_heights = []
for i in range(1, steps_numb + 1):
    step = step_height * i
    steps_heights.append(step)

final_heights = []

if num_poss_steps == len(steps_heights):
    final_heights = steps_heights
else:
    steps_heights += (sum(step_type) - len(steps_heights)) * [steps_heights[-1]]
    st_as = 0
    pair_found = False
    
    for i, stype in enumerate(step_type):
        if pair_found:
            pair_found = False
            continue
            
        if stype == 3:
            for ii in range(3):
                final_heights.append(steps_heights[st_as + ii])
            st_as += 3
            
        if stype == 1:
            final_heights.append(steps_heights[st_as])
            st_as += 1
            if step_type[i + 1] == 1:
                final_heights.append(steps_heights[st_as])
                pair_found = True
# ---------- end python_2 ----------
Z = UnitZ(Factor=python_2.final_heights)
extr = Extrude(Base=simplify(loft), Direction=graft(Z))

# ---- group: Number cells and steps
# Visualization
debrep_2 = DeconstructBrep(Brep=extr)  # -> Faces, Edges, Vertices
item_15 = ListItem(List=debrep_2.Faces, Index=0, Wrap=True)  # -> Item1, Item
sunion_2 = SolidUnion(Breps=flatten(item_15.Item1))
area_5 = Area(Geometry=sunion_2)  # -> Area, Centroid
points = PointList(Points=flatten(area_5.Centroid), Size=Slider(0.1, range=0.1..0.5))
points_2 = PointList(Points=stairsolver.route, Size=Slider(0.2, range=0.1..0.5))

# ---- group: Preview options
brep = Brep(extr)
join = BrepJoin(Breps=flatten(brep))  # -> Breps, Closed
srf_4 = Surface(flatten(sqgrid.Cells))
srf_5 = Surface(srf_3)
srf_6 = Surface(srf_2)
preview = CustomPreview(Geometry=flatten(join.Breps), Material=ColourSwatch(SwatchColor=RGB(147, 191, 178)))
preview_2 = CustomPreview(Geometry=srf_4, Material=ColourSwatch(SwatchColor=RGBA(184, 150, 99, 114)))
preview_3 = CustomPreview(Geometry=srf_5, Material=ColourSwatch(SwatchColor=RGBA(176, 150, 111, 230)))
preview_4 = CustomPreview(Geometry=srf_6, Material=ColourSwatch(SwatchColor=RGB(71, 58, 37)))

# ---- group: Calculations for each configuration
sunion_3 = SolidUnion(Breps=flatten(join.Breps))
len = Length(Curve=ln)
volume = Volume(Geometry=flatten(sunion_3))  # -> Volume, Centroid
ma = MassAddition(Input=len)  # -> Result, PartialResults
lng_5 = ListLength(List=stairsolver.route)
total_length = Panel(ma.Result)
cells_used = Panel(lng_5)
total_volume = Panel(volume.Volume)
