# Grasshopper definition 2020.10.22_Modular Atrium.gh (Grasshopper 1.0.7)
# plug-ins: Weaverbird, Kangaroo2 Components

# ---- group: Edge and Point Anchors
inclusiveness_range = Slider(0.03, range=0..1)
anchor_xyz = BooleanToggle(True)
x_y_anchors_of_edges = Curve([<curve referenced from the Rhino model> x1708])
edges_of_anchor_points = Curve([<curve referenced from the Rhino model> x20])

# ---- group: Solver Settings
start_stop = BooleanToggle(False)
rest_button = Button()
number_slider = Slider(0.65, range=0..2)
number_slider_2 = Slider(1, range=0..1)
number_slider_3 = Slider(0.065, range=0..0.1)

# ----
input_curves = Curve([<curve referenced from the Rhino model> x5000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])
explode = Explode(Curve=input_curves, Recursive=True)  # -> Segments, Vertices
wbweave = WeaverbirdsMeshFromLinesWeaveBack(Lines=flatten(explode.Segments), MaximumValence=4)
explode_2 = Explode(Curve=x_y_anchors_of_edges, Recursive=True)  # -> Segments, Vertices
explode_3 = Explode(Curve=edges_of_anchor_points, Recursive=True)  # -> Segments, Vertices

# ---- group: Height Refrence Point
hight_refrence_point_1 = Point(<point referenced from the Rhino model>)

# ----
pipe = Pipe(Curve=explode_3.Segments, Radius=inclusiveness_range, Caps=1)

demesh = DeconstructMesh(Mesh=wbweave)  # -> Vertices, Faces, Colours, Normals
edgelengths = EdgeLengths(Mesh=wbweave, LengthFactor=number_slider, Strength=number_slider_2)
load = Load(Point=demesh.Vertices, ForceVector=Vector(0, 0, 1), Weighting=number_slider_3)
show = Show(G=wbweave)

pipe_2 = Pipe(Curve=explode_2.Segments, Radius=inclusiveness_range, Caps=1)
join = BrepJoin(Breps=flatten(pipe_2))  # -> Breps, Closed
cap = CapHoles(Brep=join.Breps)
brepinc = PointInBrep(Brep=graft(pipe_2), Point=flatten(demesh.Vertices), Strict=False)
dispatch = Dispatch(List=flatten(demesh.Vertices), DispatchPattern=brepinc)  # -> ListA, ListB
pt = Point(dispatch.ListA)
cullpt = CullDuplicates(Points=pt, Tolerance=0.1, CullMode=3)  # -> Points, Indices, Valence

brepinc_2 = PointInBrep(Brep=graft(pipe), Point=flatten(demesh.Vertices), Strict=False)
dispatch_2 = Dispatch(List=flatten(demesh.Vertices), DispatchPattern=brepinc_2)  # -> ListA, ListB
pt_2 = Point(dispatch_2.ListA)

anchor_points = Point(pt_2)
pt_3 = Point(cullpt.Points)

anchorxyz = AnchorXYZ(Point=flatten(pt_3), X=anchor_xyz, Y=anchor_xyz, Z=False, Strength=1000)
anchor = Anchor(Point=anchor_points, Strength=Slider(1000000, range=0..1000000))

dispatch_3 = Dispatch(List=anchorxyz, DispatchPattern=Toggle(True))  # -> ListA, ListB

solver = Solver(
    GoalObjects=[show, edgelengths, anchor, load, dispatch_3.ListA],
    Reset=rest_button,
    Threshold=1e-15,
    Tolerance=0.01,
    On=start_stop)  # -> I, V, O

panel = Panel(dispatch_3.ListA)
mesh = Mesh(flatten(solver.O))

pt_4 = Point(hight_refrence_point_1)
Z = UnitZ(Factor=Slider(10, range=0..10))
move = Move(Geometry=pt_4, Motion=Z)  # -> Geometry, Transform
clean = CleanTree(RemoveNulls=True, RemoveInvalid=True, RemoveEmpty=False, Tree=mesh)
pt_5 = Point(move.Geometry)
mesh_2 = Mesh(clean)
ln = Line(StartPoint=pt_4, EndPoint=pt_5)
demesh_2 = DeconstructMesh(Mesh=mesh_2)  # -> Vertices, Faces, Colours, Normals
pipe_3 = Pipe(Curve=ln, Radius=Slider(0.05, range=0..0.1), Caps=1)
brepsinc = PointInBreps(Brep=pipe_3, Point=demesh_2.Vertices, Strict=False)  # -> Inside, Index
dispatch_4 = Dispatch(List=demesh_2.Vertices, DispatchPattern=brepsinc.Inside)  # -> flatten(ListA), ListB
pt_6 = Point(dispatch_4.ListA)
dist = Distance(PointA=pt_4, PointB=pt_6)

# ---- group: Height Refrence Point (continued)
height_1 = Panel(dist)
