# Grasshopper definition 11_03_2020_karamba_new.gh (Grasshopper 1.0.7)
# plug-ins: Kangaroo Components, Kangaroo2 Components, karambaGH

# ---- group: input mesh or brep
brep = Brep(<brep referenced from the Rhino model>)
mesh = MeshBrep(
    Brep=brep,
    Settings={GridMaxCount=0, GridMinCount=16, JaggedSeams=False, MaxEdgeLength=0, MinEdgeLength=0.0001, MinTolerance=0, Refine=True, RefineAngle=0, RelativeTolerance=0.65, SimplePlanes=True, Tolerance=0})
mesh_2 = Mesh(<mesh referenced from the Rhino model>)

# ----
mjoin = MeshJoin(Meshes=mesh_2)
weld = WeldMesh(Mesh=mjoin, Angle=3.141592654)
demesh = DeconstructMesh(Mesh=weld)  # -> Vertices, Faces, Colours, Normals
devec = DeconstructVector(Vector=demesh.Vertices)  # -> XComponent, YComponent, ZComponent
sort = SortList(Keys=devec.ZComponent, ValuesA=demesh.Vertices)  # -> Keys, ValuesA

# ---- group: support mesh vertices
split = SplitList(List=sort.ValuesA, Index=Slider(20, range=1..200))  # -> ListA, ListB
data = Data(split.ListA)

# ----
item = ListItem(List=sort.Keys, Index=0, Wrap=True)  # -> Item1, Item
max_height__m = Panel(item.Item1)
mesh_3 = Mesh(weld)

# ---- group: loads
safety_factor = Slider(1.2, range=0..2.5)
safety_factor_2 = Slider(1.5, range=0..2.5)
safety_factor_3 = Slider(1.5, range=0..2.5)
multiplication = Multiplication(A="1", B=safety_factor)
multiplication_2 = Multiplication(A="2", B=safety_factor_2)
multiplication_3 = Multiplication(A="0.5", B=safety_factor_3)
Z = UnitZ(Factor=multiplication)
Z_2 = UnitZ(Factor=multiplication_2)
rev = Reverse(Vector=Z)
X = UnitX(Factor=multiplication_3)
rev_2 = Reverse(Vector=Z_2)
loads = LoadsKaramba3D(Vector=rev, LCase="0", mode="Gravity")
loads_2 = LoadsKaramba3D(Vector=rev_2, Mesh=mesh_3, LCase="1", mode="MeshLoad -Const.", menu=[buttons(off, on, off), buttons(on, off)])
loads_3 = LoadsKaramba3D(Vector=X, Mesh=mesh_3, LCase="2", mode="MeshLoad -Const.", menu=[buttons(off, on, off), buttons(on, off)])
load = LoadKaramba3D(flatten(loads))

# ----
duppt = RemoveDuplicatePts(Points=flatten(data), Tolerance=0.01)
supp = SupportKaramba3D(PosInd=duppt, menu=[buttons(on, on, on, on, on, on)])

# ---- group: material
panel = Panel("""compressive strength
3 MPa
tensile strength
0,3 MPa""")
division = Division(A="23", B="2.5")
multiplication_4 = Multiplication(A=Slider(1700, range=0..10000), B=0.00984)
matprops = MaterialPropertiesKaramba3D(
    FamilyOfMaterial="Steel",
    Name="S235",
    YoungsModulus_kN_cm2="23",
    InPlaneShearModulus_kN_cm2=division,
    TransverseShearModulus_kN_cm2=division,
    SpecificWeight_kN_m3=multiplication_4,
    CoefficientOfThermalExpansion_1_C=1e-05,
    YieldStrength_kN_cm2="0.3",
    mode="Isotrop")

# ----
cross_section = CrossSectionKaramba3D(
    FamilyNameOfCrossSection="DefaultCroSec",
    ElementIdentifier="vault4",
    Material=matprops,
    Height_cm=Slider(40, range=1..200),
    mode="Shell - Const")
meshtoshell = MeshToShellKaramba3D(Mesh=mesh_3, Identifier="vault4", CrossSection=cross_section, LimitDistance_m=0.005)  # -> Element, Points, Info
assemble = AssembleModelKaramba3D(Elem=meshtoshell.Element, Support=supp, Load=load, CrossSection=cross_section, Material=matprops, LimitDistance_m=0.005)  # -> Model, Info, Mass_kg, CenterOfGravity
analyze = AnalyzeKaramba3D(Model=assemble.Model)  # -> CalculatedModel, MaximumDisplacement_cm, ResultingForceOfGravity_kN, ElasticEnergy_kNm

# ---- group: legend palette
swatch = ColourSwatch(SwatchColor=RGB(224, 122, 95))
swatch_2 = ColourSwatch(SwatchColor=RGB(238, 188, 109))
swatch_3 = ColourSwatch(SwatchColor=RGB(241, 236, 209))
swatch_4 = ColourSwatch(SwatchColor=RGB(129, 178, 154))
swatch_5 = ColourSwatch(SwatchColor=RGB(66, 107, 105))

# ---- group: solver with classic colours
modelview = ModelViewKaramba3D(Model=analyze.CalculatedModel, ResultFactors=1, ResultCase=-1)  # -> Model, DeformedMesh, DeformedAxes, DeformedModel

# ----
modelview_2 = ModelViewKaramba3D(Model=analyze.CalculatedModel, ResultFactors=1, ResultCase=-1, Colors=[swatch, swatch_2, swatch_3, swatch_4, swatch_5])  # -> Model, DeformedMesh, DeformedAxes, DeformedModel
shellview = ShellViewKaramba3D(Model=modelview.Model, IndexOfLayer=0)  # -> Model, MeshesOfRenderedShells, LegendColors, LegendTags
legend = Legend(Colour=shellview.LegendColors, Tags=shellview.LegendTags, LegendType=1)

# ---- group: max. disp. in x, y, z
panel_2 = Panel("""0
1
2""")
demesh_2 = DeconstructMesh(Mesh=mesh_3)  # -> Vertices, Faces, Colours, Normals
nodedisp = NodalDisplacementsKaramba3D(AnalyzedModel=shellview.Model, ResultCase=panel_2)  # -> AnalyzedModel, NodalTranslations_m, NodalRotations_rad
duppt_2 = RemoveDuplicatePts(Points=flatten(demesh_2.Vertices), Tolerance=0.01)
bang = ExplodeTree(Data=nodedisp.NodalTranslations_m)  # -> Branch0, Branch1, Branch2
pdecon = Deconstruct(Point=bang.Branch0)  # -> XComponent, YComponent, ZComponent
pdecon_2 = Deconstruct(Point=bang.Branch1)  # -> XComponent, YComponent, ZComponent
pdecon_3 = Deconstruct(Point=bang.Branch2)  # -> XComponent, YComponent, ZComponent
sort_2 = SortList(Keys=pdecon.YComponent, ValuesA=duppt_2)  # -> Keys, ValuesA
sort_3 = SortList(Keys=pdecon.XComponent, ValuesA=duppt_2)  # -> Keys, ValuesA
sort_4 = SortList(Keys=pdecon.ZComponent, ValuesA=duppt_2)  # -> Keys, ValuesA
sort_5 = SortList(Keys=pdecon_2.YComponent, ValuesA=duppt_2)  # -> Keys, ValuesA
sort_6 = SortList(Keys=pdecon_2.XComponent, ValuesA=duppt_2)  # -> Keys, ValuesA
sort_7 = SortList(Keys=pdecon_2.ZComponent, ValuesA=duppt_2)  # -> Keys, ValuesA
sort_8 = SortList(Keys=pdecon_3.YComponent, ValuesA=duppt_2)  # -> Keys, ValuesA
sort_9 = SortList(Keys=pdecon_3.XComponent, ValuesA=duppt_2)  # -> Keys, ValuesA
sort_10 = SortList(Keys=pdecon_3.ZComponent, ValuesA=duppt_2)  # -> Keys, ValuesA
item_2 = ListItem(List=sort_4.Keys, Index=0, Wrap=True)  # -> Item1, Item
item_3 = ListItem(List=sort_3.Keys, Index=0, Wrap=True)  # -> Item1, Item
item_4 = ListItem(List=sort_6.Keys, Index=0, Wrap=True)
item_5 = ListItem(List=sort_2.Keys, Index=0, Wrap=True)  # -> Item1, Item
item_6 = ListItem(List=sort_5.Keys, Index=0, Wrap=True)
item_7 = ListItem(List=sort_7.Keys, Index=0, Wrap=True)
item_8 = ListItem(List=sort_9.Keys, Index=0, Wrap=True)
item_9 = ListItem(List=sort_8.Keys, Index=0, Wrap=True)
item_10 = ListItem(List=sort_10.Keys, Index=0, Wrap=True)
multiplication_5 = Multiplication(A=[item_3.Item, item_5.Item, item_2.Item], B=100)
multiplication_6 = Multiplication(A=[item_4, item_6, item_7], B=100)
multiplication_7 = Multiplication(A=[item_8, item_9, item_10], B=100)
lc1_max_displ_x_y_z_cm = Panel(multiplication_6)
lc2_max_displ_x_y_z_cm = Panel(multiplication_7)
lc0_max_displ_x_y_z_cm = Panel(multiplication_5)

# ---- group: mesh as surfaces
item_11 = ListItem(List=shellview.MeshesOfRenderedShells, Index=0, Wrap=True)
demesh_3 = DeconstructMesh(Mesh=item_11)  # -> Vertices, Faces, Colours, Normals
deface = DeconstructFace(Face=demesh_3.Faces)  # -> CornerA, CornerB, CornerC, CornerD
item_12 = ListItem(List=demesh_3.Vertices, Index=deface.CornerA, Wrap=True)
item_13 = ListItem(List=demesh_3.Vertices, Index=deface.CornerD, Wrap=True)
item_14 = ListItem(List=demesh_3.Vertices, Index=deface.CornerB, Wrap=True)
item_15 = ListItem(List=demesh_3.Vertices, Index=deface.CornerC, Wrap=True)
srf4pt = _4PointSurface(CornerA=item_12, CornerB=item_14, CornerC=item_15, CornerD=item_13)
area = Area(Geometry=srf4pt)  # -> Area, Centroid

# ---- group: most stressed points
s_forces = ShellForcesKaramba3D(AnalyzedModel=shellview.Model, LCase=Slider(0, range=0..5), mode="Principal")  # -> AnalyzedModel, FirstPrincipalNormalForce_kN_m, SecondPrincipalNormalForce_kN_m, FirstPrincipalMoment_kNm_m, SecondPrincipalMoment_kNm_m, ShearForceInLocalXDirection_kN_m, ShearForceInLocalYDirection_kN_m
number_slider = Slider(200, range=0..200)
sort_11 = SortList(Keys=s_forces.FirstPrincipalNormalForce_kN_m, ValuesA=area.Centroid)  # -> reverse(Keys), reverse(ValuesA)
split_2 = SplitList(List=sort_11.Keys, Index=number_slider)  # -> ListA, ListB
split_3 = SplitList(List=sort_11.ValuesA, Index=number_slider)  # -> ListA, ListB
data_2 = Data(split_3.ListA)
panel_3 = Panel(split_2.ListA)

# ---- group: max. disp. allowed
division_2 = Division(A=Slider(6.1, range=1..10), B=2)
l_200 = Panel(division_2)
