# Grasshopper definition Brick Making Script.gh (Grasshopper 1.0.7)
# plug-ins: LunchBox

# ----
# ARCH CREATOR
mortar_between_bricks = Slider(0.012, range=0..0.1)
mortar_along_arch = Slider(0.01, range=0..0.1)
size_1 = Slider(0.072, range=0..1)
size_2 = Slider(0.05, range=0..1)
size_3 = Slider(0.15, range=0..1)
surface_to_creat_arch_onto = Surface(<surface referenced from the Rhino model>)
multiplication = Multiplication(A=size_2, B=2)
division = Division(A=mortar_between_bricks, B=2)
addition = Addition(A=size_1, B=division)
addition_2 = Addition(A=multiplication, B=mortar_along_arch)

flip = Flip(Surface=surface_to_creat_arch_onto)  # -> Surface, Result

# ---- group: Pattern Parameters
# SELF STANDING SAIL VAULT CURVE LENGTH BASED DISTRIBUTION
height_of_course = Slider(0.12, range=0..1)

# ----
rebuild_surface = Slider(1, range=0..1)
rotation = Slider(90, range=0..100)
rebuild_accuracy = Slider(50, range=0..100)
input_surface = Surface(<surface referenced from the Rhino model>)
space_between_bricks_2 = Slider(0.32, range=0..1)
space_between_bricks = Slider(0.16, range=0..1)
type_of_distribution = Slider(1, range=0..1)
offset = OffsetSurface(Surface=input_surface, Distance=Slider(0, range=0..1), Retrim=True)
rebuildsrf = RebuildSurface(Surface=offset, UDegree=3, VDegree=3, UNumber=rebuild_accuracy, VNumber=rebuild_accuracy)
filter = StreamFilter(Gate=rebuild_surface, Stream0=offset, Stream1=rebuildsrf)
srf = Surface(filter)

# ---- group: Brick Parameters
thickness_of_brick = Slider(0.15, range=0..1)
height_of_brick = Slider(0.11, range=0..1)
length_of_brick = Slider(0.3, range=0..1)

# ----
brep_to_boolean = Brep([<brep referenced from the Rhino model> x2])
boolean = BooleanToggle(False)

# ---- group: Sorting of Curves
debrep = DeconstructBrep(Brep=surface_to_creat_arch_onto)  # -> Faces, Edges, Vertices
sort = SortList(Keys=debrep.Edges, ValuesA=debrep.Edges)  # -> Keys, ValuesA

# ----
bbox = BoundingBox(Content=srf, Plane=PlaneXY(0, 0, 0))  # -> Box, Box_2
volume = Volume(Geometry=bbox.Box)  # -> Volume, Centroid

# ---- group: Centerline of Arch
item = ListItem(List=sort.ValuesA, Index=0, Wrap=True)  # -> Item, Item1, Item2, Item3
end = EndPoints(Curve=item.Item)  # -> Start, End
len = Length(Curve=item.Item)
vec2pt = Vector2Pt(PointA=end.End, PointB=end.Start, Unitize=True)  # -> Vector, Length
division_2 = Division(A=len, B=2)
multiplication_2 = Multiplication(A=vec2pt.Vector, B=division_2)
neg = Negative(Value=multiplication_2)
move = Move(Geometry=item.Item3, Motion=neg)  # -> Geometry, Transform

# ----
scale = Scale(Geometry=bbox.Box, Center=volume.Centroid, Factor=1.1)  # -> Geometry, Transform
debrep_2 = DeconstructBrep(Brep=scale.Geometry)  # -> Faces, Edges, Vertices
item_2 = ListItem(List=debrep_2.Faces, Index=0, Wrap=True)  # -> Item, Item1, Item2, Item3, Item4
item_3 = ListItem(List=debrep_2.Vertices, Index=0, Wrap=True)  # -> Item, Item1, Item2, Item3, Item4
ln = Line(StartPoint=item_3.Item, EndPoint=item_3.Item2)
Z = UnitZ(Factor=Slider(10, range=0..10))

# ---- group: Extracting division Points
divlength = DivideLength(Curve=move.Geometry, Length=addition_2)  # -> Points, Tangents, Parameters
lng = ListLength(List=divlength.Points)
divide = DivideCurve(Curve=move.Geometry, Count=lng, Kinks=False)  # -> Points, Tangents, Parameters

# ----
extr = Extrude(Base=ln, Direction=Z)
bbx = BrepBrep(BrepA=srf, BrepB=extr)  # -> Curves, Points
srf_cp = SurfaceClosestPoint(Point=divide.Points, Surface=surface_to_creat_arch_onto)  # -> Point, UVPoint, Distance
dispatch = Dispatch(List=divide.Points, DispatchPattern=[True, False])  # -> ListA, ListB

# ---- group: Distribute points across arch
multiplication_3 = Multiplication(A=vec2pt.Vector, B=addition)
neg_2 = Negative(Value=multiplication_3)
move_2 = Move(Geometry=dispatch.ListA, Motion=graft([neg_2, multiplication_3]))  # -> Geometry, Transform

# ----
join = JoinCurves(Curves=bbx.Curves, Preserve=False)
evalsrf = EvaluateSurface(Surface=surface_to_creat_arch_onto, Point=srf_cp.UVPoint)  # -> Point, Normal, UDirection, VDirection, Frame
box = CenterBox(Base=move_2.Geometry, X=size_1, Y=size_2, Z=size_3)
dispatch_2 = Dispatch(List=evalsrf.Normal, DispatchPattern=[True, False])  # -> ListA, ListB
dispatch_3 = Dispatch(List=evalsrf.Frame, DispatchPattern=[True, False])  # -> ListA, ListB

multiplication_4 = Multiplication(A=vec2pt.Vector, B=addition)
neg_3 = Negative(Value=multiplication_4)
move_3 = Move(Geometry=dispatch_3.ListA, Motion=graft([neg_3, multiplication_4]))  # -> Geometry, Transform
orient = Orient(Geometry=box, Source=move_2.Geometry, Target=move_3.Geometry)  # -> Geometry, Transform

box_2 = CenterBox(Base=dispatch.ListB, X=size_3, Y=size_2, Z=size_1)
multiplication_5 = Multiplication(A=dispatch_2.ListB, B=size_1)
multiplication_6 = Multiplication(A=addition, B=2)
orient_2 = Orient(Geometry=box_2, Source=dispatch.ListB, Target=dispatch_3.ListB)  # -> Geometry, Transform
multiplication_7 = Multiplication(A=dispatch_2.ListB, B=multiplication_6)
move_4 = Move(Geometry=orient_2.Geometry, Motion=multiplication_5)  # -> Geometry, Transform
move_5 = Move(Geometry=move_4.Geometry, Motion=multiplication_7)  # -> Geometry, Transform

multiplication_8 = Multiplication(A=dispatch_2.ListA, B=size_3)
move_6 = Move(Geometry=orient.Geometry, Motion=multiplication_8)  # -> Geometry, Transform

geo = Geometry([move_4.Geometry, move_6.Geometry, move_5.Geometry])
dispatch_4 = Dispatch(List=offset, DispatchPattern=boolean)  # -> ListA, ListB
bbox_2 = BoundingBox(Content=dispatch_4.ListA, Plane=PlaneXY(0, 0, 0))  # -> Box, Box_2
volume_2 = Volume(Geometry=bbox_2.Box)  # -> Volume, Centroid
scale_2 = Scale(Geometry=bbox_2.Box, Center=volume_2.Centroid, Factor=Slider(1.1, range=0..10))  # -> Geometry, Transform
item_4 = ListItem(List=brep_to_boolean, Index=0, Wrap=True)  # -> Item, Item1

srf_2 = Surface(item_2.Item4)
number_slider = Slider(1.1, range=0..10)
base_plane = Surface(srf_2)
diagonal_rib = Curve(join)
slider = Slider(7.2, range=0..10)
slider_2 = Slider(6.7, range=0..10)
dom = Domain(DomainStart=expr("-x/2", slider), DomainEnd=expr("x/2", slider))
dom_2 = Domain(DomainStart=expr("-x/2", slider_2), DomainEnd=expr("x/2", slider_2))

area = Area(Geometry=base_plane)  # -> Area, Centroid
scale_3 = Scale(Geometry=srf, Center=area.Centroid, Factor=number_slider)  # -> Geometry, Transform
scale_4 = Scale(Geometry=base_plane, Center=area.Centroid, Factor=number_slider)  # -> Geometry, Transform
flip_2 = FlipCurve(Curve=diagonal_rib)  # -> Curve, Flag

area_2 = Area(Geometry=scale_4.Geometry)  # -> Area, Centroid
divlength_2 = DivideLength(Curve=flip_2.Curve, Length=height_of_course)  # -> Points, Tangents, Parameters
pdecon = Deconstruct(Point=divlength_2.Points)  # -> XComponent, YComponent, ZComponent
lng_2 = ListLength(List=pdecon.ZComponent)
division_3 = Division(A=lng_2, B=2)
rectangle = Rectangle(Plane=area_2.Centroid, XSize=dom_2, YSize=dom, Radius=0)  # -> Rectangle, Length

pdecon_2 = Deconstruct(Point=area_2.Centroid)  # -> XComponent, YComponent, ZComponent
subtraction = Subtraction(A=pdecon.ZComponent, B=pdecon_2.ZComponent)

split = SplitList(List=subtraction, Index=division_3)  # -> ListA, ListB
Z_2 = UnitZ(Factor=split.ListB)
move_7 = Move(Geometry=scale_4.Geometry, Motion=Z_2)  # -> Geometry, Transform
boundary = BoundarySurfaces(Edges=move_7.Geometry)
bbx_2 = BrepBrep(BrepA=boundary, BrepB=srf)  # -> Curves, Points
clean = CleanTree(RemoveNulls=True, RemoveInvalid=True, RemoveEmpty=True, Tree=bbx_2.Curves)

bottom_centroid = Point(area_2.Centroid)
srf_3 = Surface(srf)
contours = Curve(clean)
division_4 = Division(A=thickness_of_brick, B=2)
division_5 = Division(A=length_of_brick, B=2)
division_6 = Division(A=height_of_brick, B=2)

vb = VBScript(C=flatten(contours))  # -> out, Line, Arc, Polyline, Open, Closed; inputs C: Curve
# ---------- vb: VB ----------
    If C.IsLinear Then
      Line = C
    Else If C.IsArc Then
      Arc = C
    Else If C.IsPolyline Then
      Polyline = C
    Else If C.IsClosed Then
      Closed = C
    Else
      Open = C
    End If
# ---------- end vb ----------
gate = StreamGate(Stream=vb.Open, Gate=type_of_distribution)  # -> Target0, Target1
open_curves = Curve(gate.Target0)
len_2 = Length(Curve=open_curves)
relay = Relay([vb.Closed, gate.Target1])
_1_brick_lines = GhPythonScript(x=len_2)  # -> out, a
# ---------- _1_brick_lines: Python ----------
__author__ = "abhis"
__version__ = "2020.10.20"

import rhinoscriptsyntax as rs
if x<=0.3:
    a = 1
# ---------- end _1_brick_lines ----------
dispatch_5 = Dispatch(List=open_curves, DispatchPattern=_1_brick_lines.a)  # -> ListA, ListB

# ---- group: Sorting Curves
_2_brick_curves = Curve(dispatch_5.ListB)
closed_curves = Curve(relay)
_1_brick_curves = Curve(dispatch_5.ListA)

# ---- group: Reducing Duplicates
join_2 = JoinCurves(Curves=closed_curves, Preserve=False)
join_3 = JoinCurves(Curves=_2_brick_curves, Preserve=False)
join_4 = JoinCurves(Curves=_1_brick_curves, Preserve=True)

# ----
midpt = CurveMiddle(Curve=join_3)
midpt_2 = CurveMiddle(Curve=join_4)
pdecon_3 = Deconstruct(Point=midpt)  # -> XComponent, YComponent, ZComponent
divide_2 = DivideCurve(Curve=join_4, Count=2, Kinks=False)  # -> Points, Tangents, Parameters
pdecon_4 = Deconstruct(Point=bottom_centroid)  # -> XComponent, YComponent, ZComponent
subtraction_2 = Subtraction(A=pdecon_3.ZComponent, B=pdecon_4.ZComponent)

# ---- group: Sorting based on distance
dist = Distance(PointA=midpt, PointB=bottom_centroid)
sort_2 = SortList(Keys=subtraction_2, ValuesA=join_3)  # -> Keys, ValuesA

# ----
item_5 = ListItem(List=divide_2.Points, Index="1", Wrap=True)
item_6 = ListItem(List=divide_2.Tangents, Index="1", Wrap=True)
_2_brick_curves_2 = Curve(sort_2.ValuesA)
dispatch_6 = Dispatch(List=_2_brick_curves_2, DispatchPattern=[False, False, False, False, True, True, True, True])  # -> ListA, ListB
crv = Curve(dispatch_6.ListB)
crv_2 = Curve(dispatch_6.ListA)

# ---- group: Sorting curves alternating pattern
dispatch_7 = Dispatch(List=_2_brick_curves_2, DispatchPattern=[True, False])  # -> ListA, ListB
dispatch_8 = Dispatch(List=[dispatch_7.ListB, dispatch_7.ListA], DispatchPattern=[True, False])  # -> ListA, ListB
dispatch_9 = Dispatch(List=[dispatch_8.ListA, dispatch_8.ListB], DispatchPattern=[True, False])  # -> ListA, ListB
dispatch_10 = Dispatch(List=join_2, DispatchPattern=[True, False])  # -> ListA, ListB
pattern_2_curves = Curve(dispatch_10.ListB)
pattern_1_curves = Curve(crv_2)
pattern_1_curves_2 = Curve(dispatch_10.ListA)
pattern_2_curves_2 = Curve(crv)

# ---- group: Splitting Curves into two for middle division
divide_3 = DivideCurve(Curve=pattern_2_curves_2, Count=2, Kinks=False)  # -> Points, Tangents, Parameters
divide_4 = DivideCurve(Curve=pattern_1_curves, Count=2, Kinks=False)  # -> Points, Tangents, Parameters
shatter = Shatter(Curve=graft(pattern_2_curves_2), Parameters=divide_3.Parameters)
shatter_2 = Shatter(Curve=graft(pattern_1_curves), Parameters=divide_4.Parameters)

# ---- group: Pattern 2 curves division
item_7 = ListItem(List=shatter, Index=0, Wrap=True)  # -> Item, Item1
crv_3 = Curve(item_7.Item1)
crv_4 = Curve(item_7.Item)
flip_3 = FlipCurve(Curve=crv_4)  # -> flatten(Curve), Flag
divlength_3 = DivideLength(Curve=crv_3, Length=space_between_bricks_2)  # -> Points, Tangents, Parameters
divlength_4 = DivideLength(Curve=flatten(flip_3.Curve), Length=space_between_bricks_2)  # -> Points, Tangents, Parameters

# ----
panel = Panel(pattern_2_curves)
lng_3 = ListLength(List=divlength_3.Points)
lng_4 = ListLength(List=divlength_4.Points)
divide_5 = DivideCurve(Curve=flatten(crv_3), Count=flatten(lng_3), Kinks=False)  # -> Points, Tangents, Parameters
divide_6 = DivideCurve(Curve=flip_3.Curve, Count=flatten(lng_4), Kinks=False)  # -> Points, Tangents, Parameters

# ---- group: Removing Middle points
cull_i = CullIndex(List=divide_5.Points, Indices=0, Wrap=True)
cull_i_2 = CullIndex(List=divide_5.Tangents, Indices=0, Wrap=True)

# ---- group: Pattern 1 curve division
item_8 = ListItem(List=shatter_2, Index=0, Wrap=True)  # -> Item, Item1
crv_5 = Curve(item_8.Item)
crv_6 = Curve(item_8.Item1)
flip_4 = FlipCurve(Curve=crv_5)  # -> Curve, Flag
divlength_5 = DivideLength(Curve=[flip_4.Curve, crv_6], Length=space_between_bricks)  # -> Points, Tangents, Parameters

# ----
lng_5 = ListLength(List=divlength_5.Points)
divide_7 = DivideCurve(Curve=flatten([flip_4.Curve, crv_6]), Count=flatten(lng_5), Kinks=False)  # -> Points, Tangents, Parameters

# ---- group: Pattern 1 curve division (continued)
dispatch_11 = Dispatch(List=divide_7.Tangents, DispatchPattern=[True, False])  # -> ListA, ListB
dispatch_12 = Dispatch(List=divide_7.Points, DispatchPattern=[True, False])  # -> ListA, ListB

# ---- group: Points and tangents from closed curves
divlength_6 = DivideLength(Curve=pattern_1_curves_2, Length=space_between_bricks)  # -> Points, Tangents, Parameters
divlength_7 = DivideLength(Curve=pattern_2_curves, Length=space_between_bricks_2)  # -> Points, Tangents, Parameters

# ----
lng_6 = ListLength(List=divlength_6.Points)
viewer = ParamViewer(divlength_7.Points)
lng_7 = ListLength(List=divlength_7.Points)  # -> flatten(Length)
divide_8 = DivideCurve(Curve=pattern_1_curves_2, Count=flatten(lng_6), Kinks=False)  # -> Points, Tangents, Parameters

# ---- group: Points and tangents from closed curves (continued)
dispatch_13 = Dispatch(List=divide_8.Points, DispatchPattern=[True, False])  # -> ListA, ListB
dispatch_14 = Dispatch(List=divide_8.Tangents, DispatchPattern=[True, False])  # -> ListA, ListB

# ----
divide_9 = DivideCurve(Curve=pattern_2_curves, Count=flatten(lng_7), Kinks=False)  # -> Points, Tangents, Parameters
panel_2 = Panel(lng_7)

# ---- group: Final set of alternating points
oc_pattern_2 = Point([divide_6.Points, cull_i])
cc_pattern_2 = Point(divide_9.Points)
cc_pattern_1 = Point(dispatch_13.ListB)
oc_pattern_1 = Point(dispatch_12.ListB)
point_pool_short_curves = Point(item_5)
point_pool_long_curves = Point([oc_pattern_1, oc_pattern_2, cc_pattern_2, cc_pattern_1])

# ---- group: Final set of alternating points / Tangents of alternative pints
data = Data([cull_i_2, divide_6.Tangents, divide_9.Tangents, dispatch_14.ListB])

# ---- group: Surface Normals(short curves)
srf_cp_2 = SurfaceClosestPoint(Point=flatten(point_pool_short_curves), Surface=srf_3)  # -> Point, UVPoint, Distance
evalsrf_2 = EvaluateSurface(Surface=srf_3, Point=srf_cp_2.UVPoint)  # -> Point, graft(Normal), UDirection, VDirection, graft(Frame)

# ---- group: Surface Normals(Long Curves)
srf_cp_3 = SurfaceClosestPoint(Point=point_pool_long_curves, Surface=srf_3)  # -> Point, UVPoint, Distance
evalsrf_3 = EvaluateSurface(Surface=srf_3, Point=srf_cp_3.UVPoint)  # -> Point, Normal, UDirection, VDirection, Frame

# ---- group: Brick size and orientation(long Curves) / Orienting Normals(long curves)
align = AlignPlane(Plane=evalsrf_3.Frame, Direction=[data, dispatch_11.ListB])  # -> Plane, Angle
rad = Radians(Degrees=rotation)
rotate = Rotate(Geometry=align.Plane, Angle=rad, Plane=align.Plane)  # -> Geometry, Transform

# ---- group: Brick Size and Orientation (Short curves)
align_2 = AlignPlane(Plane=evalsrf_2.Frame, Direction=item_6)  # -> Plane, Angle
box_3 = CenterBox(Base=point_pool_short_curves, X=division_6, Y=division_5, Z=division_4)
orient_3 = Orient(Geometry=box_3, Source=point_pool_short_curves, Target=align_2.Plane)  # -> Geometry, Transform
deg = Degrees(Radians=Slider(2, range=0..100))
rotate_2 = Rotate(Geometry=orient_3.Geometry, Angle=deg, Plane=evalsrf_2.Frame)  # -> Geometry, Transform

# ---- group: Brick size and orientation(long Curves)
box_4 = CenterBox(Base=point_pool_long_curves, X=division_6, Y=division_5, Z=division_4)
orient_4 = Orient(Geometry=box_4, Source=point_pool_long_curves, Target=rotate.Geometry)  # -> Geometry, Transform

# ----
geo_2 = Geometry([orient_4.Geometry, rotate_2.Geometry])
volume_3 = Volume(Geometry=geo_2)  # -> Volume, Centroid
dispatch_15 = Dispatch(List=geo_2, DispatchPattern=invert(boolean))  # -> ListA, ListB
brepinc = PointInBrep(Brep=scale_2.Geometry, Point=volume_3.Centroid, Strict=False)
dispatch_16 = Dispatch(List=geo_2, DispatchPattern=brepinc)  # -> ListA, ListB
brep = Brep(flatten(dispatch_16.ListA))
sdiff = SolidDifference(BrepsA=brep, BrepsB=[item_4.Item, brep_to_boolean])
dispatch_17 = Dispatch(List=sdiff, DispatchPattern=boolean)  # -> ListA, ListB
geo_3 = Geometry([dispatch_15.ListA, dispatch_17.ListA])
