# Grasshopper definition FInal_Adobe2.0.gh (Grasshopper 1.0.7)
# plug-ins: LunchBox

# ---- group: Brickhieght input
brick_height = Slider(0.05, range=0..0.1)

# ---- group: dome input
number_of_segments = Slider(16, range=0..18)
diameter = Slider(9, range=1..10)

# ---- group: squinch height input
squinch_height = Slider(1, range=0..1.5)

# ----
# Brick dimensions
# Fixed ratio 1:2:4
multiplication = Multiplication(A=brick_height, B=4)
multiplication_2 = Multiplication(A=brick_height, B=2)
brick_width = Panel(multiplication_2)
brick_depth = Panel(multiplication)

# ---- group: Creates Fibonachi curves
# Creates Fibonaci curves
multiplication_3 = Multiplication(A="0.9", B=10)
division = Division(A=diameter, B=multiplication_3)
phi = GoldenRatio(Factor=1)
domain_range = Domain_range(factor="0.9", A="1", B="25")  # -> output, range_2
division_2 = Division(A=division, B=phi)
fibonacci_values_diameter = Fibonacci_values_Diameter(list=domain_range.range_2, shift="1", B=division)
fibonacci_values_rise = Fibonacci_values_Rise(list=domain_range.range_2, shift="1", B=division_2)
fibonacci_points = Fibonacci_Points(xy_angle=domain_range.range_2, offset=fibonacci_values_diameter)  # -> pt_2, point
central_axis = Central_axis(A=fibonacci_points.pt_2, G=fibonacci_points.pt_2, F=fibonacci_values_rise)
fibonacci_curve = Fibonacci_Curve(G=fibonacci_points.point, F=fibonacci_values_rise)  # -> L, C
arraycurve_seg = Arraycurve_seg(G=fibonacci_curve.C, N=number_of_segments)  # -> i, item_1
points_proj_onaxis = Points_proj_onAxis(P=fibonacci_curve.L, C=central_axis)

# ----
# Polygons_forloft
polygonsections = Polygonsections(P=points_proj_onaxis, C=arraycurve_seg.i, P_2=points_proj_onaxis, S=number_of_segments, C_2=arraycurve_seg.item_1)

# ----
# Finaldome_surface
loft = Loft(Curves=polygonsections, Options={Adjust=False, Closed=False, LoftEnds=0, LoftSimp=0, LoftType=0, Rebuild=10, Refit=0.01})  # -> flatten(Loft)

# ---- group: Imported data
dome_segments = Data(number_of_segments)
dome_surface = Data(loft)
dome_diameter = Data(diameter)
brick_height_2 = Data(brick_height)

# ----
# finds dome base
contour = Contour(Shape=dome_surface, Point=Point(0, 0, 0), Direction=Vector(0, 0, 1), Distance=brick_height_2)  # -> flatten(Contours)
dome_base = ListItem(List=contour, Index="0", Wrap=True)
area = Area(Geometry=dome_base)  # -> Area, Centroid
offset = OffsetCurve(Curve=dome_base, Distance=brick_depth, Plane=PlaneXY(0, 0, 0), Corners=1)

# ----
# Creates base rectangle
division_3 = Division(A=dome_diameter, B=-2)
X = UnitX(Factor=division_3)
Y = UnitY(Factor=division_3)
move = Move(Geometry=area.Centroid, Motion=Y)  # -> Geometry, Transform
move_2 = Move(Geometry=move.Geometry, Motion=X)  # -> Geometry, Transform
Z = UnitZ(Factor=expr("x*-1", squinch_height))
base_rectangle = Rectangle(Plane=move_2.Geometry, XSize=dome_diameter, YSize=dome_diameter, Radius=0)  # -> Rectangle, Length
move_3 = Move(Geometry=base_rectangle.Rectangle, Motion=Z)  # -> Geometry, Transform

# ----
# Divides base rectangles in same segemnts as dome polygon
edges = BrepEdges(Brep=move_3.Geometry)  # -> Naked, Interior, NonManifold
lng = ListLength(List=edges.Naked)
division_4 = Division(A=dome_segments, B=lng)
divide = DivideCurve(Curve=edges.Naked, Count=division_4, Kinks=False)  # -> Points, Tangents, Parameters
cullpt = CullDuplicates(Points=flatten(divide.Points), Tolerance=0.1, CullMode=3)  # -> Points, Indices, Valence

# ---- group: creates lines between dome base and rectangle base
dome_base_2 = Geometry(offset)
base_rectangle_2 = Geometry(base_rectangle.Rectangle)
shift = ShiftList(List=flatten(cullpt.Points), Shift=1, Wrap=True)
explode = Explode(Curve=dome_base_2, Recursive=True)  # -> Segments, Vertices
area_2 = Area(Geometry=dome_base_2)  # -> Area, Centroid
area_3 = Area(Geometry=base_rectangle_2)  # -> Area, Centroid
cir = Circle(Plane=area_3.Centroid, Radius=1)
ln = Line(StartPoint=shift, EndPoint=cullpt.Points)
crv = Curve(explode.Segments)
cir_2 = Circle(Plane=area_2.Centroid, Radius=1)
end = EndPoints(Curve=ln)  # -> Start, End
end_2 = EndPoints(Curve=crv)  # -> Start, End
alongcrv = SortAlongCurve(Points=end.Start, Curve=cir)  # -> Points, Indices
alongcrv_2 = SortAlongCurve(Points=end_2.End, Curve=cir_2)  # -> Points, Indices
shift_2 = ShiftList(List=alongcrv.Points, Shift=1, Wrap=True)
ln_2 = Line(StartPoint=shift_2, EndPoint=alongcrv_2.Points)

# ----
# Joining_surfaces
lofted_dome_surface = Loft(Curves=contour, Options={Adjust=False, Closed=False, LoftEnds=0, LoftSimp=0, LoftType=0, Rebuild=10, Refit=0.01})  # -> flatten(Loft)
brep = Brep(lofted_dome_surface)

# ----
# Squinch_surface
squinch_surface = Loft(Curves=ln_2, Options={Adjust=False, Closed=True, LoftEnds=0, LoftSimp=0, LoftType=3, Rebuild=10, Refit=0.01})
brep_2 = Brep(squinch_surface)

# ----
# Total_surface
join = BrepJoin(Breps=[brep, brep_2])  # -> Breps, Closed

# ---- group: Imported data
dome_contours = Data(contour)
brick__height = Data(brick_height)
brick_depth_2 = Data(multiplication)
brick_width_2 = Data(multiplication_2)

base_rectangle_number_of_segments = Data(lng)
dome_base_curve = Curve(offset)
dome_segments_2 = Data(number_of_segments)
squinch_surface_2 = Data(squinch_surface)
brick__height_2 = Data(brick_height)
brick_height_3 = Data(brick_height)

# ---- group: create Segments
# Module 1 Brick for laying for dome's top course
# Creates scaled segements
explode_2 = Explode(Curve=dome_contours, Recursive=True)  # -> Segments, Vertices
multiplication_4 = Multiplication(A=brick_width_2, B="2")
len = Length(Curve=explode_2.Segments)
subtraction = Subtraction(A=len, B=multiplication_4)
pcen = PolygonCenter(Polyline=explode_2.Segments)  # -> CenterV, CenterE, CenterA
division_5 = Division(A=subtraction, B=len)
scale = Scale(Geometry=explode_2.Segments, Center=pcen.CenterV, Factor=division_5)  # -> Geometry, Transform

# ----
# Brick
division_6 = Division(A=brick__height, B=2)
box = CenterBox(Base=PlaneXY(0, 0, 0), X=brick_width_2, Y=brick_depth_2, Z=division_6)
debrep = DeconstructBrep(Brep=box)  # -> Faces, Edges, Vertices
item = ListItem(List=debrep.Vertices, Index=3, Wrap=True)
pl = ConstructPlane(Origin=item, XAxis=Vector(1, 0, 0), YAxis=Vector(0, 1, 0))

# ----
# Brick
number_slider = Slider(2, range=0..10)
division_7 = Division(A=brick__height, B=number_slider)
box_2 = CenterBox(Base=PlaneXY(0, 0, 0), X=expr("x*0.9", brick_width_2), Y=brick_depth_2, Z=division_7)
debrep_2 = DeconstructBrep(Brep=box_2)  # -> Faces, Edges, Vertices
item_2 = ListItem(List=debrep_2.Vertices, Index=Slider(8, range=0..10), Wrap=True)
pl_2 = ConstructPlane(Origin=item_2, XAxis=Vector(1, 0, 0), YAxis=Vector(0, 1, 0))

# ----
# Creates Squinch corner stones
brep_3 = Brep([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])
brep_4 = Brep([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])
brep_5 = Brep([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])
brep_6 = Brep([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])
brep_7 = Brep([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])
brep_8 = Brep([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])
brep_9 = Brep([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])
brep_10 = Brep([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])
cornerstonesurface = CornerstoneSurface(B=[brep_7, brep_8, brep_9, brep_10], B_2=[brep_3, brep_5, brep_4, brep_6])
Z_2 = UnitZ(Factor=brick__height)
extr = Extrude(Base=cornerstonesurface, Direction=expr("-x", Z_2))
panel = Panel("""0
90
180
270""")
rotate = Rotate(Geometry=extr, Angle=degrees(panel), Plane=PlaneXY(0, 0, 0))  # -> Geometry, Transform
geo = Geometry([extr, rotate.Geometry])
preview = CustomPreview(Geometry=geo, Material=ColourSwatch(SwatchColor=RGB(178, 75, 75)))

# ----
# Creates contours and remaps data tree
contour_2 = Contour(Shape=squinch_surface_2, Point=Point(0, 0, 0), Direction=Vector(0, 0, 1), Distance=brick__height_2)  # -> flatten(Contours)
flip = FlipCurve(Curve=dome_base_curve)  # -> Curve, Flag
explode_3 = Explode(Curve=flip.Curve, Recursive=True)  # -> Segments, Vertices
explode_4 = Explode(Curve=contour_2, Recursive=True)  # -> Segments, Vertices

# ----
# Bricks for dome Squinch
shift_3 = ShiftList(List=explode_3.Segments, Shift=2, Wrap=True)

entwine = Entwine(Branch0X=simplify(explode_4.Segments), Branch1X=simplify(shift_3), FlattenInputs=False)  # -> flatten(Result)
flatten = FlattenTree(Tree=entwine, Path="{0}")
partition = PartitionList(List=simplify(flatten), Size=dome_segments_2)

# ----
# Scaling factor
lng_2 = ListLength(List=partition)
division_8 = Division(A=lng_2, B=4)
dup = DuplicateData(Data=base_rectangle_number_of_segments, Number=division_8, Order=True)
ma = MassAddition(Input=dup)  # -> Result, PartialResults
subtraction_2 = Subtraction(A=lng_2, B=ma.PartialResults)
subtraction_3 = Subtraction(A=subtraction_2, B=-1)
data = Data([subtraction_3, subtraction_2])

# ----
# Creates scaled segments
panel_2 = Panel("2")
cull_i = CullIndex(List=partition, Indices=data, Wrap=True)
multiplication_5 = Multiplication(A=brick_width_2, B=panel_2)
len_2 = Length(Curve=cull_i)
pcen_2 = PolygonCenter(Polyline=cull_i)  # -> CenterV, CenterE, CenterA
subtraction_4 = Subtraction(A=len_2, B=Slider(0.08, range=0.01..0.4))
division_9 = Division(A=subtraction_4, B=len_2)
scale_2 = Scale(Geometry=cull_i, Center=pcen_2.CenterV, Factor=division_9)  # -> Geometry, Transform

item_3 = ListItem(List=partition, Index=subtraction_2, Wrap=True)
pcen_3 = PolygonCenter(Polyline=item_3)  # -> CenterV, CenterE, CenterA
number_slider_2 = Slider(0.1, range=0.01..0.1)
len_3 = Length(Curve=item_3)
subtraction_5 = Subtraction(A=len_3, B=Slider(0.3, range=0.01..0.3))
division_10 = Division(A=subtraction_5, B=len_3)
scale_3 = Scale(Geometry=item_3, Center=pcen_3.CenterV, Factor=division_10)  # -> Geometry, Transform

# ---- group: Divide Segments
# Divides Segments into points with Brickmodule 1's width
brick_width_3 = Data(brick_width_2)
item_4 = ListItem(List=scale.Geometry, Index=0, Wrap=True)
crv_2 = Curve(item_4)
len_4 = Length(Curve=crv_2)
multiplication_6 = Multiplication(A=brick_width_3, B="2")
division_11 = Division(A=len_4, B=multiplication_6)
round = Round(Number=division_11)  # -> Nearest, Floor, Ceiling

# ----
# Divides Segments into points with Brickmodule 2's width
number_slider_3 = Slider(4, range=0..10)
smaller = SmallerThan(FirstNumber=round.Floor, SecondNumber=number_slider_3)  # -> SmallerThan, OrEqualTo
brick_width_4 = Data(brick_width_2)
multiplication_7 = Multiplication(A=brick_width_4, B="1")
cull = CullPattern(List=len_4, CullPattern=smaller.SmallerThan)
division_12 = Division(A=cull, B=multiplication_7)
round_2 = Round(Number=division_12)  # -> Nearest, Floor, Ceiling
divide_2 = DivideCurve(Curve=crv_2, Count=round_2.Floor, Kinks=False)  # -> Points, Tangents, Parameters
cull_i_2 = CullIndex(List=divide_2.Points, Indices=-1, Wrap=True)

# ---- group: Divide Segments (continued)
cull_2 = CullPattern(List=round.Floor, CullPattern=invert(smaller.SmallerThan))
divide_3 = DivideCurve(Curve=crv_2, Count=cull_2, Kinks=False)  # -> Points, Tangents, Parameters
cull_i_3 = CullIndex(List=divide_3.Points, Indices=-1, Wrap=True)

# ----
# vector from center to points
pt = Point(cull_i_3)
area_4 = Area(Geometry=dome_contours)  # -> Area, graft(Centroid)
path_mapper = PathMapper(pt, source="{A;B;C;D}", target="{B}")
vec2pt = Vector2Pt(PointA=area_4.Centroid, PointB=path_mapper, Unitize=False)  # -> Vector, Length
vdis = VectorDisplay(Anchor=area_4.Centroid, Vector=vec2pt.Vector)

# ---- group: Vector in the direction of curve
# Finds Vectors in the direction of Curve
shatter = Shatter(Curve=crv_2, Parameters=divide_3.Parameters)
end_3 = EndPoints(Curve=shatter)  # -> Start, End
vec2pt_2 = Vector2Pt(PointA=end_3.Start, PointB=end_3.End, Unitize=False)  # -> Vector, Length
vdis_2 = VectorDisplay(Anchor=end_3.Start, Vector=vec2pt_2.Vector)

# ----
# Finds Vectors in the direction of Curve
shatter_2 = Shatter(Curve=crv_2, Parameters=divide_2.Parameters)
end_4 = EndPoints(Curve=shatter_2)  # -> Start, End
vec2pt_3 = Vector2Pt(PointA=end_4.Start, PointB=end_4.End, Unitize=False)  # -> Vector, Length
vdis_3 = VectorDisplay(Anchor=end_4.Start, Vector=vec2pt_3.Vector)

# ----
# vector from center to points
path_mapper_2 = PathMapper(cull_i_2, source="{A;B;C;D}", target="{B}")
area_5 = Area(Geometry=dome_contours)  # -> Area, graft(Centroid)
vec2pt_4 = Vector2Pt(PointA=area_5.Centroid, PointB=path_mapper_2, Unitize=False)  # -> Vector, Length
vdis_4 = VectorDisplay(Anchor=area_5.Centroid, Vector=vec2pt_4.Vector)

# ----
# Lay Bricks in place
pl_3 = ConstructPlane(Origin=path_mapper, XAxis=vec2pt_2.Vector, YAxis=vec2pt.Vector)
orient = Orient(Geometry=box, Source=pl, Target=pl_3)  # -> Geometry, Transform

# ----
# Creates scaled Corner segements
item_5 = ListItem(List=partition, Index=subtraction_3, Wrap=True)
len_5 = Length(Curve=item_5)
subtraction_6 = Subtraction(A=len_5, B=Slider(0.3, range=0.01..0.3))

end_5 = EndPoints(Curve=item_5)  # -> Start, End
pcen_4 = PolygonCenter(Polyline=item_5)  # -> CenterV, CenterE, CenterA
division_13 = Division(A=subtraction_6, B=len_5)

scale_4 = Scale(Geometry=item_5, Center=pcen_4.CenterV, Factor=division_13)  # -> Geometry, Transform

# ----
# Divides Segments into points
merge = Merge(Data1=simplify(scale_2.Geometry), Data2=simplify(scale_4.Geometry), Data3=simplify(scale_3.Geometry))
crv_3 = Curve(merge)
multiplication_8 = Multiplication(A=brick_width_2, B="2")
len_6 = Length(Curve=crv_3)
division_14 = Division(A=len_6, B=multiplication_8)
round_3 = Round(Number=division_14)  # -> Nearest, Floor, Ceiling
divide_4 = DivideCurve(Curve=crv_3, Count=round_3.Floor, Kinks=False)  # -> Points, Tangents, Parameters

# ----
# Finds Vectors in the direction of Curve
pt_2 = Point(divide_4.Points)
shift_4 = ShiftList(List=pt_2, Shift=1, Wrap=False)
vec2pt_5 = Vector2Pt(PointA=pt_2, PointB=shift_4, Unitize=False)  # -> Vector, Length
vdis_5 = VectorDisplay(Anchor=pt_2, Vector=vec2pt_5.Vector)

# ----
# Brick
brick_width_5 = Data(multiplication_2)
division_15 = Division(A=brick__height, B=2)

# ----
# Module 2 Brick for laying for dome's top course
division_16 = Division(A=brick_width_5, B=2)

box_3 = CenterBox(Base=PlaneXY(0, 0, 0), X=division_16, Y=brick_depth_2, Z=division_15)
debrep_3 = DeconstructBrep(Brep=box_3)  # -> Faces, Edges, Vertices
item_6 = ListItem(List=debrep_3.Vertices, Index=3, Wrap=True)
pl_4 = ConstructPlane(Origin=item_6, XAxis=Vector(1, 0, 0), YAxis=Vector(0, 1, 0))

# ----
# Lay Bricks in place
pl_5 = ConstructPlane(Origin=path_mapper_2, XAxis=vec2pt_3.Vector, YAxis=vec2pt_4.Vector)
orient_2 = Orient(Geometry=box_3, Source=pl_4, Target=pl_5)  # -> Geometry, Transform

# ----
# Array all bricks in place
merge_2 = Merge(Data1=orient.Geometry, Data2=orient_2.Geometry)
dome_segments_3 = Data(number_of_segments)
arrpolar = PolarArray(Geometry=merge_2, Plane=area_4.Centroid, Count=dome_segments_3, Angle=6.283185307)  # -> Geometry, Transform

# ----
# Dome bricks
all_bricks_on_dome = Geometry(arrpolar.Geometry)

# ----
# Creates a line betwn first and last brick vertices from adjacent segments
item_7 = ListItem(List=arrpolar.Geometry, Index=-1, Wrap=True)
# Creates dome's corner bricks
clean = CleanTree(RemoveNulls=True, RemoveInvalid=True, RemoveEmpty=False, Tree=item_7)
lng_3 = ListLength(List=merge_2)  # -> flatten(Length)
clean_2 = CleanTree(RemoveNulls=True, RemoveInvalid=True, RemoveEmpty=False, Tree=merge_2)
partition_2 = PartitionList(List=flatten(clean), Size=lng_3)
item_8 = ListItem(List=clean_2, Index=-1, Wrap=True)
item_9 = ListItem(List=partition_2, Index=0, Wrap=True)
debrep_4 = DeconstructBrep(Brep=item_8)  # -> Faces, Edges, Vertices
debrep_5 = DeconstructBrep(Brep=item_9)  # -> Faces, Edges, Vertices
item_10 = ListItem(List=debrep_4.Vertices, Index=[1, 2], Wrap=True)
item_11 = ListItem(List=debrep_5.Vertices, Index=[0, 3], Wrap=True)
ln_3 = Line(StartPoint=item_11, EndPoint=item_10)

# ----
# Counts the number of bricks per segment in one leaf
module1bricksinplace = Data([orient_2.Geometry, orient.Geometry])
module2bricksinplace = Data(orient_2.Geometry)
clean_3 = CleanTree(RemoveNulls=True, RemoveInvalid=True, RemoveEmpty=True, Tree=module2bricksinplace)
clean_4 = CleanTree(RemoveNulls=True, RemoveInvalid=True, RemoveEmpty=True, Tree=module1bricksinplace)
lng_4 = ListLength(List=clean_3)  # -> flatten(Length)
lng_5 = ListLength(List=clean_4)  # -> flatten(Length)
sort_val = SortDuplicateValues(ValueList=lng_4)  # -> UniqueValues, Indices
sort_val_2 = SortDuplicateValues(ValueList=lng_5)  # -> UniqueValues, Indices
python = GhPythonScript(
    x=lng_5,
    y=ColourSwatch(SwatchColor=RGB(235, 73, 73)),
    z=ColourSwatch(SwatchColor=RGB(46, 163, 159)),
    u=ColourSwatch(SwatchColor=RGB(29, 191, 29)),
    v=ColourSwatch(SwatchColor=RGB(213, 70, 232)))  # -> out, a, num_4, num_5, num_6, num_7; inputs x: list of Int32, y: Color, z: Color, u: Color, v: Color
# ---------- python: Python ----------
__author__ = "Anagha"
__version__ = "2020.10.27"

import rhinoscriptsyntax as rs
a = []
num_4 = 0
num_5 = 0
num_6 = 0
num_7 = 0

for i in x:
    if i == 4:
        a.append(y)
        num_4 += 1
    elif i == 5:
        a.append(z)
        num_5 += 1
    elif i == 6:
        a.append(u)
        num_6 += 1
    elif i == 7:
        a.append(v)
        num_7 += 1
# ---------- end python ----------
python_2 = GhPythonScript(
    x=lng_4,
    w=ColourSwatch(SwatchColor=RGB(235, 156, 73)),
    s=ColourSwatch(SwatchColor=RGB(46, 83, 163)),
    t=ColourSwatch(SwatchColor=RGB(222, 216, 44)),
    y=ColourSwatch(SwatchColor=RGB(235, 73, 73)),
    z=ColourSwatch(SwatchColor=RGB(46, 163, 159)),
    u=ColourSwatch(SwatchColor=RGB(29, 191, 29)),
    v=ColourSwatch(SwatchColor=RGB(213, 70, 232)))  # -> out, a, num_1, num_2, num_3, num_4, num_5, num_6, num_7; inputs x: list of Int32, y: Color, z: Color, u: Color, v: Color
# ---------- python_2: Python ----------
__author__ = "Anagha"
__version__ = "2020.10.27"

import rhinoscriptsyntax as rs
a = []
num_1 = 0
num_2 = 0
num_3 = 0
num_4 = 0
num_5 = 0
num_6 = 0
num_7 = 0

for i in x:
    if i == 1:
        a.append(w)
        num_1 += 1
    elif i == 2:
        a.append(s)
        num_2 += 1
    elif i == 3:
        a.append(t)
        num_3 += 1
    elif i == 4:
        a.append(y)
        num_4 += 1
    elif i == 5:
        a.append(z)
        num_5 += 1
    elif i == 6:
        a.append(u)
        num_6 += 1
    elif i == 7:
        a.append(v)
        num_7 += 1
# ---------- end python_2 ----------
concat = Concatenate(
    FragmentA=" There are  ",
    FragmentE=sort_val.UniqueValues,
    FragmentD=" module_2 bricks per segment in ",
    FragmentB=[python_2.num_1, python_2.num_2, python_2.num_3, python_2.num_4, python_2.num_5, python_2.num_6, python_2.num_7],
    FragmentC=" courses")
concat_2 = Concatenate(
    FragmentA=" There are  ",
    FragmentE=sort_val_2.UniqueValues,
    FragmentD=" module_1 bricks per segment in ",
    FragmentB=[python.num_4, python.num_5, python.num_6, python.num_7],
    FragmentC=" courses")

# ----
# Scales the line for equal lengths
item_12 = ListItem(List=ln_3, Index=-1, Wrap=True)
item_13 = ListItem(List=ln_3, Index=0, Wrap=True)
len_7 = Length(Curve=item_13)
pcen_5 = PolygonCenter(Polyline=item_13)  # -> CenterV, CenterE, CenterA
len_8 = Length(Curve=item_12)
pcen_6 = PolygonCenter(Polyline=item_12)  # -> CenterV, CenterE, CenterA
division_17 = Division(A=brick_width_2, B=len_7)
division_18 = Division(A=brick_width_2, B=len_8)
multiplication_9 = Multiplication(A=division_17, B=Slider(0.3, range=0.1..4))
multiplication_10 = Multiplication(A=division_18, B=Slider(1.4, range=1..4))
scale_5 = Scale(Geometry=item_13, Center=pcen_5.CenterV, Factor=multiplication_9)  # -> Geometry, Transform
scale_6 = Scale(Geometry=item_12, Center=pcen_6.CenterV, Factor=multiplication_10)  # -> Geometry, Transform

# ----
# Creates Brick surface
number_slider_4 = Slider(0.03, range=0.01..0.1)
crv_4 = Curve(scale_6.Geometry)
crv_5 = Curve(scale_5.Geometry)
offset_2 = OffsetCurve(Curve=crv_4, Distance=number_slider_4, Plane=PlaneXY(0, 0, 0), Corners=1)
end_6 = EndPoints(Curve=crv_5)  # -> Start, End
end_7 = EndPoints(Curve=crv_4)  # -> Start, End
curvepoint = PointOnCurve(offset_2, parameter=0.5)
pline = PolyLine(Vertices=[end_7.End, end_6.End, end_6.Start, end_7.Start], Closed=False)
ln_4 = Line(StartPoint=end_7.End, EndPoint=curvepoint)
ln_5 = Line(StartPoint=end_7.Start, EndPoint=curvepoint)
join_2 = JoinCurves(Curves=[ln_4, ln_5, pline], Preserve=False)
boundary = BoundarySurfaces(Edges=join_2)

# ----
# Array's the bricks
Z_3 = UnitZ(Factor=brick_height)
extr_2 = Extrude(Base=boundary, Direction=Z_3)
arrpolar_2 = PolarArray(Geometry=extr_2, Plane=area_4.Centroid, Count=number_of_segments, Angle=6.283185307)  # -> Geometry, Transform

# ----
# Corner bricks
cornerbricks = Geometry(arrpolar_2.Geometry)

information_module_1_brick_laying = Panel(concat_2)
information_module_2_brick_laying = Panel(concat)

pt_3 = Point(divide_4.Points)

# ----
# vector from center to points
area_6 = Area(Geometry=contour_2)  # -> Area, simplify(graft(Centroid))
path_mapper_3 = PathMapper(pt_3, source="{a;b}", target="{a}")
vec2pt_6 = Vector2Pt(PointA=area_6.Centroid, PointB=path_mapper_3, Unitize=False)  # -> Vector, Length
item_14 = ListItem(List=area_6.Centroid, Index=0, Wrap=True)

item_15 = ListItem(List=vec2pt_6.Vector, Index=0, Wrap=True)

vdis_6 = VectorDisplay(Anchor=item_14, Vector=item_15)

# ----
# Lay Bricks in place
pl_6 = ConstructPlane(Origin=flatten(pt_2), XAxis=flatten(vec2pt_5.Vector), YAxis=flatten(vec2pt_6.Vector))
orient_3 = Orient(Geometry=box_2, Source=pl_2, Target=pl_6)  # -> Geometry, Transform

# ----
# Squinch Bricks
all_bricks_on_squinch = Geometry(orient_3.Geometry)

# ----
# Results
swatch = ColourSwatch(SwatchColor=RGB(194, 159, 159))
domebricks = CustomPreview(Geometry=all_bricks_on_dome, Material=swatch)
domecornerstones = CustomPreview(Geometry=arrpolar_2.Geometry, Material=ColourSwatch(SwatchColor=RGB(158, 125, 125)))
squnichbricks = CustomPreview(Geometry=orient_3.Geometry, Material=ColourSwatch(SwatchColor=RGB(191, 132, 132)))
module2domebrickscount = CustomPreview(Geometry=clean_3, Material=graft(python_2.a))
module1domebrickscount = CustomPreview(Geometry=clean_4, Material=graft(python.a))

# ==== cluster Domain_range
factor = ClusterInput()
A = ClusterInput()
B = ClusterInput()
pi = Pi(Factor=factor)
addition = Addition(A=A, B=B)
range = Range(Domain=pi, Steps=addition)
output = ClusterOutput(pi)
range_2 = ClusterOutput(range)

# ==== cluster Fibonacci_values_Diameter
list = ClusterInput()
shift = ClusterInput()
shift_list = ShiftList(List=list, Shift=shift, Wrap=True)
B = ClusterInput()
panel = Panel(shift_list)
multiplication = Multiplication(A=shift_list, B=B)
golden_ratio = GoldenRatio(Factor=multiplication)
panel_2 = Panel(multiplication)
output = ClusterOutput(golden_ratio)

# ==== cluster Fibonacci_Points
pt = ConstructPoint(XCoordinate=0, YCoordinate=0, ZCoordinate=0)
xy_angle = ClusterInput()
offset = ClusterInput()
pt_2 = ClusterOutput(pt)
point_polar = PointPolar(BasePlane=pt, XYAngle=xy_angle, ZAngle=0, Offset=offset)
point = ClusterOutput(point_polar)

# ==== cluster Fibonacci_values_Rise
list = ClusterInput()
shift = ClusterInput()
shift_list = ShiftList(List=list, Shift=shift, Wrap=False)
B = ClusterInput()
multiplication = Multiplication(A=shift_list, B=B)
golden_ratio = GoldenRatio(Factor=multiplication)
output = ClusterOutput(golden_ratio)

# ==== cluster Central_axis
F = ClusterInput()
Z = UnitZ(Factor=F)
G = ClusterInput()
item = ListItem(List=Z, Index=-1, Wrap=True)
move = Move(Geometry=reverse(G), Motion=item)  # -> Geometry, Transform
A = ClusterInput()
ln = Line(StartPoint=A, EndPoint=move.Geometry)
L = ClusterOutput(ln)

# ==== cluster Fibonacci_Curve
F = ClusterInput()
G = ClusterInput()
Z = UnitZ(Factor=F)
move = Move(Geometry=reverse(G), Motion=Z)  # -> Geometry, Transform
cull_i = CullIndex(List=move.Geometry, Indices=[0, -1], Wrap=True)
L = ClusterOutput(cull_i)
intcrv_t = InterpolateT(Vertices=cull_i, TangentStart=Vector(0, 0, 0), TangentEnd=Vector(0, 0, 0), KnotStyle=1)  # -> Curve, Length, Domain
C = ClusterOutput(intcrv_t.Curve)

# ==== cluster Points_proj_onAxis
P = ClusterInput()
planesrf = PlaneSurface(Plane=P, XSize=Domain(-1000, 1000), YSize=Domain(-1000, 1000))
C = ClusterInput()
scx = SurfaceCurve(Surface=planesrf, Curve=C)  # -> Curves, Points, UVPoints, Normals, Parameters, Tangents
cullpt = CullDuplicates(Points=flatten(scx.Points), Tolerance=0.1, CullMode=3)  # -> Points, Indices, Valence
P_2 = ClusterOutput(cullpt.Points)

# ==== cluster Arraycurve_seg
G = ClusterInput()
N = ClusterInput()
arrpolar = PolarArray(Geometry=G, Plane=PlaneXY(0, 0, 0), Count=N, Angle=degrees(Slider(360, range=0..1000)))  # -> Geometry, Transform
item = ListItem(List=arrpolar.Geometry, Index=0, Wrap=True)  # -> Item, Item1
i = ClusterOutput(item.Item)
item_1 = ClusterOutput(item.Item1)

# ==== cluster Polygonsections
P = ClusterInput()
planesrf = PlaneSurface(Plane=P, XSize=Domain(-1000, 1000), YSize=Domain(-1000, 1000))
C = ClusterInput()
C_2 = ClusterInput()
scx = SurfaceCurve(Surface=planesrf, Curve=C)  # -> Curves, Points, UVPoints, Normals, Parameters, Tangents
scx_2 = SurfaceCurve(Surface=planesrf, Curve=C_2)  # -> Curves, Points, UVPoints, Normals, Parameters, Tangents
cullpt = CullDuplicates(Points=flatten(scx.Points), Tolerance=0.1, CullMode=3)  # -> Points, Indices, Valence
cullpt_2 = CullDuplicates(Points=flatten(scx_2.Points), Tolerance=0.1, CullMode=3)  # -> Points, Indices, Valence
P_2 = ClusterInput()
S = ClusterInput()
poledge = PolygonEdge(EdgeStart=flatten(cullpt.Points), EdgeEnd=flatten(cullpt_2.Points), PlanePoint=flatten(P_2), Segments=S)  # -> Polygon, Centre, CornerRadius, EdgeRadius
P_3 = ClusterOutput(poledge.Polygon)

# ==== cluster CornerstoneSurface
B = ClusterInput()
B_2 = ClusterInput()
mortar_thickness = Slider(0.058, range=0..0.5)
number_slider = Slider(3, range=0..5)
debrep = DeconstructBrep(Brep=B_2)  # -> Faces, Edges, Vertices
debrep_2 = DeconstructBrep(Brep=B)  # -> Faces, Edges, Vertices
item = ListItem(List=debrep.Edges, Index=Slider(1, range=0..5), Wrap=True)
item_2 = ListItem(List=debrep_2.Edges, Index=number_slider, Wrap=True)
item_3 = ListItem(List=item, Index=number_slider, Wrap=True)
offset = OffsetCurve(Curve=item_2, Distance=expr("-x", mortar_thickness), Plane=PlaneXY(0, 0, 0), Corners=1)
offset_2 = OffsetCurve(Curve=item_3, Distance=expr("-x", mortar_thickness), Plane=PlaneXY(0, 0, 0), Corners=1)
end = EndPoints(Curve=offset)  # -> Start, End
end_2 = EndPoints(Curve=offset_2)  # -> Start, End
pline = PolyLine(Vertices=[end.Start, end_2.End, end_2.Start, end.End], Closed=True)
boundary = BoundarySurfaces(Edges=pline)
S = ClusterOutput(boundary)
