# Grasshopper definition Location_finder.gh (Grasshopper 1.0.7)

python = GhPythonScript(
    area=Slider(1500, range=0..10000),
    dist_water=Slider(21, range=0..100),
    dist_ycenter=Slider(6, range=0..100),
    dist_bazzar=Slider(40, range=0..100))  # -> out, program_list
# ---------- python: Python ----------
__author__ = "Beza"
__version__ = "2020.09.28"

import rhinoscriptsyntax as rs

program_list = []

if area >= 1500 :
    program_list.append('tea house')
    if dist_water <= 25 :
        program_list.append('hammam')
    if dist_ycenter <= 10 :
        program_list.append('play area')
    if dist_bazzar >= 100 :
        program_list.append('quiet room')

print(program_list)
# ---------- end python ----------
# 6Input: Distance parameters
# This simple python script gives out the programs you can have in the selected site.
panel = Panel(python.program_list)

sqgrid = Square(Plane=PlaneXY(0, 0, 0), Size=Slider(1, range=0..10), ExtentX="296", ExtentY="188")  # -> Cells, Points
image = ImageSampler(
    sqgrid.Points,
    FilePath="C:\Users\Beza\Documents\desktop files\earthy\noli map.png",
    Filter="Red",
    Interpolate=False,
    Umax=296,
    Umin=0,
    Vmax=188,
    Vmin=0,
    Wrap=1)
dom = ConstructDomain(DomainStart=Slider(0, range=0..1), DomainEnd=Slider(0.5, range=0..1))
bnd = Bounds(Numbers=image)
remap = RemapNumbers(Value=image, Source=bnd, Target=dom)  # -> Mapped, Clipped
cir = Circle(Plane=sqgrid.Points, Radius=remap.Mapped)
area = Area(Geometry=cir)  # -> Area, Centroid
# 1. Input: Noli map, boudary size, grid size
# Identifies the empty plots by use of the image sampler.
rectangle = Rectangle(Plane=area.Centroid, XSize=remap.Mapped, YSize=remap.Mapped, Radius=0)  # -> Rectangle, Length

larger = LargerThan(FirstNumber=remap.Mapped, SecondNumber=Slider(0.5, range=0..1))  # -> LargerThan, flatten(OrEqualTo)
preview = CustomPreview(Geometry=rectangle.Rectangle, Material=ColourSwatch(SwatchColor=RGB(204, 204, 204)))
cull = CullPattern(List=flatten(cir), CullPattern=larger.OrEqualTo)
crv = Curve(cull)
area_2 = Area(Geometry=crv)  # -> Area, Centroid
rectangle_2 = Rectangle(Plane=area_2.Centroid, XSize="-0.5 to 0.5", YSize="-0.5 to 0.5", Radius=0)  # -> Rectangle, Length
srf = Surface(rectangle_2.Rectangle)
# 2. Input: size to filter by
# Here by inputing a number, you can filter out small open areas. for instance if a mapped area is smaller than the average mapped grid, then it is eliminated.
preview_2 = CustomPreview(Geometry=srf, Material=ColourSwatch(SwatchColor=RGB(255, 255, 255)))

water = Point([Point(236, 107, 0), Point(5, 41, 0), Point(36, 20, 0), Point(121, 64, 0), Point(127, 109, 0), Point(171, 61, 0), Point(169, 23, 0), Point(197, 44, 0), Point(193, -2, 0), Point(266, -2, 0), Point(258, 53, 0), Point(265, 122, 0), Point(293, 126, 0), Point(296, 140, 0), Point(204, 125, 0), Point(158, 142, 0)])
cir_2 = Circle(Plane=water, Radius=Slider(25, range=0..100))
cir_3 = Circle(Plane=water, Radius=Slider(2, range=0..100))
srf_2 = Surface(cir_3)
incurves = PointInCurves(Point=area_2.Centroid, Curves=cir_2)  # -> Relationship, Index, Point
preview_3 = CustomPreview(Geometry=srf_2, Material=ColourSwatch(SwatchColor=RGB(79, 220, 255)))
cull_2 = CullPattern(List=area_2.Centroid, CullPattern=incurves.Relationship)
pt = Point(cull_2)
srf_3 = Surface(cir_2)
rectangle_3 = Rectangle(Plane=pt, XSize="-0.5 to 0.5", YSize="-0.5 to 0.5", Radius=0)  # -> Rectangle, Length
preview_4 = CustomPreview(Geometry=srf_3, Material=ColourSwatch(SwatchColor=RGBA(79, 220, 255, 32)))
srf_4 = Surface(rectangle_3.Rectangle)
# 3. Input: Water resource location, maximum distance from water resource
# This part of the script selects open plots with in a given radius of the water resource.
preview_5 = CustomPreview(Geometry=srf_4, Material=ColourSwatch(SwatchColor=RGB(214, 212, 107)))

youth_cent = Point([Point(234, 73, 0), Point(187, -7, 0), Point(129, -5, 0), Point(72, 151, 0), Point(180, 164, 0), Point(173, 101, 0), Point(132, 89, 0), Point(206, 139, 0), Point(243, 171, 0), Point(63, 185, 0)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])
cir_4 = Circle(Plane=youth_cent, Radius=Slider(2, range=0..100))
cir_5 = Circle(Plane=youth_cent, Radius=Slider(10, range=0..100))
srf_5 = Surface(cir_4)
incurves_2 = PointInCurves(Point=pt, Curves=cir_5)  # -> Relationship, Index, Point
preview_6 = CustomPreview(Geometry=srf_5, Material=ColourSwatch(SwatchColor=RGB(245, 98, 98)))
cull_3 = CullPattern(List=cull_2, CullPattern=incurves_2.Relationship)
srf_6 = Surface(cir_5)
rectangle_4 = Rectangle(Plane=cull_3, XSize="-0.5 to 0.5", YSize="-0.5 to 0.5", Radius=0)  # -> Rectangle, Length
srf_7 = Surface(rectangle_4.Rectangle)
swatch = ColourSwatch(SwatchColor=RGB(209, 21, 21))
preview_7 = CustomPreview(Geometry=srf_6, Material=ColourSwatch(SwatchColor=RGBA(245, 98, 98, 56)))
srf_8 = Surface(rectangle_4.Rectangle)
preview_8 = CustomPreview(Geometry=srf_8, Material=swatch)
# 4 Input: Youth Center, schools, kindergarten location, max distance from listed facilities
# This part of the script selects open plots with in a given radius of the facilites.
preview_9 = CustomPreview(Geometry=srf_7, Material=swatch)

list = ValueList({"District one": 0, "District Two": 1, "District Three": 3, "District Four": 4, "District Five": 6, "District Six": 8, "District Seven": 10, "District Eight": 11, "District Nine": 9, "District Ten": 7, "District Eleven": 5, "District Twelve": 2}, selected="District Nine")
districts = Districts(i=list)
edges = BrepEdges(Brep=districts)  # -> Naked, Interior, NonManifold
pt_2 = Point(cull_3)
line = Line(edges.Naked)
incurve = PointInCurve(Point=pt_2, Curve=districts)  # -> Relationship, Point
item = ListItem(List=line, Index="2", Wrap=True)
curvepoint = PointOnCurve(item, parameter=0.5)
cull_4 = CullPattern(List=pt_2, CullPattern=incurve.Relationship)
dist = Distance(PointA=cull_4, PointB=curvepoint)
gradient = Gradient(
    LowerLimit="0",
    UpperLimit="84",
    Parameter=dist,
    stops=[0: RGB(11, 138, 31), 0: RGB(141, 135, 29), 0: RGB(53, 227, 144), 0: RGB(203, 22, 21), 0: RGB(143, 80, 216), 0: RGB(7, 33, 36), 0: RGB(113, 33, 21), 0: RGB(253, 185, 39), 0: RGB(207, 247, 186), 0: RGB(29, 243, 55)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])
rectangle_5 = Rectangle(Plane=cull_4, XSize="-0.5 to 0.5", YSize="-0.5 to 0.5", Radius=0)  # -> Rectangle, Length
srf_9 = Surface(rectangle_5.Rectangle)
# 5 Input: District Boundaries, chosen district , location of main road
# This part of the script finds the best location away from busy, loud main road. You can select the district; if there are no suitable open plots in that district the script will show an error.
preview_10 = CustomPreview(Geometry=srf_9, Material=gradient)

# ==== cluster Districts
d_5 = Curve(<curve referenced from the Rhino model>)
d_7 = Curve(<curve referenced from the Rhino model>)
d_4 = Curve(<curve referenced from the Rhino model>)
d_11 = Curve(<curve referenced from the Rhino model>)
d_8 = Curve(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)
d_12 = Curve(<curve referenced from the Rhino model>)
d_10 = Curve(<curve referenced from the Rhino model>)
d_6 = Curve(<curve referenced from the Rhino model>)
d_3 = Curve(<curve referenced from the Rhino model>)
d_2 = Curve(<curve referenced from the Rhino model>)
d_9 = Curve(<curve referenced from the Rhino model>)
d_1 = Curve(<curve referenced from the Rhino model>)
merge = Merge(
    Data1=d_1,
    Data2=d_2,
    Data3=d_12,
    Data4=d_3,
    Data5=d_4,
    Data6=d_11,
    Data7=d_5,
    Data8=d_10,
    Data9=d_6,
    Data10=d_9,
    Data11=d_7,
    Data12=d_8)
i = ClusterInput()
item = ListItem(List=merge, Index=i, Wrap=True)
i_2 = ClusterOutput(item)
