# Grasshopper definition Structural_analysis_group2.gh (Grasshopper 1.0.7)
# plug-ins: MeshEdit Components, MetaHopper, Kangaroo2 Components, karambaGH

wall_brep = Brep(<brep referenced from the Rhino model>)
brep_join = BrepJoin(Breps=wall_brep)  # -> Breps, Closed
mesh_breps = MeshBreps(
    Brep=brep_join.Breps,
    MeshResolution=Slider(0.3, range=0..1),
    EdgeRefinementFactor=Slider(0.5, range=0..1),
    PointReduction=True,
    SmoothingStepSize=0,
    SmoothingIterations=5)  # -> simplify(Mesh), Info
wall = Mesh(mesh_breps.Mesh)

roof_brep = Brep(<brep referenced from the Rhino model>)
join = BrepJoin(Breps=flatten(roof_brep))  # -> simplify(Breps), Closed
mesh_breps_2 = MeshBreps(
    Brep=roof_brep,
    MeshResolution=Slider(0.3, range=0..1),
    EdgeRefinementFactor=Slider(0.5, range=0..1),
    PointReduction=True,
    SmoothingStepSize=0,
    SmoothingIterations=5)  # -> simplify(Mesh), Info
roof = Mesh(mesh_breps_2.Mesh)

# ----
# ROOF AND WALL MESH INPUTS
# ROOF BREP
# SMOOTH MESH
# WALL BREP
mesh_join = MeshJoin(Meshes=roof)

clean_tree = CleanTree(RemoveNulls=True, RemoveInvalid=True, RemoveEmpty=Toggle(True), Tree=wall)
mesh = Mesh(simplify(clean_tree))
match_tree = MatchTree(Tree=mesh, Guide=mesh_join)
mesh_unifynormals = MeshUnifyNormals(Mesh=mesh_join)
mesh_unifynormals_2 = MeshUnifyNormals(Mesh=match_tree)
mesh_flip = MeshFlip(Mesh=mesh_unifynormals_2)
weld_mesh = WeldMesh(Mesh=mesh_flip, Angle=3.141592654)
mesh_join_2 = MeshJoin(Meshes=weld_mesh)
smooth_mesh = SmoothMesh(Mesh=mesh_join_2, Strength=0.5, SkipNaked=True, Iterations=1)

area = Area(Geometry=mesh_unifynormals)  # -> Area, Centroid
panel = Panel(area.Area)

unit_mm = Slider(75, range=0..100)
expression = Expression(mm=unit_mm, Expression="mm*0.001")
expression_2 = Expression(u=expression, Expression="u*2")
expression_3 = Expression(u=expression, Expression="u*4")
brick_size_mm = DomainBox(Base=PlaneXY(0, 0, 0), Width=expression_2, Length=expression_3, Height=expression)

unit_mm_2 = Slider(75, range=0..100)
expression_4 = Expression(mm=unit_mm_2, Expression="mm*0.001")
expression_5 = Expression(u=expression_4, Expression="u*2")
expression_6 = Expression(u=expression_4, Expression="u*4")
brick_size_mm_2 = DomainBox(Base=PlaneXY(0, 0, 0), Width=expression_5, Length=expression_6, Height=expression_4)

number_of_bricks_in_shell_thickness = Slider(8, range=0..20)
multiplication = Multiplication(BrickUnitM=expression_4, B=number_of_bricks_in_shell_thickness, _100=100)
thickness_cm = Panel(multiplication)

# ---- group: Range of values
specific_weight_kg_m3 = Panel("1500")
yield_strenght_kn_cm2 = Panel("0.13")
young_s_modulus_n_mm2 = Panel("150")
compressive_strenght_n_mm2 = Panel("1.3")
tensile_strenght_n_mm2 = Panel("0.13")

# ----
expression_7 = Expression(E=young_s_modulus_n_mm2, Expression="E*1000000")
expression_8 = Expression(d=specific_weight_kg_m3, Expression="d*0.01")
expression_9 = Expression(E=expression_7, Expression="E*0.0000001")
panel_2 = Panel(expression_9)
panel_3 = Panel(expression_8)
material_properties_karamba3d = MaterialPropertiesKaramba3D(
    FamilyOfMaterial="Adobe",
    Name="walls",
    ElementIdentifier="walls",
    YoungsModulus_kN_cm2=panel_2,
    InPlaneShearModulus_kN_cm2=expr("x/2.5", panel_2),
    TransverseShearModulus_kN_cm2=8076,
    SpecificWeight_kN_m3=panel_3,
    CoefficientOfThermalExpansion_1_C=1e-05,
    YieldStrength_kN_cm2=yield_strenght_kn_cm2,
    mode="Isotrop")

# ---- group: Input Data
thickness_mm = Slider(7, range=0..20)

# ---- group: WALL
cross_section_karamba3d = CrossSectionKaramba3D(
    FamilyNameOfCrossSection="DefaultCroSec",
    ElementIdentifier="walls",
    Material=material_properties_karamba3d,
    Height_cm=thickness_cm,
    mode="Shell - Const")

# ----
expression_10 = Expression(E=young_s_modulus_n_mm2, Expression="E*1000000")
expression_11 = Expression(E=expression_10, Expression="E*0.0000001")
expression_12 = Expression(d=specific_weight_kg_m3, Expression="d*0.01")
panel_4 = Panel(expression_11)
panel_5 = Panel(expression_12)
material_properties_karamba3d_2 = MaterialPropertiesKaramba3D(
    FamilyOfMaterial="Adobe",
    Name="S235",
    ElementIdentifier="Roof",
    YoungsModulus_kN_cm2=panel_4,
    InPlaneShearModulus_kN_cm2=expr("x/2.5", panel_4),
    TransverseShearModulus_kN_cm2=8076,
    SpecificWeight_kN_m3=panel_5,
    CoefficientOfThermalExpansion_1_C=1e-05,
    YieldStrength_kN_cm2=yield_strenght_kn_cm2,
    mode="Isotrop")

multiplication_2 = Multiplication(BrickUnitM=expression, B=thickness_mm, _100=100)
thickness_cm_2 = Panel(multiplication_2)

multiplication_3 = Multiplication(A=Slider(-1, range=-2..2), B="4")
unit_z = UnitZ(Factor=multiplication_3)
loads = LoadsKaramba3D(Vector=unit_z, LCase="1", mode="Gravity")

unit_z_2 = UnitZ(Factor=Slider(-1, range=-2..2))
loads_karamba3d = LoadsKaramba3D(
    Vector=unit_z_2,
    Mesh=mesh_unifynormals,
    ElementIdentifiers="Roof",
    LCase="0",
    mode="MeshLoad -Const.",
    menu=[buttons(off, on, off), buttons(on, on)])

specific_weight_filler_kn_m3 = Panel("1.5")
dome = Dome(A_2=specific_weight_filler_kn_m3, M=mesh_unifynormals, A=thickness_cm_2)
unit_z_3 = UnitZ(Factor=expr("x*-1.2", dome))
loads_karamba3d_2 = LoadsKaramba3D(
    Vectors=unit_z_3,
    Mesh=mesh_unifynormals,
    LCase="2",
    mode="MeshLoad -Variable",
    menu=[buttons(off, on, off), buttons(on, on)])

slab_load_kn_m2 = Panel("1")
dome_2 = Dome(A_2=slab_load_kn_m2, M=mesh_unifynormals, A=thickness_cm_2)
unit_z_4 = UnitZ(Factor=expr("x*-1.2", dome_2))
loads_karamba3d_3 = LoadsKaramba3D(
    Vectors=unit_z_4,
    Mesh=mesh_unifynormals,
    LCase="2",
    mode="MeshLoad -Variable",
    menu=[buttons(off, on, off), buttons(on, on)])

specific_weight_filler_kn_m3_2 = Panel("16")
dome_3 = Dome(A_2=specific_weight_filler_kn_m3_2, M=mesh_unifynormals, A=thickness_cm_2)
unit_z_5 = UnitZ(Factor=expr("x*-1.2", dome_3))
loads_karamba3d_4 = LoadsKaramba3D(
    Vectors=unit_z_5,
    Mesh=mesh_unifynormals,
    LCase="2",
    mode="MeshLoad -Variable",
    menu=[buttons(off, on, off), buttons(on, on)])

live_load_kn_m2 = Panel("4")
dome_4 = Dome(A_2=live_load_kn_m2, M=mesh_unifynormals, A=thickness_cm_2)
unit_z_6 = UnitZ(Factor=expr("x*-1.2", dome_4))
loads_karamba3d_5 = LoadsKaramba3D(
    Vectors=unit_z_6,
    Mesh=mesh_unifynormals,
    LCase="2",
    mode="MeshLoad -Variable",
    menu=[buttons(off, on, off), buttons(on, on)])

# ---- group: ROOF
cross_section_karamba3d_2 = CrossSectionKaramba3D(
    FamilyNameOfCrossSection="DefaultCroSec",
    ElementIdentifier="Roof",
    Material=material_properties_karamba3d_2,
    Height_cm=thickness_cm_2,
    mode="Shell - Const")

# ----
mesh_to_shell_karamba3d = MeshToShellKaramba3D(Mesh=smooth_mesh, Identifier="walls", CrossSection=cross_section_karamba3d, LimitDistance_m=0.005)  # -> Element, Points, Info
wall_anchors = Curve([<curve referenced from the Rhino model> x5])
nv = NakedVertices(Mesh=smooth_mesh)  # -> ClothedIndex, NakedIndex, ClothedPts, NakedPts
crv_cp = CurveClosestPoint(Point=flatten(nv.NakedPts), Curve=graft(wall_anchors))  # -> Point, Parameter, Distance
smaller = SmallerThan(FirstNumber=crv_cp.Distance, SecondNumber=0.1)  # -> SmallerThan, OrEqualTo
dispatch = Dispatch(List=flatten(nv.NakedPts), DispatchPattern=smaller.OrEqualTo)  # -> flatten(ListA), ListB
achor_points = Point(flatten(dispatch.ListA))
remove_duplicate_points_karamba3d = RemoveDuplicatePointsKaramba3D(Point=achor_points, LimitDistance=0.005)  # -> OutPoint, Info, Indexes
support_karamba3d = SupportKaramba3D(PosInd=remove_duplicate_points_karamba3d.OutPoint, menu=[buttons(on, on, on, off, off, off)])

group_toggle = GroupToggle(ToggleActive=True, ToggleVisible=False)  # disabled

mesh_to_shell_karamba3d_2 = MeshToShellKaramba3D(Mesh=mesh_unifynormals, Identifier="Roof", CrossSection=cross_section_karamba3d_2, LimitDistance_m=0.005)  # -> Element, Points, Info
roof_anchors = Curve(<curve referenced from the Rhino model>)
point = Point(mesh_to_shell_karamba3d_2.Points)
crv_cp_2 = CurveClosestPoint(Point=flatten(point), Curve=graft(roof_anchors))  # -> Point, Parameter, Distance
smaller_2 = SmallerThan(FirstNumber=crv_cp_2.Distance, SecondNumber=0.1)  # -> SmallerThan, OrEqualTo
dispatch_2 = Dispatch(List=flatten(point), DispatchPattern=smaller_2.SmallerThan)  # -> flatten(ListA), ListB
achor_points_2 = Point(flatten(dispatch_2.ListA))
remove_duplicate_points_karamba3d_2 = RemoveDuplicatePointsKaramba3D(Point=achor_points_2, LimitDistance=0.005)  # -> OutPoint, Info, Indexes
support_karamba3d_2 = SupportKaramba3D(PosInd=flatten(remove_duplicate_points_karamba3d_2.OutPoint), menu=[buttons(on, on, on, off, off, off)])

# ----
# ROOF ANALYSIS
# KARAMBA
# RESULTS
# Supports
# INPUTS
# verification of limit states
# Unit convertor
# Cross section
# brick size
# Material properties
# Loads
# mesh load
# self weight
# finish material load
# Slab load
# Filling load
# live load
load_karamba3d = LoadKaramba3D([loads_karamba3d, loads, loads_karamba3d_2, loads_karamba3d_3, loads_karamba3d_4, loads_karamba3d_5])

assemble_model_karamba3d = AssembleModelKaramba3D(
    Elem=flatten(mesh_to_shell_karamba3d_2.Element),
    Support=flatten(support_karamba3d_2),
    Load=flatten(load_karamba3d),
    CrossSection=cross_section_karamba3d_2,
    Material=material_properties_karamba3d_2,
    LimitDistance_m=0.005)  # -> Model, Info, Mass_kg, CenterOfGravity

panel_6 = Panel(assemble_model_karamba3d.Model)
analyze_karamba3d = AnalyzeKaramba3D(Model=assemble_model_karamba3d.Model)  # -> CalculatedModel, MaximumDisplacement_cm, ResultingForceOfGravity_kN, ElasticEnergy_kNm
model_view_karamba3d = ModelViewKaramba3D(Model=analyze_karamba3d.CalculatedModel, ResultFactors=1, ResultCase=-1)  # -> Model, DeformedMesh, DeformedAxes, DeformedModel
shell_view_karamba3d = ShellViewKaramba3D(Model=model_view_karamba3d.Model, IndexOfLayer=0)  # -> Model, MeshesOfRenderedShells, LegendColors, LegendTags

reaction_forces_karamba3d = ReactionForcesKaramba3D(AnalyzedModel=analyze_karamba3d.CalculatedModel, ResultCase=0)  # -> AnalyzedModel, ReactionForces_kN, ReactionMoments_kNm, SupportPosition, SumOfReactionForces_kN, SumOfReactionMoments_kNm
point_2 = Point(flatten(reaction_forces_karamba3d.SupportPosition))
vector = Vector(flatten(reaction_forces_karamba3d.ReactionForces_kN))
reverse = Reverse(Vector=vector)
vector_display = VectorDisplay(Anchor=point_2, Vector=reverse)
closest_point = ClosestPoint(Point=point_2, Cloud=mesh_to_shell_karamba3d.Points)  # -> ClosestPoint, CPIndex, Distance
loads_karamba3d_6 = LoadsKaramba3D(ForceVector=reverse, Local=False, PosInd=closest_point.ClosestPoint, LCase="0", mode="Point")

point_3 = Point(point_2)
vector_2 = Vector(vector)
vector_display_2 = VectorDisplay(Anchor=point_3, Vector=vector_2)
vector_3 = Vector(vector_2)
point_4 = Point(point_3)
vector_length = VectorLength(Vector=vector_3)
sort_list = SortList(Keys=vector_length, ValuesValuesA=vector_3, ValuesA=point_4)  # -> Keys, ValuesValuesA, ValuesA
list_item = ListItem(List=sort_list.ValuesValuesA, Index=0, Wrap=True)  # -> Item3, Item2, Item1, Item
list_item_2 = ListItem(List=sort_list.ValuesA, Index=0, Wrap=True)  # -> Item3, Item2, Item1, Item
vectors = Merge(Data1=list_item.Item3, Data2=list_item.Item2, Data3=list_item.Item1)
points = Merge(Data1=list_item_2.Item3, Data2=list_item_2.Item2, Data3=list_item_2.Item1)
deconstruct_vector = DeconstructVector(Vector=vector_3)  # -> XComponent, YComponent, ZComponent
vector_xyz = VectorXYZ(XComponent=0, YComponent=0, ZComponent=deconstruct_vector.ZComponent)  # -> Vector, Length
vector_xyz_2 = VectorXYZ(XComponent=deconstruct_vector.XComponent, YComponent=0, ZComponent=0)  # -> Vector, Length
vector_xyz_3 = VectorXYZ(XComponent=0, YComponent=deconstruct_vector.YComponent, ZComponent=0)  # -> Vector, Length
point_5 = Point(point_4)
move = Move(Geometry=point_5, Motion=vector_xyz.Vector)  # -> Geometry, Transform
move_2 = Move(Geometry=point_5, Motion=vector_xyz_3.Vector)  # -> Geometry, Transform
vector_length_2 = VectorLength(Vector=vector_xyz_2.Vector)
vector_length_3 = VectorLength(Vector=vector_xyz.Vector)
move_3 = Move(Geometry=point_5, Motion=vector_xyz_2.Vector)  # -> Geometry, Transform
vector_length_4 = VectorLength(Vector=vector_xyz_3.Vector)
vector_4 = Vector(graft(vector_xyz_2.Vector))
vector_5 = Vector(graft(vector_xyz_3.Vector))
point_6 = Point(graft(point_5))
vector_6 = Vector(graft(vector_xyz.Vector))
text_tag = TextTag(Location=move_3.Geometry, Text=vector_length_2)
text_tag_2 = TextTag(Location=move_2.Geometry, Text=vector_length_4)
text_tag_3 = TextTag(Location=move.Geometry, Text=vector_length_3)
# Rib maker
# Rib maker
vector_display_3 = VectorDisplay(Anchor=point_6, Vector=vector_6)
vector_display_4 = VectorDisplay(Anchor=point_6, Vector=[vector_4, vector_5, vector_6])
vector_display_5 = VectorDisplay(Anchor=point_6, Vector=[vector_5, vector_4])
addition = Addition(A=flatten(vector_length_2), B=flatten(vector_length_4), C=flatten(vector_length_3))
mass_addition = MassAddition(Input=vector_length_3)  # -> Result, PartialResults
panel_7 = Panel(mass_addition.Result)

assemble_model_karamba3d_2 = AssembleModelKaramba3D(
    Elem=flatten(mesh_to_shell_karamba3d.Element),
    Support=flatten(support_karamba3d),
    Load=[loads_karamba3d_6, loads],
    CrossSection=flatten(cross_section_karamba3d),
    Material=flatten(material_properties_karamba3d),
    LimitDistance_m=0.005)  # -> flatten(Model), Info, Mass_kg, CenterOfGravity
list_item_3 = ListItem(List=assemble_model_karamba3d_2.Model, Index=0, Wrap=True)  # -> Item, Item1

cull_index = CullIndex(List=shell_view_karamba3d.LegendTags, Indices=0, Wrap=True)
multiplication_4 = Multiplication(A=cull_index, B=10)
merge = Merge(Data1="Stress [N/mm2]", Data2=multiplication_4)  # -> flatten(Result)

legend = Legend(Colour=shell_view_karamba3d.LegendColors, Tags=merge, LegendType=1)

compression_limit_kn_cm2 = Panel("-0.13")
tension_limit_kn_cm2 = Panel("0.013")
panel_8 = Panel("""0
-1""")
cull_index_2 = CullIndex(List=shell_view_karamba3d.LegendTags, Indices=panel_8, Wrap=True)
ghpython_script = GhPythonScript(c_lim=compression_limit_kn_cm2, t_lim=tension_limit_kn_cm2, x=cull_index_2)  # -> out, compresion, tension, good, colors; inputs x: list
# ---------- ghpython_script: Python ----------
__author__ = "Shriya Balan"
__version__ = "2020.10.13"

import rhinoscriptsyntax as rs
tension_t = []
good_t = []
compresion_t = []
colors_t = []

for i in x:
    if i > t_lim:
        tension_t.append(i)
        colors_t.append("0,102,255")
    elif i < c_lim:
        compresion_t.append(i)
        colors_t.append("255,0,0")
    else:
        good_t.append(i)
        colors_t.append("255,255,0")

tension = tension_t
good = good_t
compresion = compresion_t
colors = colors_t
# ---------- end ghpython_script ----------
model_view_karamba3d_2 = ModelViewKaramba3D(Model=analyze_karamba3d.CalculatedModel, ResultFactors=1, ResultCase=-1, Colors=ghpython_script.colors)  # -> Model, DeformedMesh, DeformedAxes, DeformedModel
shell_view_karamba3d_2 = ShellViewKaramba3D(Model=model_view_karamba3d_2.Model, IndexOfLayer=0)  # -> Model, MeshesOfRenderedShells, LegendColors, LegendTags
# Principle stress displayer
# Reaction force displayer
legend_2 = Legend(Colour=shell_view_karamba3d_2.LegendColors, Tags=shell_view_karamba3d_2.LegendTags, LegendType=1)

# ----
# WALL ANALYSIS
# KARAMBA
# RESULTS
# Supports
# verification of limit states
# Cross section
# Unit convertor
# Material properties
# Birck sizes
# Reaction forces
panel_9 = Panel(reaction_forces_karamba3d.SumOfReactionForces_kN)
analyze_karamba3d_2 = AnalyzeKaramba3D(Model=list_item_3.Item)  # -> CalculatedModel, MaximumDisplacement_cm, ResultingForceOfGravity_kN, ElasticEnergy_kNm
model_view_karamba3d_3 = ModelViewKaramba3D(Model=analyze_karamba3d_2.CalculatedModel, ResultFactors=1, ResultCase=-1)  # -> Model, DeformedMesh, DeformedAxes, DeformedModel
shell_view_karamba3d_3 = ShellViewKaramba3D(Model=model_view_karamba3d_3.Model, IndexOfLayer=0)  # -> Model, MeshesOfRenderedShells, flatten(LegendColors), flatten(LegendTags)

# ---- group: Unit converter
cull_index_3 = CullIndex(List=shell_view_karamba3d_3.LegendTags, Indices=0, Wrap=True)
multiplication_5 = Multiplication(A=cull_index_3, B=10)
merge_2 = Merge(Data1="Stress [N/mm2]", Data2=multiplication_5)  # -> flatten(Result)

# ----
legend_3 = Legend(Colour=shell_view_karamba3d_3.LegendColors, Tags=merge_2, LegendType=1)

panel_10 = Panel("""0
-1""")
compression_limit_kn_cm2_2 = Panel("-0.13")
tension_limit_kn_cm2_2 = Panel("0.013")
cull_index_4 = CullIndex(List=shell_view_karamba3d_3.LegendTags, Indices=panel_10, Wrap=True)
ghpython_script_2 = GhPythonScript(c_lim=compression_limit_kn_cm2_2, t_lim=tension_limit_kn_cm2_2, x=cull_index_4)  # -> out, compresion, tension, good, colors; inputs x: list; same code as ghpython_script
model_view_karamba3d_4 = ModelViewKaramba3D(Model=analyze_karamba3d_2.CalculatedModel, ResultFactors=1, ResultCase=-1, Colors=ghpython_script_2.colors)  # -> Model, DeformedMesh, DeformedAxes, DeformedModel
shell_view_karamba3d_4 = ShellViewKaramba3D(Model=model_view_karamba3d_4.Model, IndexOfLayer=0)  # -> Model, MeshesOfRenderedShells, LegendColors, LegendTags
# Principle stress displayer
# Reaction force displayer
# Principle stress displayer
legend_4 = Legend(Colour=shell_view_karamba3d_4.LegendColors, Tags=shell_view_karamba3d_4.LegendTags, LegendType=1)

# ==== cluster Dome
M = ClusterInput()
A = ClusterInput()
facen = FaceNormals(Mesh=M)  # -> Centers, Normals
G = ClusterInput()
project = ProjectPoint(Point=facen.Centers, Direction=expr("{0,0,1}", Vector(0, 0, -1)), Geometry=G)  # -> Point, Index
division = Division(A=A, B=2000)
pt = Point(facen.Centers)
A_2 = ClusterInput()
dist = Distance(PointA=pt, PointB=project.Point)
subtraction = Subtraction(A=dist, B=division)
multiplication = Multiplication(A=A_2, B=subtraction)
ln = Line(StartPoint=pt, EndPoint=project.Point)
multiplication_2 = Multiplication(A=multiplication, B=0.01)
R = ClusterOutput(multiplication_2)
