# Grasshopper definition Basic_bubble_diagram.gh (Grasshopper 1.0.7)
# plug-ins: LunchBox, SpaceSyntaxDesign_GH

point_spread = Slider(50, range=0..10000)
star_column = Slider(3, range=0..10)
end_column = Slider(29, range=0..100)
radius_1 = Slider(0.001, range=0.001..1)
radius_2 = Slider(0.198, range=0.001..1)
path = FilePath("C:\Users\thijm\Google Drive\Prive\School\Msc 3\AR3B011 EARTHY\Earthy_Group2\1.Configuring\Copy of Wellness Centre requirements.xlsx")
subtraction = Subtraction(A=end_column, B=star_column)
dom = ConstructDomain(DomainStart=star_column, DomainEnd=end_column)
excelread = ExcelReader(ReadExcelData=Toggle(True), WorkbookPath=path, WorksheetName="REL-Chart")  # -> Exceptions, ExcelData
range = Range(Domain=dom, Steps=subtraction)
branch = TreeBranch(Tree=excelread.ExcelData, Path=range, MaintainPaths=True)
panel = Panel(branch)
panel_2 = Panel("""0
1""")
item = ListItem(List=branch, Index="1", Wrap=True)  # -> flatten(Item)
cull_i = CullIndex(List=branch, Indices=panel_2, Wrap=True)
lng = ListLength(List=cull_i)  # -> flatten(Length)
rectangle = Rectangle(Plane=PlaneXY(0, 0, 0), XSize=point_spread, YSize=point_spread, Radius=0)  # -> Rectangle, Length
rec = Rectangle(rectangle.Rectangle)
item_2 = ListItem(List=lng, Index=0, Wrap=True)
branch_2 = TreeBranch(Tree=excelread.ExcelData, Path=Slider(2, range=0..10), MaintainPaths=True)
pop2d = Populate2D(Region=rec, Count=item_2, Seed=1)
cull_i_2 = CullIndex(List=branch_2, Indices=panel_2, Wrap=True)
pt = Point(pop2d)
panel_3 = Panel(cull_i_2)
python = GhPythonScript(x=cull_i_2)  # -> out, a; inputs x: list of Int32
# ---------- python: Python ----------
__author__ = "Thijmen"
__version__ = "2020.09.16"

import rhinoscriptsyntax as rs

a = 0
for i in x:
    a += i
# ---------- end python ----------
python_2 = GhPythonScript(bpoints=pt, connections=cull_i)  # -> out, a, b; inputs bpoints: list of Point3d, connections: tree of Int32
# ---------- python_2: Python ----------
__author__ = "Thijmen"
__version__ = "2020.09.14"

import rhinoscriptsyntax as rs
import Rhino.Geometry as rg

list_lines1 = []
list_lines2 = []

for i,b in enumerate(bpoints):
    for j,con in enumerate(connections.Branch(i)):
        if con == 1:
            list_lines1.append(rg.Line(b, bpoints[j]))
        elif con == 2:
            list_lines2.append(rg.Line(b, bpoints[j]))

a = list_lines1
b = list_lines2
# ---------- end python_2 ----------
crv = Curve(python_2.a)
pipe = Pipe(Curve=python_2.a, Radius=radius_1, Caps=Toggle(True))  # -> flatten(Pipe)
nodelinkgraph = GraphFromNodesLinks(Points=pt, Links=crv, Labels=item, Areas=cull_i_2, TotalArea=Slider(1345, range=1000..2000))  # -> Graph, GraphVertices, Attributes
pt_2 = ConstructPoint(XCoordinate=0, YCoordinate=0, ZCoordinate=0)
pt_3 = ConstructPoint(XCoordinate="1", YCoordinate=0, ZCoordinate=0)
pt_4 = ConstructPoint(XCoordinate=0, YCoordinate="1", ZCoordinate=0)
forcedirecteddrawing = ForceDirectedDrawing(
    Graph=nodelinkgraph.Graph,
    Vertices=nodelinkgraph.GraphVertices,
    Attributes=nodelinkgraph.Attributes,
    AttractionStrength=0.25,
    RepulsionStrength=1.4,
    ConvergenceTolearnce=0.001,
    MaximumIterations=4000,
    Active=Toggle(True))  # -> NewGraphVertices, IterationCount
pl_3pt = Plane3Pt(PointA=pt_2, PointB=pt_3, PointC=pt_4)
data = Data(forcedirecteddrawing.NewGraphVertices)
diskograph = DiskoGraphDrawing(Plane=pl_3pt, Graph=nodelinkgraph.Graph, Vertices=data, Attributes=nodelinkgraph.Attributes, Thickness=1)
data_2 = Data(nodelinkgraph.Graph)
data_3 = Data(nodelinkgraph.Attributes)
crv_2 = Curve(flatten(crv))
xy = XYPlane(Origin=Point(0, 0, 0))

panel_4 = Panel("Syntactic plan layout")
news_graph = GraphFromNodesLinksWithNEWS(Points=pt, Links=crv_2, Labels=item, Areas=cull_i_2, TotalArea=Slider(1000, range=1000..2000))  # -> Graph, GraphVertices, Attributes
panel_5 = Panel(python.a)
pln = Plane(xy)
ge = GraphEdges(Graph=news_graph.Graph, Vertices=news_graph.GraphVertices)
tuttedrawing = TutteConvexDrawing(BasePlane=pln, Graph=news_graph.Graph, Vertices=news_graph.GraphVertices, Attributes=news_graph.Attributes)  # -> NewGraphVertices, ConvexFaceBorders, SubGraph, SubVertices, SubAttributes
diskograph_2 = DiskoGraphDrawing(Plane=pln, Graph=news_graph.Graph, Vertices=tuttedrawing.NewGraphVertices, Attributes=news_graph.Attributes, Thickness=1)
sg = Data(tuttedrawing.SubGraph)
sv = Point(tuttedrawing.SubVertices)
satt = Data(tuttedrawing.SubAttributes)
triangulate = TriangulateMeshInAllWays(
    TutteOutputVerticesIncludingNEWS=tuttedrawing.NewGraphVertices,
    ConvexFaceBorders=tuttedrawing.ConvexFaceBorders,
    IndexOfTriangulation=Slider(30, range=0..100),
    ExcludeDegenerateTINS=Toggle(False))  # -> AllTriangularMeshes, TheChosenTriangularMesh
dual = DualGraph(NEWS_Triangulated_Mesh=triangulate.TheChosenTriangularMesh, SubAttributes=satt)  # -> DualVertices, DualFaces, DualFaceBorders, DualFaceColors
cgraph = CellGraph()  # -> Graph, GraphVertices

panel_6 = Panel(tuttedrawing.SubVertices)
integration = IntegrationAnalysis(Graph=data_2, Attributes=data_3)  # -> DepthTable, DepthMap, RelativeASymetry, Integration, IntegrationRelativeColors, IntegrationTags
entropy = EntropyAnalysis(Graph=data_2, Attributes=data_3, DepthTable=integration.DepthTable, DepthMap=integration.DepthMap)  # -> Entropy, EntropyRelativeColors, EntropyTags
choice = ChoiceAnalysis(Graph=data_2, Attributes=data_3)  # -> ShortestPaths, ChoiceBetweenness, ChoiceRelativeColors, ChoiceTags
control = ControlAnalysis(Graph=data_2, Attributes=data_3)  # -> Control, ControlRelativeColors, ControlTags
dv = Point(dual.DualVertices)
df = Text(dual.DualFaces)
dfb = Curve(dual.DualFaceBorders)
dfc = Data(dual.DualFaceColors)
sg_2 = Data(sg)
sv_2 = Point(sv)
satt_2 = Data(satt)
G = Integer(cgraph.Graph)
sort = SortList(Keys=choice.ChoiceBetweenness, ValuesA=choice.ChoiceRelativeColors, ValuesB=choice.ChoiceTags)  # -> Keys, ValuesA, ValuesB
sort_2 = SortList(Keys=control.Control, ValuesA=control.ControlRelativeColors, ValuesB=control.ControlTags)  # -> Keys, ValuesA, ValuesB
diff = DifferenceFactor(RelativeAsymetries=integration.RelativeASymetry)
sort_3 = SortList(Keys=integration.Integration, ValuesA=integration.IntegrationRelativeColors, ValuesB=integration.IntegrationTags)  # -> Keys, ValuesA, ValuesB
sort_4 = SortList(Keys=entropy.Entropy, ValuesA=entropy.EntropyRelativeColors, ValuesB=entropy.EntropyTags)  # -> Keys, ValuesA, ValuesB
panel_7 = Panel(diff)
legend = Legend(Colour=sort_2.ValuesA, Tags=sort_2.ValuesB, LegendType=1)
legend_2 = Legend(Colour=sort.ValuesA, Tags=sort.ValuesB, LegendType=1)
legend_3 = Legend(Colour=sort_4.ValuesA, Tags=sort_4.ValuesB, LegendType=1)
legend_4 = Legend(Colour=sort_3.ValuesA, Tags=sort_3.ValuesB, LegendType=1)
lng_2 = ListLength(List=cull_i_2)
panel_8 = Panel(lng_2)
justifiedgraph = JustifiedGraphDrawing(
    ViewPointIndex=Slider(18, range=0..24),
    Plane=PlaneXY(6392.123215, -11208.62666, 0),
    Size=Slider(30, range=0..10000),
    Thickness=Slider(2, range=0..10000),
    Graph=data_2,
    Attributes=data_3,
    DepthTable=integration.DepthTable)
