# Grasshopper definition Final_GradientDescentTool_.gh (Grasshopper 1.0.7)
# plug-ins: LunchBox, Kangaroo2 Components

# ---- group: Excel INPUT
# You need to have excel file opened on your machine to read data.
# Name of the excel file is SPACE LAYOUT.
# 
# Instruction on how to use the excel is stated in sheet 1
boolean_toggle = BooleanToggle(True)
panel = Panel("""1
2
4
9
10""")
excelread = ExcelReaderLEGACY(ReadToggle=boolean_toggle, Worksheet="2", Column=panel, RowStart="2", RowEnd="26")  # -> Exceptions, ExcelData
explode_tree = ExplodeTree(Data=excelread.ExcelData)  # -> Branch0, Branch1, Branch2, Branch3, Branch4

# ----
distance_from_site_s_center_point = Slider(8, range=0..150)
size_of_the_region = Slider(50, range=0..50)
number_slider = Slider(100, range=0..100)
number_slider_2 = Slider(100, range=0..100)
north_direction = Curve(<curve referenced from the Rhino model>)

# ----
# Assign colours
swatch = ColourSwatch(SwatchColor=RGB(178, 116, 219))
swatch_2 = ColourSwatch(SwatchColor=RGB(165, 204, 165))

# ----
# Creates grid of 1.2x1.2m
pt = Point(Point(515129.2342, -7920, 0))
rectangle = Rectangle(Plane=pt, XSize=number_slider, YSize=number_slider_2, Radius=0)  # -> Rectangle, Length
boundary = BoundarySurfaces(Edges=rectangle.Rectangle)
division = Division(A=number_slider, B=1.2)
division_2 = Division(A=number_slider_2, B=1.2)
grid = GridStructure(Surface=boundary, UDivisions=division, VDivisions=division_2)  # -> StructureLines, StructureNodes
pt_2 = Point(grid.StructureNodes)

site_rectangle = Curve(rectangle.Rectangle)

# ----
# This cluster groups the spaces as per the Hierarchy of Depth
correctdatastructure = Correctdatastructure(L=explode_tree.Branch2, L_2=explode_tree.Branch3, values=explode_tree.Branch0, L_3=explode_tree.Branch4)  # -> C, L_4, rectangle_2

# ----
# This group of creates the regions in N,S,W,E,NE,SE,
# and populates it with assigned spaces in excel
segregationofspaces = SegregationOfSpaces(geometry=site_rectangle, curve=north_direction, B=distance_from_site_s_center_point, x_size=size_of_the_region)  # -> rectangle, start, vector, rectangle_4, rectangle_2, rectangle_5, rectangle_3, rectangle_6
movespacetoregion = MoveSpacetoRegion(
    D=correctdatastructure.rectangle_2,
    x=correctdatastructure.C,
    region=segregationofspaces.rectangle,
    region_3=segregationofspaces.rectangle_4,
    region_4=segregationofspaces.rectangle_2,
    region_2=segregationofspaces.rectangle_5,
    region_5=segregationofspaces.rectangle_3,
    region_6=segregationofspaces.rectangle_6)  # -> depth1_2, depth2_2, depth3_2, depth4_2, depth5_2

northsigndisplay = VectorDisplay(Anchor=segregationofspaces.start, Vector=segregationofspaces.vector)
line = Line(grid.StructureLines)

# ----
# Depth1 : Setting relaxation Goals
entrance_checkpoint = Curve(<curve referenced from the Rhino model>)
snaptogrid_ii = SnapToGridII(A=pt_2, C=entrance_checkpoint)
curve = Curve(movespacetoregion.depth1_2)
area = Area(Geometry=snaptogrid_ii)  # -> Area, Centroid
area_2 = Area(Geometry=curve)  # -> Area, graft(Centroid)
ln = Line(StartPoint=area_2.Centroid, EndPoint=area.Centroid)
curvecollide = CurveCollide(
    Curves=flatten(curve),
    PassiveCurves=flatten(snaptogrid_ii),
    BasePlane=PlaneXY(0, 0, 0),
    Strength=Slider(10000, range=0..100000))  # -> Goal, Frames
ct = ConstantTension(Line=ln, Strength=Slider(0.05, range=0.01..0.1))
oncurve = OnCurve(Points=area.Centroid, Curve=snaptogrid_ii, Strength=Slider(100, range=0..1000))
merge = Merge(Data1=curvecollide.Goal, Data2=ct, Data3=oncurve)

boundary_2 = BoundarySurfaces(Edges=snaptogrid_ii)

# ----
# Depth 1-Dynamic Relaxation
number_slider_3 = Slider(0.01, range=0.002..0.01)
bouncysolver = BouncySolver(
    GoalObjects=flatten(merge),
    Reset=Button(),
    Threshold=1e-15,
    Tolerance=0.01,
    Damping=number_slider_3,
    Iterations=50,
    On=Toggle(False))  # -> I, V, O
clean_tree = CleanTree(RemoveNulls=True, RemoveInvalid=True, RemoveEmpty=False, Tree=bouncysolver.O)
c_script = CSharpScript(x=clean_tree)  # -> out, A
# ---------- c_script: C# ----------
    A = x as Curve[];
# ---------- end c_script ----------
curve_2 = Curve(c_script.A)
null = NullItem(Item=flatten(curve_2))  # -> NullFlags, InvalidFlags, Description
cull = CullPattern(List=flatten(curve_2), CullPattern=invert(null.NullFlags))
snaptogrid_ii_2 = SnapToGridII(A=pt_2, C=cull)
boundary_3 = BoundarySurfaces(Edges=snaptogrid_ii_2)

# ----
# Depth2 : Setting relaxation Goals
relaxed_curve = Curve(flatten(snaptogrid_ii_2))
courtyardwaterfountain = Curve(relaxed_curve)
curve_3 = Curve(movespacetoregion.depth2_2)
area_3 = Area(Geometry=courtyardwaterfountain)  # -> Area, graft(Centroid)
area_4 = Area(Geometry=curve_3)  # -> Area, Centroid
ln_2 = Line(StartPoint=area_4.Centroid, EndPoint=area_3.Centroid)
oncurve_2 = OnCurve(Points=flatten(area_3.Centroid), Curve=courtyardwaterfountain, Strength=Slider(100, range=0..1000))
ct_2 = ConstantTension(Line=ln_2, Strength=Slider(0.05, range=0.01..0.1))
curvecollide_2 = CurveCollide(
    Curves=flatten(curve_3),
    PassiveCurves=flatten([courtyardwaterfountain, snaptogrid_ii]),
    BasePlane=PlaneXY(0, 0, 0),
    Strength=Slider(10000, range=0..100000))  # -> Goal, Frames
merge_2 = Merge(Data1=curvecollide_2.Goal, Data2=ct_2, Data3=oncurve_2)

# ----
# Depth 2-Dynamic Relaxation
number_slider_4 = Slider(0.63, range=0..1)
bouncysolver_2 = BouncySolver(
    GoalObjects=flatten(merge_2),
    Reset=Button(),
    Threshold=1e-15,
    Tolerance=0.01,
    Damping=number_slider_4,
    Iterations=50,
    On=Toggle(False))  # -> I, V, O
clean_tree_2 = CleanTree(RemoveNulls=True, RemoveInvalid=True, RemoveEmpty=False, Tree=bouncysolver_2.O)
c_script_2 = CSharpScript(x=clean_tree_2)  # -> out, A; same code as c_script
curve_4 = Curve(c_script_2.A)
null_2 = NullItem(Item=flatten(curve_4))  # -> NullFlags, InvalidFlags, Description
cull_2 = CullPattern(List=flatten(curve_4), CullPattern=invert(null_2.NullFlags))
snaptogrid_ii_3 = SnapToGridII(A=pt_2, C=cull_2)

# ----
# Depth4 : Setting relaxation Goals
select_curves_to_attract_to = Panel("""0
1
3
6""")
curvestorelax = ListItem(List=movespacetoregion.depth4_2, Index=0, Wrap=True)  # -> Item, Item1, Item2, Item3, Item4, Item5, Item6

curve_5 = Curve([curvestorelax.Item, curvestorelax.Item6])
area_5 = Area(Geometry=curve_5)  # -> Area, Centroid

# ----
# Depth5 : Setting relaxation Goals
panel_2 = Panel("""2
3""")

# ----
# Depth3 : Setting relaxation Goals
panel_3 = Panel("""2
7""")
relaxedcurves = Curve(flatten(snaptogrid_ii_3))
partition = PartitionList(List=movespacetoregion.depth3_2, Size=panel_3)
bang = ExplodeTree(Data=partition)  # -> _0220, _0221
item = ListItem(List=relaxedcurves, Index=0, Wrap=True)  # -> Item, Item1, Item2

# ---- group: Tea house
buffer1 = Curve(item.Item)
curve_6 = Curve(bang._0220)
area_6 = Area(Geometry=curve_6)  # -> Area, Centroid
area_7 = Area(Geometry=buffer1)  # -> Area, Centroid

# ---- group: Hammam-changing rooms
herbal_garden = Curve(item.Item2)
curve_7 = Curve(bang._0221)
area_8 = Area(Geometry=herbal_garden)  # -> Area, Centroid
area_9 = Area(Geometry=curve_7)  # -> Area, Centroid

# ----
ln_3 = Line(StartPoint=area_9.Centroid, EndPoint=area_8.Centroid)
oncurve_3 = OnCurve(Points=area_8.Centroid, Curve=herbal_garden, Strength=Slider(100, range=0..1000))
ct_3 = ConstantTension(Line=ln_3, Strength=Slider(0.04, range=0.01..0.1))

ln_4 = Line(StartPoint=area_6.Centroid, EndPoint=area_7.Centroid)
ct_4 = ConstantTension(Line=ln_4, Strength=Slider(0.04, range=0.01..0.1))
oncurve_4 = OnCurve(Points=area_7.Centroid, Curve=buffer1, Strength=Slider(100, range=0..1000))

curvecollide_3 = CurveCollide(
    Curves=flatten([curve_6, curve_7]),
    PassiveCurves=flatten([buffer1, snaptogrid_ii, herbal_garden, courtyardwaterfountain, item.Item1, item.Item]),
    BasePlane=PlaneXY(0, 0, 0),
    Strength=Slider(10000, range=0..100000))  # -> Goal, Frames
merge_3 = Merge(Data1=curvecollide_3.Goal, Data2=ct_4, Data3=oncurve_4, Data6=ct_3, Data7=oncurve_3)

# ----
# Depth 3-Dynamic Relaxation
number_slider_5 = Slider(0.65, range=0..1)
bouncysolver_3 = BouncySolver(
    GoalObjects=flatten(merge_3),
    Reset=Button(),
    Threshold=1e-15,
    Tolerance=0.01,
    Damping=number_slider_5,
    Iterations=50,
    On=Toggle(False))  # -> I, V, O
clean_tree_3 = CleanTree(RemoveNulls=True, RemoveInvalid=True, RemoveEmpty=False, Tree=bouncysolver_3.O)
c_script_3 = CSharpScript(x=clean_tree_3)  # -> out, A; same code as c_script
curve_8 = Curve(c_script_3.A)
null_3 = NullItem(Item=flatten(curve_8))  # -> NullFlags, InvalidFlags, Description
cull_3 = CullPattern(List=flatten(curve_8), CullPattern=invert(null_3.NullFlags))
gridsnap_iii = GridSnapIII(A=pt_2, C=cull_3)

relaxedcurves_2 = Curve(flatten(gridsnap_iii))
item_2 = ListItem(List=relaxedcurves_2, Index=select_curves_to_attract_to, Wrap=True)
curvestoattract = ListItem(List=item_2, Index=0, Wrap=True)  # -> Item, Item1, Item2, Item3

waterbody_courtyard = Curve(curvestoattract.Item1)
curve_9 = Curve([curvestorelax.Item2, curvestorelax.Item3, curvestorelax.Item4])
area_10 = Area(Geometry=curve_9)  # -> Area, Centroid
area_11 = Area(Geometry=waterbody_courtyard)  # -> Area, Centroid

kitchen = Curve(curvestoattract.Item3)
curve_10 = Curve(curvestorelax.Item1)
area_12 = Area(Geometry=curve_10)  # -> Area, Centroid

hammam_hall = Curve(curvestoattract.Item)
area_13 = Area(Geometry=hammam_hall)  # -> Area, Centroid

play_area = Curve(curvestoattract.Item2)
curve_11 = Curve(curvestorelax.Item5)
area_14 = Area(Geometry=curve_11)  # -> Area, Centroid

ln_5 = Line(StartPoint=area_5.Centroid, EndPoint=area_13.Centroid)
ct_5 = ConstantTension(Line=ln_5, Strength=Slider(0.04, range=0.01..0.1))
oncurve_5 = OnCurve(Points=area_13.Centroid, Curve=hammam_hall, Strength=Slider(100, range=0..1000))

ln_6 = Line(StartPoint=area_10.Centroid, EndPoint=area_11.Centroid)
ct_6 = ConstantTension(Line=ln_6, Strength=Slider(0.04, range=0.01..0.1))
oncurve_6 = OnCurve(Points=area_11.Centroid, Curve=waterbody_courtyard, Strength=Slider(100, range=0..1000))

curve_12 = Curve(movespacetoregion.depth5_2)
area_15 = Area(Geometry=curve_12)  # -> Area, Centroid

area_16 = Area(Geometry=kitchen)  # -> Area, Centroid
area_17 = Area(Geometry=play_area)  # -> Area, Centroid
curvecollide_4 = CurveCollide(
    Curves=flatten([curve_9, curve_11, curve_10, curve_5]),
    PassiveCurves=flatten([snaptogrid_ii, courtyardwaterfountain, waterbody_courtyard, kitchen, play_area, buffer1, herbal_garden, relaxedcurves_2, hammam_hall]),
    BasePlane=PlaneXY(0, 0, 0),
    Strength=Slider(10000, range=0..100000))  # -> Goal, Frames

ln_7 = Line(StartPoint=area_14.Centroid, EndPoint=area_17.Centroid)
ct_7 = ConstantTension(Line=ln_7, Strength=Slider(0.04, range=0.01..0.1))
oncurve_7 = OnCurve(Points=area_17.Centroid, Curve=play_area, Strength=Slider(100, range=0..1000))

ln_8 = Line(StartPoint=area_12.Centroid, EndPoint=area_16.Centroid)
ct_8 = ConstantTension(Line=ln_8, Strength=Slider(0.04, range=0.01..0.1))
oncurve_8 = OnCurve(Points=area_16.Centroid, Curve=kitchen, Strength=Slider(100, range=0..1000))

merge_4 = Merge(
    Data1=curvecollide_4.Goal,
    Data2=ct_6,
    Data3=oncurve_6,
    Data4=ct_8,
    Data5=oncurve_8,
    Data6=ct_7,
    Data7=oncurve_7,
    Data8=ct_5,
    Data9=oncurve_5)

# ----
# Depth 4-Dynamic Relaxation
number_slider_6 = Slider(0.65, range=0..1)
bouncysolver_4 = BouncySolver(
    GoalObjects=flatten(merge_4),
    Reset=Button(),
    Threshold=1e-15,
    Tolerance=0.01,
    Damping=number_slider_6,
    Iterations=50,
    On=Toggle(False))  # -> I, V, O
clean_tree_4 = CleanTree(RemoveNulls=True, RemoveInvalid=True, RemoveEmpty=False, Tree=bouncysolver_4.O)
c_script_4 = CSharpScript(x=clean_tree_4)  # -> out, A; same code as c_script
curve_13 = Curve(c_script_4.A)
null_4 = NullItem(Item=flatten(curve_13))  # -> NullFlags, InvalidFlags, Description
cull_4 = CullPattern(List=flatten(curve_13), CullPattern=invert(null_4.NullFlags))
split = SplitList(List=cull_4, Index=3)  # -> ListA, ListB
snaptogrid_ii_4 = SnapToGridII(A=pt_2, C=split.ListB)
snaptogrid_ii_5 = SnapToGridII(A=pt_2, C=split.ListA)

relaxedcurves_3 = Curve(flatten(snaptogrid_ii_4))
item_3 = ListItem(List=relaxedcurves_3, Index=panel_2, Wrap=True)

changing_rooms = Curve(item_3)
area_18 = Area(Geometry=changing_rooms)  # -> Area, Centroid

ln_9 = Line(StartPoint=area_15.Centroid, EndPoint=area_18.Centroid)
ct_9 = ConstantTension(Line=ln_9, Strength=Slider(0.02, range=0.01..0.1))
oncurve_9 = OnCurve(Points=area_18.Centroid, Curve=changing_rooms, Strength=Slider(100, range=0..1000))

curvecollide_5 = CurveCollide(
    Curves=flatten(curve_12),
    PassiveCurves=flatten([snaptogrid_ii, courtyardwaterfountain, waterbody_courtyard, kitchen, play_area, buffer1, herbal_garden, relaxedcurves_2, changing_rooms, cull_4]),
    BasePlane=PlaneXY(0, 0, 0),
    Strength=Slider(10000, range=0..100000))  # -> Goal, Frames
merge_5 = Merge(Data1=curvecollide_5.Goal, Data2=ct_9, Data3=oncurve_9)

# ----
# Depth 5-Dynamic Relaxation
number_slider_7 = Slider(0.81, range=0..1)
bouncysolver_5 = BouncySolver(
    GoalObjects=flatten(merge_5),
    Reset=Button(),
    Threshold=1e-15,
    Tolerance=0.01,
    Damping=number_slider_7,
    Iterations=50,
    On=Toggle(False))  # -> I, V, O
clean_tree_5 = CleanTree(RemoveNulls=True, RemoveInvalid=True, RemoveEmpty=False, Tree=bouncysolver_5.O)
c_script_5 = CSharpScript(x=clean_tree_5)  # -> out, A; same code as c_script
curve_14 = Curve(c_script_5.A)
null_5 = NullItem(Item=flatten(curve_14))  # -> NullFlags, InvalidFlags, Description
cull_5 = CullPattern(List=flatten(curve_14), CullPattern=invert(null_5.NullFlags))
snaptogrid_ii_6 = SnapToGridII(A=pt_2, C=cull_5)

# ----
# Result
entrance = MeshColours(Mesh=boundary_2, Colours=swatch)
waterfountaincourtyard = MeshColours(Mesh=boundary_3, Colours=swatch_2)
herbalgarden = MeshColours(Mesh=item.Item2, Colours=swatch_2)
buffers = MeshColours(Mesh=[item.Item, item.Item1], Colours=swatch)
waterbodycourtyard = MeshColours(Mesh=curvestoattract.Item1, Colours=swatch_2)
teahousefunctions = MeshColours(Mesh=relaxedcurves_2, Colours=ColourSwatch(SwatchColor=RGB(232, 216, 39)))
hammamfunctions = MeshColours(Mesh=[snaptogrid_ii_4, hammam_hall, snaptogrid_ii_6], Colours=ColourSwatch(SwatchColor=RGB(136, 176, 219)))
quietspace = MeshColours(Mesh=snaptogrid_ii_5, Colours=ColourSwatch(SwatchColor=RGB(230, 149, 62)))

# ==== cluster SnapToGridII
C = ClusterInput()
explode = Explode(Curve=C, Recursive=True)  # -> Segments, Vertices
item = ListItem(List=explode.Vertices, Index=0, Wrap=True)  # -> Item, Item1, Item2, Item3
A = ClusterInput()
vec2pt = Vector2Pt(PointA=item.Item2, PointB=item.Item1, Unitize=False)  # -> Vector, Length
vec2pt_2 = Vector2Pt(PointA=item.Item2, PointB=item.Item3, Unitize=False)  # -> Vector, Length
pt = Point(item.Item)
dist = Distance(PointA=A, PointB=item.Item)
vdis = VectorDisplay(Anchor=item.Item2, Vector=vec2pt_2.Vector)
vdis_2 = VectorDisplay(Anchor=item.Item2, Vector=vec2pt.Vector)
rev = Reverse(Vector=vec2pt.Vector)
sort = SortList(Keys=dist, ValuesA=A)  # -> Keys, ValuesA
item_2 = ListItem(List=sort.ValuesA, Index=0, Wrap=True)
pl = ConstructPlane(Origin=item.Item, XAxis=rev, YAxis=vec2pt_2.Vector)
pl_2 = ConstructPlane(Origin=item_2, XAxis=Vector(1, 0, 0), YAxis=Vector(0, 1, 0))
orient = Orient(Geometry=C, Source=flatten(pl), Target=flatten(pl_2))  # -> Geometry, Transform
G = ClusterOutput(orient.Geometry)

# ==== cluster Correctdatastructure
values = ClusterInput()
L = ClusterInput()
L_2 = ClusterInput()
L_3 = ClusterInput()
sort_val = SortDuplicateValues(ValueList=values)  # -> UniqueValues, Indices
lng = ListLength(List=sort_val.Indices)  # -> flatten(Length)
L_4 = ClusterOutput(lng)
partition = PartitionList(List=L_2, Size=lng)
partition_2 = PartitionList(List=L_3, Size=lng)
partition_3 = PartitionList(List=L, Size=lng)
C = ClusterOutput(partition_3)
rectangle = Rectangle(Plane=PlaneXY(0, 0, 0), XSize=partition, YSize=partition_2, Radius=0)  # -> Rectangle, Length
rectangle_2 = ClusterOutput(rectangle.Rectangle)

# ==== cluster SegregationOfSpaces
curve = ClusterInput()
geometry = ClusterInput()
end_points = EndPoints(Curve=curve)  # -> Start, End
area = Area(Geometry=geometry)  # -> Area, Centroid
xy_plane = XYPlane(Origin=Point(0, 0, 0))
vector_2pt = Vector2Pt(PointA=end_points.Start, PointB=end_points.End, Unitize=False)  # -> Vector, Length
xy_plane_2 = XYPlane(Origin=Point(0, 0, 0))
start = ClusterOutput(end_points.Start)
rotate = Rotate(Geometry=vector_2pt.Vector, Angle=degrees(Slider(90, range=0..100)), Plane=xy_plane_2)  # -> Geometry, Transform
B = ClusterInput()
x_size = ClusterInput()
rotate_2 = Rotate(Geometry=vector_2pt.Vector, Angle=degrees(Slider(135, range=0..135)), Plane=xy_plane)  # -> Geometry, Transform
vector = ClusterOutput(vector_2pt.Vector)
multiplication = Multiplication(A=vector_2pt.Vector, B=B)
multiplication_2 = Multiplication(A=rotate.Geometry, B=B)
multiplication_3 = Multiplication(A=rotate_2.Geometry, B=B)
move = Move(Geometry=area.Centroid, Motion=expr("-x", multiplication))  # -> Geometry, Transform
move_2 = Move(Geometry=area.Centroid, Motion=expr("-x", multiplication_2))  # -> Geometry, Transform
move_3 = Move(Geometry=area.Centroid, Motion=expr("-x", multiplication_3))  # -> Geometry, Transform
move_4 = Move(Geometry=area.Centroid, Motion=multiplication)  # -> Geometry, Transform
move_5 = Move(Geometry=area.Centroid, Motion=multiplication_2)  # -> Geometry, Transform
move_6 = Move(Geometry=area.Centroid, Motion=multiplication_3)  # -> Geometry, Transform
south_region = Rectangle(Plane=move.Geometry, XSize=x_size, YSize=x_size, Radius=0)  # -> Rectangle, Length
north_region = Rectangle(Plane=move_4.Geometry, XSize=x_size, YSize=x_size, Radius=0)  # -> Rectangle, Length
west_region = Rectangle(Plane=move_5.Geometry, XSize=x_size, YSize=x_size, Radius=0)  # -> Rectangle, Length
east_region = Rectangle(Plane=move_2.Geometry, XSize=x_size, YSize=x_size, Radius=0)  # -> Rectangle, Length
north_east = Rectangle(Plane=move_3.Geometry, XSize=x_size, YSize=x_size, Radius=0)  # -> Rectangle, Length
south_west = Rectangle(Plane=move_6.Geometry, XSize=x_size, YSize=x_size, Radius=0)  # -> Rectangle, Length
rectangle = ClusterOutput(north_region.Rectangle)
rectangle_2 = ClusterOutput(west_region.Rectangle)
rectangle_3 = ClusterOutput(north_east.Rectangle)
rectangle_4 = ClusterOutput(south_region.Rectangle)
rectangle_5 = ClusterOutput(east_region.Rectangle)
rectangle_6 = ClusterOutput(south_west.Rectangle)

# ==== cluster MoveSpacetoRegion
D = ClusterInput()
x = ClusterInput()
bang = ExplodeTree(Data=D)  # -> Branch0, Branch1, Branch2, Branch3, Branch4
bang_2 = ExplodeTree(Data=x)  # -> Branch0, Branch1, Branch2, Branch3, Branch4
numberofspaceperdirection = GhPythonScript(x=flatten(x))  # -> out, n, e, w, s, ne, sw; inputs x: list
# ---------- numberofspaceperdirection: Python ----------
__author__ = "Anagha"
__version__ = "2020.09.28"

import rhinoscriptsyntax as rs
n = 0
s = 0
e = 0
w = 0
ne = 0
sw = 0
for i in x:
    if i =='N':
        n = n+1
    if i =='S':
        s = s+1
    if i =='E':
        e = e+1
    if i =='W':
        w = w+1
    if i =='NE':
        ne = ne+1
    if i =='SW':
        sw = sw+1
print(n,s,e,w,ne,sw)
# ---------- end numberofspaceperdirection ----------
region = ClusterInput()
region_2 = ClusterInput()
region_3 = ClusterInput()
region_4 = ClusterInput()
region_5 = ClusterInput()
region_6 = ClusterInput()

populate_2d_n = Populate2D(Region=region, Count=numberofspaceperdirection.n, Seed=1)
populate_2d_e = Populate2D(Region=region_2, Count=numberofspaceperdirection.e, Seed=1)
populate_2d_s = Populate2D(Region=region_3, Count=numberofspaceperdirection.s, Seed=0)
populate_2d_w = Populate2D(Region=region_4, Count=numberofspaceperdirection.w, Seed=1)
populate_2d_ne = Populate2D(Region=region_5, Count=numberofspaceperdirection.ne, Seed=1)
populate_2d_sw = Populate2D(Region=region_6, Count=numberofspaceperdirection.sw, Seed=1)

python = GhPythonScript(
    x=flatten(bang.Branch1),
    y=bang_2.Branch1,
    Region_S=populate_2d_s,
    Region_W=populate_2d_w,
    Region_E=populate_2d_e,
    Region_NE=populate_2d_ne,
    Region_SW=populate_2d_sw)  # -> out, rec_n, rec_s, rec_w, rec_e, rec_ne, rec_sw; inputs x: list of Brep, y: list, Region_N: list of Point3d, Region_S: list of Point3d, Region_W: list of Point3d, Region_E: list of Point3d, Region_NE: list of Point3d, Region_SW: list of Point3d
# ---------- python: Python ----------
__author__ = "Anagha"
__version__ = "2020.09.28"

import rhinoscriptsyntax as rs
import Grasshopper as gh
from Grasshopper import DataTree as DT
import ghpythonlib as th
import Rhino.Geometry as rh

newPoints = []
new_Centroid = []
print(y)
point = rh.Point3d(0,0,0)
point_temp = rh.Point3d(0,0,0)
count_N = 0
count_S = 0
count_E = 0
count_W = 0
count_NE = 0
count_SW = 0
rec_n = []
rec_s = []
rec_e = []
rec_w = []
rec_ne = []
rec_sw = []
for i in range(len(x)):
    if y[i] =='N':
        point = rh.AreaMassProperties.Compute(x[i]).Centroid
        point_temp = Region_N[count_N]
        vect = rh.Vector3d(point_temp - point)
        x[i].Translate(vect)
        rec_n.append(x[i])
        count_N = count_N+1
    if y[i] =='S':
        point = rh.AreaMassProperties.Compute(x[i]).Centroid
        point_temp = Region_S[count_S]
        vect = rh.Vector3d(point_temp - point)
        x[i].Translate(vect)
        rec_s.append(x[i])
        count_S = count_S+1
    if y[i] =='E':
        point = rh.AreaMassProperties.Compute(x[i]).Centroid
        point_temp = Region_E[count_E]
        vect = rh.Vector3d(point_temp - point)
        x[i].Translate(vect)
        rec_e.append(x[i])
        count_E = count_E+1
    if y[i] =='W':
        point = rh.AreaMassProperties.Compute(x[i]).Centroid
        point_temp = Region_W[count_W]
        vect = rh.Vector3d(point_temp - point)
        x[i].Translate(vect)
        rec_w.append(x[i])
        count_W = count_W+1
    if y[i] =='NE':
        point = rh.AreaMassProperties.Compute(x[i]).Centroid
        point_temp = Region_NE[count_NE]
        vect = rh.Vector3d(point_temp - point)
        x[i].Translate(vect)
        rec_ne.append(x[i])
        count_NE = count_NE+1
    if y[i] =='SW':
        point = rh.AreaMassProperties.Compute(x[i]).Centroid
        point_temp = Region_SW[count_SW]
        vect = rh.Vector3d(point_temp - point)
        x[i].Translate(vect)
        rec_sw.append(x[i])
        count_SW = count_SW+1
# ---------- end python ----------
python_2 = GhPythonScript(
    x=flatten(bang.Branch3),
    y=bang_2.Branch3,
    Region_S=populate_2d_s,
    Region_W=populate_2d_w,
    Region_E=populate_2d_e,
    Region_NE=populate_2d_ne,
    Region_SW=populate_2d_sw)  # -> out, rec_n, rec_s, rec_w, rec_e, rec_ne, rec_sw; inputs x: list of Brep, y: list, Region_N: list of Point3d, Region_S: list of Point3d, Region_W: list of Point3d, Region_E: list of Point3d, Region_NE: list of Point3d, Region_SW: list of Point3d; same code as python
python_3 = GhPythonScript(
    x=flatten(bang.Branch2),
    y=bang_2.Branch2,
    Region_S=populate_2d_s,
    Region_W=populate_2d_w,
    Region_E=populate_2d_e,
    Region_NE=populate_2d_ne,
    Region_SW=populate_2d_sw)  # -> out, rec_n, rec_s, rec_w, rec_e, rec_ne, rec_sw; inputs x: list of Brep, y: list, Region_N: list of Point3d, Region_S: list of Point3d, Region_W: list of Point3d, Region_E: list of Point3d, Region_NE: list of Point3d, Region_SW: list of Point3d; same code as python
python_4 = GhPythonScript(
    x=flatten(bang.Branch4),
    y=bang_2.Branch4,
    Region_S=populate_2d_s,
    Region_W=populate_2d_w,
    Region_E=populate_2d_e,
    Region_NE=populate_2d_ne,
    Region_SW=populate_2d_sw)  # -> out, rec_n, rec_s, rec_w, rec_e, rec_ne, rec_sw; inputs x: list of Brep, y: list, Region_N: list of Point3d, Region_S: list of Point3d, Region_W: list of Point3d, Region_E: list of Point3d, Region_NE: list of Point3d, Region_SW: list of Point3d; same code as python
python_5 = GhPythonScript(
    x=flatten(bang.Branch0),
    y=bang_2.Branch0,
    Region_S=populate_2d_s,
    Region_W=populate_2d_w,
    Region_E=populate_2d_e,
    Region_NE=populate_2d_ne,
    Region_SW=populate_2d_sw)  # -> out, rec_n, rec_s, rec_w, rec_e, rec_ne, rec_sw; inputs x: list of Brep, y: list, Region_N: list of Point3d, Region_S: list of Point3d, Region_W: list of Point3d, Region_E: list of Point3d, Region_NE: list of Point3d, Region_SW: list of Point3d; same code as python
depth2 = Curve([python.rec_n, python.rec_s, python.rec_w, python.rec_e, python.rec_ne, python.rec_sw])
depth3 = Curve([python_3.rec_sw, python_3.rec_n, python_3.rec_w, python_3.rec_s, python_3.rec_ne, python_3.rec_e])
depth4 = Curve([python_2.rec_n, python_2.rec_s, python_2.rec_w, python_2.rec_e, python_2.rec_ne, python_2.rec_sw])
depth1 = Curve([python_5.rec_n, python_5.rec_s, python_5.rec_w, python_5.rec_e, python_5.rec_ne, python_5.rec_sw])
depth5 = Curve([python_4.rec_n, python_4.rec_s, python_4.rec_w, python_4.rec_e, python_4.rec_ne, python_4.rec_sw])
depth2_2 = ClusterOutput(depth2)
depth3_2 = ClusterOutput(depth3)
depth4_2 = ClusterOutput(depth4)
depth1_2 = ClusterOutput(depth1)
depth5_2 = ClusterOutput(depth5)

# ==== cluster GridSnapIII
C = ClusterInput()
explode = Explode(Curve=C, Recursive=True)  # -> Segments, Vertices
item = ListItem(List=explode.Vertices, Index=0, Wrap=True)  # -> Item, Item1, Item2, Item3
A = ClusterInput()
vec2pt = Vector2Pt(PointA=item.Item2, PointB=item.Item1, Unitize=False)  # -> Vector, Length
vec2pt_2 = Vector2Pt(PointA=item.Item2, PointB=item.Item3, Unitize=False)  # -> Vector, Length
dist = Distance(PointA=A, PointB=item.Item3)
vdis = VectorDisplay(Anchor=item.Item2, Vector=vec2pt.Vector)
vdis_2 = VectorDisplay(Anchor=item.Item2, Vector=vec2pt_2.Vector)
sort = SortList(Keys=dist, ValuesA=A)  # -> Keys, ValuesA
pl = ConstructPlane(Origin=item.Item, XAxis=vec2pt.Vector, YAxis=vec2pt_2.Vector)
item_2 = ListItem(List=sort.ValuesA, Index=0, Wrap=True)
pl_2 = ConstructPlane(Origin=item_2, XAxis=Vector(1, 0, 0), YAxis=Vector(0, 1, 0))
orient = Orient(Geometry=C, Source=flatten(pl), Target=flatten(pl_2))  # -> Geometry, Transform
G = ClusterOutput(orient.Geometry)
