# Grasshopper definition Rib_brickgen.gh (Grasshopper 1.0.7)
# plug-ins: MetaHopper

panel = Panel("15 cm depth min")
connecter_stone = Slider(0.2, range=0.1..1.2)
connector_stone = Data(connecter_stone)

second_crv = Curve(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)
# This row creates the starting stone
input_whole_curve = Curve(second_crv)

first_curve = Curve(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)
# This row creates the starting stone
input_whole_curve_2 = Curve(first_curve)

diagonal = Curve(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)
# This row creates the starting stone
input_whole_curve_3 = Curve(diagonal)

# ----
# input variables: Before changing these parameters please make sure that the structural calculations are sound.
ending_stone = Slider(0.2, range=0.2..1.2)
middle_stones = Slider(0.3, range=0..1)
stone_width = Slider(0.24, range=0..1)
stone_height = Slider(0.45, range=0.15..0.45)
starting_stone = Slider(0.5, range=0.2..1.2)
starting_stone_2 = Data(starting_stone)
ending_stone_2 = Data(ending_stone)
middle_stone = Data(middle_stones)
stone_height_2 = Data(stone_height)
stone_width_2 = Data(stone_width)

horizontal_secondairy_ribs = Curve(flatten(Tree({0;0}: [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], {0;1}: [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], {0;2}: [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])))
vertical_secondairy_ribs = Curve(flatten([<curve referenced from the Rhino model> x3]))
brick_height = Data(Slider(0.1, range=0..1))
brick_depth = Data(Slider(0.2, range=0..1))
brick_width = Data(Slider(0.3, range=0..1))

# ----
# Start curve devider: Devides the original curve in two.
# outputting the start, middle and end point of the original curve.
# 
# also providing the first half of the arc
# This row creates the midle stones
input_whole_curve_4 = Curve(input_whole_curve_3)
# This row creates the midle stones
start_curve_divider = Start_curve_divider(C=input_whole_curve_4, C_2=input_whole_curve_4)  # -> P, i
start_midle_and_end_point_of_original_ar = Point(start_curve_divider.P)  # "start, midle and end point of original arc"
first_half_of_arc = Curve(start_curve_divider.i)

# ----
# Start curve devider: Devides the original curve in two.
# outputting the start, middle and end point of the original curve.
# 
# also providing the first half of the arc
input_whole_curve_5 = Curve(input_whole_curve)
start_curve_divider_2 = Start_curve_divider(C=input_whole_curve_5, C_2=input_whole_curve_5)  # -> P, i
first_half_of_arc_2 = Curve(start_curve_divider_2.i)
start_midle_and_end_point_of_original_ar_2 = Point(start_curve_divider_2.P)  # "start, midle and end point of original arc"

# ----
# Start curve devider: Devides the original curve in two.
# outputting the start, middle and end point of the original curve.
# 
# also providing the first half of the arc
# This row creates the midle stones
input_whole_curve_6 = Curve(input_whole_curve_2)
start_curve_divider_3 = Start_curve_divider(C=input_whole_curve_6, C_2=input_whole_curve_6)  # -> P, i
start_midle_and_end_point_of_original_ar_3 = Point(start_curve_divider_3.P)  # "start, midle and end point of original arc"
first_half_of_arc_3 = Curve(start_curve_divider_3.i)

horizontal_secondairy_ribs_2 = Curve(flatten(horizontal_secondairy_ribs))
list_item = ListItem(List=horizontal_secondairy_ribs_2, Index=-1, Wrap=True)  # -> Item, Item1, Item2
branch_1 = Curve(list_item.Item1)
base_curve = Curve(list_item.Item)
# Base
branch_2 = Curve(list_item.Item2)

# ----
# Plane maker: Makes plane perpendiculair to the surface
base_curve_2 = Curve(branch_1)
plane_maker = PlaneMaker_2(base_curve=base_curve_2)
plane = Plane(plane_maker)

# ----
# Plane maker: Makes plane perpendiculair to the surface
base_curve_3 = Curve(branch_2)
plane_maker_2 = PlaneMaker_2(base_curve=base_curve_3)
plane_2 = Plane(plane_maker_2)

# ----
# Plane maker: Takes the points on the arc and makes a center point which is as high as the lowest point on the curve.
# 
# Also creates a plane which is parallel to the curve
start_midle_and_end_point_of_original_ar_4 = Point(start_midle_and_end_point_of_original_ar)  # "start, midle and end point of original arc"
plane_maker_3 = PlaneMaker(L=start_midle_and_end_point_of_original_ar_4)  # -> pt_2, pl
center_point_of_dome = Point(plane_maker_3.pt_2)
plane_paralel_to_curve = Plane(plane_maker_3.pl)

# ----
# Plane maker: Takes the points on the arc and makes a center point which is as high as the lowest point on the curve.
# 
# Also creates a plane which is parallel to the curve
start_midle_and_end_point_of_original_ar_5 = Point(start_midle_and_end_point_of_original_ar_2)  # "start, midle and end point of original arc"
plane_maker_4 = PlaneMaker(L=start_midle_and_end_point_of_original_ar_5)  # -> pt_2, pl
center_point_of_dome_2 = Point(plane_maker_4.pt_2)
plane_paralel_to_curve_2 = Plane(plane_maker_4.pl)

# ----
# Plane maker: Takes the points on the arc and makes a center point which is as high as the lowest point on the curve.
# 
# Also creates a plane which is parallel to the curve
start_midle_and_end_point_of_original_ar_6 = Point(start_midle_and_end_point_of_original_ar_3)  # "start, midle and end point of original arc"
plane_maker_5 = PlaneMaker(L=start_midle_and_end_point_of_original_ar_6)  # -> pt_2, pl
center_point_of_dome_3 = Point(plane_maker_5.pt_2)
plane_paralel_to_curve_3 = Plane(plane_maker_5.pl)

# ----
# Plane maker: Makes plane perpendiculair to the surface
base_curve_4 = Curve(base_curve)
plane_maker_6 = PlaneMaker_2(base_curve=base_curve_4)
plane_3 = Plane(plane_maker_6)

# ----
# connector start stone curve: Provides an curve the length of the starting curve
# 
# also outputs the remainder of the curve
connector_stone_2 = Data(connector_stone)
base_curve_5 = Curve(branch_1)
con_start_stone_curve = ConStartStoneCurve(curve=base_curve_5, D=connector_stone_2)  # -> i, C
connector_start_stone_curve = Curve(con_start_stone_curve.i)
remainer_curve_with_ending = Curve(con_start_stone_curve.C)

# ----
# connector start stone curve: Provides an curve the length of the starting curve
# 
# also outputs the remainder of the curve
connector_stone_3 = Data(connector_stone)
base_curve_6 = Curve(branch_2)
con_start_stone_curve_2 = ConStartStoneCurve(curve=base_curve_6, D=connector_stone_3)  # -> i, C
connector_start_stone_curve_2 = Curve(con_start_stone_curve_2.i)
remainer_curve_with_ending_2 = Curve(con_start_stone_curve_2.C)

# ----
# starting stone curve: Provides an curve the length of the starting curve
# 
# also outputs the remainder of the curve
starting_stone_length = Data(starting_stone_2)
first_half_of_arc_4 = Curve(first_half_of_arc)
starting_stone_curve = StartingStoneCurve(C_2=first_half_of_arc_4, C=first_half_of_arc_4, D=starting_stone_length)  # -> i, C_3
remainer_curve = Curve(starting_stone_curve.C_3)
starting_stone_curve_2 = Curve(starting_stone_curve.i)

# ----
# Ending stone remover: Removes a certain lenth from the end of the curve to ensure enough room for the ending stone
ending_stone_length = Data(ending_stone_2)
remainer_curve_2 = Curve(remainer_curve)
ending_stone_remover = EndingStoneRemover(C=remainer_curve_2, D=ending_stone_length)
remainer_of_curve = Curve(ending_stone_remover)

# ----
# starting stone curve: Provides an curve the length of the starting curve
# 
# also outputs the remainder of the curve
starting_stone_length_2 = Data(starting_stone_2)
first_half_of_arc_5 = Curve(first_half_of_arc_2)
starting_stone_curve_3 = StartingStoneCurve(C_2=first_half_of_arc_5, C=first_half_of_arc_5, D=starting_stone_length_2)  # -> i, C_3
remainer_curve_3 = Curve(starting_stone_curve_3.C_3)
starting_stone_curve_4 = Curve(starting_stone_curve_3.i)

# ----
# Ending stone remover: Removes a certain lenth from the end of the curve to ensure enough room for the ending stone
ending_stone_length_2 = Data(ending_stone_2)
remainer_curve_4 = Curve(remainer_curve_3)
ending_stone_remover_2 = EndingStoneRemover(C=remainer_curve_4, D=ending_stone_length_2)
remainer_of_curve_2 = Curve(ending_stone_remover_2)

# ----
# Mid stone curve: divides the curve into sections of equal length.
# 
# out puts them with and without the last section (which is the left over)
remainer_of_curve_3 = Curve(remainer_of_curve)
mid_stone_length = Data(middle_stone)
mid_stone_curve = MidStoneCurve(C=remainer_of_curve_3, C_2=remainer_of_curve_3, D=mid_stone_length)  # -> length_2, S, L
combined_length_of_all_mid = Data(mid_stone_curve.length_2)
all_curves_divided = Curve(mid_stone_curve.S)
mid_stone_curves = Curve(mid_stone_curve.L)

# ----
# starting stone curve: Provides an curve the length of the starting curve
# 
# also outputs the remainder of the curve
starting_stone_length_3 = Data(starting_stone_2)
first_half_of_arc_6 = Curve(first_half_of_arc_3)
starting_stone_curve_5 = StartingStoneCurve(C_2=first_half_of_arc_6, C=first_half_of_arc_6, D=starting_stone_length_3)  # -> i, C_3
starting_stone_curve_6 = Curve(starting_stone_curve_5.i)
remainer_curve_5 = Curve(starting_stone_curve_5.C_3)

# ----
# Ending stone remover: Removes a certain lenth from the end of the curve to ensure enough room for the ending stone
ending_stone_length_3 = Data(ending_stone_2)
remainer_curve_6 = Curve(remainer_curve_5)
ending_stone_remover_3 = EndingStoneRemover(C=remainer_curve_6, D=ending_stone_length_3)
remainer_of_curve_4 = Curve(ending_stone_remover_3)

# ----
# Mid stone curve: divides the curve into sections of equal length.
# 
# out puts them with and without the last section (which is the left over)
remainer_of_curve_5 = Curve(remainer_of_curve_4)
mid_stone_length_2 = Data(middle_stone)
mid_stone_curve_2 = MidStoneCurve(C=remainer_of_curve_5, C_2=remainer_of_curve_5, D=mid_stone_length_2)  # -> length_2, S, L
combined_length_of_all_mid_horizontal = Data(mid_stone_curve_2.length_2)
all_curves_divided_2 = Curve(mid_stone_curve_2.S)
mid_stone_curves_2 = Curve(mid_stone_curve_2.L)

# ----
# Mid stone curve: divides the curve into sections of equal length.
# 
# out puts them with and without the last section (which is the left over)
remainer_of_curve_6 = Curve(remainer_of_curve_2)
mid_stone_length_3 = Data(middle_stone)
mid_stone_curve_3 = MidStoneCurve(C=remainer_of_curve_6, C_2=remainer_of_curve_6, D=mid_stone_length_3)  # -> length_2, S, L
combined_length_of_all_mid_vert = Data(mid_stone_curve_3.length_2)
all_curves_divided_3 = Curve(mid_stone_curve_3.S)
mid_stone_curves_3 = Curve(mid_stone_curve_3.L)

# ----
# starting stone curve: Provides an curve the length of the starting curve
# 
# also outputs the remainder of the curve
starting_stone_length_4 = Data(starting_stone_2)
base_curve_7 = Curve(base_curve)
curve_selector = CurveSelector(curve=base_curve_7, D=starting_stone_length_4)  # -> i, C
remainer_curve_with_ending_3 = Curve(curve_selector.C)
starting_stone_curve_7 = Curve(curve_selector.i)

# ----
# Ending stone remover: Removes a certain lenth from the end of the curve to ensure enough room for the ending stone
remainer_curve_with_ending_4 = Curve(remainer_curve_with_ending_3)
connector_stone_4 = Data(connector_stone)
end_stone_remover = EndingStoneRemover(C=remainer_curve_with_ending_4, D=connector_stone_4)
remainer_of_curve_without_ending = Curve(end_stone_remover)

# ----
# Mid stone curve: divides the curve into sections of equal length.
# 
# out puts them with and without the last section (which is the left over)
remainer_of_curve_without_ending_2 = Curve(remainer_of_curve_without_ending)
mid_stone_length_4 = Data(middle_stone)
mind_stone_curve = MindStoneCurve(remainer_of_curve=remainer_of_curve_without_ending_2, D=mid_stone_length_4)  # -> length_2, S, L
mid_stone_curves_4 = Curve(mind_stone_curve.L)
combined_length_of_all_mid_vert_2 = Data(mind_stone_curve.length_2)
all_curves_divided_4 = Curve(mind_stone_curve.S)

# ----
# Mid stone cross section: Takes several inputs and provides the cross section on the midle stones.
# 
# also outputs the indentation
plane_paralel_to_curve_4 = Plane(plane_paralel_to_curve)
all_curves_divided_5 = Curve(all_curves_divided)
mid_stone_curves_5 = Curve(mid_stone_curves)
stone_height_3 = Data(stone_height_2)
mid_stone_corss_section_maker = MidStoneCorssSectionMaker(
    L_2=all_curves_divided_5,
    C_2=mid_stone_curves_5,
    C=mid_stone_curves_5,
    P=plane_paralel_to_curve_4,
    A=stone_height_3,
    L=mid_stone_curves_5)  # -> C_3, pl
mid_stone_cross_sections = Curve(mid_stone_corss_section_maker.C_3)
indentation_for_all_stones = Curve(mid_stone_corss_section_maker.pl)

# ----
# starting stone cross section: Uses several inputs create the cross section of the starting stone
indentation_for_all_stones_2 = Curve(indentation_for_all_stones)
center_point_of_dome_4 = Point(center_point_of_dome)
plane_paralel_to_curve_5 = Plane(plane_paralel_to_curve)
starting_stone_curve_8 = Curve(starting_stone_curve_2)
input_whole_curve_7 = Curve(input_whole_curve_3)
stone_height_4 = Data(stone_height_2)
cross_section_starting_stone = CrossSectionStartingStone(
    L=indentation_for_all_stones_2,
    A_2=center_point_of_dome_4,
    C_2=input_whole_curve_7,
    C=starting_stone_curve_8,
    A=stone_height_4,
    P=plane_paralel_to_curve_5)
cross_section_of_starting_stone = Curve(cross_section_starting_stone)

# ----
# Mid stone cross section: Takes several inputs and provides the cross section on the midle stones.
# 
# also outputs the indentation
plane_paralel_to_curve_6 = Plane(plane_paralel_to_curve_2)
all_curves_divided_6 = Curve(all_curves_divided_3)
mid_stone_curves_6 = Curve(mid_stone_curves_3)
stone_height_5 = Data(stone_height_2)
mid_stone_corss_section_maker_2 = MidStoneCorssSectionMaker(
    L_2=all_curves_divided_6,
    C_2=mid_stone_curves_6,
    C=mid_stone_curves_6,
    P=plane_paralel_to_curve_6,
    A=stone_height_5,
    L=mid_stone_curves_6)  # -> C_3, pl
mid_stone_cross_sections_2 = Curve(mid_stone_corss_section_maker_2.C_3)
indentation_for_all_stones_3 = Curve(mid_stone_corss_section_maker_2.pl)

# ----
# starting stone cross section: Uses several inputs create the cross section of the starting stone
indentation_for_all_stones_4 = Curve(indentation_for_all_stones_3)
center_point_of_dome_5 = Point(center_point_of_dome_2)
plane_paralel_to_curve_7 = Plane(plane_paralel_to_curve_2)
starting_stone_curve_9 = Curve(starting_stone_curve_4)
input_whole_curve_8 = Curve(input_whole_curve)
stone_height_6 = Data(stone_height_2)
cross_section_starting_stone_2 = CrossSectionStartingStone(
    L=indentation_for_all_stones_4,
    A_2=center_point_of_dome_5,
    C_2=input_whole_curve_8,
    C=starting_stone_curve_9,
    A=stone_height_6,
    P=plane_paralel_to_curve_7)
cross_section_of_starting_stone_2 = Curve(cross_section_starting_stone_2)

# ----
# Mid stone cross section: Takes several inputs and provides the cross section on the midle stones.
# 
# also outputs the indentation
plane_paralel_to_curve_8 = Plane(plane_paralel_to_curve_3)
all_curves_divided_7 = Curve(all_curves_divided_2)
mid_stone_curves_7 = Curve(mid_stone_curves_2)
stone_height_7 = Data(stone_height_2)
mid_stone_corss_section_maker_3 = MidStoneCorssSectionMaker(
    L_2=all_curves_divided_7,
    C_2=mid_stone_curves_7,
    C=mid_stone_curves_7,
    P=plane_paralel_to_curve_8,
    A=stone_height_7,
    L=mid_stone_curves_7)  # -> C_3, pl
mid_stone_cross_sections_3 = Curve(mid_stone_corss_section_maker_3.C_3)
indentation_for_all_stones_5 = Curve(mid_stone_corss_section_maker_3.pl)

# ----
# starting stone cross section: Uses several inputs create the cross section of the starting stone
indentation_for_all_stones_6 = Curve(indentation_for_all_stones_5)
center_point_of_dome_6 = Point(center_point_of_dome_3)
plane_paralel_to_curve_9 = Plane(plane_paralel_to_curve_3)
starting_stone_curve_10 = Curve(starting_stone_curve_6)
input_whole_curve_9 = Curve(input_whole_curve_2)
stone_height_8 = Data(stone_height_2)
cross_section_starting_stone_3 = CrossSectionStartingStone(
    L=indentation_for_all_stones_6,
    A_2=center_point_of_dome_6,
    C_2=input_whole_curve_9,
    C=starting_stone_curve_10,
    A=stone_height_8,
    P=plane_paralel_to_curve_9)
cross_section_of_starting_stone_3 = Curve(cross_section_starting_stone_3)

# ----
# Mid stone cross section: Takes several inputs and provides the cross section on the midle stones.
# 
# also outputs the indentation
plane_paralel_to_curve_10 = Plane(plane_3)
all_curves_divided_8 = Curve(all_curves_divided_4)
mid_stone_curves_8 = Curve(mid_stone_curves_4)
stone_height_9 = Data(stone_height_2)
mid_stone_cross_section_maker = MidStoneCrossSectionMaker(L=all_curves_divided_8, curve=mid_stone_curves_8, P=plane_paralel_to_curve_10, A=stone_height_9)  # -> C, pl
mid_stone_cross_sections_4 = Curve(mid_stone_cross_section_maker.C)
indentation_for_all_stones_7 = Curve(mid_stone_cross_section_maker.pl)

# ----
# starting stone cross section: Uses several inputs create the cross section of the starting stone
indentation_for_all_stones_8 = Curve(indentation_for_all_stones_7)
plane_paralel_to_curve_11 = Plane(plane_paralel_to_curve_2)
center_point_of_dome_7 = Point(center_point_of_dome_2)
starting_stone_curve_11 = Curve(starting_stone_curve_7)
input_whole_curve_10 = Curve(base_curve)
stone_height_10 = Data(stone_height_2)
starting_stone_cross_section_maker = StartingStoneCrossSectionMaker(
    L=indentation_for_all_stones_8,
    A_2=center_point_of_dome_7,
    C_2=input_whole_curve_10,
    A=stone_height_10,
    C=starting_stone_curve_11,
    P=plane_paralel_to_curve_11)
cross_section_of_starting_stone_4 = Curve(starting_stone_cross_section_maker)

# ----
# Stone extruder: Using a cross section , stone width and a plane it provides a starting stone brep
cross_section_of_starting_stone_5 = Curve(cross_section_of_starting_stone_4)
plane_paralel_to_curve_12 = Plane(plane_3)
stone_width_3 = Data(stone_width_2)
stone_extruder = StoneExtruder(A=stone_width_3, E=cross_section_of_starting_stone_5, P=plane_paralel_to_curve_12)
starting_stones = Brep(stone_extruder)

# ----
# Stone extruder 2.0: Using a cross section , stone width and a plane it provides a starting stone brep.
# 
# this version also unifys surface normals
cross_section_of_stone = Curve(mid_stone_cross_sections_4)
plane_paralel_to_curve_13 = Plane(plane_3)
stone_width_4 = Data(stone_width_2)
cluster = Cluster_3(A=stone_width_4, E=cross_section_of_stone, P=plane_paralel_to_curve_13)
mid_stone_stone = Brep(cluster)

# ----
# Stone extruder: Using a cross section , stone width and a plane it provides a starting stone brep
cross_section_of_starting_stone_6 = Curve(cross_section_of_starting_stone)
plane_paralel_to_curve_14 = Plane(plane_paralel_to_curve)
stone_width_5 = Data(stone_width_2)
stone_extruder_2 = StoneExtruder(A=stone_width_5, E=cross_section_of_starting_stone_6, P=plane_paralel_to_curve_14)
starting_stone_3 = Brep(stone_extruder_2)

# ----
# Stone extruder: Using a cross section , stone width and a plane it provides a starting stone brep
cross_section_of_starting_stone_7 = Curve(cross_section_of_starting_stone_2)
plane_paralel_to_curve_15 = Plane(plane_paralel_to_curve_2)
stone_width_6 = Data(stone_width_2)
stone_extruder_3 = StoneExtruder(A=stone_width_6, E=cross_section_of_starting_stone_7, P=plane_paralel_to_curve_15)
starting_stone_4 = Brep(stone_extruder_3)

# ----
# Stones extruder: Using a cross section , stone width and a plane it provides stones brep.
# 
# The difference with the normal stone extruder is the ability to process several cross sections at once.
mid_stone_cross_sections_5 = Curve(mid_stone_cross_sections)
plane_paralel_to_curve_16 = Plane(plane_paralel_to_curve)
stone_width_7 = Data(stone_width_2)
mid_stones_extruder = MidStonesExtruder(A=stone_width_7, L=mid_stone_cross_sections_5, P=plane_paralel_to_curve_16)
mid_stones = Brep(mid_stones_extruder)

# ----
# Stones extruder: Using a cross section , stone width and a plane it provides stones brep.
# 
# The difference with the normal stone extruder is the ability to process several cross sections at once.
mid_stone_cross_sections_6 = Curve(mid_stone_cross_sections_3)
plane_paralel_to_curve_17 = Plane(plane_paralel_to_curve_3)
stone_width_8 = Data(stone_width_2)
mid_stones_extruder_2 = MidStonesExtruder(A=stone_width_8, L=mid_stone_cross_sections_6, P=plane_paralel_to_curve_17)
mid_stones_2 = Brep(mid_stones_extruder_2)

# ----
# Stone extruder: Using a cross section , stone width and a plane it provides a starting stone brep
cross_section_of_starting_stone_8 = Curve(cross_section_of_starting_stone_3)
plane_paralel_to_curve_18 = Plane(plane_paralel_to_curve_3)
stone_width_9 = Data(stone_width_2)
stone_extruder_4 = StoneExtruder(A=stone_width_9, E=cross_section_of_starting_stone_8, P=plane_paralel_to_curve_18)
starting_stone_5 = Brep(stone_extruder_4)

# ----
# Stones extruder: Using a cross section , stone width and a plane it provides stones brep.
# 
# The difference with the normal stone extruder is the ability to process several cross sections at once.
mid_stone_cross_sections_7 = Curve(mid_stone_cross_sections_2)
plane_paralel_to_curve_19 = Plane(plane_paralel_to_curve_2)
stone_width_10 = Data(stone_width_2)
mid_stones_extruder_3 = MidStonesExtruder(A=stone_width_10, L=mid_stone_cross_sections_7, P=plane_paralel_to_curve_19)
mid_stones_3 = Brep(mid_stones_extruder_3)

# ----
# Combiner: Combines starting stones with mid stones into one list with all the stones of the rib
starting_stone_6 = Brep(starting_stones)
mid_stones_4 = Brep(mid_stone_stone)
all_stones = Merge(Data1=starting_stone_6, Data2=mid_stones_4)
all_stones_2 = Brep(all_stones)

# ----
# Combiner: Combines starting stones with mid stones into one list with all the stones of the rib
starting_stone_7 = Brep(starting_stone_3)
mid_stones_5 = Brep(mid_stones)
all_stones_3 = Merge(Data1=starting_stone_7, Data2=mid_stones_5)
all_stones_4 = Brep(all_stones_3)

# ----
# Combiner: Combines starting stones with mid stones into one list with all the stones of the rib
starting_stone_8 = Brep(starting_stone_4)
mid_stones_6 = Brep(mid_stones_3)
all_stones_5 = Merge(Data1=starting_stone_8, Data2=mid_stones_6)
all_stones_6 = Brep(all_stones_5)

# ----
# Combiner: Combines starting stones with mid stones into one list with all the stones of the rib
starting_stone_9 = Brep(starting_stone_5)
mid_stones_7 = Brep(mid_stones_2)
all_stones_7 = Merge(Data1=starting_stone_9, Data2=mid_stones_7)
all_stones_8 = Brep(all_stones_7)

# ----
# Mirror diagonals: Takes one diagonal and 2 planes which are on 45 degrees at both sides of the diagonal and mirrors the diagonal rib into 4 diagonal ribs.
plane_1_45_degrees = Plane(plane_paralel_to_curve_3)
plane_2_45_degrees = Plane(plane_paralel_to_curve_2)
all_stones_9 = Brep(all_stones_4)
diagonal_mirror = DiagonalMirror(d1=all_stones_9, P_2=plane_2_45_degrees, G=all_stones_9, P=plane_1_45_degrees)
all_rib_stones_diagonal = Brep(diagonal_mirror)

# ----
# Ending stone remover: Removes a certain lenth from the end of the curve to ensure enough room for the ending stone
# Branch 1
remainer_curve_with_ending_5 = Curve(remainer_curve_with_ending)
all_rib_stones_diagonal_2 = Brep(all_rib_stones_diagonal)
connector_stone_5 = Data(connector_stone)

# ----
# End stone branch 1
# End stone curve: Takes several inputs and provides the cross section on the end stones.
# End stone branch 2
remainer_curve_with_ending_6 = Curve(remainer_curve_with_ending)

# ----
# Ending stone remover: Removes a certain lenth from the end of the curve to ensure enough room for the ending stone
# Branch 2
remainer_curve_with_ending_7 = Curve(remainer_curve_with_ending_2)
all_rib_stones_diagonal_3 = Brep(all_rib_stones_diagonal)
connector_stone_6 = Data(connector_stone)

# ----
# End stone curve: Takes several inputs and provides the cross section on the end stones.
remainer_curve_with_ending_8 = Curve(remainer_curve_with_ending_2)

# ----
# End stone cross section: Takes several inputs and provides the cross section on the end stones.
# 
# because of diagonal connection stone needs to be clipped
all_rib_stones_diagonal_4 = Brep(all_rib_stones_diagonal)
plane_paralel_to_curve_20 = Plane(plane)
stone_height_11 = Data(stone_height_2)

# ----
# End stone cross section: Takes several inputs and provides the cross section on the end stones.
# 
# because of diagonal connection stone needs to be clipped
all_rib_stones_diagonal_5 = Brep(all_rib_stones_diagonal)
plane_paralel_to_curve_21 = Plane(plane_2)
stone_height_12 = Data(stone_height_2)

# ----
# Mid stone curve: divides the curve into sections of equal length.
# 
# out puts them with and without the last section (which is the left over)
mid_stone_length_5 = Data(middle_stone)

# ----
# Mid stone curve: divides the curve into sections of equal length.
# 
# out puts them with and without the last section (which is the left over)
mid_stone_length_6 = Data(middle_stone)

# ----
# Stone extruder 2.0: Using a cross section , stone width and a plane it provides a starting stone brep.
# 
# this version also unifys surface normals
plane_paralel_to_curve_22 = Plane(plane)
stone_width_11 = Data(stone_width_2)

# ----
# Mid stone cross section: Takes several inputs and provides the cross section on the midle stones.
# 
# also outputs the indentation
plane_paralel_to_curve_23 = Plane(plane)
stone_height_13 = Data(stone_height_2)

# ----
# Stone extruder 2.0: Using a cross section , stone width and a plane it provides a starting stone brep.
# 
# this version also unifys surface normals
plane_paralel_to_curve_24 = Plane(plane_2)
stone_width_12 = Data(stone_width_2)

# ----
# Mid stone cross section: Takes several inputs and provides the cross section on the midle stones.
# 
# also outputs the indentation
plane_paralel_to_curve_25 = Plane(plane_2)
stone_height_14 = Data(stone_height_2)

# ----
# Stone extruder 2.0 flipped stone: Using a cross section , stone width and a plane it provides a starting stone brep.
# 
# this version also unifys surface normals
plane_paralel_to_curve_26 = Plane(plane)
stone_width_13 = Data(stone_width_2)

# ----
# Stone extruder 2.0: Using a cross section , stone width and a plane it provides a starting stone brep.
# 
# this version also unifys surface normals
plane_paralel_to_curve_27 = Plane(plane_2)
stone_width_14 = Data(stone_width_2)

# ----
# Middle stones creator: Creates middle stone for secondairy ribs.
# 
# Also provides a trimmed start stone for both of the branches
base_stones = Brep(mid_stone_stone)
base_curve_8 = Curve(base_curve)

# ----
# Secondairy ribs infiller: Makes plane perpendiculair to the surface
brick_height_2 = Data(brick_height)
brick_depth_2 = Data(brick_depth)
brick_depth_3 = Data(brick_depth)
block_width = Data(stone_width_2)
brick_width_2 = Data(brick_width)
base_curve_9 = Curve(branch_1)
base_curve_10 = Curve(branch_2)
base_curve_11 = Curve(base_curve)

# ----
# Mirror diagonals: Takes one diagonal and 2 planes which are on 45 degrees at both sides of the diagonal and mirrors the diagonal rib into 4 diagonal ribs.
starting_stone_base = Brep(starting_stones)
mid_stones_base = Brep(mid_stone_stone)
plane_2_45_degrees_2 = Plane(plane_paralel_to_curve_2)
plane_1_45_degrees_2 = Plane(plane_paralel_to_curve_3)
diagonal_curve = Plane(plane_paralel_to_curve)

# ----
# Mirror: takes one rib and mirrors in with the plane of the curve purpendiculair to it.
plane_2_45_degrees_3 = Plane(plane_paralel_to_curve_2)
all_stones_10 = Brep(all_stones_8)

rib_mirror = RibMirror(d1=all_stones_10, G=all_stones_10, P=plane_2_45_degrees_3)

all_rib_stones_horizontal = Brep(rib_mirror)

all_rib_stones_horizontal_2 = Brep(all_rib_stones_horizontal)

all_rib_stones_horizontal_3 = Brep(all_rib_stones_horizontal)

all_rib_stones_horizontal_4 = Brep(all_rib_stones_horizontal)

all_rib_stones_horizontal_5 = Brep(all_rib_stones_horizontal)

# ----
# Mirror: takes one rib and mirrors in with the plane of the curve purpendiculair to it.
plane_1_45_degrees_3 = Plane(plane_paralel_to_curve_3)
all_stones_11 = Brep(all_stones_6)

rib_mirror_2 = RibMirror(d1=all_stones_11, G=all_stones_11, P=plane_1_45_degrees_3)

all_rib_stones_vertical = Brep(rib_mirror_2)

all_rib_stones_vertical_2 = Brep(all_rib_stones_vertical)
end_stone_remover_2 = EndStoneRemover(
    curve=remainer_curve_with_ending_5,
    tree=[all_rib_stones_vertical_2, all_rib_stones_diagonal_2, all_rib_stones_horizontal_2],
    D=connector_stone_5)
remainer_of_curve_without_ending_3 = Curve(end_stone_remover_2)

all_rib_stones_vertical_3 = Brep(all_rib_stones_vertical)
end_stone_remover_3 = EndStoneRemover(
    curve=remainer_curve_with_ending_7,
    tree=[all_rib_stones_vertical_3, all_rib_stones_diagonal_3, all_rib_stones_horizontal_3],
    D=connector_stone_6)
remainer_of_curve_without_ending_4 = Curve(end_stone_remover_3)

remainer_of_curve_without_ending_5 = Curve(remainer_of_curve_without_ending_3)
mind_stone_curve_2 = MindStoneCurve(remainer_of_curve=remainer_of_curve_without_ending_5, D=mid_stone_length_5)  # -> length_2, S, L
mid_stone_curves_9 = Curve(mind_stone_curve_2.L)
combined_length_of_all_mid_vert_3 = Data(mind_stone_curve_2.length_2)
all_curves_divided_9 = Curve(mind_stone_curve_2.S)

remainer_of_curve_without_ending_6 = Curve(remainer_of_curve_without_ending_4)
mind_stone_curve_3 = MindStoneCurve(remainer_of_curve=remainer_of_curve_without_ending_6, D=mid_stone_length_6)  # -> length_2, S, L
mid_stone_curves_10 = Curve(mind_stone_curve_3.L)
combined_length_of_all_mid_vert_4 = Data(mind_stone_curve_3.length_2)
all_curves_divided_10 = Curve(mind_stone_curve_3.S)

all_curves_divided_11 = Curve(all_curves_divided_9)
mid_stone_curves_11 = Curve(mid_stone_curves_9)
mid_stone_cross_section_maker_2 = MidStoneCrossSectionMaker_2(L=all_curves_divided_11, curve=mid_stone_curves_11, P=plane_paralel_to_curve_23, A=stone_height_13)  # -> C, pl
mid_stone_cross_sections_8 = Curve(mid_stone_cross_section_maker_2.C)
indentation_for_all_stones_9 = Curve(mid_stone_cross_section_maker_2.pl)

all_curves_divided_12 = Curve(all_curves_divided_10)
mid_stone_curves_12 = Curve(mid_stone_curves_10)
mid_stone_cross_section_maker_3 = MidStoneCrossSectionMaker_2(L=all_curves_divided_12, curve=mid_stone_curves_12, P=plane_paralel_to_curve_25, A=stone_height_14)  # -> C, pl
mid_stone_cross_sections_9 = Curve(mid_stone_cross_section_maker_3.C)
indentation_for_all_stones_10 = Curve(mid_stone_cross_section_maker_3.pl)

cross_section_of_stone_2 = Curve(mid_stone_cross_sections_8)
cluster_2 = Cluster_4(A=stone_width_13, E=cross_section_of_stone_2, plane=plane_paralel_to_curve_26)
mid_stones_8 = Brep(cluster_2)

cross_section_of_stone_3 = Curve(mid_stone_cross_sections_9)
stone_extruder_5 = Cluster_3(A=stone_width_14, E=cross_section_of_stone_3, P=plane_paralel_to_curve_27)
mid_stones_9 = Brep(stone_extruder_5)

branch_1_stones = Brep(mid_stones_8)
branch_2_stones = Brep(mid_stones_9)
middle_stone_creator = MiddleStoneCreator(
    list_4=branch_1_stones,
    list_5=branch_2_stones,
    list=base_stones,
    list_3=branch_1_stones,
    list_2=branch_2_stones,
    curve=base_curve_8)  # -> list_6, list_7, breps
middle_stone_2 = Brep(middle_stone_creator.breps)
stones_branch_1 = Brep(middle_stone_creator.list_6)
stones_branch_2 = Brep(middle_stone_creator.list_7)

branch_2_stones_2 = Brep(stones_branch_1)
cluster_3 = Cluster_5(list=branch_2_stones_2, curve=remainer_curve_with_ending_6)
end_curve = Curve(cluster_3)

branch_2_stones_3 = Brep(stones_branch_2)
end_stone_curve = EndStoneCurve(list=branch_2_stones_3, curve=remainer_curve_with_ending_8)
end_curve_2 = Curve(end_stone_curve)

indentation_for_all_stones_11 = Curve(indentation_for_all_stones_9)
all_rib_stones_vertical_4 = Brep(all_rib_stones_vertical)
end_curve_3 = Curve(end_curve)
cluster_4 = EndStoneCrossSection(
    curve=end_curve_3,
    P=plane_paralel_to_curve_20,
    A=stone_height_11,
    brep=[all_rib_stones_vertical_4, all_rib_stones_diagonal_4, all_rib_stones_horizontal_4],
    list=indentation_for_all_stones_11)
cross_section_on_end_stone = Curve(cluster_4)

indentation_for_all_stones_12 = Curve(indentation_for_all_stones_10)
all_rib_stones_vertical_5 = Brep(all_rib_stones_vertical)
end_curve_4 = Curve(end_curve_2)
end_stone_cross_section = EndStoneCrossSection(
    curve=end_curve_4,
    P=plane_paralel_to_curve_21,
    A=stone_height_12,
    brep=[all_rib_stones_vertical_5, all_rib_stones_diagonal_5, all_rib_stones_horizontal_5],
    list=indentation_for_all_stones_12)
cross_section_on_end_stone_2 = Curve(end_stone_cross_section)

cross_section_of_stone_4 = Curve(cross_section_on_end_stone)
cluster_5 = Cluster_3(A=stone_width_11, E=cross_section_of_stone_4, P=plane_paralel_to_curve_22)
unclipped_end_stone = Brep(cluster_5)

cross_section_of_stone_5 = Curve(cross_section_on_end_stone_2)
stone_extruder_6 = Cluster_3(A=stone_width_12, E=cross_section_of_stone_5, P=plane_paralel_to_curve_24)
unclipped_end_stone_2 = Brep(stone_extruder_6)

# ----
# Top stone selector: Takes in all the ribs and selects the top stones
all_rib_stones_horizontal_6 = Brep(all_rib_stones_horizontal)
all_rib_stones_diagonal_6 = Brep(all_rib_stones_diagonal)
all_rib_stones_vertical_6 = Brep(all_rib_stones_vertical)
stop_stone_selector = StopStoneSelector(list=all_rib_stones_diagonal_6, list_2=all_rib_stones_horizontal_6, list_3=all_rib_stones_vertical_6)
top_stones_of_all_ribs = Curve(stop_stone_selector)

# ----
# ending stone creator: takes in top stones and creates an apex in between
start_midle_and_end_point_of_original_ar_7 = Point(start_midle_and_end_point_of_original_ar)  # "start, midle and end point of original arc"
top_stones_of_all_ribs_2 = Curve(top_stones_of_all_ribs)
stone_height_15 = Data(stone_height_2)
end_stone_creator = EndStoneCreator(list=start_midle_and_end_point_of_original_ar_7, L=top_stones_of_all_ribs_2, A=stone_height_15)
ending_stone_3 = Brep(end_stone_creator)

# ----
# Brick panels vertical: Creates a infill panel for the brickwork for the inbetween the vertical and diagonal arc
combined_length_of_all_mid_vert_5 = Data(combined_length_of_all_mid_vert)
combined_length_of_all_mid_diagonals = Data(combined_length_of_all_mid)
first_half_of_arc_vertical = Curve(first_half_of_arc_2)
stone_width_15 = Data(stone_width_2)
first_half_of_arc_diagonal = Curve(first_half_of_arc)
starting_stone_10 = Data(starting_stone_2)
stone_width_16 = Data(stone_width_2)
starting_stone_11 = Data(starting_stone_2)
ending_stone_4 = Brep(ending_stone_3)
cluster_6 = Cluster_2(
    brep=ending_stone_4,
    curve=first_half_of_arc_diagonal,
    curve_2=first_half_of_arc_diagonal,
    A=starting_stone_11,
    B=combined_length_of_all_mid_diagonals,
    A_2=stone_width_16,
    curve_3=first_half_of_arc_vertical,
    curve_4=first_half_of_arc_vertical,
    A_3=starting_stone_10,
    B_2=combined_length_of_all_mid_vert_5,
    A_4=stone_width_15)
surface = Surface(cluster_6)

# ----
# Brick panels horizontal: Creates a infill panel for the brickwork for the inbetween the vertical and diagonal arc
combined_length_of_all_mid_horizontal_2 = Data(combined_length_of_all_mid_horizontal)
combined_length_of_all_mid_diagonals_2 = Data(combined_length_of_all_mid)
first_half_of_arc_horizontal = Curve(first_half_of_arc_3)
first_half_of_arc_diagonal_2 = Curve(first_half_of_arc)
starting_stone_12 = Data(starting_stone_2)
starting_stone_13 = Data(starting_stone_2)
ending_stone_5 = Brep(ending_stone_3)
stone_width_17 = Data(stone_width_2)
stone_width_18 = Data(stone_width_2)
cluster_7 = Cluster(
    brep=ending_stone_5,
    curve=first_half_of_arc_diagonal_2,
    curve_2=first_half_of_arc_diagonal_2,
    A=starting_stone_13,
    B=combined_length_of_all_mid_diagonals_2,
    A_2=stone_width_17,
    curve_3=first_half_of_arc_horizontal,
    curve_4=first_half_of_arc_horizontal,
    A_3=starting_stone_12,
    B_2=combined_length_of_all_mid_horizontal_2,
    A_4=stone_width_18)
surface_horizontal = Surface(cluster_7)

# ----
# Stone clipper 2.0: uses a surface to offset a line that clips a brep.
unclipped_end_stone_3 = Brep(unclipped_end_stone)
surface_horizontal_2 = Surface(surface_horizontal)
stone_clipper = StoneClipper(brep_2=unclipped_end_stone_3, brep=surface_horizontal_2)
clipped_end_stone_branch_one = Brep(stone_clipper)

# ----
# Stone clipper 2.0: uses a surface to offset a line that clips a brep.
unclipped_end_stone_4 = Brep(unclipped_end_stone_2)
surface_horizontal_3 = Surface(surface_horizontal)
stone_clipper_2 = StoneClipper_2(brep_2=unclipped_end_stone_4, brep=surface_horizontal_3)
clipped_end_stone_branch_two = Brep(stone_clipper_2)

surface_horizontal_4 = Surface(surface_horizontal)
surface_2 = Surface(surface_horizontal)
secondairy_ribs_infill_maker = SecondairyRibsInfillMaker(
    curve=base_curve_11,
    block_width=block_width,
    curve_3=base_curve_9,
    surface_horizontal=surface_horizontal_4,
    curve_2=base_curve_10,
    B=brick_depth_2,
    surface=surface_2,
    brick_width=brick_width_2,
    brick_depth=brick_depth_3,
    brick_height=brick_height_2)  # -> i, item_2, i_2
infill_base_2 = Brep(secondairy_ribs_infill_maker.item_2)
infill_base_1 = Brep(secondairy_ribs_infill_maker.i)
infill_top = Brep(secondairy_ribs_infill_maker.i_2)

infill_base_1_2 = Brep(infill_base_1)
infill_base_2_2 = Brep(infill_base_2)
infill_top_2 = Brep(infill_top)
stones_branch_2_2 = Brep(stones_branch_2)
clipped_end_stone_branch_one_2 = Brep(clipped_end_stone_branch_one)
stones_branch_1_2 = Brep(stones_branch_1)
middle_stone_3 = Brep(middle_stone_2)
clipped_end_stone_branch_two_2 = Brep(clipped_end_stone_branch_two)
mirror = Mirror(
    all_stones=[infill_base_1_2, infill_base_2_2, infill_top_2, starting_stone_base, mid_stones_base, stones_branch_1_2, stones_branch_2_2, middle_stone_3, clipped_end_stone_branch_one_2, clipped_end_stone_branch_two_2],
    P_2=plane_2_45_degrees_2,
    P=plane_1_45_degrees_2,
    plane=diagonal_curve)
all_rib_stones_diagonal_7 = Brep(mirror)

mirror_2 = Mirror(
    all_stones=[starting_stone_base, mid_stones_base, stones_branch_1_2, stones_branch_2_2, middle_stone_3, clipped_end_stone_branch_one_2, clipped_end_stone_branch_two_2],
    P_2=plane_2_45_degrees_2,
    P=plane_1_45_degrees_2,
    plane=diagonal_curve)

# ----
# Script output: provides all outputs of the script
clipped_end_stone_branch_one_3 = Brep(clipped_end_stone_branch_one)
clipped_end_stone_branch_two_3 = Brep(clipped_end_stone_branch_two)
all_rib_stones_diagonal_8 = Brep(all_rib_stones_diagonal_7)
starting_stone_base_2 = Brep(starting_stones)
mid_stones_base_2 = Brep(mid_stone_stone)
stones_branch_1_3 = Brep(stones_branch_1)
stones_branch_2_3 = Brep(stones_branch_2)
middle_stone_4 = Brep(middle_stone_2)
infill_base_1_3 = Brep(infill_base_1)
infill_base_2_3 = Brep(infill_base_2)
infill_top_3 = Brep(infill_top)
custom_preview = CustomPreview(
    Geometry=[stones_branch_1_3, stones_branch_2_3, middle_stone_4, clipped_end_stone_branch_one_3, infill_base_1_3, clipped_end_stone_branch_two_3, mid_stones_base_2, infill_top_3, starting_stone_base_2, infill_base_2_3, all_rib_stones_diagonal_8],
    Material={diffuse=RGB(221, 160, 221), emission=RGB(66, 48, 66), shine=0.5, specular=RGB(255, 255, 255), transparency=0})

# ----
# Brick panels horizontal: Takes the horizontal brick panel and fills it in with bricks
brick_height_3 = Data(brick_height)
brick_depth_4 = Data(brick_depth)
brick_width_3 = Data(brick_width)
surface_3 = Surface(surface_horizontal)
horizontal_infiller = HorizontalInfiller(brep=surface_3, brick_width=brick_width_3, brick_depth=brick_depth_4, brick_height=brick_height_3)
stones = Brep(horizontal_infiller)

# ----
# Brick panels horizontal: Takes the horizontal brick panel and fills it in with bricks
brick_height_4 = Data(brick_height)
brick_depth_5 = Data(brick_depth)
brick_width_4 = Data(brick_width)
surface_4 = Surface(surface)
vertical_infiller = VerticalInfiller(brep=surface_4, brick_width=brick_width_4, brick_depth=brick_depth_5, brick_height=brick_height_4)
stones_2 = Brep(vertical_infiller)

# ----
# Mirror diagonals: Takes one diagonal and 2 planes which are on 45 degrees at both sides of the diagonal and mirrors the diagonal rib into 4 diagonal ribs.
plane_1_45_degrees_4 = Plane(plane_paralel_to_curve_3)
plane_2_45_degrees_4 = Plane(plane_paralel_to_curve_2)
all_stones_12 = Brep([stones_2, stones])
diagonal_mirror_2 = DiagonalMirror(d1=all_stones_12, P_2=plane_2_45_degrees_4, G=all_stones_12, P=plane_1_45_degrees_4)
all_rib_stones_diagonal_9 = Brep(diagonal_mirror_2)

# ----
# Script output: provides all outputs of the script
all_rib_stones_diagonal_10 = Brep(all_rib_stones_diagonal_9)
all_rib_stones_diagonal_11 = Brep(all_rib_stones_diagonal)
all_rib_stones_horizontal_7 = Brep(all_rib_stones_horizontal)
all_rib_stones_vertical_7 = Brep(all_rib_stones_vertical)
ending_stone_6 = Brep(ending_stone_3)
custom_preview_2 = CustomPreview(
    Geometry=[ending_stone_6, all_rib_stones_diagonal_11, all_rib_stones_horizontal_7, all_rib_stones_vertical_7, all_rib_stones_diagonal_10],
    Material={diffuse=RGB(221, 160, 221), emission=RGB(66, 48, 66), shine=0.5, specular=RGB(255, 255, 255), transparency=0})

# ----
# 3D printing: Takes in 1 point to make an array and spreads out the stones for 3D printing
brep = Brep(flatten([mirror_2, ending_stone_6, all_rib_stones_diagonal_11, all_rib_stones_horizontal_7, all_rib_stones_vertical_7]))  # disabled
point = Point(<point referenced from the Rhino model>)
_3d_printer = _3DPrinter(geometry=point, brep=brep)  # disabled
group_toggle = GroupToggle(ToggleActive=True, ToggleVisible=False)  # disabled
brep_2 = Brep(_3d_printer)  # disabled

# ----
# 3D printing: Takes in 1 point to make an array and spreads out the stones for 3D printing
brep_3 = Brep(flatten(mirror_2))  # disabled
point_2 = Point(<point referenced from the Rhino model>)  # disabled
_3d_printer_2 = _3DPrinter(geometry=point_2, brep=brep_3)  # disabled
group_toggle_2 = GroupToggle(ToggleActive=True, ToggleVisible=False)  # disabled
brep_4 = Brep(_3d_printer_2)  # disabled

# ==== cluster Start_curve_divider
C = ClusterInput()
divide = DivideCurve(Curve=C, Count="2", Kinks=False)  # -> Points, Tangents, Parameters
C_2 = ClusterInput()
P = ClusterOutput(divide.Points)
shatter = Shatter(Curve=C_2, Parameters=divide.Parameters)
item = ListItem(List=shatter, Index=0, Wrap=True)
i = ClusterOutput(item)

# ==== cluster PlaneMaker
L = ClusterInput()
item = ListItem(List=L, Index=0, Wrap=True)  # -> Item, Item1
pdecon = Deconstruct(Point=item.Item)  # -> XComponent, YComponent, ZComponent
pdecon_2 = Deconstruct(Point=item.Item1)  # -> XComponent, YComponent, ZComponent
pt = ConstructPoint(XCoordinate=pdecon_2.XComponent, YCoordinate=pdecon_2.YComponent, ZCoordinate=pdecon.ZComponent)
pl_3pt = Plane3Pt(PointA=pt, PointB=item.Item, PointC=item.Item1)
pt_2 = ClusterOutput(pt)
pl = ClusterOutput(pl_3pt)

# ==== cluster StartingStoneCurve
C = ClusterInput()
D = ClusterInput()
C_2 = ClusterInput()
divdist = DivideDistance(Curve=C, Distance=D)  # -> Points, Tangents, Parameters
shatter = Shatter(Curve=C_2, Parameters=divdist.Parameters)
cull_i = CullIndex(List=shatter, Indices=0, Wrap=True)
item = ListItem(List=shatter, Index=0, Wrap=True)
join = JoinCurves(Curves=cull_i, Preserve=False)
i = ClusterOutput(item)
C_3 = ClusterOutput(join)

# ==== cluster CrossSectionStartingStone
A = ClusterInput()
division = Division(A=A, B=2)
neg = Negative(Value=division)
C = ClusterInput()
P = ClusterInput()
num = Number([division, neg])
offset = OffsetCurve(Curve=C, Distance=num, Plane=P, Corners=1)
C_2 = ClusterInput()
item = ListItem(List=flatten(offset), Index=0, Wrap=True)  # -> Item, Item1
end = EndPoints(Curve=C_2)  # -> Start, End
A_2 = ClusterInput()
ln = Line(StartPoint=A_2, EndPoint=end.Start)
curvature = Curvature(Curve=item.Item, Parameter=0)  # -> P, K, C
ext = ExtendCurve(Curve=ln, Type=0, Start="0", End=flatten(item.Item1))
L = ClusterInput()
ccx = CurveCurve(CurveA=flatten([curvature.C, item.Item1]), CurveB=ext)  # -> flatten(Points), ParamsA, ParamsB
item_2 = ListItem(List=L, Index=0, Wrap=True)
end_2 = EndPoints(Curve=item_2)  # -> Start, End
pline = PolyLine(Vertices=[end_2.Start, ccx.Points, end_2.End], Closed=False)
join = JoinCurves(Curves=[pline, item_2], Preserve=False)
C_3 = ClusterOutput(join)

# ==== cluster StoneExtruder
E = ClusterInput()
boundary = BoundarySurfaces(Edges=E)
A = ClusterInput()
P = ClusterInput()
division = Division(A=A, B=2)
deplane = DeconstructPlane(Plane=P)  # -> Origin, XAxis, YAxis, ZAxis
multiplication = Multiplication(A=division, B=deplane.ZAxis)  # -> flatten(Result)
offset = OffsetSurface(Surface=boundary, Distance=multiplication, Retrim=Toggle(True))
multiplication_2 = Multiplication(A=multiplication, B=-2)
extr = Extrude(Base=offset, Direction=multiplication_2)
E_2 = ClusterOutput(extr)

# ==== cluster EndingStoneRemover
C = ClusterInput()
D = ClusterInput()
flip = FlipCurve(Curve=C)  # -> Curve, Flag
divdist = DivideDistance(Curve=flip.Curve, Distance=D)  # -> Points, Tangents, Parameters
shatter = Shatter(Curve=flip.Curve, Parameters=divdist.Parameters)
cull_i = CullIndex(List=shatter, Indices=0, Wrap=True)
flip_2 = FlipCurve(Curve=cull_i)  # -> Curve, Flag
join = JoinCurves(Curves=flip_2.Curve, Preserve=False)
C_2 = ClusterOutput(join)

# ==== cluster MidStoneCurve
C = ClusterInput()
D = ClusterInput()
divdist = DivideDistance(Curve=C, Distance=D)  # -> Points, Tangents, Parameters
C_2 = ClusterInput()
shatter = Shatter(Curve=C_2, Parameters=divdist.Parameters)
cull_i = CullIndex(List=shatter, Indices=-1, Wrap=True)
join_curves = JoinCurves(Curves=cull_i, Preserve=False)
S = ClusterOutput(shatter)
L = ClusterOutput(cull_i)
length = Length(Curve=join_curves)
length_2 = ClusterOutput(length)

# ==== cluster MidStoneCorssSectionMaker
A = ClusterInput()
division = Division(A=A, B=2)
neg = Negative(Value=division)
C = ClusterInput()
P = ClusterInput()
L = ClusterInput()
num = Number([division, neg])
C_2 = ClusterInput()
offset = OffsetCurve(Curve=C, Distance=graft(num), Plane=P, Corners=1)
lng = ListLength(List=L)
eval = EvaluateLength(Curve=flatten(C_2), Length="0.1", Normalized=True)  # -> Point, Tangent, Parameter
split = SplitList(List=flatten(offset), Index=lng)  # -> flatten(ListA), flatten(ListB)
L_2 = ClusterInput()
item = ListItem(List=flatten(eval.Parameter), Index=0, Wrap=True)
item_2 = ListItem(List=L_2, Index=-2, Wrap=True)
bottom_curves = Curve(split.ListB)
top_curves = Curve(split.ListA)
multiplication = Multiplication(A=item, B=0.1)
subtraction = Subtraction(A=lng, B=1)
end = EndPoints(Curve=top_curves)  # -> Start, End
end_2 = EndPoints(Curve=bottom_curves)  # -> Start, End
ext = ExtendCurve(Curve=item_2, Type=1, Start="0", End=multiplication)
end_3 = EndPoints(Curve=ext)  # -> Start, End
item_3 = ListItem(List=[end.End, end_2.End], Index=["-1", subtraction], Wrap=True)  # -> flatten(Item)
item_4 = ListItem(List=item_3, Index=0, Wrap=True)  # -> Item, Item1
merge = Merge(Data1=flatten(eval.Point), Data2=flatten(end_3.End))  # -> graft(Result)
merge_2 = Merge(Data1=flatten(end.Start), Data2=flatten(item_4.Item))  # -> graft(Result)
merge_3 = Merge(Data1=flatten(end_2.Start), Data2=flatten(item_4.Item1))  # -> graft(Result)
pline = PolyLine(Vertices=[merge_2, merge, merge_3], Closed=False)  # -> flatten(Polyline)
weave = Weave(Pattern=[0, 1], Stream0=top_curves, Stream1=bottom_curves, NullGaps=False)
shift = ShiftList(List=pline, Shift=1, Wrap=True)  # -> flatten(List)
pl = ClusterOutput(pline)
partition = PartitionList(List=weave, Size="2")
merge_4 = Merge(Data1=partition, Data2=graft(pline), Data3=graft(shift))
cull_i = CullIndex(List=shift, Indices="-1", Wrap=True)
join = JoinCurves(Curves=merge_4, Preserve=False)  # -> flatten(Curves)
C_3 = ClusterOutput(join)

# ==== cluster MidStonesExtruder
panel = Panel("""-1
-2""")
L = ClusterInput()
A = ClusterInput()
cull_i = CullIndex(List=L, Indices=panel, Wrap=True)
division = Division(A=A, B=2)
lng = ListLength(List=cull_i)
item = ListItem(List=cull_i, Index=0, Wrap=True)  # -> Item1, Item
flip = FlipCurve(Curve=item.Item1)  # -> Curve, Flag
replace = ReplaceItems(List=cull_i, Item=flip.Curve, Indices=expr("x-1", lng), Wrap=False)
P = ClusterInput()
boundary = BoundarySurfaces(Edges=replace)
deplane = DeconstructPlane(Plane=P)  # -> Origin, XAxis, YAxis, ZAxis
multiplication = Multiplication(A=division, B=deplane.ZAxis)  # -> flatten(Result)
offset = OffsetSurface(Surface=boundary, Distance=multiplication, Retrim=Toggle(True))  # -> graft(Surface)
multiplication_2 = Multiplication(A=multiplication, B=-2)
extr = Extrude(Base=offset, Direction=multiplication_2)
E = ClusterOutput(extr)

# ==== cluster DiagonalMirror
G = ClusterInput()
P = ClusterInput()
mirror = Mirror(Geometry=G, Plane=P)  # -> Geometry, Transform
d1 = ClusterInput()
merge = Merge(Data1=d1, Data2=mirror.Geometry)
P_2 = ClusterInput()
mirror_2 = Mirror(Geometry=merge, Plane=P_2)  # -> Geometry, Transform
merge_2 = Merge(Data1=merge, Data2=mirror_2.Geometry)
result = ClusterOutput(merge_2)

# ==== cluster RibMirror
G = ClusterInput()
P = ClusterInput()
mirror = Mirror(Geometry=G, Plane=P)  # -> Geometry, Transform
d1 = ClusterInput()
merge = Merge(Data1=d1, Data2=mirror.Geometry)
result = ClusterOutput(merge)

# ==== cluster StopStoneSelector
list = ClusterInput()
list_2 = ClusterInput()
list_3 = ClusterInput()
list_item = ListItem(List=list, Index=0, Wrap=True)  # -> Item, Item1, Item2, Item3
list_item_2 = ListItem(List=list_2, Index=0, Wrap=True)  # -> Item, Item1
list_item_3 = ListItem(List=list_3, Index=0, Wrap=True)  # -> Item, Item1
brep = Brep(flatten(list_item.Item))
brep_2 = Brep(flatten(list_item.Item1))
brep_3 = Brep(flatten(list_item.Item2))
brep_4 = Brep(flatten(list_item.Item3))
brep_5 = Brep(flatten(list_item_2.Item))
brep_6 = Brep(flatten(list_item_2.Item1))
brep_7 = Brep(flatten(list_item_3.Item))
brep_8 = Brep(flatten(list_item_3.Item1))
merge = Merge(Data1=graft(brep), Data2=graft(brep_2), Data3=graft(brep_3), Data4=graft(brep_4))
merge_2 = Merge(Data1=graft(brep_5), Data2=graft(brep_6), Data3=graft(brep_7), Data4=graft(brep_8))
viewer = ParamViewer(merge)
viewer_2 = ParamViewer(merge_2)
item = ListItem(List=reverse(viewer), Index=0, Wrap=True)
item_2 = ListItem(List=viewer_2, Index=0, Wrap=True)  # -> Item1, Item
branch = TreeBranch(Tree=merge, Path=item, MaintainPaths=True)
branch_2 = TreeBranch(Tree=merge_2, Path=item_2.Item1, MaintainPaths=True)
debrep = DeconstructBrep(Brep=branch)  # -> Faces, Edges, Vertices
debrep_2 = DeconstructBrep(Brep=branch_2)  # -> Faces, Edges, Vertices
merge_3 = Merge(Data1=debrep.Edges, Data2=debrep_2.Edges)
result = ClusterOutput(merge_3)

# ==== cluster EndStoneCreator
L = ClusterInput()
panel = Panel("""1
3
13""")
item = ListItem(List=L, Index=panel, Wrap=True)
end = EndPoints(Curve=item)  # -> Start, End
list = ClusterInput()
item_2 = ListItem(List=end.End, Index=0, Wrap=True)  # -> flatten(Item), flatten(Item1), flatten(Item2)
item_3 = ListItem(List=end.Start, Index=0, Wrap=True)  # -> flatten(Item), flatten(Item1), flatten(Item2)
list_item = ListItem(List=list, Index=0, Wrap=True)  # -> Item, Item1
circle = CircleCNR(Center=list_item.Item1, Normal=Vector(0, 0, 1), Radius="0.1")
weave = Weave(Pattern=[0, 1], Stream0=item_3.Item, Stream1=item_2.Item, NullGaps=False)
weave_2 = Weave(Pattern=[0, 1], Stream0=item_3.Item1, Stream1=item_2.Item1, NullGaps=False)
weave_3 = Weave(Pattern=[0, 1], Stream0=item_3.Item2, Stream1=item_2.Item2, NullGaps=False)
A = ClusterInput()
subtraction = Subtraction(A=A, B=Slider(0.1, range=0..0.1))
alongcrv = SortAlongCurve(Points=weave, Curve=circle)  # -> Points, Indices
alongcrv_2 = SortAlongCurve(Points=weave_2, Curve=circle)  # -> Points, Indices
alongcrv_3 = SortAlongCurve(Points=weave_3, Curve=circle)  # -> Points, Indices
construct_point = ConstructPoint(XCoordinate=0, YCoordinate=0, ZCoordinate=Slider(0.159, range=0..5))
construct_point_2 = ConstructPoint(XCoordinate=0, YCoordinate=0, ZCoordinate=expr("x*-1", subtraction))
pline = PolyLine(Vertices=alongcrv.Points, Closed=True)
pline_2 = PolyLine(Vertices=alongcrv_3.Points, Closed=True)
pline_3 = PolyLine(Vertices=alongcrv_2.Points, Closed=True)
move = Move(Geometry=list_item.Item1, Motion=construct_point)  # -> Geometry, Transform
move_2 = Move(Geometry=list_item.Item1, Motion=construct_point_2)  # -> Geometry, Transform
point = Point(flatten(alongcrv.Points))
point_2 = Point(flatten(alongcrv_3.Points))
loft = Loft(
    Curves=[pline, pline_3, pline_2],
    Options={Adjust=False, Closed=False, LoftEnds=0, LoftSimp=0, LoftType=3, Rebuild=10, Refit=0.01})  # -> flatten(Loft)
shift_list = ShiftList(List=point, Shift=1, Wrap=True)  # -> flatten(List)
list_length = ListLength(List=point)
shift_list_2 = ShiftList(List=point_2, Shift=1, Wrap=True)  # -> flatten(List)
list_length_2 = ListLength(List=point_2)
duplicate_data = DuplicateData(Data=move.Geometry, Number=list_length, Order=True)  # -> flatten(Data)
duplicate_data_2 = DuplicateData(Data=move_2.Geometry, Number=list_length_2, Order=True)  # -> flatten(Data)
point_3 = Point(graft(duplicate_data))
point_4 = Point(graft(duplicate_data))
point_5 = Point(graft(shift_list))
point_6 = Point(graft(point))
point_7 = Point(graft(duplicate_data_2))
point_8 = Point(graft(duplicate_data_2))
point_9 = Point(graft(shift_list_2))
point_10 = Point(graft(point_2))
point_11 = Point([point_3, point_6, point_5, point_4])
point_12 = Point([point_7, point_10, point_9, point_8])
polyline = PolyLine(Vertices=point_11, Closed=False)  # -> flatten(Polyline)
polyline_2 = PolyLine(Vertices=point_12, Closed=False)  # -> flatten(Polyline)
boundary_surfaces = BoundarySurfaces(Edges=polyline)  # -> flatten(Surfaces)
boundary_surfaces_2 = BoundarySurfaces(Edges=polyline_2)  # -> flatten(Surfaces)
brep_join = BrepJoin(Breps=[boundary_surfaces, loft, boundary_surfaces_2])  # -> Breps, Closed
breps = ClusterOutput(brep_join.Breps)

# ==== cluster Cluster
A = ClusterInput()
B = ClusterInput()
addition = Addition(A=A, B=B)
curve = ClusterInput()
divide_length = DivideLength(Curve=curve, Length=addition)  # -> Points, Tangents, Parameters
curve_2 = ClusterInput()
A_2 = ClusterInput()
shatter = Shatter(Curve=curve_2, Parameters=divide_length.Parameters)
division = Division(A=A_2, B=-2)
multiplication = Multiplication(A=division, B=Slider(1.5, range=1..1.5))
construct_point = ConstructPoint(XCoordinate=multiplication, YCoordinate=0, ZCoordinate=0)
cull_index = CullIndex(List=shatter, Indices=-1, Wrap=True)
A_3 = ClusterInput()
B_2 = ClusterInput()
addition_2 = Addition(A=A_3, B=B_2)
move = Move(Geometry=cull_index, Motion=construct_point)  # -> Geometry, Transform
curve_3 = ClusterInput()
brep = ClusterInput()
divide_length_2 = DivideLength(Curve=curve_3, Length=addition_2)  # -> Points, Tangents, Parameters
brep_curve = BrepCurve(Brep=brep, Curve=move.Geometry)  # -> Curves, Points
curve_4 = ClusterInput()
A_4 = ClusterInput()
shatter_2 = Shatter(Curve=curve_4, Parameters=divide_length_2.Parameters)
division_2 = Division(A=A_4, B=2)
curve_closest_point = CurveClosestPoint(Point=brep_curve.Points, Curve=move.Geometry)  # -> Point, Parameter, Distance
shatter_3 = Shatter(Curve=move.Geometry, Parameters=curve_closest_point.Parameter)
cull_index_2 = CullIndex(List=shatter_2, Indices=-1, Wrap=True)
construct_point_2 = ConstructPoint(XCoordinate=division_2, YCoordinate=0, ZCoordinate=0)
move_2 = Move(Geometry=cull_index_2, Motion=construct_point_2)  # -> Geometry, Transform
cull_index_3 = CullIndex(List=shatter_3, Indices=-1, Wrap=True)
end_points = EndPoints(Curve=cull_index_3)  # -> Start, End
end_points_2 = EndPoints(Curve=move_2.Geometry)  # -> Start, End
line = Line(StartPoint=end_points.Start, EndPoint=end_points_2.Start)
sweep2 = Sweep2(Rail1=cull_index_3, Rail2=move_2.Geometry, Sections=line, SameHeight=False)
brep_2 = ClusterOutput(sweep2)

# ==== cluster Cluster_2
A = ClusterInput()
B = ClusterInput()
addition = Addition(A=A, B=B)
curve = ClusterInput()
divide_length = DivideLength(Curve=curve, Length=addition)  # -> Points, Tangents, Parameters
curve_2 = ClusterInput()
A_2 = ClusterInput()
shatter = Shatter(Curve=curve_2, Parameters=divide_length.Parameters)
division = Division(A=A_2, B=-2)
multiplication = Multiplication(A=division, B=Slider(1.5, range=1..2))
construct_point = ConstructPoint(XCoordinate=0, YCoordinate=multiplication, ZCoordinate=0)
cull_index = CullIndex(List=shatter, Indices=-1, Wrap=True)
A_3 = ClusterInput()
B_2 = ClusterInput()
addition_2 = Addition(A=A_3, B=B_2)
move = Move(Geometry=cull_index, Motion=construct_point)  # -> Geometry, Transform
curve_3 = ClusterInput()
brep = ClusterInput()
divide_length_2 = DivideLength(Curve=curve_3, Length=addition_2)  # -> Points, Tangents, Parameters
brep_curve = BrepCurve(Brep=brep, Curve=move.Geometry)  # -> Curves, Points
curve_4 = ClusterInput()
A_4 = ClusterInput()
shatter_2 = Shatter(Curve=curve_4, Parameters=divide_length_2.Parameters)
curve_closest_point = CurveClosestPoint(Point=brep_curve.Points, Curve=move.Geometry)  # -> Point, Parameter, Distance
division_2 = Division(A=A_4, B=2)
shatter_3 = Shatter(Curve=move.Geometry, Parameters=curve_closest_point.Parameter)
construct_point_2 = ConstructPoint(XCoordinate=0, YCoordinate=division_2, ZCoordinate=0)
cull_index_2 = CullIndex(List=shatter_2, Indices=-1, Wrap=True)
move_2 = Move(Geometry=cull_index_2, Motion=construct_point_2)  # -> Geometry, Transform
cull_index_3 = CullIndex(List=shatter_3, Indices=-1, Wrap=True)
end_points = EndPoints(Curve=cull_index_3)  # -> Start, End
end_points_2 = EndPoints(Curve=move_2.Geometry)  # -> Start, End
line = Line(StartPoint=end_points.Start, EndPoint=end_points_2.Start)
sweep2 = Sweep2(Rail1=cull_index_3, Rail2=move_2.Geometry, Sections=line, SameHeight=False)
brep_2 = ClusterOutput(sweep2)

# ==== cluster HorizontalInfiller
brep = ClusterInput()
brick_height = ClusterInput()
brick_depth = ClusterInput()
brick_width = ClusterInput()
brick_height_2 = Data(brick_height)
brick_depth_2 = Data(brick_depth)
brick_width_2 = Data(brick_width)

# ----
# Takes the surface and divides in to provide vectors for every stone to be moved to the correct position
deconstruct_brep = DeconstructBrep(Brep=brep)  # -> Faces, Edges, Vertices
list_item = ListItem(List=deconstruct_brep.Edges, Index=0, Wrap=True)  # -> Item, Item1, Item2, Item3
curve = Curve(list_item.Item)
curve_2 = Curve(list_item.Item2)
curve_3 = Curve(list_item.Item3)
divide_distance = DivideDistance(Curve=curve_2, Distance=brick_depth_2)  # -> Points, Tangents, Parameters
list_item_2 = ListItem(List=divide_distance.Points, Index=0, Wrap=True)  # -> Item1, Item
vector_2pt = Vector2Pt(PointA=list_item_2.Item1, PointB=divide_distance.Points, Unitize=False)  # -> Vector, Length
move = Move(Geometry=curve_3, Motion=vector_2pt.Vector)  # -> Geometry, Transform
curve_proximity = CurveProximity(CurveA=move.Geometry, CurveB=curve)  # -> PointA, PointB, Distance
curve_closest_point = CurveClosestPoint(Point=curve_proximity.PointA, Curve=move.Geometry)  # -> Point, flatten(Parameter), Distance
curve_4 = Curve(flatten(move.Geometry))
shatter = Shatter(Curve=graft(curve_4), Parameters=graft(curve_closest_point.Parameter))
list_item_3 = ListItem(List=shatter, Index=0, Wrap=True)  # -> flatten(Item)
divide_distance_2 = DivideDistance(Curve=list_item_3, Distance=brick_width_2)  # -> Points, Tangents, Parameters
point = Point(divide_distance_2.Points)
dispatch = Dispatch(List=point, DispatchPattern=[True, False])  # -> ListA, ListB
cull_index = CullIndex(List=dispatch.ListA, Indices=0, Wrap=True)
end_points = EndPoints(Curve=list_item_3)  # -> Start, End
flip_matrix = FlipMatrix(Data=dispatch.ListB)
flip_matrix_2 = FlipMatrix(Data=cull_index)
point_2 = Point(flatten(end_points.Start))
dispatch_2 = Dispatch(List=flip_matrix_2, DispatchPattern=[True, False])  # -> ListA, ListB
dispatch_3 = Dispatch(List=flip_matrix, DispatchPattern=[True, False])  # -> ListA, ListB
reverse_list = ReverseList(List=point_2)
shift_list = ShiftList(List=flatten(reverse_list), Shift=1, Wrap=True)
point_3 = Point(dispatch_2.ListA)
point_4 = Point(flatten(reverse_list))
point_5 = Point(dispatch_3.ListB)
cull_index_2 = CullIndex(List=point_4, Indices=-1, Wrap=True)
cull_index_3 = CullIndex(List=shift_list, Indices=-1, Wrap=True)
reverse_list_2 = ReverseList(List=point_5)
reverse_list_3 = ReverseList(List=point_3)
clean_tree = CleanTree(RemoveNulls=True, RemoveInvalid=True, RemoveEmpty=False, Tree=reverse_list_2)
clean_tree_2 = CleanTree(RemoveNulls=True, RemoveInvalid=True, RemoveEmpty=False, Tree=reverse_list_3)
vector_2pt_2 = Vector2Pt(PointA=cull_index_2, PointB=cull_index_3, Unitize=False)  # -> Vector, Length
list_item_4 = ListItem(List=dispatch.ListA, Index=0, Wrap=True)  # -> flatten(Item)
flip_matrix_3 = FlipMatrix(Data=clean_tree)
flip_matrix_4 = FlipMatrix(Data=clean_tree_2)
dispatch_4 = Dispatch(List=list_item_4, DispatchPattern=[True, False])  # -> ListA, ListB
clean_tree_3 = CleanTree(RemoveNulls=True, RemoveInvalid=True, RemoveEmpty=False, Tree=flip_matrix_3)
clean_tree_4 = CleanTree(RemoveNulls=True, RemoveInvalid=True, RemoveEmpty=False, Tree=flip_matrix_4)
reverse_list_4 = ReverseList(List=dispatch_4.ListA)
reverse_list_5 = ReverseList(List=dispatch_4.ListB)
point_6 = Point(graft(reverse_list_4))
point_7 = Point(graft(reverse_list_5))
vector_2pt_3 = Vector2Pt(PointA=point_6, PointB=clean_tree_4, Unitize=False)  # -> Vector, Length
vector_2pt_4 = Vector2Pt(PointA=point_7, PointB=clean_tree_3, Unitize=False)  # -> Vector, Length

# ----
# Creates a point in the center of the arc to orient the brick from
extremes = Extremes(Curve=curve_2, Plane=PlaneXY(0, 0, 0))  # -> Highest, Lowest
deconstruct = Deconstruct(Point=extremes.Highest)  # -> XComponent, YComponent, ZComponent
deconstruct_2 = Deconstruct(Point=extremes.Lowest)  # -> XComponent, YComponent, ZComponent
construct_point = ConstructPoint(XCoordinate=deconstruct.XComponent, YCoordinate=deconstruct.YComponent, ZCoordinate=deconstruct_2.ZComponent)

# ----
# stone and half stone maker
division = Division(A=brick_width_2, B=2)
center_box = CenterBox(Base=construct_point, X=brick_height_2, Y=brick_depth_2, Z=brick_width_2)
center_box_2 = CenterBox(Base=construct_point, X=brick_height_2, Y=brick_depth_2, Z=division)
brep_wireframe = BrepWireframe(Brep=center_box, Density=-1)
brep_wireframe_2 = BrepWireframe(Brep=center_box_2, Density=-1)
list_item_5 = ListItem(List=brep_wireframe, Index=Slider(4, range=0..12), Wrap=True)
list_item_6 = ListItem(List=brep_wireframe_2, Index=Slider(4, range=0..12), Wrap=True)
end_points_2 = EndPoints(Curve=list_item_5)  # -> Start, End
end_points_3 = EndPoints(Curve=list_item_6)  # -> Start, End

vector_2pt_5 = Vector2Pt(PointA=construct_point, PointB=flatten(point_2), Unitize=False)  # -> Vector, Length
construct_plane = ConstructPlane(Origin=reverse_list, XAxis=vector_2pt_2.Vector, YAxis=vector_2pt_5.Vector)
dispatch_5 = Dispatch(List=construct_plane, DispatchPattern=[True, False])  # -> ListA, ListB

orient = Orient(Geometry=center_box, Source=end_points_2.Start, Target=dispatch_5.ListA)  # -> Geometry, Transform
move_2 = Move(Geometry=graft(orient.Geometry), Motion=vector_2pt_4.Vector)  # -> Geometry, Transform
orient_2 = Orient(Geometry=center_box, Source=end_points_2.Start, Target=dispatch_5.ListB)  # -> Geometry, Transform
move_3 = Move(Geometry=graft(orient_2.Geometry), Motion=vector_2pt_3.Vector)  # -> Geometry, Transform
orient_3 = Orient(Geometry=center_box_2, Source=end_points_3.Start, Target=dispatch_5.ListA)  # -> Geometry, Transform
extend_curve = ExtendCurve(Curve=curve, Type=1, Start="1", End="1")
offset_curve = OffsetCurve(Curve=extend_curve, Plane=PlaneXY(0, 0, 0), Distance=1, BothSides=True, Kinks=0, CapType=1)
second_layer_start = Box(orient_2.Geometry)
first_layer_start = Box(orient_3.Geometry)
second_layer = Box(move_3.Geometry)
first_layer = Box(move_2.Geometry)
split_brep_multiple = SplitBrepMultiple(Brep=flatten([first_layer, second_layer, second_layer_start, first_layer_start]), Cutters=offset_curve)
list_item_7 = ListItem(List=split_brep_multiple, Index=0, Wrap=True)
cull_index_4 = CullIndex(List=flatten(list_item_7), Indices="24", Wrap=True)
list = ClusterOutput(cull_index_4)

# ==== cluster VerticalInfiller
brep = ClusterInput()
brick_height = ClusterInput()
brick_depth = ClusterInput()
brick_width = ClusterInput()
brick_height_2 = Data(brick_height)
brick_depth_2 = Data(brick_depth)
brick_width_2 = Data(brick_width)

# ----
# Takes the surface and divides in to provide vectors for every stone to be moved to the correct position
deconstruct_brep = DeconstructBrep(Brep=brep)  # -> Faces, Edges, Vertices
list_item = ListItem(List=deconstruct_brep.Edges, Index=0, Wrap=True)  # -> Item, Item1, Item2, Item3
curve = Curve(list_item.Item)
curve_2 = Curve(list_item.Item2)
curve_3 = Curve(list_item.Item3)
divide_distance = DivideDistance(Curve=curve_2, Distance=brick_depth_2)  # -> Points, Tangents, Parameters
list_item_2 = ListItem(List=divide_distance.Points, Index=0, Wrap=True)  # -> Item1, Item
vector_2pt = Vector2Pt(PointA=list_item_2.Item1, PointB=divide_distance.Points, Unitize=False)  # -> Vector, Length
move = Move(Geometry=curve_3, Motion=vector_2pt.Vector)  # -> Geometry, Transform
curve_proximity = CurveProximity(CurveA=move.Geometry, CurveB=curve)  # -> PointA, PointB, Distance
curve_closest_point = CurveClosestPoint(Point=curve_proximity.PointA, Curve=move.Geometry)  # -> Point, flatten(Parameter), Distance
curve_4 = Curve(flatten(move.Geometry))
shatter = Shatter(Curve=graft(curve_4), Parameters=graft(curve_closest_point.Parameter))
list_item_3 = ListItem(List=shatter, Index=0, Wrap=True)  # -> flatten(Item)
divide_distance_2 = DivideDistance(Curve=list_item_3, Distance=brick_width_2)  # -> Points, Tangents, Parameters
point = Point(divide_distance_2.Points)
dispatch = Dispatch(List=point, DispatchPattern=[True, False])  # -> ListA, ListB
cull_index = CullIndex(List=dispatch.ListA, Indices=0, Wrap=True)
end_points = EndPoints(Curve=list_item_3)  # -> Start, End
flip_matrix = FlipMatrix(Data=dispatch.ListB)
flip_matrix_2 = FlipMatrix(Data=cull_index)
point_2 = Point(flatten(end_points.Start))
dispatch_2 = Dispatch(List=flip_matrix_2, DispatchPattern=[True, False])  # -> ListA, ListB
dispatch_3 = Dispatch(List=flip_matrix, DispatchPattern=[True, False])  # -> ListA, ListB
reverse_list = ReverseList(List=point_2)
shift_list = ShiftList(List=flatten(reverse_list), Shift=1, Wrap=True)
point_3 = Point(dispatch_2.ListA)
point_4 = Point(flatten(reverse_list))
point_5 = Point(dispatch_3.ListB)
cull_index_2 = CullIndex(List=point_4, Indices=-1, Wrap=True)
cull_index_3 = CullIndex(List=shift_list, Indices=-1, Wrap=True)
reverse_list_2 = ReverseList(List=point_5)
reverse_list_3 = ReverseList(List=point_3)
clean_tree = CleanTree(RemoveNulls=True, RemoveInvalid=True, RemoveEmpty=False, Tree=reverse_list_2)
clean_tree_2 = CleanTree(RemoveNulls=True, RemoveInvalid=True, RemoveEmpty=False, Tree=reverse_list_3)
vector_2pt_2 = Vector2Pt(PointA=cull_index_2, PointB=cull_index_3, Unitize=False)  # -> Vector, Length
list_item_4 = ListItem(List=dispatch.ListA, Index=0, Wrap=True)  # -> flatten(Item)
flip_matrix_3 = FlipMatrix(Data=clean_tree)
flip_matrix_4 = FlipMatrix(Data=clean_tree_2)
dispatch_4 = Dispatch(List=list_item_4, DispatchPattern=[True, False])  # -> ListA, ListB
clean_tree_3 = CleanTree(RemoveNulls=True, RemoveInvalid=True, RemoveEmpty=False, Tree=flip_matrix_3)
clean_tree_4 = CleanTree(RemoveNulls=True, RemoveInvalid=True, RemoveEmpty=False, Tree=flip_matrix_4)
reverse_list_4 = ReverseList(List=dispatch_4.ListA)
reverse_list_5 = ReverseList(List=dispatch_4.ListB)
point_6 = Point(graft(reverse_list_4))
point_7 = Point(graft(reverse_list_5))
vector_2pt_3 = Vector2Pt(PointA=point_6, PointB=clean_tree_4, Unitize=False)  # -> Vector, Length
vector_2pt_4 = Vector2Pt(PointA=point_7, PointB=clean_tree_3, Unitize=False)  # -> Vector, Length

# ----
# Creates a point in the center of the arc to orient the brick from
extremes = Extremes(Curve=curve_2, Plane=PlaneXY(0, 0, 0))  # -> Highest, Lowest
deconstruct = Deconstruct(Point=extremes.Highest)  # -> XComponent, YComponent, ZComponent
deconstruct_2 = Deconstruct(Point=extremes.Lowest)  # -> XComponent, YComponent, ZComponent
construct_point = ConstructPoint(XCoordinate=deconstruct.XComponent, YCoordinate=deconstruct.YComponent, ZCoordinate=deconstruct_2.ZComponent)

# ----
# stone and half stone maker
division = Division(A=brick_width_2, B=2)
center_box = CenterBox(Base=construct_point, X=brick_height_2, Y=brick_depth_2, Z=brick_width_2)
center_box_2 = CenterBox(Base=construct_point, X=brick_height_2, Y=brick_depth_2, Z=division)
brep_wireframe = BrepWireframe(Brep=center_box, Density=-1)
brep_wireframe_2 = BrepWireframe(Brep=center_box_2, Density=-1)
list_item_5 = ListItem(List=brep_wireframe, Index=Slider(8, range=0..12), Wrap=True)
list_item_6 = ListItem(List=brep_wireframe_2, Index=Slider(0, range=0..12), Wrap=True)
end_points_2 = EndPoints(Curve=list_item_5)  # -> Start, End
end_points_3 = EndPoints(Curve=list_item_6)  # -> Start, End

vector_2pt_5 = Vector2Pt(PointA=construct_point, PointB=flatten(point_2), Unitize=False)  # -> Vector, Length
construct_plane = ConstructPlane(Origin=reverse_list, XAxis=vector_2pt_2.Vector, YAxis=vector_2pt_5.Vector)
dispatch_5 = Dispatch(List=construct_plane, DispatchPattern=[True, False])  # -> ListA, ListB

orient = Orient(Geometry=center_box, Source=end_points_2.Start, Target=dispatch_5.ListA)  # -> Geometry, Transform
move_2 = Move(Geometry=graft(orient.Geometry), Motion=vector_2pt_4.Vector)  # -> Geometry, Transform
orient_2 = Orient(Geometry=center_box, Source=end_points_2.Start, Target=dispatch_5.ListB)  # -> Geometry, Transform
move_3 = Move(Geometry=graft(orient_2.Geometry), Motion=vector_2pt_3.Vector)  # -> Geometry, Transform
orient_3 = Orient(Geometry=center_box_2, Source=end_points_3.Start, Target=dispatch_5.ListA)  # -> Geometry, Transform
extend_curve = ExtendCurve(Curve=curve, Type=1, Start="1", End="1")
offset_curve = OffsetCurve(Curve=extend_curve, Plane=PlaneXY(0, 0, 0), Distance=1, BothSides=True, Kinks=0, CapType=1)
second_layer_start = Box(orient_2.Geometry)
first_layer_start = Box(orient_3.Geometry)
second_layer = Box(move_3.Geometry)
first_layer = Box(move_2.Geometry)
split_brep_multiple = SplitBrepMultiple(Brep=flatten([first_layer, second_layer, second_layer_start, first_layer_start]), Cutters=flatten(offset_curve))
list_item_7 = ListItem(List=split_brep_multiple, Index=Slider(1, range=0..3), Wrap=True)  # -> flatten(Item)
i = ClusterOutput(list_item_7)

# ==== cluster PlaneMaker_2
base_curve = ClusterInput()
base_curve_2 = Curve(base_curve)
curvature = Curvature(Curve=base_curve_2, Parameter="0")  # -> Point, Curvature, Curvature_2
end_points = EndPoints(Curve=base_curve_2)  # -> Start, End
area = Area(Geometry=curvature.Curvature_2)  # -> Area, Centroid
plane_3pt = Plane3Pt(PointA=end_points.Start, PointB=area.Centroid, PointC=end_points.End)
plane = ClusterOutput(plane_3pt)

# ==== cluster CurveSelector
curve = ClusterInput()
D = ClusterInput()
flip_curve = FlipCurve(Curve=curve)  # -> Curve, Flag
divdist = DivideDistance(Curve=flip_curve.Curve, Distance=D)  # -> Points, Tangents, Parameters
shatter = Shatter(Curve=flip_curve.Curve, Parameters=divdist.Parameters)
cull_i = CullIndex(List=shatter, Indices=0, Wrap=True)
item = ListItem(List=shatter, Index=0, Wrap=True)
join = JoinCurves(Curves=cull_i, Preserve=False)
i = ClusterOutput(item)
C = ClusterOutput(join)

# ==== cluster MindStoneCurve
remainer_of_curve = ClusterInput()
remainer_of_curve_2 = Curve(remainer_of_curve)
D = ClusterInput()
divdist = DivideDistance(Curve=remainer_of_curve_2, Distance=D)  # -> Points, Tangents, Parameters
shatter = Shatter(Curve=remainer_of_curve_2, Parameters=divdist.Parameters)
cull_i = CullIndex(List=shatter, Indices=-1, Wrap=True)
join_curves = JoinCurves(Curves=cull_i, Preserve=False)
S = ClusterOutput(shatter)
L = ClusterOutput(cull_i)
length = Length(Curve=join_curves)
length_2 = ClusterOutput(length)

# ==== cluster MidStoneCrossSectionMaker
curve = ClusterInput()
A = ClusterInput()
curve_2 = Curve(curve)
division = Division(A=A, B=2)
neg = Negative(Value=division)
P = ClusterInput()
num = Number([division, neg])
lng = ListLength(List=curve_2)
offset = OffsetCurve(Curve=curve_2, Distance=graft(num), Plane=P, Corners=1)
eval = EvaluateLength(Curve=flatten(curve_2), Length="0.1", Normalized=True)  # -> Point, Tangent, Parameter
split = SplitList(List=flatten(offset), Index=lng)  # -> flatten(ListA), flatten(ListB)
L = ClusterInput()
item = ListItem(List=flatten(eval.Parameter), Index=0, Wrap=True)  # -> Item1, Item, Item1_2
item_2 = ListItem(List=L, Index=-2, Wrap=True)
top_curves = Curve(split.ListA)
bottom_curves = Curve(split.ListB)
multiplication = Multiplication(A=item.Item1, B=0.1)
subtraction = Subtraction(A=lng, B=1)
end = EndPoints(Curve=top_curves)  # -> Start, End
end_2 = EndPoints(Curve=bottom_curves)  # -> Start, End
ext = ExtendCurve(Curve=item_2, Type=1, Start="0", End=expr("x*-1", multiplication))
item_3 = ListItem(List=[end.End, end_2.End], Index=["-1", subtraction], Wrap=True)  # -> flatten(Item)
end_3 = EndPoints(Curve=ext)  # -> Start, End
item_4 = ListItem(List=item_3, Index=0, Wrap=True)  # -> Item, Item1
merge = Merge(Data1=flatten(eval.Point), Data2=flatten(end_3.End))  # -> graft(Result)
merge_2 = Merge(Data1=flatten(end.Start), Data2=flatten(item_4.Item))  # -> graft(Result)
merge_3 = Merge(Data1=flatten(end_2.Start), Data2=flatten(item_4.Item1))  # -> graft(Result)
pline = PolyLine(Vertices=[merge_2, merge, merge_3], Closed=False)  # -> flatten(Polyline)
weave = Weave(Pattern=[0, 1], Stream0=top_curves, Stream1=bottom_curves, NullGaps=False)
shift = ShiftList(List=pline, Shift=1, Wrap=True)  # -> flatten(List)
pl = ClusterOutput(pline)
partition = PartitionList(List=weave, Size="2")
merge_4 = Merge(Data1=partition, Data2=graft(pline), Data3=graft(shift))
cull_i = CullIndex(List=shift, Indices="-1", Wrap=True)
join = JoinCurves(Curves=merge_4, Preserve=False)  # -> flatten(Curves)
C = ClusterOutput(join)

# ==== cluster Cluster_3
E = ClusterInput()
boundary = BoundarySurfaces(Edges=E)
list_item = ListItem(List=boundary, Index=0, Wrap=True)
A = ClusterInput()
P = ClusterInput()
division = Division(A=A, B=2)
deplane = DeconstructPlane(Plane=P)  # -> Origin, XAxis, YAxis, ZAxis
flip = Flip(Surface=boundary, Guide=list_item)  # -> Surface, Result
multiplication = Multiplication(A=division, B=deplane.ZAxis)  # -> flatten(Result)
offset = OffsetSurface(Surface=flip.Surface, Distance=multiplication, Retrim=Toggle(True))
multiplication_2 = Multiplication(A=multiplication, B=-2)
extr = Extrude(Base=offset, Direction=multiplication_2)
E_2 = ClusterOutput(extr)

# ==== cluster StartingStoneCrossSectionMaker
A = ClusterInput()
division = Division(A=A, B=2)
neg = Negative(Value=division)
C = ClusterInput()
P = ClusterInput()
num = Number([division, neg])
offset = OffsetCurve(Curve=C, Distance=num, Plane=P, Corners=1)
C_2 = ClusterInput()
item = ListItem(List=flatten(offset), Index=0, Wrap=True)  # -> Item, Item1
end = EndPoints(Curve=C_2)  # -> Start, End
A_2 = ClusterInput()
ln = Line(StartPoint=A_2, EndPoint=end.End)
curvature = Curvature(Curve=item.Item, Parameter=0)  # -> P, K, C
ext = ExtendCurve(Curve=ln, Type=0, Start="0", End=flatten(item.Item))
L = ClusterInput()
ccx = CurveCurve(CurveA=flatten([item.Item1, curvature.C]), CurveB=ext)  # -> flatten(Points), ParamsA, ParamsB
item_2 = ListItem(List=L, Index=0, Wrap=True)
end_2 = EndPoints(Curve=item_2)  # -> Start, End
pline = PolyLine(Vertices=[end_2.End, ccx.Points, end_2.Start], Closed=False)
join = JoinCurves(Curves=[pline, item_2], Preserve=False)
C_3 = ClusterOutput(join)

# ==== cluster ConStartStoneCurve
curve = ClusterInput()
D = ClusterInput()
curve_2 = Curve(curve)
divdist = DivideDistance(Curve=curve_2, Distance=D)  # -> Points, Tangents, Parameters
shatter = Shatter(Curve=curve_2, Parameters=divdist.Parameters)
cull_i = CullIndex(List=shatter, Indices=0, Wrap=True)
item = ListItem(List=shatter, Index=0, Wrap=True)
join = JoinCurves(Curves=cull_i, Preserve=False)
i = ClusterOutput(item)
C = ClusterOutput(join)

# ==== cluster EndStoneRemover
curve = ClusterInput()
tree = ClusterInput()
curve_2 = Curve(curve)
simplify_tree = SimplifyTree(Tree=tree, Front=False)  # -> flatten(Tree)
brep_curve = BrepCurve(Brep=flatten(simplify_tree), Curve=curve_2)  # -> Curves, flatten(Points)
curve_closest_point = CurveClosestPoint(Point=brep_curve.Points, Curve=curve_2)  # -> Point, Parameter, Distance
D = ClusterInput()
shatter = Shatter(Curve=curve_2, Parameters=curve_closest_point.Parameter)
list_item = ListItem(List=shatter, Index=0, Wrap=True)
flip = FlipCurve(Curve=list_item)  # -> Curve, Flag
divdist = DivideDistance(Curve=flip.Curve, Distance=D)  # -> Points, Tangents, Parameters
shatter_2 = Shatter(Curve=flip.Curve, Parameters=divdist.Parameters)
cull_i = CullIndex(List=shatter_2, Indices=0, Wrap=True)
flip_2 = FlipCurve(Curve=cull_i)  # -> Curve, Flag
join = JoinCurves(Curves=flip_2.Curve, Preserve=False)
C = ClusterOutput(join)

# ==== cluster MidStoneCrossSectionMaker_2
A = ClusterInput()
curve = ClusterInput()
division = Division(A=A, B=2)
curve_2 = Curve(curve)
neg = Negative(Value=division)
P = ClusterInput()
num = Number([division, neg])
lng = ListLength(List=curve_2)
offset = OffsetCurve(Curve=curve_2, Distance=graft(num), Plane=P, Corners=1)
eval = EvaluateLength(Curve=flatten(curve_2), Length="0.1", Normalized=True)  # -> Point, Tangent, Parameter
split = SplitList(List=flatten(offset), Index=lng)  # -> flatten(ListA), flatten(ListB)
L = ClusterInput()
item = ListItem(List=flatten(eval.Parameter), Index=0, Wrap=True)  # -> Item1, Item, Item1_2
item_2 = ListItem(List=L, Index=-2, Wrap=True)
top_curves = Curve(split.ListA)
bottom_curves = Curve(split.ListB)
multiplication = Multiplication(A=item.Item1, B=0.1)
subtraction = Subtraction(A=lng, B=1)
end = EndPoints(Curve=top_curves)  # -> Start, End
end_2 = EndPoints(Curve=bottom_curves)  # -> Start, End
ext = ExtendCurve(Curve=item_2, Type=1, Start="0", End=multiplication)
item_3 = ListItem(List=[end.End, end_2.End], Index=["-1", subtraction], Wrap=True)  # -> flatten(Item)
end_3 = EndPoints(Curve=ext)  # -> Start, End
item_4 = ListItem(List=item_3, Index=0, Wrap=True)  # -> Item, Item1
merge = Merge(Data1=flatten(eval.Point), Data2=flatten(end_3.End))  # -> graft(Result)
merge_2 = Merge(Data1=flatten(end.Start), Data2=flatten(item_4.Item))  # -> graft(Result)
merge_3 = Merge(Data1=flatten(end_2.Start), Data2=flatten(item_4.Item1))  # -> graft(Result)
pline = PolyLine(Vertices=[merge_2, merge, merge_3], Closed=False)  # -> flatten(Polyline)
weave = Weave(Pattern=[0, 1], Stream0=top_curves, Stream1=bottom_curves, NullGaps=False)
shift = ShiftList(List=pline, Shift=1, Wrap=True)  # -> flatten(List)
pl = ClusterOutput(pline)
partition = PartitionList(List=weave, Size="2")
merge_4 = Merge(Data1=partition, Data2=graft(pline), Data3=graft(shift))
cull_i = CullIndex(List=shift, Indices="-1", Wrap=True)
join = JoinCurves(Curves=merge_4, Preserve=False)  # -> flatten(Curves)
C = ClusterOutput(join)

# ==== cluster Cluster_4
E = ClusterInput()
boundary = BoundarySurfaces(Edges=E)
list_item = ListItem(List=boundary, Index=0, Wrap=True)
A = ClusterInput()
division = Division(A=A, B=2)
flip = Flip(Surface=boundary, Guide=list_item)  # -> Surface, Result
plane = ClusterInput()
flip_plane = FlipPlane(Plane=plane, FlipX=False, FlipY=False, FlipZ=True)  # -> Flipped, ResultBoolean
deplane = DeconstructPlane(Plane=flip_plane.Flipped)  # -> Origin, XAxis, YAxis, ZAxis
multiplication = Multiplication(A=division, B=deplane.ZAxis)  # -> flatten(Result)
offset = OffsetSurface(Surface=flip.Surface, Distance=multiplication, Retrim=Toggle(True))
multiplication_2 = Multiplication(A=multiplication, B=-2)
extr = Extrude(Base=offset, Direction=multiplication_2)
E_2 = ClusterOutput(extr)

# ==== cluster EndStoneCurve
curve = ClusterInput()
list = ClusterInput()
curve_2 = Curve(curve)
list_item = ListItem(List=list, Index=0, Wrap=True)  # -> Item1, Item
deconstruct_brep = DeconstructBrep(Brep=list_item.Item1)  # -> Faces, Edges, Vertices
list_item_2 = ListItem(List=deconstruct_brep.Edges, Index="15", Wrap=True)
curve_curve = CurveCurve(CurveA=list_item_2, CurveB=curve_2)  # -> Points, ParamsA, ParamsB
curve_closest_point = CurveClosestPoint(Point=curve_curve.Points, Curve=curve_2)  # -> Point, Parameter, Distance
shatter = Shatter(Curve=curve_2, Parameters=curve_closest_point.Parameter)
list_item_3 = ListItem(List=shatter, Index=0, Wrap=True)  # -> Item1, Item
item_1 = ClusterOutput(list_item_3.Item1)

# ==== cluster StoneClipper
brep = ClusterInput()
deconstruct_brep = DeconstructBrep(Brep=brep)  # -> Faces, Edges, Vertices
list_item = ListItem(List=deconstruct_brep.Edges, Index=0, Wrap=True)
extend_curve = ExtendCurve(Curve=list_item, Type=0, Start="1", End="1")
offset_curve = OffsetCurve(Curve=extend_curve, Plane=PlaneXY(0, 0, 0), Distance=1, BothSides=True, Kinks=0, CapType=1)
surface = Surface(offset_curve)
brep_2 = ClusterInput()
split_brep = SplitBrep(Brep=brep_2, Cutter=surface)
list_item_2 = ListItem(List=split_brep, Index=0, Wrap=True)
cap_holes = CapHoles(Brep=list_item_2)
brep_3 = ClusterOutput(cap_holes)

# ==== cluster EndStoneCrossSection
brep = ClusterInput()
A = ClusterInput()
curve = ClusterInput()
division = Division(A=A, B=2)
brep_2 = Brep(flatten(brep))
neg = Negative(Value=division)
curve_2 = Curve(curve)
P = ClusterInput()
num = Number([division, neg])
offset = OffsetCurve(Curve=curve_2, Distance=graft(num), Plane=P, Corners=1)  # -> flatten(Curve)
extend_curve = ExtendCurve(Curve=offset, Type=1, Start="1", End="1")
list = ClusterInput()
list_item = ListItem(List=list, Index=0, Wrap=True)  # -> Item1, Item
curve_3 = Curve(list_item.Item1)
list_item_2 = ListItem(List=extend_curve, Index=0, Wrap=True)  # -> Item, Item1
multiple_curves = MultipleCurves(Curves=[extend_curve, curve_3])  # -> Points, IndexA, IndexB, ParamA, ParamB
end_points = EndPoints(Curve=curve_3)  # -> Start, End
curve_closest_point = CurveClosestPoint(Point=end_points.Start, Curve=list_item_2.Item)  # -> Point, Parameter, Distance
curve_closest_point_2 = CurveClosestPoint(Point=end_points.End, Curve=list_item_2.Item1)  # -> Point, Parameter, Distance
shatter = Shatter(Curve=list_item_2.Item, Parameters=curve_closest_point.Parameter)  # -> flatten(Segments)
shatter_2 = Shatter(Curve=list_item_2.Item1, Parameters=curve_closest_point_2.Parameter)  # -> flatten(Segments)
list_item_3 = ListItem(List=shatter, Index="1", Wrap=True)
list_item_4 = ListItem(List=shatter_2, Index="1", Wrap=True)
end_points_2 = EndPoints(Curve=list_item_3)  # -> Start, End
end_points_3 = EndPoints(Curve=list_item_4)  # -> Start, End
line = Line(StartPoint=end_points_2.End, EndPoint=end_points_3.End)
join_curves = JoinCurves(Curves=[curve_3, line, list_item_3, list_item_4], Preserve=False)
curves = ClusterOutput(join_curves)

# ==== cluster StoneClipper_2
brep = ClusterInput()
deconstruct_brep = DeconstructBrep(Brep=brep)  # -> Faces, Edges, Vertices
list_item = ListItem(List=deconstruct_brep.Edges, Index=0, Wrap=True)  # -> Item, Item1, Item2
extend_curve = ExtendCurve(Curve=list_item.Item2, Type=0, Start="1", End="1")
offset_curve = OffsetCurve(Curve=extend_curve, Plane=PlaneXY(0, 0, 0), Distance=1, BothSides=True, Kinks=0, CapType=1)
surface = Surface(offset_curve)
brep_2 = ClusterInput()
split_brep = SplitBrep(Brep=brep_2, Cutter=surface)
list_item_2 = ListItem(List=split_brep, Index=0, Wrap=True)  # -> Item1, Item
cap_holes = CapHoles(Brep=list_item_2.Item1)
brep_3 = ClusterOutput(cap_holes)

# ==== cluster MiddleStoneCreator
curve = ClusterInput()
curve_2 = Curve(curve)
list = ClusterInput()
list_2 = ClusterInput()
list_3 = ClusterInput()
list_item = ListItem(List=list, Index=0, Wrap=True)  # -> Item1, Item
list_item_2 = ListItem(List=list_2, Index=0, Wrap=True)
list_item_3 = ListItem(List=list_3, Index=0, Wrap=True)
extend_curve = ExtendCurve(Curve=curve_2, Type=0, Start="2", End="2")
offset_curve = OffsetCurve(Curve=extend_curve, Plane=PlaneXY(0, 0, 0), Distance=1, BothSides=True, Kinks=0, CapType=1)
end_points = EndPoints(Curve=curve_2)  # -> Start, End
split_brep = SplitBrep(Brep=[list_item_3, list_item_2], Cutter=offset_curve)
point = Point(end_points.Start)
list_item_4 = ListItem(List=split_brep, Index=0, Wrap=True)
list_item_5 = ListItem(List=flatten(list_item_4), Index=0, Wrap=True)  # -> Item, Item1
cap_holes = CapHoles(Brep=list_item_5.Item)
cap_holes_2 = CapHoles(Brep=list_item_5.Item1)
list_4 = ClusterInput()
list_5 = ClusterInput()
replace_items = ReplaceItems(List=list_4, Item=cap_holes, Indices=0, Wrap=False)
replace_items_2 = ReplaceItems(List=list_5, Item=cap_holes_2, Indices=0, Wrap=False)
list_6 = ClusterOutput(replace_items)
list_7 = ClusterOutput(replace_items_2)
deconstruct_brep = DeconstructBrep(Brep=list_item.Item1)  # -> Faces, Edges, Vertices
deconstruct_brep_2 = DeconstructBrep(Brep=cap_holes)  # -> Faces, Edges, Vertices
deconstruct_brep_3 = DeconstructBrep(Brep=cap_holes_2)  # -> Faces, Edges, Vertices
distance = Distance(PointA=deconstruct_brep.Vertices, PointB=point)
distance_2 = Distance(PointA=deconstruct_brep_2.Vertices, PointB=point)
distance_3 = Distance(PointA=deconstruct_brep_3.Vertices, PointB=point)
sort_list = SortList(Keys=flatten(distance), ValuesValuesA=flatten(deconstruct_brep.Vertices))  # -> Keys, ValuesValuesA
sort_list_2 = SortList(Keys=flatten(distance_2), ValuesValuesA=flatten(deconstruct_brep_2.Vertices))  # -> Keys, ValuesValuesA
sort_list_3 = SortList(Keys=flatten(distance_3), ValuesValuesA=flatten(deconstruct_brep_3.Vertices))  # -> Keys, ValuesValuesA
list_item_6 = ListItem(List=sort_list.ValuesValuesA, Index=0, Wrap=True)  # -> Item, Item1, Item2, Item3, Item4, Item5
list_item_7 = ListItem(List=sort_list_2.ValuesValuesA, Index=0, Wrap=True)  # -> Item, Item1, Item2, Item3, Item4, Item5, Item6
list_item_8 = ListItem(List=sort_list_3.ValuesValuesA, Index=0, Wrap=True)  # -> Item, Item1, Item2, Item3, Item4, Item5, Item6
point_2 = Point([list_item_6.Item, list_item_6.Item1])
point_3 = Point([list_item_6.Item2, list_item_6.Item3])
point_4 = Point([list_item_6.Item4, list_item_6.Item5])
point_5 = Point([list_item_7.Item, list_item_7.Item1])
point_6 = Point([list_item_7.Item6, list_item_7.Item3])
point_7 = Point([list_item_7.Item4, list_item_7.Item5])
point_8 = Point([list_item_8.Item3, list_item_8.Item6])
point_9 = Point([list_item_8.Item4, list_item_8.Item5])
point_10 = Point([list_item_8.Item, list_item_8.Item2])
reverse_list = ReverseList(List=point_4)
point_11 = Point(flatten([reverse_list, point_6, point_8]))
reverse_list_2 = ReverseList(List=point_3)
point_12 = Point([reverse_list_2, point_7, point_9])
reverse_list_3 = ReverseList(List=point_2)
point_13 = Point([reverse_list_3, point_5, point_10])
mass_addition = MassAddition(Input=point_12)  # -> Result, PartialResults
list_length = ListLength(List=point_12)
division = Division(A=mass_addition.Result, B=list_length)
mass_addition_2 = MassAddition(Input=point_11)  # -> Result, PartialResults
list_length_2 = ListLength(List=point_11)
shift_list = ShiftList(List=flatten(point_12), Shift=1, Wrap=True)  # -> flatten(List)
point_14 = Point(flatten(division))
point_15 = Point(flatten(point_12))
duplicate_data = DuplicateData(Data=flatten(point_14), Number=list_length, Order=True)  # -> flatten(Data)
division_2 = Division(A=mass_addition_2.Result, B=list_length_2)
point_16 = Point(graft(shift_list))
point_17 = Point(graft(point_15))
point_18 = Point(graft(duplicate_data))
shift_list_2 = ShiftList(List=flatten(point_11), Shift=1, Wrap=True)  # -> flatten(List)
polyline = PolyLine(Vertices=[point_18, point_17, point_16], Closed=True)  # -> flatten(Polyline)
point_19 = Point(flatten(division_2))
point_20 = Point(flatten(point_11))
duplicate_data_2 = DuplicateData(Data=flatten(point_19), Number=list_length_2, Order=True)  # -> flatten(Data)
point_21 = Point(graft(shift_list_2))
polyline_2 = PolyLine(Vertices=point_13, Closed=True)
polyline_3 = PolyLine(Vertices=point_11, Closed=True)
polyline_4 = PolyLine(Vertices=point_12, Closed=True)
point_22 = Point(graft(point_20))
point_23 = Point(graft(duplicate_data_2))
boundary_surfaces = BoundarySurfaces(Edges=polyline)
polyline_5 = PolyLine(Vertices=[point_23, point_22, point_21], Closed=True)  # -> flatten(Polyline)
loft = Loft(
    Curves=[polyline_3, polyline_2, polyline_4],
    Options={Adjust=False, Closed=False, LoftEnds=0, LoftSimp=0, LoftType=3, Rebuild=10, Refit=0.01})
boundary_surfaces_2 = BoundarySurfaces(Edges=polyline_5)
brep_join = BrepJoin(Breps=flatten([boundary_surfaces_2, loft, boundary_surfaces]))  # -> Breps, Closed
breps = ClusterOutput(brep_join.Breps)

# ==== cluster Cluster_5
curve = ClusterInput()
list = ClusterInput()
curve_2 = Curve(curve)
list_item = ListItem(List=list, Index=0, Wrap=True)  # -> Item1, Item
deconstruct_brep = DeconstructBrep(Brep=list_item.Item1)  # -> Faces, Edges, Vertices
list_item_2 = ListItem(List=deconstruct_brep.Edges, Index="8", Wrap=True)
curve_curve = CurveCurve(CurveA=list_item_2, CurveB=curve_2)  # -> Points, ParamsA, ParamsB
curve_closest_point = CurveClosestPoint(Point=curve_curve.Points, Curve=curve_2)  # -> Point, Parameter, Distance
shatter = Shatter(Curve=curve_2, Parameters=curve_closest_point.Parameter)
list_item_3 = ListItem(List=shatter, Index=0, Wrap=True)  # -> Item1, Item
item_1 = ClusterOutput(list_item_3.Item1)

# ==== cluster SecondairyRibsInfillMaker
surface_horizontal = ClusterInput()
block_width = ClusterInput()
surface_horizontal_2 = Surface(surface_horizontal)
block_width_2 = Data(block_width)
brick_depth = ClusterInput()
brick_height = ClusterInput()
brick_width = ClusterInput()
negative = Negative(Value=block_width_2)
surface = ClusterInput()
negative_2 = Negative(Value=block_width_2)
negative_3 = Negative(Value=block_width_2)
brick_depth_2 = Data(brick_depth)
brick_height_2 = Data(brick_height)
brick_width_2 = Data(brick_width)
surface_2 = Surface(surface)
division = Division(A=[block_width_2, negative], B=2)
division_2 = Division(A=[block_width_2, negative_2], B=2)
division_3 = Division(A=[block_width_2, negative_3], B=2)
curve = ClusterInput()
curve_2 = ClusterInput()
curve_3 = ClusterInput()
offset_on_srf = OffsetOnSrf(Curve=curve, Distance=division, Surface=surface_horizontal_2)  # -> flatten(Curve)
B = ClusterInput()
offset_on_srf_2 = OffsetOnSrf(Curve=curve_2, Distance=division_2, Surface=surface_horizontal_2)  # -> flatten(Curve)
deconstruct_brep = DeconstructBrep(Brep=surface_2)  # -> Faces, Edges, Vertices
offset_on_srf_3 = OffsetOnSrf(Curve=curve_3, Distance=division_3, Surface=surface_horizontal_2)  # -> flatten(Curve)
list_item = ListItem(List=deconstruct_brep.Edges, Index=0, Wrap=True)  # -> Item, Item1, Item2, Item3
list_item_2 = ListItem(List=offset_on_srf, Index=0, Wrap=True)  # -> Item, Item1
list_item_3 = ListItem(List=offset_on_srf_3, Index=0, Wrap=True)  # -> Item, Item1
list_item_4 = ListItem(List=offset_on_srf_2, Index=0, Wrap=True)  # -> Item, Item1
extend_curve = ExtendCurve(Curve=list_item_2.Item, Type=1, Start="0", End="1")
extend_curve_2 = ExtendCurve(Curve=list_item_3.Item, Type=1, Start="0", End="1")
extend_curve_3 = ExtendCurve(Curve=list_item_4.Item1, Type=1, Start="0", End="1")
curve_4 = Curve(list_item.Item)
curve_5 = Curve(list_item.Item2)
curve_6 = Curve(list_item.Item3)
curve_curve = CurveCurve(CurveA=list_item_2.Item1, CurveB=list_item_4.Item)  # -> Points, ParamsA, ParamsB
curve_curve_2 = CurveCurve(CurveA=extend_curve, CurveB=list_item_3.Item1)  # -> Points, ParamsA, ParamsB
curve_curve_3 = CurveCurve(CurveA=extend_curve_2, CurveB=extend_curve_3)  # -> Points, ParamsA, ParamsB
length = Length(Curve=curve_5)
division_4 = Division(A=length, B=B)
round = Round(Number=division_4)  # -> Nearest, Floor, Ceiling
construct_domain = ConstructDomain(DomainStart="0", DomainEnd=length)
range = Range(Domain=construct_domain, Steps=round.Floor)
deconstruct_brep_2 = DeconstructBrep(Brep=surface_2)  # -> Faces, Edges, Vertices
offset_on_srf_4 = OffsetOnSrf(Curve=curve_6, Distance=range, Surface=surface_2)  # -> flatten(Curve)
curve_closest_point = CurveClosestPoint(Point=curve_curve.Points, Curve=list_item_4.Item)  # -> Point, Parameter, Distance
curve_closest_point_2 = CurveClosestPoint(Point=curve_curve.Points, Curve=list_item_2.Item1)  # -> Point, Parameter, Distance
curve_closest_point_3 = CurveClosestPoint(Point=curve_curve_2.Points, Curve=extend_curve)  # -> Point, Parameter, Distance
curve_closest_point_4 = CurveClosestPoint(Point=curve_curve_2.Points, Curve=list_item_3.Item1)  # -> Point, Parameter, Distance
curve_closest_point_5 = CurveClosestPoint(Point=curve_curve_3.Points, Curve=extend_curve_2)  # -> Point, Parameter, Distance
curve_closest_point_6 = CurveClosestPoint(Point=curve_curve_3.Points, Curve=extend_curve_3)  # -> Point, Parameter, Distance
list_item_5 = ListItem(List=deconstruct_brep_2.Edges, Index=0, Wrap=True)  # -> Item, Item1, Item2, Item3
shatter = Shatter(Curve=list_item_4.Item, Parameters=curve_closest_point.Parameter)
shatter_2 = Shatter(Curve=list_item_2.Item1, Parameters=curve_closest_point_2.Parameter)
shatter_3 = Shatter(Curve=extend_curve, Parameters=curve_closest_point_3.Parameter)
shatter_4 = Shatter(Curve=list_item_3.Item1, Parameters=curve_closest_point_4.Parameter)
shatter_5 = Shatter(Curve=extend_curve_2, Parameters=curve_closest_point_5.Parameter)
shatter_6 = Shatter(Curve=extend_curve_3, Parameters=curve_closest_point_6.Parameter)
curve_7 = Curve(list_item_5.Item)
curve_8 = Curve(list_item_5.Item2)
extremes = Extremes(Curve=curve_8, Plane=PlaneXY(0, 0, 0))  # -> Highest, Lowest
list_item_6 = ListItem(List=shatter, Index=1, Wrap=True)
list_item_7 = ListItem(List=shatter_2, Index=1, Wrap=True)
list_item_8 = ListItem(List=shatter_3, Index=1, Wrap=True)
list_item_9 = ListItem(List=shatter_4, Index=1, Wrap=True)
list_item_10 = ListItem(List=shatter_5, Index=1, Wrap=True)
list_item_11 = ListItem(List=shatter_6, Index=1, Wrap=True)
# Creates a point in the center of the arc to orient the brick from
deconstruct = Deconstruct(Point=extremes.Highest)  # -> XComponent, YComponent, ZComponent
deconstruct_2 = Deconstruct(Point=extremes.Lowest)  # -> XComponent, YComponent, ZComponent
join_curves = JoinCurves(Curves=[list_item_6, list_item_7], Preserve=False)
join_curves_2 = JoinCurves(Curves=[list_item_8, list_item_9], Preserve=False)
join_curves_3 = JoinCurves(Curves=[list_item_10, list_item_11], Preserve=False)
project = Project(Curve=[join_curves, join_curves_2, join_curves_3], Brep=surface_horizontal_2, Direction=Vector(0, 0, 1))  # -> flatten(Curve)
offset_curve_from_surface = OffsetCurveFromSurface(Curve=flatten(project), Surface=flatten(surface_horizontal_2), Distance=1, BothSides=True, CapType=1)
construct_point = ConstructPoint(XCoordinate=deconstruct.XComponent, YCoordinate=deconstruct.YComponent, ZCoordinate=deconstruct_2.ZComponent)
surface_split = SurfaceSplit(Surface=surface_horizontal_2, Curves=project)
explode = Explode(Curve=offset_curve_from_surface, Recursive=True)  # -> Segments, Vertices
cull_index = CullIndex(List=surface_split, Indices=0, Wrap=True)  # -> flatten(List)
end_points = EndPoints(Curve=flatten(explode.Segments))  # -> Start, End
list_item_12 = ListItem(List=cull_index, Index=0, Wrap=True)  # -> Item, Item1, Item2
panel = Panel("""2
12
25""")
panel_2 = Panel("""7
19
32""")
project_2 = Project(Curve=offset_on_srf_4, Brep=list_item_12.Item1, Direction=Vector(0, 0, 1))
project_3 = Project(Curve=offset_on_srf_4, Brep=list_item_12.Item, Direction=Vector(0, 0, 1))
project_4 = Project(Curve=offset_on_srf_4, Brep=list_item_12.Item2, Direction=Vector(0, 0, 1))
list_item_13 = ListItem(List=end_points.Start, Index=panel, Wrap=True)
list_item_14 = ListItem(List=end_points.Start, Index=panel_2, Wrap=True)
flip_curve = FlipCurve(Curve=project_2, Guide=curve_6)  # -> Curve, Flag
line = Line(StartPoint=list_item_14, EndPoint=list_item_13)
multiplication = Multiplication(A=brick_width_2, B=2)
list_item_15 = ListItem(List=flatten(offset_curve_from_surface), Index=0, Wrap=True)  # -> Item, Item1, Item2
list_item_16 = ListItem(List=line, Index=0, Wrap=True)  # -> Item, Item1, Item2
flip_curve_2 = FlipCurve(Curve=project_4, Guide=curve_6)  # -> Curve, Flag
divide_length = DivideLength(Curve=flip_curve.Curve, Length=multiplication)  # -> Points, Tangents, flatten(Parameters)
flip_curve_3 = FlipCurve(Curve=project_3, Guide=curve_6)  # -> Curve, Flag
multiplication_2 = Multiplication(A=brick_width_2, B=2)
multiplication_3 = Multiplication(A=brick_width_2, B=2)
list_length = ListLength(List=flatten(project_2))
divide_length_2 = DivideLength(Curve=flip_curve_2.Curve, Length=multiplication_2)  # -> Points, Tangents, flatten(Parameters)
center_box = CenterBox(Base=construct_point, X=brick_width_2, Y=brick_depth_2, Z=brick_height_2)
divide_length_3 = DivideLength(Curve=flip_curve_3.Curve, Length=multiplication_3)  # -> Points, Tangents, flatten(Parameters)
simplify_tree = SimplifyTree(Tree=divide_length.Points, Front=False)
list_length_2 = ListLength(List=flatten(project_4))
construct_point_2 = ConstructPoint(XCoordinate="1", YCoordinate=0, ZCoordinate=0)
curve_curve_4 = CurveCurve(CurveA=list_item_15.Item1, CurveB=list_item_16.Item1)  # -> flatten(Points), ParamsA, ParamsB
curve_curve_5 = CurveCurve(CurveA=list_item_15.Item2, CurveB=list_item_16.Item2)  # -> flatten(Points), ParamsA, ParamsB
curve_curve_6 = CurveCurve(CurveA=list_item_15.Item, CurveB=list_item_16.Item)  # -> flatten(Points), ParamsA, ParamsB
center_box_2 = CenterBox(Base=construct_point, X=brick_width_2, Y=brick_depth_2, Z=brick_height_2)
list_length_3 = ListLength(List=flatten(project_3))
simplify_tree_2 = SimplifyTree(Tree=divide_length_2.Points, Front=False)
center_box_3 = CenterBox(Base=construct_point, X=brick_width_2, Y=brick_depth_2, Z=brick_height_2)
simplify_tree_3 = SimplifyTree(Tree=divide_length_3.Points, Front=False)
construct_point_3 = ConstructPoint(XCoordinate="1", YCoordinate=0, ZCoordinate=0)
list_item_17 = ListItem(List=simplify_tree, Index=0, Wrap=True)  # -> Item, Item1
construct_point_4 = ConstructPoint(XCoordinate="1", YCoordinate=0, ZCoordinate=0)
duplicate_data = DuplicateData(Data=construct_point_3, Number=list_length_2, Order=True)
duplicate_data_2 = DuplicateData(Data=construct_point_4, Number=list_length_3, Order=True)
flip_matrix = FlipMatrix(Data=simplify_tree)
duplicate_data_3 = DuplicateData(Data=construct_point_2, Number=list_length, Order=True)
list_item_18 = ListItem(List=simplify_tree_2, Index=0, Wrap=True)  # -> Item, Item1
curve_closest_point_7 = CurveClosestPoint(Point=curve_curve_4.Points, Curve=list_item_15.Item1)  # -> Point, Parameter, Distance
curve_closest_point_8 = CurveClosestPoint(Point=curve_curve_5.Points, Curve=list_item_15.Item2)  # -> Point, Parameter, Distance
curve_closest_point_9 = CurveClosestPoint(Point=curve_curve_6.Points, Curve=list_item_15.Item)  # -> Point, Parameter, Distance
list_item_19 = ListItem(List=simplify_tree_3, Index=0, Wrap=True)  # -> Item, Item1
clean_tree = CleanTree(RemoveNulls=True, RemoveInvalid=True, RemoveEmpty=True, Tree=flip_matrix)
flip_matrix_2 = FlipMatrix(Data=simplify_tree_2)
clean_tree_2 = CleanTree(RemoveNulls=True, RemoveInvalid=True, RemoveEmpty=True, Tree=list_item_17.Item)  # -> flatten(Tree)
clean_tree_3 = CleanTree(RemoveNulls=True, RemoveInvalid=True, RemoveEmpty=True, Tree=list_item_17.Item1)  # -> flatten(Tree)
flip_matrix_3 = FlipMatrix(Data=simplify_tree_3)
shatter_7 = Shatter(Curve=list_item_15.Item1, Parameters=curve_closest_point_7.Parameter)
shatter_8 = Shatter(Curve=list_item_15.Item2, Parameters=curve_closest_point_8.Parameter)
clean_tree_4 = CleanTree(RemoveNulls=True, RemoveInvalid=True, RemoveEmpty=True, Tree=flip_matrix_2)
shatter_9 = Shatter(Curve=list_item_15.Item, Parameters=curve_closest_point_9.Parameter)
list_length_4 = ListLength(List=clean_tree)  # -> flatten(Length)
clean_tree_5 = CleanTree(RemoveNulls=True, RemoveInvalid=True, RemoveEmpty=True, Tree=flip_matrix_3)
clean_tree_6 = CleanTree(RemoveNulls=True, RemoveInvalid=True, RemoveEmpty=True, Tree=list_item_18.Item)  # -> flatten(Tree)
clean_tree_7 = CleanTree(RemoveNulls=True, RemoveInvalid=True, RemoveEmpty=True, Tree=list_item_18.Item1)  # -> flatten(Tree)
clean_tree_8 = CleanTree(RemoveNulls=True, RemoveInvalid=True, RemoveEmpty=True, Tree=list_item_19.Item)  # -> flatten(Tree)
clean_tree_9 = CleanTree(RemoveNulls=True, RemoveInvalid=True, RemoveEmpty=True, Tree=list_item_19.Item1)  # -> flatten(Tree)
list_length_5 = ListLength(List=clean_tree_4)  # -> flatten(Length)
list_item_20 = ListItem(List=list_length_4, Index=0, Wrap=True)  # -> Item2, Item1, Item
split_list = SplitList(List=clean_tree_3, Index=list_item_20.Item)  # -> ListA, ListB
split_list_2 = SplitList(List=clean_tree_2, Index=list_item_20.Item)  # -> ListA, ListB
list_item_21 = ListItem(List=shatter_7, Index=0, Wrap=True)  # -> Item, Item1
list_item_22 = ListItem(List=shatter_8, Index=0, Wrap=True)  # -> Item, Item1
list_length_6 = ListLength(List=clean_tree_5)  # -> flatten(Length)
list_item_23 = ListItem(List=shatter_9, Index=0, Wrap=True)  # -> Item, Item1
panel_3 = Panel(list_length_4)
list_item_24 = ListItem(List=list_length_5, Index=0, Wrap=True)  # -> Item2, Item1, Item
split_list_3 = SplitList(List=clean_tree_6, Index=list_item_24.Item2)  # -> ListA, ListB
split_list_4 = SplitList(List=clean_tree_7, Index=list_item_24.Item2)  # -> ListA, ListB
list_item_25 = ListItem(List=list_length_6, Index=0, Wrap=True)  # -> Item1, Item
split_list_5 = SplitList(List=clean_tree_8, Index=list_item_25.Item1)  # -> ListA, ListB
split_list_6 = SplitList(List=clean_tree_9, Index=list_item_25.Item1)  # -> ListA, ListB
vector_2pt = Vector2Pt(PointA=split_list_2.ListA, PointB=split_list.ListA, Unitize=False)  # -> Vector, Length
split_list_7 = SplitList(List=vector_2pt.Vector, Index=list_length)  # -> ListA, ListB
join_curves_4 = JoinCurves(Curves=flatten([list_item_16.Item1, list_item_21.Item1]), Preserve=False)
join_curves_5 = JoinCurves(Curves=flatten([list_item_16.Item2, list_item_22.Item1]), Preserve=False)
join_curves_6 = JoinCurves(Curves=flatten([list_item_23.Item1, list_item_16.Item]), Preserve=False)
join_curves_7 = JoinCurves(Curves=flatten([list_item_16.Item1, list_item_21.Item]), Preserve=False)
join_curves_8 = JoinCurves(Curves=flatten([list_item_16.Item2, list_item_22.Item]), Preserve=False)
join_curves_9 = JoinCurves(Curves=flatten([list_item_23.Item, list_item_16.Item]), Preserve=False)
vector_2pt_2 = Vector2Pt(PointA=split_list_3.ListA, PointB=split_list_4.ListA, Unitize=False)  # -> Vector, Length
split_list_8 = SplitList(List=vector_2pt_2.Vector, Index=list_length_2)  # -> ListA, ListB
reverse = Reverse(Vector=split_list_8.ListA)
deconstruct_brep_3 = DeconstructBrep(Brep=center_box_2)  # -> Faces, Edges, Vertices
vector_2pt_3 = Vector2Pt(PointA=split_list_5.ListA, PointB=split_list_6.ListA, Unitize=False)  # -> Vector, Length
split_list_9 = SplitList(List=vector_2pt_3.Vector, Index=list_length_3)  # -> ListA, ListB
reverse_2 = Reverse(Vector=split_list_9.ListA)
construct_plane = ConstructPlane(Origin=flatten(list_item_19.Item), XAxis=duplicate_data_2, YAxis=reverse_2)  # -> flatten(Plane)
split_list_10 = SplitList(List=construct_plane, Index=list_item_25.Item1)  # -> ListA, ListB
move = Move(Geometry=split_list_10.ListA, Motion=vector_2pt_3.Vector)  # -> Geometry, Transform
vector_2pt_4 = Vector2Pt(PointA=construct_point, PointB=flatten(clean_tree_2), Unitize=False)  # -> Vector, Length
construct_plane_2 = ConstructPlane(Origin=clean_tree_2, XAxis=duplicate_data_3, YAxis=vector_2pt_4.Vector)  # -> flatten(Plane)
deconstruct_brep_4 = DeconstructBrep(Brep=center_box_3)  # -> Faces, Edges, Vertices
merge = Merge(Data1=split_list_10.ListA, Data2=split_list_10.ListB, Data3=move.Geometry)
patch = Patch(Curves=join_curves_7, Spans=10, Flexibility=10, Trim=True)
patch_2 = Patch(Curves=join_curves_4, Spans=10, Flexibility=1, Trim=True)
patch_3 = Patch(Curves=join_curves_8, Spans=10, Flexibility=10, Trim=True)
patch_4 = Patch(Curves=join_curves_5, Spans=10, Flexibility=1, Trim=True)
patch_5 = Patch(Curves=join_curves_9, Spans=10, Flexibility=10, Trim=True)
patch_6 = Patch(Curves=join_curves_6, Spans=10, Flexibility=1, Trim=True)
reverse_3 = Reverse(Vector=split_list_7.ListA)
list_item_26 = ListItem(List=deconstruct_brep_3.Vertices, Index=Slider(0, range=0..7), Wrap=True)
list_item_27 = ListItem(List=deconstruct_brep_4.Vertices, Index=Slider(0, range=0..7), Wrap=True)
split_list_11 = SplitList(List=construct_plane_2, Index=list_item_20.Item)  # -> ListA, ListB
construct_plane_3 = ConstructPlane(Origin=flatten(list_item_18.Item), XAxis=duplicate_data, YAxis=reverse)  # -> flatten(Plane)
split_list_12 = SplitList(List=construct_plane_3, Index=list_item_24.Item2)  # -> ListA, ListB
clean_tree_10 = CleanTree(RemoveNulls=True, RemoveInvalid=True, RemoveEmpty=True, Tree=split_list_12.ListB)
move_2 = Move(Geometry=split_list_12.ListA, Motion=vector_2pt_2.Vector)  # -> Geometry, Transform
cull_index_2 = CullIndex(List=clean_tree_10, Indices=-1, Wrap=True)
merge_2 = Merge(Data1=split_list_12.ListA, Data2=cull_index_2, Data3=move_2.Geometry)
orient = Orient(Geometry=center_box_2, Source=list_item_26, Target=merge_2)  # -> Geometry, Transform
deconstruct_brep_5 = DeconstructBrep(Brep=center_box)  # -> Faces, Edges, Vertices
top = Surface([patch_2, patch])
orient_2 = Orient(Geometry=center_box_3, Source=list_item_27, Target=merge)  # -> Geometry, Transform
top_2 = Surface([patch_3, patch_4])
extend_curve_4 = ExtendCurve(Curve=curve_7, Type=1, Start="1", End="1")
extend_curve_5 = ExtendCurve(Curve=curve_7, Type=1, Start="1", End="1")
move_3 = Move(Geometry=split_list_11.ListA, Motion=vector_2pt.Vector)  # -> Geometry, Transform
list_item_28 = ListItem(List=deconstruct_brep_5.Vertices, Index=Slider(0, range=0..7), Wrap=True)
merge_3 = Merge(Data1=split_list_11.ListA, Data3=move_3.Geometry)
offset_curve = OffsetCurve(Curve=extend_curve_5, Plane=PlaneXY(0, 0, 0), Distance=1, BothSides=True, Kinks=0, CapType=1)
split_brep_multiple = SplitBrepMultiple(Brep=flatten(orient.Geometry), Cutters=patch_5)
orient_3 = Orient(Geometry=center_box, Source=list_item_28, Target=merge_3)  # -> Geometry, Transform
split_brep_multiple_2 = SplitBrepMultiple(Brep=flatten(orient_2.Geometry), Cutters=offset_curve)
clean_tree_11 = CleanTree(RemoveNulls=True, RemoveInvalid=True, RemoveEmpty=True, Tree=split_brep_multiple)
clean_tree_12 = CleanTree(RemoveNulls=True, RemoveInvalid=True, RemoveEmpty=True, Tree=split_brep_multiple_2)
split_brep_multiple_3 = SplitBrepMultiple(Brep=flatten(orient_3.Geometry), Cutters=top_2)
list_item_29 = ListItem(List=clean_tree_11, Index=0, Wrap=True)  # -> Item, Item1, Item2
list_item_30 = ListItem(List=clean_tree_12, Index=0, Wrap=True)
clean_tree_13 = CleanTree(RemoveNulls=True, RemoveInvalid=True, RemoveEmpty=True, Tree=split_brep_multiple_3)
brep = Brep(list_item_29.Item1)
split_brep_multiple_4 = SplitBrepMultiple(Brep=flatten(brep), Cutters=patch_6)
clean_tree_14 = CleanTree(RemoveNulls=True, RemoveInvalid=True, RemoveEmpty=True, Tree=split_brep_multiple_4)
list_item_31 = ListItem(List=clean_tree_14, Index=0, Wrap=True)  # -> Item, Item1, Item2
item_2 = ClusterOutput(list_item_31.Item2)
i = ClusterOutput(list_item_30)
list_item_32 = ListItem(List=clean_tree_13, Index=0, Wrap=True)  # -> Item, Item1, Item2
brep_2 = Brep(list_item_32.Item)
extend_curve_6 = ExtendCurve(Curve=curve_7, Type=1, Start="1", End="1")
offset_curve_2 = OffsetCurve(Curve=extend_curve_6, Plane=PlaneXY(0, 0, 0), Distance=1, BothSides=True, Kinks=0, CapType=1)
split_brep_multiple_5 = SplitBrepMultiple(Brep=flatten(brep_2), Cutters=offset_curve_2)
clean_tree_15 = CleanTree(RemoveNulls=True, RemoveInvalid=True, RemoveEmpty=True, Tree=split_brep_multiple_5)
list_item_33 = ListItem(List=clean_tree_15, Index=0, Wrap=True)  # -> Item, Item1, Item2
i_2 = ClusterOutput(list_item_33.Item)

# ==== cluster Mirror
all_stones = ClusterInput()
all_stones_2 = Brep(all_stones)
all_stones_3 = Brep(all_stones_2)
P = ClusterInput()
mirror = Mirror(Geometry=all_stones_3, Plane=P)  # -> Geometry, Transform
merge = Merge(Data1=all_stones_3, Data2=mirror.Geometry)
P_2 = ClusterInput()
plane = ClusterInput()
mirror_2 = Mirror(Geometry=merge, Plane=P_2)  # -> Geometry, Transform
merge_2 = Merge(Data1=merge, Data2=mirror_2.Geometry)
mirror_3 = Mirror(Geometry=merge_2, Plane=plane)  # -> Geometry, Transform
merge_3 = Merge(Data1=merge_2, Data2=mirror_3.Geometry)
result = ClusterOutput(merge_3)

# ==== cluster _3DPrinter
brep = ClusterInput()
brep_2 = Brep(brep)
list_length = ListLength(List=brep_2)
division = Division(A=list_length, B=2)
rectangle = Rectangle(Plane=PlaneXY(0, 0, 0), XSize="-0.4 To 0.4", YSize="-0.4 To 0.4", Radius=0)  # -> Rectangle, Length
round = Round(Number=division)  # -> Nearest, Floor, Ceiling
geometry = ClusterInput()
rectangular_array = RectangularArray(Geometry=geometry, Cell=rectangle.Rectangle, XCount=round.Floor, YCount=round.Ceiling)  # -> Geometry, Transform
volume = Volume(Geometry=brep_2)  # -> Volume, Centroid
plane_normal = PlaneNormal(Origin=rectangular_array.Geometry, ZAxis=Vector(0, 0, 1))
orient = Orient(Geometry=brep_2, Source=volume.Centroid, Target=plane_normal)  # -> Geometry, Transform
geometry_2 = ClusterOutput(orient.Geometry)
