# Grasshopper definition tesselation_relaxer.gh (Grasshopper 1.0.7)
# plug-ins: Weaverbird, MetaHopper, Kangaroo2 Components

strenght_weak_anchor_points = Slider(0.025, range=0..1)
anchor_vault_openings = Curve(<curve referenced from the Rhino model>)
anchor_curves_strong = Curve(<curve referenced from the Rhino model>)
strenght_relaxation = Slider(2.4, range=0..50)
poly_lines_for_meshing = Curve([<curve referenced from the Rhino model> x32])

# ----
# Mesh maker 3000
group_toggle = GroupToggle(ToggleActive=True, ToggleVisible=False)  # disabled
weaverbird_s_tile = WeaverbirdsTile(MeshCurves=poly_lines_for_meshing, FillStrategy=1, OptIn=2)
weaverbird_s_constant_quads_split_subdiv = WeaverbirdsConstantQuadsSplitSubdivision(MeshCurves=weaverbird_s_tile, Level=Slider(2, range=0..10), SmoothNakedEdges=Slider(0, range=0..100))
byparent = ByParent(Mesh=weaverbird_s_constant_quads_split_subdiv, Level=1)
division = Division(A=strenght_relaxation, B=1000)
weld_mesh = WeldMesh(Mesh=flatten(byparent), Angle=3.141592654)
mesh = Mesh(weld_mesh)
nv = NakedVertices(Mesh=weld_mesh)  # -> ClothedIndex, NakedIndex, ClothedPts, NakedPts
crv_cp = CurveClosestPoint(Point=flatten(nv.NakedPts), Curve=graft(anchor_curves_strong))  # -> Point, Parameter, Distance
crv_cp_2 = CurveClosestPoint(Point=flatten(nv.NakedPts), Curve=graft(anchor_vault_openings))  # -> Point, Parameter, Distance
weld_mesh_2 = WeldMesh(Mesh=mesh, Angle=3.141592654)
smaller = SmallerThan(FirstNumber=crv_cp.Distance, SecondNumber=0.1)  # -> SmallerThan, OrEqualTo
smaller_2 = SmallerThan(FirstNumber=crv_cp_2.Distance, SecondNumber=0.1)  # -> SmallerThan, OrEqualTo
dispatch = Dispatch(List=flatten(nv.NakedPts), DispatchPattern=smaller.SmallerThan)  # -> flatten(ListA), ListB
dispatch_2 = Dispatch(List=flatten(nv.NakedPts), DispatchPattern=smaller_2.SmallerThan)  # -> flatten(ListA), ListB
point = Point(dispatch.ListA)
point_2 = Point(dispatch_2.ListA)
point_3 = Point(point)
point_4 = Point(point_2)
edgelengths = EdgeLengths(Mesh=weld_mesh_2, LengthFactor=Slider(1, range=0..1), Strength=1)
vertexloads = VertexLoads(Mesh=weld_mesh_2, Strength=division)
anchor = Anchor(Point=point_3, Strength=10000)
show = Show(G=weld_mesh_2)
solver = Solver(GoalObjects=[vertexloads, show, edgelengths, anchor], Reset=Button(), Threshold=1e-15, Tolerance=0.01, On=Toggle(False))  # -> I, V, O
mesh_2 = Mesh(solver.O)
custom_preview = CustomPreview(
    Geometry=mesh_2,
    Material={diffuse=RGB(221, 160, 221), emission=RGB(66, 48, 66), shine=0.5, specular=RGB(255, 255, 255), transparency=0})
