# Grasshopper definition Building_meshing.gh (Grasshopper 1.0.7)
# plug-ins: Weaverbird, MetaHopper, Kangaroo2 Components

# ----
# Potential script part
number_slider = Slider(3000, range=0..5000)

# ----
# cafe
number_slider_2 = Slider(2300, range=0..5000)

# ----
# entrance -barrel vault -ground floor
number_slider_3 = Slider(2300, range=0..5000)

# ---- group: button
toggle = GroupToggle(ToggleActive=True, ToggleVisible=False)  # disabled

# ----
# Library
number_slider_4 = Slider(2300, range=0..5000)

# ----
# Simulation Settings
force_on_mesh = Slider(1, range=0..20)

# ---- group: Button
toggle_2 = GroupToggle(ToggleActive=True, ToggleVisible=False)  # disabled

# ---- group: button
toggle_3 = GroupToggle(ToggleActive=True, ToggleVisible=False)  # disabled

toggle_4 = GroupToggle(ToggleActive=True, ToggleVisible=False)  # disabled

# ----
# part A
# Input Curves
curve = Curve(<curve referenced from the Rhino model>)

number_slider_5 = Slider(25, range=0..100)  # disabled
number_slider_6 = Slider(47, range=0..100)  # disabled
surface = Surface(curve)  # disabled
mesh_surface = MeshSurface(Surface=surface, UCount=number_slider_5, VCount=number_slider_6, Overhang=True, Equalize=False)  # disabled
mesh_edges = MeshEdges(Mesh=mesh_surface)  # -> NakedEdges, InteriorEdges, NonManifoldEdges; disabled

# ----
# Input Curves
curve_2 = Curve(<curve referenced from the Rhino model>)

boundary_surfaces = BoundarySurfaces(Edges=curve)
boundary_surfaces_2 = BoundarySurfaces(Edges=curve_2)

# ----
# Meshing
crv = Curve(<curve referenced from the Rhino model>)
# Groups
# External input
wbsplitquads = WeaverbirdsConstantQuadsSplitSubdivision(MeshCurves=crv, Level=Slider(1, range=0..2), SmoothNakedEdges=Slider(0, range=0..1))
# Parameters
byparent = ByParent(Mesh=wbsplitquads, Level=Slider(4, range=0..5))

deconstruct_brep = DeconstructBrep(Brep=boundary_surfaces)  # -> Faces, Edges, Vertices
deconstruct_brep_2 = DeconstructBrep(Brep=boundary_surfaces_2)  # -> Faces, Edges, Vertices

# ----
# Meshing
crv_2 = Curve(<curve referenced from the Rhino model>)
wbsplitquads_2 = WeaverbirdsConstantQuadsSplitSubdivision(MeshCurves=crv_2, Level=Slider(1, range=0..2), SmoothNakedEdges=Slider(0, range=0..1))
byparent_2 = ByParent(Mesh=wbsplitquads_2, Level=Slider(3, range=0..3))

# ----
# Anchor point parameters
demesh = DeconstructMesh(Mesh=simplify(byparent_2))  # -> Vertices, Faces, Colours, Normals
crv_3 = Curve([<curve referenced from the Rhino model> x2])
point_in_curves = PointInCurves(Point=demesh.Vertices, Curves=crv_3)  # -> Relationship, Index, Point
dispatch = Dispatch(List=demesh.Vertices, DispatchPattern=point_in_curves.Relationship)  # -> ListA, ListB
data = Data(dispatch.ListA)

# ----
# Meshing
crv_4 = Curve([<curve referenced from the Rhino model> x2])
wbsplitquads_3 = WeaverbirdsConstantQuadsSplitSubdivision(MeshCurves=crv_4, Level=Slider(1, range=0..2), SmoothNakedEdges=Slider(0, range=0..1))
byparent_3 = ByParent(Mesh=wbsplitquads_3, Level=Slider(4, range=0..7))

# ----
# Anchor point parameters
demesh_2 = DeconstructMesh(Mesh=simplify(byparent_3))  # -> Vertices, Faces, Colours, Normals
crv_5 = Curve([<curve referenced from the Rhino model> x4])
point_in_curves_2 = PointInCurves(Point=demesh_2.Vertices, Curves=crv_5)  # -> Relationship, Index, Point
dispatch_2 = Dispatch(List=demesh_2.Vertices, DispatchPattern=point_in_curves_2.Relationship)  # -> ListA, ListB
data_2 = Data(dispatch_2.ListA)

crv_6 = Curve([<curve referenced from the Rhino model> x42])
Z = UnitZ(Factor=number_slider_3)
boundary = BoundarySurfaces(Edges=crv_6)
extr = Extrude(Base=boundary, Direction=Z)

# ----
# support extrusion
# Meshing
crv_7 = Curve([<curve referenced from the Rhino model> x4])
wbsplitquads_4 = WeaverbirdsConstantQuadsSplitSubdivision(MeshCurves=crv_7, Level=Slider(1, range=0..4), SmoothNakedEdges=Slider(0, range=0..1))
byparent_4 = ByParent(Mesh=wbsplitquads_4, Level=Slider(3, range=0..4))

# ----
# Anchor point parameters
demesh_3 = DeconstructMesh(Mesh=simplify(byparent_4))  # -> Vertices, Faces, Colours, Normals
crv_8 = Curve([<curve referenced from the Rhino model> x8])
point_in_curves_3 = PointInCurves(Point=demesh_3.Vertices, Curves=crv_8)  # -> Relationship, Index, Point
dispatch_3 = Dispatch(List=demesh_3.Vertices, DispatchPattern=point_in_curves_3.Relationship)  # -> ListA, ListB
data_3 = Data(dispatch_3.ListA)

item = ListItem(List=deconstruct_brep_2.Edges, Index=[Slider(1, range=0..1), Slider(3, range=0..10)], Wrap=True)

# ----
# Iwan
demesh_4 = DeconstructMesh(Mesh=simplify(byparent))  # -> Vertices, Faces, Colours, Normals

# ----
# Anchor point parameters
crv_9 = Curve([<curve referenced from the Rhino model> x2])
point_in_curves_4 = PointInCurves(Point=demesh_4.Vertices, Curves=crv_9)  # -> Relationship, Index, Point
dispatch_4 = Dispatch(List=demesh_4.Vertices, DispatchPattern=point_in_curves_4.Relationship)  # -> ListA, ListB
data_4 = Data(dispatch_4.ListA)

item_2 = ListItem(List=deconstruct_brep.Edges, Index=[Slider(1, range=0..1), Slider(3, range=0..10)], Wrap=True)
number_slider_7 = Slider(6, range=0..10)
power = Power(A=2, B=number_slider_7)
weaverbird_s_tile = WeaverbirdsTile(MeshCurves=curve, FillStrategy=1, OptIn=2)
number_slider_8 = Slider(6, range=0..10)
power_2 = Power(A=2, B=number_slider_8)
weaverbird_s_tile_2 = WeaverbirdsTile(MeshCurves=curve_2, FillStrategy=1, OptIn=2)
list_item = ListItem(List=deconstruct_brep_2.Edges, Index=[Slider(0, range=0..1), Slider(2, range=0..10)], Wrap=True)
list_item_2 = ListItem(List=deconstruct_brep.Edges, Index=[Slider(0, range=0..1), Slider(2, range=0..10)], Wrap=True)

# ----
# Solver input
edgelengths = EdgeLengths(Mesh=byparent_2, LengthFactor=Slider(1, range=0..1), Strength=1)
show = Show(G=byparent_2)
vertexloads = VertexLoads(Mesh=byparent_2, Strength=Slider(3, range=0..5))
anchor = Anchor(Point=data, Strength=10000)

# ----
# Output
# Solver input
edgelengths_2 = EdgeLengths(Mesh=byparent, LengthFactor=Slider(1, range=0..1), Strength=1)
show_2 = Show(G=byparent)
vertexloads_2 = VertexLoads(Mesh=byparent, Strength=Slider(3, range=0..5))
anchor_2 = Anchor(Point=data_4, Strength=10000)

power_3 = Power(A=2, B=number_slider_8)
divide_curve = DivideCurve(Curve=item_2, Count=power, Kinks=False)  # -> simplify(Points), Tangents, Parameters
power_4 = Power(A=2, B=number_slider_7)

# ----
# Solver input
edgelengths_3 = EdgeLengths(Mesh=byparent_3, LengthFactor=Slider(1, range=0..1), Strength=1)
show_3 = Show(G=byparent_3)
# Result
vertexloads_3 = VertexLoads(Mesh=byparent_3, Strength=Slider(2, range=1..5))
anchor_3 = Anchor(Point=data_2, Strength=10000)

multiplication = Multiplication(B=4)
multiplication_2 = Multiplication(B=4)
byparent_5 = ByParent(Mesh=weaverbird_s_tile, Level=number_slider_7)
medges = MeshEdges(Mesh=byparent_5)  # -> NakedEdges, InteriorEdges, NonManifoldEdges
byparent_6 = ByParent(Mesh=weaverbird_s_tile_2, Level=number_slider_8)
medges_2 = MeshEdges(Mesh=byparent_6)  # -> NakedEdges, InteriorEdges, NonManifoldEdges

# ----
# Result
solver = Solver(GoalObjects=[vertexloads, edgelengths, show, anchor], Reset=Button(), Threshold=1e-15, Tolerance=0.01, On=Toggle(True))  # -> I, V, O
preview = CustomPreview(Geometry=solver.O, Material=ColourSwatch(SwatchColor=RGB(255, 157, 38)))

divide_curve_2 = DivideCurve(Curve=list_item, Count=power_3, Kinks=False)  # -> simplify(Points), Tangents, Parameters
divide_curve_3 = DivideCurve(Curve=item, Count=power_2, Kinks=False)  # -> simplify(Points), Tangents, Parameters

# ----
# Result
solver_2 = Solver(
    GoalObjects=[vertexloads_2, edgelengths_2, show_2, anchor_2],
    Reset=Button(),
    Threshold=1e-15,
    Tolerance=0.01,
    On=Toggle(True))  # -> I, V, flatten(O)
preview_2 = CustomPreview(Geometry=solver_2.O, Material=ColourSwatch(SwatchColor=RGB(255, 157, 38)))

# ----
# Solver input
edgelengths_4 = EdgeLengths(Mesh=byparent_4, LengthFactor=Slider(1, range=0..1), Strength=1)
show_4 = Show(G=byparent_4)
vertexloads_4 = VertexLoads(Mesh=byparent_4, Strength=Slider(4, range=0..5))
anchor_4 = Anchor(Point=data_3, Strength=10000)

tree_branch = TreeBranch(Tree=divide_curve.Points, Path=Slider(1, range=0..100), MaintainPaths=True)

solver_3 = Solver(
    GoalObjects=[vertexloads_3, edgelengths_3, show_3, anchor_3],
    Reset=Button(),
    Threshold=1e-15,
    Tolerance=0.01,
    On=Toggle(True))  # -> I, V, O
preview_3 = CustomPreview(Geometry=solver_3.O, Material=ColourSwatch(SwatchColor=RGB(255, 157, 38)))

number_slider_9 = Slider(43, range=0..100)
number_slider_10 = Slider(3, range=0..10)
number_slider_11 = Slider(11, range=0..100)
number_slider_12 = Slider(3, range=0..10)
number_slider_13 = Slider(27, range=0..100)
number_slider_14 = Slider(3, range=0..10)
series = Series(Start=number_slider_13, Step=1, Count=number_slider_14)
series_2 = Series(Start=number_slider_9, Step=1, Count=number_slider_10)
series_3 = Series(Start=number_slider_11, Step=1, Count=number_slider_12)
cull_index = CullIndex(List=tree_branch, Indices=[series_3, series, series_2], Wrap=True)

tree_branch_2 = TreeBranch(Tree=divide_curve.Points, Path=Slider(0, range=0..100), MaintainPaths=True)
divide_curve_4 = DivideCurve(Curve=list_item_2, Count=power_4, Kinks=False)  # -> simplify(Points), Tangents, Parameters
point = Point([cull_index, tree_branch_2])

# ----
# Result
solver_4 = Solver(
    GoalObjects=[vertexloads_4, edgelengths_4, show_4, anchor_4],
    Reset=Button(),
    Threshold=1e-15,
    Tolerance=0.01,
    On=Toggle(False))  # -> I, V, O
preview_4 = CustomPreview(Geometry=solver_4.O, Material=ColourSwatch(SwatchColor=RGB(255, 157, 38)))

# ----
# Moving the final mesh
Z_2 = UnitZ(Factor=number_slider)
move = Move(Geometry=solver_2.O, Motion=Z_2)  # -> Geometry, Transform

tree_branch_3 = TreeBranch(Tree=divide_curve_3.Points, Path=Slider(0, range=0..100), MaintainPaths=True)
series_4 = Series(Start=Slider(2, range=0..100), Step=1, Count=Slider(6, range=0..10))
series_5 = Series(Start=Slider(33, range=0..100), Step=1, Count=Slider(7, range=0..10))
cull_index_2 = CullIndex(List=tree_branch_3, Indices=[series_4, series_5], Wrap=True)

# ----
# Moving the final mesh
Z_3 = UnitZ(Factor=number_slider_2)
move_2 = Move(Geometry=solver.O, Motion=Z_3)  # -> Geometry, Transform

# ----
# Moving the final mesh
Z_4 = UnitZ(Factor=number_slider_4)
move_3 = Move(Geometry=solver_3.O, Motion=Z_4)  # -> Geometry, Transform

number_slider_15 = Slider(43, range=0..100)
number_slider_16 = Slider(11, range=0..100)
number_slider_17 = Slider(3, range=0..10)
number_slider_18 = Slider(27, range=0..100)
number_slider_19 = Slider(3, range=0..10)
tree_branch_4 = TreeBranch(Tree=divide_curve_3.Points, Path=Slider(1, range=0..100), MaintainPaths=True)
series_6 = Series(Start=number_slider_15, Step=1, Count=Slider(3, range=0..10))
series_7 = Series(Start=number_slider_18, Step=1, Count=number_slider_19)
series_8 = Series(Start=number_slider_16, Step=1, Count=number_slider_17)
cull_index_3 = CullIndex(List=reverse(tree_branch_4), Indices=[series_8, series_7, series_6], Wrap=True)

# ----
# Moving the final mesh
Z_5 = UnitZ(Factor=number_slider_3)
move_4 = Move(Geometry=solver_4.O, Motion=Z_5)  # -> Geometry, Transform

subtraction = Subtraction(A=number_slider_13, B=1)
addition = Addition(A=number_slider_13, B=number_slider_14)
subtraction_2 = Subtraction(A=number_slider_9, B=1)
addition_2 = Addition(A=number_slider_9, B=number_slider_10)
subtraction_3 = Subtraction(A=number_slider_11, B=1)
addition_3 = Addition(A=number_slider_11, B=number_slider_12)
list_item_3 = ListItem(List=tree_branch, Index=subtraction, Wrap=True)
list_item_4 = ListItem(List=tree_branch, Index=addition, Wrap=True)
list_item_5 = ListItem(List=tree_branch, Index=subtraction_2, Wrap=True)
list_item_6 = ListItem(List=tree_branch, Index=addition_2, Wrap=True)
list_item_7 = ListItem(List=tree_branch, Index=subtraction_3, Wrap=True)
list_item_8 = ListItem(List=tree_branch, Index=addition_3, Wrap=True)

subtraction_4 = Subtraction(A=number_slider_18, B=1)
addition_4 = Addition(A=number_slider_18, B=number_slider_19)
subtraction_5 = Subtraction(A=number_slider_15, B=1)
addition_5 = Addition(A=number_slider_15, B=number_slider_19)
subtraction_6 = Subtraction(A=number_slider_16, B=1)
addition_6 = Addition(A=number_slider_16, B=number_slider_17)
list_item_9 = ListItem(List=reverse(tree_branch_4), Index=subtraction_4, Wrap=True)
list_item_10 = ListItem(List=reverse(tree_branch_4), Index=addition_4, Wrap=True)
list_item_11 = ListItem(List=reverse(tree_branch_4), Index=subtraction_5, Wrap=True)
list_item_12 = ListItem(List=reverse(tree_branch_4), Index=addition_5, Wrap=True)
list_item_13 = ListItem(List=reverse(tree_branch_4), Index=subtraction_6, Wrap=True)
list_item_14 = ListItem(List=reverse(tree_branch_4), Index=addition_6, Wrap=True)
panel = Panel(cull_index_3)
_4point_surface = _4PointSurface(CornerA=list_item_9, CornerB=list_item_10, CornerC=list_item_4, CornerD=list_item_3)
_4point_surface_2 = _4PointSurface(CornerA=list_item_11, CornerB=list_item_12, CornerC=list_item_6, CornerD=list_item_5)
_4point_surface_3 = _4PointSurface(CornerA=list_item_13, CornerB=list_item_14, CornerC=list_item_8, CornerD=list_item_7)
number_slider_20 = Slider(4, range=0..10)
surface_2 = Surface([_4point_surface_3, _4point_surface, _4point_surface_2])
mesh_surface_2 = MeshSurface(Surface=surface_2, UCount=number_slider_20, VCount=Slider(1, range=0..1), Overhang=True, Equalize=False)
weld_mesh = WeldMesh(Mesh=[byparent_5, byparent_6, mesh_surface_2], Angle=3.141592654)
mesh_join = MeshJoin(Meshes=weld_mesh)  # -> flatten(Mesh)
mesh_edges_2 = MeshEdges(Mesh=weld_mesh)  # -> NakedEdges, InteriorEdges, NonManifoldEdges
mesh_edges_3 = MeshEdges(Mesh=mesh_surface_2)  # -> NakedEdges, InteriorEdges, NonManifoldEdges
explode = Explode(Curve=surface_2, Recursive=True)  # -> Segments, Vertices
anchor_5 = Anchor(Strength=10000)
list_item_15 = ListItem(List=explode.Segments, Index=[Slider(0, range=0..100), Slider(2, range=0..10)], Wrap=True)
divide_curve_5 = DivideCurve(Curve=list_item_15, Count=number_slider_20, Kinks=False)  # -> Points, Tangents, Parameters
edgelengths_5 = EdgeLengths(Mesh=mesh_join, LengthFactor=1, Strength=1)
anchor_6 = Anchor(Point=flatten(point), Strength=10000)
anchor_7 = Anchor(Point=flatten([cull_index_2, cull_index_3, divide_curve_5.Points]), Strength=10000)
anchorxyz = AnchorXYZ(Point=[divide_curve_4.Points, divide_curve_2.Points], X=True, Y=False, Z=False, Strength=1000)
vertexloads_5 = VertexLoads(Mesh=mesh_join, Strength=force_on_mesh)
anchorxyz_2 = AnchorXYZ(Point=[tree_branch, cull_index_3], X=False, Y=True, Z=False, Strength=1000)
anchorxyz_3 = AnchorXYZ(Point=[tree_branch_3, tree_branch_4], X=False, Y=True, Z=False, Strength=1000)
show_5 = Show(G=mesh_join)
solver_5 = Solver(
    GoalObjects=[show_5, vertexloads_5, edgelengths_5, anchor_6, anchorxyz, anchor_7, anchorxyz_3, anchorxyz_2],
    Reset=Button(),
    Threshold=1e-15,
    Tolerance=0.01,
    On=Toggle(False))  # -> I, V, simplify(O)

clean_tree = CleanTree(RemoveNulls=True, RemoveInvalid=True, RemoveEmpty=False, Tree=flatten(solver_5.O))
unit_z = UnitZ(Factor=Slider(1700, range=0..10000))
list_item_16 = ListItem(List=clean_tree, Index=[Slider(0, range=0..100), Slider(1, range=0..1)], Wrap=True)
mesh_join_2 = MeshJoin(Meshes=list_item_16)
move_5 = Move(Geometry=mesh_join_2, Motion=unit_z)  # -> Geometry, Transform

panel_2 = Panel(clean_tree)
mesh_edges_4 = MeshEdges(Mesh=list_item_16)  # -> NakedEdges, InteriorEdges, NonManifoldEdges
panel_3 = Panel(mesh_edges_4.NakedEdges)

# ----
# Output
custom_preview = CustomPreview(
    Geometry=move_5.Geometry,
    Material={diffuse=RGB(221, 160, 221), emission=RGB(66, 48, 66), shine=0.5, specular=RGB(255, 255, 255), transparency=0})

weaverbird_s_mesh_thicken = WeaverbirdsMeshThicken(MeshCurves=move_5.Geometry, Distance=Slider(250, range=0..1000), OffsetType=0)
list_item_17 = ListItem(List=mesh_edges_4.NakedEdges, Index=Slider(130, range=0..1000), Wrap=True)
mesh_join_3 = MeshJoin(Meshes=weaverbird_s_mesh_thicken)

# ----
# Arcade ribbed (one cross vault)
boolean_toggle = BooleanToggle(True)
force_on_mesh_2 = Slider(5, range=0..8)
edgelength_factor = Slider(1, range=0..1)
column_height = Slider(1700, range=0..2200)
toggle_5 = GroupToggle(ToggleActive=True, ToggleVisible=False)  # disabled
curve_3 = Curve([<curve referenced from the Rhino model> x4])
panel_4 = Panel(curve_3)
crv_10 = Curve([<curve referenced from the Rhino model> x85])
Z_6 = UnitZ(Factor=column_height)
boundary_2 = BoundarySurfaces(Edges=crv_10)
extr_2 = Extrude(Base=boundary_2, Direction=Z_6)

weaverbird_s_catmull_clark_subdivision = WeaverbirdsCatmullClarkSubdivision(MeshCurves=curve_3, Level=Slider(2, range=0..10), SmoothNakedEdges=0)
panel_5 = Panel(weaverbird_s_catmull_clark_subdivision)
byparent_7 = ByParent(Mesh=weaverbird_s_catmull_clark_subdivision, Level=Slider(2, range=0..10))

explode_2 = Explode(Curve=curve_3, Recursive=True)  # -> Segments, Vertices
number_slider_21 = Slider(4, range=0..6)
multiplication_3 = Multiplication(A=number_slider_21, B=number_slider_21)

list_item_18 = ListItem(List=explode_2.Segments, Index=Slider(3, range=0..10), Wrap=True)  # -> simplify(Item)
tree_branch_5 = TreeBranch(Tree=list_item_18, Path=[Slider(0, range=0..10), Slider(1, range=0..10)], MaintainPaths=True)
tree_branch_6 = TreeBranch(Tree=list_item_18, Path=[Slider(2, range=0..10), Slider(3, range=0..10)], MaintainPaths=True)
divide_curve_6 = DivideCurve(Curve=simplify(tree_branch_5), Count=multiplication_3, Kinks=False)  # -> Points, Tangents, Parameters
divide_curve_7 = DivideCurve(Curve=simplify(tree_branch_6), Count=multiplication_3, Kinks=False)  # -> Points, Tangents, Parameters

list_item_19 = ListItem(List=explode_2.Segments, Index=[Slider(0, range=0..10), Slider(3, range=0..10)], Wrap=True)
divide_curve_8 = DivideCurve(Curve=simplify(list_item_19), Count=multiplication_3, Kinks=False)  # -> Points, Tangents, Parameters

mesh_edges_5 = MeshEdges(Mesh=byparent_7)  # -> NakedEdges, InteriorEdges, NonManifoldEdges
edgelengths_6 = EdgeLengths(Mesh=byparent_7, LengthFactor=Slider(0.9, range=0..1), Strength=1)
vertexloads_6 = VertexLoads(Mesh=byparent_7, Strength=force_on_mesh_2)
anchor_8 = Anchor(Point=divide_curve_8.Points, Strength=10000)
show_6 = Show(G=byparent_7)
anchorxyz_4 = AnchorXYZ(Point=divide_curve_6.Points, X=True, Y=False, Z=False, Strength=1000)
anchorxyz_5 = AnchorXYZ(Point=divide_curve_7.Points, X=False, Y=True, Z=False, Strength=1000)
solver_6 = Solver(
    GoalObjects=[show_6, vertexloads_6, edgelengths_6, anchor_8, anchorxyz_4, anchorxyz_5],
    Reset=Button(),
    Threshold=1e-15,
    Tolerance=0.01,
    On=boolean_toggle)  # -> I, V, O

clean_tree_2 = CleanTree(RemoveNulls=True, RemoveInvalid=True, RemoveEmpty=False, Tree=solver_6.O)  # -> flatten(Tree)
split_list = SplitList(List=clean_tree_2, Index=80)  # -> ListA, ListB
unit_z_2 = UnitZ(Factor=column_height)

mesh_join_4 = MeshJoin(Meshes=split_list.ListA)

move_6 = Move(Geometry=mesh_join_4, Motion=unit_z_2)  # -> Geometry, Transform
weaverbird_s_mesh_thicken_2 = WeaverbirdsMeshThicken(MeshCurves=move_6.Geometry, Distance=Slider(250, range=0..1000), OffsetType=0)
