# Grasshopper definition Building_meshingadded.gh (Grasshopper 1.0.7)
# plug-ins: Pufferfish, Weaverbird, MetaHopper, Kangaroo2 Components

# ----
# Potential script part
number_slider = Slider(3000, range=0..5000)

# ----
# cafe
number_slider_2 = Slider(2300, range=0..5000)

# ----
# Entrance Domes
# Result
group_toggle = GroupToggle(ToggleActive=True, ToggleVisible=False)  # disabled
curve = Curve([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])
curve_2 = Curve([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])

# ----
# entrance -barrel vault -ground floor
number_slider_3 = Slider(2300, range=0..5000)

force_on_mesh = Slider(15, range=0..20)
edgelength_factor = Slider(1, range=0..1)
column_height = Slider(1500, range=0..2200)
length_factor = Slider(0.5, range=0..1)

# ---- group: button
toggle = GroupToggle(ToggleActive=True, ToggleVisible=False)  # disabled

# ----
# Library
number_slider_4 = Slider(2300, range=0..5000)

force_on_mesh_2 = Slider(6, range=0..20)
column_height_2 = Slider(2000, range=0..2200)
length_factor_2 = Slider(0.5, range=0..1)

force_on_mesh_3 = Slider(4, range=0..20)
column_height_3 = Slider(2000, range=0..2200)
length_factor_3 = Slider(0.5, range=0..1)

force_on_mesh_4 = Slider(4, range=0..20)
column_height_4 = Slider(2000, range=0..2200)
length_factor_4 = Slider(0.5, range=0..1)

force_on_mesh_5 = Slider(4, range=0..20)
column_height_5 = Slider(2000, range=0..2200)
length_factor_5 = Slider(0.5, range=0..1)

force_on_mesh_6 = Slider(4, range=0..20)
column_height_6 = Slider(2000, range=0..2200)
length_factor_6 = Slider(0.5, range=0..1)

# ----
# Simulation Settings
force_on_mesh_7 = Slider(1, range=0..20)

# ----
# Barell Vault 1
# Result
group_toggle_2 = GroupToggle(ToggleActive=True, ToggleVisible=False)  # disabled
curve_3 = Curve(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)

# ---- group: Button
toggle_2 = GroupToggle(ToggleActive=True, ToggleVisible=False)  # disabled

# ---- group: button
toggle_3 = GroupToggle(ToggleActive=True, ToggleVisible=False)  # disabled

toggle_4 = GroupToggle(ToggleActive=True, ToggleVisible=False)  # disabled

# ----
force_on_mesh_8 = Slider(15, range=0..20)
column_height_7 = Slider(1500, range=0..2200)
length_factor_7 = Slider(0.5, range=0..1)

mesh_level = Slider(2, range=0..10)
length_factor_8 = Slider(0.9, range=0..1)
mesh_thickness = Slider(250, range=0..1000)
force_on_mesh_9 = Slider(5, range=0..8)
edgelength_factor_2 = Slider(1, range=0..1)
column_height_8 = Slider(1700, range=0..2200)

# ----
# Arcade ribbed (one cross vault)
toggle_5 = GroupToggle(ToggleActive=True, ToggleVisible=False)  # disabled

# ----
# Barell Vault 1
# Result
group_toggle_3 = GroupToggle(ToggleActive=True, ToggleVisible=False)  # disabled
curve_4 = Curve(<curve referenced from the Rhino model>)

# ----
# Barell Vault 1
# Result
group_toggle_4 = GroupToggle(ToggleActive=True, ToggleVisible=False)  # disabled
curve_5 = Curve(<curve referenced from the Rhino model>)

# ----
# Barell Vault 1
group_toggle_5 = GroupToggle(ToggleActive=True, ToggleVisible=False)  # disabled
curve_6 = Curve(<curve referenced from the Rhino model>)

# ----
# Barell Vault 1
# Result
group_toggle_6 = GroupToggle(ToggleActive=True, ToggleVisible=False)  # disabled
curve_7 = Curve(<curve referenced from the Rhino model>)

# ----
# Barell Vault 1
# Result
group_toggle_7 = GroupToggle(ToggleActive=True, ToggleVisible=False)  # disabled
curve_8 = Curve(<curve referenced from the Rhino model>)

force_on_mesh_10 = Slider(15, range=0..20)
column_height_9 = Slider(1500, range=0..2200)

# ----
# Barell Vault 2
# Result
group_toggle_8 = GroupToggle(ToggleActive=True, ToggleVisible=False)  # disabled
curve_9 = Curve(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)

# ----
# part A
# Input Curves
curve_10 = Curve(<curve referenced from the Rhino model>)

number_slider_5 = Slider(25, range=0..100)  # disabled
number_slider_6 = Slider(47, range=0..100)  # disabled
surface = Surface(curve_10)  # disabled
mesh_surface = MeshSurface(Surface=surface, UCount=number_slider_5, VCount=number_slider_6, Overhang=True, Equalize=False)  # disabled
mesh_edges = MeshEdges(Mesh=mesh_surface)  # -> NakedEdges, InteriorEdges, NonManifoldEdges; disabled

# ----
# Input Curves
curve_11 = Curve(<curve referenced from the Rhino model>)

startingpoint = Point(<point referenced from the Rhino model>)
finalpoints = Point([<point referenced from the Rhino model> x16])
initialcurve = Curve([<curve referenced from the Rhino model> x4])

boundary_surfaces = BoundarySurfaces(Edges=curve_10)
boundary_surfaces_2 = BoundarySurfaces(Edges=curve_11)

# ----
# Groups
# Meshing
crv = Curve(<curve referenced from the Rhino model>)
# External input
wbsplitquads = WeaverbirdsConstantQuadsSplitSubdivision(MeshCurves=crv, Level=Slider(1, range=0..2), SmoothNakedEdges=Slider(0, range=0..1))
# Parameters
byparent = ByParent(Mesh=wbsplitquads, Level=Slider(4, range=0..5))

deconstruct_brep = DeconstructBrep(Brep=boundary_surfaces)  # -> Faces, Edges, Vertices
deconstruct_brep_2 = DeconstructBrep(Brep=boundary_surfaces_2)  # -> Faces, Edges, Vertices

# ----
# Meshing
crv_2 = Curve(<curve referenced from the Rhino model>)
wbsplitquads_2 = WeaverbirdsConstantQuadsSplitSubdivision(MeshCurves=crv_2, Level=Slider(1, range=0..2), SmoothNakedEdges=Slider(0, range=0..1))
byparent_2 = ByParent(Mesh=wbsplitquads_2, Level=Slider(3, range=0..3))

# ----
# Anchor point parameters
demesh = DeconstructMesh(Mesh=simplify(byparent_2))  # -> Vertices, Faces, Colours, Normals
crv_3 = Curve([<curve referenced from the Rhino model> x2])
point_in_curves = PointInCurves(Point=demesh.Vertices, Curves=crv_3)  # -> Relationship, Index, Point
dispatch = Dispatch(List=demesh.Vertices, DispatchPattern=point_in_curves.Relationship)  # -> ListA, ListB
data = Data(dispatch.ListA)

# ----
# Meshing
crv_4 = Curve([<curve referenced from the Rhino model> x2])
wbsplitquads_3 = WeaverbirdsConstantQuadsSplitSubdivision(MeshCurves=crv_4, Level=Slider(1, range=0..2), SmoothNakedEdges=Slider(0, range=0..1))
byparent_3 = ByParent(Mesh=wbsplitquads_3, Level=Slider(4, range=0..7))

# ----
# Anchor point parameters
demesh_2 = DeconstructMesh(Mesh=simplify(byparent_3))  # -> Vertices, Faces, Colours, Normals
crv_5 = Curve([<curve referenced from the Rhino model> x4])
point_in_curves_2 = PointInCurves(Point=demesh_2.Vertices, Curves=crv_5)  # -> Relationship, Index, Point
dispatch_2 = Dispatch(List=demesh_2.Vertices, DispatchPattern=point_in_curves_2.Relationship)  # -> ListA, ListB
data_2 = Data(dispatch_2.ListA)

explode = Explode(Curve=initialcurve, Recursive=True)  # -> Segments, Vertices
number_slider_7 = Slider(4, range=0..6)
multiplication = Multiplication(A=number_slider_7, B=number_slider_7)

weaverbird_s_catmull_clark_subdivision = WeaverbirdsCatmullClarkSubdivision(MeshCurves=curve_2, Level=Slider(2, range=0..10), SmoothNakedEdges=0)
byparent_4 = ByParent(Mesh=weaverbird_s_catmull_clark_subdivision, Level=Slider(2, range=0..10))

weaverbird_s_catmull_clark_subdivision_2 = WeaverbirdsCatmullClarkSubdivision(MeshCurves=initialcurve, Level=Slider(2, range=0..10), SmoothNakedEdges=0)
panel = Panel(weaverbird_s_catmull_clark_subdivision_2)
byparent_5 = ByParent(Mesh=weaverbird_s_catmull_clark_subdivision_2, Level=mesh_level)

list_item = ListItem(List=explode.Segments, Index=Slider(3, range=0..10), Wrap=True)  # -> simplify(Item)
tree_branch = TreeBranch(Tree=list_item, Path=[Slider(0, range=0..10), Slider(1, range=0..10)], MaintainPaths=True)
tree_branch_2 = TreeBranch(Tree=list_item, Path=[Slider(2, range=0..10), Slider(3, range=0..10)], MaintainPaths=True)
divide_curve = DivideCurve(Curve=simplify(tree_branch), Count=multiplication, Kinks=False)  # -> Points, Tangents, Parameters
divide_curve_2 = DivideCurve(Curve=simplify(tree_branch_2), Count=multiplication, Kinks=False)  # -> Points, Tangents, Parameters

crv_6 = Curve([<curve referenced from the Rhino model> x42])
Z = UnitZ(Factor=number_slider_3)
boundary = BoundarySurfaces(Edges=crv_6)
extr = Extrude(Base=boundary, Direction=Z)

# ----
# support extrusion
# Meshing
crv_7 = Curve([<curve referenced from the Rhino model> x4])
wbsplitquads_4 = WeaverbirdsConstantQuadsSplitSubdivision(MeshCurves=crv_7, Level=Slider(1, range=0..4), SmoothNakedEdges=Slider(0, range=0..1))
byparent_6 = ByParent(Mesh=wbsplitquads_4, Level=Slider(3, range=0..4))

# ----
# Anchor point parameters
demesh_3 = DeconstructMesh(Mesh=simplify(byparent_6))  # -> Vertices, Faces, Colours, Normals
crv_8 = Curve([<curve referenced from the Rhino model> x8])
point_in_curves_3 = PointInCurves(Point=demesh_3.Vertices, Curves=crv_8)  # -> Relationship, Index, Point
dispatch_3 = Dispatch(List=demesh_3.Vertices, DispatchPattern=point_in_curves_3.Relationship)  # -> ListA, ListB
data_3 = Data(dispatch_3.ListA)

number_slider_8 = Slider(4, range=0..6)
explode_2 = Explode(Curve=curve_9, Recursive=True)  # -> simplify(Segments), Vertices
multiplication_2 = Multiplication(A=number_slider_8, B=number_slider_8)
list_item_2 = ListItem(List=explode_2.Segments, Index=[Slider(1, range=0..10), Slider(3, range=0..10)], Wrap=True)
list_item_3 = ListItem(List=explode_2.Segments, Index=[Slider(0, range=0..100), Slider(2, range=0..10)], Wrap=True)
divide_curve_3 = DivideCurve(Curve=list_item_2, Count=multiplication_2, Kinks=False)  # -> Points, Tangents, Parameters
divide_curve_4 = DivideCurve(Curve=list_item_3, Count=multiplication_2, Kinks=False)  # -> Points, Tangents, Parameters

weaverbird_s_catmull_clark_subdivision_3 = WeaverbirdsCatmullClarkSubdivision(MeshCurves=curve, Level=Slider(2, range=0..10), SmoothNakedEdges=0)
byparent_7 = ByParent(Mesh=weaverbird_s_catmull_clark_subdivision_3, Level=Slider(2, range=0..10))

number_slider_9 = Slider(4, range=0..6)
explode_3 = Explode(Curve=curve_3, Recursive=True)  # -> simplify(Segments), Vertices
multiplication_3 = Multiplication(A=number_slider_9, B=number_slider_9)
list_item_4 = ListItem(List=explode_3.Segments, Index=[Slider(1, range=0..10), Slider(3, range=0..10)], Wrap=True)
list_item_5 = ListItem(List=explode_3.Segments, Index=[Slider(0, range=0..100), Slider(2, range=0..10)], Wrap=True)
divide_curve_5 = DivideCurve(Curve=list_item_4, Count=multiplication_3, Kinks=False)  # -> Points, Tangents, Parameters
divide_curve_6 = DivideCurve(Curve=list_item_5, Count=multiplication_3, Kinks=False)  # -> Points, Tangents, Parameters

weaverbird_s_catmull_clark_subdivision_4 = WeaverbirdsCatmullClarkSubdivision(MeshCurves=curve_4, Level=Slider(2, range=0..10), SmoothNakedEdges=0)
panel_2 = Panel(weaverbird_s_catmull_clark_subdivision_4)
byparent_8 = ByParent(Mesh=weaverbird_s_catmull_clark_subdivision_4, Level=Slider(3, range=0..10))

weaverbird_s_catmull_clark_subdivision_5 = WeaverbirdsCatmullClarkSubdivision(MeshCurves=curve_5, Level=Slider(2, range=0..10), SmoothNakedEdges=0)
panel_3 = Panel(weaverbird_s_catmull_clark_subdivision_5)
byparent_9 = ByParent(Mesh=weaverbird_s_catmull_clark_subdivision_5, Level=Slider(3, range=0..10))

weaverbird_s_catmull_clark_subdivision_6 = WeaverbirdsCatmullClarkSubdivision(MeshCurves=curve_3, Level=Slider(2, range=0..10), SmoothNakedEdges=0)
byparent_10 = ByParent(Mesh=weaverbird_s_catmull_clark_subdivision_6, Level=Slider(2, range=0..10))

weaverbird_s_catmull_clark_subdivision_7 = WeaverbirdsCatmullClarkSubdivision(MeshCurves=curve_6, Level=Slider(2, range=0..10), SmoothNakedEdges=0)
panel_4 = Panel(weaverbird_s_catmull_clark_subdivision_7)
byparent_11 = ByParent(Mesh=weaverbird_s_catmull_clark_subdivision_7, Level=Slider(3, range=0..10))

weaverbird_s_catmull_clark_subdivision_8 = WeaverbirdsCatmullClarkSubdivision(MeshCurves=curve_9, Level=Slider(2, range=0..10), SmoothNakedEdges=0)
byparent_12 = ByParent(Mesh=weaverbird_s_catmull_clark_subdivision_8, Level=Slider(2, range=0..10))

list_item_6 = ListItem(List=explode.Segments, Index=[Slider(0, range=0..10), Slider(3, range=0..10)], Wrap=True)
divide_curve_7 = DivideCurve(Curve=simplify(list_item_6), Count=multiplication, Kinks=False)  # -> Points, Tangents, Parameters

explode_4 = Explode(Curve=curve, Recursive=True)  # -> Segments, Vertices
number_slider_10 = Slider(4, range=0..6)
multiplication_4 = Multiplication(A=number_slider_10, B=number_slider_10)

explode_5 = Explode(Curve=curve_2, Recursive=True)  # -> simplify(Segments), Vertices
list_item_7 = ListItem(List=explode_5.Segments, Index=[Slider(1, range=0..10), Slider(3, range=0..10)], Wrap=True)
list_item_8 = ListItem(List=explode_5.Segments, Index=Slider(0, range=0..10), Wrap=True)
divide_curve_8 = DivideCurve(Curve=list_item_7, Count=multiplication_4, Kinks=False)  # -> Points, Tangents, Parameters
divide_curve_9 = DivideCurve(Curve=list_item_8, Count=multiplication_4, Kinks=False)  # -> simplify(Points), Tangents, Parameters
tree_branch_3 = TreeBranch(Tree=divide_curve_9.Points, Path=[Slider(0, range=0..3), Slider(2, range=0..3)], MaintainPaths=True)
tree_branch_4 = TreeBranch(Tree=divide_curve_9.Points, Path=[Slider(1, range=0..3), Slider(3, range=0..3)], MaintainPaths=True)
mesh_join = MeshJoin(Meshes=[byparent_7, byparent_4])

weaverbird_s_catmull_clark_subdivision_9 = WeaverbirdsCatmullClarkSubdivision(MeshCurves=curve_7, Level=Slider(2, range=0..10), SmoothNakedEdges=0)
panel_5 = Panel(weaverbird_s_catmull_clark_subdivision_9)
byparent_13 = ByParent(Mesh=weaverbird_s_catmull_clark_subdivision_9, Level=Slider(3, range=0..10))

item = ListItem(List=deconstruct_brep_2.Edges, Index=[Slider(1, range=0..1), Slider(3, range=0..10)], Wrap=True)

weaverbird_s_catmull_clark_subdivision_10 = WeaverbirdsCatmullClarkSubdivision(MeshCurves=curve_8, Level=Slider(2, range=0..10), SmoothNakedEdges=0)
panel_6 = Panel(weaverbird_s_catmull_clark_subdivision_10)
byparent_14 = ByParent(Mesh=weaverbird_s_catmull_clark_subdivision_10, Level=Slider(3, range=0..10))

# ----
# Iwan
demesh_4 = DeconstructMesh(Mesh=simplify(byparent))  # -> Vertices, Faces, Colours, Normals

# ----
# Anchor point parameters
crv_9 = Curve([<curve referenced from the Rhino model> x2])
point_in_curves_4 = PointInCurves(Point=demesh_4.Vertices, Curves=crv_9)  # -> Relationship, Index, Point
dispatch_4 = Dispatch(List=demesh_4.Vertices, DispatchPattern=point_in_curves_4.Relationship)  # -> ListA, ListB
data_4 = Data(dispatch_4.ListA)

item_2 = ListItem(List=deconstruct_brep.Edges, Index=[Slider(1, range=0..1), Slider(3, range=0..10)], Wrap=True)

explode_6 = Explode(Curve=curve_4, Recursive=True)  # -> simplify(Segments), Vertices
number_slider_11 = Slider(32, range=0..100)
list_item_9 = ListItem(List=explode_6.Segments, Index=[Slider(1, range=0..10), Slider(3, range=0..10)], Wrap=True)
list_item_10 = ListItem(List=explode_6.Segments, Index=[Slider(0, range=0..100), Slider(2, range=0..10)], Wrap=True)
divide_curve_10 = DivideCurve(Curve=list_item_9, Count=number_slider_11, Kinks=False)  # -> Points, Tangents, Parameters
divide_curve_11 = DivideCurve(Curve=list_item_10, Count=number_slider_11, Kinks=False)  # -> Points, Tangents, Parameters

explode_7 = Explode(Curve=curve_5, Recursive=True)  # -> simplify(Segments), Vertices
number_slider_12 = Slider(32, range=0..100)
list_item_11 = ListItem(List=explode_7.Segments, Index=[Slider(1, range=0..10), Slider(3, range=0..10)], Wrap=True)
list_item_12 = ListItem(List=explode_7.Segments, Index=[Slider(0, range=0..100), Slider(2, range=0..10)], Wrap=True)
divide_curve_12 = DivideCurve(Curve=list_item_11, Count=number_slider_12, Kinks=False)  # -> Points, Tangents, Parameters
divide_curve_13 = DivideCurve(Curve=list_item_12, Count=number_slider_12, Kinks=False)  # -> Points, Tangents, Parameters

explode_8 = Explode(Curve=curve_6, Recursive=True)  # -> simplify(Segments), Vertices
number_slider_13 = Slider(32, range=0..100)
list_item_13 = ListItem(List=explode_8.Segments, Index=[Slider(1, range=0..10), Slider(3, range=0..10)], Wrap=True)
list_item_14 = ListItem(List=explode_8.Segments, Index=[Slider(0, range=0..100), Slider(2, range=0..10)], Wrap=True)
divide_curve_14 = DivideCurve(Curve=list_item_13, Count=number_slider_13, Kinks=False)  # -> Points, Tangents, Parameters
divide_curve_15 = DivideCurve(Curve=list_item_14, Count=number_slider_13, Kinks=False)  # -> Points, Tangents, Parameters

number_slider_14 = Slider(6, range=0..10)
power = Power(A=2, B=number_slider_14)
weaverbird_s_tile = WeaverbirdsTile(MeshCurves=curve_10, FillStrategy=1, OptIn=2)

explode_9 = Explode(Curve=curve_7, Recursive=True)  # -> simplify(Segments), Vertices
number_slider_15 = Slider(32, range=0..100)
list_item_15 = ListItem(List=explode_9.Segments, Index=[Slider(1, range=0..10), Slider(3, range=0..10)], Wrap=True)
list_item_16 = ListItem(List=explode_9.Segments, Index=[Slider(0, range=0..100), Slider(2, range=0..10)], Wrap=True)
divide_curve_16 = DivideCurve(Curve=list_item_15, Count=number_slider_15, Kinks=False)  # -> Points, Tangents, Parameters
divide_curve_17 = DivideCurve(Curve=list_item_16, Count=number_slider_15, Kinks=False)  # -> Points, Tangents, Parameters

explode_10 = Explode(Curve=curve_8, Recursive=True)  # -> simplify(Segments), Vertices
number_slider_16 = Slider(32, range=0..100)
list_item_17 = ListItem(List=explode_10.Segments, Index=[Slider(1, range=0..10), Slider(3, range=0..10)], Wrap=True)
list_item_18 = ListItem(List=explode_10.Segments, Index=[Slider(0, range=0..100), Slider(2, range=0..10)], Wrap=True)
divide_curve_18 = DivideCurve(Curve=list_item_17, Count=number_slider_16, Kinks=False)  # -> Points, Tangents, Parameters
divide_curve_19 = DivideCurve(Curve=list_item_18, Count=number_slider_16, Kinks=False)  # -> Points, Tangents, Parameters

number_slider_17 = Slider(6, range=0..10)
power_2 = Power(A=2, B=number_slider_17)
weaverbird_s_tile_2 = WeaverbirdsTile(MeshCurves=curve_11, FillStrategy=1, OptIn=2)
list_item_19 = ListItem(List=deconstruct_brep_2.Edges, Index=[Slider(0, range=0..1), Slider(2, range=0..10)], Wrap=True)
list_item_20 = ListItem(List=deconstruct_brep.Edges, Index=[Slider(0, range=0..1), Slider(2, range=0..10)], Wrap=True)

# ----
# Solver input
edgelengths = EdgeLengths(Mesh=byparent_2, LengthFactor=Slider(1, range=0..1), Strength=1)
show = Show(G=byparent_2)
vertexloads = VertexLoads(Mesh=byparent_2, Strength=Slider(3, range=0..5))
anchor = Anchor(Point=data, Strength=10000)

# ----
# Output
# Solver input
edgelengths_2 = EdgeLengths(Mesh=byparent, LengthFactor=Slider(1, range=0..1), Strength=1)
show_2 = Show(G=byparent)
vertexloads_2 = VertexLoads(Mesh=byparent, Strength=Slider(3, range=0..5))
anchor_2 = Anchor(Point=data_4, Strength=10000)

power_3 = Power(A=2, B=number_slider_17)
divide_curve_20 = DivideCurve(Curve=item_2, Count=power, Kinks=False)  # -> simplify(Points), Tangents, Parameters

list_item_21 = ListItem(List=explode_4.Segments, Index=Slider(3, range=0..10), Wrap=True)  # -> simplify(Item)
tree_branch_5 = TreeBranch(Tree=list_item_21, Path=[Slider(0, range=0..10), Slider(2, range=0..10)], MaintainPaths=True)
tree_branch_6 = TreeBranch(Tree=list_item_21, Path=[Slider(1, range=0..10), Slider(3, range=0..10)], MaintainPaths=True)
divide_curve_21 = DivideCurve(Curve=simplify(tree_branch_5), Count=multiplication_4, Kinks=False)  # -> Points, Tangents, Parameters
divide_curve_22 = DivideCurve(Curve=simplify(tree_branch_6), Count=multiplication_4, Kinks=False)  # -> Points, Tangents, Parameters

power_4 = Power(A=2, B=number_slider_14)

# ----
# Solver input
edgelengths_3 = EdgeLengths(Mesh=byparent_3, LengthFactor=Slider(1, range=0..1), Strength=1)
show_3 = Show(G=byparent_3)
vertexloads_3 = VertexLoads(Mesh=byparent_3, Strength=Slider(2, range=1..5))
anchor_3 = Anchor(Point=data_2, Strength=10000)

multiplication_5 = Multiplication(B=4)
multiplication_6 = Multiplication(B=4)

list_item_22 = ListItem(List=explode_4.Segments, Index=[Slider(2, range=0..10), Slider(4, range=0..10)], Wrap=True)
divide_curve_23 = DivideCurve(Curve=simplify(list_item_22), Count=multiplication_4, Kinks=False)  # -> Points, Tangents, Parameters

byparent_15 = ByParent(Mesh=weaverbird_s_tile, Level=number_slider_14)
medges = MeshEdges(Mesh=byparent_15)  # -> NakedEdges, InteriorEdges, NonManifoldEdges
byparent_16 = ByParent(Mesh=weaverbird_s_tile_2, Level=number_slider_17)
medges_2 = MeshEdges(Mesh=byparent_16)  # -> NakedEdges, InteriorEdges, NonManifoldEdges

# ----
# Result
solver = Solver(GoalObjects=[vertexloads, edgelengths, show, anchor], Reset=Button(), Threshold=1e-15, Tolerance=0.01, On=Toggle(True))  # -> I, V, O
preview = CustomPreview(Geometry=solver.O, Material=ColourSwatch(SwatchColor=RGB(255, 157, 38)))

divide_curve_24 = DivideCurve(Curve=list_item_19, Count=power_3, Kinks=False)  # -> simplify(Points), Tangents, Parameters
divide_curve_25 = DivideCurve(Curve=item, Count=power_2, Kinks=False)  # -> simplify(Points), Tangents, Parameters

# ----
# Result
solver_2 = Solver(
    GoalObjects=[vertexloads_2, edgelengths_2, show_2, anchor_2],
    Reset=Button(),
    Threshold=1e-15,
    Tolerance=0.01,
    On=Toggle(True))  # -> I, V, flatten(O)
preview_2 = CustomPreview(Geometry=solver_2.O, Material=ColourSwatch(SwatchColor=RGB(255, 157, 38)))

# ----
# Solver input
edgelengths_4 = EdgeLengths(Mesh=byparent_6, LengthFactor=Slider(1, range=0..1), Strength=1)
show_4 = Show(G=byparent_6)
vertexloads_4 = VertexLoads(Mesh=byparent_6, Strength=Slider(4, range=0..5))
anchor_4 = Anchor(Point=data_3, Strength=10000)

tree_branch_7 = TreeBranch(Tree=divide_curve_20.Points, Path=Slider(1, range=0..100), MaintainPaths=True)

# ----
# Result
colour_swatch = ColourSwatch(SwatchColor=RGB(255, 157, 38))
solver_3 = Solver(
    GoalObjects=[vertexloads_3, edgelengths_3, show_3, anchor_3],
    Reset=Button(),
    Threshold=1e-15,
    Tolerance=0.01,
    On=Toggle(True))  # -> I, V, O
preview_3 = CustomPreview(Geometry=solver_3.O, Material=colour_swatch)

number_slider_18 = Slider(43, range=0..100)
number_slider_19 = Slider(3, range=0..10)
number_slider_20 = Slider(11, range=0..100)
number_slider_21 = Slider(3, range=0..10)
number_slider_22 = Slider(27, range=0..100)
number_slider_23 = Slider(3, range=0..10)
series = Series(Start=number_slider_22, Step=1, Count=number_slider_23)
series_2 = Series(Start=number_slider_18, Step=1, Count=number_slider_19)
series_3 = Series(Start=number_slider_20, Step=1, Count=number_slider_21)
cull_index = CullIndex(List=tree_branch_7, Indices=[series_3, series, series_2], Wrap=True)

tree_branch_8 = TreeBranch(Tree=divide_curve_20.Points, Path=Slider(0, range=0..100), MaintainPaths=True)
divide_curve_26 = DivideCurve(Curve=list_item_20, Count=power_4, Kinks=False)  # -> simplify(Points), Tangents, Parameters
point = Point([cull_index, tree_branch_8])

# ----
# Result
solver_4 = Solver(
    GoalObjects=[vertexloads_4, edgelengths_4, show_4, anchor_4],
    Reset=Button(),
    Threshold=1e-15,
    Tolerance=0.01,
    On=Toggle(False))  # -> I, V, O
preview_4 = CustomPreview(Geometry=solver_4.O, Material=ColourSwatch(SwatchColor=RGB(255, 157, 38)))

# ----
# Moving the final mesh
Z_2 = UnitZ(Factor=number_slider)
move = Move(Geometry=solver_2.O, Motion=Z_2)  # -> Geometry, Transform

tree_branch_9 = TreeBranch(Tree=divide_curve_25.Points, Path=Slider(0, range=0..100), MaintainPaths=True)
series_4 = Series(Start=Slider(2, range=0..100), Step=1, Count=Slider(6, range=0..10))
series_5 = Series(Start=Slider(33, range=0..100), Step=1, Count=Slider(7, range=0..10))
cull_index_2 = CullIndex(List=tree_branch_9, Indices=[series_4, series_5], Wrap=True)

# ----
# Moving the final mesh
Z_3 = UnitZ(Factor=number_slider_2)
move_2 = Move(Geometry=solver.O, Motion=Z_3)  # -> Geometry, Transform

# ----
# Moving the final mesh
Z_4 = UnitZ(Factor=number_slider_4)
move_3 = Move(Geometry=solver_3.O, Motion=Z_4)  # -> Geometry, Transform

number_slider_24 = Slider(43, range=0..100)
number_slider_25 = Slider(11, range=0..100)
number_slider_26 = Slider(3, range=0..10)
number_slider_27 = Slider(27, range=0..100)
number_slider_28 = Slider(3, range=0..10)
tree_branch_10 = TreeBranch(Tree=divide_curve_25.Points, Path=Slider(1, range=0..100), MaintainPaths=True)
series_6 = Series(Start=number_slider_24, Step=1, Count=Slider(3, range=0..10))
series_7 = Series(Start=number_slider_27, Step=1, Count=number_slider_28)
series_8 = Series(Start=number_slider_25, Step=1, Count=number_slider_26)
cull_index_3 = CullIndex(List=reverse(tree_branch_10), Indices=[series_8, series_7, series_6], Wrap=True)

# ----
# Solver Input
show_5 = Show(G=byparent_5)
vertexloads_5 = VertexLoads(Mesh=byparent_5, Strength=force_on_mesh_9)
edgelengths_5 = EdgeLengths(Mesh=byparent_5, LengthFactor=length_factor_8, Strength=1)
anchor_5 = Anchor(Point=divide_curve_7.Points, Strength=10000)
anchorxyz = AnchorXYZ(Point=divide_curve.Points, X=True, Y=False, Z=False, Strength=1000)
anchorxyz_2 = AnchorXYZ(Point=divide_curve_2.Points, X=False, Y=True, Z=False, Strength=1000)

# ----
# Moving the final mesh
Z_5 = UnitZ(Factor=number_slider_3)
move_4 = Move(Geometry=solver_4.O, Motion=Z_5)  # -> Geometry, Transform

subtraction = Subtraction(A=number_slider_22, B=1)
addition = Addition(A=number_slider_22, B=number_slider_23)
subtraction_2 = Subtraction(A=number_slider_18, B=1)
addition_2 = Addition(A=number_slider_18, B=number_slider_19)
subtraction_3 = Subtraction(A=number_slider_20, B=1)
addition_3 = Addition(A=number_slider_20, B=number_slider_21)
list_item_23 = ListItem(List=tree_branch_7, Index=subtraction, Wrap=True)
list_item_24 = ListItem(List=tree_branch_7, Index=addition, Wrap=True)
list_item_25 = ListItem(List=tree_branch_7, Index=subtraction_2, Wrap=True)
list_item_26 = ListItem(List=tree_branch_7, Index=addition_2, Wrap=True)
list_item_27 = ListItem(List=tree_branch_7, Index=subtraction_3, Wrap=True)
list_item_28 = ListItem(List=tree_branch_7, Index=addition_3, Wrap=True)

subtraction_4 = Subtraction(A=number_slider_27, B=1)
addition_4 = Addition(A=number_slider_27, B=number_slider_28)
subtraction_5 = Subtraction(A=number_slider_24, B=1)
addition_5 = Addition(A=number_slider_24, B=number_slider_28)
subtraction_6 = Subtraction(A=number_slider_25, B=1)
addition_6 = Addition(A=number_slider_25, B=number_slider_26)

solver_5 = Solver(
    GoalObjects=[show_5, vertexloads_5, edgelengths_5, anchor_5, anchorxyz, anchorxyz_2],
    Reset=Button(),
    Threshold=1e-15,
    Tolerance=0.01,
    On=Toggle(True))  # -> I, V, O
clean_tree = CleanTree(RemoveNulls=True, RemoveInvalid=True, RemoveEmpty=False, Tree=solver_5.O)  # -> flatten(Tree)
split_list = SplitList(List=clean_tree, Index=80)  # -> ListA, ListB
unit_z = UnitZ(Factor=column_height_8)
mesh_join_2 = MeshJoin(Meshes=split_list.ListA)
move_5 = Move(Geometry=mesh_join_2, Motion=unit_z)  # -> Geometry, Transform
weaverbird_s_mesh_thicken = WeaverbirdsMeshThicken(MeshCurves=move_5.Geometry, Distance=mesh_thickness, OffsetType=0)
# Moving the final mesh
move_to_point = MoveToPoint(Geometry=weaverbird_s_mesh_thicken, PointA=startingpoint, PointB=finalpoints)  # -> Moved, Vector, Transform

list_item_29 = ListItem(List=reverse(tree_branch_10), Index=subtraction_4, Wrap=True)
list_item_30 = ListItem(List=reverse(tree_branch_10), Index=addition_4, Wrap=True)
list_item_31 = ListItem(List=reverse(tree_branch_10), Index=subtraction_5, Wrap=True)
list_item_32 = ListItem(List=reverse(tree_branch_10), Index=addition_5, Wrap=True)
list_item_33 = ListItem(List=reverse(tree_branch_10), Index=subtraction_6, Wrap=True)
list_item_34 = ListItem(List=reverse(tree_branch_10), Index=addition_6, Wrap=True)
panel_7 = Panel(cull_index_3)
_4point_surface = _4PointSurface(CornerA=list_item_29, CornerB=list_item_30, CornerC=list_item_24, CornerD=list_item_23)
_4point_surface_2 = _4PointSurface(CornerA=list_item_31, CornerB=list_item_32, CornerC=list_item_26, CornerD=list_item_25)
_4point_surface_3 = _4PointSurface(CornerA=list_item_33, CornerB=list_item_34, CornerC=list_item_28, CornerD=list_item_27)

# ----
# Solver Input
show_6 = Show(G=byparent_10)
vertexloads_6 = VertexLoads(Mesh=byparent_10, Strength=force_on_mesh_8)
edgelengths_6 = EdgeLengths(Mesh=byparent_10, LengthFactor=length_factor_7, Strength=1)
anchor_6 = Anchor(Point=divide_curve_5.Points, Strength=10000)
anchorxyz_3 = AnchorXYZ(Point=divide_curve_6.Points, X=True, Y=False, Z=False, Strength=1000)

# ----
# Solver Input
show_7 = Show(G=mesh_join)
vertexloads_7 = VertexLoads(Mesh=mesh_join, Strength=force_on_mesh)
edgelengths_7 = EdgeLengths(Mesh=mesh_join, LengthFactor=length_factor, Strength=1)
anchor_7 = Anchor(Point=divide_curve_23.Points, Strength=10000)
anchor_8 = Anchor(Point=divide_curve_8.Points, Strength=10000)
anchorxyz_4 = AnchorXYZ(Point=[divide_curve_21.Points, tree_branch_4], X=True, Y=False, Z=False, Strength=1000)
anchorxyz_5 = AnchorXYZ(Point=[divide_curve_22.Points, tree_branch_3], X=False, Y=True, Z=False, Strength=1000)

# ----
# Solver Input
show_8 = Show(G=byparent_8)
vertexloads_8 = VertexLoads(Mesh=byparent_8, Strength=force_on_mesh_2)
edgelengths_8 = EdgeLengths(Mesh=byparent_8, LengthFactor=length_factor_2, Strength=1)
anchor_9 = Anchor(Point=divide_curve_10.Points, Strength=10000)
anchorxyz_6 = AnchorXYZ(Point=divide_curve_11.Points, X=True, Y=False, Z=False, Strength=1000)

# ----
# Solver Input
show_9 = Show(G=byparent_9)
vertexloads_9 = VertexLoads(Mesh=byparent_9, Strength=force_on_mesh_3)
edgelengths_9 = EdgeLengths(Mesh=byparent_9, LengthFactor=length_factor_3, Strength=1)
anchor_10 = Anchor(Point=divide_curve_12.Points, Strength=10000)
anchorxyz_7 = AnchorXYZ(Point=divide_curve_13.Points, X=True, Y=False, Z=False, Strength=1000)

# ----
# Solver Input
show_10 = Show(G=byparent_11)
vertexloads_10 = VertexLoads(Mesh=byparent_11, Strength=force_on_mesh_4)
edgelengths_10 = EdgeLengths(Mesh=byparent_11, LengthFactor=length_factor_4, Strength=1)
anchor_11 = Anchor(Point=divide_curve_14.Points, Strength=10000)
anchorxyz_8 = AnchorXYZ(Point=divide_curve_15.Points, X=False, Y=True, Z=False, Strength=1000)

# ----
# Solver Input
show_11 = Show(G=byparent_13)
vertexloads_11 = VertexLoads(Mesh=byparent_13, Strength=force_on_mesh_5)
edgelengths_11 = EdgeLengths(Mesh=byparent_13, LengthFactor=length_factor_5, Strength=1)
anchor_12 = Anchor(Point=divide_curve_16.Points, Strength=10000)
anchorxyz_9 = AnchorXYZ(Point=divide_curve_17.Points, X=True, Y=True, Z=False, Strength=1000)

# ----
# Solver Input
show_12 = Show(G=byparent_14)
vertexloads_12 = VertexLoads(Mesh=byparent_14, Strength=force_on_mesh_6)
edgelengths_12 = EdgeLengths(Mesh=byparent_14, LengthFactor=length_factor_6, Strength=1)
anchor_13 = Anchor(Point=divide_curve_18.Points, Strength=10000)
anchorxyz_10 = AnchorXYZ(Point=divide_curve_19.Points, X=True, Y=True, Z=False, Strength=1000)

# ----
# Solver Input
show_13 = Show(G=byparent_12)
vertexloads_13 = VertexLoads(Mesh=byparent_12, Strength=force_on_mesh_10)
edgelengths_13 = EdgeLengths(Mesh=byparent_12, LengthFactor=Slider(0.5, range=0..1), Strength=1)
anchor_14 = Anchor(Point=divide_curve_3.Points, Strength=10000)
anchorxyz_11 = AnchorXYZ(Point=divide_curve_4.Points, X=True, Y=False, Z=False, Strength=1000)

number_slider_29 = Slider(4, range=0..10)
surface_2 = Surface([_4point_surface_3, _4point_surface, _4point_surface_2])

solver_6 = Solver(
    GoalObjects=[show_6, vertexloads_6, edgelengths_6, anchor_6, anchorxyz_3],
    Reset=Button(),
    Threshold=1e-15,
    Tolerance=0.01,
    On=Toggle(False))  # -> I, V, O
clean_tree_2 = CleanTree(RemoveNulls=True, RemoveInvalid=True, RemoveEmpty=False, Tree=solver_6.O)  # -> flatten(Tree)
split_list_2 = SplitList(List=clean_tree_2, Index=Slider(16, range=0..100))  # -> ListA, ListB
unit_z_2 = UnitZ(Factor=column_height_7)
mesh_join_3 = MeshJoin(Meshes=split_list_2.ListA)
move_6 = Move(Geometry=mesh_join_3, Motion=unit_z_2)  # -> Geometry, Transform
weaverbird_s_mesh_thicken_2 = WeaverbirdsMeshThicken(MeshCurves=move_6.Geometry, Distance=Slider(250, range=-250..250), OffsetType=0)

mesh_surface_2 = MeshSurface(Surface=surface_2, UCount=number_slider_29, VCount=Slider(1, range=0..1), Overhang=True, Equalize=False)
weld_mesh = WeldMesh(Mesh=[byparent_15, byparent_16, mesh_surface_2], Angle=3.141592654)
mesh_join_4 = MeshJoin(Meshes=weld_mesh)  # -> flatten(Mesh)
mesh_edges_2 = MeshEdges(Mesh=weld_mesh)  # -> NakedEdges, InteriorEdges, NonManifoldEdges

solver_7 = Solver(
    GoalObjects=[show_13, vertexloads_13, edgelengths_13, anchor_14, anchorxyz_11],
    Reset=Button(),
    Threshold=1e-15,
    Tolerance=0.01,
    On=Toggle(False))  # -> I, V, O
clean_tree_3 = CleanTree(RemoveNulls=True, RemoveInvalid=True, RemoveEmpty=False, Tree=solver_7.O)  # -> flatten(Tree)
split_list_3 = SplitList(List=clean_tree_3, Index=Slider(16, range=0..100))  # -> ListA, ListB
unit_z_3 = UnitZ(Factor=column_height_9)
mesh_join_5 = MeshJoin(Meshes=split_list_3.ListA)
move_7 = Move(Geometry=mesh_join_5, Motion=unit_z_3)  # -> Geometry, Transform
weaverbird_s_mesh_thicken_3 = WeaverbirdsMeshThicken(MeshCurves=move_7.Geometry, Distance=Slider(250, range=-250..250), OffsetType=0)

solver_8 = Solver(
    GoalObjects=[show_7, vertexloads_7, edgelengths_7, anchor_7, anchor_8, anchorxyz_4, anchorxyz_5],
    Reset=Button(),
    Threshold=1e-15,
    Tolerance=0.01,
    On=Toggle(False))  # -> I, V, O
clean_tree_4 = CleanTree(RemoveNulls=True, RemoveInvalid=True, RemoveEmpty=False, Tree=solver_8.O)  # -> flatten(Tree)
list_item_35 = ListItem(List=clean_tree_4, Index=0, Wrap=True)
unit_z_4 = UnitZ(Factor=column_height)
move_8 = Move(Geometry=list_item_35, Motion=unit_z_4)  # -> Geometry, Transform
weaverbird_s_mesh_thicken_4 = WeaverbirdsMeshThicken(MeshCurves=move_8.Geometry, Distance=Slider(-250, range=-250..1000), OffsetType=0)

mesh_edges_3 = MeshEdges(Mesh=mesh_surface_2)  # -> NakedEdges, InteriorEdges, NonManifoldEdges
explode_11 = Explode(Curve=surface_2, Recursive=True)  # -> Segments, Vertices

solver_9 = Solver(
    GoalObjects=[show_8, vertexloads_8, edgelengths_8, anchor_9, anchorxyz_6],
    Reset=Button(),
    Threshold=1e-15,
    Tolerance=0.01,
    On=Toggle(False))  # -> I, V, O
clean_tree_5 = CleanTree(RemoveNulls=True, RemoveInvalid=True, RemoveEmpty=False, Tree=solver_9.O)  # -> flatten(Tree)
split_list_4 = SplitList(List=clean_tree_5, Index=Slider(16, range=0..100))  # -> ListA, ListB
unit_z_5 = UnitZ(Factor=column_height_2)
mesh_join_6 = MeshJoin(Meshes=split_list_4.ListA)
move_9 = Move(Geometry=mesh_join_6, Motion=unit_z_5)  # -> Geometry, Transform

solver_10 = Solver(
    GoalObjects=[show_9, vertexloads_9, edgelengths_9, anchor_10, anchorxyz_7],
    Reset=Button(),
    Threshold=1e-15,
    Tolerance=0.01,
    On=Toggle(False))  # -> I, V, O
clean_tree_6 = CleanTree(RemoveNulls=True, RemoveInvalid=True, RemoveEmpty=False, Tree=solver_10.O)  # -> flatten(Tree)
split_list_5 = SplitList(List=clean_tree_6, Index=Slider(16, range=0..100))  # -> ListA, ListB
unit_z_6 = UnitZ(Factor=column_height_3)
mesh_join_7 = MeshJoin(Meshes=split_list_5.ListA)
move_10 = Move(Geometry=mesh_join_7, Motion=unit_z_6)  # -> Geometry, Transform

# ----
# Result
solver_11 = Solver(
    GoalObjects=[show_10, vertexloads_10, edgelengths_10, anchor_11, anchorxyz_8],
    Reset=Button(),
    Threshold=1e-15,
    Tolerance=0.01,
    On=Toggle(False))  # -> I, V, O
clean_tree_7 = CleanTree(RemoveNulls=True, RemoveInvalid=True, RemoveEmpty=False, Tree=solver_11.O)  # -> flatten(Tree)
split_list_6 = SplitList(List=clean_tree_7, Index=Slider(16, range=0..100))  # -> ListA, ListB
unit_z_7 = UnitZ(Factor=column_height_4)
mesh_join_8 = MeshJoin(Meshes=split_list_6.ListA)
move_11 = Move(Geometry=mesh_join_8, Motion=unit_z_7)  # -> Geometry, Transform

solver_12 = Solver(
    GoalObjects=[show_11, vertexloads_11, edgelengths_11, anchor_12, anchorxyz_9],
    Reset=Button(),
    Threshold=1e-15,
    Tolerance=0.01,
    On=Toggle(False))  # -> I, V, O
clean_tree_8 = CleanTree(RemoveNulls=True, RemoveInvalid=True, RemoveEmpty=False, Tree=solver_12.O)  # -> flatten(Tree)
split_list_7 = SplitList(List=clean_tree_8, Index=Slider(16, range=0..100))  # -> ListA, ListB
unit_z_8 = UnitZ(Factor=column_height_5)
mesh_join_9 = MeshJoin(Meshes=split_list_7.ListA)
move_12 = Move(Geometry=mesh_join_9, Motion=unit_z_8)  # -> Geometry, Transform

solver_13 = Solver(
    GoalObjects=[show_12, vertexloads_12, edgelengths_12, anchor_13, anchorxyz_10],
    Reset=Button(),
    Threshold=1e-15,
    Tolerance=0.01,
    On=Toggle(True))  # -> I, V, O
clean_tree_9 = CleanTree(RemoveNulls=True, RemoveInvalid=True, RemoveEmpty=False, Tree=solver_13.O)  # -> flatten(Tree)
split_list_8 = SplitList(List=clean_tree_9, Index=Slider(16, range=0..100))  # -> ListA, ListB
unit_z_9 = UnitZ(Factor=column_height_6)
mesh_join_10 = MeshJoin(Meshes=split_list_8.ListA)
move_13 = Move(Geometry=mesh_join_10, Motion=unit_z_9)  # -> Geometry, Transform

crv_10 = Curve([<curve referenced from the Rhino model> x85])
boundary_2 = BoundarySurfaces(Edges=crv_10)
Z_6 = UnitZ(Factor=column_height_8)
extr_2 = Extrude(Base=boundary_2, Direction=Z_6)

anchor_15 = Anchor(Strength=10000)
list_item_36 = ListItem(List=explode_11.Segments, Index=[Slider(0, range=0..100), Slider(2, range=0..10)], Wrap=True)
divide_curve_27 = DivideCurve(Curve=list_item_36, Count=number_slider_29, Kinks=False)  # -> Points, Tangents, Parameters
edgelengths_14 = EdgeLengths(Mesh=mesh_join_4, LengthFactor=1, Strength=1)
anchor_16 = Anchor(Point=flatten(point), Strength=10000)
anchor_17 = Anchor(Point=flatten([cull_index_2, cull_index_3, divide_curve_27.Points]), Strength=10000)
anchorxyz_12 = AnchorXYZ(Point=[divide_curve_26.Points, divide_curve_24.Points], X=True, Y=False, Z=False, Strength=1000)
vertexloads_14 = VertexLoads(Mesh=mesh_join_4, Strength=force_on_mesh_7)
anchorxyz_13 = AnchorXYZ(Point=[tree_branch_7, cull_index_3], X=False, Y=True, Z=False, Strength=1000)
anchorxyz_14 = AnchorXYZ(Point=[tree_branch_9, tree_branch_10], X=False, Y=True, Z=False, Strength=1000)
show_14 = Show(G=mesh_join_4)
solver_14 = Solver(
    GoalObjects=[show_14, vertexloads_14, edgelengths_14, anchor_16, anchorxyz_12, anchor_17, anchorxyz_14, anchorxyz_13],
    Reset=Button(),
    Threshold=1e-15,
    Tolerance=0.01,
    On=Toggle(False))  # -> I, V, simplify(O)

weaverbird_s_mesh_thicken_5 = WeaverbirdsMeshThicken(MeshCurves=move_9.Geometry, Distance=Slider(400, range=-250..500), OffsetType=0)
weaverbird_s_mesh_thicken_6 = WeaverbirdsMeshThicken(MeshCurves=move_10.Geometry, Distance=Slider(150, range=-250..250), OffsetType=0)
weaverbird_s_mesh_thicken_7 = WeaverbirdsMeshThicken(MeshCurves=move_11.Geometry, Distance=Slider(150, range=-250..250), OffsetType=0)
weaverbird_s_mesh_thicken_8 = WeaverbirdsMeshThicken(MeshCurves=move_12.Geometry, Distance=Slider(150, range=-250..250), OffsetType=0)
weaverbird_s_mesh_thicken_9 = WeaverbirdsMeshThicken(MeshCurves=move_13.Geometry, Distance=Slider(150, range=-250..250), OffsetType=0)

clean_tree_10 = CleanTree(RemoveNulls=True, RemoveInvalid=True, RemoveEmpty=False, Tree=flatten(solver_14.O))
unit_z_10 = UnitZ(Factor=Slider(1700, range=0..10000))
list_item_37 = ListItem(List=clean_tree_10, Index=[Slider(0, range=0..100), Slider(1, range=0..1)], Wrap=True)
mesh_join_11 = MeshJoin(Meshes=list_item_37)
move_14 = Move(Geometry=mesh_join_11, Motion=unit_z_10)  # -> Geometry, Transform

panel_8 = Panel(clean_tree_10)
mesh_edges_4 = MeshEdges(Mesh=list_item_37)  # -> NakedEdges, InteriorEdges, NonManifoldEdges
panel_9 = Panel(mesh_edges_4.NakedEdges)

# ----
# Output
custom_preview = CustomPreview(
    Geometry=move_14.Geometry,
    Material={diffuse=RGB(221, 160, 221), emission=RGB(66, 48, 66), shine=0.5, specular=RGB(255, 255, 255), transparency=0})

weaverbird_s_mesh_thicken_10 = WeaverbirdsMeshThicken(MeshCurves=move_14.Geometry, Distance=Slider(250, range=0..1000), OffsetType=0)
list_item_38 = ListItem(List=mesh_edges_4.NakedEdges, Index=Slider(130, range=0..1000), Wrap=True)
mesh_join_12 = MeshJoin(Meshes=weaverbird_s_mesh_thicken_10)
