# Grasshopper definition Arcade_-_Cross_vault.gh (Grasshopper 1.0.7)
# Copyright: Arup
# plug-ins: MetaHopper, Kangaroo2 Components

# ----
# Simulation Settings
reset = Button()  # disabled
simulation_toggle = BooleanToggle(False)  # disabled
force_on_mesh = Slider(0.3, range=0..1)  # disabled
edgelength_factor = Slider(1, range=0..1)  # disabled

# ----
# Group Toggel
group_toggle = GroupToggle(ToggleActive=True, ToggleVisible=False)  # disabled

# ----
# Groups
# External input
# Parameters
# Arcade
# Origin
point = Point(<point referenced from the Rhino model>)  # disabled

# ----
# Dimension Paramaters
square_size = Slider(250, range=0..1000)  # disabled
column_width = Slider(0.15, range=0..1)  # disabled
column_height = Slider(160, range=0..1000)  # disabled

# ----
# Output
# Base plate + Walls
unit_x = UnitX(Factor=square_size)  # disabled
unit_y = UnitY(Factor=square_size)  # disabled
move = Move(Geometry=point, Motion=unit_y)  # -> Geometry, Transform; disabled
move_2 = Move(Geometry=point, Motion=expr("-x", unit_x))  # -> Geometry, Transform; disabled
move_3 = Move(Geometry=move_2.Geometry, Motion=unit_y)  # -> Geometry, Transform; disabled
_4point_surface = _4PointSurface(CornerA=point, CornerB=move_2.Geometry, CornerC=move_3.Geometry, CornerD=move.Geometry)  # disabled
number_slider = Slider(1, range=0..1)  # disabled
explode = Explode(Curve=_4point_surface, Recursive=True)  # -> Segments, Vertices; disabled
subtraction = Subtraction(A=number_slider, B=column_width)  # disabled
evaluate_curve = EvaluateCurve(Curve=reparameterize(explode.Segments), Parameter=column_width)  # -> Point, Tangent, Angle; disabled
evaluate_curve_2 = EvaluateCurve(Curve=reparameterize(explode.Segments), Parameter=subtraction)  # -> Point, Tangent, Angle; disabled
number_slider_2 = Slider(2, range=0..10)  # disabled
number_slider_3 = Slider(2, range=0..10)  # disabled
number_slider_4 = Slider(4, range=0..10)  # disabled
list_item = ListItem(List=evaluate_curve_2.Point, Index=0, Wrap=True)  # disabled
list_item_2 = ListItem(List=evaluate_curve.Point, Index=number_slider_3, Wrap=True)  # disabled
list_item_3 = ListItem(List=evaluate_curve_2.Point, Index=number_slider_2, Wrap=True)  # disabled
list_item_4 = ListItem(List=evaluate_curve.Point, Index=number_slider_4, Wrap=True)  # disabled
line = Line(StartPoint=list_item, EndPoint=list_item_2)  # disabled
line_2 = Line(StartPoint=list_item_3, EndPoint=list_item_4)  # disabled
evaluate_curve_3 = EvaluateCurve(Curve=reparameterize(line), Parameter=subtraction)  # -> Point, Tangent, Angle; disabled
evaluate_curve_4 = EvaluateCurve(Curve=reparameterize(line), Parameter=column_width)  # -> Point, Tangent, Angle; disabled
evaluate_curve_5 = EvaluateCurve(Curve=reparameterize(line_2), Parameter=subtraction)  # -> Point, Tangent, Angle; disabled
evaluate_curve_6 = EvaluateCurve(Curve=reparameterize(line_2), Parameter=column_width)  # -> Point, Tangent, Angle; disabled
list_item_5 = ListItem(List=explode.Vertices, Index=0, Wrap=True)  # -> Item, Item1, Item2, Item3; disabled
list_item_6 = ListItem(List=evaluate_curve_2.Point, Index=0, Wrap=True)  # -> Item, Item1, Item2, Item3; disabled
list_item_7 = ListItem(List=evaluate_curve.Point, Index=0, Wrap=True)  # -> Item, Item1, Item2, Item3; disabled
point_2 = Point(list_item_6.Item3)  # disabled
point_3 = Point(list_item_7.Item)  # disabled
point_4 = Point(list_item_6.Item1)  # disabled
point_5 = Point(list_item_7.Item2)  # disabled
point_6 = Point(list_item_5.Item1)  # disabled
point_7 = Point(list_item_6.Item)  # disabled
point_8 = Point(evaluate_curve_4.Point)  # disabled
point_9 = Point(list_item_7.Item1)  # disabled
point_10 = Point(list_item_5.Item)  # disabled
point_11 = Point(evaluate_curve_5.Point)  # disabled
point_12 = Point(list_item_5.Item2)  # disabled
point_13 = Point(evaluate_curve_3.Point)  # disabled
point_14 = Point(list_item_5.Item3)  # disabled
point_15 = Point(list_item_6.Item2)  # disabled
point_16 = Point(evaluate_curve_6.Point)  # disabled
point_17 = Point(list_item_7.Item3)  # disabled
_4point_surface_2 = _4PointSurface(CornerA=point_6, CornerB=point_7, CornerC=point_8, CornerD=point_9)  # disabled
_4point_surface_3 = _4PointSurface(CornerA=point_10, CornerB=point_2, CornerC=point_11, CornerD=point_3)  # disabled
_4point_surface_4 = _4PointSurface(CornerA=point_12, CornerB=point_4, CornerC=point_13, CornerD=point_5)  # disabled
_4point_surface_5 = _4PointSurface(CornerA=point_14, CornerB=point_15, CornerC=point_16, CornerD=point_17)  # disabled
explode_2 = Explode(Curve=_4point_surface_2, Recursive=True)  # -> Segments, Vertices; disabled
explode_3 = Explode(Curve=_4point_surface_3, Recursive=True)  # -> Segments, Vertices; disabled
explode_4 = Explode(Curve=_4point_surface_4, Recursive=True)  # -> Segments, Vertices; disabled
explode_5 = Explode(Curve=_4point_surface_5, Recursive=True)  # -> Segments, Vertices; disabled
list_item_8 = ListItem(List=explode_2.Segments, Index=0, Wrap=True)  # -> Item, Item1; disabled
unit_z = UnitZ(Factor=column_height)  # disabled
list_item_9 = ListItem(List=explode_3.Segments, Index=0, Wrap=True)  # -> Item, Item1; disabled
list_item_10 = ListItem(List=explode_4.Segments, Index=0, Wrap=True)  # -> Item, Item1; disabled
list_item_11 = ListItem(List=explode_5.Segments, Index=0, Wrap=True)  # -> Item, Item1; disabled
curve = Curve([list_item_8.Item1, list_item_8.Item])  # disabled
curve_2 = Curve([list_item_9.Item1, list_item_9.Item])  # disabled
curve_3 = Curve([list_item_10.Item1, list_item_10.Item])  # disabled
curve_4 = Curve([list_item_11.Item1, list_item_11.Item])  # disabled
extrude = Extrude(Base=curve_3, Direction=unit_z)  # disabled
extrude_2 = Extrude(Base=curve, Direction=unit_z)  # disabled
extrude_3 = Extrude(Base=curve_2, Direction=unit_z)  # disabled
extrude_4 = Extrude(Base=curve_4, Direction=unit_z)  # disabled

# ----
# Mesh for welding spots
number_slider_5 = Slider(20, range=0..100)  # disabled
unit_x_2 = UnitX(Factor=square_size)  # disabled
panel = Panel("""90
180
270""")  # disabled
radians = Radians(Degrees=panel)  # disabled

# ----
# Points for anchor
surface = Surface(_4point_surface)  # disabled
move_4 = Move(Geometry=surface, Motion=unit_z)  # -> Geometry, Transform; disabled
explode_6 = Explode(Curve=move_4.Geometry, Recursive=True)  # -> Segments, Vertices; disabled
divide_curve = DivideCurve(Curve=explode_6.Segments, Count=number_slider_5, Kinks=False)  # -> simplify(Points), Tangents, Parameters; disabled
panel_2 = Panel("""0
1
2
3
-1
-2
-3
-4""")  # disabled
list_item_12 = ListItem(List=divide_curve.Points, Index=panel_2, Wrap=True)  # disabled
multiplication = Multiplication(A=square_size, B=2)  # disabled
unit_x_3 = UnitX(Factor=multiplication)  # disabled
unit_y_2 = UnitY(Factor=multiplication)  # disabled

mesh_surface = MeshSurface(Surface=move_4.Geometry, UCount=number_slider_5, VCount=number_slider_5, Overhang=True, Equalize=False)  # disabled
area = Area(Geometry=mesh_surface)  # -> Area, Centroid; disabled
move_5 = Move(Geometry=mesh_surface, Motion=unit_x_2)  # -> Geometry, Transform; disabled
rotate = Rotate(Geometry=move_5.Geometry, Angle=radians, Plane=area.Centroid)  # -> Geometry, Transform; disabled
weld_mesh = WeldMesh(Mesh=[rotate.Geometry, move_5.Geometry, mesh_surface], Angle=3.141592654)  # disabled

move_6 = Move(Geometry=[mesh_surface, list_item_12], Motion=unit_x_2)  # -> Geometry, Transform; disabled
move_7 = Move(Geometry=move_6.Geometry, Motion=expr("-x", unit_x_3))  # -> Geometry, Transform; disabled
split_list = SplitList(List=move_6.Geometry, Index=1)  # -> ListA, ListB; disabled
rotate_2 = Rotate(Geometry=move_7.Geometry, Angle=1.570796327, Plane=area.Centroid)  # -> Geometry, Transform; disabled
move_8 = Move(Geometry=rotate_2.Geometry, Motion=unit_y_2)  # -> Geometry, Transform; disabled
split_list_2 = SplitList(List=move_7.Geometry, Index=1)  # -> ListA, ListB; disabled
split_list_3 = SplitList(List=move_8.Geometry, Index=1)  # -> ListA, ListB; disabled
split_list_4 = SplitList(List=rotate_2.Geometry, Index=1)  # -> ListA, ListB; disabled
point_18 = Point([split_list.ListB, split_list_2.ListB, split_list_4.ListB, split_list_3.ListB])  # disabled

# ----
# Goal Objects
show = Show(G=weld_mesh)  # disabled
vertexloads = VertexLoads(Mesh=weld_mesh, Strength=force_on_mesh)  # disabled
edgelengths = EdgeLengths(Mesh=weld_mesh, LengthFactor=edgelength_factor, Strength=1)  # disabled
anchor = Anchor(Point=list_item_12, Strength=10000)  # disabled
anchor_2 = Anchor(Point=point_18, Strength=10000)  # disabled

# ----
# Solver + Result
bouncysolver = BouncySolver(
    GoalObjects=[anchor, vertexloads, show, edgelengths, anchor_2],
    Reset=reset,
    Threshold=1e-15,
    Tolerance=0.01,
    Damping=0.99,
    Iterations=10,
    On=simulation_toggle)  # -> I, V, O; disabled
number_slider_6 = Slider(12, range=0..12)  # disabled
colour_swatch = ColourSwatch(SwatchColor=RGB(140, 173, 189))
mesh = Mesh([extrude_2, extrude_4, extrude_3, extrude])  # disabled
list_item_13 = ListItem(List=bouncysolver.O, Index=number_slider_6, Wrap=True)  # disabled
custom_preview = CustomPreview(Geometry=bouncysolver.O, Material=colour_swatch)  # disabled

# ----
# Final Mesh
mesh_2 = Mesh([list_item_13, mesh])  # disabled

custom_preview_2 = CustomPreview(Geometry=mesh_2, Material=colour_swatch)
