# Grasshopper definition Entrence_-_Barrel_vaults.gh (Grasshopper 1.0.7)
# Copyright: Arup
# plug-ins: Weaverbird, MetaHopper, Kangaroo2 Components

# ----
# Global Parameters
floor_thickness = Slider(400, range=0..600)
# Groups
# External input
wall_height = Slider(2200, range=2000..3000)
colour_swatch = ColourSwatch(SwatchColor=RGB(45, 134, 255))

reset = Button()
mesh_density = Slider(4, range=0..5)
force_y_dir = Slider(1, range=0..5)
force_x_dir = Slider(2.5, range=0..5)
length_factor = Slider(1, range=0..1)
force_balcony = Slider(1.2, range=0..5)

curve = Curve([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])
curve_2 = Curve(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)
curve_3 = Curve([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])

reset_2 = Button()
mesh_density_2 = Slider(4, range=0..5)
force = Slider(5, range=0..5)
length_factor_2 = Slider(1, range=0..1)

# ----
# Entrence 00 - Collums
width = Slider(500, range=0..1000)
group_toggle = GroupToggle(ToggleActive=True, ToggleVisible=False)  # disabled
# Output
# Parameters
point = Point([Point(45250, 27250, 0), Point(46850, 27250, 0), Point(50250, 27250, 0), Point(45250, 24750, 0), Point(46875, 24750, 0), Point(51125, 24750, 0), Point(52750, 24750, 0), Point(52750, 22000, 0), Point(51125, 22000, 0), Point(46875, 22000, 0), Point(45250, 22000, 0), Point(45250, 17500, 0), Point(46875, 17500, 0), Point(51125, 17500, 0), Point(52750, 17500, 0), Point(52750, 14750, 0), Point(51125, 14750, 0), Point(50250, 14750, 0), Point(46875, 14750, 0), Point(45250, 14750, 0), Point(45250, 12250, 0), Point(50250, 12250, 0)])
division = Division(A=wall_height, B=2)
unit_z = UnitZ(Factor=division)

unit_y = UnitY(Factor=width)
move = Move(Geometry=point, Motion=unit_y)  # -> Geometry, Transform
unit_x = UnitX(Factor=width)
move_2 = Move(Geometry=move.Geometry, Motion=expr("-x", unit_x))  # -> Geometry, Transform
unit_z_2 = UnitZ(Factor=wall_height)
move_3 = Move(Geometry=move_2.Geometry, Motion=unit_z_2)  # -> Geometry, Transform

box_2pt = Box2Pt(PointA=point, PointB=move_3.Geometry, Plane=PlaneXY(0, 0, 0))
area = Area(Geometry=box_2pt)  # -> Area, Centroid
move_4 = Move(Geometry=area.Centroid, Motion=unit_z)  # -> Geometry, Transform

# ----
# Entrence 01 - Collums
division_2 = Division(A=wall_height, B=2)
unit_z_3 = UnitZ(Factor=division_2)

# ----
# Entrance - First floor
# Script for creating the first floor of the entrance. Different forces can be applied to make the height of the domes similair
group_toggle_2 = GroupToggle(ToggleActive=True, ToggleVisible=False)  # disabled
move_5 = Move(Geometry=curve, Motion=unit_z_2)  # -> Geometry, Transform
move_6 = Move(Geometry=curve_3, Motion=unit_z_2)  # -> Geometry, Transform
move_7 = Move(Geometry=curve_2, Motion=unit_z_2)  # -> Geometry, Transform

# ----
# Entrance - Second Floor
curve_4 = Curve([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])

# ----
# Y-dir
boundary_surfaces = BoundarySurfaces(Edges=move_5.Geometry)
deconstruct_brep = DeconstructBrep(Brep=boundary_surfaces)  # -> Faces, Edges, Vertices
weaverbird_s_tile = WeaverbirdsTile(MeshCurves=move_5.Geometry, FillStrategy=1, OptIn=2)
byparent = ByParent(Mesh=weaverbird_s_tile, Level=mesh_density)
show = Show(G=byparent)
vertexloads = VertexLoads(Mesh=byparent, Strength=force_x_dir)
edgelengths = EdgeLengths(Mesh=byparent, LengthFactor=length_factor, Strength=1)

length = Length(Curve=deconstruct_brep.Edges)
sort_list = SortList(Keys=length)  # -> Keys, ValuesValuesA
list_item = ListItem(List=sort_list.Keys, Index=1, Wrap=True)
smaller_than = SmallerThan(FirstNumber=list_item, SecondNumber=length)  # -> SmallerThan, OrEqualTo
cull_pattern = CullPattern(List=deconstruct_brep.Edges, CullPattern=smaller_than.SmallerThan)
power = Power(A=2, B=mesh_density)

# ----
# Balcony
boundary_surfaces_2 = BoundarySurfaces(Edges=move_7.Geometry)
deconstruct_brep_2 = DeconstructBrep(Brep=boundary_surfaces_2)  # -> Faces, Edges, Vertices
weaverbird_s_tile_2 = WeaverbirdsTile(MeshCurves=move_7.Geometry, FillStrategy=1, OptIn=2)
byparent_2 = ByParent(Mesh=weaverbird_s_tile_2, Level=mesh_density)
show_2 = Show(G=byparent_2)
vertexloads_2 = VertexLoads(Mesh=byparent_2, Strength=force_balcony)
edgelengths_2 = EdgeLengths(Mesh=byparent_2, LengthFactor=length_factor, Strength=1)

length_2 = Length(Curve=deconstruct_brep_2.Edges)
sort_list_2 = SortList(Keys=length_2)  # -> Keys, ValuesValuesA
list_item_2 = ListItem(List=sort_list_2.Keys, Index=1, Wrap=True)
smaller_than_2 = SmallerThan(FirstNumber=list_item_2, SecondNumber=length_2)  # -> SmallerThan, OrEqualTo
cull_pattern_2 = CullPattern(List=deconstruct_brep_2.Edges, CullPattern=smaller_than_2.SmallerThan)
power_2 = Power(A=2, B=mesh_density)

divide_curve = DivideCurve(Curve=cull_pattern_2, Count=power_2, Kinks=False)  # -> Points, Tangents, Parameters
point_2 = Point(divide_curve.Points)
anchor = Anchor(Point=point_2, Strength=10000)
solver = Solver(GoalObjects=[anchor, edgelengths_2, vertexloads_2, show_2], Reset=reset, Threshold=1e-15, Tolerance=0.01, On=True)  # -> I, V, O

# ----
# X-dir
boundary_surfaces_3 = BoundarySurfaces(Edges=move_6.Geometry)
deconstruct_brep_3 = DeconstructBrep(Brep=boundary_surfaces_3)  # -> Faces, Edges, Vertices
weaverbird_s_tile_3 = WeaverbirdsTile(MeshCurves=move_6.Geometry, FillStrategy=1, OptIn=2)
byparent_3 = ByParent(Mesh=weaverbird_s_tile_3, Level=mesh_density)
show_3 = Show(G=byparent_3)
vertexloads_3 = VertexLoads(Mesh=byparent_3, Strength=force_y_dir)
edgelengths_3 = EdgeLengths(Mesh=byparent_3, LengthFactor=length_factor, Strength=1)

length_3 = Length(Curve=deconstruct_brep_3.Edges)
sort_list_3 = SortList(Keys=length_3)  # -> Keys, ValuesValuesA
list_item_3 = ListItem(List=sort_list_3.Keys, Index=1, Wrap=True)
smaller_than_3 = SmallerThan(FirstNumber=list_item_3, SecondNumber=length_3)  # -> SmallerThan, OrEqualTo
cull_pattern_3 = CullPattern(List=deconstruct_brep_3.Edges, CullPattern=smaller_than_3.SmallerThan)
power_3 = Power(A=2, B=mesh_density)

divide_curve_2 = DivideCurve(Curve=cull_pattern, Count=power, Kinks=False)  # -> Points, Tangents, Parameters
point_3 = Point(divide_curve_2.Points)

divide_curve_3 = DivideCurve(Curve=cull_pattern_3, Count=power_3, Kinks=False)  # -> Points, Tangents, Parameters
point_4 = Point(divide_curve_3.Points)
anchor_2 = Anchor(Point=[point_4, point_3], Strength=10000)
solver_2 = Solver(GoalObjects=[anchor_2, vertexloads_3, edgelengths_3, show_3], Reset=reset, Threshold=1e-15, Tolerance=0.01, On=True)  # -> I, V, O

anchor_3 = Anchor(Point=[point_3, point_4], Strength=10000)
solver_3 = Solver(GoalObjects=[anchor_3, edgelengths, vertexloads, show], Reset=reset, Threshold=1e-15, Tolerance=0.01, On=True)  # -> I, V, O

# ----
# Calculate height difference
deconstruct = Deconstruct(Point=solver_2.V)  # -> XComponent, YComponent, ZComponent
deconstruct_2 = Deconstruct(Point=solver_3.V)  # -> XComponent, YComponent, ZComponent
sort_list_4 = SortList(Keys=deconstruct_2.ZComponent)  # -> Keys, ValuesValuesA
sort_list_5 = SortList(Keys=deconstruct.ZComponent)  # -> Keys, ValuesValuesA
list_item_4 = ListItem(List=sort_list_4.Keys, Index=-1, Wrap=True)
list_item_5 = ListItem(List=sort_list_5.Keys, Index=-1, Wrap=True)
subtraction = Subtraction(A=list_item_5, B=list_item_4)
round = Round(Number=subtraction)  # -> flatten(Nearest), Floor, Ceiling
height_difference = Panel(round.Nearest)

deconstruct_3 = Deconstruct(Point=solver.V)  # -> XComponent, YComponent, ZComponent
sort_list_6 = SortList(Keys=deconstruct_3.ZComponent)  # -> Keys, ValuesValuesA
list_item_6 = ListItem(List=sort_list_6.Keys, Index=-1, Wrap=True)
subtraction_2 = Subtraction(A=list_item_6, B=list_item_5)
round_2 = Round(Number=subtraction_2)  # -> flatten(Nearest), Floor, Ceiling
height_difference_2 = Panel(round_2.Nearest)
ghpython_script = GhPythonScript(x=height_difference_2)  # -> out, a
# ---------- ghpython_script: Python ----------
__author__ = "Haas"
__version__ = "2020.10.12"

import rhinoscriptsyntax as rs
a = ("Height difference balcony: " + x + " mm")
print("Height difference balcony: " + x + " mm")
# ---------- end ghpython_script ----------
ghpython_script_2 = GhPythonScript(x=height_difference)  # -> out, a
# ---------- ghpython_script_2: Python ----------
__author__ = "Haas"
__version__ = "2020.10.12"

import rhinoscriptsyntax as rs
a = ("Height difference: " + x + " mm")
print("Height difference: " + x + " mm")
# ---------- end ghpython_script_2 ----------

# ----
# Define second floor height:
# 
# Find heigest point, round to convienient number, add floor thickness
ghpython_script_3 = GhPythonScript(x=list_item_5, y=list_item_4, z=list_item_6, h=floor_thickness)  # -> out, a
# ---------- ghpython_script_3: Python ----------
__author__ = "Haas"
__version__ = "2020.10.12"

import rhinoscriptsyntax as rs
import math

if x <= y >= z:
    print(y)
    n = y
elif x <= z >= y:
    print(z)
    n = z
else:
    print(x)
    n = x


f = math.floor(n)

b = (f%100)
c = 100-b
a = (c+f+h)
# ---------- end ghpython_script_3 ----------
unit_z_4 = UnitZ(Factor=ghpython_script_3.a)

move_8 = Move(Geometry=box_2pt, Motion=unit_z_4)  # -> Geometry, Transform
area_2 = Area(Geometry=move_8.Geometry)  # -> Area, Centroid
move_9 = Move(Geometry=area_2.Centroid, Motion=unit_z_3)  # -> Geometry, Transform
deconstruct_4 = Deconstruct(Point=move_9.Geometry)  # -> XComponent, YComponent, ZComponent
list_item_7 = ListItem(List=deconstruct_4.ZComponent, Index=0, Wrap=True)

unit_z_5 = UnitZ(Factor=list_item_7)
move_10 = Move(Geometry=curve_4, Motion=unit_z_5)  # -> Geometry, Transform

panel = Panel(ghpython_script_2.out)
panel_2 = Panel(ghpython_script.a)
custom_preview = CustomPreview(Geometry=[solver_3.O, solver_2.O, solver.O], Material=colour_swatch)

# ----
# Barrel Vault Cluster
curve_5 = Curve(move_10.Geometry)
cluster = Cluster(
    mesh_curves=curve_5,
    level=mesh_density_2,
    reset=reset_2,
    strength=force,
    lengthfactor=length_factor_2,
    edges=curve_5,
    B=mesh_density_2)  # -> V, O

custom_preview_2 = CustomPreview(Geometry=cluster.O, Material=colour_swatch)
point_5 = Point(cluster.V)

# ==== cluster Cluster
edges = ClusterInput()
boundary_surfaces = BoundarySurfaces(Edges=edges)
deconstruct_brep = DeconstructBrep(Brep=boundary_surfaces)  # -> Faces, Edges, Vertices
B = ClusterInput()

length = Length(Curve=deconstruct_brep.Edges)
sort_list = SortList(Keys=length)  # -> Keys, ValuesValuesA
list_item = ListItem(List=sort_list.Keys, Index=1, Wrap=True)
smaller_than = SmallerThan(FirstNumber=list_item, SecondNumber=length)  # -> SmallerThan, OrEqualTo
cull_pattern = CullPattern(List=deconstruct_brep.Edges, CullPattern=smaller_than.SmallerThan)
power = Power(A=2, B=B)

mesh_curves = ClusterInput()
weaverbird_s_tile = WeaverbirdsTile(MeshCurves=mesh_curves, FillStrategy=1, OptIn=2)
divide_curve = DivideCurve(Curve=cull_pattern, Count=power, Kinks=False)  # -> Points, Tangents, Parameters
level = ClusterInput()
byparent = ByParent(Mesh=weaverbird_s_tile, Level=level)
point = Point(divide_curve.Points)
strength = ClusterInput()
lengthfactor = ClusterInput()
show = Show(G=byparent)
vertexloads = VertexLoads(Mesh=byparent, Strength=strength)
edgelengths = EdgeLengths(Mesh=byparent, LengthFactor=lengthfactor, Strength=1)
anchor = Anchor(Point=point, Strength=10000)
reset = ClusterInput()
solver = Solver(GoalObjects=[anchor, vertexloads, edgelengths, show], Reset=reset, Threshold=1e-15, Tolerance=0.01, On=True)  # -> I, V, O
V = ClusterOutput(solver.V)
O = ClusterOutput(solver.O)
