# Grasshopper definition Multifunctional_Room_-_Lunette_vault.gh (Grasshopper 1.0.7)
# Copyright: Arup
# plug-ins: EleFront, Weaverbird, MetaHopper, Kangaroo2 Components

# ----
# Global Parameters
floor_thickness = Slider(400, range=0..600)
# Groups
# External input
wall_height = Slider(2200, range=2000..3000)

# ---- group: Input (point of placement)
point = Point(Point(47887.391, 23109.68126, 0))

# ---- group: Forces
force = Slider(1, range=0.1..5)
length_factor = Slider(1, range=0..1)

# ---- group: Paramaters Lunette vault
module_width = Slider(2500, range=0..10000)
of_modules = Slider(5, range=0..7)
detail_of_mesh = Slider(4, range=0..10)
mesh_detail_offset = Slider(100, range=0..100)
window_size = Slider(0.15, range=0.01..0.5)
module_height = Slider(7500, range=0..10000)
height_vault = Slider(2800, range=0..10000)

# ----
unit_x = UnitX(Factor=module_width)
unit_y = UnitY(Factor=module_height)
move = Move(Geometry=point, Motion=unit_y)  # -> Geometry, Transform
move_2 = Move(Geometry=point, Motion=unit_x)  # -> Geometry, Transform
move_3 = Move(Geometry=move_2.Geometry, Motion=unit_y)  # -> Geometry, Transform
multiplication = Multiplication(A=of_modules, B=2500)
construct_domain = ConstructDomain(DomainStart=Slider(0, range=0..100), DomainEnd=multiplication)
_4point_surface = _4PointSurface(CornerA=point, CornerB=move_2.Geometry, CornerC=move_3.Geometry, CornerD=move.Geometry)
range = Range(Domain=construct_domain, Steps=of_modules)
unit_x_2 = UnitX(Factor=range)
move_4 = Move(Geometry=_4point_surface, Motion=unit_x_2)  # -> Geometry, Transform

list_item = ListItem(List=range, Index=-1, Wrap=True)
addition = Addition(A=list_item, B=2500)
list_length = ListLength(List=move_4.Geometry)
unit_y_2 = UnitY(Factor=mesh_detail_offset)
unit_y_3 = UnitY(Factor=mesh_detail_offset)  # -> expr("-x", UnitVector)
unit_x_3 = UnitX(Factor=addition)
division = Division(A=list_length, B=2)
move_5 = Move(Geometry=point, Motion=unit_y_2)  # -> Geometry, Transform
move_6 = Move(Geometry=point, Motion=unit_y_3)  # -> Geometry, Transform
subtraction = Subtraction(A=division, B=1)
move_7 = Move(Geometry=move_5.Geometry, Motion=unit_x_3)  # -> Geometry, Transform
move_8 = Move(Geometry=move_6.Geometry, Motion=unit_x_3)  # -> Geometry, Transform
number = Number([subtraction, division])
list_item_2 = ListItem(List=move_4.Geometry, Index=number, Wrap=True)
_4point_surface_2 = _4PointSurface(CornerA=move_5.Geometry, CornerB=move_6.Geometry, CornerC=move_8.Geometry, CornerD=move_7.Geometry)
deconstruct_brep = DeconstructBrep(Brep=list_item_2)  # -> Faces, Edges, Vertices
point_2 = Point(deconstruct_brep.Vertices)
point_in_curves = PointInCurves(Point=point_2, Curves=_4point_surface_2)  # -> Relationship, Index, Point
dispatch = Dispatch(List=point_in_curves.Point, DispatchPattern=point_in_curves.Relationship)  # -> flatten(ListA), ListB
list_item_3 = ListItem(List=dispatch.ListA, Index=[0, -1], Wrap=True)
unit_y_4 = UnitY(Factor=mesh_detail_offset)  # -> expr("-x", UnitVector)
point_3 = Point(list_item_3)
unit_y_5 = UnitY(Factor=mesh_detail_offset)
move_9 = Move(Geometry=point_3, Motion=unit_y_5)  # -> Geometry, Transform
move_10 = Move(Geometry=point_3, Motion=unit_y_4)  # -> Geometry, Transform
list_item_4 = ListItem(List=move_9.Geometry, Index=0, Wrap=True)  # -> Item, Item1
list_item_5 = ListItem(List=move_10.Geometry, Index=0, Wrap=True)  # -> Item, Item1
_4point_surface_3 = _4PointSurface(CornerA=list_item_4.Item, CornerB=list_item_5.Item, CornerC=list_item_5.Item1, CornerD=list_item_4.Item1)

unit_y_6 = UnitY(Factor=module_height)
list_item_6 = ListItem(List=range, Index=-1, Wrap=True)
move_11 = Move(Geometry=point, Motion=unit_y_6)  # -> Geometry, Transform
construct_domain_2 = ConstructDomain(DomainStart=Slider(0, range=0..100), DomainEnd=of_modules)
addition_2 = Addition(A=list_item_6, B=2500)
unit_y_7 = UnitY(Factor=mesh_detail_offset)  # -> expr("-x", UnitVector)
unit_y_8 = UnitY(Factor=mesh_detail_offset)
range_2 = Range(Domain=construct_domain_2, Steps=of_modules)
unit_x_4 = UnitX(Factor=addition_2)
move_12 = Move(Geometry=move_11.Geometry, Motion=unit_y_8)  # -> Geometry, Transform
move_13 = Move(Geometry=move_11.Geometry, Motion=unit_y_7)  # -> Geometry, Transform
cull_index = CullIndex(List=range_2, Indices=number, Wrap=True)
move_14 = Move(Geometry=move_12.Geometry, Motion=unit_x_4)  # -> Geometry, Transform
move_15 = Move(Geometry=move_13.Geometry, Motion=unit_x_4)  # -> Geometry, Transform
list_item_7 = ListItem(List=move_4.Geometry, Index=cull_index, Wrap=True)
_4point_surface_4 = _4PointSurface(CornerA=move_12.Geometry, CornerB=move_13.Geometry, CornerC=move_15.Geometry, CornerD=move_14.Geometry)
move_16 = Move(Geometry=_4point_surface_3, Motion=unit_y_6)  # -> Geometry, Transform
deconstruct_brep_2 = DeconstructBrep(Brep=list_item_7)  # -> Faces, Edges, flatten(Vertices)
region_difference = RegionDifference(CurvesA=_4point_surface_4, CurvesB=move_16.Geometry)
point_in_curves_2 = PointInCurves(Point=deconstruct_brep_2.Vertices, Curves=region_difference)  # -> Relationship, Index, Point
dispatch_2 = Dispatch(List=point_in_curves_2.Point, DispatchPattern=point_in_curves_2.Relationship)  # -> ListA, ListB
point_4 = Point(dispatch_2.ListA)
deconstruct = Deconstruct(Point=point_4)  # -> XComponent, YComponent, ZComponent
sort_list = SortList(Keys=deconstruct.XComponent)  # -> Keys, ValuesValuesA
delete_consecutive = DeleteConsecutive(Set=sort_list.Keys, Wrap=False)  # -> Set, Count
list_length_2 = ListLength(List=delete_consecutive.Set)
construct_domain_3 = ConstructDomain(DomainStart=Slider(0, range=0..100), DomainEnd=list_length_2)
range_3 = Range(Domain=construct_domain_3, Steps=list_length_2)
construct_point = ConstructPoint(XCoordinate=delete_consecutive.Set, YCoordinate=deconstruct.YComponent, ZCoordinate=deconstruct.ZComponent)
addition_3 = Addition(A=range_3, B=1)
split_list = SplitList(List=addition_3, Index=list_length_2)  # -> ListA, ListB
split_list_2 = SplitList(List=construct_point, Index=list_length_2)  # -> ListA, ListB
list_item_8 = ListItem(List=split_list_2.ListA, Index=split_list.ListA, Wrap=True)
line = Line(StartPoint=split_list_2.ListA, EndPoint=list_item_8)
list_length_3 = ListLength(List=line)  # -> expr("x-1", Length)
division_2 = Division(A=list_length_3, B=2)
cull_index_2 = CullIndex(List=line, Indices=list_length_3, Wrap=True)
round = Round(Number=division_2)  # -> Nearest, Floor, Ceiling
cull_index_3 = CullIndex(List=cull_index_2, Indices=round.Floor, Wrap=True)
subtraction_2 = Subtraction(A=1, B=window_size)
unit_y_9 = UnitY(Factor=mesh_detail_offset)
unit_y_10 = UnitY(Factor=mesh_detail_offset)  # -> expr("-x", UnitVector)
evaluate_curve = EvaluateCurve(Curve=reparameterize(cull_index_3), Parameter=window_size)  # -> Point, Tangent, Angle
evaluate_curve_2 = EvaluateCurve(Curve=reparameterize(cull_index_3), Parameter=subtraction_2)  # -> Point, Tangent, Angle
move_17 = Move(Geometry=evaluate_curve.Point, Motion=unit_y_9)  # -> Geometry, Transform
move_18 = Move(Geometry=evaluate_curve.Point, Motion=unit_y_10)  # -> Geometry, Transform
move_19 = Move(Geometry=evaluate_curve_2.Point, Motion=unit_y_9)  # -> Geometry, Transform
move_20 = Move(Geometry=evaluate_curve_2.Point, Motion=unit_y_10)  # -> Geometry, Transform
_4point_surface_5 = _4PointSurface(CornerA=move_17.Geometry, CornerB=move_18.Geometry, CornerC=move_20.Geometry, CornerD=move_19.Geometry)

subtraction_3 = Subtraction(A=module_height, B=mesh_detail_offset)
unit_y_11 = UnitY(Factor=mesh_detail_offset)
unit_y_12 = UnitY(Factor=subtraction_3)
point_5 = Point(point)
move_21 = Move(Geometry=point_5, Motion=unit_y_11)  # -> Geometry, Transform
move_22 = Move(Geometry=point_5, Motion=unit_y_12)  # -> Geometry, Transform
unit_x_5 = UnitX(Factor=mesh_detail_offset)
unit_x_6 = UnitX(Factor=mesh_detail_offset)  # -> expr("-x", UnitVector)
move_23 = Move(Geometry=move_21.Geometry, Motion=unit_x_5)  # -> Geometry, Transform
move_24 = Move(Geometry=move_21.Geometry, Motion=unit_x_6)  # -> Geometry, Transform
move_25 = Move(Geometry=move_22.Geometry, Motion=unit_x_5)  # -> Geometry, Transform
move_26 = Move(Geometry=move_22.Geometry, Motion=unit_x_6)  # -> Geometry, Transform
_4point_surface_6 = _4PointSurface(CornerA=move_24.Geometry, CornerB=move_23.Geometry, CornerC=move_25.Geometry, CornerD=move_26.Geometry)
move_27 = Move(Geometry=_4point_surface_6, Motion=unit_x_4)  # -> Geometry, Transform

number_slider = Slider(2500, range=0..10000)
unit_x_7 = UnitX(Factor=number_slider)
unit_y_13 = UnitY(Factor=number_slider)
move_28 = Move(Geometry=point, Motion=unit_y_13)  # -> Geometry, Transform
move_29 = Move(Geometry=point, Motion=unit_x_7)  # -> Geometry, Transform
move_30 = Move(Geometry=move_29.Geometry, Motion=unit_y_13)  # -> Geometry, Transform
multiplication_2 = Multiplication(A=of_modules, B=2500)
construct_domain_4 = ConstructDomain(DomainStart=Slider(0, range=0..100), DomainEnd=multiplication_2)
subtraction_4 = Subtraction(A=module_height, B=2500)
division_3 = Division(A=subtraction_4, B=2500)
_4point_surface_7 = _4PointSurface(CornerA=point, CornerB=move_29.Geometry, CornerC=move_30.Geometry, CornerD=move_28.Geometry)
construct_domain_5 = ConstructDomain(DomainStart=0, DomainEnd=subtraction_4)
range_4 = Range(Domain=construct_domain_4, Steps=of_modules)
unit_x_8 = UnitX(Factor=range_4)
range_5 = Range(Domain=construct_domain_5, Steps=division_3)
unit_y_14 = UnitY(Factor=range_5)
move_31 = Move(Geometry=_4point_surface_7, Motion=unit_x_8)  # -> graft(Geometry), Transform
move_32 = Move(Geometry=move_31.Geometry, Motion=unit_y_14)  # -> Geometry, Transform

surface = Surface(move_32.Geometry)
explode = Explode(Curve=surface, Recursive=True)  # -> Segments, Vertices
polyline = PolyLine(Vertices=explode.Vertices, Closed=False)  # -> flatten(Polyline)
weaverbird_s_tile = WeaverbirdsTile(MeshCurves=polyline, FillStrategy=1, OptIn=2)  # -> flatten(OutputMeshCurves)
byparent = ByParent(Mesh=weaverbird_s_tile, Level=detail_of_mesh)

solid_union = SolidUnion(Breps=move_4.Geometry)
nakedvertices = NakedVertices(Mesh=byparent)  # -> ClothedIndex, NakedIndex, ClothedPts, NakedPts
offset_curve = OffsetCurve(Curve=solid_union, Distance=expr("-x", mesh_detail_offset), Plane=PlaneXY(0, 0, 0), Corners=1)
point_6 = Point(nakedvertices.NakedPts)
point_in_curves_3 = PointInCurves(Point=point_6, Curves=offset_curve)  # -> Relationship, Index, Point
dispatch_3 = Dispatch(List=point_in_curves_3.Point, DispatchPattern=point_in_curves_3.Relationship)  # -> ListA, ListB
point_7 = Point(dispatch_3.ListB)
curve = Curve(flatten([move_27.Geometry, _4point_surface_6]))
curve_2 = Curve(flatten([_4point_surface_5, _4point_surface_3]))
point_in_curves_4 = PointInCurves(Point=point_7, Curves=[curve_2, curve])  # -> Relationship, Index, Point
dispatch_4 = Dispatch(List=point_in_curves_4.Point, DispatchPattern=point_in_curves_4.Relationship)  # -> ListA, ListB
point_8 = Point(dispatch_4.ListB)

division_4 = Division(A=module_height, B=2)
unit_y_15 = UnitY(Factor=division_4)  # -> expr("-x", UnitVector)
move_33 = Move(Geometry=_4point_surface_4, Motion=unit_y_15)  # -> Geometry, Transform
point_9 = Point([nakedvertices.ClothedPts, nakedvertices.NakedPts])
point_in_curves_5 = PointInCurves(Point=point_9, Curves=move_33.Geometry)  # -> Relationship, Index, Point
dispatch_5 = Dispatch(List=point_in_curves_5.Point, DispatchPattern=point_in_curves_5.Relationship)  # -> ListA, ListB
unit_z = UnitZ(Factor=height_vault)
point_10 = Point(dispatch_5.ListA)
move_34 = Move(Geometry=point_10, Motion=unit_z)  # -> Geometry, Transform

# ---- group: Preview
point_11 = Point([point_8, move_34.Geometry])
surface_2 = Surface([_4point_surface_3, _4point_surface_5, move_27.Geometry, _4point_surface_6])

# ----
mesh = Mesh(byparent)
point_12 = Point(unit_x_4)
point_13 = Point(point_8)
point_14 = Point(unit_y_6)
unit_y_16 = UnitY(Factor=point_14)
unit_y_17 = UnitY(Factor=point_14)  # -> expr("-x", UnitVector)
unit_x_9 = UnitX(Factor=point_12)
unit_x_10 = UnitX(Factor=point_12)  # -> expr("-x", UnitVector)
move_35 = Move(Geometry=mesh, Motion=unit_y_16)  # -> Geometry, Transform
move_36 = Move(Geometry=mesh, Motion=unit_y_17)  # -> Geometry, Transform
move_37 = Move(Geometry=mesh, Motion=unit_x_9)  # -> Geometry, Transform
move_38 = Move(Geometry=mesh, Motion=unit_x_10)  # -> Geometry, Transform
move_39 = Move(Geometry=point_13, Motion=unit_y_16)  # -> Geometry, Transform
move_40 = Move(Geometry=point_13, Motion=unit_y_17)  # -> Geometry, Transform
area = Area(Geometry=solid_union)  # -> Area, Centroid
number_slider_2 = Slider(180, range=0..1000)
move_41 = Move(Geometry=area.Centroid, Motion=unit_y_16)  # -> Geometry, Transform
move_42 = Move(Geometry=area.Centroid, Motion=unit_y_17)  # -> Geometry, Transform
rotate = Rotate(Geometry=move_39.Geometry, Angle=degrees(number_slider_2), Plane=move_41.Geometry)  # -> Geometry, Transform
rotate_2 = Rotate(Geometry=move_40.Geometry, Angle=degrees(number_slider_2), Plane=move_42.Geometry)  # -> Geometry, Transform
move_43 = Move(Geometry=point_13, Motion=unit_x_9)  # -> Geometry, Transform
move_44 = Move(Geometry=point_13, Motion=unit_x_10)  # -> Geometry, Transform

weld_mesh = WeldMesh(Mesh=[move_35.Geometry, move_36.Geometry, move_37.Geometry, move_38.Geometry, mesh], Angle=3.141592654)
mesh_2 = Mesh(weld_mesh)
point_15 = Point([rotate.Geometry, rotate_2.Geometry, move_43.Geometry, move_44.Geometry])
anchor = Anchor(Point=point_10, Target=move_34.Geometry, Strength=10000)  # disabled
anchor_2 = Anchor(Point=point_15, Strength=10000)
show = Show(G=byparent)
vertexloads = VertexLoads(Mesh=mesh_2, Strength=force)
edgelengths = EdgeLengths(Mesh=mesh_2, LengthFactor=length_factor, Strength=1)
zombiesolver = ZombieSolver(GoalObjects=[anchor_2, anchor, show, vertexloads, edgelengths], Threshold=1e-10, Tolerance=0.01, MaxIterations=50000)  # -> I, V, O

# ----
# Output
# Parameters
# Design Rules:
# Module Width and Height always: x*2500
# 
# Amound of modules, always uneven number
group_toggle = GroupToggle(ToggleActive=True, ToggleVisible=False)  # disabled
value_list = ValueList({"Point": 0, "Curve": 1, "Arc": 2, "Circle": 3, "Ellipse": 4, "Line": 5, "Polyline": 6, "Surface": 7, "Brep": 8, "Mesh": 9, "Polysurface": 10, "Block": 11, "Text": 12, "TextDot": 13, "Dimension": 14, "LinearDimension": 15, "AngularDimension": 16, "Hatch": 17, "Leader": 18}, selected="Mesh")
filter_by_type = FilterByType(Geometry=zombiesolver.O, ObjectType=value_list)

null_item = NullItem(Item=zombiesolver.O)  # -> NullFlags, InvalidFlags, Description
dispatch_6 = Dispatch(List=zombiesolver.O, DispatchPattern=null_item.NullFlags)  # -> ListA, ListB
text = Text(dispatch_6.ListB)
evaluate = Evaluate(Expression="Contains(x, \"Mesh\")", Variable_x=text)
unit_z_2 = UnitZ(Factor=wall_height)
cull_pattern = CullPattern(List=dispatch_6.ListB, CullPattern=evaluate)
move_45 = Move(Geometry=cull_pattern, Motion=unit_z_2)  # -> Geometry, Transform

# ---- group: Final mesh
custom_preview = CustomPreview(Geometry=move_45.Geometry, Material=ColourSwatch(SwatchColor=RGB(45, 134, 255)))
