# Grasshopper definition Theathre_-_Nubian_vault.gh (Grasshopper 1.0.7)
# Copyright: Arup
# plug-ins: MeshEdit Components, EleFront, Weaverbird, MetaHopper, Kangaroo2 Components, karambaGH

# ----
# Global Parameters
floor_thickness = Slider(400, range=0..600)
# Output
# Groups
# External input
# Parameters
wall_height = Slider(2200, range=2000..3000)
colour_swatch = ColourSwatch(SwatchColor=RGB(45, 134, 255))

buttress_widht = Slider(2500, range=0..100000)
module_length = Slider(5000, range=0..10000)
door_bump_height = Slider(500, range=0..1000)
middle_widht = Slider(7500, range=0..100000)
door_height = Slider(1200, range=0..10000)
door_pos_start = Slider(1500, range=0..2500)
force = Slider(3.5, range=-20..200)
door_width = Slider(2000, range=0..10000)
max_iterations = Slider(2000, range=0..10000)

buttress_widht_2 = Slider(2500, range=0..100000)
middle_widht_2 = Slider(7500, range=0..100000)
module_length_2 = Slider(5000, range=0..10000)
door_height_2 = Slider(1200, range=0..10000)
door_bump_height_2 = Slider(500, range=0..1000)
door_pos_start_2 = Slider(750, range=0..1500)
door_width_2 = Slider(1500, range=0..10000)
max_iterations_2 = Slider(2000, range=0..10000)
force_2 = Slider(3, range=-20..200)

group_toggle = GroupToggle(ToggleActive=True, ToggleVisible=False)  # disabled

group_toggle_2 = GroupToggle(ToggleActive=True, ToggleVisible=False)  # disabled

# ----
# Double door
module_2 = Panel("""2500
7500
4000
1200
500
250
1500
2000
3.0""")
module_1 = Panel("""2500
7500
4750
1200
500
1000
1500
2000
2.0""")
module_3 = Panel("""2500
7500
4000
1200
500
250
1500
2000
2.0""")
module_5 = Panel("""2500
7500
5000
1200
500
750
1500
2000
2.0""")
module_6 = Panel("""2500
7500
5000
1200
500
750
1500
2000
3.0""")
point = Point(Point(22500, 12501.05487, 0))

unit_y = UnitY(Factor=module_length_2)  # -> expr("-x", UnitVector)
unit_x = UnitX(Factor=buttress_widht_2)  # -> expr("-x", UnitVector)
move = Move(Geometry=point, Motion=unit_y)  # -> Geometry, Transform
move_2 = Move(Geometry=point, Motion=unit_x)  # -> Geometry, Transform
move_3 = Move(Geometry=move_2.Geometry, Motion=unit_y)  # -> Geometry, Transform
unit_z = UnitZ(Factor=wall_height)
_4point_surface = _4PointSurface(CornerA=point, CornerB=move_2.Geometry, CornerC=move_3.Geometry, CornerD=move.Geometry)
extrude = Extrude(Base=_4point_surface, Direction=unit_z)
deconstruct_brep = DeconstructBrep(Brep=extrude)  # -> Faces, Edges, Vertices
list_item = ListItem(List=deconstruct_brep.Faces, Index=[4, 5], Wrap=True)

unit_x_2 = UnitX(Factor=middle_widht_2)  # -> expr("-x", UnitVector)
move_4 = Move(Geometry=move_2.Geometry, Motion=unit_x_2)  # -> Geometry, Transform
move_5 = Move(Geometry=move_3.Geometry, Motion=unit_x_2)  # -> Geometry, Transform
_4point_surface_2 = _4PointSurface(CornerA=move_2.Geometry, CornerB=move_3.Geometry, CornerC=move_5.Geometry, CornerD=move_4.Geometry)
extrude_2 = Extrude(Base=_4point_surface_2, Direction=unit_z)
deconstruct_brep_2 = DeconstructBrep(Brep=extrude_2)  # -> Faces, Edges, Vertices
list_item_2 = ListItem(List=deconstruct_brep_2.Faces, Index=[1, 3, 5, 7], Wrap=True)
brep = Brep(list_item_2)

deconstruct_brep_3 = DeconstructBrep(Brep=brep)  # -> Faces, flatten(Edges), Vertices
list_item_3 = ListItem(List=deconstruct_brep_3.Edges, Index=0, Wrap=True)
addition = Addition(A=door_pos_start_2, B=door_width_2)
evaluate_curve = EvaluateCurve(Curve=list_item_3, Parameter=expr("-x", [addition, door_pos_start_2]))  # -> Point, Tangent, Angle
list_item_4 = ListItem(List=evaluate_curve.Point, Index=0, Wrap=True)  # -> Item, Item1
line = Line(StartPoint=list_item_4.Item, EndPoint=list_item_4.Item1)
addition_2 = Addition(A=door_height_2, B=door_bump_height_2)
unit_z_2 = UnitZ(Factor=door_height_2)
unit_z_3 = UnitZ(Factor=addition_2)
point_on_curve = PointOnCurve(line, parameter=0.5)
point_2 = Point([list_item_4.Item, list_item_4.Item1])
move_6 = Move(Geometry=point_on_curve, Motion=unit_z_3)  # -> Geometry, Transform
move_7 = Move(Geometry=evaluate_curve.Point, Motion=unit_z_2)  # -> Geometry, Transform
line_2 = Line(StartPoint=move_7.Geometry, EndPoint=point_2)
line_3 = Line(StartPoint=move_6.Geometry, EndPoint=move_7.Geometry)
merge = Merge(Data1=line_3, Data2=line_2)
unit_x_3 = UnitX(Factor=Slider(1000, range=0..1000))
join_curves = JoinCurves(Curves=merge, Preserve=False)  # -> flatten(Curves)
extrude_3 = Extrude(Base=join_curves, Direction=expr("-x", unit_x_3))
unit_x_4 = UnitX(Factor=middle_widht_2)
move_8 = Move(Geometry=extrude_3, Motion=expr("-x", unit_x_4))  # -> Geometry, Transform

unit_y_2 = UnitY(Factor=Slider(2000, range=0..10000))  # -> expr("-x", UnitVector)
brep_2 = Brep(flatten([move_8.Geometry, extrude_3]))
move_9 = Move(Geometry=brep_2, Motion=unit_y_2)  # -> Geometry, Transform
split_brep_multiple = SplitBrepMultiple(Brep=graft(brep), Cutters=flatten([brep_2, move_9.Geometry]))  # -> simplify(flatten(Result))
line_4 = Line(StartPoint=move_2.Geometry, EndPoint=move_4.Geometry)
brep_3 = Brep(list_item)
area = Area(Geometry=_4point_surface_2)  # -> Area, Centroid
list_item_5 = ListItem(List=split_brep_multiple, Index=[3, 6, 9], Wrap=True)
mirror = Mirror(Geometry=brep_3, Plane=line_4)  # -> Geometry, Transform
unit_x_5 = UnitX(Factor=middle_widht_2)  # -> expr("-x", UnitVector)
move_10 = Move(Geometry=mirror.Geometry, Motion=unit_x_5)  # -> Geometry, Transform
number_slider = Slider(0.01, range=0..0.01)
brep_4 = Brep(list_item_5)
brep_5 = Brep(move_10.Geometry)
brep_6 = Brep(brep_3)
brep_join = BrepJoin(Breps=[brep_6, brep_4, brep_5])  # -> Breps, Closed
scale = Scale(Geometry=brep_join.Breps, Center=area.Centroid, Factor=number_slider)  # -> Geometry, Transform

brep_7 = Brep([brep_5, brep_6, brep])
brep_join_2 = BrepJoin(Breps=brep_7)  # -> Breps, Closed
number_slider_2 = Slider(0.5, range=0..1)
multiplication = Multiplication(A=module_length_2, B=number_slider_2)
scale_nu = ScaleNU(Geometry=brep_join_2.Breps, Plane=point, ScaleX=1, ScaleY=number_slider_2, ScaleZ=1)  # -> Geometry, Transform
unit_y_3 = UnitY(Factor=multiplication)
move_11 = Move(Geometry=scale_nu.Geometry, Motion=unit_y_3)  # -> Geometry, Transform
move_12 = Move(Geometry=scale_nu.Geometry, Motion=unit_y)  # -> Geometry, Transform
scale_2 = Scale(Geometry=move_12.Geometry, Center=area.Centroid, Factor=number_slider)  # -> Geometry, Transform
scale_3 = Scale(Geometry=move_11.Geometry, Center=area.Centroid, Factor=number_slider)  # -> Geometry, Transform
brep_8 = Brep(scale_2.Geometry)
brep_9 = Brep(scale_3.Geometry)

mesh_breps_karamba3d = MeshBreps(
    Brep=[brep_8, brep_9],
    MeshResolution=Slider(1, range=0..10),
    EdgeRefinementFactor=0.67,
    PointReduction=False,
    SmoothingStepSize=0,
    SmoothingIterations=5)  # -> flatten(Mesh), Info
mesh_join = MeshJoin(Meshes=mesh_breps_karamba3d.Mesh)
mesh_unifynormals = MeshUnifyNormals(Mesh=mesh_join)
unify_mesh = UnifyMesh(Mesh=mesh_unifynormals)  # -> Result, Count
deconstruct_mesh = DeconstructMesh(Mesh=unify_mesh.Result)  # -> Vertices, Faces, Colours, Normals
mesh_edges = MeshEdges(Mesh=unify_mesh.Result)  # -> NakedEdges, InteriorEdges, NonManifoldEdges
cull_duplicates = CullDuplicates(Points=deconstruct_mesh.Vertices, Tolerance=0.1, CullMode=3)  # -> Points, Indices, Valence
deconstruct = Deconstruct(Point=cull_duplicates.Points)  # -> XComponent, YComponent, ZComponent
smaller_than = SmallerThan(FirstNumber=deconstruct.ZComponent, SecondNumber=Slider(0.1, range=0..0.1))  # -> SmallerThan, OrEqualTo
cull_pattern = CullPattern(List=cull_duplicates.Points, CullPattern=smaller_than.OrEqualTo)
point_3 = Point(cull_pattern)
line_5 = Line([mesh_edges.InteriorEdges, mesh_edges.NakedEdges, mesh_edges.NonManifoldEdges])

mesh_breps_karamba3d_2 = MeshBreps(
    Brep=scale.Geometry,
    MeshResolution=Slider(1, range=0..10),
    EdgeRefinementFactor=0.67,
    PointReduction=False,
    SmoothingStepSize=0,
    SmoothingIterations=5)  # -> flatten(Mesh), Info
mesh_join_2 = MeshJoin(Meshes=mesh_breps_karamba3d_2.Mesh)
mesh_unifynormals_2 = MeshUnifyNormals(Mesh=mesh_join_2)
unify_mesh_2 = UnifyMesh(Mesh=mesh_unifynormals_2)  # -> Result, Count
deconstruct_mesh_2 = DeconstructMesh(Mesh=unify_mesh_2.Result)  # -> Vertices, Faces, Colours, Normals
cull_duplicates_2 = CullDuplicates(Points=deconstruct_mesh_2.Vertices, Tolerance=0.1, CullMode=3)  # -> Points, Indices, Valence
mesh_edges_2 = MeshEdges(Mesh=unify_mesh_2.Result)  # -> NakedEdges, InteriorEdges, NonManifoldEdges
deconstruct_2 = Deconstruct(Point=cull_duplicates_2.Points)  # -> XComponent, YComponent, ZComponent
smaller_than_2 = SmallerThan(FirstNumber=deconstruct_2.ZComponent, SecondNumber=Slider(0.1, range=0..0.1))  # -> SmallerThan, OrEqualTo
cull_pattern_2 = CullPattern(List=cull_duplicates_2.Points, CullPattern=smaller_than_2.OrEqualTo)
point_4 = Point(cull_pattern_2)
line_6 = Line([mesh_edges_2.InteriorEdges, mesh_edges_2.NakedEdges, mesh_edges_2.NonManifoldEdges])

sp_strengthortho = Slider(500, range=0..500)
an_strength = Slider(2500, range=0..2500)
unit_z_4 = UnitZ(Factor=force_2)
support = Point(flatten([point_4, point_3]))
springortho = Curve(flatten([line_6, line_5]))
mesh = Mesh([unify_mesh_2.Result, unify_mesh.Result])
particles = Point(flatten([cull_duplicates_2.Points, cull_duplicates.Points]))
length_line = LengthLine(Line=springortho, Strength=sp_strengthortho)
load = Load(Point=particles, ForceVector=unit_z_4)
vertexloads = VertexLoads(Mesh=mesh, Strength=unit_z_4)
anchor = Anchor(Point=support, Strength=an_strength)
show = Show(G=[unify_mesh_2.Result, unify_mesh.Result])
merge_2 = Merge(Data2=simplify(show), Data3=simplify(length_line), Data4=simplify(anchor), Data5=simplify(vertexloads))  # -> flatten(Result)
zombiesolver = ZombieSolver(GoalObjects=merge_2, Threshold=1e-10, Tolerance=0.01, MaxIterations=max_iterations_2)  # -> I, V, O

null_item = NullItem(Item=zombiesolver.O)  # -> NullFlags, InvalidFlags, Description
dispatch = Dispatch(List=zombiesolver.O, DispatchPattern=null_item.NullFlags)  # -> ListA, ListB
value_list = ValueList({"Point": 0, "Curve": 1, "Arc": 2, "Circle": 3, "Ellipse": 4, "Line": 5, "Polyline": 6, "Surface": 7, "Brep": 8, "Mesh": 9, "Polysurface": 10, "Block": 11, "Text": 12, "TextDot": 13, "Dimension": 14, "LinearDimension": 15, "AngularDimension": 16, "Hatch": 17, "Leader": 18}, selected="Mesh")
text = Text(dispatch.ListB)
filter_by_type = FilterByType(Geometry=dispatch.ListB, ObjectType=value_list)
dispatch_2 = Dispatch(List=dispatch.ListB, DispatchPattern=[True, False])  # -> ListA, ListB
number_slider_3 = Slider(100, range=0..100)
list_item_6 = ListItem(List=flatten(filter_by_type), Index=0, Wrap=True)
scale_4 = Scale(Geometry=list_item_6, Center=area.Centroid, Factor=number_slider_3)  # -> Geometry, Transform
weaverbird_s_laplacian_smoothing = WeaverbirdsLaplacianSmoothing(MeshCurves=scale_4.Geometry, Level=Slider(20, range=0..20), SmoothNakedEdges=Slider(0, range=0..2), Thin=1)

final_mesh = Mesh(weaverbird_s_laplacian_smoothing)

# ----
# Single door
module_4 = Panel("""2500
7500
5000
1200
500
1500
2000
2000
2.0""")
point_5 = Point(Point(47887.391, 23109.68126, 0))
addition_3 = Addition(A=middle_widht, B=buttress_widht)

unit_y_4 = UnitY(Factor=module_length)  # -> expr("-x", UnitVector)
unit_x_6 = UnitX(Factor=buttress_widht)  # -> expr("-x", UnitVector)
move_13 = Move(Geometry=point_5, Motion=unit_y_4)  # -> Geometry, Transform
move_14 = Move(Geometry=point_5, Motion=unit_x_6)  # -> Geometry, Transform
move_15 = Move(Geometry=move_14.Geometry, Motion=unit_y_4)  # -> Geometry, Transform
unit_z_5 = UnitZ(Factor=wall_height)
_4point_surface_3 = _4PointSurface(CornerA=point_5, CornerB=move_14.Geometry, CornerC=move_15.Geometry, CornerD=move_13.Geometry)
extrude_4 = Extrude(Base=_4point_surface_3, Direction=unit_z_5)
deconstruct_brep_4 = DeconstructBrep(Brep=extrude_4)  # -> Faces, Edges, Vertices
list_item_7 = ListItem(List=deconstruct_brep_4.Faces, Index=[4, 5], Wrap=True)

unit_x_7 = UnitX(Factor=middle_widht)  # -> expr("-x", UnitVector)
move_16 = Move(Geometry=move_14.Geometry, Motion=unit_x_7)  # -> Geometry, Transform
move_17 = Move(Geometry=move_15.Geometry, Motion=unit_x_7)  # -> Geometry, Transform
_4point_surface_4 = _4PointSurface(CornerA=move_14.Geometry, CornerB=move_15.Geometry, CornerC=move_17.Geometry, CornerD=move_16.Geometry)
extrude_5 = Extrude(Base=_4point_surface_4, Direction=unit_z_5)
deconstruct_brep_5 = DeconstructBrep(Brep=extrude_5)  # -> Faces, Edges, Vertices
list_item_8 = ListItem(List=deconstruct_brep_5.Faces, Index=[1, 3, 5, 7], Wrap=True)
brep_10 = Brep(list_item_8)

deconstruct_brep_6 = DeconstructBrep(Brep=brep_10)  # -> Faces, flatten(Edges), Vertices
list_item_9 = ListItem(List=deconstruct_brep_6.Edges, Index=0, Wrap=True)
addition_4 = Addition(A=door_pos_start, B=door_width)
evaluate_curve_2 = EvaluateCurve(Curve=list_item_9, Parameter=expr("-x", [addition_4, door_pos_start]))  # -> Point, Tangent, Angle
list_item_10 = ListItem(List=evaluate_curve_2.Point, Index=0, Wrap=True)  # -> Item, Item1
line_7 = Line(StartPoint=list_item_10.Item, EndPoint=list_item_10.Item1)
addition_5 = Addition(A=door_height, B=door_bump_height)
unit_z_6 = UnitZ(Factor=door_height)
unit_z_7 = UnitZ(Factor=addition_5)
point_on_curve_2 = PointOnCurve(line_7, parameter=0.5)
point_6 = Point([list_item_10.Item, list_item_10.Item1])
move_18 = Move(Geometry=point_on_curve_2, Motion=unit_z_7)  # -> Geometry, Transform
move_19 = Move(Geometry=evaluate_curve_2.Point, Motion=unit_z_6)  # -> Geometry, Transform
line_8 = Line(StartPoint=move_19.Geometry, EndPoint=point_6)
line_9 = Line(StartPoint=move_18.Geometry, EndPoint=move_19.Geometry)
merge_3 = Merge(Data1=line_9, Data2=line_8)
unit_x_8 = UnitX(Factor=Slider(4181, range=0..10000))  # -> expr("-x", UnitVector)
join_curves_2 = JoinCurves(Curves=merge_3, Preserve=False)  # -> flatten(Curves)
unit_x_9 = UnitX(Factor=addition_3)
extrude_6 = Extrude(Base=join_curves_2, Direction=expr("-x", unit_x_8))
move_20 = Move(Geometry=extrude_6, Motion=expr("-x", unit_x_9))  # -> Geometry, Transform

brep_11 = Brep(flatten([move_20.Geometry, extrude_6]))
split_brep_multiple_2 = SplitBrepMultiple(Brep=graft(brep_10), Cutters=flatten(brep_11))  # -> simplify(flatten(Result))
line_10 = Line(StartPoint=move_14.Geometry, EndPoint=move_16.Geometry)
brep_12 = Brep(list_item_7)
area_2 = Area(Geometry=_4point_surface_4)  # -> Area, Centroid
mirror_2 = Mirror(Geometry=brep_12, Plane=line_10)  # -> Geometry, Transform
list_item_11 = ListItem(List=split_brep_multiple_2, Index=[1, 2, 4], Wrap=True)
unit_x_10 = UnitX(Factor=middle_widht)  # -> expr("-x", UnitVector)
move_21 = Move(Geometry=mirror_2.Geometry, Motion=unit_x_10)  # -> Geometry, Transform
brep_13 = Brep(brep_12)
brep_14 = Brep(list_item_11)
brep_15 = Brep(move_21.Geometry)
split_brep_multiple_3 = SplitBrepMultiple(Brep=graft([brep_13, brep_15]), Cutters=flatten(brep_11))  # -> simplify(flatten(Result))
list_item_12 = ListItem(List=split_brep_multiple_3, Index=[0, 2, 3, 5], Wrap=True)
number_slider_4 = Slider(0.01, range=0..0.01)
brep_join_3 = BrepJoin(Breps=[list_item_12, brep_14])  # -> Breps, Closed
scale_5 = Scale(Geometry=brep_join_3.Breps, Center=area_2.Centroid, Factor=number_slider_4)  # -> Geometry, Transform

brep_16 = Brep([brep_15, brep_13, brep_10])
brep_join_4 = BrepJoin(Breps=brep_16)  # -> Breps, Closed
number_slider_5 = Slider(0.5, range=0..1)
multiplication_2 = Multiplication(A=module_length, B=number_slider_5)
scale_nu_2 = ScaleNU(Geometry=brep_join_4.Breps, Plane=point_5, ScaleX=1, ScaleY=number_slider_5, ScaleZ=1)  # -> Geometry, Transform
unit_y_5 = UnitY(Factor=multiplication_2)
move_22 = Move(Geometry=scale_nu_2.Geometry, Motion=unit_y_5)  # -> Geometry, Transform
move_23 = Move(Geometry=scale_nu_2.Geometry, Motion=unit_y_4)  # -> Geometry, Transform
scale_6 = Scale(Geometry=move_23.Geometry, Center=area_2.Centroid, Factor=number_slider_4)  # -> Geometry, Transform
scale_7 = Scale(Geometry=move_22.Geometry, Center=area_2.Centroid, Factor=number_slider_4)  # -> Geometry, Transform
brep_17 = Brep(scale_6.Geometry)
brep_18 = Brep(scale_7.Geometry)

mesh_breps_karamba3d_3 = MeshBreps(
    Brep=[brep_17, brep_18],
    MeshResolution=Slider(1, range=0..10),
    EdgeRefinementFactor=0.67,
    PointReduction=False,
    SmoothingStepSize=0,
    SmoothingIterations=5)  # -> flatten(Mesh), Info
mesh_join_3 = MeshJoin(Meshes=mesh_breps_karamba3d_3.Mesh)
mesh_unifynormals_3 = MeshUnifyNormals(Mesh=mesh_join_3)
unify_mesh_3 = UnifyMesh(Mesh=mesh_unifynormals_3)  # -> Result, Count
deconstruct_mesh_3 = DeconstructMesh(Mesh=unify_mesh_3.Result)  # -> Vertices, Faces, Colours, Normals
mesh_edges_3 = MeshEdges(Mesh=unify_mesh_3.Result)  # -> NakedEdges, InteriorEdges, NonManifoldEdges
cull_duplicates_3 = CullDuplicates(Points=deconstruct_mesh_3.Vertices, Tolerance=0.1, CullMode=3)  # -> Points, Indices, Valence
deconstruct_3 = Deconstruct(Point=cull_duplicates_3.Points)  # -> XComponent, YComponent, ZComponent
smaller_than_3 = SmallerThan(FirstNumber=deconstruct_3.ZComponent, SecondNumber=Slider(0.1, range=0..0.1))  # -> SmallerThan, OrEqualTo
cull_pattern_3 = CullPattern(List=cull_duplicates_3.Points, CullPattern=smaller_than_3.OrEqualTo)
point_7 = Point(cull_pattern_3)
line_11 = Line([mesh_edges_3.InteriorEdges, mesh_edges_3.NakedEdges, mesh_edges_3.NonManifoldEdges])

mesh_breps_karamba3d_4 = MeshBreps(
    Brep=scale_5.Geometry,
    MeshResolution=Slider(1, range=0..10),
    EdgeRefinementFactor=0.67,
    PointReduction=False,
    SmoothingStepSize=0,
    SmoothingIterations=5)  # -> flatten(Mesh), Info
mesh_join_4 = MeshJoin(Meshes=mesh_breps_karamba3d_4.Mesh)
mesh_unifynormals_4 = MeshUnifyNormals(Mesh=mesh_join_4)
unify_mesh_4 = UnifyMesh(Mesh=mesh_unifynormals_4)  # -> Result, Count
deconstruct_mesh_4 = DeconstructMesh(Mesh=unify_mesh_4.Result)  # -> Vertices, Faces, Colours, Normals
cull_duplicates_4 = CullDuplicates(Points=deconstruct_mesh_4.Vertices, Tolerance=0.1, CullMode=3)  # -> Points, Indices, Valence
mesh_edges_4 = MeshEdges(Mesh=unify_mesh_4.Result)  # -> NakedEdges, InteriorEdges, NonManifoldEdges
deconstruct_4 = Deconstruct(Point=cull_duplicates_4.Points)  # -> XComponent, YComponent, ZComponent
smaller_than_4 = SmallerThan(FirstNumber=deconstruct_4.ZComponent, SecondNumber=Slider(0.1, range=0..0.1))  # -> SmallerThan, OrEqualTo
cull_pattern_4 = CullPattern(List=cull_duplicates_4.Points, CullPattern=smaller_than_4.OrEqualTo)
point_8 = Point(cull_pattern_4)
line_12 = Line([mesh_edges_4.InteriorEdges, mesh_edges_4.NakedEdges, mesh_edges_4.NonManifoldEdges])

sp_strengthortho_2 = Slider(500, range=0..500)
an_strength_2 = Slider(2500, range=0..2500)
unit_z_8 = UnitZ(Factor=force)
support_2 = Point(flatten([point_8, point_7]))
springortho_2 = Curve(flatten([line_12, line_11]))
mesh_2 = Mesh([unify_mesh_4.Result, unify_mesh_3.Result])
particles_2 = Point(flatten([cull_duplicates_4.Points, cull_duplicates_3.Points]))
length_line_2 = LengthLine(Line=springortho_2, Strength=sp_strengthortho_2)
load_2 = Load(Point=particles_2, ForceVector=unit_z_8)
vertexloads_2 = VertexLoads(Mesh=mesh_2, Strength=unit_z_8)
anchor_2 = Anchor(Point=support_2, Strength=an_strength_2)
show_2 = Show(G=[unify_mesh_4.Result, unify_mesh_3.Result])
merge_4 = Merge(Data2=simplify(show_2), Data3=simplify(length_line_2), Data4=simplify(anchor_2), Data5=simplify(vertexloads_2))  # -> flatten(Result)
zombiesolver_2 = ZombieSolver(GoalObjects=merge_4, Threshold=1e-10, Tolerance=0.01, MaxIterations=max_iterations)  # -> I, V, O

# ----
# Theathre
number_slider_6 = Slider(2, range=0..10)
byparent = ByParent(Mesh=scale.Geometry, Level=number_slider_6)
value_list_2 = ValueList({"Point": 0, "Curve": 1, "Arc": 2, "Circle": 3, "Ellipse": 4, "Line": 5, "Polyline": 6, "Surface": 7, "Brep": 8, "Mesh": 9, "Polysurface": 10, "Block": 11, "Text": 12, "TextDot": 13, "Dimension": 14, "LinearDimension": 15, "AngularDimension": 16, "Hatch": 17, "Leader": 18}, selected="Mesh")
filter_by_type_2 = FilterByType(Geometry=zombiesolver_2.O, ObjectType=value_list_2)
scale_8 = Scale(Geometry=byparent, Center=area.Centroid, Factor=number_slider_3)  # -> Geometry, Transform

null_item_2 = NullItem(Item=zombiesolver_2.O)  # -> NullFlags, InvalidFlags, Description
dispatch_3 = Dispatch(List=zombiesolver_2.O, DispatchPattern=null_item_2.NullFlags)  # -> ListA, ListB
text_2 = Text(dispatch_3.ListB)
evaluate = Evaluate(Expression="Contains(x, \"Mesh\")", Variable_x=text_2)
dispatch_4 = Dispatch(List=dispatch_3.ListB, DispatchPattern=evaluate)  # -> ListA, ListB
list_item_13 = ListItem(List=flatten(filter_by_type_2), Index=0, Wrap=True)
scale_9 = Scale(Geometry=list_item_13, Center=area_2.Centroid, Factor=Slider(100, range=0..100))  # -> Geometry, Transform
weaverbird_s_laplacian_smoothing_2 = WeaverbirdsLaplacianSmoothing(MeshCurves=scale_9.Geometry, Level=Slider(20, range=0..20), SmoothNakedEdges=Slider(0, range=0..2), Thin=1)

final_mesh_2 = Mesh(weaverbird_s_laplacian_smoothing_2)
