# Grasshopper definition Barrel_vault_with_walls.gh (Grasshopper 1.0.7)
# Copyright: Arup

widht_room = Slider(7500, range=0..10000)
height_room = Slider(15000, range=0..100000)
dome_length = Slider(9114, range=0..10000)
height_wall = Slider(2000, range=0..100000)
brick_lenght = Slider(250, range=0..1000)
brick_widht = Slider(125, range=0..1000)
brick_height = Slider(125, range=0..200)

# ---- group: Input
# Output
# Groups
# External input
# Parameters
point = Point(Point(10000, -8.185452316e-12, 0))

# ----
# Floorplan
division = Division(A=widht_room, B=brick_lenght)
division_2 = Division(A=height_room, B=brick_lenght)
round = Round(Number=division)  # -> Nearest, Floor, Ceiling
round_2 = Round(Number=division_2)  # -> Nearest, Floor, Ceiling
multiplication = Multiplication(A=round.Nearest, B=brick_lenght)
multiplication_2 = Multiplication(A=round_2.Nearest, B=brick_lenght)
unit_y = UnitY(Factor=multiplication)
unit_x = UnitX(Factor=multiplication_2)
move = Move(Geometry=point, Motion=unit_y)  # -> Geometry, Transform
move_2 = Move(Geometry=move.Geometry, Motion=unit_x)  # -> Geometry, Transform
rectangle_3pt = Rectangle3Pt(PointA=point, PointB=move.Geometry, PointC=move_2.Geometry)  # -> Rectangle, Length

# ----
# Brick
brick_length = Integer(brick_lenght)
cluster = Cluster(brick_dimension=brick_length)
cluster_2 = Cluster(brick_dimension=brick_widht)
cluster_3 = Cluster(brick_dimension=brick_height)
domain_box = DomainBox(Base=point, X=cluster, Y=cluster_2, Z=cluster_3)
rotate = Rotate(Geometry=domain_box, Angle=degrees(90), Plane=point)  # -> Geometry, Transform
number_slider = Slider(4, range=0..7)
deconstruct_brep = DeconstructBrep(Brep=rotate.Geometry)  # -> Faces, Edges, Vertices
deconstruct_brep_2 = DeconstructBrep(Brep=domain_box)  # -> Faces, Edges, Vertices
list_item = ListItem(List=deconstruct_brep.Vertices, Index=number_slider, Wrap=True)
list_item_2 = ListItem(List=deconstruct_brep_2.Vertices, Index=number_slider, Wrap=True)

# ----
# Brick layers
unit_z = UnitZ(Factor=1)
point_2 = Point(point)
line_sdl = LineSDL(Start=point_2, Direction=unit_z, Length=height_wall)
division_3 = Division(A=height_wall, B=brick_height)
divide_curve = DivideCurve(Curve=line_sdl, Count=division_3, Kinks=False)  # -> Points, Tangents, Parameters
cull_index = CullIndex(List=divide_curve.Points, Indices=0, Wrap=True)
dispatch = Dispatch(List=cull_index, DispatchPattern=[True, False])  # -> ListA, ListB

# ----
# Brick placement - Barrel vault and walls
# Script for creating a barrel vault with walls included.
addition = Addition(A=multiplication_2, B=brick_widht)

# ----
# First Layer
explode = Explode(Curve=rectangle_3pt.Rectangle, Recursive=True)  # -> Segments, Vertices
list_item_3 = ListItem(List=explode.Segments, Index=0, Wrap=True)
list_item_4 = ListItem(List=explode.Segments, Index=1, Wrap=True)
length = Length(Curve=list_item_4)
length_2 = Length(Curve=list_item_3)
area = Area(Geometry=rectangle_3pt.Rectangle)  # -> Area, Centroid
division_4 = Division(A=length_2, B=brick_lenght)
division_5 = Division(A=length, B=brick_lenght)
divide_curve_2 = DivideCurve(Curve=list_item_3, Count=division_4, Kinks=False)  # -> Points, Tangents, Parameters
divide_curve_3 = DivideCurve(Curve=list_item_4, Count=division_5, Kinks=False)  # -> Points, Tangents, Parameters
cull_index_2 = CullIndex(List=divide_curve_2.Points, Indices=-1, Wrap=True)
orient = Orient(Geometry=rotate.Geometry, Source=list_item, Target=cull_index_2)  # -> Geometry, Transform
orient_2 = Orient(Geometry=domain_box, Source=list_item_2, Target=divide_curve_3.Points)  # -> Geometry, Transform
unit_x_2 = UnitX(Factor=brick_widht)  # -> expr("-x", UnitVector)
move_3 = Move(Geometry=orient_2.Geometry, Motion=unit_x_2)  # -> Geometry, Transform
geometry = Geometry([move_3.Geometry, orient.Geometry])
rotate_2 = Rotate(Geometry=geometry, Angle=degrees(180), Plane=area.Centroid)  # -> Geometry, Transform
geometry_2 = Geometry(graft([geometry, rotate_2.Geometry]))

# ----
# Barrel Arch
deconstruct_brep_3 = DeconstructBrep(Brep=rectangle_3pt.Rectangle)  # -> Faces, Edges, Vertices
unit_z_2 = UnitZ(Factor=height_wall)
list_item_5 = ListItem(List=deconstruct_brep_3.Edges, Index=0, Wrap=True)
move_4 = Move(Geometry=list_item_5, Motion=unit_z_2)  # -> Geometry, Transform
end_points = EndPoints(Curve=move_4.Geometry)  # -> Start, End
catenary = Catenary(PointA=end_points.Start, PointB=end_points.End, Length=dome_length, Gravity=expr("-x", Vector(0, 0, -1)))

# ----
# Second Layer
divide_curve_4 = DivideCurve(Curve=list_item_3, Count=division_4, Kinks=False)  # -> Points, Tangents, Parameters
orient_3 = Orient(Geometry=rotate.Geometry, Source=list_item, Target=divide_curve_4.Points)  # -> Geometry, Transform
unit_y_2 = UnitY(Factor=brick_widht)  # -> expr("-x", UnitVector)
cull_index_3 = CullIndex(List=orient_2.Geometry, Indices=-1, Wrap=True)
move_5 = Move(Geometry=orient_3.Geometry, Motion=unit_y_2)  # -> Geometry, Transform
geometry_3 = Geometry([move_5.Geometry, cull_index_3])
rotate_3 = Rotate(Geometry=geometry_3, Angle=degrees(180), Plane=area.Centroid)  # -> Geometry, Transform
geometry_4 = Geometry(graft([rotate_3.Geometry, geometry_3]))

orient_4 = Orient(Geometry=geometry_4, Source=point, Target=dispatch.ListA)  # -> Geometry, Transform
orient_5 = Orient(Geometry=geometry_2, Source=point, Target=dispatch.ListB)  # -> Geometry, Transform
geometry_5 = Geometry([orient_4.Geometry, orient_5.Geometry])

# ----
# Location for bricks arch
explode_2 = Explode(Curve=rectangle_3pt.Rectangle, Recursive=True)  # -> Segments, Vertices
list_item_6 = ListItem(List=explode_2.Segments, Index=1, Wrap=True)
length_3 = Length(Curve=list_item_6)
unit_z_3 = UnitZ(Factor=height_wall)
division_6 = Division(A=length_3, B=brick_widht)
divide_curve_5 = DivideCurve(Curve=list_item_6, Count=division_6, Kinks=False)  # -> Points, Tangents, Parameters
move_6 = Move(Geometry=divide_curve_5.Points, Motion=unit_z_3)  # -> Geometry, Transform
dispatch_2 = Dispatch(List=move_6.Geometry, DispatchPattern=[True, False])  # -> ListA, ListB

# ----
# Closing walls
list_item_7 = ListItem(List=explode_2.Segments, Index=0, Wrap=True)
move_7 = Move(Geometry=list_item_7, Motion=unit_z_3)  # -> Geometry, Transform
curve = Curve(catenary)
length_4 = Length(Curve=move_7.Geometry)
point_on_curve = PointOnCurve(curve, parameter=0.5)
end_points_2 = EndPoints(Curve=move_7.Geometry)  # -> Start, End
division_7 = Division(A=length_4, B=brick_lenght)  # -> graft(Result)
deconstruct = Deconstruct(Point=end_points_2.End)  # -> XComponent, YComponent, ZComponent
deconstruct_2 = Deconstruct(Point=point_on_curve)  # -> XComponent, YComponent, ZComponent
divide_curve_6 = DivideCurve(Curve=move_7.Geometry, Count=division_7, Kinks=False)  # -> flatten(Points), Tangents, Parameters
unit_z_4 = UnitZ(Factor=1)
subtraction = Subtraction(A=deconstruct_2.ZComponent, B=deconstruct.ZComponent)
unit_y_3 = UnitY(Factor=brick_lenght)
list_item_8 = ListItem(List=divide_curve_6.Points, Index=0, Wrap=True)
line_sdl_2 = LineSDL(Start=end_points_2.End, Direction=unit_z_4, Length=subtraction)
move_8 = Move(Geometry=list_item_8, Motion=unit_y_3)  # -> Geometry, Transform
unit_z_5 = UnitZ(Factor=brick_height)
length_5 = Length(Curve=line_sdl_2)
move_9 = Move(Geometry=move_8.Geometry, Motion=unit_z_5)  # -> Geometry, Transform
division_8 = Division(A=length_5, B=brick_height)
round_3 = Round(Number=division_8)  # -> Nearest, Floor, Ceiling
rectangle_3pt_2 = Rectangle3Pt(PointA=list_item_8, PointB=move_8.Geometry, PointC=move_9.Geometry)  # -> Rectangle, Length
multiplication_3 = Multiplication(A=round_3.Ceiling, B=brick_height)
line_sdl_3 = LineSDL(Start=end_points_2.End, Direction=unit_z_4, Length=multiplication_3)
orient_6 = Orient(Geometry=rectangle_3pt_2.Rectangle, Source=list_item_8, Target=divide_curve_6.Points)  # -> Geometry, Transform
divide_curve_7 = DivideCurve(Curve=line_sdl_3, Count=round_3.Ceiling, Kinks=False)  # -> Points, Tangents, Parameters
division_9 = Division(A=unit_y_3, B=2)
move_10 = Move(Geometry=orient_6.Geometry, Motion=division_9)  # -> graft(Geometry), Transform
dispatch_3 = Dispatch(List=divide_curve_7.Points, DispatchPattern=[True, False])  # -> ListA, ListB
geometry_6 = Geometry(graft(orient_6.Geometry))
orient_7 = Orient(Geometry=move_10.Geometry, Source=end_points_2.End, Target=dispatch_3.ListA)  # -> Geometry, Transform
orient_8 = Orient(Geometry=geometry_6, Source=end_points_2.End, Target=dispatch_3.ListB)  # -> Geometry, Transform
boundary_surfaces = BoundarySurfaces(Edges=[move_7.Geometry, curve])
region_difference = RegionDifference(CurvesA=boundary_surfaces, CurvesB=orient_8.Geometry)
region_difference_2 = RegionDifference(CurvesA=boundary_surfaces, CurvesB=orient_7.Geometry)
unit_x_3 = UnitX(Factor=brick_widht)
extrude = Extrude(Base=[region_difference, region_difference_2], Direction=unit_x_3)
cap_holes = CapHoles(Brep=extrude)
unit_x_4 = UnitX(Factor=unit_x_3)  # -> expr("-x", UnitVector)
move_11 = Move(Geometry=cap_holes, Motion=unit_x_4)  # -> Geometry, Transform
unit_x_5 = UnitX(Factor=addition)
move_12 = Move(Geometry=move_11.Geometry, Motion=unit_x_5)  # -> Geometry, Transform

# ----
# Bricks Arch 2
integer = Integer(brick_lenght)
division_10 = Division(A=integer, B=2)
negative = Negative(Value=division_10)
extend_curve = ExtendCurve(Curve=catenary, Type=0, Start=negative, End=negative)
length_6 = Length(Curve=extend_curve)
division_11 = Division(A=length_6, B=brick_lenght)
round_4 = Round(Number=division_11)  # -> Nearest, Floor, Ceiling
rebuild_curve = RebuildCurve(Curve=extend_curve, Count=expr("x+1", round_4.Nearest), Tangents=False)
unit_x_6 = UnitX(Factor=brick_widht)
extrude_2 = Extrude(Base=rebuild_curve, Direction=unit_x_6)
divide_curve_8 = DivideCurve(Curve=extend_curve, Count=round_4.Nearest, Kinks=False)  # -> Points, Tangents, Parameters
xz_plane = XZPlane(Origin=divide_curve_8.Points)
brep_plane = BrepPlane(Brep=extrude_2, Plane=xz_plane)  # -> Curves, Points
explode_3 = Explode(Curve=brep_plane.Curves, Recursive=True)  # -> flatten(Segments), Vertices
end_points_3 = EndPoints(Curve=explode_3.Segments)  # -> flatten(Start), flatten(End)
shift_list = ShiftList(List=end_points_3.Start, Shift=1, Wrap=True)
point_3 = Point(end_points_3.Start)
rectangle_3pt_3 = Rectangle3Pt(PointA=point_3, PointB=shift_list, PointC=end_points_3.End)  # -> Rectangle, Length
plane_3pt = Plane3Pt(PointA=point_3, PointB=shift_list, PointC=end_points_3.End)
point_on_curve_2 = PointOnCurve(extend_curve, parameter=0.5)
list_item_9 = ListItem(List=rectangle_3pt_3.Rectangle, Index=0, Wrap=True)
cull_index_4 = CullIndex(List=rectangle_3pt_3.Rectangle, Indices=[-1, -2], Wrap=True)
list_item_10 = ListItem(List=plane_3pt, Index=[0, 1], Wrap=True)
unit_x_7 = UnitX(Factor=brick_widht)
rotate_4 = Rotate(Geometry=list_item_9, Angle=degrees(180), Plane=point_on_curve_2)  # -> Geometry, Transform
rotate_5 = Rotate(Geometry=list_item_10, Angle=degrees(180), Plane=point_on_curve_2)  # -> Geometry, Transform
cull_index_5 = CullIndex(List=plane_3pt, Indices=[-1, -2], Wrap=True)
move_13 = Move(Geometry=rotate_4.Geometry, Motion=unit_x_7)  # -> Geometry, Transform
rectangle = Rectangle([cull_index_4, move_13.Geometry])
plane = Plane([cull_index_5, rotate_5.Geometry])
amplitude = Amplitude(Vector=plane, Amplitude=brick_height)
extrude_3 = Extrude(Base=rectangle, Direction=amplitude)
cap_holes_2 = CapHoles(Brep=extrude_3)
list_item_11 = ListItem(List=cap_holes_2, Index=0, Wrap=True)

# ----
# Bricks Arch 1
length_7 = Length(Curve=catenary)
division_12 = Division(A=length_7, B=brick_lenght)
unit_x_8 = UnitX(Factor=brick_widht)
round_5 = Round(Number=division_12)  # -> Nearest, Floor, Ceiling
rebuild_curve_2 = RebuildCurve(Curve=catenary, Count=expr("x+1", round_5.Nearest), Tangents=False)
divide_curve_9 = DivideCurve(Curve=catenary, Count=round_5.Nearest, Kinks=False)  # -> Points, Tangents, Parameters
extrude_4 = Extrude(Base=rebuild_curve_2, Direction=unit_x_8)
xz_plane_2 = XZPlane(Origin=divide_curve_9.Points)
brep_plane_2 = BrepPlane(Brep=extrude_4, Plane=xz_plane_2)  # -> Curves, Points
explode_4 = Explode(Curve=brep_plane_2.Curves, Recursive=True)  # -> flatten(Segments), Vertices
end_points_4 = EndPoints(Curve=explode_4.Segments)  # -> flatten(Start), flatten(End)
shift_list_2 = ShiftList(List=end_points_4.Start, Shift=1, Wrap=True)
point_4 = Point(end_points_4.Start)
plane_3pt_2 = Plane3Pt(PointA=point_4, PointB=shift_list_2, PointC=end_points_4.End)
rectangle_3pt_4 = Rectangle3Pt(PointA=point_4, PointB=shift_list_2, PointC=end_points_4.End)  # -> Rectangle, Length
point_on_curve_3 = PointOnCurve(catenary, parameter=0.5)
list_item_12 = ListItem(List=rectangle_3pt_4.Rectangle, Index=0, Wrap=True)
cull_index_6 = CullIndex(List=rectangle_3pt_4.Rectangle, Indices=[-1, -2], Wrap=True)
list_item_13 = ListItem(List=plane_3pt_2, Index=[0, 1], Wrap=True)
unit_x_9 = UnitX(Factor=brick_widht)
rotate_6 = Rotate(Geometry=list_item_12, Angle=degrees(180), Plane=point_on_curve_3)  # -> Geometry, Transform
rotate_7 = Rotate(Geometry=list_item_13, Angle=degrees(180), Plane=point_on_curve_3)  # -> Geometry, Transform
move_14 = Move(Geometry=rotate_6.Geometry, Motion=unit_x_9)  # -> Geometry, Transform
cull_index_7 = CullIndex(List=plane_3pt_2, Indices=[-1, -2], Wrap=True)
rectangle_2 = Rectangle([cull_index_6, move_14.Geometry])
plane_2 = Plane([cull_index_7, rotate_7.Geometry])
amplitude_2 = Amplitude(Vector=plane_2, Amplitude=brick_height)
extrude_5 = Extrude(Base=rectangle_2, Direction=amplitude_2)
cap_holes_3 = CapHoles(Brep=extrude_5)
unit_x_10 = UnitX(Factor=brick_widht)  # -> expr("-x", UnitVector)

# ----
# Infill bricks
number_slider_2 = Slider(1, range=0..4)
unit_y_4 = UnitY(Factor=brick_widht)
unit_x_11 = UnitX(Factor=brick_widht)  # -> expr("-x", UnitVector)
point_on_curve_4 = PointOnCurve(catenary, parameter=0.5)
unit_x_12 = UnitX(Factor=brick_widht)

list_item_14 = ListItem(List=cap_holes_3, Index=0, Wrap=True)
split_brep = SplitBrep(Brep=list_item_14, Cutter=list_item_11)  # -> flatten(Result)
list_item_15 = ListItem(List=split_brep, Index=[4, 9], Wrap=True)

brep = Brep(flatten(list_item_15))
list_item_16 = ListItem(List=brep, Index=0, Wrap=True)
deconstruct_brep_4 = DeconstructBrep(Brep=list_item_16)  # -> Faces, Edges, Vertices
list_item_17 = ListItem(List=deconstruct_brep_4.Faces, Index=number_slider_2, Wrap=True)
deconstruct_brep_5 = DeconstructBrep(Brep=list_item_17)  # -> Faces, Edges, Vertices
list_item_18 = ListItem(List=deconstruct_brep_5.Vertices, Index=3, Wrap=True)
move_15 = Move(Geometry=list_item_18, Motion=unit_y_4)  # -> Geometry, Transform
list_item_19 = ListItem(List=deconstruct_brep_5.Vertices, Index=Slider(0, range=0..4), Wrap=True)
list_item_20 = ListItem(List=deconstruct_brep_5.Vertices, Index=3, Wrap=True)
line = Line(StartPoint=list_item_19, EndPoint=list_item_20)
line_2 = Line(StartPoint=move_15.Geometry, EndPoint=list_item_20)
line_3 = Line(StartPoint=list_item_19, EndPoint=move_15.Geometry)
boundary_surfaces_2 = BoundarySurfaces(Edges=[line, line_2, line_3])
extrude_6 = Extrude(Base=boundary_surfaces_2, Direction=unit_x_11)
rotate_8 = Rotate(Geometry=extrude_6, Angle=degrees(180), Plane=point_on_curve_4)  # -> Geometry, Transform
move_16 = Move(Geometry=rotate_8.Geometry, Motion=unit_x_12)  # -> Geometry, Transform
geometry_7 = Geometry([move_16.Geometry, extrude_6])

brep_2 = Brep(graft([cap_holes_3, geometry_7]))
move_17 = Move(Geometry=brep_2, Motion=unit_x_10)  # -> Geometry, Transform
orient_9 = Orient(Geometry=brep_2, Source=end_points.End, Target=dispatch_2.ListB)  # -> Geometry, Transform

brep_3 = Brep(graft([cap_holes_2, list_item_15, geometry_7]))
orient_10 = Orient(Geometry=brep_3, Source=end_points.End, Target=dispatch_2.ListA)  # -> Geometry, Transform

geometry_8 = Geometry([orient_9.Geometry, orient_10.Geometry, move_17.Geometry])
geometry_9 = Geometry([move_12.Geometry, move_11.Geometry])
geometry_10 = Geometry(geometry_5)

# ---- group: Output
geometry_11 = Geometry([geometry_10, geometry_8, geometry_9])

# ==== cluster Cluster
brick_dimension = ClusterInput()
division = Division(A=brick_dimension, B=2)
negative = Negative(Value=division)
construct_domain = ConstructDomain(DomainStart=negative, DomainEnd=division)
domain = ClusterOutput(construct_domain)
