# Grasshopper definition Single_wall.gh (Grasshopper 1.0.7)
# Copyright: Arup

# ----
# Groups
wall_length = Slider(15490, range=0..100000)
wall_height = Slider(7000, range=0..100000)
brick_length = Slider(500, range=0..500)
brick_width = Slider(250, range=0..250)
brick_height = Slider(200, range=0..200)
wall_rotation = Slider(0, range=0..360)

# ---- group: Input
# External input
point = Point(Point(10000, 7500, 0))

# ----
unit_z = UnitZ(Factor=wall_height)
cluster = Cluster_2(total=wall_height, brick=brick_height)
move = Move(Geometry=point, Motion=unit_z)  # -> Geometry, Transform
division = Division(A=cluster, B=brick_height)
round = Round(Number=division)  # -> Nearest, Floor, Ceiling
line = Line(StartPoint=point, EndPoint=move.Geometry)
divide_curve = DivideCurve(Curve=line, Count=round.Ceiling, Kinks=False)  # -> Points, Tangents, Parameters
dispatch = Dispatch(List=divide_curve.Points, DispatchPattern=[True, False])  # -> ListA, ListB

division_2 = Division(A=brick_length, B=2)
cluster_2 = Cluster(brick_dimension=brick_width)
cluster_3 = Cluster(brick_dimension=brick_height)
cluster_4 = Cluster(brick_dimension=division_2)
domain_box = DomainBox(Base=point, X=cluster_4, Y=cluster_2, Z=cluster_3)
deconstruct_brep = DeconstructBrep(Brep=domain_box)  # -> Faces, Edges, Vertices
list_item = ListItem(List=deconstruct_brep.Vertices, Index=3, Wrap=True)

# ----
# Parameters
cluster_5 = Cluster_2(total=wall_length, brick=brick_length)
# Output
unit_x = UnitX(Factor=cluster_5)
move_2 = Move(Geometry=point, Motion=unit_x)  # -> Geometry, Transform
line_2 = Line(StartPoint=point, EndPoint=move_2.Geometry)
length = Length(Curve=line_2)
division_3 = Division(A=length, B=brick_length)
round_2 = Round(Number=division_3)  # -> Nearest, Floor, Ceiling
divide_curve_2 = DivideCurve(Curve=line_2, Count=round_2.Ceiling, Kinks=False)  # -> Points, Tangents, Parameters

# ----
# Brick placement - Wall
# Script for creating a simple wall to be used as temporary structure
brick_length_2 = Integer(brick_length)
box = Box(domain_box)
base_corner_for_source = Point(list_item)
base_corner_for_source_2 = Point(base_corner_for_source)

cluster_6 = Cluster(brick_dimension=brick_length_2)
domain_box_2 = DomainBox(Base=point, X=cluster_6, Y=cluster_2, Z=cluster_3)
deconstruct_brep_2 = DeconstructBrep(Brep=domain_box_2)  # -> Faces, Edges, Vertices
list_item_2 = ListItem(List=deconstruct_brep_2.Vertices, Index=3, Wrap=True)

division_4 = Division(A=brick_length, B=2)
extend_curve = ExtendCurve(Curve=line_2, Type=0, Start=expr("-x", division_4), End=expr("-x", division_4))
end_points = EndPoints(Curve=line_2)  # -> Start, End
length_2 = Length(Curve=extend_curve)
unit_x_2 = UnitX(Factor=division_4)
division_5 = Division(A=length_2, B=brick_length)
round_3 = Round(Number=division_5)  # -> Nearest, Floor, Ceiling
move_3 = Move(Geometry=end_points.End, Motion=unit_x_2)  # -> Geometry, Transform
divide_curve_3 = DivideCurve(Curve=extend_curve, Count=round_3.Ceiling, Kinks=False)  # -> Points, Tangents, Parameters
orient = Orient(Geometry=domain_box, Source=base_corner_for_source_2, Target=end_points.Start)  # -> Geometry, Transform
orient_2 = Orient(Geometry=domain_box, Source=base_corner_for_source_2, Target=move_3.Geometry)  # -> Geometry, Transform
orient_3 = Orient(Geometry=domain_box_2, Source=list_item_2, Target=divide_curve_3.Points)  # -> Geometry, Transform
geometry = Geometry([orient.Geometry, orient_2.Geometry])

orient_4 = Orient(Geometry=domain_box_2, Source=list_item_2, Target=divide_curve_2.Points)  # -> Geometry, Transform

geometry_2 = Geometry(graft(orient_4.Geometry))
geometry_3 = Geometry(graft([orient_3.Geometry, geometry]))
orient_5 = Orient(Geometry=geometry_2, Source=point, Target=dispatch.ListA)  # -> Geometry, Transform
orient_6 = Orient(Geometry=geometry_3, Source=point, Target=dispatch.ListB)  # -> Geometry, Transform
geometry_4 = Geometry([orient_5.Geometry, orient_6.Geometry])
rotate = Rotate(Geometry=geometry_4, Angle=degrees(wall_rotation), Plane=point)  # -> Geometry, Transform

# ---- group: Output
geometry_5 = Geometry(rotate.Geometry)

# ==== cluster Cluster
brick_dimension = ClusterInput()
division = Division(A=brick_dimension, B=2)
negative = Negative(Value=division)
construct_domain = ConstructDomain(DomainStart=negative, DomainEnd=division)
domain = ClusterOutput(construct_domain)

# ==== cluster Cluster_2
brick = ClusterInput()
total = ClusterInput()
number = Number(brick)
number_2 = Number(total)
division = Division(A=number_2, B=number)
round = Round(Number=division)  # -> Nearest, Floor, Ceiling
multiplication = Multiplication(A=number, B=round.Ceiling)
result = ClusterOutput(multiplication)
