# Grasshopper definition Solid_Tower.gh (Grasshopper 1.0.7)
# Copyright: Arup
# plug-ins: Pufferfish, EleFront

brick_length = Slider(250, range=0..500)
brick_width = Slider(250, range=0..250)
tower_base = Slider(3500, range=0..10000)
brick_height = Slider(200, range=0..200)
tower_height = Slider(12000, range=0..100000)

# ----
# Ladder Parameters
widht = Slider(1000, range=0..1000)
depth = Slider(1500, range=0..3000)
start_height = Slider(4000, range=0..10000)

# ---- group: Input
# Groups
# External input
# Parameters
point = Point(Point(45250, 32750, 0))

# ----
# Output
# Brick placement - Tower
# Script for creating a solid tower with a vertical stair integrated.
number = Number(brick_height)

# ---- group: This is just to make to gaps visible
gaps = Slider(0.98, range=0..1)

# ----
# Brick creation
unit_x = UnitX(Factor=brick_length)
move = Move(Geometry=point, Motion=unit_x)  # -> Geometry, Transform
unit_y = UnitY(Factor=brick_width)
division = Division(A=brick_length, B=2)
move_2 = Move(Geometry=move.Geometry, Motion=unit_y)  # -> Geometry, Transform
unit_z = UnitZ(Factor=brick_height)
division_2 = Division(A=brick_width, B=2)
unit_x_2 = UnitX(Factor=division)
move_3 = Move(Geometry=move_2.Geometry, Motion=unit_z)  # -> Geometry, Transform
unit_y_2 = UnitY(Factor=division_2)
box_2pt = Box2Pt(PointA=point, PointB=move_3.Geometry, Plane=PlaneXY(0, 0, 0))
move_4 = Move(Geometry=point, Motion=unit_y_2)  # -> Geometry, Transform
move_5 = Move(Geometry=point, Motion=unit_x_2)  # -> Geometry, Transform
volume = Volume(Geometry=box_2pt)  # -> Volume, Centroid
division_3 = Division(A=brick_width, B=2)
unit_x_3 = UnitX(Factor=division_3)
scale = Scale(Geometry=box_2pt, Center=volume.Centroid, Factor=gaps)  # -> Geometry, Transform
move_6 = Move(Geometry=move_4.Geometry, Motion=unit_x_3)  # -> Geometry, Transform
geometry = Geometry(scale.Geometry)

# ----
# Brick Layers
unit_z_2 = UnitZ(Factor=tower_height)
move_7 = Move(Geometry=point, Motion=unit_z_2)  # -> Geometry, Transform
line = Line(StartPoint=point, EndPoint=move_7.Geometry)
division_4 = Division(A=tower_height, B=brick_height)
divide_curve = DivideCurve(Curve=line, Count=division_4, Kinks=False)  # -> Points, Tangents, Parameters
dispatch = Dispatch(List=divide_curve.Points, DispatchPattern=[True, False])  # -> ListA, ListB

# ----
# Brick placement
unit_x_4 = UnitX(Factor=tower_base)
unit_y_3 = UnitY(Factor=tower_base)
move_8 = Move(Geometry=point, Motion=unit_x_4)  # -> Geometry, Transform
move_9 = Move(Geometry=point, Motion=unit_y_3)  # -> Geometry, Transform
rectangle_3pt = Rectangle3Pt(PointA=point, PointB=move_8.Geometry, PointC=move_9.Geometry)  # -> Rectangle, Length
division_5 = Division(A=brick_width, B=2)
offset_curve = OffsetCurve(Curve=rectangle_3pt.Rectangle, Distance=division_5, Plane=PlaneXY(0, 0, 0), Corners=1)
explode = Explode(Curve=offset_curve, Recursive=True)  # -> Segments, Vertices
list_item = ListItem(List=explode.Vertices, Index=0, Wrap=True)
list_item_2 = ListItem(List=explode.Segments, Index=0, Wrap=True)
length = Length(Curve=list_item_2)
subtraction = Subtraction(A=length, B=brick_width)
unit_x_5 = UnitX(Factor=subtraction)
division_6 = Division(A=tower_base, B=2)
move_10 = Move(Geometry=list_item, Motion=unit_x_5)  # -> Geometry, Transform
line_2 = Line(StartPoint=list_item, EndPoint=move_10.Geometry)
unit_y_4 = UnitY(Factor=division_6)
point_on_curve = PointOnCurve(line_2, parameter=0.5)
move_11 = Move(Geometry=point_on_curve, Motion=unit_y_4)  # -> Geometry, Transform
line_3 = Line(StartPoint=point_on_curve, EndPoint=move_11.Geometry)
length_2 = Length(Curve=line_3)
division_7 = Division(A=length_2, B=brick_width)
divide_curve_2 = DivideCurve(Curve=line_3, Count=division_7, Kinks=False)  # -> Points, Tangents, Parameters
division_8 = Division(A=tower_base, B=2)
last_index = LastIndex(List=divide_curve_2.Points)
construct_domain = ConstructDomain(DomainStart=division_8, DomainEnd=0)
division_9 = Division(A=division_8, B=250)
division_10 = Division(A=tower_base, B=2)
range = Range(Domain=construct_domain, Steps=division_9)
construct_domain_2 = ConstructDomain(DomainStart=division_10, DomainEnd=0)
cull_index = CullIndex(List=range, Indices=-1, Wrap=True)
range_2 = Range(Domain=construct_domain_2, Steps=last_index)
multiplication = Multiplication(A=cull_index, B=2)
cull_index_2 = CullIndex(List=range_2, Indices=0, Wrap=True)
unit_x_6 = UnitX(Factor=cull_index_2)  # -> expr("-x", UnitVector)
move_12 = Move(Geometry=divide_curve_2.Points, Motion=unit_x_6)  # -> Geometry, Transform
unit_x_7 = UnitX(Factor=multiplication)
move_13 = Move(Geometry=move_12.Geometry, Motion=unit_x_7)  # -> Geometry, Transform
division_11 = Division(A=brick_length, B=2)
line_4 = Line(StartPoint=move_12.Geometry, EndPoint=move_13.Geometry)
negative = Negative(Value=division_11)
cull_index_3 = CullIndex(List=line_4, Indices=-1, Wrap=True)
cull_index_4 = CullIndex(List=line_4, Indices=[-1, -2], Wrap=True)
list_item_3 = ListItem(List=cull_index_3, Index=-1, Wrap=True)
extend_curve = ExtendCurve(Curve=cull_index_4, Type=0, Start=negative, End=negative)
end_points = EndPoints(Curve=extend_curve)  # -> Start, End
line_5 = Line(StartPoint=end_points.Start, EndPoint=end_points.End)  # -> flatten(Line)
length_3 = Length(Curve=line_5)
point_on_curve_2 = PointOnCurve(list_item_3, parameter=0.5)
division_12 = Division(A=length_3, B=brick_length)
divide_curve_3 = DivideCurve(Curve=line_5, Count=division_12, Kinks=False)  # -> Points, Tangents, Parameters
point_2 = Point([divide_curve_3.Points, point_on_curve_2])
orient = Orient(Geometry=geometry, Source=move_5.Geometry, Target=point_2)  # -> graft(Geometry), Transform
area = Area(Geometry=rectangle_3pt.Rectangle)  # -> Area, Centroid
rotate = Rotate(Geometry=orient.Geometry, Angle=degrees([90, 180, 270]), Plane=area.Centroid)  # -> Geometry, Transform
yz_plane = YZPlane(Origin=area.Centroid)
unit_z_3 = UnitZ(Factor=number)
unit_z_4 = UnitZ(Factor=number)

# ----
# Ladder extrusion
curve = Curve(offset_curve)
explode_2 = Explode(Curve=curve, Recursive=True)  # -> Segments, Vertices
division_13 = Division(A=widht, B=2)
list_item_4 = ListItem(List=explode_2.Segments, Index=0, Wrap=True)
unit_z_5 = UnitZ(Factor=start_height)
point_on_curve_3 = PointOnCurve(list_item_4, parameter=0.5)
unit_x_8 = UnitX(Factor=division_13)
move_14 = Move(Geometry=point_on_curve_3, Motion=unit_z_5)  # -> Geometry, Transform
unit_y_5 = UnitY(Factor=depth)
multiplication_2 = Multiplication(A=division_13, B=2)
move_15 = Move(Geometry=move_14.Geometry, Motion=unit_x_8)  # -> Geometry, Transform
move_16 = Move(Geometry=move_15.Geometry, Motion=unit_y_5)  # -> Geometry, Transform
unit_x_9 = UnitX(Factor=multiplication_2)  # -> expr("-x", UnitVector)
move_17 = Move(Geometry=move_16.Geometry, Motion=unit_x_9)  # -> Geometry, Transform
subtraction_2 = Subtraction(A=tower_height, B=start_height)
addition = Addition(A=subtraction_2, B=200)
rectangle_3pt_2 = Rectangle3Pt(PointA=move_15.Geometry, PointB=move_16.Geometry, PointC=move_17.Geometry)  # -> Rectangle, Length
unit_z_6 = UnitZ(Factor=addition)
extrude = Extrude(Base=rectangle_3pt_2.Rectangle, Direction=unit_z_6)
cap_holes = CapHoles(Brep=extrude)

point_3 = Point(point)
point_4 = Point(dispatch.ListA)
geometry_2 = Geometry(graft([rotate.Geometry, orient.Geometry]))
point_5 = Point(dispatch.ListB)
orient_2 = Orient(Geometry=geometry_2, Source=point_3, Target=point_4)  # -> Geometry, Transform

mirror = Mirror(Geometry=geometry_2, Plane=yz_plane)  # -> Geometry, Transform
move_18 = Move(Geometry=point_3, Motion=unit_z_3)  # -> Geometry, Transform
move_19 = Move(Geometry=mirror.Geometry, Motion=unit_z_4)  # -> Geometry, Transform

point_6 = Point(move_18.Geometry)
geometry_3 = Geometry(move_19.Geometry)
orient_3 = Orient(Geometry=geometry_3, Source=point_6, Target=point_5)  # -> Geometry, Transform
geometry_4 = Geometry([orient_3.Geometry, orient_2.Geometry])

volume_2 = Volume(Geometry=geometry_4)  # -> Volume, Centroid
brep = Brep(cap_holes)
in = Inside(Brep=brep, Point=volume_2.Centroid, Strict=False)
gate_not = GateNot(A=in)
dispatch_2 = Dispatch(List=geometry_4, DispatchPattern=gate_not)  # -> ListA, ListB
cull_pattern = CullPattern(List=geometry_4, CullPattern=gate_not)
brep_2 = Brep(flatten(dispatch_2.ListB))

group = Group(Objects=brep_2)
bounding_box = BoundingBox(Content=group, Plane=PlaneXY(0, 0, 0))  # -> Box, Box_2
volume_3 = Volume(Geometry=bounding_box.Box)  # -> Volume, Centroid
deconstruct_brep = DeconstructBrep(Brep=bounding_box.Box)  # -> Faces, Edges, Vertices
list_item_5 = ListItem(List=deconstruct_brep.Edges, Index=0, Wrap=True)
length_4 = Length(Curve=list_item_5)
subtraction_3 = Subtraction(A=length_4, B=500)
division_14 = Division(A=Slider(100, range=0..100), B=length_4)
multiplication_3 = Multiplication(A=division_14, B=subtraction_3)
division_15 = Division(A=multiplication_3, B=100)
scale_nu = ScaleNU(Geometry=bounding_box.Box, Plane=volume_3.Centroid, ScaleX=division_15, ScaleY=1, ScaleZ=1)  # -> Geometry, Transform
value_list = ValueList({"Point": 0, "Curve": 1, "Arc": 2, "Circle": 3, "Ellipse": 4, "Line": 5, "Polyline": 6, "Surface": 7, "Brep": 8, "Mesh": 9, "Polysurface": 10, "Block": 11, "Text": 12, "TextDot": 13, "Dimension": 14, "LinearDimension": 15, "AngularDimension": 16, "Hatch": 17, "Leader": 18}, selected="Brep")
split_brep_multiple = SplitBrepMultiple(Brep=brep_2, Cutters=scale_nu.Geometry)
filter_by_type = FilterByType(Geometry=split_brep_multiple, ObjectType=value_list)
cap_holes_2 = CapHoles(Brep=filter_by_type)
volume_4 = Volume(Geometry=cap_holes_2)  # -> Volume, Centroid
in_2 = Inside(Brep=scale_nu.Geometry, Point=volume_4.Centroid, Strict=False)
gate_not_2 = GateNot(A=in_2)
cull_pattern_2 = CullPattern(List=cap_holes_2, CullPattern=gate_not_2)  # -> flatten(List)

# ---- group: Output
brep_3 = Brep([cull_pattern_2, cull_pattern])
