# Grasshopper definition Theatre_-_Nubian_vault.gh (Grasshopper 1.0.7)
# Copyright: Arup
# plug-ins: Pufferfish

# ---- group: Input
# Output
# Groups
# External input
# Parameters
mesh = Mesh(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)

# ----
brick_height = Slider(125, range=0..250)
mortar = Slider(0, range=0..100)
brick_length = Slider(250, range=0..250)
brick_width = Slider(125, range=0..240)

# ----
# Mesh Section
mesh_edges = MeshEdges(Mesh=mesh)  # -> NakedEdges, InteriorEdges, NonManifoldEdges
join_curves = JoinCurves(Curves=mesh_edges.NakedEdges, Preserve=False)
evaluate_box = EvaluateBox(Box=mesh, UParameter=0.5, VParameter=0.5, WParameter=0.5)  # -> Plane, Point, Include
curve_plane = CurvePlane(Curve=join_curves, Plane=evaluate_box.Plane)  # -> flatten(Points), ParamsC, ParamsP
list_item = ListItem(List=curve_plane.Points, Index=0, Wrap=True)  # -> Item, Item1, Item2, Item3, Item4, Item5, Item6, Item7
point = Point(list_item.Item4)
point_2 = Point(list_item.Item)
merge = Merge(Data1=point_2, Data2=point)
xz_plane = XZPlane(Origin=merge)
unit_y = UnitY(Factor=Slider(100, range=0..1000))  # -> expr("-x", UnitVector)
move = Move(Geometry=xz_plane, Motion=unit_y)  # -> Geometry, Transform
mesh_plane = MeshPlane(Mesh=mesh, Plane=move.Geometry)
split_tree = SplitTree(Data=mesh_plane, Masks=flatten("{0;1}"))  # -> Positive, Negative
explode = Explode(Curve=split_tree.Positive, Recursive=True)  # -> Segments, Vertices
number_slider = Slider(50, range=0..1000)
nurbs_curve = NurbsCurve(Vertices=explode.Vertices, Degree=3, Periodic=False)  # -> Curve, Length, Domain
extend_curve = ExtendCurve(Curve=nurbs_curve.Curve, Type=0, Start=number_slider, End=number_slider)  # -> flatten(Curve)
list_item_2 = ListItem(List=extend_curve, Index=0, Wrap=True)  # -> Item, Item1, Item2
curve_curve = CurveCurve(CurveA=list_item_2.Item, CurveB=list_item_2.Item1)  # -> Points, ParamsA, ParamsB
point_3 = Point(curve_curve.Points)
curve = Curve(list_item_2.Item)
curve_2 = Curve(list_item_2.Item1)
points_trim_curve = PointsTrimCurve(Curve=curve, Points=point_3, Flip=False)  # -> Trimmed, SubDomains, Intersected
points_trim_curve_2 = PointsTrimCurve(Curve=curve, Points=point_3, Flip=True)  # -> Trimmed, SubDomains, Intersected
points_trim_curve_3 = PointsTrimCurve(Curve=curve_2, Points=point_3, Flip=True)  # -> Trimmed, SubDomains, Intersected
addition = Addition(A=brick_height, B=mortar)
division = Division(A=addition, B=2)
division_2 = Division(A=brick_length, B=2)
join_curves_2 = JoinCurves(Curves=flatten([points_trim_curve_3.Trimmed, points_trim_curve_2.Trimmed]), Preserve=False)
negative = Negative(Value=division)
negative_2 = Negative(Value=division_2)
extend_curve_2 = ExtendCurve(Curve=join_curves_2, Type=0, Start=negative, End=negative)
curve_3 = Curve(extend_curve_2)
extend_curve_3 = ExtendCurve(Curve=curve_3, Type=0, Start=negative_2, End=negative_2)

# ----
# Back wall (not done)
end_points = EndPoints(Curve=curve_3)  # -> Start, End
line = Line(StartPoint=end_points.Start, EndPoint=end_points.End)
boundary_surfaces = BoundarySurfaces(Edges=[curve_3, line])

# ----
# Placement brick layers
bounding_box = BoundingBox(Content=mesh, Plane=PlaneXY(0, 0, 0))  # -> Box, Box_2
deconstruct_brep = DeconstructBrep(Brep=bounding_box.Box)  # -> Faces, Edges, Vertices
list_item_3 = ListItem(List=deconstruct_brep.Edges, Index=1, Wrap=True)
length = Length(Curve=list_item_3)
division_3 = Division(A=length, B=brick_width)
round = Round(Number=division_3)  # -> Nearest, Floor, Ceiling
unit_y_2 = UnitY(Factor=1)  # -> expr("-x", UnitVector)
end_points_2 = EndPoints(Curve=list_item_3)  # -> Start, End
multiplication = Multiplication(A=round.Nearest, B=brick_width)
line_sdl = LineSDL(Start=end_points_2.End, Direction=unit_y_2, Length=multiplication)
divide_curve = DivideCurve(Curve=line_sdl, Count=round.Nearest, Kinks=False)  # -> Points, Tangents, Parameters
dispatch = Dispatch(List=divide_curve.Points, DispatchPattern=[True, False])  # -> ListA, ListB

# ----
# Side wall 1
number_slider_2 = Slider(100, range=0..1000)
point_4 = Point(list_item.Item7)
point_5 = Point(list_item.Item6)
number_slider_3 = Slider(223, range=0..500)
unit_z = UnitZ(Factor=number_slider_2)
unit_x = UnitX(Factor=number_slider_3)
unit_x_2 = UnitX(Factor=number_slider_3)  # -> expr("-x", UnitVector)
move_2 = Move(Geometry=point_5, Motion=unit_z)  # -> Geometry, Transform
move_3 = Move(Geometry=point_5, Motion=unit_x)  # -> Geometry, Transform
move_4 = Move(Geometry=point_4, Motion=unit_x_2)  # -> Geometry, Transform
rectangle_2pt = Rectangle2Pt(Plane=move_2.Geometry, PointA=move_3.Geometry, PointB=move_4.Geometry, Radius=0)  # -> Rectangle, Length
mesh_2 = Mesh(rectangle_2pt.Rectangle)
number_slider_4 = Slider(500, range=0..1000)
mesh_split = MeshSplit(Mesh=mesh, Splitters=mesh_2)
negative_3 = Negative(Value=number_slider_4)
list_item_4 = ListItem(List=mesh_split, Index=1, Wrap=True)
construct_domain = ConstructDomain(DomainStart=number_slider_4, DomainEnd=negative_3)
mesh_edges_2 = MeshEdges(Mesh=list_item_4)  # -> NakedEdges, InteriorEdges, NonManifoldEdges
unit_x_3 = UnitX(Factor=construct_domain)  # -> expr("-x", UnitVector)
join_curves_3 = JoinCurves(Curves=mesh_edges_2.NakedEdges, Preserve=False)
unit_x_4 = UnitX(Factor=construct_domain)  # -> expr("x*2", UnitVector)
move_5 = Move(Geometry=join_curves_3, Motion=unit_x_3)  # -> Geometry, Transform
extrude = Extrude(Base=move_5.Geometry, Direction=unit_x_4)  # -> flatten(Extrusion)
unit_y_3 = UnitY(Factor=multiplication)  # -> expr("-x", UnitVector)
curve_4 = Curve(list_item_2.Item2)
extrude_2 = Extrude(Base=curve_4, Direction=unit_y_3)
mesh_split_2 = MeshSplit(Mesh=extrude_2, Splitters=extrude)
list_item_5 = ListItem(List=mesh_split_2, Index=0, Wrap=True)
division_4 = Division(A=brick_width, B=2)
unit_y_4 = UnitY(Factor=division_4)  # -> expr("-x", UnitVector)
unit_y_5 = UnitY(Factor=1)  # -> expr("-x", UnitVector)
point_6 = Point(Point(9750, 35250, 0))
move_6 = Move(Geometry=point_6, Motion=unit_y_4)  # -> Geometry, Transform
contour = Contour(Shape=list_item_5, Point=move_6.Geometry, Direction=unit_y_5, Distance=brick_width)  # -> flatten(Contours)
length_2 = Length(Curve=contour)
division_5 = Division(A=length_2, B=brick_length)
round_2 = Round(Number=division_5)  # -> Nearest, Floor, Ceiling
construct_domain_2 = ConstructDomain(DomainStart=0, DomainEnd=1)
rebuild_curve = RebuildCurve(Curve=contour, Degree=3, Count=round_2.Nearest, Tangents=False)  # -> graft(Curve)
range = Range(Domain=construct_domain_2, Steps=division_5)
curve_domain = CurveDomain(Curve=rebuild_curve, Domain=construct_domain_2)  # -> Curve, Domain
deconstruct_domain = DeconstructDomain(Domain=curve_domain.Domain)  # -> Start, End
length_3 = Length(Curve=rebuild_curve)
division_6 = Division(A=length_3, B=brick_length)
divide_curve_2 = DivideCurve(Curve=rebuild_curve, Count=division_6, Kinks=False)  # -> Points, Tangents, Parameters
unit_y_6 = UnitY(Factor=brick_width)  # -> expr("-x", UnitVector)
move_7 = Move(Geometry=divide_curve_2.Points, Motion=unit_y_6)  # -> Geometry, Transform
shift_list = ShiftList(List=divide_curve_2.Points, Shift=1, Wrap=True)
rectangle_3pt = Rectangle3Pt(PointA=divide_curve_2.Points, PointB=shift_list, PointC=move_7.Geometry)  # -> simplify(Rectangle), Length
plane_3pt = Plane3Pt(PointA=divide_curve_2.Points, PointB=shift_list, PointC=move_7.Geometry)
cull_index = CullIndex(List=plane_3pt, Indices=-1, Wrap=True)
cull_index_2 = CullIndex(List=rectangle_3pt.Rectangle, Indices=-1, Wrap=True)
amplitude = Amplitude(Vector=cull_index, Amplitude=brick_height)
extrude_3 = Extrude(Base=cull_index_2, Direction=amplitude)
cap_holes = CapHoles(Brep=extrude_3)

# ----
# Side wall 2
point_7 = Point(list_item.Item1)
point_8 = Point(list_item.Item2)
point_9 = Point(point_7)
point_10 = Point(point_8)
number_slider_5 = Slider(223, range=0..500)
unit_z_2 = UnitZ(Factor=Slider(43, range=0..1000))
unit_x_5 = UnitX(Factor=number_slider_5)
unit_x_6 = UnitX(Factor=number_slider_5)  # -> expr("-x", UnitVector)
move_8 = Move(Geometry=point_10, Motion=unit_z_2)  # -> Geometry, Transform
move_9 = Move(Geometry=point_10, Motion=unit_x_5)  # -> Geometry, Transform
move_10 = Move(Geometry=point_9, Motion=unit_x_6)  # -> Geometry, Transform
rectangle_2pt_2 = Rectangle2Pt(Plane=move_8.Geometry, PointA=move_9.Geometry, PointB=move_10.Geometry, Radius=0)  # -> Rectangle, Length
mesh_3 = Mesh(rectangle_2pt_2.Rectangle)
number_slider_6 = Slider(500, range=0..1000)
mesh_split_3 = MeshSplit(Mesh=mesh, Splitters=mesh_3)
negative_4 = Negative(Value=number_slider_6)
list_item_6 = ListItem(List=mesh_split_3, Index=1, Wrap=True)
construct_domain_3 = ConstructDomain(DomainStart=number_slider_6, DomainEnd=negative_4)
mesh_edges_3 = MeshEdges(Mesh=list_item_6)  # -> NakedEdges, InteriorEdges, NonManifoldEdges
unit_x_7 = UnitX(Factor=construct_domain_3)  # -> expr("-x", UnitVector)
join_curves_4 = JoinCurves(Curves=mesh_edges_3.NakedEdges, Preserve=False)
unit_x_8 = UnitX(Factor=construct_domain_3)  # -> expr("x*2", UnitVector)
move_11 = Move(Geometry=join_curves_4, Motion=unit_x_7)  # -> Geometry, Transform
extrude_4 = Extrude(Base=move_11.Geometry, Direction=unit_x_8)  # -> flatten(Extrusion)
unit_y_7 = UnitY(Factor=multiplication)  # -> expr("-x", UnitVector)
curve_5 = Curve(points_trim_curve.Trimmed)
curve_6 = Curve(curve_5)
extrude_5 = Extrude(Base=curve_6, Direction=unit_y_7)
mesh_split_4 = MeshSplit(Mesh=extrude_5, Splitters=extrude_4)
list_item_7 = ListItem(List=mesh_split_4, Index=0, Wrap=True)
division_7 = Division(A=brick_width, B=2)
unit_y_8 = UnitY(Factor=division_7)  # -> expr("-x", UnitVector)
unit_y_9 = UnitY(Factor=1)  # -> expr("-x", UnitVector)
point_11 = Point(Point(9750, 35250, 0))
move_12 = Move(Geometry=point_11, Motion=unit_y_8)  # -> Geometry, Transform
contour_2 = Contour(Shape=list_item_7, Point=move_12.Geometry, Direction=unit_y_9, Distance=brick_width)  # -> flatten(Contours)
length_4 = Length(Curve=contour_2)
division_8 = Division(A=length_4, B=brick_length)
round_3 = Round(Number=division_8)  # -> Nearest, Floor, Ceiling
construct_domain_4 = ConstructDomain(DomainStart=0, DomainEnd=1)
rebuild_curve_2 = RebuildCurve(Curve=contour_2, Degree=3, Count=round_3.Nearest, Tangents=False)  # -> graft(Curve)
range_2 = Range(Domain=construct_domain_4, Steps=division_8)
curve_domain_2 = CurveDomain(Curve=rebuild_curve_2, Domain=construct_domain_4)  # -> Curve, Domain
deconstruct_domain_2 = DeconstructDomain(Domain=curve_domain_2.Domain)  # -> Start, End
length_5 = Length(Curve=rebuild_curve_2)
division_9 = Division(A=length_5, B=brick_length)
divide_curve_3 = DivideCurve(Curve=rebuild_curve_2, Count=division_9, Kinks=False)  # -> Points, Tangents, Parameters
unit_y_10 = UnitY(Factor=brick_width)  # -> expr("-x", UnitVector)
move_13 = Move(Geometry=divide_curve_3.Points, Motion=unit_y_10)  # -> Geometry, Transform
shift_list_2 = ShiftList(List=divide_curve_3.Points, Shift=1, Wrap=True)
rectangle_3pt_2 = Rectangle3Pt(PointA=divide_curve_3.Points, PointB=shift_list_2, PointC=move_13.Geometry)  # -> simplify(Rectangle), Length
plane_3pt_2 = Plane3Pt(PointA=divide_curve_3.Points, PointB=shift_list_2, PointC=move_13.Geometry)
cull_index_3 = CullIndex(List=plane_3pt_2, Indices=-1, Wrap=True)
cull_index_4 = CullIndex(List=rectangle_3pt_2.Rectangle, Indices=-1, Wrap=True)
amplitude_2 = Amplitude(Vector=cull_index_3, Amplitude=brick_height)
extrude_6 = Extrude(Base=cull_index_4, Direction=amplitude_2)
cap_holes_2 = CapHoles(Brep=extrude_6)

# ----
# Vault top layer 1
length_6 = Length(Curve=curve_3)
division_10 = Division(A=length_6, B=brick_length)
divide_curve_4 = DivideCurve(Curve=curve_3, Count=division_10, Kinks=False)  # -> Points, Tangents, Parameters
unit_y_11 = UnitY(Factor=brick_width)  # -> expr("-x", UnitVector)
move_14 = Move(Geometry=divide_curve_4.Points, Motion=unit_y_11)  # -> Geometry, Transform
shift_list_3 = ShiftList(List=divide_curve_4.Points, Shift=1, Wrap=True)
rectangle_3pt_3 = Rectangle3Pt(PointA=divide_curve_4.Points, PointB=shift_list_3, PointC=move_14.Geometry)  # -> Rectangle, Length
plane_3pt_3 = Plane3Pt(PointA=divide_curve_4.Points, PointB=shift_list_3, PointC=move_14.Geometry)
cull_index_5 = CullIndex(List=plane_3pt_3, Indices=-1, Wrap=True)
cull_index_6 = CullIndex(List=rectangle_3pt_3.Rectangle, Indices=-1, Wrap=True)
negative_5 = Negative(Value=brick_height)
amplitude_3 = Amplitude(Vector=cull_index_5, Amplitude=negative_5)
extrude_7 = Extrude(Base=cull_index_6, Direction=amplitude_3)
cap_holes_3 = CapHoles(Brep=extrude_7)
geometry = Geometry(cap_holes_3)

# ----
# Vault top layer 2
length_7 = Length(Curve=extend_curve_3)
division_11 = Division(A=length_7, B=brick_length)
divide_curve_5 = DivideCurve(Curve=extend_curve_3, Count=division_11, Kinks=False)  # -> Points, Tangents, Parameters
unit_y_12 = UnitY(Factor=brick_width)  # -> expr("-x", UnitVector)
move_15 = Move(Geometry=divide_curve_5.Points, Motion=unit_y_12)  # -> Geometry, Transform
shift_list_4 = ShiftList(List=divide_curve_5.Points, Shift=1, Wrap=True)
rectangle_3pt_4 = Rectangle3Pt(PointA=divide_curve_5.Points, PointB=shift_list_4, PointC=move_15.Geometry)  # -> Rectangle, Length
plane_3pt_4 = Plane3Pt(PointA=divide_curve_5.Points, PointB=shift_list_4, PointC=move_15.Geometry)
cull_index_7 = CullIndex(List=plane_3pt_4, Indices=-1, Wrap=True)
cull_index_8 = CullIndex(List=rectangle_3pt_4.Rectangle, Indices=-1, Wrap=True)
negative_6 = Negative(Value=brick_height)
amplitude_4 = Amplitude(Vector=cull_index_7, Amplitude=negative_6)
extrude_8 = Extrude(Base=cull_index_8, Direction=amplitude_4)
cap_holes_4 = CapHoles(Brep=extrude_8)
list_item_8 = ListItem(List=cap_holes_3, Index=[0, -1], Wrap=True)
list_item_9 = ListItem(List=cap_holes_4, Index=[0, -1], Wrap=True)
solid_difference = SolidDifference(BrepsA=list_item_8, BrepsB=list_item_9)
list_item_10 = ListItem(List=solid_difference, Index=[0, 2], Wrap=True)
unit_y_13 = UnitY(Factor=brick_width)
geometry_2 = Geometry([list_item_10, cap_holes_4])
move_16 = Move(Geometry=geometry_2, Motion=unit_y_13)  # -> graft(Geometry), Transform
orient = Orient(Geometry=move_16.Geometry, Source=end_points_2.End, Target=dispatch.ListA)  # -> Geometry, Transform
cap_holes_5 = CapHoles(Brep=orient.Geometry)

move_17 = Move(Geometry=geometry, Motion=unit_y_13)  # -> graft(Geometry), Transform
orient_2 = Orient(Geometry=move_17.Geometry, Source=end_points_2.End, Target=dispatch.ListB)  # -> Geometry, Transform
cap_holes_6 = CapHoles(Brep=orient_2.Geometry)

# ----
# Brick placement - Theathre vault
# Script for converting a mesh to a propper brick layout.
number_slider_7 = Slider(1.05, range=0..10)
geometry_3 = Geometry([cap_holes_2, cap_holes])
geometry_4 = Geometry([cap_holes_5, cap_holes_6])
scale_nu = ScaleNU(Geometry=geometry_3, Plane=point_6, ScaleX=1, ScaleY=1, ScaleZ=number_slider_7)  # -> Geometry, Transform
geometry_5 = Geometry([scale_nu.Geometry, geometry_4])

# ---- group: Output
geometry_6 = Geometry(geometry_5)
