# Grasshopper definition 02_Tower.gh (Grasshopper 1.0.7)
# plug-ins: Kangaroo2 Components, karambaGH

number_slider = Slider(12, range=0..20)
matprops = MaterialPropertiesKaramba3D(
    FamilyOfMaterial="Adobe",
    Name="Adobe brick",
    ElementIdentifier="Tower",
    YoungsModulus_kN_cm2="11.5",
    InPlaneShearModulus_kN_cm2="5",
    TransverseShearModulus_kN_cm2="5",
    SpecificWeight_kN_m3="15",
    CoefficientOfThermalExpansion_1_C=1e-05,
    YieldStrength_kN_cm2="0.21",
    mode="Isotrop")
Z = UnitZ(Factor=number_slider)
pt = ConstructPoint(XCoordinate=7, YCoordinate=0, ZCoordinate=0)
Z_2 = UnitZ(Factor=1)
cross_section = CrossSectionKaramba3D(
    FamilyNameOfCrossSection="DefaultCroSec",
    Material=matprops,
    Height_cm="275",
    UpperFlangeWidth_cm="275",
    LowerFlangeWidth_cm="275",
    UpperFlangeThickness_cm="137",
    LowerFlangeThickness_cm="137",
    SidewallsThickness_cm="137",
    FilletRadius_cm=0.6,
    mode="Box")
multiplication = Multiplication(A=number_slider, B="2")
multiplication_2 = Multiplication(A="-2", B="2.5")
Z_3 = UnitZ(Factor="-1")
Y = UnitY(Factor=multiplication_2)
multiplication_3 = Multiplication(A=Z_3, B="0.9")
multiplication_4 = Multiplication(A=Y, B="1.5")
matprops_2 = MaterialPropertiesKaramba3D(
    FamilyOfMaterial="Adobe",
    Name="Adobe brick",
    ElementIdentifier="Tower",
    YoungsModulus_kN_cm2="11.5",
    InPlaneShearModulus_kN_cm2="5",
    TransverseShearModulus_kN_cm2="5",
    SpecificWeight_kN_m3="15",
    CoefficientOfThermalExpansion_1_C=1e-05,
    YieldStrength_kN_cm2="0.21",
    mode="Isotrop")
loads = LoadsKaramba3D(Vector=multiplication_3, LCase="1", mode="Gravity")
supp = SupportKaramba3D(PosInd=pt, menu=[buttons(on, on, on, on, on, on)])
loads_2 = LoadsKaramba3D(Vector=multiplication_4, LCase="4", mode="Uniform Line", menu=[buttons(on, off, off)])  # -> flatten(Load)
multiplication_5 = Multiplication(A="-1", B="0.9")
multiplication_6 = Multiplication(A="-1", B="1.5")
multiplication_7 = Multiplication(A="-1", B="1.5")
multiplication_8 = Multiplication(A="130", B="0.01")
subtraction = Subtraction(A="2.75", B=multiplication_8)
planesrf = PlaneSurface(Plane=PlaneXY(0, 0, 0), XSize=subtraction, YSize=subtraction)
wires = BrepWireframe(Brep=planesrf, Density=-1)
division = Division(A="130", B="100")
extr = Extrude(Base=wires, Direction=Z)
subtraction_2 = Subtraction(A=subtraction, B=division)
multiplication_9 = Multiplication(A=subtraction_2, B=subtraction_2)
mesh_uv = MeshSurface(Surface=extr, UCount=multiplication, VCount="15", Overhang=True, Equalize=False)
multiplication_10 = Multiplication(A=multiplication_9, B=number_slider)
multiplication_11 = Multiplication(A=number_slider, B=subtraction)
weld = WeldMesh(Mesh=mesh_uv, Angle=3.141592654)
multiplication_12 = Multiplication(A=multiplication_10, B="15")
multiplication_13 = Multiplication(A=multiplication_11, B="4")
mjoin = MeshJoin(Meshes=weld)
division_2 = Division(A=multiplication_12, B=multiplication_13)
multiplication_14 = Multiplication(A=division_2, B="-1")
demesh = DeconstructMesh(Mesh=mjoin)  # -> flatten(Vertices), Faces, Colours, Normals
pdecon = Deconstruct(Point=demesh.Vertices)  # -> XComponent, YComponent, ZComponent
smaller = SmallerThan(FirstNumber=pdecon.ZComponent, SecondNumber="0.1")  # -> SmallerThan, OrEqualTo
cull = CullPattern(List=demesh.Vertices, CullPattern=smaller.SmallerThan)
panel = Panel(multiplication_14)
duppt = RemoveDuplicatePts(Points=cull, Tolerance=0.01)
multiplication_15 = Multiplication(A=panel, B="0.9")
supp_2 = SupportKaramba3D(PosInd=duppt, menu=[buttons(on, on, on, off, off, off)])
Z_4 = UnitZ(Factor=multiplication_5)
Z_5 = UnitZ(Factor=multiplication_15)
Y_2 = UnitY(Factor=multiplication_6)
Z_6 = UnitZ(Factor=multiplication_7)
cross_section_2 = CrossSectionKaramba3D(
    FamilyNameOfCrossSection="DefaultCroSec",
    ElementIdentifier="Tower",
    Material=matprops_2,
    Height_cm="130",
    mode="Shell - Const")
loads_3 = LoadsKaramba3D(Vector=Z_4, LCase="1", mode="Gravity")
loads_4 = LoadsKaramba3D(
    Vector=Z_5,
    Mesh=mjoin,
    ElementIdentifiers="Tower",
    LCase="2",
    mode="MeshLoad -Const.",
    menu=[buttons(off, on, off), buttons(on, off)])  # -> flatten(Load)
loads_5 = LoadsKaramba3D(
    Vector=Y_2,
    Mesh=mjoin,
    ElementIdentifiers="Tower",
    LCase="4",
    mode="MeshLoad -Const.",
    menu=[buttons(off, off, on), buttons(on, off)])  # -> flatten(Load)
loads_6 = LoadsKaramba3D(
    Vector=Z_6,
    Mesh=mjoin,
    ElementIdentifiers="Tower",
    LCase="3",
    mode="MeshLoad -Const.",
    menu=[buttons(off, off, on), buttons(on, off)])  # -> flatten(Load)
meshtoshell = MeshToShellKaramba3D(Mesh=mjoin, Identifier="Tower", CrossSection=cross_section_2, LimitDistance_m=0.005)  # -> Element, Points, Info
assemble = AssembleModelKaramba3D(Elem=meshtoshell.Element, Support=supp_2, Load=[loads_3, loads_4, loads_5, loads_6], LimitDistance_m=0.005)  # -> Model, Info, Mass_kg, CenterOfGravity
analyze = AnalyzeKaramba3D(Model=assemble.Model)  # -> CalculatedModel, MaximumDisplacement_cm, ResultingForceOfGravity_kN, ElasticEnergy_kNm
modelview = ModelViewKaramba3D(Model=analyze.CalculatedModel, ResultFactors=1, ResultCase=-1)  # -> Model, DeformedMesh, DeformedAxes, DeformedModel
number_slider_2 = Slider(12, range=0..100)
line = LineSDL(Start=pt, Direction=Z_2, Length=number_slider_2)
linetobeam = LineToBeamKaramba3D(Line=line, CrossSection=cross_section, New=True, Remove=True, LimitDistance_m=0.005)  # -> Element, Points, Info
assemble_2 = AssembleModelKaramba3D(Elem=linetobeam.Element, Support=supp, Load=[loads, loads_2], Material=matprops, LimitDistance_m=0.005)  # -> Model, Info, Mass_kg, CenterOfGravity
analyze_2 = AnalyzeKaramba3D(Model=assemble_2.Model)  # -> CalculatedModel, MaximumDisplacement_cm, ResultingForceOfGravity_kN, ElasticEnergy_kNm
analyzethii = AnalyzeThIIKaramba3D(Model=assemble_2.Model, LoadCase=-1, RTolerance=1e-07, MaxIterations=50, NoTensionalNII=False)  # -> CalculatedModel, MaximumDisplacement_cm, ResultingForceOfGravity_kN, ElasticEnergy_kNm
modelview_2 = ModelViewKaramba3D(Model=analyze_2.CalculatedModel, ResultFactors=1, ResultCase=-1)  # -> Model, DeformedMesh, DeformedAxes, DeformedModel
modelview_3 = ModelViewKaramba3D(Model=analyzethii.CalculatedModel, ResultFactors=1, ResultCase=-1)  # -> Model, DeformedMesh, DeformedAxes, DeformedModel
beamview = BeamViewKaramba3D(Model=modelview_2.Model)  # -> Model, MeshesOfRenderedBeams, DeformedBeamAxes, LegendColors, LegendTags
bmodes = BucklingModesKaramba3D(Model=modelview_3.Model, FromIndex=1, NumberOfModes=1, MaximumNumberOfIterations=300, Epsilon=1e-07)  # -> ModelWithBucklingModesAsLoadCaseResults, BucklingLoadFactors
panel_2 = Panel(bmodes.BucklingLoadFactors)
legend = Legend(Colour=beamview.LegendColors, Tags=beamview.LegendTags, LegendType=1)
b_res_force = BeamResultantForcesKaramba3D(AnalyzedModel=modelview_2.Model, LoadCase=-1, MaximumProbingDistance_m=-1, NumberOfProbingPointsPerElement=3)  # -> AnalyzedModel, flatten(NormalForce_kN), ResultantBendingMoment_kNm, ResultantShearForce_kN
shellview = ShellViewKaramba3D(Model=modelview.Model, IndexOfLayer=0)  # -> Model, MeshesOfRenderedShells, LegendColors, LegendTags
item = ListItem(List=b_res_force.NormalForce_kN, Index=1, Wrap=True)
panel_3 = Panel(item)
division_3 = Division(A=number_slider_2, B="500")
legend_2 = Legend(Colour=shellview.LegendColors, Tags=shellview.LegendTags, LegendType=1)
multiplication_16 = Multiplication(A=division_3, B="100")
division_4 = Division(A=number_slider, B="500")
multiplication_17 = Multiplication(A=panel_3, B="-1")
panel_4 = Panel("max displacement: ")
panel_5 = Panel(multiplication_16)
multiplication_18 = Multiplication(A=division_4, B="100")
multiplication_19 = Multiplication(A=multiplication_17, B="1000")
multiplication_20 = Multiplication(A="2500", B="2500")
panel_7 = Panel(multiplication_18)
division_5 = Division(A=multiplication_19, B=multiplication_20)
panel_8 = Panel(division_5)
