# Grasshopper definition Theater_for_structural_rev2.gh (Grasshopper 1.0.7)
# plug-ins: Kangaroo2 Components, karambaGH

mesh = Mesh([<mesh referenced from the Rhino model> x6])
demesh = DeconstructMesh(Mesh=mesh)  # -> flatten(Vertices), Faces, Colours, Normals
pdecon = Deconstruct(Point=demesh.Vertices)  # -> XComponent, YComponent, ZComponent
smaller = SmallerThan(FirstNumber=pdecon.ZComponent, SecondNumber="0.05")  # -> SmallerThan, OrEqualTo
cull = CullPattern(List=demesh.Vertices, CullPattern=smaller.SmallerThan)
duppt = RemoveDuplicatePts(Points=cull, Tolerance=0.01)
matprops = MaterialPropertiesKaramba3D(
    FamilyOfMaterial="Adobe",
    Name="Adobe brick",
    ElementIdentifier="Wall",
    YoungsModulus_kN_cm2="11.5",
    InPlaneShearModulus_kN_cm2="5",
    TransverseShearModulus_kN_cm2="5",
    SpecificWeight_kN_m3="15",
    CoefficientOfThermalExpansion_1_C=1e-05,
    YieldStrength_kN_cm2="0.21",
    mode="Isotrop")
X = UnitX(Factor="1/3")
Z = UnitZ(Factor="-1")
multiplication = Multiplication(A=X, B="1.5")
multiplication_2 = Multiplication(A=Z, B="0.9")
supp = SupportKaramba3D(PosInd=duppt, menu=[buttons(on, on, on, off, off, off)])
cross_section = CrossSectionKaramba3D(
    FamilyNameOfCrossSection="DefaultCroSec",
    ElementIdentifier="Wall",
    Material=matprops,
    Height_cm="87.5",
    mode="Shell - Const")
loads = LoadsKaramba3D(Vectors=multiplication, Mesh=mesh, LCase="2", mode="MeshLoad -Variable", menu=[buttons(off, off, on), buttons(on, off)])  # -> flatten(Load)
loads_2 = LoadsKaramba3D(Vector=multiplication_2, LCase="1", mode="Gravity")
item = ListItem(List=cross_section, Index=0, Wrap=True)
meshtoshell = MeshToShellKaramba3D(Mesh=mesh, Identifier="Wall", CrossSection=item, LimitDistance_m=0.005)  # -> Element, Points, Info
assemble = AssembleModelKaramba3D(Elem=meshtoshell.Element, Support=supp, Load=[loads_2, loads], LimitDistance_m=0.005)  # -> Model, Info, Mass_kg, CenterOfGravity
analyze = AnalyzeKaramba3D(Model=assemble.Model)  # -> CalculatedModel, MaximumDisplacement_cm, ResultingForceOfGravity_kN, ElasticEnergy_kNm
modelview = ModelViewKaramba3D(Model=analyze.CalculatedModel, ResultFactors=1, ResultCase=-1)  # -> Model, DeformedMesh, DeformedAxes, DeformedModel
shellview = ShellViewKaramba3D(Model=modelview.Model, IndexOfLayer=0)  # -> Model, MeshesOfRenderedShells, LegendColors, LegendTags
legend = Legend(Colour=shellview.LegendColors, Tags=shellview.LegendTags, LegendType=1)
# max tensile stress:
# 0.021 kN/cm2
# max compression stress:
# 0.21 kN/cm2
panel = Panel("""max displacement:
750*0.0015 = 1.125 cm""")
