# Grasshopper definition entrance-meshing-structure-22-10.gh (Grasshopper 1.0.7)
# plug-ins: Kangaroo2 Components, karambaGH

mesh = Mesh([<mesh referenced from the Rhino model> x10])
mesh_2 = Mesh([<mesh referenced from the Rhino model> x148])
weld = WeldMesh(Mesh=mesh_2, Angle=3.141592654)
mjoin = MeshJoin(Meshes=weld)
demesh = DeconstructMesh(Mesh=mesh)  # -> flatten(Vertices), Faces, Colours, Normals
demesh_2 = DeconstructMesh(Mesh=mjoin)  # -> flatten(Vertices), Faces, Colours, Normals
pdecon = Deconstruct(Point=demesh.Vertices)  # -> XComponent, YComponent, ZComponent
pdecon_2 = Deconstruct(Point=demesh_2.Vertices)  # -> XComponent, YComponent, ZComponent
smaller = SmallerThan(FirstNumber=pdecon.ZComponent, SecondNumber="1.75")  # -> SmallerThan, OrEqualTo
smaller_2 = SmallerThan(FirstNumber=pdecon_2.ZComponent, SecondNumber="5.8")  # -> SmallerThan, OrEqualTo
cull = CullPattern(List=demesh.Vertices, CullPattern=smaller.SmallerThan)
cull_2 = CullPattern(List=demesh_2.Vertices, CullPattern=smaller_2.SmallerThan)
duppt = RemoveDuplicatePts(Points=cull, Tolerance=0.01)
subtraction = Subtraction(A="2670", B="2600")
dom = ConstructDomain(DomainStart="2600", DomainEnd="2670")
duppt_2 = RemoveDuplicatePts(Points=cull_2, Tolerance=0.01)
matprops = MaterialPropertiesKaramba3D(
    FamilyOfMaterial="Adobe",
    Name="Adobe brick",
    ElementIdentifier="Wall",
    YoungsModulus_kN_cm2="11.5",
    InPlaneShearModulus_kN_cm2="5",
    TransverseShearModulus_kN_cm2="5",
    SpecificWeight_kN_m3="15",
    CoefficientOfThermalExpansion_1_C=1e-05,
    YieldStrength_kN_cm2="0.21",
    mode="Isotrop")
matprops_2 = MaterialPropertiesKaramba3D(
    FamilyOfMaterial="Adobe",
    Name="Adobe brick",
    ElementIdentifier="Wall",
    YoungsModulus_kN_cm2="11.5",
    InPlaneShearModulus_kN_cm2="5",
    TransverseShearModulus_kN_cm2="5",
    SpecificWeight_kN_m3="15",
    CoefficientOfThermalExpansion_1_C=1e-05,
    YieldStrength_kN_cm2="0.21",
    mode="Isotrop")
rdpoints = RemoveDuplicatePointsKaramba3D(Point=duppt, LimitDistance=0.005)  # -> OutPoint, Info, Indexes
Z = UnitZ(Factor="-5")
Z_2 = UnitZ(Factor="-2")
range = Range(Domain=dom, Steps=subtraction)
Z_3 = UnitZ(Factor="-1")
X = UnitX(Factor="-1")
Z_4 = UnitZ(Factor="-1")
Z_5 = UnitZ(Factor="-1")
multiplication = Multiplication(A=Z, B="1.2")
multiplication_2 = Multiplication(A=Z_2, B="1.5")
cull_i = CullIndex(List=rdpoints.OutPoint, Indices=range, Wrap=True)
multiplication_3 = Multiplication(A=X, B="1.5")
multiplication_4 = Multiplication(A=Z_3, B="1.5")
multiplication_5 = Multiplication(A=Z_4, B="0.9")
multiplication_6 = Multiplication(A=Z_5, B="0.9")
supp = SupportKaramba3D(PosInd=duppt_2, menu=[buttons(on, on, on, off, off, off)])
cross_section = CrossSectionKaramba3D(
    FamilyNameOfCrossSection="DefaultCroSec",
    ElementIdentifier="Wall",
    Material=matprops,
    Height_cm="70",
    mode="Shell - Const")
loads = LoadsKaramba3D(Vectors=multiplication, Mesh=mesh, LCase="2", mode="MeshLoad -Variable", menu=[buttons(off, off, on), buttons(on, off)])  # -> flatten(Load)
loads_2 = LoadsKaramba3D(Vector=multiplication_5, LCase="1", mode="Gravity")
loads_3 = LoadsKaramba3D(
    Vectors=multiplication_2,
    Mesh=mesh,
    LCase="3",
    mode="MeshLoad -Variable",
    menu=[buttons(off, off, on), buttons(on, off)])  # -> flatten(Load)
cross_section_2 = CrossSectionKaramba3D(
    FamilyNameOfCrossSection="DefaultCroSec",
    ElementIdentifier="Wall",
    Material=matprops_2,
    Height_cm="25",
    mode="Shell - Const")
loads_4 = LoadsKaramba3D(
    Vectors=multiplication_3,
    Mesh=mjoin,
    LCase="2",
    mode="MeshLoad -Variable",
    menu=[buttons(off, off, on), buttons(on, off)])  # -> flatten(Load)
loads_5 = LoadsKaramba3D(Vector=multiplication_6, LCase="1", mode="Gravity")
loads_6 = LoadsKaramba3D(
    Vectors=multiplication_4,
    Mesh=mjoin,
    LCase="2",
    mode="MeshLoad -Variable",
    menu=[buttons(off, off, on), buttons(on, off)])  # -> flatten(Load)
supp_2 = SupportKaramba3D(PosInd=cull_i, menu=[buttons(on, on, on, off, off, off)])
meshtoshell = MeshToShellKaramba3D(Mesh=mesh, Identifier="Wall", CrossSection=cross_section, LimitDistance_m=0.005)  # -> Element, Points, Info
meshtoshell_2 = MeshToShellKaramba3D(Mesh=mjoin, Identifier="Wall", CrossSection=cross_section_2, LimitDistance_m=0.005)  # -> Element, Points, Info
assemble = AssembleModelKaramba3D(Elem=meshtoshell.Element, Support=supp_2, Load=[loads_2, loads, loads_3], LimitDistance_m=0.005)  # -> Model, Info, Mass_kg, CenterOfGravity
assemble_2 = AssembleModelKaramba3D(Elem=meshtoshell_2.Element, Support=supp, Load=[loads_5, loads_4, loads_6], LimitDistance_m=0.005)  # -> Model, Info, Mass_kg, CenterOfGravity
analyze = AnalyzeKaramba3D(Model=assemble.Model)  # -> CalculatedModel, MaximumDisplacement_cm, ResultingForceOfGravity_kN, ElasticEnergy_kNm
analyze_2 = AnalyzeKaramba3D(Model=assemble_2.Model)  # -> CalculatedModel, MaximumDisplacement_cm, ResultingForceOfGravity_kN, ElasticEnergy_kNm
modelview = ModelViewKaramba3D(Model=analyze.CalculatedModel, ResultFactors=1, ResultCase=-1)  # -> Model, DeformedMesh, DeformedAxes, DeformedModel
modelview_2 = ModelViewKaramba3D(Model=analyze_2.CalculatedModel, ResultFactors=1, ResultCase=-1)  # -> Model, DeformedMesh, DeformedAxes, DeformedModel
shellview = ShellViewKaramba3D(Model=modelview.Model, IndexOfLayer=0)  # -> Model, MeshesOfRenderedShells, LegendColors, LegendTags
shellview_2 = ShellViewKaramba3D(Model=modelview_2.Model, IndexOfLayer=0)  # -> Model, MeshesOfRenderedShells, LegendColors, LegendTags
legend = Legend(Colour=shellview.LegendColors, Tags=shellview.LegendTags, LegendType=1)
legend_2 = Legend(Colour=shellview_2.LegendColors, Tags=shellview_2.LegendTags, LegendType=1)
# max tension stress:
# 0.021 kN/cm2
# max compression stress:
# 0.21 kN/cm2
panel = Panel("""max displacement:
500*0.0015 = 0.75 cm""")
# max tension stress:
# 0.021 kN/cm2
# max compression stress:
# 0.21 kN/cm2
panel_2 = Panel("""max displacement:
500*0.0015 = 0.75 cm""")
