# Grasshopper definition 12102020_Script for Space generation.gh (Grasshopper 1.0.7)
# plug-ins: Packhunt

# ----
# Debugging needs to be done to ensure that GH-Python component gives the same output as Python3
number_slider = Slider(9, range=0..26)
python = GhPythonScript(nos=number_slider, module_size=Slider(2.25, range=0..10))  # -> out, Sorted_List, Bounding_box, riwaq_matrix, Blocks_direction, actual_matrix
# ---------- python: Python ----------
# The aim of this script is to generate the necessary areas for the communal or family dwelling based on the number of people convert it into the measurements of the modular system
# The no. of modular blocks for each space are then converted into clusters of necessary proportions.
# The logic for connecting them with the courtyard is established and the blocks are split into lists based on directions and floors.
import math 
module_size = 2.25
final_module_matrices = []


class communal_dwelling :

    def __init__(self,nos):
        self.nos = nos

    def area_distribution(self):# We take out the areas required for each space based on research and referances . The number of people and the area required per person is used to generate the areas for each space
        num = self.nos
        Entrance = num * 0.45
        Living_room = num * 5
        Kitchen = num * 1.2
        Courtyard = num*5
        Iwan = num * 0.9
        Farm = num * 3.0
        Equipment_room = num * 0.2
        areas = {"Courtyard": Courtyard, "Entrance": Entrance, "Iwan": Iwan,
                "Living_room": Living_room, "Kitchen": Kitchen, "Farm": Farm}
        return areas

    def blocks_house (self) :# Taking out the modules from the areas
        area_com_dwg = self.area_distribution()
        courtyard_blocks = list(area_com_dwg.values())
        courtyard_blocks_values =[]
        for i in courtyard_blocks:
            a = int(int(i) / module_size)
            if a < 1 :
                b = 2
            else:
                b=a
            courtyard_blocks_values.append(b)
        return courtyard_blocks_values

    def matrix_generator_for_riwaq(self,variable_a):
        a= variable_a
        perfect_square = []
        y_grid = []
        
        for i in range(1, a+1):
            b = i*i
            if b <= a:
                perfect_square.append(b)

        c = math.sqrt(perfect_square[-1])
        d = a-perfect_square[-1]
        if d < c:
            y_grid.append(c)
        elif c < d < c*2:
            y_grid.append(c+1)
        else:
            y_grid.append(c+2)
        matrix = (int(c), int(y_grid[0]))
        
        if matrix[0]<=4:
             matrix_mod = (3,3)
        else: 
             matrix_mod = matrix 

        return matrix_mod
    
    def matrix_generator_for_incremental_spaces(self,variable_b):
        a= variable_b
        perfect_square = []
        y_grid = []

        for i in range(1, a+1):
            b = i*i
            if b <= a:
                perfect_square.append(b)

        c = math.sqrt(perfect_square[-1])
        d = a-perfect_square[-1]
        if d < c:
            y_grid.append(c)
        elif c < d < c*1.1:
            y_grid.append(c+1)
        else:
            y_grid.append(c+2)
        matrix = (int(c), int(y_grid[0]))
        if matrix[0]<=2:
             matrix = (2,3)
        else: 
            matrix = matrix

        return matrix
               
    def matrix_generator_for_toilets(self):
        nos =self.nos
        a = nos % 2
        if a > 0:
            b = nos+1
        else:
            b = nos
        Toilet_num = int(b/3)
        if Toilet_num <= 2:
            Toilet_num = Toilet_num
        else:
            Toilet_num = 2
        
        Toilet_tuples= (2,2*Toilet_num),(2,2*Toilet_num)
        Toilet_shower_list=list(Toilet_tuples)
        return Toilet_shower_list

    def riwaq_matrix (self):
        b = self.blocks_house()
        c=b[0]
        d= list(self.matrix_generator_for_riwaq(c))
        e = [x+2 for x in d]
        return e

    def Bedroom_matrix (self):
        nos =self.nos
        a = nos % 2
        if a > 0:
            b = nos+1
        else:
            b = nos
        Bedroom_num = int(b/2)
        Bedroom_matrix=[]
        for i in range(Bedroom_num):
            i= (2,3)
            Bedroom_matrix.append(i)
        return Bedroom_matrix

    def Incremental_space_matrix (self): #Living_room,Kitchen,Farm
        spaces= self.blocks_house()
        incremental_spaces=spaces[3:]
        Incremental_space_tuples= []
        for i in incremental_spaces:
            a =self.matrix_generator_for_incremental_spaces(i)
            Incremental_space_tuples.append(a)
        return Incremental_space_tuples
    
    def priority_list_definition (self):
        # Priority List : Entrance,Staircase, Iwan, Living Room,Kitchen,Farm,Toilets,Shower,Bedroom
        # 0 = South , 1 = East , 2= North , 3= West 
        priority_list_incremental_spaces = [[0, 1, 2, 3],[3, 0, 1, 2],[0, 3, 1, 2], [2, 1, 3, 0], [1, 3, 2, 0],[3, 0, 1, 2],[3, 0, 1, 2],[3, 0, 1, 2]]
        priority_list_bedroom =[]
        nos =self.nos
        a = nos % 2
        if a > 0:
            b = nos+1
        else:
            b = nos
        Bedroom_num = int(b/2)
        for i in range(Bedroom_num):
            a=[2, 1, 3, 0] 
            priority_list_bedroom.append(a)
        for i in priority_list_bedroom :
            priority_list_incremental_spaces.append(i)
        
        return priority_list_incremental_spaces

    def Final_list_of_modules_of_spaces (self):
        # Priority List : Entrance,Staircase,Iwan, Living Room,Kitchen,Farm,Toilets,Shower,Bedroom
        # 0 = South , 1 = East , 2= North , 3= West
        toilet_modules= self.matrix_generator_for_toilets()
        bedroom_modules = self.Bedroom_matrix()
        Final_list_of_modules_of_spaces=[(1,3),(2,3),(3,3)]
        Living_Kitchen_Toilet = self.Incremental_space_matrix()
        for i in Living_Kitchen_Toilet :
            Final_list_of_modules_of_spaces.append(i)
        for i in toilet_modules:
            Final_list_of_modules_of_spaces.insert(-1,i)
        for i in bedroom_modules :
            Final_list_of_modules_of_spaces.append(i)

        return Final_list_of_modules_of_spaces 
    
    def sides_available_for_connection (self):
        riwaq_matrix_extraction = self.riwaq_matrix()
        Number_of_sides = [riwaq_matrix_extraction[0],riwaq_matrix_extraction[1],riwaq_matrix_extraction[0],riwaq_matrix_extraction[1]]
        return Number_of_sides

    def smallest_side_connection_per_function (self):
        all_modules = self.Final_list_of_modules_of_spaces()
        first_value_of_tuples = []
        for i in all_modules :
            first_value_of_tuples.append(i[0])
        return first_value_of_tuples

    def Sorting_into_directions_as_per_priority(self):
        # Priority List : Entrance,Staircase,Iwan, Living Room,Kitchen,Farm,Toilets,Shower,Bedroom
        # 0 = South , 1 = East , 2= North , 3= West
        priority_list_all_spaces = self.priority_list_definition()
        Direction_Lengths = self.sides_available_for_connection() 
        lengths_spaces= self.smallest_side_connection_per_function()
        final_list_of_modules = self.Final_list_of_modules_of_spaces()
        Result_of_lists = [[], [], [], []]
        Remainder_spaces = []
        for i in range(len(lengths_spaces)):
            inputValueCurrentlyBeingRead = lengths_spaces[i]
            pList = priority_list_all_spaces[i]
            #print (inputValueCurrentlyBeingRead)
            #print("pList", pList)
            for j in range(len(pList)):
                selectedPriorityValue = pList[j]
                spaceAvailableInSelectedLocation = Direction_Lengths[selectedPriorityValue]
               # print("spaceAvailableInSelectedLocation",
                   # spaceAvailableInSelectedLocation)
               # print("selectedPriorityValue", selectedPriorityValue)
                if spaceAvailableInSelectedLocation >= inputValueCurrentlyBeingRead:
                    Direction_Lengths[selectedPriorityValue] = spaceAvailableInSelectedLocation - \
                        inputValueCurrentlyBeingRead
                    Result_of_lists[selectedPriorityValue].append(
                        final_list_of_modules[i])
                    break
                elif j == (len(pList))-1:
                   # print("for loop complete")
                    Remainder_spaces.append(final_list_of_modules[i])
        East_Direction = Result_of_lists[1]
        North_Direction = Result_of_lists[2]
        West_Direction = Result_of_lists[3]
        South_Direction = Result_of_lists[0]
        return ["SENW",East_Direction,North_Direction,West_Direction,South_Direction],["Remainder_spaces",Remainder_spaces]

    def Sorting_into_directions_as_per_priority_for_bounding_box(self):
        # Priority List : Entrance,Staircase,Iwan, Living Room,Kitchen,Farm,Toilets,Shower,Bedroom
        # 0 = South , 1 = East , 2= North , 3= West
        priority_list_all_spaces = self.priority_list_definition()
        Direction_Lengths = self.sides_available_for_connection() 
        lengths_spaces= self.smallest_side_connection_per_function()
        final_list_of_modules = self.Final_list_of_modules_of_spaces()
        Result_of_lists = [[], [], [], []]
        Remainder_spaces = []
        for i in range(len(lengths_spaces)):
            inputValueCurrentlyBeingRead = lengths_spaces[i]
            pList = priority_list_all_spaces[i]
            #print (inputValueCurrentlyBeingRead)
            #print("pList", pList)
            for j in range(len(pList)):
                selectedPriorityValue = pList[j]
                spaceAvailableInSelectedLocation = Direction_Lengths[selectedPriorityValue]
               # print("spaceAvailableInSelectedLocation",
                   # spaceAvailableInSelectedLocation)
               # print("selectedPriorityValue", selectedPriorityValue)
                if spaceAvailableInSelectedLocation >= inputValueCurrentlyBeingRead:
                    Direction_Lengths[selectedPriorityValue] = spaceAvailableInSelectedLocation - \
                        inputValueCurrentlyBeingRead
                    Result_of_lists[selectedPriorityValue].append(
                        final_list_of_modules[i])
                    break
                elif j == (len(pList))-1:
                   # print("for loop complete")
                    Remainder_spaces.append(final_list_of_modules[i])
        East_Direction = Result_of_lists[1]
        North_Direction = Result_of_lists[2]
        West_Direction = Result_of_lists[3]
        South_Direction = Result_of_lists[0]
        return [East_Direction,North_Direction,West_Direction,South_Direction]

    def Sorting_into_directions_as_per_priority_combined_dwellings(self,S,E,N,W):
        # Priority List : Entrance,Staircase,Iwan, Living Room,Kitchen,Farm,Toilets,Shower,Bedroom
        # 0 = South , 1 = East , 2= North , 3= West
        Direction_Lengths_original = self.sides_available_for_connection()
        Direction_Lengths =Direction_Lengths_original 
        input_gh_cull_index = [S,E,N,W]
        cull_index_final =[]
        for i in range(4) :
            if input_gh_cull_index[i] >0:
                cull_index_final.append(i)
        for i in cull_index_final :
           a= Direction_Lengths_original[i]*0
           Direction_Lengths_original.pop(i)
           Direction_Lengths_original.insert(i,0)
        priority_list_all_spaces = self.priority_list_definition()
        lengths_spaces= self.smallest_side_connection_per_function()
        final_list_of_modules = self.Final_list_of_modules_of_spaces()
        Result_of_lists = [[], [], [], []]
        Remainder_spaces = []
        for i in range(len(lengths_spaces)):
            inputValueCurrentlyBeingRead = lengths_spaces[i]
            pList = priority_list_all_spaces[i]
            #print (inputValueCurrentlyBeingRead)
            #print("pList", pList)
            for j in range(len(pList)):
                selectedPriorityValue = pList[j]
                spaceAvailableInSelectedLocation = Direction_Lengths[selectedPriorityValue]
                #print("spaceAvailableInSelectedLocation",
                    #spaceAvailableInSelectedLocation)
                #print("selectedPriorityValue", selectedPriorityValue)
                if spaceAvailableInSelectedLocation >= inputValueCurrentlyBeingRead:
                    Direction_Lengths[selectedPriorityValue] = spaceAvailableInSelectedLocation - \
                        inputValueCurrentlyBeingRead
                    Result_of_lists[selectedPriorityValue].append(
                        final_list_of_modules[i])
                    break
                elif j == (len(pList))-1:
                    #print("for loop complete")
                    Remainder_spaces.append(final_list_of_modules[i])
        East_Direction = Result_of_lists[1]
        North_Direction = Result_of_lists[2]
        West_Direction = Result_of_lists[3]
        South_Direction = Result_of_lists[0]
        return ["SENW",East_Direction,North_Direction,West_Direction,South_Direction],["Remainder_spaces",Remainder_spaces] 

    def Bounding_box(self):
        SENW = self.Sorting_into_directions_as_per_priority_for_bounding_box()
        South_Direction =SENW[0]
        if len(South_Direction)  == 1:
            South_Dimention = South_Direction[0][1]
        else:    
            South_Dimention =max(South_Direction[1])

        East_Direction =SENW[1]
        if len(East_Direction) == 1 :
            East_Dimention = East_Direction[0][1]
        else:    
            East_Dimention =max(East_Direction[1])

        North_Direction =SENW[2]
        if len(North_Direction) == 1 :
            North_Dimention = North_Direction[0][1]
        else:    
            North_Dimention =max(North_Direction[1])

        West_Direction =SENW[3]
        if len(West_Direction) ==  1 :
            West_Dimention = West_Direction[0][1]
        else:    
            West_Dimention =max(North_Direction[1])

        Dimentions_bounding_box = [(East_Dimention*1.5 +West_Dimention*1.5),"x", (South_Dimention*1.5 +North_Dimention*1.5) ]
        return Dimentions_bounding_box

    def num_sides_per_direction(self):
        SENW = self.Sorting_into_directions_as_per_priority_for_bounding_box()
        South_Direction =SENW[0]
        if len(South_Direction)  == 1:
            South_Dimention = South_Direction[0][1]
        else:    
            South_Dimention =max(South_Direction[1])

        East_Direction =SENW[1]
        if len(East_Direction) == 1 :
            East_Dimention = East_Direction[0][1]
        else:    
            East_Dimention =max(East_Direction[1])

        North_Direction =SENW[2]
        if len(North_Direction) == 1 :
            North_Dimention = North_Direction[0][1]
        else:    
            North_Dimention =max(North_Direction[1])

        West_Direction =SENW[3]
        if len(West_Direction) ==  1 :
            West_Dimention = West_Direction[0][1]
        else:    
            West_Dimention =max(North_Direction[1])

        return South_Dimention , East_Dimention , North_Dimention , West_Dimention


Family_1 = communal_dwelling(nos)
Sorted_List=(Family_1.Sorting_into_directions_as_per_priority_for_bounding_box())
riwaq_matrix=(Family_1.riwaq_matrix())
Bounding_box=(Family_1.Bounding_box())
Blocks_direction=(Family_1.num_sides_per_direction())
actual_matrix = (Family_1.Sorting_into_directions_as_per_priority())
# ---------- end python ----------
listtotree = ListToTree(PythonList=python.Bounding_box)  # -> simplify(DataTree); inputs PythonList: list, BasePath: list of Int32
# ---------- listtotree: Python ----------
from Grasshopper import DataTree as Tree
from Grasshopper.Kernel.Data import GH_Path as Path
from System import Array

def list_to_tree(input, none_and_holes=False, base_path=[0]):
    """Transforms nestings of lists or tuples to a Grasshopper DataTree"""
    
    def process_one_item(input,tree,track):
        path = Path(Array[int](track))
        if len(input) == 0 and none_and_holes: tree.EnsurePath(path); return
        for i,item in enumerate(input):
            if hasattr(item, '__iter__'): #if list or tuple
                track.append(i); process_one_item(item,tree,track); track.pop()
            else:
                if none_and_holes: tree.Insert(item,path,i)
                elif item is not None: tree.Add(item,path)
    tree = Tree[object]()
    if input is not None: process_one_item(input,tree,base_path[:]); return tree
    

pythonList = PythonList or []
None_and_holes = False
Base_path = BasePath or [0]


DataTree = list_to_tree(pythonList,none_and_holes = None_and_holes, base_path= Base_path)
# ---------- end listtotree ----------
listtotree_2 = ListToTree(PythonList=python.Sorted_List)  # -> simplify(DataTree); inputs PythonList: list, BasePath: list of Int32; same code as listtotree
listtotree_3 = ListToTree(PythonList=python.Blocks_direction)  # -> simplify(DataTree); inputs PythonList: list, BasePath: list of Int32; same code as listtotree
listtotree_4 = ListToTree(PythonList=python.riwaq_matrix)  # -> simplify(DataTree); inputs PythonList: list, BasePath: list of Int32; same code as listtotree
listtotree_5 = ListToTree(PythonList=python.actual_matrix)  # -> simplify(DataTree); inputs PythonList: list, BasePath: list of Int32; same code as listtotree

panel = Panel(listtotree_5)
pshift = ShiftPaths(Data=listtotree_2, Offset=-1)
panel_2 = Panel(pshift)
bang = ExplodeTree(Data=panel_2)  # -> Branch0, Branch1, Branch2, Branch3
panel_3 = Panel(listtotree_4)

partition = PartitionList(List=bang.Branch0, Size="2")
partition_2 = PartitionList(List=bang.Branch3, Size="2")
partition_3 = PartitionList(List=bang.Branch1, Size="2")
partition_4 = PartitionList(List=bang.Branch2, Size="2")
panel_4 = Panel(partition)
item = ListItem(List=partition_3, Index=0, Wrap=True)  # -> Item, Item1
item_2 = ListItem(List=partition_4, Index=0, Wrap=True)  # -> Item, Item1
item_3 = ListItem(List=partition, Index=0, Wrap=True)  # -> Item, Item1
item_4 = ListItem(List=partition_2, Index=0, Wrap=True)  # -> Item, Item1
rectangle = Rectangle(Plane=PlaneXY(0, 0, 0), XSize=item_3.Item, YSize=item_3.Item1, Radius=0)  # -> Rectangle, Length
rectangle_2 = Rectangle(Plane=PlaneXY(0, 0, 0), XSize=item.Item, YSize=item.Item1, Radius=0)  # -> Rectangle, Length
rectangle_3 = Rectangle(Plane=PlaneXY(0, 0, 0), XSize=item_2.Item, YSize=item_2.Item1, Radius=0)  # -> Rectangle, Length
rectangle_4 = Rectangle(Plane=PlaneXY(0, 0, 0), XSize=item_4.Item, YSize=item_4.Item1, Radius=0)  # -> Rectangle, Length

item_5 = ListItem(List=panel_3, Index=0, Wrap=True)  # -> Item, Item1

construct_domain = ConstructDomain(DomainStart=expr("x/2", item_5.Item1), DomainEnd=expr("-x/2", item_5.Item1))
construct_domain_2 = ConstructDomain(DomainStart=expr("x/2", item_5.Item), DomainEnd=expr("-x/2", item_5.Item))
rectangle_5 = Rectangle(Plane=PlaneXY(0, 0, 0), XSize=construct_domain_2, YSize=construct_domain, Radius=0)  # -> Rectangle, Length
srf = Surface(rectangle_5.Rectangle)
preview = CustomPreview(Geometry=srf, Material=ColourSwatch(SwatchColor=RGB(235, 23, 23)))

number_slider_2 = Slider(4, range=0..10)
number_slider_3 = Slider(5, range=0..10)
multiplication = Multiplication(A=item_5.Item, B=1.5)
construct_domain_3 = ConstructDomain(DomainStart=expr("x/2", item_5.Item1), DomainEnd=expr("-x/2", item_5.Item1))
construct_domain_4 = ConstructDomain(DomainStart=expr("x/2", item_5.Item), DomainEnd=expr("-x/2", item_5.Item))
rectangle_6 = Rectangle(Plane=PlaneXY(0, 0, 0), XSize=construct_domain_4, YSize=construct_domain_3, Radius=0)  # -> Rectangle, Length
rotate = Rotate(Geometry=rectangle_2.Rectangle, Angle=degrees(Slider(270, range=0..1000)), Plane=PlaneXY(0, 0, 0))  # -> Geometry, Transform
rotate_2 = Rotate(Geometry=rectangle.Rectangle, Angle=degrees(Slider(90, range=0..1000)), Plane=PlaneXY(0, 0, 0))  # -> Geometry, Transform
explode = Explode(Curve=rectangle_6.Rectangle, Recursive=True)  # -> graft(Segments), Vertices
rotate_3 = Rotate(Geometry=rectangle_4.Rectangle, Angle=degrees(Slider(180, range=0..1000)), Plane=PlaneXY(0, 0, 0))  # -> Geometry, Transform
explode_tree = ExplodeTree(Data=explode.Segments)  # -> Branch0, Branch1, Branch2, Branch3
geometry = Geometry(rotate_2.Geometry)
geometry_2 = Geometry(rotate.Geometry)
geometry_3 = Geometry(rectangle_3.Rectangle)
geometry_4 = Geometry(rotate_3.Geometry)

explode_2 = Explode(Curve=geometry_2, Recursive=True)  # -> Segments, Vertices
explode_3 = Explode(Curve=geometry_3, Recursive=True)  # -> Segments, Vertices
explode_4 = Explode(Curve=geometry, Recursive=True)  # -> Segments, Vertices
explode_5 = Explode(Curve=geometry_4, Recursive=True)  # -> Segments, Vertices
list_item = ListItem(List=explode_2.Segments, Index="0", Wrap=True)
list_item_2 = ListItem(List=explode_3.Segments, Index="0", Wrap=True)
list_item_3 = ListItem(List=explode_4.Segments, Index="0", Wrap=True)
end_points = EndPoints(Curve=list_item)  # -> Start, End
length = Length(Curve=list_item)  # -> flatten(Length)
list_item_4 = ListItem(List=explode_5.Segments, Index="0", Wrap=True)
length_2 = Length(Curve=list_item_2)  # -> flatten(Length)
end_points_2 = EndPoints(Curve=list_item_2)  # -> Start, End
length_3 = Length(Curve=list_item_3)  # -> flatten(Length)
end_points_3 = EndPoints(Curve=list_item_3)  # -> Start, End
list_length = ListLength(List=length)
length_4 = Length(Curve=list_item_4)  # -> flatten(Length)
end_points_4 = EndPoints(Curve=list_item_4)  # -> Start, End
list_length_2 = ListLength(List=length_2)
list_length_3 = ListLength(List=length_3)
larger_than = LargerThan(FirstNumber=list_length, SecondNumber="1")  # -> LargerThan, OrEqualTo
sort = SortList(Keys=length_4, ValuesA=length_4)  # -> Keys, ValuesA
list_length_4 = ListLength(List=sort.ValuesA)
larger_than_2 = LargerThan(FirstNumber=list_length_2, SecondNumber="1")  # -> LargerThan, OrEqualTo
larger_than_3 = LargerThan(FirstNumber=list_length_3, SecondNumber="1")  # -> LargerThan, OrEqualTo
ghpython_script = GhPythonScript(x=length)  # -> out, list; inputs x: list of Int32
# ---------- ghpython_script: Python ----------
__author__ = "SID-TUDelft"
__version__ = "2020.10.06"

import rhinoscriptsyntax as rs
list =[]
for i in range(len(x)-1) :
    a= x[i]
    b= x[i] + x[i+1]
    list.append(a)
    list.append(b)

print list
# ---------- end ghpython_script ----------
ghpython_script_2 = GhPythonScript(x=length_2)  # -> out, list; inputs x: list of Int32; same code as ghpython_script
ghpython_script_3 = GhPythonScript(x=length_3)  # -> out, list; inputs x: list of Int32; same code as ghpython_script
larger_than_4 = LargerThan(FirstNumber=list_length_4, SecondNumber="1")  # -> LargerThan, OrEqualTo
ghpython_script_4 = GhPythonScript(x=sort.ValuesA)  # -> out, list; inputs x: list of Int32; same code as ghpython_script
stream_filter = StreamFilter(Gate=larger_than.LargerThan, Stream0=length, Stream1=ghpython_script.list)
stream_filter_2 = StreamFilter(Gate=larger_than_2.LargerThan, Stream0=length_2, Stream1=ghpython_script_2.list)
south_side = GenericInput(explode_tree.Branch0)
stream_filter_3 = StreamFilter(Gate=larger_than_3.LargerThan, Stream0=length_3, Stream1=ghpython_script_3.list)
stream_filter_4 = StreamFilter(Gate=larger_than_4.LargerThan, Stream0=sort.ValuesA, Stream1=ghpython_script_4.list)
west_side = GenericInput(explode_tree.Branch3)
module_size = Slider(1, range=0..10)
module_size_2 = Slider(1, range=0..10)
sort_2 = SortList(Keys=stream_filter_4, ValuesA=stream_filter_4)  # -> Keys, ValuesA
divide_length = DivideLength(Curve=west_side, Length=module_size_2)  # -> Points, Tangents, Parameters
divide_length_2 = DivideLength(Curve=south_side, Length=module_size)  # -> Points, Tangents, Parameters
module_size_3 = Slider(1, range=0..10)
module_size_4 = Slider(1, range=0..10)
north_side = GenericInput(explode_tree.Branch2)
east_side = GenericInput(explode_tree.Branch1)
list_item_5 = ListItem(List=divide_length.Points, Index=stream_filter_3, Wrap=True)
list_item_6 = ListItem(List=divide_length_2.Points, Index=sort_2.ValuesA, Wrap=True)
divide_length_3 = DivideLength(Curve=east_side, Length=module_size_4)  # -> Points, Tangents, Parameters
divide_length_4 = DivideLength(Curve=north_side, Length=module_size_3)  # -> Points, Tangents, Parameters
vector_2pt = Vector2Pt(PointA=end_points_3.Start, PointB=graft(list_item_5), Unitize=False)  # -> Vector, Length
vector_2pt_2 = Vector2Pt(PointA=end_points_4.Start, PointB=graft(list_item_6), Unitize=False)  # -> Vector, Length
list_item_7 = ListItem(List=divide_length_3.Points, Index=stream_filter, Wrap=True)
list_item_8 = ListItem(List=divide_length_4.Points, Index=stream_filter_2, Wrap=True)
vector_2pt_3 = Vector2Pt(PointA=end_points.Start, PointB=graft(list_item_7), Unitize=False)  # -> Vector, Length
vector_2pt_4 = Vector2Pt(PointA=end_points_2.Start, PointB=graft(list_item_8), Unitize=False)  # -> Vector, Length
move = Move(Geometry=geometry, Motion=vector_2pt.Vector)  # -> Geometry, Transform
move_2 = Move(Geometry=geometry_4, Motion=vector_2pt_2.Vector)  # -> Geometry, Transform
move_3 = Move(Geometry=geometry_2, Motion=vector_2pt_3.Vector)  # -> Geometry, Transform
move_4 = Move(Geometry=geometry_3, Motion=vector_2pt_4.Vector)  # -> Geometry, Transform
Z = UnitZ(Factor=Slider(3, range=0..10))
srf_2 = Surface(move.Geometry)
Z_2 = UnitZ(Factor=Slider(3, range=0..10))
srf_3 = Surface(move_3.Geometry)
srf_4 = Surface(move_2.Geometry)
extr = Extrude(Base=srf_4, Direction=Z)
extr_2 = Extrude(Base=srf_3, Direction=Z_2)
Z_3 = UnitZ(Factor=Slider(3, range=0..10))
Z_4 = UnitZ(Factor=Slider(3, range=0..10))
srf_5 = Surface(move_4.Geometry)
preview_2 = CustomPreview(Geometry=extr_2, Material=ColourSwatch(SwatchColor=RGB(23, 235, 38)))
preview_3 = CustomPreview(Geometry=extr, Material=ColourSwatch(SwatchColor=RGB(209, 67, 176)))
extr_3 = Extrude(Base=srf_2, Direction=Z_3)
extr_4 = Extrude(Base=srf_5, Direction=Z_4)
preview_4 = CustomPreview(Geometry=extr_4, Material=ColourSwatch(SwatchColor=RGB(235, 133, 23)))
preview_5 = CustomPreview(Geometry=extr_3, Material=ColourSwatch(SwatchColor=RGB(53, 81, 94)))
