# Grasshopper definition 16092020_Pythonscript_for_family_distribution.gh (Grasshopper 1.0.7)

# Family Index/Name
panel = Panel("""fam1
fam2
fam3
fam4
fam5
fam6
fam7
fam8
fam9
fam10
fam11
fam12""")
# Number of People
panel_2 = Panel("""4
6
7
8
3
5
7
2
6
5
3
6""")
python = GhPythonScript(familyIndex=panel, familyComposition=panel_2)  # -> out, communalDwelling, communalDwellingindex, familyDwelling, familyDwellingindex, spacename, communalHousingareas, familyHousingareas; inputs familyIndex: list, familyComposition: list of Int32
# ---------- python: Python ----------
__author__ = "SID-TUDelft"
__version__ = "2020.09.14"
import ghpythonlib as gh
import rhinoscriptsyntax as rs
c=[]

communalDwelling=[]
familyDwelling=[]
communalDwellingindex=[]
familyDwellingindex=[]
r=familyIndex
u=familyComposition


for x, y in zip(r, u):  
    if y<=3:
        communalDwelling.append(y)
        communalDwellingindex.append(x)
    else :
        familyDwelling.append(y)
        familyDwellingindex.append(x)





#Defining functions which calculate the areas for the houses depnding on the families
print communalDwelling
print familyDwelling
spacename=["entrance","livingroom","Bedroom","ToiletShower","Iwan","kitchen","courtyard","farm","equipmentroom","storage"]

def communalhousingSize(nos):
    listofareas=[]
    entrancearea=nos*0.45
    livingroomarea = nos*1.7
    Bedroomnos =nos/2
    Bedroomarea = Bedroomnos*6.75
    ToiletShowernos=nos/4
    ToiletShowerarea=ToiletShowernos*2.25
    Iwanarea = nos*0.9
    kitchenarea=nos*1
    courtyardarea=nos*1
    farmareas=nos*2.8
    equipmentroom=nos*0.45
    storageareas=nos*1.35
    listofareas.append(entrancearea)
    listofareas.append(livingroomarea)
    listofareas.append(Bedroomarea)
    listofareas.append(ToiletShowerarea)
    listofareas.append(Iwanarea)
    listofareas.append(kitchenarea)
    listofareas.append(courtyardarea)
    listofareas.append(farmareas)
    listofareas.append(equipmentroom)
    listofareas.append(storageareas)
    return listofareas


def familyhousingSize(nos):
    listofareas=[]
    entrancearea=nos*1.5
    livingroomarea = nos*3.4
    Bedroomnos =nos/2
    Bedroomarea = nos*6.8
    ToiletShowerarea=nos*1.5
    Iwanarea = nos*2.3
    kitchenarea=nos*1.5
    courtyardarea=nos*1.5
    farmareas=nos*3
    equipmentroom=nos*0.8
    storageareas=nos*1.5
    listofareas.append(entrancearea)
    listofareas.append(livingroomarea)
    listofareas.append(Bedroomarea)
    listofareas.append(ToiletShowerarea)
    listofareas.append(Iwanarea)
    listofareas.append(kitchenarea)
    listofareas.append(courtyardarea)
    listofareas.append(farmareas)
    listofareas.append(equipmentroom)
    listofareas.append(storageareas)
    return listofareas



familyHousingareas=[]
for i in familyDwelling :
    t= familyhousingSize(i)
    familyHousingareas.append(t)

communalHousingareas=[]
for i in communalDwelling :
    t= communalhousingSize(i)
    communalHousingareas.append(t)
# ---------- end python ----------
# Communal Dwelling distribution
panel_3 = Panel(python.communalDwelling)
panel_4 = Panel(python.communalDwellingindex)
# Family Dwelling distribution
panel_5 = Panel(python.familyDwelling)
panel_6 = Panel(python.familyDwellingindex)
# Area Distribution
panel_7 = Panel(python.spacename)
listtotree = ListToTree(PythonList=python.communalHousingareas)  # -> DataTree; inputs PythonList: list, BasePath: list of Int32
# ---------- listtotree: Python ----------
from Grasshopper import DataTree as Tree
from Grasshopper.Kernel.Data import GH_Path as Path
from System import Array

def list_to_tree(input, none_and_holes=False, base_path=[0]):
    """Transforms nestings of lists or tuples to a Grasshopper DataTree"""
    
    def process_one_item(input,tree,track):
        path = Path(Array[int](track))
        if len(input) == 0 and none_and_holes: tree.EnsurePath(path); return
        for i,item in enumerate(input):
            if hasattr(item, '__iter__'): #if list or tuple
                track.append(i); process_one_item(item,tree,track); track.pop()
            else:
                if none_and_holes: tree.Insert(item,path,i)
                elif item is not None: tree.Add(item,path)
    tree = Tree[object]()
    if input is not None: process_one_item(input,tree,base_path[:]); return tree
    

pythonList = PythonList or []
None_and_holes = False
Base_path = BasePath or [0]


DataTree = list_to_tree(pythonList,none_and_holes = None_and_holes, base_path= Base_path)
# ---------- end listtotree ----------
listtotree_2 = ListToTree(PythonList=python.familyHousingareas)  # -> DataTree; inputs PythonList: list, BasePath: list of Int32; same code as listtotree
# Family Dwelling areas
panel_8 = Panel(listtotree_2)
# Communal Dwelling Areas
panel_9 = Panel(listtotree)
ma = MassAddition(Input=panel_8)  # -> Result, PartialResults
ma_2 = MassAddition(Input=panel_9)  # -> Result, PartialResults
panel_10 = Panel(ma_2.Result)
panel_11 = Panel(ma.Result)
ma_3 = MassAddition(Input=flatten([panel_10, panel_11]))  # -> Result, PartialResults
panel_12 = Panel(ma_3.Result)
