# Grasshopper definition Dynamic_Relaxation_Script.gh (Grasshopper 1.0.7)
# plug-ins: Weaverbird, Kangaroo2 Components

# ----
# Base Mesh Input
brep = Brep([<brep referenced from the Rhino model> x16])
mesh = Mesh([<mesh referenced from the Rhino model> x40])
mesh_join = MeshJoin(Meshes=mesh)

# ----
# Mesh Sub-division
number_slider = Slider(5, range=0..10)
wbtriangles = WeaverbirdsSplitTrianglesSubdivision(MeshCurves=mesh, Level=number_slider)
wbsplitquads = WeaverbirdsConstantQuadsSplitSubdivision(MeshCurves=mesh_join, Level=Slider(2, range=0..10), SmoothNakedEdges="0")
wbcatmullclark = WeaverbirdsCatmullClarkSubdivision(MeshCurves=mesh, Level=Slider(2, range=1..3), SmoothNakedEdges="0")

# ----
# Sub-Divided Mesh
mesh_2 = Mesh(wbtriangles)

brep_2 = Brep([<brep referenced from the Rhino model> x32])
mesh_3 = Mesh(brep_2)
wbvertices = WeaverbirdsVerticesComponent(MeshClosedPolylinesGroup=mesh_3, Weld=True)  # -> flatten(Points)

# ----
# Edges and Vertices
wbvertices_2 = WeaverbirdsVerticesComponent(MeshClosedPolylinesGroup=mesh_2, Weld=True)  # -> flatten(Points)
wbedges = WeaverbirdsMeshEdges(MeshOrPolylines=mesh_2)

# ----
# If the sorting from center is necessary
area = Area(Geometry=mesh)  # -> Area, Centroid
dist = Distance(PointA=wbvertices_2, PointB=area.Centroid)
sort = SortList(Keys=dist, ValuesA=wbvertices_2)  # -> Keys, reverse(ValuesA)

# ----
# Stiffness settings
number_slider_2 = Slider(8, range=0..10)
edgelengths = EdgeLengths(Mesh=mesh_2, LengthFactor=Slider(1, range=0..1), Strength=number_slider_2)

# ----
# Anchor Points
# Make a curve
# around supports
# and insert
crv = Curve([<curve referenced from the Rhino model> x6])
incurves = PointInCurves(Point=wbvertices_2, Curves=crv)  # -> Relationship, Index, Point
cull = CullPattern(List=wbvertices_2, CullPattern=incurves.Relationship)
anchor = Anchor(Point=[cull, wbvertices], Strength=10000)

# ----
# Point Loads
cull_2 = CullPattern(List=wbvertices_2, CullPattern=invert(incurves.Relationship))
number_slider_3 = Slider(0.1, range=0..0.15)
Z = UnitZ(Factor=Slider(0.6, range=0..1))
load = Load(Point=cull_2, ForceVector=Z, Weighting=1)

# ----
# Kangaroo
toggle = BooleanToggle(False)
show = Show(G=mesh_2)
solver = Solver(GoalObjects=flatten([anchor, edgelengths, load, show]), Reset=Button(), Threshold=1e-15, Tolerance=0.01, On=toggle)  # -> I, V, flatten(O)

# ----
# Outputs
item = ListItem(List=flatten(solver.O), Index=0, Wrap=True)
null = NullItem(Item=solver.O)  # -> NullFlags, InvalidFlags, Description
mesh_4 = Mesh(item)
branch = TreeBranch(Tree=flatten(solver.O), Path="0", MaintainPaths=True)
cull_3 = CullPattern(List=solver.O, CullPattern=simplify(null.NullFlags))
mesh_caps = MeshCaps(M=flatten(mesh_4), W=True, O=True, D=0)  # -> out, A, E; inputs M: Mesh, clr: Color
# ---------- mesh_caps: VB ----------
    Component.Params.Input(0).Name = "Mesh"
    Component.Params.Input(0).Description = "An open mesh"
    Component.Params.Input(1).Name = "Join and Weld"
    Component.Params.Input(1).Description = "If true the original mesh will be joined and welded to the new caps, else the caps will be output as a list of new meshes"
    Component.Params.Input(2).Name = "Simplify Faces"
    Component.Params.Input(2).Description = "If true, naked edges consisting of 3 to 4 segments will be replaced with a single face, else faces will use new center vertex method"
    Component.Params.Input(3).Name = "Distance (Optional, Rhino Units)"
    Component.Params.Input(3).Description = "A single number which sets the Rhino unit based distance that the center point will be offset from the vertex averages"

    Component.Params.Output(1).Name = "Mesh"
    Component.Params.Output(1).Description = "If successful, a list or single of valid meshes"
    Component.Params.Output(2).Name = "Polylines"
    Component.Params.Output(2).Description = "If successful, a list of valid edge polylines"

    If M IsNot Nothing Then
      Dim i,j,k,kk,ka As Integer
      Dim arrP() As polyline
      Dim P As polyline
      Dim arrM As New list(Of Mesh)
      Dim mj As New mesh
      Dim clrB,clrC,blnN() As Boolean
      Dim oc,tcc As New list(Of color)
      If (clr <> Nothing) Then clrC = True
      If ((m.VertexColors.count() > 0) Or (clr <> Nothing)) Then clrB = True
      If (m.VertexColors.count() = 0) Then  m.vertexcolors.CreateMonotoneMesh(color.LightGray)
      oc = m.VertexColors.ToArray.tolist()
      Dim mv() As point3d
      Dim mo As New list(Of mesh)
      Dim fc As New list(Of MeshFace)
      Dim np As New list(Of point3d)
      Dim ni As New list(Of Integer)
      Dim ind(3) As Integer

      mv = m.Vertices.ToPoint3dArray()
      blnN = m.GetNakedEdgePointStatus()
      arrP = m.GetNakedEdges()

      For i = 0 To ubound(blnN) Step 1
        If blnN(i) Then
          np.add(mv(i))
          ni.add(i)
        End If
      Next

      Dim cld As New pointcloud(np.toarray())
      For i = 0 To ubound(arrP) Step 1
        Dim tm As New mesh
        tm.Vertices.Clear()
        tm.Faces.Clear()

        p = arrP(i)
        If (O And (p.count() < 6)) Then
          ind(0) = ni(cld.ClosestPoint(p(0)))
          ind(1) = ni(cld.ClosestPoint(p(1)))
          ind(2) = ni(cld.ClosestPoint(p(2)))
          ind(3) = ni(cld.ClosestPoint(p(3)))
          tm.Vertices.Add(mv(ind(0)))
          tm.Vertices.Add(mv(ind(1)))
          tm.Vertices.Add(mv(ind(2)))

          tm.VertexColors.Add(oc(ind(0)))
          tm.VertexColors.Add(oc(ind(1)))
          tm.VertexColors.Add(oc(ind(2)))
          If p.count() = 5 Then
            fc.add(New meshface(ind(0), ind(1), ind(2), ind(3)))
            tm.Vertices.Add(mv(ind(3)))
            tm.VertexColors.Add(oc(ind(3)))
            tm.Faces.addface(New meshface(0, 1, 2, 3))
          ElseIf p.count() = 4 Then
            fc.add(New meshface(ind(0), ind(1), ind(2)))
            tm.Faces.addface(New meshface(0, 1, 2))
          End If
          tm.FaceNormals.ComputeFaceNormals()
          tm.Normals.ComputeNormals()
          mo.add(tm)

        Else
          Dim tx As New mesh
          Dim vec As New vector3d
          Dim tv As New list(Of point3d)
          Dim tc As New list(Of color)
          Dim tfc As New list(Of meshface)
          Dim r,g,b As Integer
          Dim tcl As color
          k = cld.ClosestPoint(p(0))
          ka = k
          tx.Vertices.AddVertices(p.ToArray())
          tx.Faces.AddFaces(p.TriangulateClosedPolyline())
          tx.Normals.ComputeNormals()

          vec = tx.Normals(0)

          tv.add(p(0))
          tc.add(oc(k))
          r = oc(ni(k)).R
          g = oc(ni(k)).G
          b = oc(ni(k)).B
          For j = 1 To p.count() - 2 Step 1
            kk = cld.ClosestPoint(p(j))
            fc.add(New meshface(m.Vertices.count(), ni(k), ni(kk)))
            vec += tx.Normals(j)
            k = kk

            tv.add(p(j))
            tc.add(oc(k))
            r += oc(ni(k)).R
            g += oc(ni(k)).G
            b += oc(ni(k)).B
            tfc.add(New meshface(p.count() - 1, j - 1, j))
          Next
          fc.add(New meshface(m.Vertices.count(), ni(k), ni(ka)))
          vec.Unitize()
          vec *= D
          m.Vertices.add(p.CenterPoint() + vec)

          r /= (p.count() - 1)
          g /= (p.count() - 1)
          b /= (p.count() - 1)
          If r > 255 Then r = 255 Else If r < 0 Then r = 0
          If g > 255 Then g = 255 Else If g < 0 Then g = 0
          If b > 255 Then b = 255 Else If b < 0 Then b = 0
          If clrC Then tcl = clr Else tcl = color.FromArgb(r, g, b)
          m.VertexColors.Add(tcl)

          tv.add(p.CenterPoint() + vec)
          tc.add(tcl)
          tfc.add(New meshface(p.count() - 1, p.count() - 2, 0))
          tm.vertices.AddVertices(tv.toarray())
          If clrB Then tm.VertexColors.AppendColors(tc.toarray())
          tm.faces.addfaces(tfc)
          tm.FaceNormals.ComputeFaceNormals()
          tm.Normals.ComputeNormals()
          mo.add(tm)
        End If
      Next

      If w Then
        m.Faces.AddFaces(fc)
        m.FaceNormals.ComputeFaceNormals()
        m.UnifyNormals()
        m.Normals.ComputeNormals()
        If Not clrB Then m.VertexColors.Clear()
        A = m
      Else
        A = mo
      End If
      E = arrP
    End If
# ---------- mesh_caps: VB additional code ----------
  Private Function avgC(ByVal R As Double, ByVal G As Double, ByVal B As Double, ByVal T As Integer)

    R /= t
    G /= t
    B /= t
    If R > 255 Then R = 255 Else If R < 0 Then R = 0
    If G > 255 Then G = 255 Else If G < 0 Then G = 0
    If B > 255 Then B = 255 Else If B < 0 Then B = 0

    Return color.FromArgb(CInt(R), CInt(G), CInt(B))
  End Function
# ---------- end mesh_caps ----------
mesh_5 = Mesh(branch)
panel = Panel(null.NullFlags)
panel_2 = Panel(cull_3)
