# Grasshopper definition Brick laying_Iwan.gh (Grasshopper 1.0.7)

brep = Brep(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)

# ----
# Vault
debrep = DeconstructBrep(Brep=brep)  # -> Faces, Edges, Vertices
number_slider = Slider(0.075, range=0..0.1)
item = ListItem(List=debrep.Edges, Index=0, Wrap=True)  # -> Item, Item1, Item2, Item3, Item4, Item5, Item6
divdist = DivideDistance(Curve=item.Item1, Distance=number_slider)  # -> Points, Tangents, Parameters
divdist_2 = DivideDistance(Curve=item.Item5, Distance=number_slider)  # -> Points, Tangents, Parameters

crv = Curve(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)

number_slider_2 = Slider(26, range=0..100)
end = EndPoints(Curve=crv)  # -> Start, End
vec2pt = Vector2Pt(PointA=end.Start, PointB=end.End, Unitize=False)  # -> Vector, Length
geo = Geometry(end.Start)
contour = Contour(Shape=brep, Point=geo, Direction=vec2pt.Vector, Distance=number_slider)  # -> simplify(flatten(Contours))
# Rotation vetor for nubian vault
series = Series(Start=0, Step=1, Count=number_slider_2)
item_2 = ListItem(List=contour, Index=series, Wrap=True)
dispatch = Dispatch(List=item_2, DispatchPattern=[True, False])  # -> ListA, ListB
geo_2 = Geometry(dispatch.ListB)

lng = ListLength(List=contour)
subtraction = Subtraction(A=lng, B=number_slider_2)
series_2 = Series(Start=number_slider_2, Step=1, Count=subtraction)
item_3 = ListItem(List=contour, Index=series_2, Wrap=True)

dispatch_2 = Dispatch(List=item_3, DispatchPattern=[True, False])  # -> ListA, ListB
geo_3 = Geometry(dispatch_2.ListB)
midpt = CurveMiddle(Curve=geo_3)
crv_cp = CurveClosestPoint(Point=midpt, Curve=geo_3)  # -> Point, Parameter, Distance
geo_4 = Geometry(dispatch_2.ListA)
shatter = Shatter(Curve=graft(geo_3), Parameters=graft(crv_cp.Parameter))
midpt_2 = CurveMiddle(Curve=geo_4)
crv_cp_2 = CurveClosestPoint(Point=midpt_2, Curve=geo_4)  # -> Point, Parameter, Distance
shatter_2 = Shatter(Curve=graft(geo_4), Parameters=graft(crv_cp_2.Parameter))
item_4 = ListItem(List=shatter, Index=Slider(0, range=0..2), Wrap=True)  # -> flatten(Item)
item_5 = ListItem(List=shatter_2, Index=Slider(0, range=0..2), Wrap=True)  # -> flatten(Item)
flip = FlipCurve(Curve=item_4)  # -> Curve, Flag
brep_2 = Brep(brep)
geo_5 = Geometry(dispatch.ListB)
number_slider_3 = Slider(0.15, range=0..1)
flip_2 = FlipCurve(Curve=item_5)  # -> Curve, Flag

# ---- group: Arch
# Arches
deconstruct_brep = DeconstructBrep(Brep=brep_2)  # -> Faces, Edges, Vertices
list_item = ListItem(List=deconstruct_brep.Edges, Index=Slider(4, range=0..10), Wrap=True)
curve = Curve(list_item)

# ----
end_2 = EndPoints(Curve=item_4)  # -> Start, End
geo_6 = Geometry(graft(end_2.End))
end_3 = EndPoints(Curve=flip_2.Curve)  # -> Start, End
geo_7 = Geometry(graft(end_3.End))

# ---- group: Brick inputs
brick_depth = Slider(0.15, range=0..10)
brick_width = Slider(0.3, range=0..10)
brick_height = Slider(0.075, range=0..10)
mortar = Slider(0.01, range=0..10)

# ----
negative = Negative(Value=brick_depth)
negative_2 = Negative(Value=brick_width)
offset_curve_loose = OffsetCurveLoose(Curve=curve, Distance=negative)
addition = Addition(A=brick_height, B=mortar)
lng_2 = ListLength(List=geo_5)
length = Length(Curve=offset_curve_loose)
lng_3 = ListLength(List=item_4)
division = Division(A=length, B=addition)
lng_4 = ListLength(List=flip_2.Curve)
perp_frames = PerpFrames(Curve=curve, Count=division, Align=True)  # -> Frames, Parameters
geo_8 = Geometry(item.Item2)
rectangle = Rectangle(Plane=perp_frames.Frames, XSize=brick_depth, YSize=brick_width, Radius=0)  # -> Rectangle, Length
midpt_3 = CurveMiddle(Curve=geo_8)
geo_9 = Geometry(item.Item2)
midpt_4 = CurveMiddle(Curve=geo_9)
xz = XZPlane(Origin=midpt_4)
xz_2 = XZPlane(Origin=midpt_3)
box_rectangle = BoxRectangle(Rectangle=rectangle.Rectangle, Height=brick_height)
plane = Plane(Plane(origin=(14.6, 50.3, 3.9), x=(0, 0, -1), y=(0, 1, 0)))
mirror = Mirror(Geometry=box_rectangle, Plane=plane)  # -> Geometry, Transform
brep_3 = Brep([mirror.Geometry, box_rectangle])

number_slider_4 = Slider(0.3, range=0..1)

divdist_3 = DivideDistance(Curve=flatten(geo_5), Distance=number_slider_4)  # -> simplify(Points), Tangents, Parameters
end_4 = EndPoints(Curve=geo_5)  # -> Start, End
geo_10 = Geometry(graft(end_4.End))
merge = Merge(Data1=divdist_3.Points, Data2=simplify(geo_10))
pline = PolyLine(Vertices=merge, Closed=False)
explode = Explode(Curve=pline, Recursive=True)  # -> Segments, Vertices
cull_i = CullIndex(List=explode.Segments, Indices="-1", Wrap=True)
end_5 = EndPoints(Curve=cull_i)  # -> Start, End

box = DomainBox(Base=divdist_3.Points, X=Slider(0.075, range=0..1), Y=number_slider_3, Z=number_slider_4)  # -> graft(Box)
debrep_2 = DeconstructBrep(Brep=box)  # -> Faces, Edges, Vertices
item_6 = ListItem(List=debrep_2.Edges, Index=Slider(9, range=0..12), Wrap=True)

end_6 = EndPoints(Curve=item_6)  # -> Start, End
vec2pt_2 = Vector2Pt(PointA=end_6.End, PointB=end_6.Start, Unitize=False)  # -> simplify(Vector), Length
geo_11 = Geometry(end_6.End)
vdis = VectorDisplay(Anchor=end_6.End, Vector=vec2pt_2.Vector)

vec2pt_3 = Vector2Pt(PointA=end_5.Start, PointB=end_5.End, Unitize=False)  # -> simplify(Vector), Length
vdis_2 = VectorDisplay(Anchor=end_5.Start, Vector=vec2pt_3.Vector)

orient = OrientDirection(Geometry=box, PointA=geo_11, DirectionA=vec2pt_2.Vector, PointB=end_5.Start, DirectionB=vec2pt_3.Vector)  # -> Geometry, Transform
viewer = ParamViewer(orient.Geometry)
series_3 = Series(Start=0, Step=1, Count=lng_2)
item_7 = ListItem(List=viewer, Index=series_3, Wrap=True)
branch = TreeBranch(Tree=orient.Geometry, Path=item_7, MaintainPaths=True)
cull_i_2 = CullIndex(List=orient.Geometry, Indices="-1", Wrap=True)
geo_12 = Geometry(cull_i_2)

item_8 = ListItem(List=explode.Segments, Index="-1", Wrap=True)
geo_13 = Geometry(item_8)
end_7 = EndPoints(Curve=geo_13)  # -> Start, End
len = Length(Curve=geo_13)
box_2 = DomainBox(Base=end_7.End, X=Slider(0.075, range=0..0.3), Y=Slider(0.15, range=0..1), Z=len)  # -> graft(Box)
vec2pt_4 = Vector2Pt(PointA=end_7.Start, PointB=end_7.End, Unitize=False)  # -> simplify(Vector), Length
debrep_3 = DeconstructBrep(Brep=box_2)  # -> Faces, Edges, Vertices
item_9 = ListItem(List=debrep_3.Edges, Index=Slider(9, range=0..12), Wrap=True)
end_8 = EndPoints(Curve=item_9)  # -> Start, End
vec2pt_5 = Vector2Pt(PointA=end_8.End, PointB=end_8.Start, Unitize=False)  # -> simplify(Vector), Length
orient_2 = OrientDirection(Geometry=box_2, PointA=end_8.Start, DirectionA=vec2pt_5.Vector, PointB=end_7.End, DirectionB=vec2pt_4.Vector)  # -> Geometry, Transform
geo_14 = Geometry([orient_2.Geometry, branch])

mirror_2 = Mirror(Geometry=geo_14, Plane=xz)  # -> Geometry, Transform

number_slider_5 = Slider(0.3, range=0..1)

divdist_4 = DivideDistance(Curve=flatten(item_4), Distance=number_slider_5)  # -> simplify(Points), Tangents, Parameters

box_3 = DomainBox(Base=divdist_4.Points, X=Slider(0.075, range=0..1), Y=number_slider_3, Z=number_slider_5)  # -> graft(Box)
debrep_4 = DeconstructBrep(Brep=box_3)  # -> Faces, Edges, Vertices
item_10 = ListItem(List=debrep_4.Edges, Index=Slider(11, range=0..12), Wrap=True)

merge_2 = Merge(Data1=divdist_4.Points, Data2=simplify(geo_6))

end_9 = EndPoints(Curve=item_10)  # -> Start, End
vec2pt_6 = Vector2Pt(PointA=end_9.End, PointB=end_9.Start, Unitize=False)  # -> simplify(Vector), Length
geo_15 = Geometry(end_9.End)
vdis_3 = VectorDisplay(Anchor=end_9.End, Vector=vec2pt_6.Vector)

pline_2 = PolyLine(Vertices=merge_2, Closed=False)
explode_2 = Explode(Curve=pline_2, Recursive=True)  # -> Segments, Vertices
cull_i_3 = CullIndex(List=explode_2.Segments, Indices="-1", Wrap=True)
end_10 = EndPoints(Curve=cull_i_3)  # -> Start, End
vec2pt_7 = Vector2Pt(PointA=end_10.End, PointB=end_10.Start, Unitize=False)  # -> simplify(Vector), Length
vdis_4 = VectorDisplay(Anchor=end_10.Start, Vector=vec2pt_7.Vector)

orient_3 = OrientDirection(Geometry=box_3, PointA=geo_15, DirectionA=vec2pt_6.Vector, PointB=end_10.End, DirectionB=vec2pt_7.Vector)  # -> Geometry, Transform
viewer_2 = ParamViewer(orient_3.Geometry)
series_4 = Series(Start=0, Step=1, Count=lng_3)
item_11 = ListItem(List=viewer_2, Index=series_4, Wrap=True)
branch_2 = TreeBranch(Tree=orient_3.Geometry, Path=item_11, MaintainPaths=True)
cull_i_4 = CullIndex(List=orient_3.Geometry, Indices="-1", Wrap=True)
geo_16 = Geometry(cull_i_4)

number_slider_6 = Slider(0.3, range=0..1)

divdist_5 = DivideDistance(Curve=flatten(flip_2.Curve), Distance=number_slider_6)  # -> simplify(Points), Tangents, Parameters

box_4 = DomainBox(Base=divdist_5.Points, X=Slider(0.075, range=0..1), Y=number_slider_3, Z=number_slider_6)  # -> graft(Box)
debrep_5 = DeconstructBrep(Brep=box_4)  # -> Faces, Edges, Vertices
item_12 = ListItem(List=debrep_5.Edges, Index=Slider(11, range=0..12), Wrap=True)

merge_3 = Merge(Data1=simplify(divdist_5.Points), Data2=simplify(geo_7))

end_11 = EndPoints(Curve=item_12)  # -> Start, End
vec2pt_8 = Vector2Pt(PointA=end_11.End, PointB=end_11.Start, Unitize=False)  # -> simplify(Vector), Length
geo_17 = Geometry(end_11.End)
vdis_5 = VectorDisplay(Anchor=end_11.End, Vector=vec2pt_8.Vector)

pline_3 = PolyLine(Vertices=merge_3, Closed=False)
explode_3 = Explode(Curve=pline_3, Recursive=True)  # -> Segments, Vertices
cull_i_5 = CullIndex(List=explode_3.Segments, Indices="-1", Wrap=True)
end_12 = EndPoints(Curve=cull_i_5)  # -> Start, End
geo_18 = Geometry(end_12.Start)
vec2pt_9 = Vector2Pt(PointA=end_12.Start, PointB=end_12.End, Unitize=False)  # -> simplify(Vector), Length
vdis_6 = VectorDisplay(Anchor=end_12.Start, Vector=vec2pt_9.Vector)

orient_4 = OrientDirection(Geometry=box_4, PointA=geo_17, DirectionA=vec2pt_8.Vector, PointB=end_12.Start, DirectionB=vec2pt_9.Vector)  # -> Geometry, Transform
viewer_3 = ParamViewer(orient_4.Geometry)
series_5 = Series(Start=0, Step=1, Count=lng_4)
item_13 = ListItem(List=viewer_3, Index=series_5, Wrap=True)
branch_3 = TreeBranch(Tree=orient_4.Geometry, Path=item_13, MaintainPaths=True)
cull_i_6 = CullIndex(List=orient_4.Geometry, Indices="-1", Wrap=True)
geo_19 = Geometry(cull_i_6)

item_14 = ListItem(List=explode_3.Segments, Index="-1", Wrap=True)
geo_20 = Geometry(item_14)
end_13 = EndPoints(Curve=geo_20)  # -> Start, End
len_2 = Length(Curve=geo_20)
box_5 = DomainBox(Base=end_13.End, X=Slider(0.075, range=0..0.3), Y=Slider(0.15, range=0..1), Z=len_2)  # -> graft(Box)
vec2pt_10 = Vector2Pt(PointA=end_13.End, PointB=end_13.Start, Unitize=False)  # -> simplify(Vector), Length
debrep_6 = DeconstructBrep(Brep=box_5)  # -> Faces, Edges, Vertices
item_15 = ListItem(List=debrep_6.Edges, Index=Slider(11, range=0..12), Wrap=True)
end_14 = EndPoints(Curve=item_15)  # -> Start, End
vec2pt_11 = Vector2Pt(PointA=end_14.Start, PointB=end_14.End, Unitize=False)  # -> simplify(Vector), Length
orient_5 = OrientDirection(Geometry=box_5, PointA=end_14.Start, DirectionA=vec2pt_11.Vector, PointB=end_13.End, DirectionB=vec2pt_10.Vector)  # -> Geometry, Transform
geo_21 = Geometry([orient_5.Geometry, branch_3])

mirror_3 = Mirror(Geometry=geo_21, Plane=xz_2)  # -> Geometry, Transform

item_16 = ListItem(List=explode_2.Segments, Index="-1", Wrap=True)
geo_22 = Geometry(item_16)
end_15 = EndPoints(Curve=geo_22)  # -> Start, End
len_3 = Length(Curve=geo_22)
box_6 = DomainBox(Base=end_15.End, X=Slider(0.075, range=0..0.3), Y=Slider(0.15, range=0..1), Z=len_3)  # -> graft(Box)
vec2pt_12 = Vector2Pt(PointA=end_15.Start, PointB=end_15.End, Unitize=False)  # -> simplify(Vector), Length
debrep_7 = DeconstructBrep(Brep=box_6)  # -> Faces, Edges, Vertices
item_17 = ListItem(List=debrep_7.Edges, Index=Slider(11, range=0..12), Wrap=True)
end_16 = EndPoints(Curve=item_17)  # -> Start, End
vec2pt_13 = Vector2Pt(PointA=end_16.Start, PointB=end_16.End, Unitize=False)  # -> simplify(Vector), Length
orient_6 = OrientDirection(Geometry=box_6, PointA=end_16.End, DirectionA=vec2pt_13.Vector, PointB=end_15.End, DirectionB=vec2pt_12.Vector)  # -> Geometry, Transform

mirror_4 = Mirror(Geometry=item_16, Plane=xz)  # -> Geometry, Transform
join = JoinCurves(Curves=[mirror_4.Geometry, item_16], Preserve=False)
multiplication = Multiplication(A=len_3, B=2)
len_4 = Length(Curve=join)
division_2 = Division(A=len_4, B=2)
subtraction_2 = Subtraction(A=len_4, B=Slider(0.2, range=0..1))

geo_23 = Geometry(join)
end_17 = EndPoints(Curve=geo_23)  # -> Start, End
len_5 = Length(Curve=geo_23)
box_7 = DomainBox(Base=end_17.End, X=Slider(0.075, range=0..0.3), Y=Slider(0.15, range=0..1), Z=len_5)  # -> graft(Box)
vec2pt_14 = Vector2Pt(PointA=end_17.Start, PointB=end_17.End, Unitize=False)  # -> simplify(Vector), Length
debrep_8 = DeconstructBrep(Brep=box_7)  # -> Faces, Edges, Vertices
item_18 = ListItem(List=debrep_8.Edges, Index=Slider(11, range=0..12), Wrap=True)
end_18 = EndPoints(Curve=item_18)  # -> Start, End
smaller = SmallerThan(FirstNumber=len_4, SecondNumber="0.4")  # -> SmallerThan, OrEqualTo
vec2pt_15 = Vector2Pt(PointA=end_18.Start, PointB=end_18.End, Unitize=False)  # -> simplify(Vector), Length
orient_7 = OrientDirection(Geometry=box_7, PointA=end_18.End, DirectionA=vec2pt_15.Vector, PointB=end_17.End, DirectionB=vec2pt_14.Vector)  # -> Geometry, Transform
cull = CullPattern(List=orient_6.Geometry, CullPattern=invert(smaller.OrEqualTo))
cull_2 = CullPattern(List=orient_7.Geometry, CullPattern=smaller.OrEqualTo)
merge_4 = Merge(Data1=flatten(cull_2), Data2=flatten(cull))

geo_24 = Geometry([branch_2, merge_4])

mirror_5 = Mirror(Geometry=geo_24, Plane=xz)  # -> Geometry, Transform
geo_25 = Geometry([mirror_3.Geometry, branch_3, mirror_2.Geometry, mirror_5.Geometry, geo_21, geo_14, geo_24])
preview = CustomPreview(Geometry=geo_25, Material=ColourSwatch(SwatchColor=RGB(156, 138, 138)))
