# Grasshopper definition Brick laying_Room Module.gh (Grasshopper 1.0.7)
# plug-ins: Pufferfish

# Corner Cove
# Referance Surface
srf = Surface(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)

debrep = DeconstructBrep(Brep=srf)  # -> Faces, Edges, Vertices
number_slider = Slider(0.05, range=0..0.1)
item = ListItem(List=debrep.Edges, Index=0, Wrap=True)  # -> Item, Item1, Item2
divdist = DivideDistance(Curve=item.Item2, Distance=number_slider)  # -> Points, Tangents, Parameters
divdist_2 = DivideDistance(Curve=item.Item, Distance=number_slider)  # -> Points, Tangents, Parameters

# ----
# Middle Vault
brep = Brep(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)

debrep_2 = DeconstructBrep(Brep=brep)  # -> Faces, Edges, Vertices
item_2 = ListItem(List=debrep_2.Edges, Index=0, Wrap=True)  # -> Item, Item1, Item2, Item3, Item4, Item5, Item6

end = EndPoints(Curve=item_2.Item1)  # -> Start, End
vec2pt = Vector2Pt(PointA=end.Start, PointB=end.End, Unitize=False)  # -> Vector, Length
geo = Geometry(end.Start)
contour = Contour(Shape=brep, Point=geo, Direction=vec2pt.Vector, Distance=Slider(0.075, range=0..0.1))  # -> simplify(flatten(Contours))
dispatch = Dispatch(List=contour, DispatchPattern=[True, False])  # -> ListA, ListB

dispatch_2 = Dispatch(List=divdist_2.Points, DispatchPattern=[True, False])  # -> ListA, ListB
geo_2 = Geometry(reverse(dispatch_2.ListA))
pline = PolyLine(Vertices=geo_2, Closed=False)
explode = Explode(Curve=pline, Recursive=True)  # -> Segments, Vertices
midpt = CurveMiddle(Curve=explode.Segments)
srf_cp = SurfaceClosestPoint(Point=midpt, Surface=srf)  # -> Point, UVPoint, Distance
iso = IsoCurve(Surface=srf, UVPoint=srf_cp.UVPoint)  # -> UIsocurve, VIsocurve
geo_3 = Geometry(iso.UIsocurve)
flip = FlipCurve(Curve=geo_3)  # -> Curve, Flag

# ---- group: Brick Inputs
brick_height = Slider(0.05, range=0..0.1)
brick_width = Slider(0.1, range=0..1)
brick_length = Slider(0.2, range=0..1)

# ----
dispatch_3 = Dispatch(List=divdist.Points, DispatchPattern=[True, False])  # -> ListA, ListB
geo_4 = Geometry(dispatch_3.ListA)
# Extracting Isocurves at end points
pline_2 = PolyLine(Vertices=geo_4, Closed=False)
explode_2 = Explode(Curve=pline_2, Recursive=True)  # -> Segments, Vertices
midpt_2 = CurveMiddle(Curve=explode_2.Segments)
srf_cp_2 = SurfaceClosestPoint(Point=midpt_2, Surface=srf)  # -> Point, UVPoint, Distance
iso_2 = IsoCurve(Surface=srf, UVPoint=srf_cp_2.UVPoint)  # -> UIsocurve, VIsocurve
geo_5 = Geometry(iso_2.UIsocurve)

# ----
# Brick Infill
curve = Curve([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])
number_slider_2 = Slider(0.075, range=0..1)
flip_2 = FlipCurve(Curve=dispatch.ListB)  # -> Curve, Flag
panel = Panel(iso_2.UIsocurve)
flip_curve = FlipCurve(Curve=curve)  # -> Curve, Flag
series = Series(Start=0, Step=1, Count=Slider(5, range=0..10))
dispdexs = DispatchIndices(List=flatten(flip_curve.Curve), Indices=series)  # -> AtI, NotI
series_2 = Series(Start=0, Step=1, Count=Slider(5, range=0..10))
series_3 = Series(Start=0, Step=1, Count=Slider(5, range=0..10))
dispdexs_2 = DispatchIndices(List=flatten(geo_5), Indices=series_2)  # -> AtI, NotI
dispdexs_3 = DispatchIndices(List=flatten(flip.Curve), Indices=series_3)  # -> AtI, NotI
number_slider_3 = Slider(0.1, range=0..1)
number_slider_4 = Slider(0.1, range=0..1)

end_2 = EndPoints(Curve=dispdexs.NotI)  # -> Start, End
divdist_3 = DivideDistance(Curve=flatten(dispdexs.NotI), Distance=brick_length)  # -> simplify(Points), Tangents, Parameters
geo_6 = Geometry(end_2.End)
pshift = ShiftPaths(Data=geo_6, Offset=-1)  # -> simplify(graft(Data))
merge = Merge(Data1=divdist_3.Points, Data2=pshift)
pline_3 = PolyLine(Vertices=merge, Closed=False)
explode_3 = Explode(Curve=pline_3, Recursive=True)  # -> Segments, Vertices
end_3 = EndPoints(Curve=explode_3.Segments)  # -> Start, End

box = DomainBox(Base=divdist_3.Points, X=brick_width, Y=brick_height, Z=brick_length)  # -> graft(Box)
debrep_3 = DeconstructBrep(Brep=box)  # -> Faces, Edges, Vertices
item_3 = ListItem(List=debrep_3.Edges, Index=Slider(8, range=0..12), Wrap=True)

divdist_4 = DivideDistance(Curve=flatten(dispdexs.AtI), Distance=brick_length)  # -> simplify(Points), Tangents, Parameters
end_4 = EndPoints(Curve=dispdexs.AtI)  # -> Start, End
geo_7 = Geometry(end_4.End)
# Generating Boxes for Bricks
pshift_2 = ShiftPaths(Data=geo_7, Offset=-1)  # -> simplify(graft(Data))
merge_2 = Merge(Data1=divdist_4.Points, Data2=pshift_2)
pline_4 = PolyLine(Vertices=merge_2, Closed=False)
explode_4 = Explode(Curve=pline_4, Recursive=True)  # -> Segments, Vertices
# Generation of Direction vector
end_5 = EndPoints(Curve=explode_4.Segments)  # -> Start, End

box_2 = DomainBox(Base=divdist_4.Points, X=brick_width, Y=brick_height, Z=brick_length)  # -> graft(Box)
# Generating Boxes for Bricks
debrep_4 = DeconstructBrep(Brep=box_2)  # -> Faces, Edges, Vertices
item_4 = ListItem(List=debrep_4.Edges, Index=Slider(8, range=0..12), Wrap=True)

end_6 = EndPoints(Curve=item_3)  # -> Start, End
vec2pt_2 = Vector2Pt(PointA=end_6.End, PointB=end_6.Start, Unitize=False)  # -> simplify(Vector), Length
geo_8 = Geometry(end_6.End)
vdis = VectorDisplay(Anchor=end_6.End, Vector=vec2pt_2.Vector)

end_7 = EndPoints(Curve=item_4)  # -> Start, End
vec2pt_3 = Vector2Pt(PointA=end_7.End, PointB=end_7.Start, Unitize=False)  # -> simplify(Vector), Length
geo_9 = Geometry(end_7.End)
# Brick Vector
vdis_2 = VectorDisplay(Anchor=end_7.End, Vector=vec2pt_3.Vector)

vec2pt_4 = Vector2Pt(PointA=end_3.Start, PointB=end_3.End, Unitize=False)  # -> simplify(Vector), Length
vdis_3 = VectorDisplay(Anchor=end_3.Start, Vector=vec2pt_4.Vector)

orient = OrientDirection(Geometry=box, PointA=geo_8, DirectionA=vec2pt_2.Vector, PointB=end_3.Start, DirectionB=vec2pt_4.Vector)  # -> Geometry, Transform

# ----
# Referance Curves
number_slider_5 = Slider(16, range=0..100)
viewer = ParamViewer(orient.Geometry)
series_4 = Series(Start=0, Step=1, Count=number_slider_5)
item_5 = ListItem(List=viewer, Index=series_4, Wrap=True)
branch = TreeBranch(Tree=orient.Geometry, Path=item_5, MaintainPaths=True)
cull_i = CullIndex(List=branch, Indices="-1", Wrap=True)
# Generation of Direction vector
# Generating Boxes for Bricks
# Brick Vector
# Rotation Vector
# Generation of Direction vector
# Generating Boxes for Bricks
# Brick Vector
geo_10 = Geometry(cull_i)

# ---- group: Last Brick
# Brick Vector
item_6 = ListItem(List=explode_4.Segments, Index="-1", Wrap=True)
# Rotation Vector
geo_11 = Geometry(item_6)
end_8 = EndPoints(Curve=geo_11)  # -> Start, End
len = Length(Curve=geo_11)
box_3 = DomainBox(Base=end_8.End, X=brick_width, Y=brick_height, Z=len)  # -> graft(Box)
vec2pt_5 = Vector2Pt(PointA=end_8.Start, PointB=end_8.End, Unitize=False)  # -> simplify(Vector), Length
debrep_5 = DeconstructBrep(Brep=box_3)  # -> Faces, Edges, Vertices
item_7 = ListItem(List=debrep_5.Edges, Index=Slider(8, range=0..12), Wrap=True)
end_9 = EndPoints(Curve=item_7)  # -> Start, End
vec2pt_6 = Vector2Pt(PointA=end_9.End, PointB=end_9.Start, Unitize=False)  # -> simplify(Vector), Length
orient_2 = OrientDirection(Geometry=box_3, PointA=end_9.Start, DirectionA=vec2pt_6.Vector, PointB=end_8.End, DirectionB=vec2pt_5.Vector)  # -> Geometry, Transform

item_8 = ListItem(List=explode_3.Segments, Index="-1", Wrap=True)
geo_12 = Geometry(item_8)
len_2 = Length(Curve=geo_12)
end_10 = EndPoints(Curve=geo_12)  # -> Start, End
box_4 = DomainBox(Base=end_10.End, X=brick_width, Y=brick_height, Z=len_2)  # -> graft(Box)
vec2pt_7 = Vector2Pt(PointA=end_10.Start, PointB=end_10.End, Unitize=False)  # -> simplify(Vector), Length
debrep_6 = DeconstructBrep(Brep=box_4)  # -> Faces, Edges, Vertices
item_9 = ListItem(List=debrep_6.Edges, Index=Slider(8, range=0..12), Wrap=True)
end_11 = EndPoints(Curve=item_9)  # -> Start, End
vec2pt_8 = Vector2Pt(PointA=end_11.End, PointB=end_11.Start, Unitize=False)  # -> simplify(Vector), Length
orient_3 = OrientDirection(Geometry=box_4, PointA=end_11.Start, DirectionA=vec2pt_8.Vector, PointB=end_10.End, DirectionB=vec2pt_7.Vector)  # -> Geometry, Transform

# ----
vec2pt_9 = Vector2Pt(PointA=end_5.Start, PointB=end_5.End, Unitize=False)  # -> simplify(Vector), Length
orient_4 = OrientDirection(Geometry=box_2, PointA=geo_9, DirectionA=vec2pt_3.Vector, PointB=end_5.Start, DirectionB=vec2pt_9.Vector)  # -> Geometry, Transform
series_5 = Series(Start=0, Step=1, Count=Slider(5, range=0..10))
viewer_2 = ParamViewer(orient_4.Geometry)
item_10 = ListItem(List=viewer_2, Index=series_5, Wrap=True)
branch_2 = TreeBranch(Tree=orient_4.Geometry, Path=item_10, MaintainPaths=True)
cull_i_2 = CullIndex(List=branch_2, Indices="-1", Wrap=True)
geo_13 = Geometry(cull_i_2)

brep_2 = Brep([geo_10, geo_13, orient_3.Geometry, orient_2.Geometry])

number_slider_6 = Slider(0.3, range=0..1)

divdist_5 = DivideDistance(Curve=flatten(dispatch.ListA), Distance=number_slider_6)  # -> simplify(Points), Tangents, Parameters
end_12 = EndPoints(Curve=dispatch.ListA)  # -> Start, End
geo_14 = Geometry(graft(end_12.End))
merge_3 = Merge(Data1=divdist_5.Points, Data2=simplify(geo_14))
pline_5 = PolyLine(Vertices=merge_3, Closed=False)
explode_5 = Explode(Curve=pline_5, Recursive=True)  # -> Segments, Vertices
cull_i_3 = CullIndex(List=explode_5.Segments, Indices="-1", Wrap=True)
end_13 = EndPoints(Curve=cull_i_3)  # -> Start, End

box_5 = DomainBox(Base=divdist_5.Points, X=number_slider_2, Y=Slider(0.15, range=0..1), Z=number_slider_6)  # -> graft(Box)
debrep_7 = DeconstructBrep(Brep=box_5)  # -> Faces, Edges, Vertices
item_11 = ListItem(List=debrep_7.Edges, Index=Slider(9, range=0..12), Wrap=True)

end_14 = EndPoints(Curve=item_11)  # -> Start, End
vec2pt_10 = Vector2Pt(PointA=end_14.End, PointB=end_14.Start, Unitize=False)  # -> simplify(Vector), Length
geo_15 = Geometry(end_14.End)
vdis_4 = VectorDisplay(Anchor=end_14.End, Vector=vec2pt_10.Vector)

vec2pt_11 = Vector2Pt(PointA=end_13.Start, PointB=end_13.End, Unitize=False)  # -> simplify(Vector), Length
vdis_5 = VectorDisplay(Anchor=end_13.Start, Vector=vec2pt_11.Vector)

orient_5 = OrientDirection(Geometry=box_5, PointA=geo_15, DirectionA=vec2pt_10.Vector, PointB=end_13.Start, DirectionB=vec2pt_11.Vector)  # -> Geometry, Transform
viewer_3 = ParamViewer(orient_5.Geometry)
series_6 = Series(Start=0, Step=1, Count=Slider(10, range=0..20))
item_12 = ListItem(List=viewer_3, Index=series_6, Wrap=True)
branch_3 = TreeBranch(Tree=orient_5.Geometry, Path=item_12, MaintainPaths=True)
cull_i_4 = CullIndex(List=orient_5.Geometry, Indices="-1", Wrap=True)
geo_16 = Geometry(cull_i_4)

item_13 = ListItem(List=explode_5.Segments, Index="-1", Wrap=True)
geo_17 = Geometry(item_13)
end_15 = EndPoints(Curve=geo_17)  # -> Start, End
len_3 = Length(Curve=geo_17)
box_6 = DomainBox(Base=end_15.End, X=Slider(0.075, range=0..0.3), Y=Slider(0.15, range=0..1), Z=len_3)  # -> graft(Box)
vec2pt_12 = Vector2Pt(PointA=end_15.Start, PointB=end_15.End, Unitize=False)  # -> simplify(Vector), Length
debrep_8 = DeconstructBrep(Brep=box_6)  # -> Faces, Edges, Vertices
item_14 = ListItem(List=debrep_8.Edges, Index=Slider(7, range=0..12), Wrap=True)
end_16 = EndPoints(Curve=item_14)  # -> Start, End
vec2pt_13 = Vector2Pt(PointA=end_16.End, PointB=end_16.Start, Unitize=False)  # -> simplify(Vector), Length
orient_6 = OrientDirection(Geometry=box_6, PointA=end_16.Start, DirectionA=vec2pt_13.Vector, PointB=end_15.End, DirectionB=vec2pt_12.Vector)  # -> Geometry, Transform
geo_18 = Geometry([orient_6.Geometry, branch_3])

number_slider_7 = Slider(0.3, range=0..1)

divdist_6 = DivideDistance(Curve=flatten(flip_2.Curve), Distance=number_slider_7)  # -> simplify(Points), Tangents, Parameters
end_17 = EndPoints(Curve=flip_2.Curve)  # -> Start, End
geo_19 = Geometry(graft(end_17.End))
merge_4 = Merge(Data1=divdist_6.Points, Data2=simplify(geo_19))
pline_6 = PolyLine(Vertices=merge_4, Closed=False)
explode_6 = Explode(Curve=pline_6, Recursive=True)  # -> Segments, Vertices
cull_i_5 = CullIndex(List=explode_6.Segments, Indices="-1", Wrap=True)
end_18 = EndPoints(Curve=cull_i_5)  # -> Start, End

box_7 = DomainBox(Base=divdist_6.Points, X=number_slider_2, Y=Slider(0.15, range=0..1), Z=number_slider_7)  # -> graft(Box)
debrep_9 = DeconstructBrep(Brep=box_7)  # -> Faces, Edges, Vertices
item_15 = ListItem(List=debrep_9.Edges, Index=Slider(9, range=0..12), Wrap=True)

end_19 = EndPoints(Curve=item_15)  # -> Start, End
vec2pt_14 = Vector2Pt(PointA=end_19.End, PointB=end_19.Start, Unitize=False)  # -> simplify(Vector), Length
geo_20 = Geometry(end_19.End)
vdis_6 = VectorDisplay(Anchor=end_19.End, Vector=vec2pt_14.Vector)

vec2pt_15 = Vector2Pt(PointA=end_18.Start, PointB=end_18.End, Unitize=False)  # -> simplify(Vector), Length
vdis_7 = VectorDisplay(Anchor=end_18.Start, Vector=vec2pt_15.Vector)

orient_7 = OrientDirection(Geometry=box_7, PointA=geo_20, DirectionA=vec2pt_14.Vector, PointB=end_18.Start, DirectionB=vec2pt_15.Vector)  # -> Geometry, Transform
viewer_4 = ParamViewer(orient_7.Geometry)
series_7 = Series(Start=0, Step=1, Count=Slider(10, range=0..20))
item_16 = ListItem(List=viewer_4, Index=series_7, Wrap=True)
branch_4 = TreeBranch(Tree=orient_7.Geometry, Path=item_16, MaintainPaths=True)
cull_i_6 = CullIndex(List=orient_7.Geometry, Indices="-1", Wrap=True)
geo_21 = Geometry(cull_i_6)

item_17 = ListItem(List=explode_6.Segments, Index="-1", Wrap=True)
geo_22 = Geometry(item_17)
end_20 = EndPoints(Curve=geo_22)  # -> Start, End
len_4 = Length(Curve=geo_22)
vec2pt_16 = Vector2Pt(PointA=end_20.Start, PointB=end_20.End, Unitize=False)  # -> simplify(Vector), Length
box_8 = DomainBox(Base=end_20.End, X=Slider(0.075, range=0..0.1), Y=Slider(0.15, range=0..1), Z=len_4)  # -> graft(Box)
debrep_10 = DeconstructBrep(Brep=box_8)  # -> Faces, Edges, Vertices
item_18 = ListItem(List=debrep_10.Edges, Index=Slider(7, range=0..12), Wrap=True)
end_21 = EndPoints(Curve=item_18)  # -> Start, End
vec2pt_17 = Vector2Pt(PointA=end_21.End, PointB=end_21.Start, Unitize=False)  # -> simplify(Vector), Length
orient_8 = OrientDirection(Geometry=box_8, PointA=end_21.Start, DirectionA=vec2pt_17.Vector, PointB=end_20.End, DirectionB=vec2pt_16.Vector)  # -> Geometry, Transform
geo_23 = Geometry([orient_8.Geometry, branch_4])
X = UnitX(Factor=Slider(0.05, range=0..0.1))
move = Move(Geometry=geo_23, Motion=X)  # -> Geometry, Transform

geo_24 = Geometry(move.Geometry)
neg = Negative(Value=Slider(0.05, range=0..0.1))
X_2 = UnitX(Factor=neg)
move_2 = Move(Geometry=geo_24, Motion=X_2)  # -> Geometry, Transform

preview = CustomPreview(Geometry=[move_2.Geometry, geo_18], Material=ColourSwatch(SwatchColor=RGB(156, 138, 138)))

number_slider_8 = Slider(0.1, range=0..1)
# Generating Boxes for Bricks
number_slider_9 = Slider(0.2, range=0..1)

# ----
# Generation of Direction vector
end_22 = EndPoints(Curve=dispdexs_3.NotI)  # -> Start, End
divdist_7 = DivideDistance(Curve=flatten(dispdexs_3.NotI), Distance=number_slider_9)  # -> simplify(Points), Tangents, Parameters
geo_25 = Geometry(end_22.End)
pshift_3 = ShiftPaths(Data=geo_25, Offset=-1)  # -> simplify(graft(Data))
merge_5 = Merge(Data1=divdist_7.Points, Data2=pshift_3)
pline_7 = PolyLine(Vertices=merge_5, Closed=False)
explode_7 = Explode(Curve=pline_7, Recursive=True)  # -> Segments, Vertices
end_23 = EndPoints(Curve=explode_7.Segments)  # -> Start, End

box_9 = DomainBox(Base=divdist_7.Points, X=number_slider_8, Y=number_slider, Z=number_slider_9)  # -> graft(Box)
debrep_11 = DeconstructBrep(Brep=box_9)  # -> Faces, Edges, Vertices
item_19 = ListItem(List=debrep_11.Edges, Index=Slider(8, range=0..12), Wrap=True)

# ----
# Brick Vector
end_24 = EndPoints(Curve=item_19)  # -> Start, End
vec2pt_18 = Vector2Pt(PointA=end_24.End, PointB=end_24.Start, Unitize=False)  # -> simplify(Vector), Length
geo_26 = Geometry(end_24.End)
vdis_8 = VectorDisplay(Anchor=end_24.End, Vector=vec2pt_18.Vector)

# ----
# Rotation Vector
vec2pt_19 = Vector2Pt(PointA=end_23.End, PointB=end_23.Start, Unitize=False)  # -> simplify(Vector), Length
vdis_9 = VectorDisplay(Anchor=end_23.Start, Vector=vec2pt_19.Vector)

# ----
# Orient
orient_9 = OrientDirection(Geometry=box_9, PointA=geo_26, DirectionA=vec2pt_18.Vector, PointB=end_23.End, DirectionB=vec2pt_19.Vector)  # -> Geometry, Transform

viewer_5 = ParamViewer(orient_9.Geometry)
series_8 = Series(Start=0, Step=1, Count=Slider(8, range=0..10))
item_20 = ListItem(List=viewer_5, Index=series_8, Wrap=True)
branch_5 = TreeBranch(Tree=orient_9.Geometry, Path=item_20, MaintainPaths=True)
cull_i_7 = CullIndex(List=branch_5, Indices="-1", Wrap=True)
item_21 = ListItem(List=explode_7.Segments, Index="-1", Wrap=True)
geo_27 = Geometry(cull_i_7)
geo_28 = Geometry(item_21)
len_5 = Length(Curve=item_21)
end_25 = EndPoints(Curve=geo_28)  # -> Start, End
vec2pt_20 = Vector2Pt(PointA=end_25.End, PointB=end_25.Start, Unitize=False)  # -> simplify(Vector), Length
box_10 = DomainBox(Base=end_25.End, X=number_slider_8, Y=number_slider, Z=len_5)  # -> graft(Box)
debrep_12 = DeconstructBrep(Brep=box_10)  # -> Faces, Edges, Vertices
item_22 = ListItem(List=debrep_12.Edges, Index=Slider(8, range=0..12), Wrap=True)
end_26 = EndPoints(Curve=item_22)  # -> Start, End
vec2pt_21 = Vector2Pt(PointA=end_26.End, PointB=end_26.Start, Unitize=False)  # -> simplify(Vector), Length
orient_10 = OrientDirection(Geometry=box_10, PointA=end_26.Start, DirectionA=vec2pt_21.Vector, PointB=end_25.Start, DirectionB=vec2pt_20.Vector)  # -> Geometry, Transform

# ----
# Generating Boxes for Bricks
number_slider_10 = Slider(0.1, range=0..1)
number_slider_11 = Slider(0.2, range=0..1)

# ----
# Generation of Direction vector
end_27 = EndPoints(Curve=dispdexs_2.NotI)  # -> Start, End
divdist_8 = DivideDistance(Curve=flatten(dispdexs_2.NotI), Distance=number_slider_11)  # -> simplify(Points), Tangents, Parameters
geo_29 = Geometry(end_27.End)
pshift_4 = ShiftPaths(Data=geo_29, Offset=-1)  # -> simplify(graft(Data))
merge_6 = Merge(Data1=divdist_8.Points, Data2=pshift_4)
pline_8 = PolyLine(Vertices=merge_6, Closed=False)
explode_8 = Explode(Curve=pline_8, Recursive=True)  # -> Segments, Vertices
end_28 = EndPoints(Curve=explode_8.Segments)  # -> Start, End

box_11 = DomainBox(Base=divdist_8.Points, X=number_slider_10, Y=number_slider, Z=number_slider_11)  # -> graft(Box)
debrep_13 = DeconstructBrep(Brep=box_11)  # -> Faces, Edges, Vertices
item_23 = ListItem(List=debrep_13.Edges, Index=Slider(8, range=0..12), Wrap=True)

# ----
# Brick Vector
end_29 = EndPoints(Curve=item_23)  # -> Start, End
vec2pt_22 = Vector2Pt(PointA=end_29.End, PointB=end_29.Start, Unitize=False)  # -> simplify(Vector), Length
geo_30 = Geometry(end_29.End)
vdis_10 = VectorDisplay(Anchor=end_29.End, Vector=vec2pt_22.Vector)

# ----
# Rotation Vector
vec2pt_23 = Vector2Pt(PointA=end_28.Start, PointB=end_28.End, Unitize=False)  # -> simplify(Vector), Length
vdis_11 = VectorDisplay(Anchor=end_28.Start, Vector=vec2pt_23.Vector)

# ----
# Orient
orient_11 = OrientDirection(Geometry=box_11, PointA=geo_30, DirectionA=vec2pt_22.Vector, PointB=end_28.Start, DirectionB=vec2pt_23.Vector)  # -> Geometry, Transform

viewer_6 = ParamViewer(orient_11.Geometry)
series_9 = Series(Start=0, Step=1, Count=Slider(8, range=0..10))
item_24 = ListItem(List=viewer_6, Index=series_9, Wrap=True)
branch_6 = TreeBranch(Tree=orient_11.Geometry, Path=item_24, MaintainPaths=True)
item_25 = ListItem(List=explode_8.Segments, Index="-1", Wrap=True)
geo_31 = Geometry(item_25)
cull_i_8 = CullIndex(List=branch_6, Indices="-1", Wrap=True)
geo_32 = Geometry(cull_i_8)
len_6 = Length(Curve=geo_31)
end_30 = EndPoints(Curve=geo_31)  # -> Start, End
box_12 = DomainBox(Base=end_30.End, X=number_slider_8, Y=number_slider, Z=len_6)  # -> graft(Box)
vec2pt_24 = Vector2Pt(PointA=end_30.Start, PointB=end_30.End, Unitize=False)  # -> simplify(Vector), Length
debrep_14 = DeconstructBrep(Brep=box_12)  # -> Faces, Edges, Vertices
item_26 = ListItem(List=debrep_14.Edges, Index=Slider(8, range=0..12), Wrap=True)
end_31 = EndPoints(Curve=item_26)  # -> Start, End
vec2pt_25 = Vector2Pt(PointA=end_31.End, PointB=end_31.Start, Unitize=False)  # -> simplify(Vector), Length
orient_12 = OrientDirection(Geometry=box_12, PointA=end_31.Start, DirectionA=vec2pt_25.Vector, PointB=end_30.End, DirectionB=vec2pt_24.Vector)  # -> Geometry, Transform

# ----
# Generating Boxes for Bricks
number_slider_12 = Slider(0.1, range=0..1)

# ----
# Generating Boxes for Bricks
number_slider_13 = Slider(0.1, range=0..1)

end_32 = EndPoints(Curve=dispdexs_3.AtI)  # -> Start, End
divdist_9 = DivideDistance(Curve=flatten(dispdexs_3.AtI), Distance=number_slider_4)  # -> simplify(Points), Tangents, Parameters
# Generation of Direction vector
geo_33 = Geometry(end_32.End)

box_13 = DomainBox(Base=divdist_9.Points, X=number_slider_13, Y=number_slider, Z=number_slider_4)  # -> graft(Box)
debrep_15 = DeconstructBrep(Brep=box_13)  # -> Faces, Edges, Vertices
item_27 = ListItem(List=debrep_15.Edges, Index=Slider(8, range=0..12), Wrap=True)

pshift_5 = ShiftPaths(Data=geo_33, Offset=-1)  # -> simplify(graft(Data))

merge_7 = Merge(Data1=divdist_9.Points, Data2=pshift_5)
pline_9 = PolyLine(Vertices=merge_7, Closed=False)
explode_9 = Explode(Curve=pline_9, Recursive=True)  # -> Segments, Vertices
end_33 = EndPoints(Curve=explode_9.Segments)  # -> Start, End

# ----
# Brick Vector
end_34 = EndPoints(Curve=item_27)  # -> Start, End
vec2pt_26 = Vector2Pt(PointA=end_34.End, PointB=end_34.Start, Unitize=False)  # -> simplify(Vector), Length
geo_34 = Geometry(end_34.End)
vdis_12 = VectorDisplay(Anchor=end_34.End, Vector=vec2pt_26.Vector)

# ----
# Rotation Vector
vec2pt_27 = Vector2Pt(PointA=end_33.End, PointB=end_33.Start, Unitize=False)  # -> simplify(Vector), Length
vdis_13 = VectorDisplay(Anchor=end_33.Start, Vector=vec2pt_27.Vector)

# ----
# Orient
orient_13 = OrientDirection(Geometry=box_13, PointA=geo_34, DirectionA=vec2pt_26.Vector, PointB=end_33.End, DirectionB=vec2pt_27.Vector)  # -> Geometry, Transform

viewer_7 = ParamViewer(orient_13.Geometry)
series_10 = Series(Start=0, Step=1, Count=Slider(5, range=0..10))
item_28 = ListItem(List=viewer_7, Index=series_10, Wrap=True)
branch_7 = TreeBranch(Tree=orient_13.Geometry, Path=item_28, MaintainPaths=True)
item_29 = ListItem(List=explode_9.Segments, Index="-1", Wrap=True)
cull_i_9 = CullIndex(List=branch_7, Indices="-1", Wrap=True)
geo_35 = Geometry(item_29)
geo_36 = Geometry(cull_i_9)
geo_37 = Geometry(geo_35)
len_7 = Length(Curve=geo_35)
end_35 = EndPoints(Curve=geo_37)  # -> Start, End
box_14 = DomainBox(Base=end_35.End, X=number_slider_8, Y=number_slider, Z=len_7)  # -> graft(Box)
vec2pt_28 = Vector2Pt(PointA=end_35.End, PointB=end_35.Start, Unitize=False)  # -> simplify(Vector), Length
debrep_16 = DeconstructBrep(Brep=box_14)  # -> Faces, Edges, Vertices
item_30 = ListItem(List=debrep_16.Edges, Index=Slider(8, range=0..12), Wrap=True)
end_36 = EndPoints(Curve=item_30)  # -> Start, End
vec2pt_29 = Vector2Pt(PointA=end_36.End, PointB=end_36.Start, Unitize=False)  # -> simplify(Vector), Length
orient_14 = OrientDirection(Geometry=box_14, PointA=end_36.Start, DirectionA=vec2pt_29.Vector, PointB=end_35.Start, DirectionB=vec2pt_28.Vector)  # -> Geometry, Transform

# ----
# Generation of Direction vector
end_37 = EndPoints(Curve=dispdexs_2.AtI)  # -> Start, End
divdist_10 = DivideDistance(Curve=flatten(dispdexs_2.AtI), Distance=number_slider_3)  # -> simplify(Points), Tangents, Parameters
geo_38 = Geometry(end_37.End)

box_15 = DomainBox(Base=divdist_10.Points, X=number_slider_12, Y=number_slider, Z=number_slider_3)  # -> graft(Box)
debrep_17 = DeconstructBrep(Brep=box_15)  # -> Faces, Edges, Vertices
item_31 = ListItem(List=debrep_17.Edges, Index=Slider(8, range=0..12), Wrap=True)

pshift_6 = ShiftPaths(Data=geo_38, Offset=-1)  # -> simplify(graft(Data))

merge_8 = Merge(Data1=divdist_10.Points, Data2=pshift_6)
pline_10 = PolyLine(Vertices=merge_8, Closed=False)
explode_10 = Explode(Curve=pline_10, Recursive=True)  # -> Segments, Vertices
end_38 = EndPoints(Curve=explode_10.Segments)  # -> Start, End

# ----
# Brick Vector
end_39 = EndPoints(Curve=item_31)  # -> Start, End
vec2pt_30 = Vector2Pt(PointA=end_39.End, PointB=end_39.Start, Unitize=False)  # -> simplify(Vector), Length
geo_39 = Geometry(end_39.End)
vdis_14 = VectorDisplay(Anchor=end_39.End, Vector=vec2pt_30.Vector)

# ----
# Rotation Vector
vec2pt_31 = Vector2Pt(PointA=end_38.Start, PointB=end_38.End, Unitize=False)  # -> simplify(Vector), Length
vdis_15 = VectorDisplay(Anchor=end_38.Start, Vector=vec2pt_31.Vector)

# ----
# Orient
orient_15 = OrientDirection(Geometry=box_15, PointA=geo_39, DirectionA=vec2pt_30.Vector, PointB=end_38.Start, DirectionB=vec2pt_31.Vector)  # -> Geometry, Transform

series_11 = Series(Start=0, Step=1, Count=Slider(5, range=0..10))
viewer_8 = ParamViewer(orient_15.Geometry)
item_32 = ListItem(List=viewer_8, Index=series_11, Wrap=True)
item_33 = ListItem(List=explode_10.Segments, Index="-1", Wrap=True)
branch_8 = TreeBranch(Tree=orient_15.Geometry, Path=item_32, MaintainPaths=True)
cull_i_10 = CullIndex(List=branch_8, Indices="-1", Wrap=True)
geo_40 = Geometry(item_33)
geo_41 = Geometry(cull_i_10)
end_40 = EndPoints(Curve=geo_40)  # -> Start, End
len_8 = Length(Curve=geo_40)
vec2pt_32 = Vector2Pt(PointA=end_40.Start, PointB=end_40.End, Unitize=False)  # -> simplify(Vector), Length
box_16 = DomainBox(Base=end_40.End, X=number_slider_8, Y=number_slider, Z=len_8)  # -> graft(Box)
debrep_18 = DeconstructBrep(Brep=box_16)  # -> Faces, Edges, Vertices
item_34 = ListItem(List=debrep_18.Edges, Index=Slider(8, range=0..12), Wrap=True)
end_41 = EndPoints(Curve=item_34)  # -> Start, End
vec2pt_33 = Vector2Pt(PointA=end_41.End, PointB=end_41.Start, Unitize=False)  # -> simplify(Vector), Length
orient_16 = OrientDirection(Geometry=box_16, PointA=end_41.Start, DirectionA=vec2pt_33.Vector, PointB=end_40.End, DirectionB=vec2pt_32.Vector)  # -> Geometry, Transform

preview_2 = CustomPreview(
    Geometry=[geo_27, geo_36, geo_32, geo_41, orient_10.Geometry, orient_14.Geometry, orient_12.Geometry, orient_16.Geometry],
    Material=ColourSwatch(SwatchColor=RGB(156, 138, 138)))
