# Grasshopper definition Brick laying_living room.gh (Grasshopper 1.0.7)

trimming_planes_for_the_dome = Brep([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])
# Reference Surface
segmental_curve = Curve(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)
sphere = Geometry(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)
point_for_orientation = Point(Point(-78.44361952, 33.07902656, 1.378858223))

# ---- group: Brick
# Dome
# Brick
number_slider = Slider(0.2, range=0..100)
brick_width = Data(number_slider)
brick_height = Data(Slider(0.05, range=0..10))
brick_depth = Data(Slider(0.1, range=0..10))

# ----
area = Area(Geometry=sphere)  # -> Area, Centroid
# Extracting contour curves
divide_distance = DivideDistance(Curve=segmental_curve, Distance=brick_height)  # -> simplify(Points), Tangents, Parameters
deconstruct = Deconstruct(Point=area.Centroid)  # -> XComponent, YComponent, ZComponent
deconstruct_2 = Deconstruct(Point=divide_distance.Points)  # -> XComponent, YComponent, ZComponent
construct_point = ConstructPoint(XCoordinate=deconstruct.XComponent, YCoordinate=deconstruct.YComponent, ZCoordinate=deconstruct_2.ZComponent)
distance = Distance(PointA=construct_point, PointB=divide_distance.Points)
circle = Circle(Plane=construct_point, Radius=distance)
trim_with_breps = TrimWithBreps(Curve=circle, Brep=trimming_planes_for_the_dome)  # -> Inside, flatten(Outside)
curve = Curve(flatten(trim_with_breps.Outside))

# ---- group: Brick Inputs
brick_height_2 = Slider(0.075, range=0..10)
brick_width_2 = Slider(0.3, range=0..10)
brick_depth_2 = Slider(0.15, range=0..10)
mortar = Slider(0.01, range=0..10)

# ----
domain_box = DomainBox(Base=PlaneXY(0, 0, 0), X=brick_width, Y=brick_depth, Z=brick_height)  # -> graft(Box)
# Perimeter Arches
curve_2 = Curve(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)
negative = Negative(Value=brick_depth_2)
negative_2 = Negative(Value=brick_width_2)

# ----
# Diving curves into circles and arcs
panel = Panel("44")
split_list = SplitList(List=curve, Index=panel)  # -> Circles, ListB
panel_2 = Panel(split_list.Circles)

addition = Addition(A=brick_height_2, B=mortar)
offset_curve_loose = OffsetCurveLoose(Curve=curve_2, Distance=negative)
length = Length(Curve=offset_curve_loose)
division = Division(A=length, B=addition)
perp_frames = PerpFrames(Curve=curve_2, Count=division, Align=True)  # -> Frames, Parameters

# ----
# Defining squinches
panel_3 = Panel("""true
false
false
false""")
dispatch = Dispatch(List=split_list.ListB, DispatchPattern=panel_3)  # -> ListA, ListB
dispatch_2 = Dispatch(List=dispatch.ListA, DispatchPattern=[True, False])  # -> ListA, ListB
division_2 = Division(A=brick_width, B=Slider(2, range=0..10))
divide_distance_2 = DivideDistance(Curve=flatten(dispatch_2.ListB), Distance=flatten(brick_width))  # -> simplify(Points), Tangents, Parameters
divide_distance_3 = DivideDistance(Curve=dispatch_2.ListA, Distance=division_2)  # -> Points, Tangents, Parameters

rectangle = Rectangle(Plane=perp_frames.Frames, XSize=brick_depth_2, YSize=negative_2, Radius=0)  # -> Rectangle, Length
dispatch_3 = Dispatch(List=split_list.Circles, DispatchPattern=[True, False])  # -> ListA, ListB
box_rectangle = BoxRectangle(Rectangle=rectangle.Rectangle, Height=brick_height_2)
plane = Plane(Plane(origin=(-78.44361952, 33.07902656, 0), x=(0, -1, 0), y=(0, 0, 1)))
plane_2 = Plane(Plane(origin=(-78.44361952, 33.07902656, 0), x=(-0.7071067812, -0.7070957652, 0.00394700266), y=(0.002790974086, 0.002790930606, 0.9999922106)))
division_3 = Division(A=brick_width, B=Slider(2, range=0..10))
mirror = Mirror(Geometry=box_rectangle, Plane=plane)  # -> Geometry, Transform
geometry = Geometry([box_rectangle, mirror.Geometry])
divide_distance_4 = DivideDistance(Curve=flatten(dispatch_3.ListA), Distance=flatten(brick_width))  # -> simplify(Points), Tangents, Parameters
divide_distance_5 = DivideDistance(Curve=dispatch_3.ListB, Distance=division_3)  # -> Points, Tangents, Parameters
mirror_2 = Mirror(Geometry=geometry, Plane=plane_2)  # -> Geometry, Transform
geometry_2 = Geometry([geometry, mirror_2.Geometry])

# ---- group: Full bricks
# Shifting of bricks in alternate courses
number_slider_2 = Slider(0, range=0..1)
cull_index = CullIndex(List=divide_distance_5.Points, Indices=number_slider_2, Wrap=True)
cull_index_2 = CullIndex(List=divide_distance_5.Tangents, Indices=number_slider_2, Wrap=True)
panel_4 = Panel("""TRUE
FALSE""")
cull_pattern = CullPattern(List=cull_index, CullPattern=panel_4)
cull_pattern_2 = CullPattern(List=cull_index_2, CullPattern=panel_4)
cull_index_3 = CullIndex(List=cull_pattern, Indices=-1, Wrap=True)
cull_index_4 = CullIndex(List=cull_pattern_2, Indices=-1, Wrap=True)
vector_2pt = Vector2Pt(PointA=point_for_orientation, PointB=simplify(cull_index_3), Unitize=False)  # -> Vector, Length
construct_plane = ConstructPlane(Origin=cull_index_3, XAxis=cull_index_4, YAxis=vector_2pt.Vector)  # -> simplify(Plane)
tree_statistics = TreeStatistics(Tree=construct_plane)  # -> Paths, Length, Count
tree_branch = TreeBranch(Tree=construct_plane, Path=tree_statistics.Paths, MaintainPaths=True)
orient = Orient(Geometry=domain_box, Source=PlaneXY(0, 0, 0), Target=tree_branch)  # -> Geometry, Transform

number_slider_3 = Slider(0, range=0..1)
cull_index_5 = CullIndex(List=divide_distance_3.Points, Indices=number_slider_3, Wrap=True)
cull_index_6 = CullIndex(List=divide_distance_3.Tangents, Indices=number_slider_3, Wrap=True)
panel_5 = Panel("""TRUE
FALSE""")
cull_pattern_3 = CullPattern(List=cull_index_5, CullPattern=panel_5)  # -> simplify(List)
cull_pattern_4 = CullPattern(List=cull_index_6, CullPattern=panel_5)
cull_index_7 = CullIndex(List=cull_pattern_3, Indices=-1, Wrap=True)
# Shifting of bricks in alternate courses
vector_2pt_2 = Vector2Pt(PointA=point_for_orientation, PointB=simplify(cull_index_7), Unitize=False)  # -> Vector, Length
cull_index_8 = CullIndex(List=cull_pattern_4, Indices=-1, Wrap=True)
construct_plane_2 = ConstructPlane(Origin=cull_index_7, XAxis=cull_index_8, YAxis=vector_2pt_2.Vector)  # -> simplify(Plane)
tree_statistics_2 = TreeStatistics(Tree=construct_plane_2)  # -> Paths, Length, Count
tree_branch_2 = TreeBranch(Tree=construct_plane_2, Path=tree_statistics_2.Paths, MaintainPaths=True)
orient_2 = Orient(Geometry=domain_box, Source=PlaneXY(0, 0, 0), Target=tree_branch_2)  # -> Geometry, Transform

# ---- group: Last Brick
end_points = EndPoints(Curve=dispatch_2.ListA)  # -> Start, End
geometry_3 = Geometry(end_points.End)
shift_paths = ShiftPaths(Data=geometry_3, Offset=-1)  # -> simplify(graft(Data))
merge = Merge(Data1=cull_pattern_3, Data2=shift_paths)
list_item = ListItem(List=cull_pattern_3, Index=-1, Wrap=True)
polyline = PolyLine(Vertices=merge, Closed=False)
vector_2pt_3 = Vector2Pt(PointA=point_for_orientation, PointB=simplify(list_item), Unitize=False)  # -> Vector, Length
list_item_2 = ListItem(List=cull_pattern_4, Index=-1, Wrap=True)
explode = Explode(Curve=polyline, Recursive=True)  # -> Segments, Vertices
construct_plane_3 = ConstructPlane(Origin=list_item, XAxis=list_item_2, YAxis=vector_2pt_3.Vector)  # -> simplify(Plane)
list_item_3 = ListItem(List=explode.Segments, Index=-1, Wrap=True)
tree_statistics_3 = TreeStatistics(Tree=construct_plane_3)  # -> Paths, Length, Count
geometry_4 = Geometry(list_item_3)
len = Length(Curve=geometry_4)
domain_box_2 = DomainBox(Base=PlaneXY(0, 0, 0), X=len, Y=brick_depth, Z=brick_height)  # -> graft(Box)
tree_branch_3 = TreeBranch(Tree=construct_plane_3, Path=tree_statistics_3.Paths, MaintainPaths=True)
brep = Brep(domain_box_2)
orient_3 = Orient(Geometry=brep, Source=PlaneXY(0, 0, 0), Target=tree_branch_3)  # -> Geometry, Transform

end_points_2 = EndPoints(Curve=dispatch_2.ListB)  # -> Start, End
geometry_5 = Geometry(end_points_2.End)
list_item_4 = ListItem(List=divide_distance_2.Tangents, Index=-1, Wrap=True)
list_item_5 = ListItem(List=divide_distance_2.Points, Index=-1, Wrap=True)
shift_paths_2 = ShiftPaths(Data=geometry_5, Offset=-1)  # -> simplify(graft(Data))
vector_2pt_4 = Vector2Pt(PointA=point_for_orientation, PointB=simplify(list_item_5), Unitize=False)  # -> Vector, Length
merge_2 = Merge(Data1=divide_distance_2.Points, Data2=shift_paths_2)
construct_plane_4 = ConstructPlane(Origin=list_item_5, XAxis=list_item_4, YAxis=vector_2pt_4.Vector)  # -> simplify(Plane)
polyline_2 = PolyLine(Vertices=merge_2, Closed=False)
tree_statistics_4 = TreeStatistics(Tree=construct_plane_4)  # -> Paths, Length, Count
explode_2 = Explode(Curve=polyline_2, Recursive=True)  # -> Segments, Vertices
tree_branch_4 = TreeBranch(Tree=construct_plane_4, Path=tree_statistics_4.Paths, MaintainPaths=True)
list_item_6 = ListItem(List=explode_2.Segments, Index=-1, Wrap=True)
geometry_6 = Geometry(list_item_6)
len_2 = Length(Curve=geometry_6)
domain_box_3 = DomainBox(Base=PlaneXY(0, 0, 0), X=len_2, Y=brick_depth, Z=brick_height)  # -> graft(Box)
brep_2 = Brep(domain_box_3)
orient_4 = Orient(Geometry=brep_2, Source=PlaneXY(0, 0, 0), Target=tree_branch_4)  # -> Geometry, Transform

polyline_3 = PolyLine(Vertices=cull_pattern, Closed=True)
list_item_7 = ListItem(List=cull_pattern, Index=-1, Wrap=True)
explode_3 = Explode(Curve=polyline_3, Recursive=True)  # -> Segments, Vertices
vector_2pt_5 = Vector2Pt(PointA=point_for_orientation, PointB=simplify(list_item_7), Unitize=False)  # -> Vector, Length
list_item_8 = ListItem(List=cull_pattern_2, Index=-1, Wrap=True)
list_item_9 = ListItem(List=explode_3.Segments, Index=-1, Wrap=True)
construct_plane_5 = ConstructPlane(Origin=list_item_7, XAxis=list_item_8, YAxis=vector_2pt_5.Vector)  # -> simplify(Plane)
geometry_7 = Geometry(list_item_9)
len_3 = Length(Curve=geometry_7)
tree_statistics_5 = TreeStatistics(Tree=construct_plane_5)  # -> Paths, Length, Count
domain_box_4 = DomainBox(Base=PlaneXY(0, 0, 0), X=len_3, Y=brick_depth, Z=brick_height)  # -> graft(Box)
tree_branch_5 = TreeBranch(Tree=construct_plane_5, Path=tree_statistics_5.Paths, MaintainPaths=True)
brep_3 = Brep(domain_box_4)
orient_5 = Orient(Geometry=brep_3, Source=PlaneXY(0, 0, 0), Target=tree_branch_5)  # -> Geometry, Transform

polyline_4 = PolyLine(Vertices=divide_distance_4.Points, Closed=True)
list_item_10 = ListItem(List=divide_distance_4.Tangents, Index=-1, Wrap=True)
list_item_11 = ListItem(List=divide_distance_4.Points, Index=-1, Wrap=True)
explode_4 = Explode(Curve=polyline_4, Recursive=True)  # -> Segments, Vertices
vector_2pt_6 = Vector2Pt(PointA=point_for_orientation, PointB=simplify(list_item_11), Unitize=False)  # -> Vector, Length
list_item_12 = ListItem(List=explode_4.Segments, Index=-1, Wrap=True)
construct_plane_6 = ConstructPlane(Origin=list_item_11, XAxis=list_item_10, YAxis=vector_2pt_6.Vector)  # -> simplify(Plane)
geometry_8 = Geometry(list_item_12)
tree_statistics_6 = TreeStatistics(Tree=construct_plane_6)  # -> Paths, Length, Count
len_4 = Length(Curve=geometry_8)
tree_branch_6 = TreeBranch(Tree=construct_plane_6, Path=tree_statistics_6.Paths, MaintainPaths=True)
domain_box_5 = DomainBox(Base=PlaneXY(0, 0, 0), X=len_4, Y=brick_depth, Z=brick_height)  # -> graft(Box)
brep_4 = Brep(domain_box_5)
orient_6 = Orient(Geometry=brep_4, Source=PlaneXY(0, 0, 0), Target=tree_branch_6)  # -> Geometry, Transform

# ---- group: Full Bricks
cull_index_9 = CullIndex(List=divide_distance_4.Tangents, Indices=-1, Wrap=True)
cull_index_10 = CullIndex(List=divide_distance_4.Points, Indices=-1, Wrap=True)
vector_2pt_7 = Vector2Pt(PointA=point_for_orientation, PointB=simplify(cull_index_10), Unitize=False)  # -> Vector, Length
construct_plane_7 = ConstructPlane(Origin=cull_index_10, XAxis=cull_index_9, YAxis=vector_2pt_7.Vector)  # -> simplify(Plane)
tree_statistics_7 = TreeStatistics(Tree=construct_plane_7)  # -> Paths, Length, Count
tree_branch_7 = TreeBranch(Tree=construct_plane_7, Path=tree_statistics_7.Paths, MaintainPaths=True)
orient_7 = Orient(Geometry=domain_box, Source=PlaneXY(0, 0, 0), Target=tree_branch_7)  # -> Geometry, Transform

cull_index_11 = CullIndex(List=divide_distance_2.Tangents, Indices=-1, Wrap=True)
cull_index_12 = CullIndex(List=divide_distance_2.Points, Indices=-1, Wrap=True)
vector_2pt_8 = Vector2Pt(PointA=point_for_orientation, PointB=simplify(cull_index_12), Unitize=False)  # -> Vector, Length
construct_plane_8 = ConstructPlane(Origin=cull_index_12, XAxis=cull_index_11, YAxis=vector_2pt_8.Vector)  # -> simplify(Plane)
tree_statistics_8 = TreeStatistics(Tree=construct_plane_8)  # -> Paths, Length, Count
tree_branch_8 = TreeBranch(Tree=construct_plane_8, Path=tree_statistics_8.Paths, MaintainPaths=True)
orient_8 = Orient(Geometry=domain_box, Source=PlaneXY(0, 0, 0), Target=tree_branch_8)  # -> Geometry, Transform

# ---- group: Cleaning Up
# Cleaning up of script for overlapping brick
series = Series(Start=0, Step=1, Count=Slider(3, range=0..100))
tree_statistics_9 = TreeStatistics(Tree=orient_7.Geometry)  # -> Paths, Length, Count
cull_index_13 = CullIndex(List=tree_statistics_9.Paths, Indices=series, Wrap=True)
tree_branch_9 = TreeBranch(Tree=orient_7.Geometry, Path=cull_index_13, MaintainPaths=True)

series_2 = Series(Start=0, Step=1, Count=Slider(3, range=0..100))
tree_statistics_10 = TreeStatistics(Tree=orient_6.Geometry)  # -> Paths, Length, Count
cull_index_14 = CullIndex(List=tree_statistics_10.Paths, Indices=series_2, Wrap=True)
tree_branch_10 = TreeBranch(Tree=orient_6.Geometry, Path=cull_index_14, MaintainPaths=True)

tree_statistics_11 = TreeStatistics(Tree=orient.Geometry)  # -> Paths, Length, Count
series_3 = Series(Start=0, Step=1, Count=Slider(3, range=0..100))
cull_index_15 = CullIndex(List=tree_statistics_11.Paths, Indices=series_3, Wrap=True)
tree_branch_11 = TreeBranch(Tree=orient.Geometry, Path=cull_index_15, MaintainPaths=True)

tree_statistics_12 = TreeStatistics(Tree=orient_5.Geometry)  # -> Paths, Length, Count
series_4 = Series(Start=0, Step=1, Count=Slider(3, range=0..100))
cull_index_16 = CullIndex(List=tree_statistics_12.Paths, Indices=series_4, Wrap=True)
tree_branch_12 = TreeBranch(Tree=orient_5.Geometry, Path=cull_index_16, MaintainPaths=True)

# ----
brep_5 = Brep([orient_8.Geometry, orient_4.Geometry, orient_2.Geometry, orient_3.Geometry])
plane_3 = Plane(Plane(origin=(-78.44361952, 33.07902656, 0), x=(0, -1, 0), y=(0, 0, 1)))
mirror_3 = Mirror(Geometry=brep_5, Plane=plane_3)  # -> Geometry, Transform
geometry_9 = Geometry([mirror_3.Geometry, brep_5])
plane_4 = Plane(Plane(origin=(-78.44361952, 33.07902656, 0), x=(0, 0, 1), y=(-1, 0, 0)))
mirror_4 = Mirror(Geometry=geometry_9, Plane=plane_4)  # -> Geometry, Transform
geometry_10 = Geometry([mirror_4.Geometry, geometry_9])
brep_6 = Brep([tree_branch_11, tree_branch_10, orient_6.Geometry, tree_branch_12, tree_branch_9])
