# Grasshopper definition Karamba structural analyses.gh (Grasshopper 1.0.7)
# plug-ins: Weaverbird, karambaGH

# ---- group: Wall mesh edges
# Insert mesh edges
# from Rhino
geometry = Geometry([<curve referenced from the Rhino model> x250])
weaverbird_s_mesh_from_lines_weave_back = WeaverbirdsMeshFromLinesWeaveBack(Lines=geometry, MaximumValence=4)

# ---- group: Roof mesh edges
# Insert mesh edges
# from Rhino
geometry_2 = Geometry([<curve referenced from the Rhino model> x314])
weaverbird_s_mesh_from_lines_weave_back_2 = WeaverbirdsMeshFromLinesWeaveBack(Lines=geometry_2, MaximumValence=4)

geometry_3 = Geometry([<curve referenced from the Rhino model> x2273])
weaverbird_s_mesh_from_lines_weave_back_3 = WeaverbirdsMeshFromLinesWeaveBack(Lines=geometry_3, MaximumValence=4)

# ---- group: Wall mesh edges
geometry_4 = Geometry([<curve referenced from the Rhino model> x1726])
weaverbird_s_mesh_from_lines_weave_back_4 = WeaverbirdsMeshFromLinesWeaveBack(Lines=geometry_4, MaximumValence=4)

# Insert mesh edges
# from Rhino
geometry_5 = Geometry([<curve referenced from the Rhino model> x913])
# Bedroom unit
# Ground floor
weaverbird_s_mesh_from_lines_weave_back_5 = WeaverbirdsMeshFromLinesWeaveBack(Lines=geometry_5, MaximumValence=4)

# ---- group: Roof mesh edges
# Insert mesh edges
# from Rhino
geometry_6 = Geometry([<curve referenced from the Rhino model> x939])
weaverbird_s_mesh_from_lines_weave_back_6 = WeaverbirdsMeshFromLinesWeaveBack(Lines=geometry_6, MaximumValence=4)

# ---- group: Self-weight
Z = UnitZ(Factor=expr("-x", "1.2"))
loads_karamba3d = LoadsKaramba3D(Vector=Z, LCase=0, mode="Gravity")

Z_2 = UnitZ(Factor=expr("-x", "1.2"))
loads_karamba3d_2 = LoadsKaramba3D(Vector=Z_2, LCase=0, mode="Gravity")

Z_3 = UnitZ(Factor=expr("-x", "1.2"))
loads_karamba3d_3 = LoadsKaramba3D(Vector=Z_3, LCase=0, mode="Gravity")

Z_4 = UnitZ(Factor=expr("-x", "1.2"))
loads_karamba3d_4 = LoadsKaramba3D(Vector=Z_4, LCase=0, mode="Gravity")

Z_5 = UnitZ(Factor=expr("-x", "1.2"))
loads_karamba3d_5 = LoadsKaramba3D(Vector=Z_5, LCase=0, mode="Gravity")

# ----
# Living room unit
# Insert geometry
# from Rhino
# Insert geometry
# from Rhino
panel = Panel("walls")
roof = Mesh(flatten([<mesh referenced from the Rhino model> x10]))
walls = Mesh(flatten([<mesh referenced from the Rhino model> x17]))
material_properties_karamba3d = MaterialPropertiesKaramba3D(
    FamilyOfMaterial="Steel",
    Name="S235",
    ElementIdentifier=["roof", panel],
    YoungsModulus_kN_cm2="11",
    InPlaneShearModulus_kN_cm2="6",
    TransverseShearModulus_kN_cm2="6",
    SpecificWeight_kN_m3="15",
    CoefficientOfThermalExpansion_1_C=1e-05,
    YieldStrength_kN_cm2="0.13",
    mode="Isotrop")
cross_section = CrossSectionKaramba3D(
    FamilyNameOfCrossSection="DefaultCroSec",
    ElementIdentifier=panel,
    Material=material_properties_karamba3d,
    Height_cm="29",
    mode="Shell - Const")
cross_section_2 = CrossSectionKaramba3D(
    FamilyNameOfCrossSection="DefaultCroSec",
    ElementIdentifier="roof",
    Material=material_properties_karamba3d,
    Height_cm="28",
    mode="Shell - Const")
meshtoshell = MeshToShellKaramba3D(Mesh=flatten(walls), CrossSection=cross_section, LimitDistance_m=0.005)  # -> simplify(Element), Points, Info
meshtoshell_2 = MeshToShellKaramba3D(Mesh=flatten(roof), CrossSection=cross_section_2, LimitDistance_m=0.005)  # -> simplify(Element), Points, Info

# ---- group: Wind load
deconstruct_mesh = DeconstructMesh(Mesh=roof)  # -> Vertices, Faces, Colours, Normals
cull_duplicates = CullDuplicates(Points=deconstruct_mesh.Vertices, Tolerance=0.1, CullMode=3)  # -> flatten(Points), Indices, Valence
deconstruct = Deconstruct(Point=cull_duplicates.Points)  # -> XComponent, YComponent, ZComponent
smaller_than = SmallerThan(FirstNumber=deconstruct.YComponent, SecondNumber="1.5")  # -> SmallerThan, OrEqualTo
dispatch = Dispatch(List=cull_duplicates.Points, DispatchPattern=smaller_than.SmallerThan)  # -> ListA, ListB
wind = Panel("0.75")
unit_y = UnitY(Factor=wind)
geometry_7 = Geometry(dispatch.ListA)
loads_karamba3d_6 = LoadsKaramba3D(
    Vector=unit_y,
    Mesh=[roof, walls],
    ElementIdentifiers=["roof", panel],
    AddPos=geometry_7,
    LCase=0,
    mode="MeshLoad -Const.",
    menu=[buttons(off, on, off), buttons(on, on)])

# ---- group: Points for supports
deconstruct_mesh_2 = DeconstructMesh(Mesh=walls)  # -> flatten(Vertices), Faces, Colours, Normals
cull_duplicates_2 = CullDuplicates(Points=deconstruct_mesh_2.Vertices, Tolerance=0.1, CullMode=3)  # -> flatten(Points), Indices, Valence
deconstruct_vector = DeconstructVector(Vector=cull_duplicates_2.Points)  # -> XComponent, YComponent, ZComponent
smaller_than_2 = SmallerThan(FirstNumber=deconstruct_vector.ZComponent, SecondNumber="0.5")  # -> SmallerThan, OrEqualTo
dispatch_2 = Dispatch(List=cull_duplicates_2.Points, DispatchPattern=smaller_than_2.SmallerThan)  # -> ListA, ListB
geometry_8 = Geometry(dispatch_2.ListA)

# ---- group: Live load
live_load = Panel("1.125")
unit_z = UnitZ(Factor=expr("-x", live_load))
loads_karamba3d_7 = LoadsKaramba3D(
    Vector=unit_z,
    Mesh=roof,
    ElementIdentifiers="roof",
    LCase=0,
    mode="MeshLoad -Const.",
    menu=[buttons(off, on, off), buttons(on, on)])

# ----
load_karamba3d = LoadKaramba3D(flatten([loads_karamba3d, loads_karamba3d_7, loads_karamba3d_6]))
pt = Point(flatten(geometry_8))
supp = SupportKaramba3D(PosInd=pt, menu=[buttons(on, on, on, on, on, on)])
assemble = AssembleModelKaramba3D(
    Elem=flatten([meshtoshell.Element, meshtoshell_2.Element]),
    Support=flatten(supp),
    Load=flatten(load_karamba3d),
    LimitDistance_m=0.005)  # -> flatten(Model), Info, Mass_kg, CenterOfGravity
analyze = AnalyzeKaramba3D(Model=flatten(assemble.Model))  # -> CalculatedModel, MaximumDisplacement_cm, ResultingForceOfGravity_kN, ElasticEnergy_kNm
reaction_forces_karamba3d = ReactionForcesKaramba3D(AnalyzedModel=analyze.CalculatedModel, ResultCase=0)  # -> AnalyzedModel, ReactionForces_kN, ReactionMoments_kNm, SupportPosition, SumOfReactionForces_kN, SumOfReactionMoments_kNm

# ---- group: Analysis results
modelview = ModelViewKaramba3D(Model=reaction_forces_karamba3d.AnalyzedModel, ResultFactors=1, ResultCase=-1)  # -> Model, DeformedMesh, DeformedAxes, DeformedModel
shellview = ShellViewKaramba3D(Model=modelview.Model, IndexOfLayer=0)  # -> Model, MeshesOfRenderedShells, LegendColors, LegendTags
legend = Legend(Colour=shellview.LegendColors, Tags=shellview.LegendTags, LegendType=101)

# ----
roof_2 = Mesh(flatten(weaverbird_s_mesh_from_lines_weave_back_6))
walls_2 = Mesh(flatten(weaverbird_s_mesh_from_lines_weave_back_5))
material_properties_karamba3d_2 = MaterialPropertiesKaramba3D(
    FamilyOfMaterial="Steel",
    Name="S235",
    ElementIdentifier=["roof", "walls"],
    YoungsModulus_kN_cm2="11",
    InPlaneShearModulus_kN_cm2="6",
    TransverseShearModulus_kN_cm2="6",
    SpecificWeight_kN_m3="15",
    CoefficientOfThermalExpansion_1_C=1e-05,
    YieldStrength_kN_cm2="0.13",
    mode="Isotrop")
cross_section_3 = CrossSectionKaramba3D(
    FamilyNameOfCrossSection="DefaultCroSec",
    ElementIdentifier="roof",
    Material=material_properties_karamba3d_2,
    Height_cm="14",
    mode="Shell - Const")
cross_section_4 = CrossSectionKaramba3D(
    FamilyNameOfCrossSection="DefaultCroSec",
    ElementIdentifier="walls",
    Material=material_properties_karamba3d_2,
    Height_cm="29",
    mode="Shell - Const")
meshtoshell_3 = MeshToShellKaramba3D(Mesh=flatten(walls_2), CrossSection=cross_section_4, LimitDistance_m=0.005)  # -> simplify(Element), Points, Info
meshtoshell_4 = MeshToShellKaramba3D(Mesh=flatten(roof_2), CrossSection=cross_section_3, LimitDistance_m=0.005)  # -> simplify(Element), Points, Info

# ---- group: Wind load
deconstruct_mesh_3 = DeconstructMesh(Mesh=roof_2)  # -> Vertices, Faces, Colours, Normals
cull_duplicates_3 = CullDuplicates(Points=deconstruct_mesh_3.Vertices, Tolerance=0.1, CullMode=3)  # -> flatten(Points), Indices, Valence
deconstruct_2 = Deconstruct(Point=cull_duplicates_3.Points)  # -> XComponent, YComponent, ZComponent
larger_than = LargerThan(FirstNumber=deconstruct_2.YComponent, SecondNumber="1.2")  # -> LargerThan, OrEqualTo
wind_2 = Panel("0.75")
dispatch_3 = Dispatch(List=cull_duplicates_3.Points, DispatchPattern=larger_than.LargerThan)  # -> ListA, ListB
unit_y_2 = UnitY(Factor=expr("-x", wind_2))
geometry_9 = Geometry(dispatch_3.ListA)
loads_karamba3d_8 = LoadsKaramba3D(
    Vector=unit_y_2,
    Mesh=[roof_2, walls_2],
    ElementIdentifiers=["roof", "walls"],
    AddPos=geometry_9,
    LCase=0,
    mode="MeshLoad -Const.",
    menu=[buttons(off, on, off), buttons(on, on)])

# ---- group: Points for supports
deconstruct_mesh_4 = DeconstructMesh(Mesh=walls_2)  # -> flatten(Vertices), Faces, Colours, Normals
cull_duplicates_4 = CullDuplicates(Points=deconstruct_mesh_4.Vertices, Tolerance=0.02, CullMode=3)  # -> flatten(Points), Indices, Valence
deconstruct_vector_2 = DeconstructVector(Vector=cull_duplicates_4.Points)  # -> XComponent, YComponent, ZComponent
smaller_than_3 = SmallerThan(FirstNumber=deconstruct_vector_2.ZComponent, SecondNumber="0.1")  # -> SmallerThan, OrEqualTo
dispatch_4 = Dispatch(List=cull_duplicates_4.Points, DispatchPattern=smaller_than_3.SmallerThan)  # -> ListA, ListB
geometry_10 = Geometry(dispatch_4.ListA)

# ---- group: Live load
live_load_2 = Panel("1.125")
unit_z_2 = UnitZ(Factor=expr("-x", live_load_2))
loads_karamba3d_9 = LoadsKaramba3D(
    Vector=unit_z_2,
    Mesh=[roof_2, walls_2],
    ElementIdentifiers=["roof", "walls"],
    LCase=0,
    mode="MeshLoad -Const.",
    menu=[buttons(off, on, off), buttons(on, on)])

# ----
pt_2 = Point(flatten(geometry_10))
supp_2 = SupportKaramba3D(PosInd=pt_2, menu=[buttons(on, on, on, on, on, on)])
load_karamba3d_2 = LoadKaramba3D(flatten([loads_karamba3d_2, loads_karamba3d_9, loads_karamba3d_8]))
assemble_2 = AssembleModelKaramba3D(
    Elem=flatten([meshtoshell_3.Element, meshtoshell_4.Element]),
    Support=flatten(supp_2),
    Load=flatten(load_karamba3d_2),
    LimitDistance_m=0.005)  # -> flatten(Model), Info, Mass_kg, CenterOfGravity
analyze_2 = AnalyzeKaramba3D(Model=flatten(assemble_2.Model))  # -> CalculatedModel, MaximumDisplacement_cm, ResultingForceOfGravity_kN, ElasticEnergy_kNm
reaction_forces_karamba3d_2 = ReactionForcesKaramba3D(AnalyzedModel=analyze_2.CalculatedModel, ResultCase=0)  # -> AnalyzedModel, ReactionForces_kN, ReactionMoments_kNm, SupportPosition, SumOfReactionForces_kN, SumOfReactionMoments_kNm

# ---- group: Analysis results
modelview_2 = ModelViewKaramba3D(Model=reaction_forces_karamba3d_2.AnalyzedModel, ResultFactors=1, ResultCase=-1)  # -> Model, DeformedMesh, DeformedAxes, DeformedModel
shellview_2 = ShellViewKaramba3D(Model=modelview_2.Model, IndexOfLayer=0)  # -> Model, MeshesOfRenderedShells, LegendColors, LegendTags
legend_2 = Legend(Colour=shellview_2.LegendColors, Tags=shellview_2.LegendTags, LegendType=101)

# ----
medges = MeshEdges(Mesh=walls_2)  # -> flatten(NakedEdges), InteriorEdges, NonManifoldEdges
data = Data(medges.NakedEdges)
end = EndPoints(Curve=data)  # -> Start, End
data_2 = Data([end.Start, end.End])
rdpoints = RemoveDuplicatePointsKaramba3D(Point=data_2, LimitDistance=0.005)  # -> OutPoint, Info, Indexes
deconstruct_3 = Deconstruct(Point=rdpoints.OutPoint)  # -> XComponent, YComponent, ZComponent
larger = LargerThan(FirstNumber=deconstruct_3.ZComponent, SecondNumber="2.4")  # -> LargerThan, OrEqualTo
cull = CullPattern(List=rdpoints.OutPoint, CullPattern=larger.OrEqualTo)

# ---- group: Second floor load / Second floor reaction forces
data_3 = Data(reaction_forces_karamba3d_2.AnalyzedModel)

# ----
# Riwaq unit
panel_2 = Panel("walls")
roof_3 = Mesh(flatten(weaverbird_s_mesh_from_lines_weave_back_2))
walls_3 = Mesh(flatten(weaverbird_s_mesh_from_lines_weave_back))
material_properties_karamba3d_3 = MaterialPropertiesKaramba3D(
    FamilyOfMaterial="Steel",
    Name="S235",
    ElementIdentifier=["roof", panel_2],
    YoungsModulus_kN_cm2="11",
    InPlaneShearModulus_kN_cm2="6",
    TransverseShearModulus_kN_cm2="6",
    SpecificWeight_kN_m3="15",
    CoefficientOfThermalExpansion_1_C=1e-05,
    YieldStrength_kN_cm2="0.13",
    mode="Isotrop")
mesh = Mesh(roof_3)
cross_section_5 = CrossSectionKaramba3D(
    FamilyNameOfCrossSection="DefaultCroSec",
    ElementIdentifier="roof",
    Material=material_properties_karamba3d_3,
    Height_cm="14",
    mode="Shell - Const")
cross_section_6 = CrossSectionKaramba3D(
    FamilyNameOfCrossSection="DefaultCroSec",
    ElementIdentifier=panel_2,
    Material=material_properties_karamba3d_3,
    Height_cm="29",
    mode="Shell - Const")
meshtoshell_5 = MeshToShellKaramba3D(Mesh=flatten(roof_3), CrossSection=cross_section_5, LimitDistance_m=0.005)  # -> simplify(Element), Points, Info
meshtoshell_6 = MeshToShellKaramba3D(Mesh=flatten(walls_3), CrossSection=cross_section_6, LimitDistance_m=0.005)  # -> simplify(Element), Points, Info

# ---- group: Wind load
deconstruct_mesh_5 = DeconstructMesh(Mesh=roof_3)  # -> Vertices, Faces, Colours, Normals
cull_duplicates_5 = CullDuplicates(Points=deconstruct_mesh_5.Vertices, Tolerance=0.1, CullMode=3)  # -> flatten(Points), Indices, Valence
deconstruct_4 = Deconstruct(Point=cull_duplicates_5.Points)  # -> XComponent, YComponent, ZComponent
smaller_than_4 = SmallerThan(FirstNumber=deconstruct_4.YComponent, SecondNumber="0.5")  # -> SmallerThan, OrEqualTo
wind_3 = Panel("0.75")
dispatch_5 = Dispatch(List=cull_duplicates_5.Points, DispatchPattern=smaller_than_4.SmallerThan)  # -> ListA, ListB
unit_y_3 = UnitY(Factor=expr("-x", wind_3))
geometry_11 = Geometry(dispatch_5.ListA)
loads_karamba3d_10 = LoadsKaramba3D(
    Vector=unit_y_3,
    Mesh=roof_3,
    ElementIdentifiers="roof",
    AddPos=geometry_11,
    LCase=0,
    mode="MeshLoad -Const.",
    menu=[buttons(off, on, off), buttons(on, on)])

# ---- group: Sand load
demesh = DeconstructMesh(Mesh=mesh)  # -> Vertices, Faces, Colours, Normals
m_facearea = MeshFaceArea(M=mesh)  # -> out, G, A, B; inputs M: Mesh
# ---------- m_facearea: VB usings ----------
Imports System.IO
Imports System.Linq
Imports System.Data
Imports System.Drawing
Imports System.Reflection
Imports System.Windows.Forms
Imports System.Xml
Imports System.Xml.Linq
Imports Microsoft.VisualBasic
Imports System.Runtime.InteropServices

Imports Rhino.DocObjects
Imports Rhino.Collections
Imports GH_IO
Imports GH_IO.Serialization
# ---------- m_facearea: VB ----------
    Component.Params.Input(0).Name = "Mesh"
    Component.Params.Input(0).Description = "Open or closed mesh"
    Component.Params.Input(1).Name = "Area Domain"
    Component.Params.Input(1).Description = "The domain that describes the range of areas to be tested against"

    Component.Params.Output(1).Name = "Preview Mesh"
    Component.Params.Output(1).Description = "A greyscale preview mesh reflecting the range of values"
    Component.Params.Output(2).Name = "Areas"
    Component.Params.Output(2).Description = "The area of each face of the mesh"
    Component.Params.Output(3).Name = "Pattern"
    Component.Params.Output(3).Description = "If the R input is used, the status of each sample point relative to the provided range (0 = Below, 1 = Within, 2 = Above)"

    If M IsNot Nothing Then
      Dim i,j,k,s As Integer

      Dim mf As Rhino.Geometry.Collections.MeshFaceList = Nothing
      Dim mfn As Rhino.Geometry.Collections.MeshFaceNormalList = Nothing
      Dim mv As Rhino.Geometry.Collections.MeshVertexList = Nothing
      Dim mtv As Rhino.Geometry.Collections.MeshTopologyVertexList = Nothing
      Dim mte As Rhino.Geometry.Collections.MeshTopologyEdgeList = Nothing
      Dim mn As Rhino.Geometry.Collections.MeshVertexNormalList = Nothing
      Dim mc As Rhino.Geometry.Collections.MeshVertexColorList = Nothing

      mf = m.Faces
      mfn = m.FaceNormals
      mv = m.Vertices
      mtv = m.TopologyVertices
      mte = m.TopologyEdges
      mn = m.Normals
      mc = m.VertexColors

      Dim arrArea As New list(Of Double)
      Dim oc As New list(Of color)
      Dim tv,farea,Tmin,Tmax As Double
      Dim arrPat As New list(Of Integer)

      Dim mfo As New list(Of MeshFace)
      Dim mvo As New list(Of point3d)

      For i = 0 To mf.count() - 1 Step 1
        s = mvo.count()
        Dim tm As New mesh
        Dim tmf As Rhino.Geometry.Collections.MeshFaceList = Nothing
        tmf = tm.Faces()
        tmf.AddFace(mf.item(i))
        tm.Vertices.AddVertices(mv)

        farea = Rhino.Geometry.AreaMassProperties.Compute(tm).Area
        arrArea.add(farea)

        If mf.item(i).isquad() Then
          mvo.add(mv.item(mf.item(i).A))
          mvo.add(mv.item(mf.item(i).B))
          mvo.add(mv.item(mf.item(i).C))
          mvo.add(mv.item(mf.item(i).D))
          mfo.add(New meshface(s, s + 1, s + 2, s + 3))
          k = 4
        Else
          mvo.add(mv.item(mf.item(i).A))
          mvo.add(mv.item(mf.item(i).B))
          mvo.add(mv.item(mf.item(i).C))
          mfo.add(New meshface(s, s + 1, s + 2))
          k = 3
        End If

        If i = 0 Then Tmin = farea Else If farea < Tmin Then Tmin = farea
        If farea > Tmax Then Tmax = farea
      Next

      If R = Nothing Then
        R.t0 = Tmin
        R.t1 = Tmax
      End If

      For i = 0 To mf.count() - 1 Step 1
        If mf.item(i).isquad() Then k = 4 Else k = 3

        If arrArea.item(i) < R.T0 Then
          For j = 0 To k - 1 Step 1
            oc.add(color.FromArgb(0, 0, 255))
          Next
          arrPat.add(0)
        ElseIf ((arrArea.item(i) > R.T1) Or ((r.t0 = 0) And (r.t1 = 0))) Then
          For j = 0 To k - 1 Step 1
            oc.add(color.FromArgb(255, 0, 0))
          Next
          arrPat.add(2)
        Else
          For j = 0 To k - 1 Step 1
            tv = math.Floor((arrArea.item(i) - R.T0) / (R.t1 - R.t0) * 255)
            oc.add(color.FromArgb(tv, tv, tv))
          Next
          arrPat.add(1)
        End If
      Next
      Dim mo As New mesh
      mo.vertices.AddVertices(mvo.toarray())
      mo.Faces.AddFaces(mfo.toarray())
      mo.VertexColors.AppendColors(oc.toarray())

      G = mo
      A = arrArea
      B = arrPat
    End If
# ---------- end m_facearea ----------
pdecon = Deconstruct(Point=demesh.Vertices)  # -> XComponent, YComponent, ZComponent
avr = Average(Input=m_facearea.A)
sort = SortList(Keys=pdecon.ZComponent, ValuesA=demesh.Vertices)  # -> reverse(Keys), reverse(ValuesA)
item = ListItem(List=sort.ValuesA, Index=0, Wrap=True)
xy = XYPlane(Origin=item)
project = Project(Geometry=demesh.Vertices, Plane=xy)  # -> Geometry, Transform
dist = Distance(PointA=demesh.Vertices, PointB=project.Geometry)
multiplication = Multiplication(A=dist, B=avr)
density_in_kn_m_3 = Panel("15")
multiplication_2 = Multiplication(A=multiplication, B=density_in_kn_m_3)
Z_6 = UnitZ(Factor=expr("-x", multiplication_2))
loads_karamba3d_11 = LoadsKaramba3D(ForceVector=Z_6, Local=False, PosInd=demesh.Vertices, LCase=0, mode="Point")

# ---- group: Points for supports
deconstruct_mesh_6 = DeconstructMesh(Mesh=walls_3)  # -> flatten(Vertices), Faces, Colours, Normals
cull_duplicates_6 = CullDuplicates(Points=deconstruct_mesh_6.Vertices, Tolerance=0.1, CullMode=3)  # -> flatten(Points), Indices, Valence
deconstruct_vector_3 = DeconstructVector(Vector=cull_duplicates_6.Points)  # -> XComponent, YComponent, ZComponent
smaller_than_5 = SmallerThan(FirstNumber=deconstruct_vector_3.ZComponent, SecondNumber="0.1")  # -> SmallerThan, OrEqualTo
dispatch_6 = Dispatch(List=cull_duplicates_6.Points, DispatchPattern=smaller_than_5.SmallerThan)  # -> ListA, ListB
geometry_12 = Geometry(dispatch_6.ListA)

# ---- group: Live load
live_load_3 = Panel("2.625")
unit_z_3 = UnitZ(Factor=expr("-x", live_load_3))
loads_karamba3d_12 = LoadsKaramba3D(
    Vector=unit_z_3,
    Mesh=roof_3,
    ElementIdentifiers="roof",
    LCase=0,
    mode="MeshLoad -Const.",
    menu=[buttons(off, on, off), buttons(off, on)])

# ----
load_karamba3d_3 = LoadKaramba3D(flatten([loads_karamba3d_4, loads_karamba3d_12, loads_karamba3d_11, loads_karamba3d_10]))
pt_3 = Point(flatten(geometry_12))
supp_3 = SupportKaramba3D(PosInd=pt_3, menu=[buttons(on, on, on, on, on, on)])
assemble_3 = AssembleModelKaramba3D(
    Elem=flatten([meshtoshell_6.Element, meshtoshell_5.Element]),
    Support=flatten(supp_3),
    Load=flatten(load_karamba3d_3),
    LimitDistance_m=0.005)  # -> flatten(Model), Info, Mass_kg, CenterOfGravity
analyze_3 = AnalyzeKaramba3D(Model=flatten(assemble_3.Model))  # -> CalculatedModel, MaximumDisplacement_cm, ResultingForceOfGravity_kN, ElasticEnergy_kNm
reaction_forces_karamba3d_3 = ReactionForcesKaramba3D(AnalyzedModel=analyze_3.CalculatedModel, ResultCase=0)  # -> AnalyzedModel, ReactionForces_kN, ReactionMoments_kNm, SupportPosition, SumOfReactionForces_kN, SumOfReactionMoments_kNm

# ---- group: Analysis results
modelview_3 = ModelViewKaramba3D(Model=reaction_forces_karamba3d_3.AnalyzedModel, ResultFactors=1, ResultCase=-1)  # -> Model, DeformedMesh, DeformedAxes, DeformedModel
shellview_3 = ShellViewKaramba3D(Model=modelview_3.Model, IndexOfLayer=0)  # -> Model, MeshesOfRenderedShells, LegendColors, LegendTags
legend_3 = Legend(Colour=shellview_3.LegendColors, Tags=shellview_3.LegendTags, LegendType=101)

# ----
# Iwan unit
# Insert mesh edges
# from Rhino
# Insert mesh edges
# from Rhino
panel_3 = Panel("roof")
roof_4 = Mesh(flatten(weaverbird_s_mesh_from_lines_weave_back_3))
walls_4 = Mesh(flatten(weaverbird_s_mesh_from_lines_weave_back_4))
mesh_2 = Mesh(roof_4)
material_properties_karamba3d_4 = MaterialPropertiesKaramba3D(
    FamilyOfMaterial="Steel",
    Name="S235",
    ElementIdentifier=[panel_3, "walls"],
    YoungsModulus_kN_cm2="11",
    InPlaneShearModulus_kN_cm2="6",
    TransverseShearModulus_kN_cm2="6",
    SpecificWeight_kN_m3="15",
    CoefficientOfThermalExpansion_1_C=1e-05,
    YieldStrength_kN_cm2="0.13",
    mode="Isotrop")
cross_section_7 = CrossSectionKaramba3D(
    FamilyNameOfCrossSection="DefaultCroSec",
    ElementIdentifier=panel_3,
    Material=material_properties_karamba3d_4,
    Height_cm="30",
    mode="Shell - Const")
cross_section_8 = CrossSectionKaramba3D(
    FamilyNameOfCrossSection="DefaultCroSec",
    ElementIdentifier="walls",
    Material=material_properties_karamba3d_4,
    Height_cm="58",
    mode="Shell - Const")
meshtoshell_7 = MeshToShellKaramba3D(Mesh=flatten(roof_4), CrossSection=cross_section_7, LimitDistance_m=0.005)  # -> simplify(Element), Points, Info
meshtoshell_8 = MeshToShellKaramba3D(Mesh=flatten(walls_4), CrossSection=cross_section_8, LimitDistance_m=0.005)  # -> simplify(Element), Points, Info

# ---- group: Wind load
deconstruct_mesh_7 = DeconstructMesh(Mesh=roof_4)  # -> Vertices, Faces, Colours, Normals
cull_duplicates_7 = CullDuplicates(Points=deconstruct_mesh_7.Vertices, Tolerance=0.1, CullMode=3)  # -> flatten(Points), Indices, Valence
deconstruct_5 = Deconstruct(Point=cull_duplicates_7.Points)  # -> XComponent, YComponent, ZComponent
smaller_than_6 = SmallerThan(FirstNumber=deconstruct_5.YComponent, SecondNumber="1.5")  # -> SmallerThan, OrEqualTo
dispatch_7 = Dispatch(List=cull_duplicates_7.Points, DispatchPattern=smaller_than_6.SmallerThan)  # -> ListA, ListB
wind_4 = Panel("0.75")
unit_y_4 = UnitY(Factor=wind_4)
geometry_13 = Geometry(dispatch_7.ListA)
loads_karamba3d_13 = LoadsKaramba3D(
    Vector=unit_y_4,
    Mesh=roof_4,
    ElementIdentifiers=panel_3,
    AddPos=geometry_13,
    LCase=0,
    mode="MeshLoad -Const.",
    menu=[buttons(off, on, off), buttons(on, on)])

# ---- group: Sand load
demesh_2 = DeconstructMesh(Mesh=mesh_2)  # -> Vertices, Faces, Colours, Normals
m_facearea_2 = MeshFaceArea(M=mesh_2)  # -> out, G, A, B; inputs M: Mesh; same code as m_facearea
pdecon_2 = Deconstruct(Point=demesh_2.Vertices)  # -> XComponent, YComponent, ZComponent
sort_2 = SortList(Keys=pdecon_2.ZComponent, ValuesA=demesh_2.Vertices)  # -> reverse(Keys), reverse(ValuesA)
item_2 = ListItem(List=sort_2.ValuesA, Index=0, Wrap=True)
xy_2 = XYPlane(Origin=item_2)
project_2 = Project(Geometry=demesh_2.Vertices, Plane=xy_2)  # -> Geometry, Transform
avr_2 = Average(Input=m_facearea_2.A)
dist_2 = Distance(PointA=demesh_2.Vertices, PointB=project_2.Geometry)
density_in_kn_m_3_2 = Panel("15")
multiplication_3 = Multiplication(A=dist_2, B=avr_2)
multiplication_4 = Multiplication(A=multiplication_3, B=density_in_kn_m_3_2)
Z_7 = UnitZ(Factor=expr("-x", multiplication_4))
loads_karamba3d_14 = LoadsKaramba3D(ForceVector=Z_7, Local=False, PosInd=demesh_2.Vertices, LCase=0, mode="Point")

# ---- group: Points for supports
deconstruct_mesh_8 = DeconstructMesh(Mesh=walls_4)  # -> flatten(Vertices), Faces, Colours, Normals
cull_duplicates_8 = CullDuplicates(Points=deconstruct_mesh_8.Vertices, Tolerance=0.1, CullMode=3)  # -> flatten(Points), Indices, Valence
deconstruct_vector_4 = DeconstructVector(Vector=cull_duplicates_8.Points)  # -> XComponent, YComponent, ZComponent
smaller_than_7 = SmallerThan(FirstNumber=deconstruct_vector_4.ZComponent, SecondNumber="0.1")  # -> SmallerThan, OrEqualTo
dispatch_8 = Dispatch(List=cull_duplicates_8.Points, DispatchPattern=smaller_than_7.SmallerThan)  # -> ListA, ListB
geometry_14 = Geometry(dispatch_8.ListA)

# ---- group: Live load
live_load_4 = Panel("1.125")
unit_z_4 = UnitZ(Factor=expr("-x", live_load_4))
loads_karamba3d_15 = LoadsKaramba3D(
    Vector=unit_z_4,
    Mesh=roof_4,
    ElementIdentifiers=panel_3,
    LCase=0,
    mode="MeshLoad -Const.",
    menu=[buttons(on, off, off), buttons(off, on)])

# ----
load_karamba3d_4 = LoadKaramba3D(flatten([loads_karamba3d_3, loads_karamba3d_15, loads_karamba3d_13, loads_karamba3d_14]))
pt_4 = Point(flatten(geometry_14))
supp_4 = SupportKaramba3D(PosInd=pt_4, menu=[buttons(on, on, on, on, on, on)])
assemble_4 = AssembleModelKaramba3D(
    Elem=flatten([meshtoshell_8.Element, meshtoshell_7.Element]),
    Support=flatten(supp_4),
    Load=flatten(load_karamba3d_4),
    CrossSection=[cross_section_8, cross_section_7],
    LimitDistance_m=0.005)  # -> flatten(Model), Info, Mass_kg, CenterOfGravity
analyze_4 = AnalyzeKaramba3D(Model=flatten(assemble_4.Model))  # -> CalculatedModel, MaximumDisplacement_cm, ResultingForceOfGravity_kN, ElasticEnergy_kNm
reaction_forces_karamba3d_4 = ReactionForcesKaramba3D(AnalyzedModel=analyze_4.CalculatedModel, ResultCase=0)  # -> AnalyzedModel, ReactionForces_kN, ReactionMoments_kNm, SupportPosition, SumOfReactionForces_kN, SumOfReactionMoments_kNm

# ---- group: Analysis results
modelview_4 = ModelViewKaramba3D(Model=reaction_forces_karamba3d_4.AnalyzedModel, ResultFactors=1, ResultCase=-1)  # -> Model, DeformedMesh, DeformedAxes, DeformedModel
shellview_4 = ShellViewKaramba3D(Model=modelview_4.Model, IndexOfLayer=0)  # -> Model, MeshesOfRenderedShells, LegendColors, LegendTags
legend_4 = Legend(Colour=shellview_4.LegendColors, Tags=shellview_4.LegendTags, LegendType=101)

# ----
# Second floor
panel_4 = Panel("columns_walls")
columns_main_walls = Mesh(flatten(walls_2))
roof_5 = Mesh(flatten(roof_2))
mesh_3 = Mesh(roof_2)
material_properties_karamba3d_5 = MaterialPropertiesKaramba3D(
    FamilyOfMaterial="Steel",
    Name="S235",
    ElementIdentifier=["roof", panel_4],
    YoungsModulus_kN_cm2="11",
    InPlaneShearModulus_kN_cm2="6",
    TransverseShearModulus_kN_cm2="6",
    SpecificWeight_kN_m3="15",
    CoefficientOfThermalExpansion_1_C=1e-05,
    YieldStrength_kN_cm2="0.13",
    mode="Isotrop")
cross_section_9 = CrossSectionKaramba3D(
    FamilyNameOfCrossSection="DefaultCroSec",
    ElementIdentifier="roof",
    Material=material_properties_karamba3d_5,
    Height_cm="20",
    mode="Shell - Const")
cross_section_10 = CrossSectionKaramba3D(
    FamilyNameOfCrossSection="DefaultCroSec",
    ElementIdentifier=panel_4,
    Material=material_properties_karamba3d_5,
    Height_cm="29",
    mode="Shell - Const")
meshtoshell_9 = MeshToShellKaramba3D(Mesh=flatten(columns_main_walls), CrossSection=cross_section_10, LimitDistance_m=0.005)  # -> simplify(Element), Points, Info
meshtoshell_10 = MeshToShellKaramba3D(Mesh=flatten(roof_5), CrossSection=cross_section_9, LimitDistance_m=0.005)  # -> simplify(Element), Points, Info
geometry_15 = Geometry(flatten(geometry_10))
supp_5 = SupportKaramba3D(PosInd=geometry_15, menu=[buttons(on, on, on, on, on, on)])

# ---- group: Wind load
deconstruct_mesh_9 = DeconstructMesh(Mesh=roof_5)  # -> Vertices, Faces, Colours, Normals
cull_duplicates_9 = CullDuplicates(Points=deconstruct_mesh_9.Vertices, Tolerance=0.1, CullMode=3)  # -> flatten(Points), Indices, Valence
deconstruct_6 = Deconstruct(Point=cull_duplicates_9.Points)  # -> XComponent, YComponent, ZComponent
smaller_than_8 = SmallerThan(FirstNumber=deconstruct_6.YComponent, SecondNumber="1.25")  # -> SmallerThan, OrEqualTo
wind_5 = Panel("0.75")
dispatch_9 = Dispatch(List=cull_duplicates_9.Points, DispatchPattern=smaller_than_8.SmallerThan)  # -> ListA, ListB
unit_y_5 = UnitY(Factor=expr("-x", wind_5))
geometry_16 = Geometry(dispatch_9.ListA)
loads_karamba3d_16 = LoadsKaramba3D(
    Vector=unit_y_5,
    Mesh=roof_5,
    ElementIdentifiers="roof",
    AddPos=geometry_16,
    LCase=0,
    mode="MeshLoad -Const.",
    menu=[buttons(off, on, off), buttons(on, on)])

# ---- group: Sand load
demesh_3 = DeconstructMesh(Mesh=mesh_3)  # -> flatten(Vertices), Faces, Colours, Normals
m_facearea_3 = MeshFaceArea(M=mesh_3)  # -> out, G, flatten(A), B; inputs M: Mesh; same code as m_facearea
pdecon_3 = Deconstruct(Point=demesh_3.Vertices)  # -> XComponent, YComponent, ZComponent
avr_3 = Average(Input=m_facearea_3.A)
sort_3 = SortList(Keys=pdecon_3.ZComponent, ValuesA=demesh_3.Vertices)  # -> reverse(Keys), reverse(ValuesA)
item_3 = ListItem(List=sort_3.ValuesA, Index=0, Wrap=True)
xy_3 = XYPlane(Origin=item_3)
project_3 = Project(Geometry=demesh_3.Vertices, Plane=xy_3)  # -> Geometry, Transform
dist_3 = Distance(PointA=demesh_3.Vertices, PointB=project_3.Geometry)
density_in_kn_m_3_3 = Panel("15")
multiplication_5 = Multiplication(A=dist_3, B=avr_3)
multiplication_6 = Multiplication(A=multiplication_5, B=density_in_kn_m_3_3)
Z_8 = UnitZ(Factor=expr("-x", multiplication_6))
loads_karamba3d_17 = LoadsKaramba3D(ForceVector=Z_8, Local=False, PosInd=demesh_3.Vertices, LCase=0, mode="Point")

# ---- group: Live load
live_load_5 = Panel("4.125")
unit_z_5 = UnitZ(Factor=expr("-x", live_load_5))
loads_karamba3d_18 = LoadsKaramba3D(
    Vector=unit_z_5,
    Mesh=[roof_5, columns_main_walls],
    ElementIdentifiers=["roof", panel_4],
    LCase=0,
    mode="MeshLoad -Const.",
    menu=[buttons(off, on, off), buttons(on, on)])

# ---- group: Second floor load
retaining_walls_top_points = Point(flatten(cull))
react = ReactionForcesKaramba3D(AnalyzedModel=data_3, ResultCase=0)  # -> AnalyzedModel, ReactionForces_kN, ReactionMoments_kNm, SupportPosition, SumOfReactionForces_kN, SumOfReactionMoments_kNm
unit_z_6 = UnitZ(Factor="2.55")
neg = Negative(Value=react.ReactionForces_kN)
neg_2 = Negative(Value=react.ReactionMoments_kNm)

# ----
move = Move(Geometry=react.SupportPosition, Motion=unit_z_6)  # -> Geometry, Transform
closest_points = ClosestPoints(Point=move.Geometry, Cloud=retaining_walls_top_points, Count=1)  # -> flatten(ClosestPoint), CPIndex, Distance

# ---- group: Second floor load (continued)
loads_karamba3d_19 = LoadsKaramba3D(ForceVector=neg, MomentVector=neg_2, Local=False, PosInd=closest_points.ClosestPoint, LCase=0, mode="Point")

# ----
load_karamba3d_5 = LoadKaramba3D(flatten([loads_karamba3d_19, loads_karamba3d_18, loads_karamba3d_17, loads_karamba3d_5, loads_karamba3d_16]))
assemble_5 = AssembleModelKaramba3D(
    Elem=flatten([meshtoshell_9.Element, meshtoshell_10.Element]),
    Support=flatten(supp_5),
    Load=flatten(load_karamba3d_5),
    LimitDistance_m=0.005)  # -> flatten(Model), Info, Mass_kg, CenterOfGravity
analyze_5 = AnalyzeKaramba3D(Model=flatten(assemble_5.Model))  # -> CalculatedModel, MaximumDisplacement_cm, ResultingForceOfGravity_kN, ElasticEnergy_kNm
reaction_forces_karamba3d_5 = ReactionForcesKaramba3D(AnalyzedModel=analyze_5.CalculatedModel, ResultCase=0)  # -> AnalyzedModel, ReactionForces_kN, ReactionMoments_kNm, SupportPosition, SumOfReactionForces_kN, SumOfReactionMoments_kNm

# ---- group: Analysis results
modelview_5 = ModelViewKaramba3D(Model=reaction_forces_karamba3d_5.AnalyzedModel, ResultFactors=1, ResultCase=-1)  # -> Model, DeformedMesh, DeformedAxes, DeformedModel
shellview_5 = ShellViewKaramba3D(Model=modelview_5.Model, IndexOfLayer=0)  # -> Model, MeshesOfRenderedShells, LegendColors, LegendTags
legend_5 = Legend(Colour=shellview_5.LegendColors, Tags=shellview_5.LegendTags, LegendType=101)
