# Grasshopper definition bricklaying_walls.gh (Grasshopper 1.0.7)

# ---- group: Wall / Input horizontal & vertical
boolean_toggle = BooleanToggle(True)
curve = Curve()
curve_2 = Curve()

# ---- group: Arch wall infill / Input horizontal & vertical
boolean_toggle_2 = BooleanToggle(False)
horizontal = Curve(<curve referenced from the Rhino model>)
curve_3 = Curve()

# ---- group: Wall with arch opening / Input horizontal & vertical
boolean_toggle_3 = BooleanToggle(False)
curve_4 = Curve()
curve_5 = Curve([<curve referenced from the Rhino model> x2])

# ---- group: Arch wall infill
ghpython_script = GhPythonScript(x=horizontal, y=curve_3, z=boolean_toggle_2)  # -> out, a, c
# ---------- ghpython_script: Python ----------
__author__ = "dion"
__version__ = "2020.10.15"

import rhinoscriptsyntax as rs

if z == True:
    a = x

if z == False:
    c = x

if z == True:
    c = y

if z == False:
    a = y
# ---------- end ghpython_script ----------
curve_6 = Curve(ghpython_script.a)
curve_7 = Curve(ghpython_script.c)
length = Length(Curve=curve_6)
length_2 = Length(Curve=curve_7)
panel = Panel(length)
panel_2 = Panel(length_2)
ghpython_script_2 = GhPythonScript(x=panel, e=curve_6)  # -> out, a, c, d
# ---------- ghpython_script_2: Python ----------
__author__ = "dion"
__version__ = "2020.10.15"

import rhinoscriptsyntax as rs

y = ["150","450",'750','1050','1350','1650','1950','2250','2550','2850','3150','3450','3750','4050','4350','4650','4950','5250','5550','5850','6150','6450','6750','7050','7350','7650','7950','8250','8550','8850','9150','9450','9750']
z = ['300','600','900','1200','1500','1800','2100','2400','2700','3000','3300','3600','3900','4200','4500','4800','5100','5400','5700','6000','6300','6600','6900','7200','7500','7800','8100','8400','8700','9000','9300','9600','9900']

if x in y:
    a = 1

if x in z:
    a = 0

if a == 0:
    d = e

if a == 1:
    c = e
# ---------- end ghpython_script_2 ----------
ghpython_script_3 = GhPythonScript(x=panel_2, e=curve_7)  # -> out, a, c, d; same code as ghpython_script_2
flatten_tree = FlattenTree(Tree=ghpython_script_2.c, Path="{0}")
flatten_tree_2 = FlattenTree(Tree=ghpython_script_2.d, Path="{0}")
flatten_tree_3 = FlattenTree(Tree=ghpython_script_3.c, Path="{0}")
flatten_tree_4 = FlattenTree(Tree=ghpython_script_3.d, Path="{0}")
clean_tree = CleanTree(RemoveNulls=True, RemoveInvalid=True, RemoveEmpty=False, Tree=flatten_tree_2)
clean_tree_2 = CleanTree(RemoveNulls=True, RemoveInvalid=True, RemoveEmpty=False, Tree=flatten_tree)
clean_tree_3 = CleanTree(RemoveNulls=True, RemoveInvalid=True, RemoveEmpty=False, Tree=flatten_tree_4)
clean_tree_4 = CleanTree(RemoveNulls=True, RemoveInvalid=True, RemoveEmpty=False, Tree=flatten_tree_3)
curve_8 = Curve(clean_tree)
curve_9 = Curve(clean_tree_2)
curve_10 = Curve(clean_tree_3)
curve_11 = Curve(clean_tree_4)
unit_z = UnitZ(Factor=37.5)
unit_z_2 = UnitZ(Factor=37.5)
curve_middle = CurveMiddle(Curve=curve_10)
move = Move(Geometry=curve_10, Motion=unit_z)  # -> Geometry, Transform
curve_middle_2 = CurveMiddle(Curve=curve_8)
move_2 = Move(Geometry=curve_8, Motion=unit_z_2)  # -> Geometry, Transform
evaluate_curve = EvaluateCurve(Curve=curve_10, Parameter=Slider(295, range=0..1500))  # -> Point, Tangent, Angle
evaluate_curve_2 = EvaluateCurve(Curve=curve_10, Parameter=Slider(295, range=0..1500))  # -> Point, Tangent, Angle
unit_z_3 = UnitZ(Factor=37.5)
curve_middle_3 = CurveMiddle(Curve=curve_11)
evaluate_curve_3 = EvaluateCurve(Curve=curve_8, Parameter=Slider(295, range=0..1500))  # -> Point, Tangent, Angle
evaluate_curve_4 = EvaluateCurve(Curve=curve_8, Parameter=Slider(295, range=0..1500))  # -> Point, Tangent, Angle
number_slider = Slider(300, range=0..1500)
curve_middle_4 = CurveMiddle(Curve=curve_9)
number_slider_2 = Slider(300, range=0..1500)
length_3 = Length(Curve=move.Geometry)
length_4 = Length(Curve=move.Geometry)
move1 = Move(Geometry=curve_9, Motion=unit_z_3)  # -> Geometry, Transform
length_5 = Length(Curve=move_2.Geometry)
evaluate_curve_5 = EvaluateCurve(Curve=curve_11, Parameter=Slider(295, range=0..1500))  # -> Point, Tangent, Angle
evaluate_curve_6 = EvaluateCurve(Curve=curve_11, Parameter=Slider(295, range=0..1500))  # -> Point, Tangent, Angle
subtraction = Subtraction(A=length_3, B=number_slider)
evaluate_curve_7 = EvaluateCurve(Curve=curve_9, Parameter=Slider(295, range=0..1500))  # -> Point, Tangent, Angle
addition = Addition(A=Slider(225, range=0..1500), B=number_slider)
evaluate_curve_8 = EvaluateCurve(Curve=curve_9, Parameter=Slider(295, range=0..1500))  # -> Point, Tangent, Angle
subtraction_2 = Subtraction(A=length_4, B=addition)
addition_2 = Addition(A=Slider(225, range=0..1500), B=number_slider_2)
subtraction_3 = Subtraction(A=length_5, B=Slider(300, range=0..1500))
evaluate_curve_9 = EvaluateCurve(Curve=move.Geometry, Parameter=subtraction)  # -> Point, Tangent, Angle
evaluate_curve_10 = EvaluateCurve(Curve=move.Geometry, Parameter=subtraction_2)  # -> Point, Tangent, Angle
evaluate_curve_11 = EvaluateCurve(Curve=move.Geometry, Parameter=Slider(375, range=0..1500))  # -> Point, Tangent, Angle
end_points = EndPoints(Curve=move.Geometry)  # -> Start, End
number_slider_3 = Slider(225, range=0..1500)
number_slider_4 = Slider(225, range=0..1500)
evaluate_curve_12 = EvaluateCurve(Curve=move_2.Geometry, Parameter=subtraction_3)  # -> Point, Tangent, Angle
evaluate_curve_13 = EvaluateCurve(Curve=move_2.Geometry, Parameter=Slider(300, range=0..1500))  # -> Point, Tangent, Angle
length_6 = Length(Curve=move1.Geometry)
length_7 = Length(Curve=move1.Geometry)
line = Line(StartPoint=end_points.End, EndPoint=evaluate_curve_9.Point)
line_2 = Line(StartPoint=evaluate_curve_11.Point, EndPoint=evaluate_curve_10.Point)
addition_3 = Addition(A=Slider(225, range=0..1500), B=number_slider_3)
subtraction_4 = Subtraction(A=length_6, B=number_slider_4)
addition_4 = Addition(A=Slider(225, range=0..1500), B=number_slider_4)
subtraction_5 = Subtraction(A=length_7, B=addition_4)
line_3 = Line(StartPoint=evaluate_curve_13.Point, EndPoint=evaluate_curve_12.Point)
evaluate_curve_14 = EvaluateCurve(Curve=move1.Geometry, Parameter=subtraction_4)  # -> Point, Tangent, Angle
evaluate_curve_15 = EvaluateCurve(Curve=move1.Geometry, Parameter=subtraction_5)  # -> Point, Tangent, Angle
evaluate_curve_16 = EvaluateCurve(Curve=move1.Geometry, Parameter=Slider(300, range=0..1500))  # -> Point, Tangent, Angle
end_points_2 = EndPoints(Curve=move1.Geometry)  # -> Start, End
offset_curve = OffsetCurve(Curve=line_2, Distance=Slider(-75, range=-75..0), Plane=PlaneXY(0, 0, 0), Corners=1)
offset_curve_2 = OffsetCurve(Curve=line_2, Distance=Slider(75, range=0..100), Plane=PlaneXY(0, 0, 0), Corners=1)
offset_curve_3 = OffsetCurve(Curve=line, Distance=Slider(75, range=0..100), Plane=PlaneXY(0, 0, 0), Corners=1)
offset_curve_4 = OffsetCurve(Curve=line, Distance=Slider(0, range=-75..0), Plane=PlaneXY(0, 0, 0), Corners=1)
line_4 = Line(StartPoint=evaluate_curve_16.Point, EndPoint=evaluate_curve_15.Point)
line_5 = Line(StartPoint=end_points_2.End, EndPoint=evaluate_curve_14.Point)
offset_curve_5 = OffsetCurve(Curve=line_3, Distance=Slider(-75, range=-75..0), Plane=PlaneXY(0, 0, 0), Corners=1)
offset_curve_6 = OffsetCurve(Curve=line_3, Distance=Slider(75, range=0..100), Plane=PlaneXY(0, 0, 0), Corners=1)
number_slider_5 = Slider(1, range=0..1)
number_slider_6 = Slider(1, range=0..1)
number_slider_7 = Slider(1, range=0..1)
number_slider_8 = Slider(1, range=0..1)
length_8 = Length(Curve=offset_curve)
length_9 = Length(Curve=offset_curve_4)
length_10 = Length(Curve=offset_curve_2)
length_11 = Length(Curve=offset_curve_3)
length_12 = Length(Curve=offset_curve_5)
length_13 = Length(Curve=offset_curve_6)
division = Division(A=length_8, B=Slider(300, range=0..1000))
division_2 = Division(A=length_10, B=Slider(300, range=0..1000))
division_3 = Division(A=length_9, B=Slider(300, range=0..1000))
division_4 = Division(A=length_11, B=Slider(300, range=0..1000))
offset_curve_7 = OffsetCurve(Curve=line_5, Distance=Slider(75, range=0..100), Plane=PlaneXY(0, 0, 0), Corners=1)
offset_curve_8 = OffsetCurve(Curve=line_5, Distance=Slider(0, range=-75..0), Plane=PlaneXY(0, 0, 0), Corners=1)
offset_curve_9 = OffsetCurve(Curve=line_4, Distance=Slider(-75, range=-75..0), Plane=PlaneXY(0, 0, 0), Corners=1)
offset_curve_10 = OffsetCurve(Curve=line_4, Distance=Slider(75, range=0..100), Plane=PlaneXY(0, 0, 0), Corners=1)
number_slider_9 = Slider(1, range=0..1)
number_slider_10 = Slider(1, range=0..1)
division_5 = Division(A=length_12, B=Slider(300, range=0..1000))
division_6 = Division(A=length_13, B=Slider(300, range=0..1000))
number_slider_11 = Slider(1, range=0..1)
number_slider_12 = Slider(1, range=0..1)
divide_curve = DivideCurve(Curve=offset_curve, Count=division, Kinks=False)  # -> Points, Tangents, Parameters
divide_curve_2 = DivideCurve(Curve=offset_curve_4, Count=division_3, Kinks=False)  # -> Points, Tangents, Parameters
divide_curve_3 = DivideCurve(Curve=offset_curve_2, Count=division_2, Kinks=False)  # -> Points, Tangents, Parameters
divide_curve_4 = DivideCurve(Curve=offset_curve_3, Count=division_4, Kinks=False)  # -> Points, Tangents, Parameters
divide_curve_5 = DivideCurve(Curve=offset_curve_5, Count=division_5, Kinks=False)  # -> Points, Tangents, Parameters
divide_curve_6 = DivideCurve(Curve=offset_curve_6, Count=division_6, Kinks=False)  # -> Points, Tangents, Parameters
length_14 = Length(Curve=offset_curve_9)
length_15 = Length(Curve=offset_curve_7)
length_16 = Length(Curve=offset_curve_8)
length_17 = Length(Curve=offset_curve_10)
line_6 = Line(StartPoint=divide_curve_3.Points, EndPoint=divide_curve.Points)
line_7 = Line(StartPoint=divide_curve.Points, EndPoint=divide_curve_3.Points)
line_8 = Line(StartPoint=divide_curve_2.Points, EndPoint=divide_curve_4.Points)
division_7 = Division(A=length_14, B=Slider(300, range=0..1000))
division_8 = Division(A=length_17, B=Slider(300, range=0..1000))
line_9 = Line(StartPoint=divide_curve_6.Points, EndPoint=divide_curve_5.Points)
division_9 = Division(A=length_15, B=Slider(300, range=0..1000))
division_10 = Division(A=length_16, B=Slider(300, range=0..1000))
line_10 = Line(StartPoint=divide_curve_5.Points, EndPoint=divide_curve_6.Points)
divide_curve_7 = DivideCurve(Curve=offset_curve_9, Count=division_7, Kinks=False)  # -> Points, Tangents, Parameters
divide_curve_8 = DivideCurve(Curve=offset_curve_10, Count=division_8, Kinks=False)  # -> Points, Tangents, Parameters
loft = Loft(Curves=line_6, Options={Adjust=False, Closed=False, LoftEnds=0, LoftSimp=0, LoftType=0, Rebuild=10, Refit=0.01})
loft_2 = Loft(Curves=line_7, Options={Adjust=False, Closed=False, LoftEnds=0, LoftSimp=0, LoftType=0, Rebuild=10, Refit=0.01})
loft_3 = Loft(Curves=line_8, Options={Adjust=False, Closed=False, LoftEnds=0, LoftSimp=0, LoftType=0, Rebuild=10, Refit=0.01})
divide_curve_9 = DivideCurve(Curve=offset_curve_7, Count=division_9, Kinks=False)  # -> Points, Tangents, Parameters
divide_curve_10 = DivideCurve(Curve=offset_curve_8, Count=division_10, Kinks=False)  # -> Points, Tangents, Parameters
loft_4 = Loft(Curves=line_9, Options={Adjust=False, Closed=False, LoftEnds=0, LoftSimp=0, LoftType=0, Rebuild=10, Refit=0.01})
loft_5 = Loft(Curves=line_10, Options={Adjust=False, Closed=False, LoftEnds=0, LoftSimp=0, LoftType=0, Rebuild=10, Refit=0.01})
radians = Radians(Degrees=90)
radians_2 = Radians(Degrees=90)
surface_closest_point = SurfaceClosestPoint(Point=divide_curve_3.Points, Surface=loft)  # -> Point, UVPoint, Distance
surface_closest_point_2 = SurfaceClosestPoint(Point=divide_curve.Points, Surface=loft_2)  # -> Point, UVPoint, Distance
surface_closest_point_3 = SurfaceClosestPoint(Point=divide_curve_2.Points, Surface=loft_3)  # -> Point, UVPoint, Distance
radians_3 = Radians(Degrees=90)
radians_4 = Radians(Degrees=90)
surface_closest_point_4 = SurfaceClosestPoint(Point=divide_curve_6.Points, Surface=loft_4)  # -> Point, UVPoint, Distance
surface_closest_point_5 = SurfaceClosestPoint(Point=divide_curve_5.Points, Surface=loft_5)  # -> Point, UVPoint, Distance
line_11 = Line(StartPoint=divide_curve_8.Points, EndPoint=divide_curve_7.Points)
line_12 = Line(StartPoint=divide_curve_7.Points, EndPoint=divide_curve_8.Points)
line_13 = Line(StartPoint=divide_curve_10.Points, EndPoint=divide_curve_9.Points)
evaluate_surface = EvaluateSurface(Surface=loft, Point=surface_closest_point.UVPoint)  # -> Point, Normal, UDirection, VDirection, Frame
evaluate_surface_2 = EvaluateSurface(Surface=loft_2, Point=surface_closest_point_2.UVPoint)  # -> Point, Normal, UDirection, VDirection, Frame
evaluate_surface_3 = EvaluateSurface(Surface=loft_3, Point=surface_closest_point_3.UVPoint)  # -> Point, Normal, UDirection, VDirection, Frame
radians_5 = Radians(Degrees=90)
radians_6 = Radians(Degrees=90)
radians_7 = Radians(Degrees=90)
radians_8 = Radians(Degrees=90)
evaluate_surface_4 = EvaluateSurface(Surface=loft_4, Point=surface_closest_point_4.UVPoint)  # -> Point, Normal, UDirection, VDirection, Frame
evaluate_surface_5 = EvaluateSurface(Surface=loft_5, Point=surface_closest_point_5.UVPoint)  # -> Point, Normal, UDirection, VDirection, Frame
radians_9 = Radians(Degrees=90)
radians_10 = Radians(Degrees=90)
radians_11 = Radians(Degrees=90)
radians_12 = Radians(Degrees=90)
number_slider_13 = Slider(470, range=0..2000)
radians_13 = Radians(Degrees=90)
radians_14 = Radians(Degrees=90)
loft_6 = Loft(Curves=line_11, Options={Adjust=False, Closed=False, LoftEnds=0, LoftSimp=0, LoftType=0, Rebuild=10, Refit=0.01})
loft_7 = Loft(Curves=line_12, Options={Adjust=False, Closed=False, LoftEnds=0, LoftSimp=0, LoftType=0, Rebuild=10, Refit=0.01})
loft_8 = Loft(Curves=line_13, Options={Adjust=False, Closed=False, LoftEnds=0, LoftSimp=0, LoftType=0, Rebuild=10, Refit=0.01})
radians_15 = Radians(Degrees=90)
radians_16 = Radians(Degrees=90)
number_slider_14 = Slider(470, range=0..2000)
radians_17 = Radians(Degrees=90)
radians_18 = Radians(Degrees=90)
rotate_plane = RotatePlane(Plane=evaluate_surface_3.Frame, Angle=radians_5)
rotate_plane_2 = RotatePlane(Plane=evaluate_surface.Frame, Angle=radians_10)
rotate_plane_3 = RotatePlane(Plane=evaluate_surface_2.Frame, Angle=radians_11)
surface_closest_point_6 = SurfaceClosestPoint(Point=divide_curve_8.Points, Surface=loft_6)  # -> Point, UVPoint, Distance
surface_closest_point_7 = SurfaceClosestPoint(Point=divide_curve_7.Points, Surface=loft_7)  # -> Point, UVPoint, Distance
surface_closest_point_8 = SurfaceClosestPoint(Point=divide_curve_10.Points, Surface=loft_8)  # -> Point, UVPoint, Distance
rotate_plane_4 = RotatePlane(Plane=evaluate_surface_4.Frame, Angle=radians_17)
rotate_plane_5 = RotatePlane(Plane=evaluate_surface_5.Frame, Angle=radians_18)
number_slider_15 = Slider(470, range=0..2000)
number_slider_16 = Slider(470, range=0..2000)
radians_19 = Radians(Degrees=90)
number_slider_17 = Slider(75, range=0..100)
evaluate_surface_6 = EvaluateSurface(Surface=loft_6, Point=surface_closest_point_6.UVPoint)  # -> Point, Normal, UDirection, VDirection, Frame
evaluate_surface_7 = EvaluateSurface(Surface=loft_7, Point=surface_closest_point_7.UVPoint)  # -> Point, Normal, UDirection, VDirection, Frame
evaluate_surface_8 = EvaluateSurface(Surface=loft_8, Point=surface_closest_point_8.UVPoint)  # -> Point, Normal, UDirection, VDirection, Frame
radians_20 = Radians(Degrees=90)
addition_5 = Addition(A=number_slider_13, B=150)
radians_21 = Radians(Degrees=90)
radians_22 = Radians(Degrees=90)
radians_23 = Radians(Degrees=90)
radians_24 = Radians(Degrees=90)
number_slider_18 = Slider(75, range=0..100)
addition_6 = Addition(A=number_slider_13, B=150)
addition_7 = Addition(A=number_slider_14, B=150)
radians_25 = Radians(Degrees=90)
radians_26 = Radians(Degrees=90)
radians_27 = Radians(Degrees=90)
radians_28 = Radians(Degrees=90)
addition_8 = Addition(A=number_slider_14, B=150)
rotate_plane_6 = RotatePlane(Plane=evaluate_surface_8.Frame, Angle=radians_20)
rotate_plane_7 = RotatePlane(Plane=evaluate_surface_6.Frame, Angle=radians_25)
rotate_plane_8 = RotatePlane(Plane=evaluate_surface_7.Frame, Angle=radians_26)
list_item = ListItem(List=rotate_plane, Index=1, Wrap=True)
division_11 = Division(A=Slider(75, range=0..100), B=2)
division_12 = Division(A=number_slider_17, B=2)
addition_9 = Addition(A=Slider(85, range=0..100), B=division_12)
unit_z_4 = UnitZ(Factor=addition_9)
move_3 = Move(Geometry=curve_10, Motion=unit_z_4)  # -> Geometry, Transform
length_18 = Length(Curve=move_3.Geometry)
subtraction_6 = Subtraction(A=length_18, B=Slider(300, range=0..1500))
evaluate_curve_17 = EvaluateCurve(Curve=move_3.Geometry, Parameter=subtraction_6)  # -> Point, Tangent, Angle
evaluate_curve_18 = EvaluateCurve(Curve=move_3.Geometry, Parameter=Slider(300, range=0..1500))  # -> Point, Tangent, Angle
line_14 = Line(StartPoint=evaluate_curve_18.Point, EndPoint=evaluate_curve_17.Point)
offset_curve_11 = OffsetCurve(Curve=line_14, Distance=Slider(-75, range=-75..0), Plane=PlaneXY(0, 0, 0), Corners=1)
offset_curve_12 = OffsetCurve(Curve=line_14, Distance=Slider(75, range=0..100), Plane=PlaneXY(0, 0, 0), Corners=1)
length_19 = Length(Curve=offset_curve_11)
length_20 = Length(Curve=offset_curve_12)
division_13 = Division(A=length_19, B=Slider(300, range=0..1000))
division_14 = Division(A=length_20, B=Slider(300, range=0..1000))
divide_curve_11 = DivideCurve(Curve=offset_curve_11, Count=division_13, Kinks=False)  # -> Points, Tangents, Parameters
divide_curve_12 = DivideCurve(Curve=offset_curve_12, Count=division_14, Kinks=False)  # -> Points, Tangents, Parameters
line_15 = Line(StartPoint=divide_curve_12.Points, EndPoint=divide_curve_11.Points)
line_16 = Line(StartPoint=divide_curve_11.Points, EndPoint=divide_curve_12.Points)
loft_9 = Loft(Curves=line_15, Options={Adjust=False, Closed=False, LoftEnds=0, LoftSimp=0, LoftType=0, Rebuild=10, Refit=0.01})
loft_10 = Loft(Curves=line_16, Options={Adjust=False, Closed=False, LoftEnds=0, LoftSimp=0, LoftType=0, Rebuild=10, Refit=0.01})
surface_closest_point_9 = SurfaceClosestPoint(Point=divide_curve_12.Points, Surface=loft_9)  # -> Point, UVPoint, Distance
surface_closest_point_10 = SurfaceClosestPoint(Point=divide_curve_11.Points, Surface=loft_10)  # -> Point, UVPoint, Distance
evaluate_surface_9 = EvaluateSurface(Surface=loft_9, Point=surface_closest_point_9.UVPoint)  # -> Point, Normal, UDirection, VDirection, Frame
evaluate_surface_10 = EvaluateSurface(Surface=loft_10, Point=surface_closest_point_10.UVPoint)  # -> Point, Normal, UDirection, VDirection, Frame
rotate_plane_9 = RotatePlane(Plane=evaluate_surface_9.Frame, Angle=radians_13)
rotate_plane_10 = RotatePlane(Plane=evaluate_surface_10.Frame, Angle=radians_14)
division_15 = Division(A=Slider(290, range=0..1000), B=2)
division_16 = Division(A=Slider(140, range=0..1000), B=2)
division_17 = Division(A=Slider(140, range=0..1000), B=2)
division_18 = Division(A=Slider(290, range=0..1000), B=2)
division_19 = Division(A=Slider(75, range=0..100), B=2)
division_20 = Division(A=Slider(140, range=0..1000), B=2)
division_21 = Division(A=Slider(290, range=0..1000), B=2)
addition_10 = Addition(A=number_slider_15, B=150)
addition_11 = Addition(A=number_slider_15, B=150)
division_22 = Division(A=Slider(75, range=0..100), B=2)
addition_12 = Addition(A=Slider(85, range=0..100), B=division_22)
unit_z_5 = UnitZ(Factor=addition_12)
move_4 = Move(Geometry=curve_8, Motion=unit_z_5)  # -> Geometry, Transform
length_21 = Length(Curve=move_4.Geometry)
length_22 = Length(Curve=move_4.Geometry)
subtraction_7 = Subtraction(A=length_21, B=number_slider_2)
subtraction_8 = Subtraction(A=length_22, B=addition_2)
evaluate_curve_19 = EvaluateCurve(Curve=move_4.Geometry, Parameter=subtraction_7)  # -> Point, Tangent, Angle
evaluate_curve_20 = EvaluateCurve(Curve=move_4.Geometry, Parameter=subtraction_8)  # -> Point, Tangent, Angle
evaluate_curve_21 = EvaluateCurve(Curve=move_4.Geometry, Parameter=Slider(375, range=0..1500))  # -> Point, Tangent, Angle
end_points_3 = EndPoints(Curve=move_4.Geometry)  # -> Start, End
line_17 = Line(StartPoint=end_points_3.End, EndPoint=evaluate_curve_19.Point)
line_18 = Line(StartPoint=evaluate_curve_21.Point, EndPoint=evaluate_curve_20.Point)
offset_curve_13 = OffsetCurve(Curve=line_18, Distance=Slider(-75, range=-75..0), Plane=PlaneXY(0, 0, 0), Corners=1)
offset_curve_14 = OffsetCurve(Curve=line_18, Distance=Slider(75, range=0..100), Plane=PlaneXY(0, 0, 0), Corners=1)
offset_curve_15 = OffsetCurve(Curve=line_17, Distance=Slider(75, range=0..100), Plane=PlaneXY(0, 0, 0), Corners=1)
offset_curve_16 = OffsetCurve(Curve=line_17, Distance=Slider(0, range=-75..0), Plane=PlaneXY(0, 0, 0), Corners=1)
length_23 = Length(Curve=offset_curve_13)
length_24 = Length(Curve=offset_curve_16)
length_25 = Length(Curve=offset_curve_14)
length_26 = Length(Curve=offset_curve_15)
division_23 = Division(A=length_23, B=Slider(300, range=0..1000))
division_24 = Division(A=length_25, B=Slider(300, range=0..1000))
division_25 = Division(A=length_24, B=Slider(300, range=0..1000))
division_26 = Division(A=length_26, B=Slider(300, range=0..1000))
divide_curve_13 = DivideCurve(Curve=offset_curve_13, Count=division_23, Kinks=False)  # -> Points, Tangents, Parameters
divide_curve_14 = DivideCurve(Curve=offset_curve_16, Count=division_25, Kinks=False)  # -> Points, Tangents, Parameters
divide_curve_15 = DivideCurve(Curve=offset_curve_14, Count=division_24, Kinks=False)  # -> Points, Tangents, Parameters
divide_curve_16 = DivideCurve(Curve=offset_curve_15, Count=division_26, Kinks=False)  # -> Points, Tangents, Parameters
line_19 = Line(StartPoint=divide_curve_15.Points, EndPoint=divide_curve_13.Points)
line_20 = Line(StartPoint=divide_curve_13.Points, EndPoint=divide_curve_15.Points)
line_21 = Line(StartPoint=divide_curve_14.Points, EndPoint=divide_curve_16.Points)
loft_11 = Loft(Curves=line_19, Options={Adjust=False, Closed=False, LoftEnds=0, LoftSimp=0, LoftType=0, Rebuild=10, Refit=0.01})
loft_12 = Loft(Curves=line_20, Options={Adjust=False, Closed=False, LoftEnds=0, LoftSimp=0, LoftType=0, Rebuild=10, Refit=0.01})
loft_13 = Loft(Curves=line_21, Options={Adjust=False, Closed=False, LoftEnds=0, LoftSimp=0, LoftType=0, Rebuild=10, Refit=0.01})
surface_closest_point_11 = SurfaceClosestPoint(Point=divide_curve_15.Points, Surface=loft_11)  # -> Point, UVPoint, Distance
surface_closest_point_12 = SurfaceClosestPoint(Point=divide_curve_13.Points, Surface=loft_12)  # -> Point, UVPoint, Distance
surface_closest_point_13 = SurfaceClosestPoint(Point=divide_curve_14.Points, Surface=loft_13)  # -> Point, UVPoint, Distance
evaluate_surface_11 = EvaluateSurface(Surface=loft_11, Point=surface_closest_point_11.UVPoint)  # -> Point, Normal, UDirection, VDirection, Frame
evaluate_surface_12 = EvaluateSurface(Surface=loft_12, Point=surface_closest_point_12.UVPoint)  # -> Point, Normal, UDirection, VDirection, Frame
evaluate_surface_13 = EvaluateSurface(Surface=loft_13, Point=surface_closest_point_13.UVPoint)  # -> Point, Normal, UDirection, VDirection, Frame
rotate_plane_11 = RotatePlane(Plane=evaluate_surface_13.Frame, Angle=radians_8)
rotate_plane_12 = RotatePlane(Plane=evaluate_surface_11.Frame, Angle=radians_15)
rotate_plane_13 = RotatePlane(Plane=evaluate_surface_12.Frame, Angle=radians_16)
list_item_2 = ListItem(List=rotate_plane_11, Index=1, Wrap=True)
division_27 = Division(A=number_slider_18, B=2)
division_28 = Division(A=Slider(290, range=0..1000), B=2)
division_29 = Division(A=Slider(140, range=0..1000), B=2)
division_30 = Division(A=Slider(140, range=0..1000), B=2)
division_31 = Division(A=Slider(290, range=0..1000), B=2)
division_32 = Division(A=Slider(75, range=0..100), B=2)
division_33 = Division(A=Slider(140, range=0..1000), B=2)
division_34 = Division(A=Slider(290, range=0..1000), B=2)
addition_13 = Addition(A=number_slider_16, B=150)
addition_14 = Addition(A=number_slider_16, B=150)
number_slider_19 = Slider(75, range=0..100)
number_slider_20 = Slider(75, range=0..100)
center_box = CenterBox(Base=[rotate_plane_9, rotate_plane_10], X=division_17, Y=division_18, Z=division_12)
center_box_2 = CenterBox(Base=list_item, X=division_15, Y=division_16, Z=division_11)
center_box_3 = CenterBox(Base=[rotate_plane_2, rotate_plane_3], X=division_20, Y=division_21, Z=division_19)
center_box_4 = CenterBox(Base=[rotate_plane_4, rotate_plane_5], X=division_30, Y=division_31, Z=division_27)
center_box_5 = CenterBox(Base=list_item_2, X=division_28, Y=division_29, Z=division_22)
center_box_6 = CenterBox(Base=[rotate_plane_12, rotate_plane_13], X=division_33, Y=division_34, Z=division_32)
division_35 = Division(A=Slider(75, range=0..100), B=2)
unit_z_6 = UnitZ(Factor=division_35)
move_5 = Move(Geometry=curve_11, Motion=unit_z_6)  # -> Geometry, Transform
length_27 = Length(Curve=move_5.Geometry)
subtraction_9 = Subtraction(A=length_27, B=Slider(375, range=0..1500))
evaluate_curve_22 = EvaluateCurve(Curve=move_5.Geometry, Parameter=subtraction_9)  # -> Point, Tangent, Angle
evaluate_curve_23 = EvaluateCurve(Curve=move_5.Geometry, Parameter=Slider(375, range=0..1500))  # -> Point, Tangent, Angle
line_22 = Line(StartPoint=evaluate_curve_23.Point, EndPoint=evaluate_curve_22.Point)
offset_curve_17 = OffsetCurve(Curve=line_22, Distance=Slider(-75, range=-75..0), Plane=PlaneXY(0, 0, 0), Corners=1)
offset_curve_18 = OffsetCurve(Curve=line_22, Distance=Slider(75, range=0..100), Plane=PlaneXY(0, 0, 0), Corners=1)
length_28 = Length(Curve=offset_curve_17)
length_29 = Length(Curve=offset_curve_18)
division_36 = Division(A=length_28, B=Slider(300, range=0..1000))
division_37 = Division(A=length_29, B=Slider(300, range=0..1000))
divide_curve_17 = DivideCurve(Curve=offset_curve_17, Count=division_36, Kinks=False)  # -> Points, Tangents, Parameters
divide_curve_18 = DivideCurve(Curve=offset_curve_18, Count=division_37, Kinks=False)  # -> Points, Tangents, Parameters
line_23 = Line(StartPoint=divide_curve_18.Points, EndPoint=divide_curve_17.Points)
line_24 = Line(StartPoint=divide_curve_17.Points, EndPoint=divide_curve_18.Points)
loft_14 = Loft(Curves=line_23, Options={Adjust=False, Closed=False, LoftEnds=0, LoftSimp=0, LoftType=0, Rebuild=10, Refit=0.01})
loft_15 = Loft(Curves=line_24, Options={Adjust=False, Closed=False, LoftEnds=0, LoftSimp=0, LoftType=0, Rebuild=10, Refit=0.01})
surface_closest_point_14 = SurfaceClosestPoint(Point=divide_curve_18.Points, Surface=loft_14)  # -> Point, UVPoint, Distance
surface_closest_point_15 = SurfaceClosestPoint(Point=divide_curve_17.Points, Surface=loft_15)  # -> Point, UVPoint, Distance
evaluate_surface_14 = EvaluateSurface(Surface=loft_14, Point=surface_closest_point_14.UVPoint)  # -> Point, Normal, UDirection, VDirection, Frame
evaluate_surface_15 = EvaluateSurface(Surface=loft_15, Point=surface_closest_point_15.UVPoint)  # -> Point, Normal, UDirection, VDirection, Frame
rotate_plane_14 = RotatePlane(Plane=evaluate_surface_14.Frame, Angle=radians_23)
rotate_plane_15 = RotatePlane(Plane=evaluate_surface_15.Frame, Angle=radians_24)
division_38 = Division(A=Slider(140, range=0..1000), B=2)
division_39 = Division(A=Slider(290, range=0..1000), B=2)
division_40 = Division(A=number_slider_19, B=2)
addition_15 = Addition(A=Slider(85, range=0..100), B=division_40)
unit_z_7 = UnitZ(Factor=addition_15)
move1_2 = Move(Geometry=curve_11, Motion=unit_z_7)  # -> Geometry, Transform
length_30 = Length(Curve=move1_2.Geometry)
length_31 = Length(Curve=move1_2.Geometry)
subtraction_10 = Subtraction(A=length_30, B=number_slider_3)
subtraction_11 = Subtraction(A=length_31, B=addition_3)
evaluate_curve_24 = EvaluateCurve(Curve=move1_2.Geometry, Parameter=subtraction_10)  # -> Point, Tangent, Angle
evaluate_curve_25 = EvaluateCurve(Curve=move1_2.Geometry, Parameter=subtraction_11)  # -> Point, Tangent, Angle
evaluate_curve_26 = EvaluateCurve(Curve=move1_2.Geometry, Parameter=Slider(300, range=0..1500))  # -> Point, Tangent, Angle
end_points_4 = EndPoints(Curve=move1_2.Geometry)  # -> Start, End
line_25 = Line(StartPoint=evaluate_curve_26.Point, EndPoint=evaluate_curve_25.Point)
line_26 = Line(StartPoint=end_points_4.End, EndPoint=evaluate_curve_24.Point)
offset_curve_19 = OffsetCurve(Curve=line_26, Distance=Slider(75, range=0..100), Plane=PlaneXY(0, 0, 0), Corners=1)
offset_curve_20 = OffsetCurve(Curve=line_26, Distance=Slider(0, range=-75..0), Plane=PlaneXY(0, 0, 0), Corners=1)
offset_curve_21 = OffsetCurve(Curve=line_25, Distance=Slider(-75, range=-75..0), Plane=PlaneXY(0, 0, 0), Corners=1)
offset_curve_22 = OffsetCurve(Curve=line_25, Distance=Slider(75, range=0..100), Plane=PlaneXY(0, 0, 0), Corners=1)
length_32 = Length(Curve=offset_curve_21)
length_33 = Length(Curve=offset_curve_19)
length_34 = Length(Curve=offset_curve_20)
length_35 = Length(Curve=offset_curve_22)
division_41 = Division(A=length_32, B=Slider(300, range=0..1000))
division_42 = Division(A=length_35, B=Slider(300, range=0..1000))
division_43 = Division(A=length_33, B=Slider(300, range=0..1000))
division_44 = Division(A=length_34, B=Slider(300, range=0..1000))
divide_curve_19 = DivideCurve(Curve=offset_curve_21, Count=division_41, Kinks=False)  # -> Points, Tangents, Parameters
divide_curve_20 = DivideCurve(Curve=offset_curve_22, Count=division_42, Kinks=False)  # -> Points, Tangents, Parameters
divide_curve_21 = DivideCurve(Curve=offset_curve_19, Count=division_43, Kinks=False)  # -> Points, Tangents, Parameters
divide_curve_22 = DivideCurve(Curve=offset_curve_20, Count=division_44, Kinks=False)  # -> Points, Tangents, Parameters
line_27 = Line(StartPoint=divide_curve_20.Points, EndPoint=divide_curve_19.Points)
line_28 = Line(StartPoint=divide_curve_19.Points, EndPoint=divide_curve_20.Points)
line_29 = Line(StartPoint=divide_curve_22.Points, EndPoint=divide_curve_21.Points)
loft_16 = Loft(Curves=line_27, Options={Adjust=False, Closed=False, LoftEnds=0, LoftSimp=0, LoftType=0, Rebuild=10, Refit=0.01})
loft_17 = Loft(Curves=line_28, Options={Adjust=False, Closed=False, LoftEnds=0, LoftSimp=0, LoftType=0, Rebuild=10, Refit=0.01})
loft_18 = Loft(Curves=line_29, Options={Adjust=False, Closed=False, LoftEnds=0, LoftSimp=0, LoftType=0, Rebuild=10, Refit=0.01})
surface_closest_point_16 = SurfaceClosestPoint(Point=divide_curve_20.Points, Surface=loft_16)  # -> Point, UVPoint, Distance
surface_closest_point_17 = SurfaceClosestPoint(Point=divide_curve_19.Points, Surface=loft_17)  # -> Point, UVPoint, Distance
surface_closest_point_18 = SurfaceClosestPoint(Point=divide_curve_22.Points, Surface=loft_18)  # -> Point, UVPoint, Distance
evaluate_surface_16 = EvaluateSurface(Surface=loft_16, Point=surface_closest_point_16.UVPoint)  # -> Point, Normal, UDirection, VDirection, Frame
evaluate_surface_17 = EvaluateSurface(Surface=loft_17, Point=surface_closest_point_17.UVPoint)  # -> Point, Normal, UDirection, VDirection, Frame
evaluate_surface_18 = EvaluateSurface(Surface=loft_18, Point=surface_closest_point_18.UVPoint)  # -> Point, Normal, UDirection, VDirection, Frame
rotate_plane_16 = RotatePlane(Plane=evaluate_surface_18.Frame, Angle=radians_19)
rotate_plane_17 = RotatePlane(Plane=evaluate_surface_16.Frame, Angle=radians_21)
rotate_plane_18 = RotatePlane(Plane=evaluate_surface_17.Frame, Angle=radians_22)
list_item_3 = ListItem(List=rotate_plane_16, Index=1, Wrap=True)
division_45 = Division(A=Slider(290, range=0..1000), B=2)
division_46 = Division(A=Slider(140, range=0..1000), B=2)
division_47 = Division(A=Slider(75, range=0..100), B=2)
division_48 = Division(A=Slider(140, range=0..1000), B=2)
division_49 = Division(A=Slider(290, range=0..1000), B=2)
division_50 = Division(A=Slider(75, range=0..100), B=2)
addition_16 = Addition(A=Slider(85, range=0..100), B=division_50)
unit_z_8 = UnitZ(Factor=addition_16)
move_6 = Move(Geometry=curve_9, Motion=unit_z_8)  # -> Geometry, Transform
length_36 = Length(Curve=move_6.Geometry)
subtraction_12 = Subtraction(A=length_36, B=Slider(375, range=0..1500))
evaluate_curve_27 = EvaluateCurve(Curve=move_6.Geometry, Parameter=subtraction_12)  # -> Point, Tangent, Angle
evaluate_curve_28 = EvaluateCurve(Curve=move_6.Geometry, Parameter=Slider(375, range=0..1500))  # -> Point, Tangent, Angle
line_30 = Line(StartPoint=evaluate_curve_28.Point, EndPoint=evaluate_curve_27.Point)
offset_curve_23 = OffsetCurve(Curve=line_30, Distance=Slider(-75, range=-75..0), Plane=PlaneXY(0, 0, 0), Corners=1)
offset_curve_24 = OffsetCurve(Curve=line_30, Distance=Slider(75, range=0..100), Plane=PlaneXY(0, 0, 0), Corners=1)
length_37 = Length(Curve=offset_curve_23)
length_38 = Length(Curve=offset_curve_24)
division_51 = Division(A=length_37, B=Slider(300, range=0..1000))
division_52 = Division(A=length_38, B=Slider(300, range=0..1000))
divide_curve_23 = DivideCurve(Curve=offset_curve_23, Count=division_51, Kinks=False)  # -> Points, Tangents, Parameters
divide_curve_24 = DivideCurve(Curve=offset_curve_24, Count=division_52, Kinks=False)  # -> Points, Tangents, Parameters
line_31 = Line(StartPoint=divide_curve_24.Points, EndPoint=divide_curve_23.Points)
line_32 = Line(StartPoint=divide_curve_23.Points, EndPoint=divide_curve_24.Points)
loft_19 = Loft(Curves=line_31, Options={Adjust=False, Closed=False, LoftEnds=0, LoftSimp=0, LoftType=0, Rebuild=10, Refit=0.01})
loft_20 = Loft(Curves=line_32, Options={Adjust=False, Closed=False, LoftEnds=0, LoftSimp=0, LoftType=0, Rebuild=10, Refit=0.01})
surface_closest_point_19 = SurfaceClosestPoint(Point=divide_curve_24.Points, Surface=loft_19)  # -> Point, UVPoint, Distance
surface_closest_point_20 = SurfaceClosestPoint(Point=divide_curve_23.Points, Surface=loft_20)  # -> Point, UVPoint, Distance
evaluate_surface_19 = EvaluateSurface(Surface=loft_19, Point=surface_closest_point_19.UVPoint)  # -> Point, Normal, UDirection, VDirection, Frame
evaluate_surface_20 = EvaluateSurface(Surface=loft_20, Point=surface_closest_point_20.UVPoint)  # -> Point, Normal, UDirection, VDirection, Frame
rotate_plane_19 = RotatePlane(Plane=evaluate_surface_19.Frame, Angle=radians_27)
rotate_plane_20 = RotatePlane(Plane=evaluate_surface_20.Frame, Angle=radians_28)
division_53 = Division(A=Slider(140, range=0..1000), B=2)
division_54 = Division(A=Slider(290, range=0..1000), B=2)
list_item_4 = ListItem(List=rotate_plane_6, Index=1, Wrap=True)
division_55 = Division(A=number_slider_20, B=2)
division_56 = Division(A=Slider(290, range=0..1000), B=2)
division_57 = Division(A=Slider(140, range=0..1000), B=2)
division_58 = Division(A=Slider(75, range=0..100), B=2)
division_59 = Division(A=Slider(140, range=0..1000), B=2)
division_60 = Division(A=Slider(290, range=0..1000), B=2)
center_box_7 = CenterBox(Base=[rotate_plane_14, rotate_plane_15], X=division_38, Y=division_39, Z=division_35)
center_box_8 = CenterBox(Base=list_item_3, X=division_45, Y=division_46, Z=division_40)
center_box_9 = CenterBox(Base=[rotate_plane_17, rotate_plane_18], X=division_48, Y=division_49, Z=division_47)
unit_z_9 = UnitZ(Factor=Slider(170, range=0..1000))
center_box_10 = CenterBox(Base=[rotate_plane_19, rotate_plane_20], X=division_53, Y=division_54, Z=division_50)
number_slider_21 = Slider(9, range=0..20)
number_slider_22 = Slider(9, range=0..20)
addition_17 = Addition(A=number_slider_22, B=number_slider_21)
multiplication = Multiplication(A=addition_17, B=number_slider_17)
multiplication_2 = Multiplication(A=addition_17, B=Slider(10, range=0..10))
addition_18 = Addition(A=multiplication, B=multiplication_2)
subtraction_13 = Subtraction(A=addition_18, B=10)
unit_z_10 = UnitZ(Factor=subtraction_13)
move_7 = Move(Geometry=curve_middle, Motion=unit_z_10)  # -> Geometry, Transform
move_8 = Move(Geometry=evaluate_curve.Point, Motion=unit_z_10)  # -> Geometry, Transform
move_9 = Move(Geometry=evaluate_curve_2.Point, Motion=unit_z_10)  # -> Geometry, Transform
line_33 = Line(StartPoint=move_8.Geometry, EndPoint=move_7.Geometry)
line_34 = Line(StartPoint=move_9.Geometry, EndPoint=move_7.Geometry)
offset_curve_25 = OffsetCurve(Curve=line_33, Distance=Slider(0, range=0..145), Plane=PlaneXY(0, 0, 0), Corners=1)
offset_curve_26 = OffsetCurve(Curve=line_33, Distance=Slider(145, range=0..1000), Plane=PlaneXY(0, 0, 0), Corners=1)
offset_curve_27 = OffsetCurve(Curve=line_34, Distance=Slider(-145, range=-150..0), Plane=PlaneXY(0, 0, 0), Corners=1)
offset_curve_28 = OffsetCurve(Curve=line_34, Distance=Slider(145, range=0..1000), Plane=PlaneXY(0, 0, 0), Corners=1)
divide_curve_25 = DivideCurve(Curve=offset_curve_25, Count=number_slider_5, Kinks=False)  # -> Points, Tangents, Parameters
divide_curve_26 = DivideCurve(Curve=offset_curve_26, Count=number_slider_5, Kinks=False)  # -> Points, Tangents, Parameters
divide_curve_27 = DivideCurve(Curve=offset_curve_27, Count=number_slider_6, Kinks=False)  # -> Points, Tangents, Parameters
divide_curve_28 = DivideCurve(Curve=offset_curve_28, Count=number_slider_6, Kinks=False)  # -> Points, Tangents, Parameters
line_35 = Line(StartPoint=divide_curve_26.Points, EndPoint=divide_curve_25.Points)
line_36 = Line(StartPoint=divide_curve_28.Points, EndPoint=divide_curve_27.Points)
loft_21 = Loft(Curves=line_35, Options={Adjust=False, Closed=False, LoftEnds=0, LoftSimp=0, LoftType=0, Rebuild=10, Refit=0.01})
loft_22 = Loft(Curves=line_36, Options={Adjust=False, Closed=False, LoftEnds=0, LoftSimp=0, LoftType=0, Rebuild=10, Refit=0.01})
surface_closest_point_21 = SurfaceClosestPoint(Point=divide_curve_26.Points, Surface=loft_21)  # -> Point, UVPoint, Distance
surface_closest_point_22 = SurfaceClosestPoint(Point=divide_curve_27.Points, Surface=loft_22)  # -> Point, UVPoint, Distance
evaluate_surface_21 = EvaluateSurface(Surface=loft_21, Point=surface_closest_point_21.UVPoint)  # -> Point, Normal, UDirection, VDirection, Frame
evaluate_surface_22 = EvaluateSurface(Surface=loft_22, Point=surface_closest_point_22.UVPoint)  # -> Point, Normal, UDirection, VDirection, Frame
rotate_plane_21 = RotatePlane(Plane=evaluate_surface_21.Frame, Angle=radians)
rotate_plane_22 = RotatePlane(Plane=evaluate_surface_22.Frame, Angle=radians_2)
deconstruct_plane = DeconstructPlane(Plane=rotate_plane_21)  # -> Origin, XAxis, YAxis, ZAxis
deconstruct_plane_2 = DeconstructPlane(Plane=rotate_plane_22)  # -> Origin, XAxis, YAxis, ZAxis
rotate_3d = Rotate3D(Geometry=rotate_plane_21, Angle=1.570796327, Center=deconstruct_plane.Origin, Axis=deconstruct_plane.YAxis)  # -> Geometry, Transform
rotate_3d_2 = Rotate3D(Geometry=rotate_plane_22, Angle=1.570796327, Center=deconstruct_plane_2.Origin, Axis=deconstruct_plane_2.YAxis)  # -> Geometry, Transform
list_item_5 = ListItem(List=rotate_3d.Geometry, Index=1, Wrap=True)
list_item_6 = ListItem(List=rotate_3d_2.Geometry, Index=1, Wrap=True)
ellipse = Ellipse(Plane=list_item_5, Radius1=addition_5, Radius2=line_33)  # -> Ellipse, Focus1, Focus2
ellipse_2 = Ellipse(Plane=list_item_6, Radius1=addition_6, Radius2=line_34)  # -> Ellipse, Focus1, Focus2
sub_curve = SubCurve(BaseCurve=reparameterize(ellipse.Ellipse), Domain="0.25 to  0.75")
sub_curve_2 = SubCurve(BaseCurve=reparameterize(ellipse_2.Ellipse), Domain="0.25 to  0.75")
flatten_tree_5 = FlattenTree(Tree=sub_curve_2, Path="{0}")
flatten_tree_6 = FlattenTree(Tree=sub_curve, Path="{0}")
graft_tree = GraftTree(Tree=flatten_tree_5, IncludeEmptyLists=True, IncludeNullItems=True)
graft_tree_2 = GraftTree(Tree=flatten_tree_6, IncludeEmptyLists=True, IncludeNullItems=True)
center_box_11 = CenterBox(Base=list_item_4, X=division_56, Y=division_57, Z=division_55)
center_box_12 = CenterBox(Base=[rotate_plane_7, rotate_plane_8], X=division_59, Y=division_60, Z=division_58)
unit_z_11 = UnitZ(Factor=Slider(170, range=0..1000))
unit_z_12 = UnitZ(Factor=Slider(170, range=0..1000))
number_slider_23 = Slider(9, range=0..20)
number_slider_24 = Slider(9, range=0..20)
addition_19 = Addition(A=number_slider_24, B=number_slider_23)
multiplication_3 = Multiplication(A=addition_19, B=number_slider_18)
multiplication_4 = Multiplication(A=addition_19, B=Slider(10, range=0..10))
addition_20 = Addition(A=multiplication_3, B=multiplication_4)
subtraction_14 = Subtraction(A=addition_20, B=10)
unit_z_13 = UnitZ(Factor=subtraction_14)
move_10 = Move(Geometry=curve_middle_2, Motion=unit_z_13)  # -> Geometry, Transform
move_11 = Move(Geometry=evaluate_curve_3.Point, Motion=unit_z_13)  # -> Geometry, Transform
move_12 = Move(Geometry=evaluate_curve_4.Point, Motion=unit_z_13)  # -> Geometry, Transform
line_37 = Line(StartPoint=move_11.Geometry, EndPoint=move_10.Geometry)
line_38 = Line(StartPoint=move_12.Geometry, EndPoint=move_10.Geometry)
offset_curve_29 = OffsetCurve(Curve=line_37, Distance=Slider(0, range=0..145), Plane=PlaneXY(0, 0, 0), Corners=1)
offset_curve_30 = OffsetCurve(Curve=line_37, Distance=Slider(145, range=0..1000), Plane=PlaneXY(0, 0, 0), Corners=1)
offset_curve_31 = OffsetCurve(Curve=line_38, Distance=Slider(-145, range=-150..0), Plane=PlaneXY(0, 0, 0), Corners=1)
offset_curve_32 = OffsetCurve(Curve=line_38, Distance=Slider(145, range=0..1000), Plane=PlaneXY(0, 0, 0), Corners=1)
divide_curve_29 = DivideCurve(Curve=offset_curve_29, Count=number_slider_7, Kinks=False)  # -> Points, Tangents, Parameters
divide_curve_30 = DivideCurve(Curve=offset_curve_30, Count=number_slider_7, Kinks=False)  # -> Points, Tangents, Parameters
divide_curve_31 = DivideCurve(Curve=offset_curve_31, Count=number_slider_8, Kinks=False)  # -> Points, Tangents, Parameters
divide_curve_32 = DivideCurve(Curve=offset_curve_32, Count=number_slider_8, Kinks=False)  # -> Points, Tangents, Parameters
line_39 = Line(StartPoint=divide_curve_30.Points, EndPoint=divide_curve_29.Points)
line_40 = Line(StartPoint=divide_curve_32.Points, EndPoint=divide_curve_31.Points)
loft_23 = Loft(Curves=line_39, Options={Adjust=False, Closed=False, LoftEnds=0, LoftSimp=0, LoftType=0, Rebuild=10, Refit=0.01})
loft_24 = Loft(Curves=line_40, Options={Adjust=False, Closed=False, LoftEnds=0, LoftSimp=0, LoftType=0, Rebuild=10, Refit=0.01})
surface_closest_point_23 = SurfaceClosestPoint(Point=divide_curve_30.Points, Surface=loft_23)  # -> Point, UVPoint, Distance
surface_closest_point_24 = SurfaceClosestPoint(Point=divide_curve_31.Points, Surface=loft_24)  # -> Point, UVPoint, Distance
evaluate_surface_23 = EvaluateSurface(Surface=loft_23, Point=surface_closest_point_23.UVPoint)  # -> Point, Normal, UDirection, VDirection, Frame
evaluate_surface_24 = EvaluateSurface(Surface=loft_24, Point=surface_closest_point_24.UVPoint)  # -> Point, Normal, UDirection, VDirection, Frame
rotate_plane_23 = RotatePlane(Plane=evaluate_surface_23.Frame, Angle=radians_3)
rotate_plane_24 = RotatePlane(Plane=evaluate_surface_24.Frame, Angle=radians_4)
deconstruct_plane_3 = DeconstructPlane(Plane=rotate_plane_23)  # -> Origin, XAxis, YAxis, ZAxis
deconstruct_plane_4 = DeconstructPlane(Plane=rotate_plane_24)  # -> Origin, XAxis, YAxis, ZAxis
rotate_3d_3 = Rotate3D(Geometry=rotate_plane_23, Angle=1.570796327, Center=deconstruct_plane_3.Origin, Axis=deconstruct_plane_3.YAxis)  # -> Geometry, Transform
rotate_3d_4 = Rotate3D(Geometry=rotate_plane_24, Angle=1.570796327, Center=deconstruct_plane_4.Origin, Axis=deconstruct_plane_4.YAxis)  # -> Geometry, Transform
list_item_7 = ListItem(List=rotate_3d_3.Geometry, Index=1, Wrap=True)
list_item_8 = ListItem(List=rotate_3d_4.Geometry, Index=1, Wrap=True)
ellipse_3 = Ellipse(Plane=list_item_7, Radius1=addition_7, Radius2=line_37)  # -> Ellipse, Focus1, Focus2
ellipse_4 = Ellipse(Plane=list_item_8, Radius1=addition_8, Radius2=line_38)  # -> Ellipse, Focus1, Focus2
sub_curve_3 = SubCurve(BaseCurve=reparameterize(ellipse_3.Ellipse), Domain="0.25 to  0.75")
sub_curve_4 = SubCurve(BaseCurve=reparameterize(ellipse_4.Ellipse), Domain="0.25 to  0.75")
flatten_tree_7 = FlattenTree(Tree=sub_curve_4, Path="{0}")
flatten_tree_8 = FlattenTree(Tree=sub_curve_3, Path="{0}")
graft_tree_3 = GraftTree(Tree=flatten_tree_7, IncludeEmptyLists=True, IncludeNullItems=True)
graft_tree_4 = GraftTree(Tree=flatten_tree_8, IncludeEmptyLists=True, IncludeNullItems=True)
end_points_5 = EndPoints(Curve=graft_tree_2)  # -> Start, End
end_points_6 = EndPoints(Curve=graft_tree)  # -> Start, End
unit_z_14 = UnitZ(Factor=Slider(170, range=0..1000))
end_points_7 = EndPoints(Curve=graft_tree_4)  # -> Start, End
end_points_8 = EndPoints(Curve=graft_tree_3)  # -> Start, End
linear_array = LinearArray(Geometry=center_box, Direction=unit_z_9, Count=Slider(13, range=0..20))  # -> Geometry, Transform
linear_array_2 = LinearArray(Geometry=[center_box_3, center_box_2], Direction=unit_z_12, Count=Slider(14, range=0..20))  # -> Geometry, Transform
line_41 = Line(StartPoint=end_points_5.Start, EndPoint=end_points_5.End)
line_42 = Line(StartPoint=end_points_6.Start, EndPoint=end_points_6.End)
linear_array_3 = LinearArray(Geometry=center_box_4, Direction=unit_z_11, Count=Slider(13, range=0..20))  # -> Geometry, Transform
linear_array_4 = LinearArray(Geometry=[center_box_6, center_box_5], Direction=unit_z_14, Count=Slider(14, range=0..20))  # -> Geometry, Transform
line_43 = Line(StartPoint=end_points_7.Start, EndPoint=end_points_7.End)
line_44 = Line(StartPoint=end_points_8.Start, EndPoint=end_points_8.End)
unit_z_15 = UnitZ(Factor=Slider(170, range=0..1000))
unit_z_16 = UnitZ(Factor=Slider(170, range=0..1000))
unit_z_17 = UnitZ(Factor=Slider(170, range=0..1000))
unit_z_18 = UnitZ(Factor=Slider(170, range=0..1000))
brep = Brep([linear_array_2.Geometry, linear_array.Geometry])
loft_25 = Loft(
    Curves=[graft_tree, line_42],
    Options={Adjust=False, Closed=False, LoftEnds=0, LoftSimp=0, LoftType=0, Rebuild=10, Refit=0.01})
loft_26 = Loft(
    Curves=[graft_tree_2, line_41],
    Options={Adjust=False, Closed=False, LoftEnds=0, LoftSimp=0, LoftType=0, Rebuild=10, Refit=0.01})
loft_27 = Loft(
    Curves=[graft_tree, graft_tree_2],
    Options={Adjust=False, Closed=False, LoftEnds=0, LoftSimp=0, LoftType=0, Rebuild=10, Refit=0.01})
loft_28 = Loft(
    Curves=[line_42, line_41],
    Options={Adjust=False, Closed=False, LoftEnds=0, LoftSimp=0, LoftType=0, Rebuild=10, Refit=0.01})
brep_2 = Brep([linear_array_4.Geometry, linear_array_3.Geometry])
linear_array_5 = LinearArray(Geometry=center_box_7, Direction=unit_z_15, Count=Slider(14, range=0..20))  # -> Geometry, Transform
loft_29 = Loft(
    Curves=[graft_tree_3, line_44],
    Options={Adjust=False, Closed=False, LoftEnds=0, LoftSimp=0, LoftType=0, Rebuild=10, Refit=0.01})
loft_30 = Loft(
    Curves=[graft_tree_4, line_43],
    Options={Adjust=False, Closed=False, LoftEnds=0, LoftSimp=0, LoftType=0, Rebuild=10, Refit=0.01})
loft_31 = Loft(
    Curves=[graft_tree_3, graft_tree_4],
    Options={Adjust=False, Closed=False, LoftEnds=0, LoftSimp=0, LoftType=0, Rebuild=10, Refit=0.01})
loft_32 = Loft(
    Curves=[line_44, line_43],
    Options={Adjust=False, Closed=False, LoftEnds=0, LoftSimp=0, LoftType=0, Rebuild=10, Refit=0.01})
linear_array_6 = LinearArray(Geometry=[center_box_9, center_box_8], Direction=unit_z_17, Count=Slider(13, range=0..20))  # -> Geometry, Transform
linear_array_7 = LinearArray(Geometry=center_box_10, Direction=unit_z_16, Count=Slider(14, range=0..20))  # -> Geometry, Transform
flatten_tree_9 = FlattenTree(Tree=brep, Path="{0}")
linear_array_8 = LinearArray(Geometry=[center_box_12, center_box_11], Direction=unit_z_18, Count=Slider(13, range=0..20))  # -> Geometry, Transform
flatten_tree_10 = FlattenTree(Tree=brep_2, Path="{0}")
unit_z_19 = UnitZ(Factor=Slider(170, range=0..1000))
brep_join = BrepJoin(Breps=[loft_25, loft_27, loft_28, loft_26])  # -> Breps, Closed
unit_z_20 = UnitZ(Factor=Slider(170, range=0..1000))
number_slider_25 = Slider(9, range=0..20)
number_slider_26 = Slider(9, range=0..20)
addition_21 = Addition(A=number_slider_26, B=number_slider_25)
multiplication_5 = Multiplication(A=addition_21, B=number_slider_19)
multiplication_6 = Multiplication(A=addition_21, B=Slider(10, range=0..10))
addition_22 = Addition(A=multiplication_5, B=multiplication_6)
subtraction_15 = Subtraction(A=addition_22, B=10)
unit_z_21 = UnitZ(Factor=subtraction_15)
move_13 = Move(Geometry=curve_middle_3, Motion=unit_z_21)  # -> Geometry, Transform
move_14 = Move(Geometry=evaluate_curve_5.Point, Motion=unit_z_21)  # -> Geometry, Transform
move_15 = Move(Geometry=evaluate_curve_6.Point, Motion=unit_z_21)  # -> Geometry, Transform
line_45 = Line(StartPoint=move_14.Geometry, EndPoint=move_13.Geometry)
line_46 = Line(StartPoint=move_15.Geometry, EndPoint=move_13.Geometry)
offset_curve_33 = OffsetCurve(Curve=line_45, Distance=Slider(0, range=0..145), Plane=PlaneXY(0, 0, 0), Corners=1)
offset_curve_34 = OffsetCurve(Curve=line_45, Distance=Slider(145, range=0..1000), Plane=PlaneXY(0, 0, 0), Corners=1)
offset_curve_35 = OffsetCurve(Curve=line_46, Distance=Slider(-145, range=-150..0), Plane=PlaneXY(0, 0, 0), Corners=1)
offset_curve_36 = OffsetCurve(Curve=line_46, Distance=Slider(145, range=0..1000), Plane=PlaneXY(0, 0, 0), Corners=1)
divide_curve_33 = DivideCurve(Curve=offset_curve_33, Count=number_slider_9, Kinks=False)  # -> Points, Tangents, Parameters
divide_curve_34 = DivideCurve(Curve=offset_curve_34, Count=number_slider_9, Kinks=False)  # -> Points, Tangents, Parameters
divide_curve_35 = DivideCurve(Curve=offset_curve_35, Count=number_slider_10, Kinks=False)  # -> Points, Tangents, Parameters
divide_curve_36 = DivideCurve(Curve=offset_curve_36, Count=number_slider_10, Kinks=False)  # -> Points, Tangents, Parameters
line_47 = Line(StartPoint=divide_curve_34.Points, EndPoint=divide_curve_33.Points)
line_48 = Line(StartPoint=divide_curve_36.Points, EndPoint=divide_curve_35.Points)
loft_33 = Loft(Curves=line_47, Options={Adjust=False, Closed=False, LoftEnds=0, LoftSimp=0, LoftType=0, Rebuild=10, Refit=0.01})
loft_34 = Loft(Curves=line_48, Options={Adjust=False, Closed=False, LoftEnds=0, LoftSimp=0, LoftType=0, Rebuild=10, Refit=0.01})
surface_closest_point_25 = SurfaceClosestPoint(Point=divide_curve_34.Points, Surface=loft_33)  # -> Point, UVPoint, Distance
surface_closest_point_26 = SurfaceClosestPoint(Point=divide_curve_35.Points, Surface=loft_34)  # -> Point, UVPoint, Distance
evaluate_surface_25 = EvaluateSurface(Surface=loft_33, Point=surface_closest_point_25.UVPoint)  # -> Point, Normal, UDirection, VDirection, Frame
evaluate_surface_26 = EvaluateSurface(Surface=loft_34, Point=surface_closest_point_26.UVPoint)  # -> Point, Normal, UDirection, VDirection, Frame
rotate_plane_25 = RotatePlane(Plane=evaluate_surface_25.Frame, Angle=radians_6)
rotate_plane_26 = RotatePlane(Plane=evaluate_surface_26.Frame, Angle=radians_7)
deconstruct_plane_5 = DeconstructPlane(Plane=rotate_plane_25)  # -> Origin, XAxis, YAxis, ZAxis
deconstruct_plane_6 = DeconstructPlane(Plane=rotate_plane_26)  # -> Origin, XAxis, YAxis, ZAxis
rotate_3d_5 = Rotate3D(Geometry=rotate_plane_25, Angle=1.570796327, Center=deconstruct_plane_5.Origin, Axis=deconstruct_plane_5.YAxis)  # -> Geometry, Transform
rotate_3d_6 = Rotate3D(Geometry=rotate_plane_26, Angle=1.570796327, Center=deconstruct_plane_6.Origin, Axis=deconstruct_plane_6.YAxis)  # -> Geometry, Transform
list_item_9 = ListItem(List=rotate_3d_5.Geometry, Index=1, Wrap=True)
list_item_10 = ListItem(List=rotate_3d_6.Geometry, Index=1, Wrap=True)
ellipse_5 = Ellipse(Plane=list_item_9, Radius1=addition_10, Radius2=line_45)  # -> Ellipse, Focus1, Focus2
ellipse_6 = Ellipse(Plane=list_item_10, Radius1=addition_11, Radius2=line_46)  # -> Ellipse, Focus1, Focus2
sub_curve_5 = SubCurve(BaseCurve=reparameterize(ellipse_5.Ellipse), Domain="0.25 to  0.75")
sub_curve_6 = SubCurve(BaseCurve=reparameterize(ellipse_6.Ellipse), Domain="0.25 to  0.75")
flatten_tree_11 = FlattenTree(Tree=sub_curve_6, Path="{0}")
flatten_tree_12 = FlattenTree(Tree=sub_curve_5, Path="{0}")
graft_tree_5 = GraftTree(Tree=flatten_tree_11, IncludeEmptyLists=True, IncludeNullItems=True)
graft_tree_6 = GraftTree(Tree=flatten_tree_12, IncludeEmptyLists=True, IncludeNullItems=True)
end_points_9 = EndPoints(Curve=graft_tree_5)  # -> Start, End
end_points_10 = EndPoints(Curve=graft_tree_6)  # -> Start, End
line_49 = Line(StartPoint=end_points_10.Start, EndPoint=end_points_10.End)
line_50 = Line(StartPoint=end_points_9.Start, EndPoint=end_points_9.End)
loft_35 = Loft(
    Curves=[line_50, graft_tree_5],
    Options={Adjust=False, Closed=False, LoftEnds=0, LoftSimp=0, LoftType=0, Rebuild=10, Refit=0.01})
loft_36 = Loft(
    Curves=[line_49, graft_tree_6],
    Options={Adjust=False, Closed=False, LoftEnds=0, LoftSimp=0, LoftType=0, Rebuild=10, Refit=0.01})
loft_37 = Loft(
    Curves=[graft_tree_5, graft_tree_6],
    Options={Adjust=False, Closed=False, LoftEnds=0, LoftSimp=0, LoftType=0, Rebuild=10, Refit=0.01})
loft_38 = Loft(
    Curves=[line_50, line_49],
    Options={Adjust=False, Closed=False, LoftEnds=0, LoftSimp=0, LoftType=0, Rebuild=10, Refit=0.01})
unit_z_22 = UnitZ(Factor=Slider(170, range=0..1000))
brep_join_2 = BrepJoin(Breps=[loft_29, loft_31, loft_32, loft_30])  # -> Breps, Closed
unit_z_23 = UnitZ(Factor=Slider(170, range=0..1000))
number_slider_27 = Slider(9, range=0..20)
number_slider_28 = Slider(9, range=0..20)
addition_23 = Addition(A=number_slider_28, B=number_slider_27)
multiplication_7 = Multiplication(A=addition_23, B=number_slider_20)
multiplication_8 = Multiplication(A=addition_23, B=Slider(10, range=0..10))
addition_24 = Addition(A=multiplication_7, B=multiplication_8)
subtraction_16 = Subtraction(A=addition_24, B=10)
unit_z_24 = UnitZ(Factor=subtraction_16)
move_16 = Move(Geometry=curve_middle_4, Motion=unit_z_24)  # -> Geometry, Transform
move_17 = Move(Geometry=evaluate_curve_7.Point, Motion=unit_z_24)  # -> Geometry, Transform
move_18 = Move(Geometry=evaluate_curve_8.Point, Motion=unit_z_24)  # -> Geometry, Transform
line_51 = Line(StartPoint=move_17.Geometry, EndPoint=move_16.Geometry)
line_52 = Line(StartPoint=move_18.Geometry, EndPoint=move_16.Geometry)
offset_curve_37 = OffsetCurve(Curve=line_51, Distance=Slider(0, range=0..145), Plane=PlaneXY(0, 0, 0), Corners=1)
offset_curve_38 = OffsetCurve(Curve=line_51, Distance=Slider(145, range=0..1000), Plane=PlaneXY(0, 0, 0), Corners=1)
offset_curve_39 = OffsetCurve(Curve=line_52, Distance=Slider(-145, range=-300..0), Plane=PlaneXY(0, 0, 0), Corners=1)
offset_curve_40 = OffsetCurve(Curve=line_52, Distance=Slider(145, range=0..1000), Plane=PlaneXY(0, 0, 0), Corners=1)
divide_curve_37 = DivideCurve(Curve=offset_curve_37, Count=number_slider_11, Kinks=False)  # -> Points, Tangents, Parameters
divide_curve_38 = DivideCurve(Curve=offset_curve_38, Count=number_slider_11, Kinks=False)  # -> Points, Tangents, Parameters
divide_curve_39 = DivideCurve(Curve=offset_curve_39, Count=number_slider_12, Kinks=False)  # -> Points, Tangents, Parameters
divide_curve_40 = DivideCurve(Curve=offset_curve_40, Count=number_slider_12, Kinks=False)  # -> Points, Tangents, Parameters
line_53 = Line(StartPoint=divide_curve_38.Points, EndPoint=divide_curve_37.Points)
line_54 = Line(StartPoint=divide_curve_40.Points, EndPoint=divide_curve_39.Points)
loft_39 = Loft(Curves=line_53, Options={Adjust=False, Closed=False, LoftEnds=0, LoftSimp=0, LoftType=0, Rebuild=10, Refit=0.01})
loft_40 = Loft(Curves=line_54, Options={Adjust=False, Closed=False, LoftEnds=0, LoftSimp=0, LoftType=0, Rebuild=10, Refit=0.01})
surface_closest_point_27 = SurfaceClosestPoint(Point=divide_curve_38.Points, Surface=loft_39)  # -> Point, UVPoint, Distance
surface_closest_point_28 = SurfaceClosestPoint(Point=divide_curve_39.Points, Surface=loft_40)  # -> Point, UVPoint, Distance
evaluate_surface_27 = EvaluateSurface(Surface=loft_39, Point=surface_closest_point_27.UVPoint)  # -> Point, Normal, UDirection, VDirection, Frame
evaluate_surface_28 = EvaluateSurface(Surface=loft_40, Point=surface_closest_point_28.UVPoint)  # -> Point, Normal, UDirection, VDirection, Frame
rotate_plane_27 = RotatePlane(Plane=evaluate_surface_27.Frame, Angle=radians_9)
rotate_plane_28 = RotatePlane(Plane=evaluate_surface_28.Frame, Angle=radians_12)
deconstruct_plane_7 = DeconstructPlane(Plane=rotate_plane_27)  # -> Origin, XAxis, YAxis, ZAxis
deconstruct_plane_8 = DeconstructPlane(Plane=rotate_plane_28)  # -> Origin, XAxis, YAxis, ZAxis
rotate_3d_7 = Rotate3D(Geometry=rotate_plane_27, Angle=1.570796327, Center=deconstruct_plane_7.Origin, Axis=deconstruct_plane_7.YAxis)  # -> Geometry, Transform
rotate_3d_8 = Rotate3D(Geometry=rotate_plane_28, Angle=1.570796327, Center=deconstruct_plane_8.Origin, Axis=deconstruct_plane_8.YAxis)  # -> Geometry, Transform
list_item_11 = ListItem(List=rotate_3d_7.Geometry, Index=1, Wrap=True)
list_item_12 = ListItem(List=rotate_3d_8.Geometry, Index=1, Wrap=True)
ellipse_7 = Ellipse(Plane=list_item_11, Radius1=addition_13, Radius2=line_51)  # -> Ellipse, Focus1, Focus2
ellipse_8 = Ellipse(Plane=list_item_12, Radius1=addition_14, Radius2=line_52)  # -> Ellipse, Focus1, Focus2
sub_curve_7 = SubCurve(BaseCurve=reparameterize(ellipse_7.Ellipse), Domain="0.25 to  0.75")
sub_curve_8 = SubCurve(BaseCurve=reparameterize(ellipse_8.Ellipse), Domain="0.25 to  0.75")
flatten_tree_13 = FlattenTree(Tree=sub_curve_8, Path="{0}")
flatten_tree_14 = FlattenTree(Tree=sub_curve_7, Path="{0}")
graft_tree_7 = GraftTree(Tree=flatten_tree_13, IncludeEmptyLists=True, IncludeNullItems=True)
graft_tree_8 = GraftTree(Tree=flatten_tree_14, IncludeEmptyLists=True, IncludeNullItems=True)
end_points_11 = EndPoints(Curve=graft_tree_7)  # -> Start, End
end_points_12 = EndPoints(Curve=graft_tree_8)  # -> Start, End
line_55 = Line(StartPoint=end_points_12.Start, EndPoint=end_points_12.End)
line_56 = Line(StartPoint=end_points_11.Start, EndPoint=end_points_11.End)
loft_41 = Loft(
    Curves=[line_56, graft_tree_7],
    Options={Adjust=False, Closed=False, LoftEnds=0, LoftSimp=0, LoftType=0, Rebuild=10, Refit=0.01})
loft_42 = Loft(
    Curves=[line_55, graft_tree_8],
    Options={Adjust=False, Closed=False, LoftEnds=0, LoftSimp=0, LoftType=0, Rebuild=10, Refit=0.01})
loft_43 = Loft(
    Curves=[graft_tree_7, graft_tree_8],
    Options={Adjust=False, Closed=False, LoftEnds=0, LoftSimp=0, LoftType=0, Rebuild=10, Refit=0.01})
loft_44 = Loft(
    Curves=[line_56, line_55],
    Options={Adjust=False, Closed=False, LoftEnds=0, LoftSimp=0, LoftType=0, Rebuild=10, Refit=0.01})
linear_array_9 = LinearArray(Geometry=center_box, Direction=unit_z_20, Count=number_slider_21)  # -> Geometry, Transform
linear_array_10 = LinearArray(Geometry=[center_box_3, center_box_2], Direction=unit_z_19, Count=number_slider_22)  # -> Geometry, Transform
brep_3 = Brep([linear_array_6.Geometry, linear_array_5.Geometry])
solid_intersection = SolidIntersection(BrepsA=flatten_tree_9, BrepsB=brep_join.Breps)
linear_array_11 = LinearArray(Geometry=center_box_4, Direction=unit_z_23, Count=number_slider_23)  # -> Geometry, Transform
linear_array_12 = LinearArray(Geometry=[center_box_6, center_box_5], Direction=unit_z_22, Count=number_slider_24)  # -> Geometry, Transform
brep_4 = Brep([linear_array_8.Geometry, linear_array_7.Geometry])
solid_intersection_2 = SolidIntersection(BrepsA=flatten_tree_10, BrepsB=brep_join_2.Breps)
flatten_tree_15 = FlattenTree(Tree=brep_3, Path="{0}")
brep_join_3 = BrepJoin(Breps=[loft_35, loft_37, loft_38, loft_36])  # -> Breps, Closed
flatten_tree_16 = FlattenTree(Tree=brep_4, Path="{0}")
brep_join_4 = BrepJoin(Breps=[loft_41, loft_43, loft_44, loft_42])  # -> Breps, Closed
unit_z_25 = UnitZ(Factor=Slider(170, range=0..1000))
unit_z_26 = UnitZ(Factor=Slider(170, range=0..1000))
unit_z_27 = UnitZ(Factor=Slider(170, range=0..1000))
unit_z_28 = UnitZ(Factor=Slider(170, range=0..1000))
linear_array_13 = LinearArray(Geometry=center_box_7, Direction=unit_z_25, Count=number_slider_26)  # -> Geometry, Transform
linear_array_14 = LinearArray(Geometry=[center_box_9, center_box_8], Direction=unit_z_26, Count=number_slider_25)  # -> Geometry, Transform
linear_array_15 = LinearArray(Geometry=center_box_10, Direction=unit_z_27, Count=number_slider_28)  # -> Geometry, Transform
linear_array_16 = LinearArray(Geometry=[center_box_12, center_box_11], Direction=unit_z_28, Count=number_slider_27)  # -> Geometry, Transform
solid_intersection_3 = SolidIntersection(BrepsA=flatten_tree_15, BrepsB=brep_join_3.Breps)
solid_intersection_4 = SolidIntersection(BrepsA=flatten_tree_16, BrepsB=brep_join_4.Breps)
geometry = Geometry([linear_array_10.Geometry, linear_array_9.Geometry, solid_intersection])
geometry_2 = Geometry([linear_array_14.Geometry, linear_array_13.Geometry, solid_intersection_3])
geometry_3 = Geometry([linear_array_12.Geometry, linear_array_11.Geometry, solid_intersection_2])
geometry_4 = Geometry([linear_array_16.Geometry, linear_array_15.Geometry, solid_intersection_4])

# ---- group: Arch wall infill / Output
geometry_5 = Geometry([geometry_3, geometry_4, geometry, geometry_2])

# ---- group: Wall
ghpython_script_4 = GhPythonScript(x=curve, y=curve_2, z=boolean_toggle)  # -> out, a, c; same code as ghpython_script
curve_12 = Curve(ghpython_script_4.a)
curve_13 = Curve(ghpython_script_4.c)
length_39 = Length(Curve=curve_13)
length_40 = Length(Curve=curve_12)
panel_3 = Panel(length_39)
panel_4 = Panel(length_40)
ghpython_script_5 = GhPythonScript(x=panel_3, e=curve_13)  # -> out, a, c, d
# ---------- ghpython_script_5: Python ----------
__author__ = "dion"
__version__ = "2020.10.15"

import rhinoscriptsyntax as rs

y = ['750','1050','1350','1650','1950','2250','2550','2850','3150','3450','3750','4050','4350','4650','4950','5250','5550','5850','6150','6450','6750','7050','7350','7650','7950','8250','8550','8850','9150','9450','9750']
z = ['600','900','1200','1500','1800','2100','2400','2700','3000','3300','3600','3900','4200','4500','4800','5100','5400','5700','6000','6300','6600','6900','7200','7500','7800','8100','8400','8700','9000','9300','9600','9900']

if x in y:
    a = 1

if x in z:
    a = 0

if a == 0:
    d = e

if a == 1:
    c = e
# ---------- end ghpython_script_5 ----------
ghpython_script_6 = GhPythonScript(x=panel_4, e=curve_12)  # -> out, a, c, d; same code as ghpython_script_5
flatten_tree_17 = FlattenTree(Tree=ghpython_script_5.d, Path="{0}")
flatten_tree_18 = FlattenTree(Tree=ghpython_script_5.c, Path="{0}")
clean_tree_5 = CleanTree(RemoveNulls=True, RemoveInvalid=True, RemoveEmpty=False, Tree=flatten_tree_18)
flatten_tree_19 = FlattenTree(Tree=ghpython_script_6.d, Path="{0}")
flatten_tree_20 = FlattenTree(Tree=ghpython_script_6.c, Path="{0}")
clean_tree_6 = CleanTree(RemoveNulls=True, RemoveInvalid=True, RemoveEmpty=False, Tree=flatten_tree_17)
clean_tree_7 = CleanTree(RemoveNulls=True, RemoveInvalid=True, RemoveEmpty=False, Tree=flatten_tree_19)
clean_tree_8 = CleanTree(RemoveNulls=True, RemoveInvalid=True, RemoveEmpty=False, Tree=flatten_tree_20)
unit_z_29 = UnitZ(Factor=37.5)
unit_z_30 = UnitZ(Factor=37.5)
unit_z_31 = UnitZ(Factor=37.33630941)
move_19 = Move(Geometry=clean_tree_7, Motion=unit_z_29)  # -> Geometry, Transform
move_20 = Move(Geometry=clean_tree_6, Motion=unit_z_30)  # -> Geometry, Transform
move1_3 = Move(Geometry=clean_tree_5, Motion=unit_z_31)  # -> Geometry, Transform
number_slider_29 = Slider(300, range=0..1500)
number_slider_30 = Slider(225, range=0..1500)
length_41 = Length(Curve=move_19.Geometry)
number_slider_31 = Slider(300, range=0..1500)
length_42 = Length(Curve=move_19.Geometry)
length_43 = Length(Curve=move_20.Geometry)
number_slider_32 = Slider(225, range=0..1500)
subtraction_17 = Subtraction(A=length_41, B=number_slider_29)
addition_25 = Addition(A=Slider(225, range=0..1500), B=number_slider_29)
subtraction_18 = Subtraction(A=length_42, B=addition_25)
addition_26 = Addition(A=Slider(225, range=0..1500), B=number_slider_30)
length_44 = Length(Curve=move1_3.Geometry)
length_45 = Length(Curve=move1_3.Geometry)
addition_27 = Addition(A=Slider(225, range=0..1500), B=number_slider_31)
subtraction_19 = Subtraction(A=length_43, B=Slider(300, range=0..1500))
evaluate_curve_29 = EvaluateCurve(Curve=move_19.Geometry, Parameter=subtraction_17)  # -> Point, Tangent, Angle
evaluate_curve_30 = EvaluateCurve(Curve=move_19.Geometry, Parameter=subtraction_18)  # -> Point, Tangent, Angle
evaluate_curve_31 = EvaluateCurve(Curve=move_19.Geometry, Parameter=Slider(375, range=0..1500))  # -> Point, Tangent, Angle
end_points_13 = EndPoints(Curve=move_19.Geometry)  # -> Start, End
subtraction_20 = Subtraction(A=length_44, B=number_slider_32)
addition_28 = Addition(A=Slider(225, range=0..1500), B=number_slider_32)
subtraction_21 = Subtraction(A=length_45, B=addition_28)
evaluate_curve_32 = EvaluateCurve(Curve=move_20.Geometry, Parameter=subtraction_19)  # -> Point, Tangent, Angle
evaluate_curve_33 = EvaluateCurve(Curve=move_20.Geometry, Parameter=Slider(300, range=0..1500))  # -> Point, Tangent, Angle
evaluate_curve_34 = EvaluateCurve(Curve=move1_3.Geometry, Parameter=subtraction_20)  # -> Point, Tangent, Angle
evaluate_curve_35 = EvaluateCurve(Curve=move1_3.Geometry, Parameter=subtraction_21)  # -> Point, Tangent, Angle
evaluate_curve_36 = EvaluateCurve(Curve=move1_3.Geometry, Parameter=Slider(300, range=0..1500))  # -> Point, Tangent, Angle
end_points_14 = EndPoints(Curve=move1_3.Geometry)  # -> Start, End
line_57 = Line(StartPoint=end_points_13.End, EndPoint=evaluate_curve_29.Point)
line_58 = Line(StartPoint=evaluate_curve_31.Point, EndPoint=evaluate_curve_30.Point)
line_59 = Line(StartPoint=evaluate_curve_36.Point, EndPoint=evaluate_curve_35.Point)
line_60 = Line(StartPoint=evaluate_curve_33.Point, EndPoint=evaluate_curve_32.Point)
line_61 = Line(StartPoint=end_points_14.End, EndPoint=evaluate_curve_34.Point)
offset_curve_41 = OffsetCurve(Curve=line_58, Distance=Slider(-75, range=-75..0), Plane=PlaneXY(0, 0, 0), Corners=1)
offset_curve_42 = OffsetCurve(Curve=line_58, Distance=Slider(75, range=0..100), Plane=PlaneXY(0, 0, 0), Corners=1)
offset_curve_43 = OffsetCurve(Curve=line_57, Distance=Slider(75, range=0..100), Plane=PlaneXY(0, 0, 0), Corners=1)
offset_curve_44 = OffsetCurve(Curve=line_57, Distance=Slider(0, range=-75..0), Plane=PlaneXY(0, 0, 0), Corners=1)
offset_curve_45 = OffsetCurve(Curve=line_60, Distance=Slider(-75, range=-75..0), Plane=PlaneXY(0, 0, 0), Corners=1)
offset_curve_46 = OffsetCurve(Curve=line_60, Distance=Slider(75, range=0..100), Plane=PlaneXY(0, 0, 0), Corners=1)
offset_curve_47 = OffsetCurve(Curve=line_61, Distance=Slider(75, range=0..100), Plane=PlaneXY(0, 0, 0), Corners=1)
offset_curve_48 = OffsetCurve(Curve=line_61, Distance=Slider(0, range=-75..0), Plane=PlaneXY(0, 0, 0), Corners=1)
offset_curve_49 = OffsetCurve(Curve=line_59, Distance=Slider(-75, range=-75..0), Plane=PlaneXY(0, 0, 0), Corners=1)
offset_curve_50 = OffsetCurve(Curve=line_59, Distance=Slider(75, range=0..100), Plane=PlaneXY(0, 0, 0), Corners=1)
length_46 = Length(Curve=offset_curve_41)
length_47 = Length(Curve=offset_curve_44)
length_48 = Length(Curve=offset_curve_42)
length_49 = Length(Curve=offset_curve_43)
length_50 = Length(Curve=offset_curve_45)
length_51 = Length(Curve=offset_curve_46)
division_61 = Division(A=length_46, B=Slider(300, range=0..1000))
division_62 = Division(A=length_48, B=Slider(300, range=0..1000))
division_63 = Division(A=length_47, B=Slider(300, range=0..1000))
division_64 = Division(A=length_49, B=Slider(300, range=0..1000))
length_52 = Length(Curve=offset_curve_49)
length_53 = Length(Curve=offset_curve_47)
length_54 = Length(Curve=offset_curve_48)
length_55 = Length(Curve=offset_curve_50)
division_65 = Division(A=length_50, B=Slider(300, range=0..1000))
division_66 = Division(A=length_51, B=Slider(300, range=0..1000))
divide_curve_41 = DivideCurve(Curve=offset_curve_41, Count=division_61, Kinks=False)  # -> Points, Tangents, Parameters
divide_curve_42 = DivideCurve(Curve=offset_curve_44, Count=division_63, Kinks=False)  # -> Points, Tangents, Parameters
divide_curve_43 = DivideCurve(Curve=offset_curve_42, Count=division_62, Kinks=False)  # -> Points, Tangents, Parameters
divide_curve_44 = DivideCurve(Curve=offset_curve_43, Count=division_64, Kinks=False)  # -> Points, Tangents, Parameters
divide_curve_45 = DivideCurve(Curve=offset_curve_45, Count=division_65, Kinks=False)  # -> Points, Tangents, Parameters
division_67 = Division(A=length_52, B=Slider(300, range=0..1000))
division_68 = Division(A=length_55, B=Slider(300, range=0..1000))
divide_curve_46 = DivideCurve(Curve=offset_curve_46, Count=division_66, Kinks=False)  # -> Points, Tangents, Parameters
division_69 = Division(A=length_53, B=Slider(300, range=0..1000))
division_70 = Division(A=length_54, B=Slider(300, range=0..1000))
divide_curve_47 = DivideCurve(Curve=offset_curve_49, Count=division_67, Kinks=False)  # -> Points, Tangents, Parameters
divide_curve_48 = DivideCurve(Curve=offset_curve_50, Count=division_68, Kinks=False)  # -> Points, Tangents, Parameters
divide_curve_49 = DivideCurve(Curve=offset_curve_47, Count=division_69, Kinks=False)  # -> Points, Tangents, Parameters
divide_curve_50 = DivideCurve(Curve=offset_curve_48, Count=division_70, Kinks=False)  # -> Points, Tangents, Parameters
line_62 = Line(StartPoint=divide_curve_43.Points, EndPoint=divide_curve_41.Points)
line_63 = Line(StartPoint=divide_curve_41.Points, EndPoint=divide_curve_43.Points)
line_64 = Line(StartPoint=divide_curve_42.Points, EndPoint=divide_curve_44.Points)
line_65 = Line(StartPoint=divide_curve_46.Points, EndPoint=divide_curve_45.Points)
line_66 = Line(StartPoint=divide_curve_45.Points, EndPoint=divide_curve_46.Points)
loft_45 = Loft(Curves=line_62, Options={Adjust=False, Closed=False, LoftEnds=0, LoftSimp=0, LoftType=0, Rebuild=10, Refit=0.01})
loft_46 = Loft(Curves=line_63, Options={Adjust=False, Closed=False, LoftEnds=0, LoftSimp=0, LoftType=0, Rebuild=10, Refit=0.01})
loft_47 = Loft(Curves=line_64, Options={Adjust=False, Closed=False, LoftEnds=0, LoftSimp=0, LoftType=0, Rebuild=10, Refit=0.01})
line_67 = Line(StartPoint=divide_curve_48.Points, EndPoint=divide_curve_47.Points)
line_68 = Line(StartPoint=divide_curve_47.Points, EndPoint=divide_curve_48.Points)
line_69 = Line(StartPoint=divide_curve_50.Points, EndPoint=divide_curve_49.Points)
loft_48 = Loft(Curves=line_65, Options={Adjust=False, Closed=False, LoftEnds=0, LoftSimp=0, LoftType=0, Rebuild=10, Refit=0.01})
loft_49 = Loft(Curves=line_66, Options={Adjust=False, Closed=False, LoftEnds=0, LoftSimp=0, LoftType=0, Rebuild=10, Refit=0.01})
surface_closest_point_29 = SurfaceClosestPoint(Point=divide_curve_43.Points, Surface=loft_45)  # -> Point, UVPoint, Distance
surface_closest_point_30 = SurfaceClosestPoint(Point=divide_curve_41.Points, Surface=loft_46)  # -> Point, UVPoint, Distance
surface_closest_point_31 = SurfaceClosestPoint(Point=divide_curve_42.Points, Surface=loft_47)  # -> Point, UVPoint, Distance
loft_50 = Loft(Curves=line_67, Options={Adjust=False, Closed=False, LoftEnds=0, LoftSimp=0, LoftType=0, Rebuild=10, Refit=0.01})
loft_51 = Loft(Curves=line_68, Options={Adjust=False, Closed=False, LoftEnds=0, LoftSimp=0, LoftType=0, Rebuild=10, Refit=0.01})
loft_52 = Loft(Curves=line_69, Options={Adjust=False, Closed=False, LoftEnds=0, LoftSimp=0, LoftType=0, Rebuild=10, Refit=0.01})
surface_closest_point_32 = SurfaceClosestPoint(Point=divide_curve_46.Points, Surface=loft_48)  # -> Point, UVPoint, Distance
surface_closest_point_33 = SurfaceClosestPoint(Point=divide_curve_45.Points, Surface=loft_49)  # -> Point, UVPoint, Distance
evaluate_surface_29 = EvaluateSurface(Surface=loft_45, Point=surface_closest_point_29.UVPoint)  # -> Point, Normal, UDirection, VDirection, Frame
evaluate_surface_30 = EvaluateSurface(Surface=loft_46, Point=surface_closest_point_30.UVPoint)  # -> Point, Normal, UDirection, VDirection, Frame
evaluate_surface_31 = EvaluateSurface(Surface=loft_47, Point=surface_closest_point_31.UVPoint)  # -> Point, Normal, UDirection, VDirection, Frame
radians_29 = Radians(Degrees=90)
surface_closest_point_34 = SurfaceClosestPoint(Point=divide_curve_48.Points, Surface=loft_50)  # -> Point, UVPoint, Distance
surface_closest_point_35 = SurfaceClosestPoint(Point=divide_curve_47.Points, Surface=loft_51)  # -> Point, UVPoint, Distance
surface_closest_point_36 = SurfaceClosestPoint(Point=divide_curve_50.Points, Surface=loft_52)  # -> Point, UVPoint, Distance
radians_30 = Radians(Degrees=90)
radians_31 = Radians(Degrees=90)
radians_32 = Radians(Degrees=90)
radians_33 = Radians(Degrees=90)
evaluate_surface_32 = EvaluateSurface(Surface=loft_48, Point=surface_closest_point_32.UVPoint)  # -> Point, Normal, UDirection, VDirection, Frame
evaluate_surface_33 = EvaluateSurface(Surface=loft_49, Point=surface_closest_point_33.UVPoint)  # -> Point, Normal, UDirection, VDirection, Frame
radians_34 = Radians(Degrees=90)
radians_35 = Radians(Degrees=90)
radians_36 = Radians(Degrees=90)
radians_37 = Radians(Degrees=90)
radians_38 = Radians(Degrees=90)
radians_39 = Radians(Degrees=90)
radians_40 = Radians(Degrees=90)
radians_41 = Radians(Degrees=90)
radians_42 = Radians(Degrees=90)
radians_43 = Radians(Degrees=90)
rotate_plane_29 = RotatePlane(Plane=evaluate_surface_31.Frame, Angle=radians_29)
evaluate_surface_34 = EvaluateSurface(Surface=loft_50, Point=surface_closest_point_34.UVPoint)  # -> Point, Normal, UDirection, VDirection, Frame
evaluate_surface_35 = EvaluateSurface(Surface=loft_51, Point=surface_closest_point_35.UVPoint)  # -> Point, Normal, UDirection, VDirection, Frame
evaluate_surface_36 = EvaluateSurface(Surface=loft_52, Point=surface_closest_point_36.UVPoint)  # -> Point, Normal, UDirection, VDirection, Frame
radians_44 = Radians(Degrees=90)
rotate_plane_30 = RotatePlane(Plane=evaluate_surface_29.Frame, Angle=radians_32)
rotate_plane_31 = RotatePlane(Plane=evaluate_surface_30.Frame, Angle=radians_33)
radians_45 = Radians(Degrees=90)
radians_46 = Radians(Degrees=90)
radians_47 = Radians(Degrees=90)
radians_48 = Radians(Degrees=90)
rotate_plane_32 = RotatePlane(Plane=evaluate_surface_32.Frame, Angle=radians_42)
rotate_plane_33 = RotatePlane(Plane=evaluate_surface_33.Frame, Angle=radians_43)
rotate_plane_34 = RotatePlane(Plane=evaluate_surface_36.Frame, Angle=radians_44)
rotate_plane_35 = RotatePlane(Plane=evaluate_surface_34.Frame, Angle=radians_45)
rotate_plane_36 = RotatePlane(Plane=evaluate_surface_35.Frame, Angle=radians_46)
list_item_13 = ListItem(List=rotate_plane_29, Index=1, Wrap=True)
division_71 = Division(A=Slider(75, range=0..100), B=2)
division_72 = Division(A=Slider(75, range=0..100), B=2)
addition_29 = Addition(A=Slider(85, range=0..100), B=division_72)
unit_z_32 = UnitZ(Factor=addition_29)
move_21 = Move(Geometry=clean_tree_7, Motion=unit_z_32)  # -> Geometry, Transform
length_56 = Length(Curve=move_21.Geometry)
subtraction_22 = Subtraction(A=length_56, B=Slider(300, range=0..1500))
evaluate_curve_37 = EvaluateCurve(Curve=move_21.Geometry, Parameter=subtraction_22)  # -> Point, Tangent, Angle
evaluate_curve_38 = EvaluateCurve(Curve=move_21.Geometry, Parameter=Slider(300, range=0..1500))  # -> Point, Tangent, Angle
line_70 = Line(StartPoint=evaluate_curve_38.Point, EndPoint=evaluate_curve_37.Point)
offset_curve_51 = OffsetCurve(Curve=line_70, Distance=Slider(-75, range=-75..0), Plane=PlaneXY(0, 0, 0), Corners=1)
offset_curve_52 = OffsetCurve(Curve=line_70, Distance=Slider(75, range=0..100), Plane=PlaneXY(0, 0, 0), Corners=1)
length_57 = Length(Curve=offset_curve_51)
length_58 = Length(Curve=offset_curve_52)
division_73 = Division(A=length_57, B=Slider(300, range=0..1000))
division_74 = Division(A=length_58, B=Slider(300, range=0..1000))
divide_curve_51 = DivideCurve(Curve=offset_curve_51, Count=division_73, Kinks=False)  # -> Points, Tangents, Parameters
divide_curve_52 = DivideCurve(Curve=offset_curve_52, Count=division_74, Kinks=False)  # -> Points, Tangents, Parameters
line_71 = Line(StartPoint=divide_curve_52.Points, EndPoint=divide_curve_51.Points)
line_72 = Line(StartPoint=divide_curve_51.Points, EndPoint=divide_curve_52.Points)
loft_53 = Loft(Curves=line_71, Options={Adjust=False, Closed=False, LoftEnds=0, LoftSimp=0, LoftType=0, Rebuild=10, Refit=0.01})
loft_54 = Loft(Curves=line_72, Options={Adjust=False, Closed=False, LoftEnds=0, LoftSimp=0, LoftType=0, Rebuild=10, Refit=0.01})
surface_closest_point_37 = SurfaceClosestPoint(Point=divide_curve_52.Points, Surface=loft_53)  # -> Point, UVPoint, Distance
surface_closest_point_38 = SurfaceClosestPoint(Point=divide_curve_51.Points, Surface=loft_54)  # -> Point, UVPoint, Distance
evaluate_surface_37 = EvaluateSurface(Surface=loft_53, Point=surface_closest_point_37.UVPoint)  # -> Point, Normal, UDirection, VDirection, Frame
evaluate_surface_38 = EvaluateSurface(Surface=loft_54, Point=surface_closest_point_38.UVPoint)  # -> Point, Normal, UDirection, VDirection, Frame
rotate_plane_37 = RotatePlane(Plane=evaluate_surface_37.Frame, Angle=radians_36)
rotate_plane_38 = RotatePlane(Plane=evaluate_surface_38.Frame, Angle=radians_37)
division_75 = Division(A=Slider(290, range=0..1000), B=2)
division_76 = Division(A=Slider(140, range=0..1000), B=2)
division_77 = Division(A=Slider(140, range=0..1000), B=2)
division_78 = Division(A=Slider(290, range=0..1000), B=2)
division_79 = Division(A=Slider(75, range=0..100), B=2)
unit_z_33 = UnitZ(Factor=division_79)
move_22 = Move(Geometry=clean_tree_8, Motion=unit_z_33)  # -> Geometry, Transform
length_59 = Length(Curve=move_22.Geometry)
subtraction_23 = Subtraction(A=length_59, B=Slider(375, range=0..1500))
evaluate_curve_39 = EvaluateCurve(Curve=move_22.Geometry, Parameter=subtraction_23)  # -> Point, Tangent, Angle
evaluate_curve_40 = EvaluateCurve(Curve=move_22.Geometry, Parameter=Slider(375, range=0..1500))  # -> Point, Tangent, Angle
line_73 = Line(StartPoint=evaluate_curve_40.Point, EndPoint=evaluate_curve_39.Point)
offset_curve_53 = OffsetCurve(Curve=line_73, Distance=Slider(-75, range=-75..0), Plane=PlaneXY(0, 0, 0), Corners=1)
offset_curve_54 = OffsetCurve(Curve=line_73, Distance=Slider(75, range=0..100), Plane=PlaneXY(0, 0, 0), Corners=1)
length_60 = Length(Curve=offset_curve_53)
length_61 = Length(Curve=offset_curve_54)
division_80 = Division(A=length_60, B=Slider(300, range=0..1000))
division_81 = Division(A=length_61, B=Slider(300, range=0..1000))
divide_curve_53 = DivideCurve(Curve=offset_curve_53, Count=division_80, Kinks=False)  # -> Points, Tangents, Parameters
divide_curve_54 = DivideCurve(Curve=offset_curve_54, Count=division_81, Kinks=False)  # -> Points, Tangents, Parameters
line_74 = Line(StartPoint=divide_curve_54.Points, EndPoint=divide_curve_53.Points)
line_75 = Line(StartPoint=divide_curve_53.Points, EndPoint=divide_curve_54.Points)
loft_55 = Loft(Curves=line_74, Options={Adjust=False, Closed=False, LoftEnds=0, LoftSimp=0, LoftType=0, Rebuild=10, Refit=0.01})
loft_56 = Loft(Curves=line_75, Options={Adjust=False, Closed=False, LoftEnds=0, LoftSimp=0, LoftType=0, Rebuild=10, Refit=0.01})
surface_closest_point_39 = SurfaceClosestPoint(Point=divide_curve_54.Points, Surface=loft_55)  # -> Point, UVPoint, Distance
surface_closest_point_40 = SurfaceClosestPoint(Point=divide_curve_53.Points, Surface=loft_56)  # -> Point, UVPoint, Distance
evaluate_surface_39 = EvaluateSurface(Surface=loft_55, Point=surface_closest_point_39.UVPoint)  # -> Point, Normal, UDirection, VDirection, Frame
evaluate_surface_40 = EvaluateSurface(Surface=loft_56, Point=surface_closest_point_40.UVPoint)  # -> Point, Normal, UDirection, VDirection, Frame
rotate_plane_39 = RotatePlane(Plane=evaluate_surface_39.Frame, Angle=radians_38)
rotate_plane_40 = RotatePlane(Plane=evaluate_surface_40.Frame, Angle=radians_39)
division_82 = Division(A=Slider(140, range=0..1000), B=2)
division_83 = Division(A=Slider(290, range=0..1000), B=2)
division_84 = Division(A=Slider(75, range=0..100), B=2)
division_85 = Division(A=Slider(140, range=0..1000), B=2)
division_86 = Division(A=Slider(290, range=0..1000), B=2)
division_87 = Division(A=Slider(75, range=0..100), B=2)
addition_30 = Addition(A=Slider(85, range=0..100), B=division_87)
unit_z_34 = UnitZ(Factor=addition_30)
move1_4 = Move(Geometry=clean_tree_8, Motion=unit_z_34)  # -> Geometry, Transform
length_62 = Length(Curve=move1_4.Geometry)
length_63 = Length(Curve=move1_4.Geometry)
subtraction_24 = Subtraction(A=length_62, B=number_slider_30)
subtraction_25 = Subtraction(A=length_63, B=addition_26)
evaluate_curve_41 = EvaluateCurve(Curve=move1_4.Geometry, Parameter=subtraction_24)  # -> Point, Tangent, Angle
evaluate_curve_42 = EvaluateCurve(Curve=move1_4.Geometry, Parameter=subtraction_25)  # -> Point, Tangent, Angle
evaluate_curve_43 = EvaluateCurve(Curve=move1_4.Geometry, Parameter=Slider(300, range=0..1500))  # -> Point, Tangent, Angle
end_points_15 = EndPoints(Curve=move1_4.Geometry)  # -> Start, End
line_76 = Line(StartPoint=evaluate_curve_43.Point, EndPoint=evaluate_curve_42.Point)
line_77 = Line(StartPoint=end_points_15.End, EndPoint=evaluate_curve_41.Point)
offset_curve_55 = OffsetCurve(Curve=line_77, Distance=Slider(75, range=0..100), Plane=PlaneXY(0, 0, 0), Corners=1)
offset_curve_56 = OffsetCurve(Curve=line_77, Distance=Slider(0, range=-75..0), Plane=PlaneXY(0, 0, 0), Corners=1)
offset_curve_57 = OffsetCurve(Curve=line_76, Distance=Slider(-75, range=-75..0), Plane=PlaneXY(0, 0, 0), Corners=1)
offset_curve_58 = OffsetCurve(Curve=line_76, Distance=Slider(75, range=0..100), Plane=PlaneXY(0, 0, 0), Corners=1)
length_64 = Length(Curve=offset_curve_57)
length_65 = Length(Curve=offset_curve_55)
length_66 = Length(Curve=offset_curve_56)
length_67 = Length(Curve=offset_curve_58)
division_88 = Division(A=length_64, B=Slider(300, range=0..1000))
division_89 = Division(A=length_67, B=Slider(300, range=0..1000))
division_90 = Division(A=length_65, B=Slider(300, range=0..1000))
division_91 = Division(A=length_66, B=Slider(300, range=0..1000))
divide_curve_55 = DivideCurve(Curve=offset_curve_57, Count=division_88, Kinks=False)  # -> Points, Tangents, Parameters
divide_curve_56 = DivideCurve(Curve=offset_curve_58, Count=division_89, Kinks=False)  # -> Points, Tangents, Parameters
divide_curve_57 = DivideCurve(Curve=offset_curve_55, Count=division_90, Kinks=False)  # -> Points, Tangents, Parameters
divide_curve_58 = DivideCurve(Curve=offset_curve_56, Count=division_91, Kinks=False)  # -> Points, Tangents, Parameters
line_78 = Line(StartPoint=divide_curve_56.Points, EndPoint=divide_curve_55.Points)
line_79 = Line(StartPoint=divide_curve_55.Points, EndPoint=divide_curve_56.Points)
line_80 = Line(StartPoint=divide_curve_58.Points, EndPoint=divide_curve_57.Points)
loft_57 = Loft(Curves=line_78, Options={Adjust=False, Closed=False, LoftEnds=0, LoftSimp=0, LoftType=0, Rebuild=10, Refit=0.01})
loft_58 = Loft(Curves=line_79, Options={Adjust=False, Closed=False, LoftEnds=0, LoftSimp=0, LoftType=0, Rebuild=10, Refit=0.01})
loft_59 = Loft(Curves=line_80, Options={Adjust=False, Closed=False, LoftEnds=0, LoftSimp=0, LoftType=0, Rebuild=10, Refit=0.01})
surface_closest_point_41 = SurfaceClosestPoint(Point=divide_curve_56.Points, Surface=loft_57)  # -> Point, UVPoint, Distance
surface_closest_point_42 = SurfaceClosestPoint(Point=divide_curve_55.Points, Surface=loft_58)  # -> Point, UVPoint, Distance
surface_closest_point_43 = SurfaceClosestPoint(Point=divide_curve_58.Points, Surface=loft_59)  # -> Point, UVPoint, Distance
evaluate_surface_41 = EvaluateSurface(Surface=loft_57, Point=surface_closest_point_41.UVPoint)  # -> Point, Normal, UDirection, VDirection, Frame
evaluate_surface_42 = EvaluateSurface(Surface=loft_58, Point=surface_closest_point_42.UVPoint)  # -> Point, Normal, UDirection, VDirection, Frame
evaluate_surface_43 = EvaluateSurface(Surface=loft_59, Point=surface_closest_point_43.UVPoint)  # -> Point, Normal, UDirection, VDirection, Frame
rotate_plane_41 = RotatePlane(Plane=evaluate_surface_43.Frame, Angle=radians_30)
rotate_plane_42 = RotatePlane(Plane=evaluate_surface_41.Frame, Angle=radians_34)
rotate_plane_43 = RotatePlane(Plane=evaluate_surface_42.Frame, Angle=radians_35)
list_item_14 = ListItem(List=rotate_plane_41, Index=1, Wrap=True)
division_92 = Division(A=Slider(290, range=0..1000), B=2)
division_93 = Division(A=Slider(140, range=0..1000), B=2)
division_94 = Division(A=Slider(75, range=0..100), B=2)
division_95 = Division(A=Slider(140, range=0..1000), B=2)
division_96 = Division(A=Slider(290, range=0..1000), B=2)
division_97 = Division(A=Slider(75, range=0..100), B=2)
addition_31 = Addition(A=Slider(85, range=0..100), B=division_97)
unit_z_35 = UnitZ(Factor=addition_31)
move_23 = Move(Geometry=clean_tree_6, Motion=unit_z_35)  # -> Geometry, Transform
length_68 = Length(Curve=move_23.Geometry)
length_69 = Length(Curve=move_23.Geometry)
subtraction_26 = Subtraction(A=length_68, B=number_slider_31)
subtraction_27 = Subtraction(A=length_69, B=addition_27)
evaluate_curve_44 = EvaluateCurve(Curve=move_23.Geometry, Parameter=subtraction_26)  # -> Point, Tangent, Angle
evaluate_curve_45 = EvaluateCurve(Curve=move_23.Geometry, Parameter=subtraction_27)  # -> Point, Tangent, Angle
evaluate_curve_46 = EvaluateCurve(Curve=move_23.Geometry, Parameter=Slider(375, range=0..1500))  # -> Point, Tangent, Angle
end_points_16 = EndPoints(Curve=move_23.Geometry)  # -> Start, End
line_81 = Line(StartPoint=end_points_16.End, EndPoint=evaluate_curve_44.Point)
line_82 = Line(StartPoint=evaluate_curve_46.Point, EndPoint=evaluate_curve_45.Point)
offset_curve_59 = OffsetCurve(Curve=line_82, Distance=Slider(-75, range=-75..0), Plane=PlaneXY(0, 0, 0), Corners=1)
offset_curve_60 = OffsetCurve(Curve=line_82, Distance=Slider(75, range=0..100), Plane=PlaneXY(0, 0, 0), Corners=1)
offset_curve_61 = OffsetCurve(Curve=line_81, Distance=Slider(75, range=0..100), Plane=PlaneXY(0, 0, 0), Corners=1)
offset_curve_62 = OffsetCurve(Curve=line_81, Distance=Slider(0, range=-75..0), Plane=PlaneXY(0, 0, 0), Corners=1)
length_70 = Length(Curve=offset_curve_59)
length_71 = Length(Curve=offset_curve_62)
length_72 = Length(Curve=offset_curve_60)
length_73 = Length(Curve=offset_curve_61)
division_98 = Division(A=length_70, B=Slider(300, range=0..1000))
division_99 = Division(A=length_72, B=Slider(300, range=0..1000))
division_100 = Division(A=length_71, B=Slider(300, range=0..1000))
division_101 = Division(A=length_73, B=Slider(300, range=0..1000))
divide_curve_59 = DivideCurve(Curve=offset_curve_59, Count=division_98, Kinks=False)  # -> Points, Tangents, Parameters
divide_curve_60 = DivideCurve(Curve=offset_curve_62, Count=division_100, Kinks=False)  # -> Points, Tangents, Parameters
divide_curve_61 = DivideCurve(Curve=offset_curve_60, Count=division_99, Kinks=False)  # -> Points, Tangents, Parameters
divide_curve_62 = DivideCurve(Curve=offset_curve_61, Count=division_101, Kinks=False)  # -> Points, Tangents, Parameters
line_83 = Line(StartPoint=divide_curve_61.Points, EndPoint=divide_curve_59.Points)
line_84 = Line(StartPoint=divide_curve_59.Points, EndPoint=divide_curve_61.Points)
line_85 = Line(StartPoint=divide_curve_60.Points, EndPoint=divide_curve_62.Points)
loft_60 = Loft(Curves=line_83, Options={Adjust=False, Closed=False, LoftEnds=0, LoftSimp=0, LoftType=0, Rebuild=10, Refit=0.01})
loft_61 = Loft(Curves=line_84, Options={Adjust=False, Closed=False, LoftEnds=0, LoftSimp=0, LoftType=0, Rebuild=10, Refit=0.01})
loft_62 = Loft(Curves=line_85, Options={Adjust=False, Closed=False, LoftEnds=0, LoftSimp=0, LoftType=0, Rebuild=10, Refit=0.01})
surface_closest_point_44 = SurfaceClosestPoint(Point=divide_curve_61.Points, Surface=loft_60)  # -> Point, UVPoint, Distance
surface_closest_point_45 = SurfaceClosestPoint(Point=divide_curve_59.Points, Surface=loft_61)  # -> Point, UVPoint, Distance
surface_closest_point_46 = SurfaceClosestPoint(Point=divide_curve_60.Points, Surface=loft_62)  # -> Point, UVPoint, Distance
evaluate_surface_44 = EvaluateSurface(Surface=loft_60, Point=surface_closest_point_44.UVPoint)  # -> Point, Normal, UDirection, VDirection, Frame
evaluate_surface_45 = EvaluateSurface(Surface=loft_61, Point=surface_closest_point_45.UVPoint)  # -> Point, Normal, UDirection, VDirection, Frame
evaluate_surface_46 = EvaluateSurface(Surface=loft_62, Point=surface_closest_point_46.UVPoint)  # -> Point, Normal, UDirection, VDirection, Frame
rotate_plane_44 = RotatePlane(Plane=evaluate_surface_46.Frame, Angle=radians_31)
rotate_plane_45 = RotatePlane(Plane=evaluate_surface_44.Frame, Angle=radians_40)
rotate_plane_46 = RotatePlane(Plane=evaluate_surface_45.Frame, Angle=radians_41)
list_item_15 = ListItem(List=rotate_plane_44, Index=1, Wrap=True)
division_102 = Division(A=Slider(75, range=0..100), B=2)
addition_32 = Addition(A=Slider(85, range=0..100), B=division_102)
unit_z_36 = UnitZ(Factor=addition_32)
move_24 = Move(Geometry=clean_tree_5, Motion=unit_z_36)  # -> Geometry, Transform
length_74 = Length(Curve=move_24.Geometry)
subtraction_28 = Subtraction(A=length_74, B=Slider(375, range=0..1500))
evaluate_curve_47 = EvaluateCurve(Curve=move_24.Geometry, Parameter=subtraction_28)  # -> Point, Tangent, Angle
evaluate_curve_48 = EvaluateCurve(Curve=move_24.Geometry, Parameter=Slider(375, range=0..1500))  # -> Point, Tangent, Angle
line_86 = Line(StartPoint=evaluate_curve_48.Point, EndPoint=evaluate_curve_47.Point)
offset_curve_63 = OffsetCurve(Curve=line_86, Distance=Slider(-75, range=-75..0), Plane=PlaneXY(0, 0, 0), Corners=1)
offset_curve_64 = OffsetCurve(Curve=line_86, Distance=Slider(75, range=0..100), Plane=PlaneXY(0, 0, 0), Corners=1)
length_75 = Length(Curve=offset_curve_63)
length_76 = Length(Curve=offset_curve_64)
division_103 = Division(A=length_75, B=Slider(300, range=0..1000))
division_104 = Division(A=length_76, B=Slider(300, range=0..1000))
divide_curve_63 = DivideCurve(Curve=offset_curve_63, Count=division_103, Kinks=False)  # -> Points, Tangents, Parameters
divide_curve_64 = DivideCurve(Curve=offset_curve_64, Count=division_104, Kinks=False)  # -> Points, Tangents, Parameters
line_87 = Line(StartPoint=divide_curve_64.Points, EndPoint=divide_curve_63.Points)
line_88 = Line(StartPoint=divide_curve_63.Points, EndPoint=divide_curve_64.Points)
loft_63 = Loft(Curves=line_87, Options={Adjust=False, Closed=False, LoftEnds=0, LoftSimp=0, LoftType=0, Rebuild=10, Refit=0.01})
loft_64 = Loft(Curves=line_88, Options={Adjust=False, Closed=False, LoftEnds=0, LoftSimp=0, LoftType=0, Rebuild=10, Refit=0.01})
surface_closest_point_47 = SurfaceClosestPoint(Point=divide_curve_64.Points, Surface=loft_63)  # -> Point, UVPoint, Distance
surface_closest_point_48 = SurfaceClosestPoint(Point=divide_curve_63.Points, Surface=loft_64)  # -> Point, UVPoint, Distance
evaluate_surface_47 = EvaluateSurface(Surface=loft_63, Point=surface_closest_point_47.UVPoint)  # -> Point, Normal, UDirection, VDirection, Frame
evaluate_surface_48 = EvaluateSurface(Surface=loft_64, Point=surface_closest_point_48.UVPoint)  # -> Point, Normal, UDirection, VDirection, Frame
rotate_plane_47 = RotatePlane(Plane=evaluate_surface_47.Frame, Angle=radians_47)
rotate_plane_48 = RotatePlane(Plane=evaluate_surface_48.Frame, Angle=radians_48)
division_105 = Division(A=Slider(290, range=0..1000), B=2)
division_106 = Division(A=Slider(140, range=0..1000), B=2)
division_107 = Division(A=Slider(140, range=0..1000), B=2)
division_108 = Division(A=Slider(290, range=0..1000), B=2)
division_109 = Division(A=Slider(75, range=0..100), B=2)
division_110 = Division(A=Slider(140, range=0..1000), B=2)
division_111 = Division(A=Slider(290, range=0..1000), B=2)
division_112 = Division(A=Slider(75, range=0..100), B=2)
center_box_13 = CenterBox(Base=[rotate_plane_37, rotate_plane_38], X=division_77, Y=division_78, Z=division_72)
division_113 = Division(A=Slider(140, range=0..1000), B=2)
division_114 = Division(A=Slider(290, range=0..1000), B=2)
center_box_14 = CenterBox(Base=[rotate_plane_39, rotate_plane_40], X=division_82, Y=division_83, Z=division_79)
center_box_15 = CenterBox(Base=list_item_13, X=division_75, Y=division_76, Z=division_71)
list_item_16 = ListItem(List=rotate_plane_34, Index=1, Wrap=True)
center_box_16 = CenterBox(Base=[rotate_plane_30, rotate_plane_31], X=division_85, Y=division_86, Z=division_84)
division_115 = Division(A=Slider(75, range=0..100), B=2)
division_116 = Division(A=Slider(290, range=0..1000), B=2)
division_117 = Division(A=Slider(140, range=0..1000), B=2)
division_118 = Division(A=Slider(75, range=0..100), B=2)
division_119 = Division(A=Slider(140, range=0..1000), B=2)
division_120 = Division(A=Slider(290, range=0..1000), B=2)
center_box_17 = CenterBox(Base=list_item_14, X=division_92, Y=division_93, Z=division_87)
center_box_18 = CenterBox(Base=[rotate_plane_42, rotate_plane_43], X=division_95, Y=division_96, Z=division_94)
center_box_19 = CenterBox(Base=[rotate_plane_32, rotate_plane_33], X=division_107, Y=division_108, Z=division_102)
center_box_20 = CenterBox(Base=list_item_15, X=division_105, Y=division_106, Z=division_97)
center_box_21 = CenterBox(Base=[rotate_plane_45, rotate_plane_46], X=division_110, Y=division_111, Z=division_109)
center_box_22 = CenterBox(Base=[rotate_plane_47, rotate_plane_48], X=division_113, Y=division_114, Z=division_112)
center_box_23 = CenterBox(Base=list_item_16, X=division_116, Y=division_117, Z=division_115)
center_box_24 = CenterBox(Base=[rotate_plane_35, rotate_plane_36], X=division_119, Y=division_120, Z=division_118)
unit_z_37 = UnitZ(Factor=Slider(170, range=0..1000))
unit_z_38 = UnitZ(Factor=Slider(170, range=0..1000))
unit_z_39 = UnitZ(Factor=Slider(170, range=0..1000))
unit_z_40 = UnitZ(Factor=Slider(170, range=0..1000))
unit_z_41 = UnitZ(Factor=Slider(170, range=0..1000))
unit_z_42 = UnitZ(Factor=Slider(170, range=0..1000))
unit_z_43 = UnitZ(Factor=Slider(170, range=0..1000))
linear_array_17 = LinearArray(Geometry=center_box_13, Direction=unit_z_37, Count=Slider(6, range=0..20))  # -> Geometry, Transform
linear_array_18 = LinearArray(Geometry=center_box_14, Direction=unit_z_38, Count=Slider(21, range=0..25))  # -> Geometry, Transform
linear_array_19 = LinearArray(Geometry=[center_box_16, center_box_15], Direction=unit_z_39, Count=Slider(6, range=0..20))  # -> Geometry, Transform
linear_array_20 = LinearArray(Geometry=[center_box_18, center_box_17], Direction=unit_z_41, Count=Slider(21, range=0..25))  # -> Geometry, Transform
unit_z_44 = UnitZ(Factor=Slider(170, range=0..1000))
linear_array_21 = LinearArray(Geometry=center_box_19, Direction=unit_z_40, Count=Slider(6, range=0..20))  # -> Geometry, Transform
linear_array_22 = LinearArray(Geometry=[center_box_21, center_box_20], Direction=unit_z_42, Count=Slider(6, range=0..20))  # -> Geometry, Transform
linear_array_23 = LinearArray(Geometry=center_box_22, Direction=unit_z_43, Count=Slider(5, range=0..20))  # -> Geometry, Transform
linear_array_24 = LinearArray(Geometry=[center_box_24, center_box_23], Direction=unit_z_44, Count=Slider(6, range=0..20))  # -> Geometry, Transform
geometry_6 = Geometry([linear_array_17.Geometry, linear_array_19.Geometry])
geometry_7 = Geometry([linear_array_18.Geometry, linear_array_20.Geometry])
geometry_8 = Geometry([linear_array_21.Geometry, linear_array_22.Geometry])
geometry_9 = Geometry([linear_array_24.Geometry, linear_array_23.Geometry])

# ---- group: Wall / Output
geometry_10 = Geometry([geometry_9, geometry_8, geometry_7, geometry_6])

# ---- group: Wall with arch
ghpython_script_7 = GhPythonScript(x=curve_4, y=curve_5, z=boolean_toggle_3)  # -> out, a, c; same code as ghpython_script
curve_14 = Curve(ghpython_script_7.c)
curve_15 = Curve(ghpython_script_7.a)
length_77 = Length(Curve=curve_15)
panel_5 = Panel(length_77)
ghpython_script_8 = GhPythonScript(x=panel_5, e=curve_15)  # -> out, a, c, d; same code as ghpython_script_5
length_78 = Length(Curve=curve_14)
flatten_tree_21 = FlattenTree(Tree=ghpython_script_8.d, Path="{0}")
flatten_tree_22 = FlattenTree(Tree=ghpython_script_8.c, Path="{0}")
clean_tree_9 = CleanTree(RemoveNulls=True, RemoveInvalid=True, RemoveEmpty=False, Tree=flatten_tree_21)
clean_tree_10 = CleanTree(RemoveNulls=True, RemoveInvalid=True, RemoveEmpty=False, Tree=flatten_tree_22)
panel_6 = Panel(length_78)
curve_16 = Curve(clean_tree_10)
curve_17 = Curve(clean_tree_9)
ghpython_script_9 = GhPythonScript(x=panel_6, e=curve_14)  # -> out, a, c, d; same code as ghpython_script_5
flatten_tree_23 = FlattenTree(Tree=ghpython_script_9.d, Path="{0}")
flatten_tree_24 = FlattenTree(Tree=ghpython_script_9.c, Path="{0}")
clean_tree_11 = CleanTree(RemoveNulls=True, RemoveInvalid=True, RemoveEmpty=False, Tree=flatten_tree_23)
clean_tree_12 = CleanTree(RemoveNulls=True, RemoveInvalid=True, RemoveEmpty=False, Tree=flatten_tree_24)
curve_18 = Curve(clean_tree_12)
curve_19 = Curve(clean_tree_11)
evaluate_curve_49 = EvaluateCurve(Curve=curve_17, Parameter=Slider(145, range=0..1500))  # -> Point, Tangent, Angle
evaluate_curve_50 = EvaluateCurve(Curve=curve_17, Parameter=Slider(145, range=0..1500))  # -> Point, Tangent, Angle
evaluate_curve_51 = EvaluateCurve(Curve=curve_16, Parameter=Slider(145, range=0..1500))  # -> Point, Tangent, Angle
evaluate_curve_52 = EvaluateCurve(Curve=curve_16, Parameter=Slider(145, range=0..1500))  # -> Point, Tangent, Angle
evaluate_curve_53 = EvaluateCurve(Curve=curve_19, Parameter=Slider(145, range=0..1500))  # -> Point, Tangent, Angle
evaluate_curve_54 = EvaluateCurve(Curve=curve_19, Parameter=Slider(145, range=0..1500))  # -> Point, Tangent, Angle
unit_z_45 = UnitZ(Factor=37.33630941)
evaluate_curve_55 = EvaluateCurve(Curve=curve_18, Parameter=Slider(145, range=0..1500))  # -> Point, Tangent, Angle
evaluate_curve_56 = EvaluateCurve(Curve=curve_18, Parameter=Slider(145, range=0..1500))  # -> Point, Tangent, Angle
unit_z_46 = UnitZ(Factor=37.33630941)
move1_5 = Move(Geometry=curve_17, Motion=unit_z_45)  # -> Geometry, Transform
evaluate_curve_57 = EvaluateCurve(Curve=curve_17, Parameter=Slider(295, range=0..1500))  # -> Point, Tangent, Angle
curve_middle_5 = CurveMiddle(Curve=curve_17)
move1_6 = Move(Geometry=curve_16, Motion=unit_z_46)  # -> Geometry, Transform
evaluate_curve_58 = EvaluateCurve(Curve=curve_16, Parameter=Slider(295, range=0..1500))  # -> Point, Tangent, Angle
curve_middle_6 = CurveMiddle(Curve=curve_16)
number_slider_33 = Slider(300, range=0..1500)
length_79 = Length(Curve=move1_5.Geometry)
length_80 = Length(Curve=move1_5.Geometry)
number_slider_34 = Slider(1, range=0..1)
number_slider_35 = Slider(1, range=0..1)
number_slider_36 = Slider(225, range=0..1500)
length_81 = Length(Curve=move1_6.Geometry)
length_82 = Length(Curve=move1_6.Geometry)
addition_33 = Addition(A=Slider(225, range=0..1500), B=number_slider_33)
subtraction_29 = Subtraction(A=length_79, B=Slider(1275, range=0..1500))
subtraction_30 = Subtraction(A=length_80, B=Slider(225, range=0..1500))
number_slider_37 = Slider(1, range=0..1)
number_slider_38 = Slider(1, range=0..1)
subtraction_31 = Subtraction(A=length_81, B=Slider(1125, range=0..1500))
subtraction_32 = Subtraction(A=length_82, B=Slider(225, range=0..1500))
evaluate_curve_59 = EvaluateCurve(Curve=curve_19, Parameter=Slider(295, range=0..1500))  # -> Point, Tangent, Angle
evaluate_curve_60 = EvaluateCurve(Curve=move1_5.Geometry, Parameter=subtraction_29)  # -> Point, Tangent, Angle
evaluate_curve_61 = EvaluateCurve(Curve=move1_5.Geometry, Parameter=subtraction_30)  # -> Point, Tangent, Angle
curve_middle_7 = CurveMiddle(Curve=curve_19)
addition_34 = Addition(A=Slider(225, range=0..1500), B=number_slider_36)
end_points_17 = EndPoints(Curve=move1_5.Geometry)  # -> Start, End
end_points_18 = EndPoints(Curve=move1_5.Geometry)  # -> Start, End
evaluate_curve_62 = EvaluateCurve(Curve=curve_18, Parameter=Slider(295, range=0..1500))  # -> Point, Tangent, Angle
evaluate_curve_63 = EvaluateCurve(Curve=move1_6.Geometry, Parameter=subtraction_31)  # -> Point, Tangent, Angle
evaluate_curve_64 = EvaluateCurve(Curve=move1_6.Geometry, Parameter=subtraction_32)  # -> Point, Tangent, Angle
curve_middle_8 = CurveMiddle(Curve=curve_18)
end_points_19 = EndPoints(Curve=move1_6.Geometry)  # -> Start, End
end_points_20 = EndPoints(Curve=move1_6.Geometry)  # -> Start, End
number_slider_39 = Slider(300, range=0..1500)
line_89 = Line(StartPoint=end_points_17.Start, EndPoint=evaluate_curve_60.Point)
line_90 = Line(StartPoint=end_points_18.End, EndPoint=evaluate_curve_61.Point)
number_slider_40 = Slider(1, range=0..1)
number_slider_41 = Slider(1, range=0..1)
number_slider_42 = Slider(225, range=0..1500)
line_91 = Line(StartPoint=end_points_19.Start, EndPoint=evaluate_curve_63.Point)
line_92 = Line(StartPoint=end_points_20.End, EndPoint=evaluate_curve_64.Point)
addition_35 = Addition(A=Slider(225, range=0..1500), B=number_slider_39)
number_slider_43 = Slider(1, range=0..1)
number_slider_44 = Slider(1, range=0..1)
addition_36 = Addition(A=Slider(225, range=0..1500), B=number_slider_42)
number_slider_45 = Slider(1, range=0..1)
offset_curve_65 = OffsetCurve(Curve=line_89, Distance=Slider(75, range=0..100), Plane=PlaneXY(0, 0, 0), Corners=1)
offset_curve_66 = OffsetCurve(Curve=line_90, Distance=Slider(75, range=0..100), Plane=PlaneXY(0, 0, 0), Corners=1)
offset_curve_67 = OffsetCurve(Curve=line_89, Distance=Slider(0, range=-75..0), Plane=PlaneXY(0, 0, 0), Corners=1)
offset_curve_68 = OffsetCurve(Curve=line_90, Distance=Slider(0, range=-75..0), Plane=PlaneXY(0, 0, 0), Corners=1)
radians_49 = Radians(Degrees=90)
radians_50 = Radians(Degrees=90)
number_slider_46 = Slider(1, range=0..1)
offset_curve_69 = OffsetCurve(Curve=line_91, Distance=Slider(75, range=0..100), Plane=PlaneXY(0, 0, 0), Corners=1)
offset_curve_70 = OffsetCurve(Curve=line_92, Distance=Slider(75, range=0..100), Plane=PlaneXY(0, 0, 0), Corners=1)
offset_curve_71 = OffsetCurve(Curve=line_91, Distance=Slider(0, range=-75..0), Plane=PlaneXY(0, 0, 0), Corners=1)
offset_curve_72 = OffsetCurve(Curve=line_92, Distance=Slider(0, range=-75..0), Plane=PlaneXY(0, 0, 0), Corners=1)
radians_51 = Radians(Degrees=90)
radians_52 = Radians(Degrees=90)
length_83 = Length(Curve=offset_curve_65)
length_84 = Length(Curve=offset_curve_67)
length_85 = Length(Curve=offset_curve_66)
length_86 = Length(Curve=offset_curve_68)
length_87 = Length(Curve=offset_curve_69)
length_88 = Length(Curve=offset_curve_71)
length_89 = Length(Curve=offset_curve_70)
length_90 = Length(Curve=offset_curve_72)
division_121 = Division(A=length_83, B=Slider(300, range=0..1000))
division_122 = Division(A=length_84, B=Slider(300, range=0..1000))
division_123 = Division(A=length_85, B=Slider(300, range=0..1000))
division_124 = Division(A=length_86, B=Slider(300, range=0..1000))
number_slider_47 = Slider(1, range=0..1)
division_125 = Division(A=length_87, B=Slider(300, range=0..1000))
division_126 = Division(A=length_88, B=Slider(300, range=0..1000))
division_127 = Division(A=length_89, B=Slider(300, range=0..1000))
division_128 = Division(A=length_90, B=Slider(300, range=0..1000))
divide_curve_65 = DivideCurve(Curve=offset_curve_65, Count=division_121, Kinks=False)  # -> Points, Tangents, Parameters
divide_curve_66 = DivideCurve(Curve=offset_curve_66, Count=division_123, Kinks=False)  # -> Points, Tangents, Parameters
divide_curve_67 = DivideCurve(Curve=offset_curve_67, Count=division_122, Kinks=False)  # -> Points, Tangents, Parameters
divide_curve_68 = DivideCurve(Curve=offset_curve_68, Count=division_124, Kinks=False)  # -> Points, Tangents, Parameters
radians_53 = Radians(Degrees=90)
radians_54 = Radians(Degrees=90)
number_slider_48 = Slider(1, range=0..1)
divide_curve_69 = DivideCurve(Curve=offset_curve_69, Count=division_125, Kinks=False)  # -> Points, Tangents, Parameters
divide_curve_70 = DivideCurve(Curve=offset_curve_70, Count=division_127, Kinks=False)  # -> Points, Tangents, Parameters
divide_curve_71 = DivideCurve(Curve=offset_curve_71, Count=division_126, Kinks=False)  # -> Points, Tangents, Parameters
divide_curve_72 = DivideCurve(Curve=offset_curve_72, Count=division_128, Kinks=False)  # -> Points, Tangents, Parameters
radians_55 = Radians(Degrees=90)
radians_56 = Radians(Degrees=90)
line_93 = Line(StartPoint=divide_curve_67.Points, EndPoint=divide_curve_65.Points)
line_94 = Line(StartPoint=divide_curve_68.Points, EndPoint=divide_curve_66.Points)
radians_57 = Radians(Degrees=90)
line_95 = Line(StartPoint=divide_curve_71.Points, EndPoint=divide_curve_69.Points)
line_96 = Line(StartPoint=divide_curve_72.Points, EndPoint=divide_curve_70.Points)
loft_65 = Loft(Curves=line_94, Options={Adjust=False, Closed=False, LoftEnds=0, LoftSimp=0, LoftType=0, Rebuild=10, Refit=0.01})
loft_66 = Loft(Curves=line_93, Options={Adjust=False, Closed=False, LoftEnds=0, LoftSimp=0, LoftType=0, Rebuild=10, Refit=0.01})
radians_58 = Radians(Degrees=90)
loft_67 = Loft(Curves=line_96, Options={Adjust=False, Closed=False, LoftEnds=0, LoftSimp=0, LoftType=0, Rebuild=10, Refit=0.01})
loft_68 = Loft(Curves=line_95, Options={Adjust=False, Closed=False, LoftEnds=0, LoftSimp=0, LoftType=0, Rebuild=10, Refit=0.01})
surface_closest_point_49 = SurfaceClosestPoint(Point=divide_curve_67.Points, Surface=loft_66)  # -> Point, UVPoint, Distance
surface_closest_point_50 = SurfaceClosestPoint(Point=divide_curve_68.Points, Surface=loft_65)  # -> Point, UVPoint, Distance
surface_closest_point_51 = SurfaceClosestPoint(Point=divide_curve_71.Points, Surface=loft_68)  # -> Point, UVPoint, Distance
surface_closest_point_52 = SurfaceClosestPoint(Point=divide_curve_72.Points, Surface=loft_67)  # -> Point, UVPoint, Distance
radians_59 = Radians(Degrees=90)
evaluate_surface_49 = EvaluateSurface(Surface=loft_66, Point=surface_closest_point_49.UVPoint)  # -> Point, Normal, UDirection, VDirection, Frame
evaluate_surface_50 = EvaluateSurface(Surface=loft_65, Point=surface_closest_point_50.UVPoint)  # -> Point, Normal, UDirection, VDirection, Frame
radians_60 = Radians(Degrees=90)
radians_61 = Radians(Degrees=90)
radians_62 = Radians(Degrees=90)
radians_63 = Radians(Degrees=90)
radians_64 = Radians(Degrees=90)
radians_65 = Radians(Degrees=90)
radians_66 = Radians(Degrees=90)
radians_67 = Radians(Degrees=90)
radians_68 = Radians(Degrees=90)
radians_69 = Radians(Degrees=90)
radians_70 = Radians(Degrees=90)
number_slider_49 = Slider(610, range=0..1000)
addition_37 = Addition(A=number_slider_49, B=150)
addition_38 = Addition(A=number_slider_49, B=150)
evaluate_surface_51 = EvaluateSurface(Surface=loft_68, Point=surface_closest_point_51.UVPoint)  # -> Point, Normal, UDirection, VDirection, Frame
evaluate_surface_52 = EvaluateSurface(Surface=loft_67, Point=surface_closest_point_52.UVPoint)  # -> Point, Normal, UDirection, VDirection, Frame
radians_71 = Radians(Degrees=90)
radians_72 = Radians(Degrees=90)
radians_73 = Radians(Degrees=90)
radians_74 = Radians(Degrees=90)
radians_75 = Radians(Degrees=90)
radians_76 = Radians(Degrees=90)
radians_77 = Radians(Degrees=90)
radians_78 = Radians(Degrees=90)
radians_79 = Radians(Degrees=90)
rotate_plane_49 = RotatePlane(Plane=evaluate_surface_49.Frame, Angle=radians_60)
rotate_plane_50 = RotatePlane(Plane=evaluate_surface_50.Frame, Angle=radians_61)
radians_80 = Radians(Degrees=90)
radians_81 = Radians(Degrees=90)
radians_82 = Radians(Degrees=90)
radians_83 = Radians(Degrees=90)
radians_84 = Radians(Degrees=90)
radians_85 = Radians(Degrees=90)
radians_86 = Radians(Degrees=90)
number_slider_50 = Slider(610, range=0..1000)
addition_39 = Addition(A=number_slider_50, B=150)
addition_40 = Addition(A=number_slider_50, B=150)
rotate_plane_51 = RotatePlane(Plane=evaluate_surface_51.Frame, Angle=radians_71)
rotate_plane_52 = RotatePlane(Plane=evaluate_surface_52.Frame, Angle=radians_72)
panel_7 = Panel(rotate_plane_49)
number_slider_51 = Slider(75, range=0..100)
addition_41 = Addition(A=Slider(10, range=0..100), B=number_slider_51)
number_slider_52 = Slider(75, range=0..100)
addition_42 = Addition(A=Slider(10, range=0..10), B=number_slider_52)
number_slider_53 = Slider(75, range=0..100)
radians_87 = Radians(Degrees=90)
radians_88 = Radians(Degrees=90)
radians_89 = Radians(Degrees=90)
radians_90 = Radians(Degrees=90)
radians_91 = Radians(Degrees=90)
radians_92 = Radians(Degrees=90)
radians_93 = Radians(Degrees=90)
radians_94 = Radians(Degrees=90)
number_slider_54 = Slider(75, range=0..100)
addition_43 = Addition(A=Slider(10, range=0..100), B=number_slider_54)
radians_95 = Radians(Degrees=90)
number_slider_55 = Slider(75, range=0..100)
addition_44 = Addition(A=Slider(10, range=0..10), B=number_slider_55)
number_slider_56 = Slider(75, range=0..100)
radians_96 = Radians(Degrees=90)
radians_97 = Radians(Degrees=90)
number_slider_57 = Slider(610, range=0..1000)
addition_45 = Addition(A=number_slider_57, B=150)
addition_46 = Addition(A=number_slider_57, B=150)
radians_98 = Radians(Degrees=90)
radians_99 = Radians(Degrees=90)
division_129 = Division(A=Slider(75, range=0..100), B=2)
division_130 = Division(A=Slider(290, range=0..1000), B=2)
division_131 = Division(A=Slider(140, range=0..1000), B=2)
radians_100 = Radians(Degrees=90)
radians_101 = Radians(Degrees=90)
radians_102 = Radians(Degrees=90)
division_132 = Division(A=Slider(75, range=0..100), B=2)
radians_103 = Radians(Degrees=90)
division_133 = Division(A=Slider(140, range=0..1000), B=2)
division_134 = Division(A=Slider(290, range=0..1000), B=2)
radians_104 = Radians(Degrees=90)
radians_105 = Radians(Degrees=90)
radians_106 = Radians(Degrees=90)
list_item_17 = ListItem(List=rotate_plane_49, Index=1, Wrap=True)
list_item_18 = ListItem(List=rotate_plane_50, Index=1, Wrap=True)
division_135 = Division(A=Slider(75, range=0..100), B=2)
division_136 = Division(A=Slider(290, range=0..1000), B=2)
division_137 = Division(A=Slider(140, range=0..1000), B=2)
division_138 = Division(A=number_slider_52, B=2)
addition_47 = Addition(A=Slider(85, range=0..100), B=division_138)
unit_z_47 = UnitZ(Factor=addition_47)
move1_7 = Move(Geometry=curve_17, Motion=unit_z_47)  # -> Geometry, Transform
length_91 = Length(Curve=move1_7.Geometry)
length_92 = Length(Curve=move1_7.Geometry)
subtraction_33 = Subtraction(A=length_91, B=Slider(1237.5, range=0..1500))
subtraction_34 = Subtraction(A=length_92, B=Slider(262.5, range=0..1500))
evaluate_curve_65 = EvaluateCurve(Curve=move1_7.Geometry, Parameter=subtraction_33)  # -> Point, Tangent, Angle
evaluate_curve_66 = EvaluateCurve(Curve=move1_7.Geometry, Parameter=subtraction_34)  # -> Point, Tangent, Angle
end_points_21 = EndPoints(Curve=move1_7.Geometry)  # -> Start, End
end_points_22 = EndPoints(Curve=move1_7.Geometry)  # -> Start, End
line_97 = Line(StartPoint=end_points_22.End, EndPoint=evaluate_curve_66.Point)
line_98 = Line(StartPoint=end_points_21.Start, EndPoint=evaluate_curve_65.Point)
offset_curve_73 = OffsetCurve(Curve=line_98, Distance=Slider(75, range=0..100), Plane=PlaneXY(0, 0, 0), Corners=1)
offset_curve_74 = OffsetCurve(Curve=line_97, Distance=Slider(75, range=0..100), Plane=PlaneXY(0, 0, 0), Corners=1)
offset_curve_75 = OffsetCurve(Curve=line_98, Distance=Slider(0, range=-75..0), Plane=PlaneXY(0, 0, 0), Corners=1)
offset_curve_76 = OffsetCurve(Curve=line_97, Distance=Slider(0, range=-75..0), Plane=PlaneXY(0, 0, 0), Corners=1)
length_93 = Length(Curve=offset_curve_73)
length_94 = Length(Curve=offset_curve_75)
length_95 = Length(Curve=offset_curve_74)
length_96 = Length(Curve=offset_curve_76)
division_139 = Division(A=length_93, B=Slider(300, range=0..1000))
division_140 = Division(A=length_94, B=Slider(300, range=0..1000))
division_141 = Division(A=length_95, B=Slider(300, range=0..1000))
division_142 = Division(A=length_96, B=Slider(300, range=0..1000))
divide_curve_73 = DivideCurve(Curve=offset_curve_73, Count=division_139, Kinks=False)  # -> Points, Tangents, Parameters
divide_curve_74 = DivideCurve(Curve=offset_curve_74, Count=division_141, Kinks=False)  # -> Points, Tangents, Parameters
divide_curve_75 = DivideCurve(Curve=offset_curve_75, Count=division_140, Kinks=False)  # -> Points, Tangents, Parameters
divide_curve_76 = DivideCurve(Curve=offset_curve_76, Count=division_142, Kinks=False)  # -> Points, Tangents, Parameters
line_99 = Line(StartPoint=divide_curve_75.Points, EndPoint=divide_curve_73.Points)
line_100 = Line(StartPoint=divide_curve_76.Points, EndPoint=divide_curve_74.Points)
loft_69 = Loft(Curves=line_99, Options={Adjust=False, Closed=False, LoftEnds=0, LoftSimp=0, LoftType=0, Rebuild=10, Refit=0.01})
loft_70 = Loft(Curves=line_100, Options={Adjust=False, Closed=False, LoftEnds=0, LoftSimp=0, LoftType=0, Rebuild=10, Refit=0.01})
surface_closest_point_53 = SurfaceClosestPoint(Point=divide_curve_75.Points, Surface=loft_69)  # -> Point, UVPoint, Distance
surface_closest_point_54 = SurfaceClosestPoint(Point=divide_curve_76.Points, Surface=loft_70)  # -> Point, UVPoint, Distance
evaluate_surface_53 = EvaluateSurface(Surface=loft_69, Point=surface_closest_point_53.UVPoint)  # -> Point, Normal, UDirection, VDirection, Frame
evaluate_surface_54 = EvaluateSurface(Surface=loft_70, Point=surface_closest_point_54.UVPoint)  # -> Point, Normal, UDirection, VDirection, Frame
rotate_plane_53 = RotatePlane(Plane=evaluate_surface_53.Frame, Angle=radians_62)
rotate_plane_54 = RotatePlane(Plane=evaluate_surface_54.Frame, Angle=radians_64)
list_item_19 = ListItem(List=rotate_plane_53, Index=1, Wrap=True)
list_item_20 = ListItem(List=rotate_plane_54, Index=1, Wrap=True)
division_143 = Division(A=Slider(290, range=0..1000), B=2)
division_144 = Division(A=Slider(65, range=0..1000), B=2)
division_145 = Division(A=number_slider_51, B=2)
division_146 = Division(A=Slider(290, range=0..1000), B=2)
division_147 = Division(A=Slider(290, range=0..1000), B=2)
division_148 = Division(A=number_slider_53, B=2)
division_149 = Division(A=Slider(290, range=0..1000), B=2)
division_150 = Division(A=Slider(290, range=0..1000), B=2)
radians_107 = Radians(Degrees=90)
radians_108 = Radians(Degrees=90)
radians_109 = Radians(Degrees=90)
radians_110 = Radians(Degrees=90)
radians_111 = Radians(Degrees=90)
radians_112 = Radians(Degrees=90)
number_slider_58 = Slider(610, range=0..1000)
addition_48 = Addition(A=number_slider_58, B=150)
addition_49 = Addition(A=number_slider_58, B=150)
division_151 = Division(A=Slider(75, range=0..100), B=2)
division_152 = Division(A=Slider(140, range=0..1000), B=2)
division_153 = Division(A=Slider(290, range=0..1000), B=2)
list_item_21 = ListItem(List=rotate_plane_51, Index=1, Wrap=True)
list_item_22 = ListItem(List=rotate_plane_52, Index=1, Wrap=True)
division_154 = Division(A=Slider(75, range=0..100), B=2)
division_155 = Division(A=Slider(290, range=0..1000), B=2)
division_156 = Division(A=Slider(140, range=0..1000), B=2)
division_157 = Division(A=number_slider_55, B=2)
addition_50 = Addition(A=Slider(85, range=0..100), B=division_157)
unit_z_48 = UnitZ(Factor=addition_50)
move1_8 = Move(Geometry=curve_16, Motion=unit_z_48)  # -> Geometry, Transform
length_97 = Length(Curve=move1_8.Geometry)
length_98 = Length(Curve=move1_8.Geometry)
subtraction_35 = Subtraction(A=length_97, B=Slider(1087.5, range=0..1500))
subtraction_36 = Subtraction(A=length_98, B=Slider(262.5, range=0..1500))
evaluate_curve_67 = EvaluateCurve(Curve=move1_8.Geometry, Parameter=subtraction_35)  # -> Point, Tangent, Angle
evaluate_curve_68 = EvaluateCurve(Curve=move1_8.Geometry, Parameter=subtraction_36)  # -> Point, Tangent, Angle
end_points_23 = EndPoints(Curve=move1_8.Geometry)  # -> Start, End
end_points_24 = EndPoints(Curve=move1_8.Geometry)  # -> Start, End
line_101 = Line(StartPoint=end_points_24.End, EndPoint=evaluate_curve_68.Point)
line_102 = Line(StartPoint=end_points_23.Start, EndPoint=evaluate_curve_67.Point)
offset_curve_77 = OffsetCurve(Curve=line_102, Distance=Slider(75, range=0..100), Plane=PlaneXY(0, 0, 0), Corners=1)
offset_curve_78 = OffsetCurve(Curve=line_101, Distance=Slider(75, range=0..100), Plane=PlaneXY(0, 0, 0), Corners=1)
offset_curve_79 = OffsetCurve(Curve=line_102, Distance=Slider(0, range=-75..0), Plane=PlaneXY(0, 0, 0), Corners=1)
offset_curve_80 = OffsetCurve(Curve=line_101, Distance=Slider(0, range=-75..0), Plane=PlaneXY(0, 0, 0), Corners=1)
length_99 = Length(Curve=offset_curve_77)
length_100 = Length(Curve=offset_curve_79)
length_101 = Length(Curve=offset_curve_78)
length_102 = Length(Curve=offset_curve_80)
division_158 = Division(A=length_99, B=Slider(300, range=0..1000))
division_159 = Division(A=length_100, B=Slider(300, range=0..1000))
division_160 = Division(A=length_101, B=Slider(300, range=0..1000))
division_161 = Division(A=length_102, B=Slider(300, range=0..1000))
divide_curve_77 = DivideCurve(Curve=offset_curve_77, Count=division_158, Kinks=False)  # -> Points, Tangents, Parameters
divide_curve_78 = DivideCurve(Curve=offset_curve_78, Count=division_160, Kinks=False)  # -> Points, Tangents, Parameters
divide_curve_79 = DivideCurve(Curve=offset_curve_79, Count=division_159, Kinks=False)  # -> Points, Tangents, Parameters
divide_curve_80 = DivideCurve(Curve=offset_curve_80, Count=division_161, Kinks=False)  # -> Points, Tangents, Parameters
line_103 = Line(StartPoint=divide_curve_79.Points, EndPoint=divide_curve_77.Points)
line_104 = Line(StartPoint=divide_curve_80.Points, EndPoint=divide_curve_78.Points)
loft_71 = Loft(Curves=line_103, Options={Adjust=False, Closed=False, LoftEnds=0, LoftSimp=0, LoftType=0, Rebuild=10, Refit=0.01})
loft_72 = Loft(Curves=line_104, Options={Adjust=False, Closed=False, LoftEnds=0, LoftSimp=0, LoftType=0, Rebuild=10, Refit=0.01})
surface_closest_point_55 = SurfaceClosestPoint(Point=divide_curve_79.Points, Surface=loft_71)  # -> Point, UVPoint, Distance
surface_closest_point_56 = SurfaceClosestPoint(Point=divide_curve_80.Points, Surface=loft_72)  # -> Point, UVPoint, Distance
evaluate_surface_55 = EvaluateSurface(Surface=loft_71, Point=surface_closest_point_55.UVPoint)  # -> Point, Normal, UDirection, VDirection, Frame
evaluate_surface_56 = EvaluateSurface(Surface=loft_72, Point=surface_closest_point_56.UVPoint)  # -> Point, Normal, UDirection, VDirection, Frame
rotate_plane_55 = RotatePlane(Plane=evaluate_surface_55.Frame, Angle=radians_73)
rotate_plane_56 = RotatePlane(Plane=evaluate_surface_56.Frame, Angle=radians_75)
list_item_23 = ListItem(List=rotate_plane_55, Index=1, Wrap=True)
list_item_24 = ListItem(List=rotate_plane_56, Index=1, Wrap=True)
division_162 = Division(A=Slider(290, range=0..1000), B=2)
division_163 = Division(A=Slider(65, range=0..1000), B=2)
division_164 = Division(A=number_slider_54, B=2)
division_165 = Division(A=Slider(290, range=0..1000), B=2)
division_166 = Division(A=Slider(290, range=0..1000), B=2)
division_167 = Division(A=Slider(75, range=0..100), B=2)
division_168 = Division(A=Slider(290, range=0..1000), B=2)
division_169 = Division(A=Slider(140, range=0..1000), B=2)
division_170 = Division(A=number_slider_56, B=2)
division_171 = Division(A=Slider(75, range=0..100), B=2)
division_172 = Division(A=Slider(290, range=0..1000), B=2)
division_173 = Division(A=Slider(290, range=0..1000), B=2)
division_174 = Division(A=Slider(140, range=0..1000), B=2)
division_175 = Division(A=Slider(290, range=0..1000), B=2)
division_176 = Division(A=Slider(75, range=0..100), B=2)
division_177 = Division(A=Slider(140, range=0..1000), B=2)
division_178 = Division(A=Slider(290, range=0..1000), B=2)
center_box_25 = CenterBox(Base=[list_item_17, list_item_18], X=division_136, Y=division_137, Z=division_135)
number_slider_59 = Slider(9, range=0..10)
number_slider_60 = Slider(9, range=0..10)
addition_51 = Addition(A=number_slider_60, B=number_slider_59)
multiplication_9 = Multiplication(A=addition_51, B=addition_41)
addition_52 = Addition(A=Slider(122.5, range=0..1000), B=multiplication_9)
unit_z_49 = UnitZ(Factor=addition_52)
move1_9 = Move(Geometry=curve_17, Motion=unit_z_49)  # -> Geometry, Transform
addition_53 = Addition(A=Slider(595, range=0..1000), B=addition_52)
addition_54 = Addition(A=Slider(85, range=0..1000), B=addition_53)
unit_z_50 = UnitZ(Factor=addition_54)
move_25 = Move(Geometry=curve_17, Motion=unit_z_50)  # -> Geometry, Transform
addition_55 = Addition(A=number_slider_59, B=number_slider_60)
unit_z_51 = UnitZ(Factor=addition_53)
move_26 = Move(Geometry=curve_17, Motion=unit_z_51)  # -> Geometry, Transform
multiplication_10 = Multiplication(A=addition_55, B=addition_42)
length_103 = Length(Curve=move_25.Geometry)
length_104 = Length(Curve=move_25.Geometry)
length_105 = Length(Curve=move1_9.Geometry)
length_106 = Length(Curve=move1_9.Geometry)
unit_z_52 = UnitZ(Factor=multiplication_10)
move_27 = Move(Geometry=evaluate_curve_49.Point, Motion=unit_z_52)  # -> Geometry, Transform
move_28 = Move(Geometry=evaluate_curve_50.Point, Motion=unit_z_52)  # -> Geometry, Transform
subtraction_37 = Subtraction(A=length_103, B=number_slider_33)
length_107 = Length(Curve=move_26.Geometry)
subtraction_38 = Subtraction(A=length_104, B=addition_33)
subtraction_39 = Subtraction(A=length_105, B=Slider(1200, range=0..1500))
subtraction_40 = Subtraction(A=length_106, B=Slider(300, range=0..1500))
move_29 = Move(Geometry=evaluate_curve_57.Point, Motion=unit_z_52)  # -> Geometry, Transform
move_30 = Move(Geometry=curve_middle_5, Motion=unit_z_52)  # -> Geometry, Transform
line_105 = Line(StartPoint=move_27.Geometry, EndPoint=move_30.Geometry)
line_106 = Line(StartPoint=move_28.Geometry, EndPoint=move_30.Geometry)
offset_curve_81 = OffsetCurve(Curve=line_105, Distance=Slider(0, range=0..145), Plane=PlaneXY(0, 0, 0), Corners=1)
offset_curve_82 = OffsetCurve(Curve=line_105, Distance=Slider(145, range=0..1000), Plane=PlaneXY(0, 0, 0), Corners=1)
offset_curve_83 = OffsetCurve(Curve=line_106, Distance=Slider(-145, range=-150..0), Plane=PlaneXY(0, 0, 0), Corners=1)
offset_curve_84 = OffsetCurve(Curve=line_106, Distance=Slider(145, range=0..1000), Plane=PlaneXY(0, 0, 0), Corners=1)
evaluate_curve_69 = EvaluateCurve(Curve=move_25.Geometry, Parameter=subtraction_37)  # -> Point, Tangent, Angle
evaluate_curve_70 = EvaluateCurve(Curve=move_25.Geometry, Parameter=subtraction_38)  # -> Point, Tangent, Angle
divide_curve_81 = DivideCurve(Curve=offset_curve_81, Count=number_slider_34, Kinks=False)  # -> Points, Tangents, Parameters
evaluate_curve_71 = EvaluateCurve(Curve=move_25.Geometry, Parameter=Slider(375, range=0..1500))  # -> Point, Tangent, Angle
divide_curve_82 = DivideCurve(Curve=offset_curve_82, Count=number_slider_34, Kinks=False)  # -> Points, Tangents, Parameters
divide_curve_83 = DivideCurve(Curve=offset_curve_83, Count=number_slider_35, Kinks=False)  # -> Points, Tangents, Parameters
divide_curve_84 = DivideCurve(Curve=offset_curve_84, Count=number_slider_35, Kinks=False)  # -> Points, Tangents, Parameters
evaluate_curve_72 = EvaluateCurve(Curve=move1_9.Geometry, Parameter=subtraction_39)  # -> Point, Tangent, Angle
subtraction_41 = Subtraction(A=length_107, B=Slider(300, range=0..1500))
evaluate_curve_73 = EvaluateCurve(Curve=move1_9.Geometry, Parameter=subtraction_40)  # -> Point, Tangent, Angle
end_points_25 = EndPoints(Curve=move_25.Geometry)  # -> Start, End
end_points_26 = EndPoints(Curve=move1_9.Geometry)  # -> Start, End
end_points_27 = EndPoints(Curve=move1_9.Geometry)  # -> Start, End
line_107 = Line(StartPoint=move_29.Geometry, EndPoint=move_30.Geometry)
evaluate_curve_74 = EvaluateCurve(Curve=move_26.Geometry, Parameter=subtraction_41)  # -> Point, Tangent, Angle
evaluate_curve_75 = EvaluateCurve(Curve=move_26.Geometry, Parameter=Slider(300, range=0..1500))  # -> Point, Tangent, Angle
line_108 = Line(StartPoint=divide_curve_82.Points, EndPoint=divide_curve_81.Points)
line_109 = Line(StartPoint=divide_curve_84.Points, EndPoint=divide_curve_83.Points)
line_110 = Line(StartPoint=end_points_25.End, EndPoint=evaluate_curve_69.Point)
line_111 = Line(StartPoint=evaluate_curve_71.Point, EndPoint=evaluate_curve_70.Point)
line_112 = Line(StartPoint=end_points_26.Start, EndPoint=evaluate_curve_72.Point)
line_113 = Line(StartPoint=end_points_27.End, EndPoint=evaluate_curve_73.Point)
loft_73 = Loft(Curves=line_108, Options={Adjust=False, Closed=False, LoftEnds=0, LoftSimp=0, LoftType=0, Rebuild=10, Refit=0.01})
loft_74 = Loft(Curves=line_109, Options={Adjust=False, Closed=False, LoftEnds=0, LoftSimp=0, LoftType=0, Rebuild=10, Refit=0.01})
offset_curve_85 = OffsetCurve(Curve=line_107, Distance=Slider(0, range=0..100), Plane=PlaneXY(0, 0, 0), Corners=1)
offset_curve_86 = OffsetCurve(Curve=line_107, Distance=Slider(75, range=0..100), Plane=PlaneXY(0, 0, 0), Corners=1)
line_114 = Line(StartPoint=evaluate_curve_75.Point, EndPoint=evaluate_curve_74.Point)
surface_closest_point_57 = SurfaceClosestPoint(Point=divide_curve_82.Points, Surface=loft_73)  # -> Point, UVPoint, Distance
surface_closest_point_58 = SurfaceClosestPoint(Point=divide_curve_83.Points, Surface=loft_74)  # -> Point, UVPoint, Distance
offset_curve_87 = OffsetCurve(Curve=line_111, Distance=Slider(-75, range=-75..0), Plane=PlaneXY(0, 0, 0), Corners=1)
offset_curve_88 = OffsetCurve(Curve=line_111, Distance=Slider(75, range=0..100), Plane=PlaneXY(0, 0, 0), Corners=1)
offset_curve_89 = OffsetCurve(Curve=line_110, Distance=Slider(75, range=0..100), Plane=PlaneXY(0, 0, 0), Corners=1)
offset_curve_90 = OffsetCurve(Curve=line_110, Distance=Slider(0, range=-75..0), Plane=PlaneXY(0, 0, 0), Corners=1)
offset_curve_91 = OffsetCurve(Curve=line_112, Distance=Slider(75, range=0..100), Plane=PlaneXY(0, 0, 0), Corners=1)
offset_curve_92 = OffsetCurve(Curve=line_113, Distance=Slider(75, range=0..100), Plane=PlaneXY(0, 0, 0), Corners=1)
offset_curve_93 = OffsetCurve(Curve=line_112, Distance=Slider(0, range=-75..0), Plane=PlaneXY(0, 0, 0), Corners=1)
offset_curve_94 = OffsetCurve(Curve=line_113, Distance=Slider(0, range=-75..0), Plane=PlaneXY(0, 0, 0), Corners=1)
evaluate_surface_57 = EvaluateSurface(Surface=loft_73, Point=surface_closest_point_57.UVPoint)  # -> Point, Normal, UDirection, VDirection, Frame
evaluate_surface_58 = EvaluateSurface(Surface=loft_74, Point=surface_closest_point_58.UVPoint)  # -> Point, Normal, UDirection, VDirection, Frame
offset_curve_95 = OffsetCurve(Curve=line_114, Distance=Slider(-75, range=-75..0), Plane=PlaneXY(0, 0, 0), Corners=1)
offset_curve_96 = OffsetCurve(Curve=line_114, Distance=Slider(75, range=0..100), Plane=PlaneXY(0, 0, 0), Corners=1)
divide_curve_85 = DivideCurve(Curve=offset_curve_85, Count=number_slider_45, Kinks=False)  # -> Points, Tangents, Parameters
divide_curve_86 = DivideCurve(Curve=offset_curve_86, Count=number_slider_45, Kinks=False)  # -> Points, Tangents, Parameters
rotate_plane_57 = RotatePlane(Plane=evaluate_surface_57.Frame, Angle=radians_49)
rotate_plane_58 = RotatePlane(Plane=evaluate_surface_58.Frame, Angle=radians_50)
length_108 = Length(Curve=offset_curve_87)
length_109 = Length(Curve=offset_curve_90)
length_110 = Length(Curve=offset_curve_88)
length_111 = Length(Curve=offset_curve_89)
length_112 = Length(Curve=offset_curve_91)
length_113 = Length(Curve=offset_curve_93)
length_114 = Length(Curve=offset_curve_92)
length_115 = Length(Curve=offset_curve_94)
length_116 = Length(Curve=offset_curve_95)
line_115 = Line(StartPoint=divide_curve_86.Points, EndPoint=divide_curve_85.Points)
deconstruct_plane_9 = DeconstructPlane(Plane=rotate_plane_57)  # -> Origin, XAxis, YAxis, ZAxis
division_179 = Division(A=length_108, B=Slider(300, range=0..1000))
division_180 = Division(A=length_110, B=Slider(300, range=0..1000))
deconstruct_plane_10 = DeconstructPlane(Plane=rotate_plane_58)  # -> Origin, XAxis, YAxis, ZAxis
division_181 = Division(A=length_109, B=Slider(300, range=0..1000))
division_182 = Division(A=length_111, B=Slider(300, range=0..1000))
length_117 = Length(Curve=offset_curve_96)
division_183 = Division(A=length_112, B=Slider(300, range=0..1000))
division_184 = Division(A=length_113, B=Slider(300, range=0..1000))
division_185 = Division(A=length_114, B=Slider(300, range=0..1000))
division_186 = Division(A=length_115, B=Slider(300, range=0..1000))
divide_curve_87 = DivideCurve(Curve=offset_curve_87, Count=division_179, Kinks=False)  # -> Points, Tangents, Parameters
divide_curve_88 = DivideCurve(Curve=offset_curve_90, Count=division_181, Kinks=False)  # -> Points, Tangents, Parameters
divide_curve_89 = DivideCurve(Curve=offset_curve_88, Count=division_180, Kinks=False)  # -> Points, Tangents, Parameters
divide_curve_90 = DivideCurve(Curve=offset_curve_89, Count=division_182, Kinks=False)  # -> Points, Tangents, Parameters
rotate_3d_9 = Rotate3D(Geometry=rotate_plane_57, Angle=1.570796327, Center=deconstruct_plane_9.Origin, Axis=deconstruct_plane_9.YAxis)  # -> Geometry, Transform
division_187 = Division(A=length_116, B=Slider(300, range=0..1000))
division_188 = Division(A=length_117, B=Slider(300, range=0..1000))
rotate_3d_10 = Rotate3D(Geometry=rotate_plane_58, Angle=1.570796327, Center=deconstruct_plane_10.Origin, Axis=deconstruct_plane_10.YAxis)  # -> Geometry, Transform
loft_75 = Loft(Curves=line_115, Options={Adjust=False, Closed=False, LoftEnds=0, LoftSimp=0, LoftType=0, Rebuild=10, Refit=0.01})
divide_curve_91 = DivideCurve(Curve=offset_curve_91, Count=division_183, Kinks=False)  # -> Points, Tangents, Parameters
divide_curve_92 = DivideCurve(Curve=offset_curve_92, Count=division_185, Kinks=False)  # -> Points, Tangents, Parameters
divide_curve_93 = DivideCurve(Curve=offset_curve_93, Count=division_184, Kinks=False)  # -> Points, Tangents, Parameters
divide_curve_94 = DivideCurve(Curve=offset_curve_94, Count=division_186, Kinks=False)  # -> Points, Tangents, Parameters
divide_curve_95 = DivideCurve(Curve=offset_curve_95, Count=division_187, Kinks=False)  # -> Points, Tangents, Parameters
divide_curve_96 = DivideCurve(Curve=offset_curve_96, Count=division_188, Kinks=False)  # -> Points, Tangents, Parameters
surface_closest_point_59 = SurfaceClosestPoint(Point=divide_curve_85.Points, Surface=loft_75)  # -> Point, UVPoint, Distance
list_item_25 = ListItem(List=rotate_3d_9.Geometry, Index=1, Wrap=True)
list_item_26 = ListItem(List=rotate_3d_10.Geometry, Index=1, Wrap=True)
line_116 = Line(StartPoint=divide_curve_89.Points, EndPoint=divide_curve_87.Points)
line_117 = Line(StartPoint=divide_curve_87.Points, EndPoint=divide_curve_89.Points)
line_118 = Line(StartPoint=divide_curve_88.Points, EndPoint=divide_curve_90.Points)
line_119 = Line(StartPoint=divide_curve_93.Points, EndPoint=divide_curve_91.Points)
line_120 = Line(StartPoint=divide_curve_94.Points, EndPoint=divide_curve_92.Points)
evaluate_surface_59 = EvaluateSurface(Surface=loft_75, Point=surface_closest_point_59.UVPoint)  # -> Point, Normal, UDirection, VDirection, Frame
ellipse_9 = Ellipse(Plane=list_item_25, Radius1=addition_37, Radius2=line_105)  # -> Ellipse, Focus1, Focus2
ellipse_10 = Ellipse(Plane=list_item_26, Radius1=addition_38, Radius2=line_106)  # -> Ellipse, Focus1, Focus2
line_121 = Line(StartPoint=divide_curve_96.Points, EndPoint=divide_curve_95.Points)
line_122 = Line(StartPoint=divide_curve_95.Points, EndPoint=divide_curve_96.Points)
loft_76 = Loft(Curves=line_116, Options={Adjust=False, Closed=False, LoftEnds=0, LoftSimp=0, LoftType=0, Rebuild=10, Refit=0.01})
loft_77 = Loft(Curves=line_117, Options={Adjust=False, Closed=False, LoftEnds=0, LoftSimp=0, LoftType=0, Rebuild=10, Refit=0.01})
loft_78 = Loft(Curves=line_118, Options={Adjust=False, Closed=False, LoftEnds=0, LoftSimp=0, LoftType=0, Rebuild=10, Refit=0.01})
loft_79 = Loft(Curves=line_120, Options={Adjust=False, Closed=False, LoftEnds=0, LoftSimp=0, LoftType=0, Rebuild=10, Refit=0.01})
loft_80 = Loft(Curves=line_119, Options={Adjust=False, Closed=False, LoftEnds=0, LoftSimp=0, LoftType=0, Rebuild=10, Refit=0.01})
rotate_plane_59 = RotatePlane(Plane=evaluate_surface_59.Frame, Angle=radians_57)
sub_curve_9 = SubCurve(BaseCurve=reparameterize(ellipse_9.Ellipse), Domain="0.2592 to  0.7408")
sub_curve_10 = SubCurve(BaseCurve=reparameterize(ellipse_10.Ellipse), Domain="0.2592 to  0.7408")
loft_81 = Loft(Curves=line_121, Options={Adjust=False, Closed=False, LoftEnds=0, LoftSimp=0, LoftType=0, Rebuild=10, Refit=0.01})
loft_82 = Loft(Curves=line_122, Options={Adjust=False, Closed=False, LoftEnds=0, LoftSimp=0, LoftType=0, Rebuild=10, Refit=0.01})
surface_closest_point_60 = SurfaceClosestPoint(Point=divide_curve_89.Points, Surface=loft_76)  # -> Point, UVPoint, Distance
surface_closest_point_61 = SurfaceClosestPoint(Point=divide_curve_87.Points, Surface=loft_77)  # -> Point, UVPoint, Distance
surface_closest_point_62 = SurfaceClosestPoint(Point=divide_curve_88.Points, Surface=loft_78)  # -> Point, UVPoint, Distance
surface_closest_point_63 = SurfaceClosestPoint(Point=divide_curve_93.Points, Surface=loft_80)  # -> Point, UVPoint, Distance
surface_closest_point_64 = SurfaceClosestPoint(Point=divide_curve_94.Points, Surface=loft_79)  # -> Point, UVPoint, Distance
deconstruct_plane_11 = DeconstructPlane(Plane=rotate_plane_59)  # -> Origin, XAxis, YAxis, ZAxis
surface_closest_point_65 = SurfaceClosestPoint(Point=divide_curve_96.Points, Surface=loft_81)  # -> Point, UVPoint, Distance
surface_closest_point_66 = SurfaceClosestPoint(Point=divide_curve_95.Points, Surface=loft_82)  # -> Point, UVPoint, Distance
evaluate_surface_60 = EvaluateSurface(Surface=loft_76, Point=surface_closest_point_60.UVPoint)  # -> Point, Normal, UDirection, VDirection, Frame
evaluate_surface_61 = EvaluateSurface(Surface=loft_77, Point=surface_closest_point_61.UVPoint)  # -> Point, Normal, UDirection, VDirection, Frame
evaluate_surface_62 = EvaluateSurface(Surface=loft_78, Point=surface_closest_point_62.UVPoint)  # -> Point, Normal, UDirection, VDirection, Frame
evaluate_surface_63 = EvaluateSurface(Surface=loft_80, Point=surface_closest_point_63.UVPoint)  # -> Point, Normal, UDirection, VDirection, Frame
evaluate_surface_64 = EvaluateSurface(Surface=loft_79, Point=surface_closest_point_64.UVPoint)  # -> Point, Normal, UDirection, VDirection, Frame
rotate_3d_11 = Rotate3D(Geometry=rotate_plane_59, Angle=1.570796327, Center=deconstruct_plane_11.Origin, Axis=deconstruct_plane_11.YAxis)  # -> Geometry, Transform
evaluate_surface_65 = EvaluateSurface(Surface=loft_81, Point=surface_closest_point_65.UVPoint)  # -> Point, Normal, UDirection, VDirection, Frame
evaluate_surface_66 = EvaluateSurface(Surface=loft_82, Point=surface_closest_point_66.UVPoint)  # -> Point, Normal, UDirection, VDirection, Frame
rotate_plane_60 = RotatePlane(Plane=evaluate_surface_62.Frame, Angle=radians_59)
rotate_plane_61 = RotatePlane(Plane=evaluate_surface_63.Frame, Angle=radians_63)
rotate_plane_62 = RotatePlane(Plane=evaluate_surface_64.Frame, Angle=radians_65)
rotate_plane_63 = RotatePlane(Plane=evaluate_surface_60.Frame, Angle=radians_68)
rotate_plane_64 = RotatePlane(Plane=evaluate_surface_61.Frame, Angle=radians_69)
list_item_27 = ListItem(List=rotate_3d_11.Geometry, Index=1, Wrap=True)
rotate_plane_65 = RotatePlane(Plane=evaluate_surface_65.Frame, Angle=radians_80)
rotate_plane_66 = RotatePlane(Plane=evaluate_surface_66.Frame, Angle=radians_81)
ellipse_11 = Ellipse(Plane=list_item_27, Radius1=number_slider_49, Radius2=line_107)  # -> Ellipse, Focus1, Focus2
sub_curve_11 = SubCurve(BaseCurve=reparameterize(ellipse_11.Ellipse), Domain="0.2592 to  0.7408")
split_tree = SplitTree(Data=sub_curve_9, Masks=flatten("{0;7;0}"))  # -> Positive, Negative
split_tree_2 = SplitTree(Data=sub_curve_9, Masks=flatten("{0;6;0}"))  # -> Positive, Negative
split_tree_3 = SplitTree(Data=sub_curve_10, Masks=flatten("{0;7;0}"))  # -> Positive, Negative
split_tree_4 = SplitTree(Data=sub_curve_10, Masks=flatten("{0;6;0}"))  # -> Positive, Negative
split_tree_5 = SplitTree(Data=sub_curve_9, Masks=flatten("{0;5;0}"))  # -> Positive, Negative
split_tree_6 = SplitTree(Data=sub_curve_9, Masks=flatten("{0;4;0}"))  # -> Positive, Negative
split_tree_7 = SplitTree(Data=sub_curve_10, Masks=flatten("{0;5;0}"))  # -> Positive, Negative
split_tree_8 = SplitTree(Data=sub_curve_9, Masks=flatten("{0;3;0}"))  # -> Positive, Negative
split_tree_9 = SplitTree(Data=sub_curve_10, Masks=flatten("{0;4;0}"))  # -> Positive, Negative
split_tree_10 = SplitTree(Data=sub_curve_10, Masks=flatten("{0;3;0}"))  # -> Positive, Negative
split_tree_11 = SplitTree(Data=sub_curve_9, Masks=flatten("{0;2;0}"))  # -> Positive, Negative
split_tree_12 = SplitTree(Data=sub_curve_10, Masks=flatten("{0;2;0}"))  # -> Positive, Negative
split_tree_13 = SplitTree(Data=sub_curve_9, Masks=flatten("{0;0;0}"))  # -> Positive, Negative
split_tree_14 = SplitTree(Data=sub_curve_9, Masks=flatten("{0;1;0}"))  # -> Positive, Negative
split_tree_15 = SplitTree(Data=sub_curve_10, Masks=flatten("{0;0;0}"))  # -> Positive, Negative
split_tree_16 = SplitTree(Data=sub_curve_10, Masks=flatten("{0;1;0}"))  # -> Positive, Negative
list_item_28 = ListItem(List=rotate_plane_60, Index=1, Wrap=True)
list_item_29 = ListItem(List=rotate_plane_61, Index=1, Wrap=True)
list_item_30 = ListItem(List=rotate_plane_62, Index=1, Wrap=True)
center_box_26 = CenterBox(Base=list_item_28, X=division_130, Y=division_131, Z=division_129)
center_box_27 = CenterBox(Base=[rotate_plane_63, rotate_plane_64], X=division_133, Y=division_134, Z=division_132)
length_118 = Length(Curve=sub_curve_11)
center_box_28 = CenterBox(Base=[list_item_19, list_item_20], X=division_143, Y=division_144, Z=division_138)
center_box_29 = CenterBox(Base=[list_item_29, list_item_30], X=division_146, Y=division_147, Z=division_145)
center_box_30 = CenterBox(Base=[rotate_plane_65, rotate_plane_66], X=division_152, Y=division_153, Z=division_151)
number_slider_61 = Slider(75, range=0..100)
addition_56 = Addition(A=Slider(10, range=0..100), B=number_slider_61)
number_slider_62 = Slider(75, range=0..100)
addition_57 = Addition(A=Slider(10, range=0..10), B=number_slider_62)
flatten_tree_25 = FlattenTree(Tree=split_tree_3.Positive, Path="{0}")
flatten_tree_26 = FlattenTree(Tree=split_tree.Positive, Path="{0}")
center_box_31 = CenterBox(Base=[list_item_21, list_item_22], X=division_155, Y=division_156, Z=division_154)
flatten_tree_27 = FlattenTree(Tree=split_tree_4.Positive, Path="{0}")
number_slider_63 = Slider(75, range=0..100)
flatten_tree_28 = FlattenTree(Tree=split_tree_2.Positive, Path="{0}")
number_slider_64 = Slider(9, range=0..10)
number_slider_65 = Slider(9, range=0..10)
addition_58 = Addition(A=number_slider_65, B=number_slider_64)
multiplication_11 = Multiplication(A=addition_58, B=addition_43)
addition_59 = Addition(A=Slider(122.5, range=0..1000), B=multiplication_11)
addition_60 = Addition(A=Slider(595, range=0..1000), B=addition_59)
addition_61 = Addition(A=addition_60, B=Slider(85, range=0..100))
unit_z_53 = UnitZ(Factor=addition_59)
unit_z_54 = UnitZ(Factor=addition_61)
unit_z_55 = UnitZ(Factor=addition_60)
move1_10 = Move(Geometry=curve_16, Motion=unit_z_53)  # -> Geometry, Transform
move_31 = Move(Geometry=curve_16, Motion=unit_z_55)  # -> Geometry, Transform
move_32 = Move(Geometry=curve_16, Motion=unit_z_54)  # -> Geometry, Transform
addition_62 = Addition(A=number_slider_64, B=number_slider_65)
multiplication_12 = Multiplication(A=addition_62, B=addition_44)
length_119 = Length(Curve=move1_10.Geometry)
length_120 = Length(Curve=move1_10.Geometry)
length_121 = Length(Curve=move_31.Geometry)
length_122 = Length(Curve=move_31.Geometry)
length_123 = Length(Curve=move_32.Geometry)
unit_z_56 = UnitZ(Factor=multiplication_12)
move_33 = Move(Geometry=evaluate_curve_51.Point, Motion=unit_z_56)  # -> Geometry, Transform
move_34 = Move(Geometry=evaluate_curve_52.Point, Motion=unit_z_56)  # -> Geometry, Transform
subtraction_42 = Subtraction(A=length_119, B=Slider(750, range=0..1500))
subtraction_43 = Subtraction(A=length_120, B=Slider(300, range=0..1500))
subtraction_44 = Subtraction(A=length_121, B=number_slider_36)
subtraction_45 = Subtraction(A=length_122, B=addition_34)
subtraction_46 = Subtraction(A=length_123, B=Slider(375, range=0..1500))
move_35 = Move(Geometry=evaluate_curve_58.Point, Motion=unit_z_56)  # -> Geometry, Transform
move_36 = Move(Geometry=curve_middle_6, Motion=unit_z_56)  # -> Geometry, Transform
line_123 = Line(StartPoint=move_33.Geometry, EndPoint=move_36.Geometry)
line_124 = Line(StartPoint=move_34.Geometry, EndPoint=move_36.Geometry)
offset_curve_97 = OffsetCurve(Curve=line_123, Distance=Slider(0, range=0..145), Plane=PlaneXY(0, 0, 0), Corners=1)
offset_curve_98 = OffsetCurve(Curve=line_123, Distance=Slider(145, range=0..1000), Plane=PlaneXY(0, 0, 0), Corners=1)
offset_curve_99 = OffsetCurve(Curve=line_124, Distance=Slider(-145, range=-150..0), Plane=PlaneXY(0, 0, 0), Corners=1)
offset_curve_100 = OffsetCurve(Curve=line_124, Distance=Slider(145, range=0..1000), Plane=PlaneXY(0, 0, 0), Corners=1)
divide_curve_97 = DivideCurve(Curve=offset_curve_97, Count=number_slider_37, Kinks=False)  # -> Points, Tangents, Parameters
divide_curve_98 = DivideCurve(Curve=offset_curve_98, Count=number_slider_37, Kinks=False)  # -> Points, Tangents, Parameters
divide_curve_99 = DivideCurve(Curve=offset_curve_99, Count=number_slider_38, Kinks=False)  # -> Points, Tangents, Parameters
divide_curve_100 = DivideCurve(Curve=offset_curve_100, Count=number_slider_38, Kinks=False)  # -> Points, Tangents, Parameters
evaluate_curve_76 = EvaluateCurve(Curve=move1_10.Geometry, Parameter=subtraction_42)  # -> Point, Tangent, Angle
evaluate_curve_77 = EvaluateCurve(Curve=move1_10.Geometry, Parameter=subtraction_43)  # -> Point, Tangent, Angle
evaluate_curve_78 = EvaluateCurve(Curve=move_31.Geometry, Parameter=subtraction_44)  # -> Point, Tangent, Angle
evaluate_curve_79 = EvaluateCurve(Curve=move_31.Geometry, Parameter=subtraction_45)  # -> Point, Tangent, Angle
evaluate_curve_80 = EvaluateCurve(Curve=move_31.Geometry, Parameter=Slider(300, range=0..1500))  # -> Point, Tangent, Angle
end_points_28 = EndPoints(Curve=move1_10.Geometry)  # -> Start, End
end_points_29 = EndPoints(Curve=move1_10.Geometry)  # -> Start, End
end_points_30 = EndPoints(Curve=move_31.Geometry)  # -> Start, End
evaluate_curve_81 = EvaluateCurve(Curve=move_32.Geometry, Parameter=subtraction_46)  # -> Point, Tangent, Angle
evaluate_curve_82 = EvaluateCurve(Curve=move_32.Geometry, Parameter=Slider(375, range=0..1500))  # -> Point, Tangent, Angle
line_125 = Line(StartPoint=move_35.Geometry, EndPoint=move_36.Geometry)
line_126 = Line(StartPoint=divide_curve_98.Points, EndPoint=divide_curve_97.Points)
line_127 = Line(StartPoint=divide_curve_100.Points, EndPoint=divide_curve_99.Points)
line_128 = Line(StartPoint=end_points_28.Start, EndPoint=evaluate_curve_76.Point)
line_129 = Line(StartPoint=end_points_29.End, EndPoint=evaluate_curve_77.Point)
line_130 = Line(StartPoint=end_points_30.End, EndPoint=evaluate_curve_78.Point)
line_131 = Line(StartPoint=evaluate_curve_80.Point, EndPoint=evaluate_curve_79.Point)
loft_83 = Loft(Curves=line_126, Options={Adjust=False, Closed=False, LoftEnds=0, LoftSimp=0, LoftType=0, Rebuild=10, Refit=0.01})
loft_84 = Loft(Curves=line_127, Options={Adjust=False, Closed=False, LoftEnds=0, LoftSimp=0, LoftType=0, Rebuild=10, Refit=0.01})
line_132 = Line(StartPoint=evaluate_curve_82.Point, EndPoint=evaluate_curve_81.Point)
offset_curve_101 = OffsetCurve(Curve=line_125, Distance=Slider(0, range=0..100), Plane=PlaneXY(0, 0, 0), Corners=1)
offset_curve_102 = OffsetCurve(Curve=line_125, Distance=Slider(75, range=0..100), Plane=PlaneXY(0, 0, 0), Corners=1)
surface_closest_point_67 = SurfaceClosestPoint(Point=divide_curve_98.Points, Surface=loft_83)  # -> Point, UVPoint, Distance
surface_closest_point_68 = SurfaceClosestPoint(Point=divide_curve_99.Points, Surface=loft_84)  # -> Point, UVPoint, Distance
offset_curve_103 = OffsetCurve(Curve=line_128, Distance=Slider(75, range=0..100), Plane=PlaneXY(0, 0, 0), Corners=1)
offset_curve_104 = OffsetCurve(Curve=line_129, Distance=Slider(75, range=0..100), Plane=PlaneXY(0, 0, 0), Corners=1)
offset_curve_105 = OffsetCurve(Curve=line_128, Distance=Slider(0, range=-75..0), Plane=PlaneXY(0, 0, 0), Corners=1)
offset_curve_106 = OffsetCurve(Curve=line_129, Distance=Slider(0, range=-75..0), Plane=PlaneXY(0, 0, 0), Corners=1)
offset_curve_107 = OffsetCurve(Curve=line_131, Distance=Slider(-75, range=-75..0), Plane=PlaneXY(0, 0, 0), Corners=1)
offset_curve_108 = OffsetCurve(Curve=line_131, Distance=Slider(75, range=0..100), Plane=PlaneXY(0, 0, 0), Corners=1)
offset_curve_109 = OffsetCurve(Curve=line_130, Distance=Slider(75, range=0..100), Plane=PlaneXY(0, 0, 0), Corners=1)
offset_curve_110 = OffsetCurve(Curve=line_130, Distance=Slider(0, range=-75..0), Plane=PlaneXY(0, 0, 0), Corners=1)
offset_curve_111 = OffsetCurve(Curve=line_132, Distance=Slider(-75, range=-75..0), Plane=PlaneXY(0, 0, 0), Corners=1)
evaluate_surface_67 = EvaluateSurface(Surface=loft_83, Point=surface_closest_point_67.UVPoint)  # -> Point, Normal, UDirection, VDirection, Frame
offset_curve_112 = OffsetCurve(Curve=line_132, Distance=Slider(75, range=0..100), Plane=PlaneXY(0, 0, 0), Corners=1)
evaluate_surface_68 = EvaluateSurface(Surface=loft_84, Point=surface_closest_point_68.UVPoint)  # -> Point, Normal, UDirection, VDirection, Frame
divide_curve_101 = DivideCurve(Curve=offset_curve_101, Count=number_slider_46, Kinks=False)  # -> Points, Tangents, Parameters
divide_curve_102 = DivideCurve(Curve=offset_curve_102, Count=number_slider_46, Kinks=False)  # -> Points, Tangents, Parameters
rotate_plane_67 = RotatePlane(Plane=evaluate_surface_67.Frame, Angle=radians_51)
rotate_plane_68 = RotatePlane(Plane=evaluate_surface_68.Frame, Angle=radians_52)
length_124 = Length(Curve=offset_curve_103)
length_125 = Length(Curve=offset_curve_105)
length_126 = Length(Curve=offset_curve_104)
length_127 = Length(Curve=offset_curve_106)
length_128 = Length(Curve=offset_curve_107)
length_129 = Length(Curve=offset_curve_110)
length_130 = Length(Curve=offset_curve_108)
length_131 = Length(Curve=offset_curve_111)
length_132 = Length(Curve=offset_curve_109)
length_133 = Length(Curve=offset_curve_112)
line_133 = Line(StartPoint=divide_curve_102.Points, EndPoint=divide_curve_101.Points)
deconstruct_plane_12 = DeconstructPlane(Plane=rotate_plane_67)  # -> Origin, XAxis, YAxis, ZAxis
deconstruct_plane_13 = DeconstructPlane(Plane=rotate_plane_68)  # -> Origin, XAxis, YAxis, ZAxis
division_189 = Division(A=length_128, B=Slider(300, range=0..1000))
division_190 = Division(A=length_130, B=Slider(300, range=0..1000))
division_191 = Division(A=length_124, B=Slider(300, range=0..1000))
division_192 = Division(A=length_125, B=Slider(300, range=0..1000))
division_193 = Division(A=length_129, B=Slider(300, range=0..1000))
division_194 = Division(A=length_126, B=Slider(300, range=0..1000))
division_195 = Division(A=length_127, B=Slider(300, range=0..1000))
division_196 = Division(A=length_132, B=Slider(300, range=0..1000))
division_197 = Division(A=length_131, B=Slider(300, range=0..1000))
division_198 = Division(A=length_133, B=Slider(300, range=0..1000))
rotate_3d_12 = Rotate3D(Geometry=rotate_plane_67, Angle=1.570796327, Center=deconstruct_plane_12.Origin, Axis=deconstruct_plane_12.YAxis)  # -> Geometry, Transform
rotate_3d_13 = Rotate3D(Geometry=rotate_plane_68, Angle=1.570796327, Center=deconstruct_plane_13.Origin, Axis=deconstruct_plane_13.YAxis)  # -> Geometry, Transform
divide_curve_103 = DivideCurve(Curve=offset_curve_107, Count=division_189, Kinks=False)  # -> Points, Tangents, Parameters
loft_85 = Loft(Curves=line_133, Options={Adjust=False, Closed=False, LoftEnds=0, LoftSimp=0, LoftType=0, Rebuild=10, Refit=0.01})
divide_curve_104 = DivideCurve(Curve=offset_curve_110, Count=division_193, Kinks=False)  # -> Points, Tangents, Parameters
divide_curve_105 = DivideCurve(Curve=offset_curve_108, Count=division_190, Kinks=False)  # -> Points, Tangents, Parameters
divide_curve_106 = DivideCurve(Curve=offset_curve_103, Count=division_191, Kinks=False)  # -> Points, Tangents, Parameters
divide_curve_107 = DivideCurve(Curve=offset_curve_104, Count=division_194, Kinks=False)  # -> Points, Tangents, Parameters
divide_curve_108 = DivideCurve(Curve=offset_curve_109, Count=division_196, Kinks=False)  # -> Points, Tangents, Parameters
divide_curve_109 = DivideCurve(Curve=offset_curve_105, Count=division_192, Kinks=False)  # -> Points, Tangents, Parameters
divide_curve_110 = DivideCurve(Curve=offset_curve_106, Count=division_195, Kinks=False)  # -> Points, Tangents, Parameters
divide_curve_111 = DivideCurve(Curve=offset_curve_111, Count=division_197, Kinks=False)  # -> Points, Tangents, Parameters
divide_curve_112 = DivideCurve(Curve=offset_curve_112, Count=division_198, Kinks=False)  # -> Points, Tangents, Parameters
surface_closest_point_69 = SurfaceClosestPoint(Point=divide_curve_101.Points, Surface=loft_85)  # -> Point, UVPoint, Distance
list_item_31 = ListItem(List=rotate_3d_12.Geometry, Index=1, Wrap=True)
list_item_32 = ListItem(List=rotate_3d_13.Geometry, Index=1, Wrap=True)
line_134 = Line(StartPoint=divide_curve_109.Points, EndPoint=divide_curve_106.Points)
line_135 = Line(StartPoint=divide_curve_110.Points, EndPoint=divide_curve_107.Points)
line_136 = Line(StartPoint=divide_curve_105.Points, EndPoint=divide_curve_103.Points)
line_137 = Line(StartPoint=divide_curve_103.Points, EndPoint=divide_curve_105.Points)
line_138 = Line(StartPoint=divide_curve_104.Points, EndPoint=divide_curve_108.Points)
line_139 = Line(StartPoint=divide_curve_112.Points, EndPoint=divide_curve_111.Points)
evaluate_surface_69 = EvaluateSurface(Surface=loft_85, Point=surface_closest_point_69.UVPoint)  # -> Point, Normal, UDirection, VDirection, Frame
line_140 = Line(StartPoint=divide_curve_111.Points, EndPoint=divide_curve_112.Points)
ellipse_12 = Ellipse(Plane=list_item_31, Radius1=addition_39, Radius2=line_123)  # -> Ellipse, Focus1, Focus2
ellipse_13 = Ellipse(Plane=list_item_32, Radius1=addition_40, Radius2=line_124)  # -> Ellipse, Focus1, Focus2
loft_86 = Loft(Curves=line_135, Options={Adjust=False, Closed=False, LoftEnds=0, LoftSimp=0, LoftType=0, Rebuild=10, Refit=0.01})
loft_87 = Loft(Curves=line_134, Options={Adjust=False, Closed=False, LoftEnds=0, LoftSimp=0, LoftType=0, Rebuild=10, Refit=0.01})
loft_88 = Loft(Curves=line_136, Options={Adjust=False, Closed=False, LoftEnds=0, LoftSimp=0, LoftType=0, Rebuild=10, Refit=0.01})
loft_89 = Loft(Curves=line_137, Options={Adjust=False, Closed=False, LoftEnds=0, LoftSimp=0, LoftType=0, Rebuild=10, Refit=0.01})
loft_90 = Loft(Curves=line_138, Options={Adjust=False, Closed=False, LoftEnds=0, LoftSimp=0, LoftType=0, Rebuild=10, Refit=0.01})
loft_91 = Loft(Curves=line_139, Options={Adjust=False, Closed=False, LoftEnds=0, LoftSimp=0, LoftType=0, Rebuild=10, Refit=0.01})
loft_92 = Loft(Curves=line_140, Options={Adjust=False, Closed=False, LoftEnds=0, LoftSimp=0, LoftType=0, Rebuild=10, Refit=0.01})
rotate_plane_69 = RotatePlane(Plane=evaluate_surface_69.Frame, Angle=radians_58)
sub_curve_12 = SubCurve(BaseCurve=reparameterize(ellipse_12.Ellipse), Domain="0.2592 to  0.7408")
sub_curve_13 = SubCurve(BaseCurve=reparameterize(ellipse_13.Ellipse), Domain="0.2592 to  0.7408")
surface_closest_point_70 = SurfaceClosestPoint(Point=divide_curve_109.Points, Surface=loft_87)  # -> Point, UVPoint, Distance
surface_closest_point_71 = SurfaceClosestPoint(Point=divide_curve_110.Points, Surface=loft_86)  # -> Point, UVPoint, Distance
surface_closest_point_72 = SurfaceClosestPoint(Point=divide_curve_105.Points, Surface=loft_88)  # -> Point, UVPoint, Distance
surface_closest_point_73 = SurfaceClosestPoint(Point=divide_curve_103.Points, Surface=loft_89)  # -> Point, UVPoint, Distance
surface_closest_point_74 = SurfaceClosestPoint(Point=divide_curve_104.Points, Surface=loft_90)  # -> Point, UVPoint, Distance
surface_closest_point_75 = SurfaceClosestPoint(Point=divide_curve_112.Points, Surface=loft_91)  # -> Point, UVPoint, Distance
surface_closest_point_76 = SurfaceClosestPoint(Point=divide_curve_111.Points, Surface=loft_92)  # -> Point, UVPoint, Distance
deconstruct_plane_14 = DeconstructPlane(Plane=rotate_plane_69)  # -> Origin, XAxis, YAxis, ZAxis
evaluate_surface_70 = EvaluateSurface(Surface=loft_87, Point=surface_closest_point_70.UVPoint)  # -> Point, Normal, UDirection, VDirection, Frame
evaluate_surface_71 = EvaluateSurface(Surface=loft_86, Point=surface_closest_point_71.UVPoint)  # -> Point, Normal, UDirection, VDirection, Frame
evaluate_surface_72 = EvaluateSurface(Surface=loft_88, Point=surface_closest_point_72.UVPoint)  # -> Point, Normal, UDirection, VDirection, Frame
evaluate_surface_73 = EvaluateSurface(Surface=loft_89, Point=surface_closest_point_73.UVPoint)  # -> Point, Normal, UDirection, VDirection, Frame
evaluate_surface_74 = EvaluateSurface(Surface=loft_90, Point=surface_closest_point_74.UVPoint)  # -> Point, Normal, UDirection, VDirection, Frame
rotate_3d_14 = Rotate3D(Geometry=rotate_plane_69, Angle=1.570796327, Center=deconstruct_plane_14.Origin, Axis=deconstruct_plane_14.YAxis)  # -> Geometry, Transform
evaluate_surface_75 = EvaluateSurface(Surface=loft_91, Point=surface_closest_point_75.UVPoint)  # -> Point, Normal, UDirection, VDirection, Frame
evaluate_surface_76 = EvaluateSurface(Surface=loft_92, Point=surface_closest_point_76.UVPoint)  # -> Point, Normal, UDirection, VDirection, Frame
rotate_plane_70 = RotatePlane(Plane=evaluate_surface_70.Frame, Angle=radians_74)
rotate_plane_71 = RotatePlane(Plane=evaluate_surface_71.Frame, Angle=radians_76)
rotate_plane_72 = RotatePlane(Plane=evaluate_surface_74.Frame, Angle=radians_78)
rotate_plane_73 = RotatePlane(Plane=evaluate_surface_72.Frame, Angle=radians_82)
rotate_plane_74 = RotatePlane(Plane=evaluate_surface_73.Frame, Angle=radians_83)
list_item_33 = ListItem(List=rotate_3d_14.Geometry, Index=1, Wrap=True)
rotate_plane_75 = RotatePlane(Plane=evaluate_surface_75.Frame, Angle=radians_85)
rotate_plane_76 = RotatePlane(Plane=evaluate_surface_76.Frame, Angle=radians_86)
ellipse_14 = Ellipse(Plane=list_item_33, Radius1=number_slider_50, Radius2=line_125)  # -> Ellipse, Focus1, Focus2
sub_curve_14 = SubCurve(BaseCurve=reparameterize(ellipse_14.Ellipse), Domain="0.2592 to  0.7408")
split_tree_17 = SplitTree(Data=sub_curve_12, Masks=flatten("{0;7;0}"))  # -> Positive, Negative
split_tree_18 = SplitTree(Data=sub_curve_12, Masks=flatten("{0;6;0}"))  # -> Positive, Negative
split_tree_19 = SplitTree(Data=sub_curve_13, Masks=flatten("{0;7;0}"))  # -> Positive, Negative
split_tree_20 = SplitTree(Data=sub_curve_13, Masks=flatten("{0;6;0}"))  # -> Positive, Negative
split_tree_21 = SplitTree(Data=sub_curve_12, Masks=flatten("{0;5;0}"))  # -> Positive, Negative
split_tree_22 = SplitTree(Data=sub_curve_12, Masks=flatten("{0;4;0}"))  # -> Positive, Negative
split_tree_23 = SplitTree(Data=sub_curve_13, Masks=flatten("{0;5;0}"))  # -> Positive, Negative
split_tree_24 = SplitTree(Data=sub_curve_12, Masks=flatten("{0;3;0}"))  # -> Positive, Negative
split_tree_25 = SplitTree(Data=sub_curve_13, Masks=flatten("{0;4;0}"))  # -> Positive, Negative
split_tree_26 = SplitTree(Data=sub_curve_13, Masks=flatten("{0;3;0}"))  # -> Positive, Negative
split_tree_27 = SplitTree(Data=sub_curve_12, Masks=flatten("{0;2;0}"))  # -> Positive, Negative
split_tree_28 = SplitTree(Data=sub_curve_13, Masks=flatten("{0;2;0}"))  # -> Positive, Negative
split_tree_29 = SplitTree(Data=sub_curve_12, Masks=flatten("{0;0;0}"))  # -> Positive, Negative
split_tree_30 = SplitTree(Data=sub_curve_12, Masks=flatten("{0;1;0}"))  # -> Positive, Negative
split_tree_31 = SplitTree(Data=sub_curve_13, Masks=flatten("{0;0;0}"))  # -> Positive, Negative
split_tree_32 = SplitTree(Data=sub_curve_13, Masks=flatten("{0;1;0}"))  # -> Positive, Negative
list_item_34 = ListItem(List=rotate_plane_70, Index=1, Wrap=True)
list_item_35 = ListItem(List=rotate_plane_71, Index=1, Wrap=True)
list_item_36 = ListItem(List=rotate_plane_72, Index=1, Wrap=True)
center_box_32 = CenterBox(Base=[list_item_23, list_item_24], X=division_162, Y=division_163, Z=division_157)
center_box_33 = CenterBox(Base=[list_item_34, list_item_35], X=division_165, Y=division_166, Z=division_164)
flatten_tree_29 = FlattenTree(Tree=split_tree_7.Positive, Path="{0}")
flatten_tree_30 = FlattenTree(Tree=split_tree_5.Positive, Path="{0}")
center_box_34 = CenterBox(Base=[rotate_plane_75, rotate_plane_76], X=division_174, Y=division_175, Z=division_171)
length_134 = Length(Curve=sub_curve_14)
flatten_tree_31 = FlattenTree(Tree=split_tree_9.Positive, Path="{0}")
flatten_tree_32 = FlattenTree(Tree=split_tree_6.Positive, Path="{0}")
flatten_tree_33 = FlattenTree(Tree=split_tree_10.Positive, Path="{0}")
flatten_tree_34 = FlattenTree(Tree=split_tree_8.Positive, Path="{0}")
center_box_35 = CenterBox(Base=list_item_36, X=division_168, Y=division_169, Z=division_167)
center_box_36 = CenterBox(Base=[rotate_plane_73, rotate_plane_74], X=division_177, Y=division_178, Z=division_176)
flatten_tree_35 = FlattenTree(Tree=split_tree_12.Positive, Path="{0}")
flatten_tree_36 = FlattenTree(Tree=split_tree_11.Positive, Path="{0}")
flatten_tree_37 = FlattenTree(Tree=split_tree_15.Positive, Path="{0}")
flatten_tree_38 = FlattenTree(Tree=split_tree_16.Positive, Path="{0}")
flatten_tree_39 = FlattenTree(Tree=split_tree_14.Positive, Path="{0}")
flatten_tree_40 = FlattenTree(Tree=split_tree_13.Positive, Path="{0}")
division_199 = Division(A=length_118, B=Slider(72, range=0..100))
number_slider_66 = Slider(4, range=0..10)
multiplication_13 = Multiplication(A=number_slider_66, B=number_slider_53)
multiplication_14 = Multiplication(A=Slider(10, range=0..100), B=number_slider_66)
addition_63 = Addition(A=multiplication_13, B=multiplication_14)
addition_64 = Addition(A=addition_52, B=addition_63)
unit_z_57 = UnitZ(Factor=addition_64)
move1_11 = Move(Geometry=curve_17, Motion=unit_z_57)  # -> Geometry, Transform
length_135 = Length(Curve=move1_11.Geometry)
length_136 = Length(Curve=move1_11.Geometry)
subtraction_47 = Subtraction(A=length_135, B=Slider(1125, range=0..1500))
subtraction_48 = Subtraction(A=length_136, B=Slider(375, range=0..1500))
evaluate_curve_83 = EvaluateCurve(Curve=move1_11.Geometry, Parameter=subtraction_47)  # -> Point, Tangent, Angle
evaluate_curve_84 = EvaluateCurve(Curve=move1_11.Geometry, Parameter=subtraction_48)  # -> Point, Tangent, Angle
end_points_31 = EndPoints(Curve=move1_11.Geometry)  # -> Start, End
end_points_32 = EndPoints(Curve=move1_11.Geometry)  # -> Start, End
line_141 = Line(StartPoint=end_points_31.Start, EndPoint=evaluate_curve_83.Point)
line_142 = Line(StartPoint=end_points_32.End, EndPoint=evaluate_curve_84.Point)
offset_curve_113 = OffsetCurve(Curve=line_141, Distance=Slider(75, range=0..100), Plane=PlaneXY(0, 0, 0), Corners=1)
offset_curve_114 = OffsetCurve(Curve=line_142, Distance=Slider(75, range=0..100), Plane=PlaneXY(0, 0, 0), Corners=1)
offset_curve_115 = OffsetCurve(Curve=line_141, Distance=Slider(0, range=-75..0), Plane=PlaneXY(0, 0, 0), Corners=1)
offset_curve_116 = OffsetCurve(Curve=line_142, Distance=Slider(0, range=-75..0), Plane=PlaneXY(0, 0, 0), Corners=1)
length_137 = Length(Curve=offset_curve_113)
length_138 = Length(Curve=offset_curve_115)
length_139 = Length(Curve=offset_curve_114)
length_140 = Length(Curve=offset_curve_116)
division_200 = Division(A=length_137, B=Slider(300, range=0..1000))
division_201 = Division(A=length_138, B=Slider(300, range=0..1000))
division_202 = Division(A=length_139, B=Slider(300, range=0..1000))
division_203 = Division(A=length_140, B=Slider(300, range=0..1000))
divide_curve_113 = DivideCurve(Curve=offset_curve_113, Count=division_200, Kinks=False)  # -> Points, Tangents, Parameters
divide_curve_114 = DivideCurve(Curve=offset_curve_114, Count=division_202, Kinks=False)  # -> Points, Tangents, Parameters
divide_curve_115 = DivideCurve(Curve=offset_curve_115, Count=division_201, Kinks=False)  # -> Points, Tangents, Parameters
divide_curve_116 = DivideCurve(Curve=offset_curve_116, Count=division_203, Kinks=False)  # -> Points, Tangents, Parameters
line_143 = Line(StartPoint=divide_curve_115.Points, EndPoint=divide_curve_113.Points)
line_144 = Line(StartPoint=divide_curve_116.Points, EndPoint=divide_curve_114.Points)
loft_93 = Loft(Curves=line_144, Options={Adjust=False, Closed=False, LoftEnds=0, LoftSimp=0, LoftType=0, Rebuild=10, Refit=0.01})
loft_94 = Loft(Curves=line_143, Options={Adjust=False, Closed=False, LoftEnds=0, LoftSimp=0, LoftType=0, Rebuild=10, Refit=0.01})
surface_closest_point_77 = SurfaceClosestPoint(Point=divide_curve_115.Points, Surface=loft_94)  # -> Point, UVPoint, Distance
surface_closest_point_78 = SurfaceClosestPoint(Point=divide_curve_116.Points, Surface=loft_93)  # -> Point, UVPoint, Distance
evaluate_surface_77 = EvaluateSurface(Surface=loft_94, Point=surface_closest_point_77.UVPoint)  # -> Point, Normal, UDirection, VDirection, Frame
evaluate_surface_78 = EvaluateSurface(Surface=loft_93, Point=surface_closest_point_78.UVPoint)  # -> Point, Normal, UDirection, VDirection, Frame
rotate_plane_77 = RotatePlane(Plane=evaluate_surface_77.Frame, Angle=radians_66)
rotate_plane_78 = RotatePlane(Plane=evaluate_surface_78.Frame, Angle=radians_67)
list_item_37 = ListItem(List=rotate_plane_77, Index=1, Wrap=True)
list_item_38 = ListItem(List=rotate_plane_78, Index=1, Wrap=True)
center_box_37 = CenterBox(Base=[list_item_37, list_item_38], X=division_149, Y=division_150, Z=division_148)
number_slider_67 = Slider(75, range=0..100)
addition_65 = Addition(A=Slider(10, range=0..100), B=number_slider_67)
number_slider_68 = Slider(75, range=0..100)
addition_66 = Addition(A=Slider(10, range=0..10), B=number_slider_68)
perp_frames = PerpFrames(Curve=sub_curve_11, Count=division_199, Align=True)  # -> Frames, Parameters
flatten_tree_41 = FlattenTree(Tree=split_tree_19.Positive, Path="{0}")
flatten_tree_42 = FlattenTree(Tree=split_tree_17.Positive, Path="{0}")
flatten_tree_43 = FlattenTree(Tree=split_tree_20.Positive, Path="{0}")
flatten_tree_44 = FlattenTree(Tree=split_tree_18.Positive, Path="{0}")
number_slider_69 = Slider(75, range=0..100)
flatten_tree_45 = FlattenTree(Tree=split_tree_23.Positive, Path="{0}")
flatten_tree_46 = FlattenTree(Tree=split_tree_21.Positive, Path="{0}")
flatten_tree_47 = FlattenTree(Tree=split_tree_25.Positive, Path="{0}")
flatten_tree_48 = FlattenTree(Tree=split_tree_22.Positive, Path="{0}")
flatten_tree_49 = FlattenTree(Tree=split_tree_26.Positive, Path="{0}")
number_slider_70 = Slider(4, range=0..10)
multiplication_15 = Multiplication(A=number_slider_70, B=number_slider_56)
multiplication_16 = Multiplication(A=Slider(10, range=0..100), B=number_slider_70)
addition_67 = Addition(A=multiplication_15, B=multiplication_16)
addition_68 = Addition(A=addition_59, B=addition_67)
unit_z_58 = UnitZ(Factor=addition_68)
move1_12 = Move(Geometry=curve_16, Motion=unit_z_58)  # -> Geometry, Transform
length_141 = Length(Curve=move1_12.Geometry)
length_142 = Length(Curve=move1_12.Geometry)
subtraction_49 = Subtraction(A=length_141, B=Slider(975, range=0..1500))
subtraction_50 = Subtraction(A=length_142, B=Slider(375, range=0..1500))
evaluate_curve_85 = EvaluateCurve(Curve=move1_12.Geometry, Parameter=subtraction_49)  # -> Point, Tangent, Angle
evaluate_curve_86 = EvaluateCurve(Curve=move1_12.Geometry, Parameter=subtraction_50)  # -> Point, Tangent, Angle
end_points_33 = EndPoints(Curve=move1_12.Geometry)  # -> Start, End
end_points_34 = EndPoints(Curve=move1_12.Geometry)  # -> Start, End
line_145 = Line(StartPoint=end_points_33.Start, EndPoint=evaluate_curve_85.Point)
line_146 = Line(StartPoint=end_points_34.End, EndPoint=evaluate_curve_86.Point)
offset_curve_117 = OffsetCurve(Curve=line_145, Distance=Slider(75, range=0..100), Plane=PlaneXY(0, 0, 0), Corners=1)
offset_curve_118 = OffsetCurve(Curve=line_146, Distance=Slider(75, range=0..100), Plane=PlaneXY(0, 0, 0), Corners=1)
offset_curve_119 = OffsetCurve(Curve=line_145, Distance=Slider(0, range=-75..0), Plane=PlaneXY(0, 0, 0), Corners=1)
offset_curve_120 = OffsetCurve(Curve=line_146, Distance=Slider(0, range=-75..0), Plane=PlaneXY(0, 0, 0), Corners=1)
length_143 = Length(Curve=offset_curve_117)
length_144 = Length(Curve=offset_curve_119)
length_145 = Length(Curve=offset_curve_118)
length_146 = Length(Curve=offset_curve_120)
division_204 = Division(A=length_143, B=Slider(300, range=0..1000))
division_205 = Division(A=length_144, B=Slider(300, range=0..1000))
division_206 = Division(A=length_145, B=Slider(300, range=0..1000))
division_207 = Division(A=length_146, B=Slider(300, range=0..1000))
divide_curve_117 = DivideCurve(Curve=offset_curve_117, Count=division_204, Kinks=False)  # -> Points, Tangents, Parameters
divide_curve_118 = DivideCurve(Curve=offset_curve_118, Count=division_206, Kinks=False)  # -> Points, Tangents, Parameters
divide_curve_119 = DivideCurve(Curve=offset_curve_119, Count=division_205, Kinks=False)  # -> Points, Tangents, Parameters
divide_curve_120 = DivideCurve(Curve=offset_curve_120, Count=division_207, Kinks=False)  # -> Points, Tangents, Parameters
line_147 = Line(StartPoint=divide_curve_119.Points, EndPoint=divide_curve_117.Points)
line_148 = Line(StartPoint=divide_curve_120.Points, EndPoint=divide_curve_118.Points)
loft_95 = Loft(Curves=line_148, Options={Adjust=False, Closed=False, LoftEnds=0, LoftSimp=0, LoftType=0, Rebuild=10, Refit=0.01})
loft_96 = Loft(Curves=line_147, Options={Adjust=False, Closed=False, LoftEnds=0, LoftSimp=0, LoftType=0, Rebuild=10, Refit=0.01})
surface_closest_point_79 = SurfaceClosestPoint(Point=divide_curve_119.Points, Surface=loft_96)  # -> Point, UVPoint, Distance
surface_closest_point_80 = SurfaceClosestPoint(Point=divide_curve_120.Points, Surface=loft_95)  # -> Point, UVPoint, Distance
evaluate_surface_79 = EvaluateSurface(Surface=loft_96, Point=surface_closest_point_79.UVPoint)  # -> Point, Normal, UDirection, VDirection, Frame
evaluate_surface_80 = EvaluateSurface(Surface=loft_95, Point=surface_closest_point_80.UVPoint)  # -> Point, Normal, UDirection, VDirection, Frame
rotate_plane_79 = RotatePlane(Plane=evaluate_surface_79.Frame, Angle=radians_77)
rotate_plane_80 = RotatePlane(Plane=evaluate_surface_80.Frame, Angle=radians_79)
list_item_39 = ListItem(List=rotate_plane_79, Index=1, Wrap=True)
list_item_40 = ListItem(List=rotate_plane_80, Index=1, Wrap=True)
center_box_38 = CenterBox(Base=[list_item_39, list_item_40], X=division_172, Y=division_173, Z=division_170)
flatten_tree_50 = FlattenTree(Tree=split_tree_24.Positive, Path="{0}")
graft_tree_9 = GraftTree(Tree=flatten_tree_26, IncludeEmptyLists=True, IncludeNullItems=True)
graft_tree_10 = GraftTree(Tree=flatten_tree_25, IncludeEmptyLists=True, IncludeNullItems=True)
graft_tree_11 = GraftTree(Tree=flatten_tree_28, IncludeEmptyLists=True, IncludeNullItems=True)
flatten_tree_51 = FlattenTree(Tree=split_tree_28.Positive, Path="{0}")
flatten_tree_52 = FlattenTree(Tree=split_tree_27.Positive, Path="{0}")
graft_tree_12 = GraftTree(Tree=flatten_tree_27, IncludeEmptyLists=True, IncludeNullItems=True)
graft_tree_13 = GraftTree(Tree=flatten_tree_30, IncludeEmptyLists=True, IncludeNullItems=True)
flatten_tree_53 = FlattenTree(Tree=split_tree_31.Positive, Path="{0}")
flatten_tree_54 = FlattenTree(Tree=split_tree_32.Positive, Path="{0}")
flatten_tree_55 = FlattenTree(Tree=split_tree_30.Positive, Path="{0}")
flatten_tree_56 = FlattenTree(Tree=split_tree_29.Positive, Path="{0}")
graft_tree_14 = GraftTree(Tree=flatten_tree_29, IncludeEmptyLists=True, IncludeNullItems=True)
graft_tree_15 = GraftTree(Tree=flatten_tree_32, IncludeEmptyLists=True, IncludeNullItems=True)
graft_tree_16 = GraftTree(Tree=flatten_tree_34, IncludeEmptyLists=True, IncludeNullItems=True)
graft_tree_17 = GraftTree(Tree=flatten_tree_31, IncludeEmptyLists=True, IncludeNullItems=True)
graft_tree_18 = GraftTree(Tree=flatten_tree_33, IncludeEmptyLists=True, IncludeNullItems=True)
graft_tree_19 = GraftTree(Tree=flatten_tree_36, IncludeEmptyLists=True, IncludeNullItems=True)
graft_tree_20 = GraftTree(Tree=flatten_tree_35, IncludeEmptyLists=True, IncludeNullItems=True)
graft_tree_21 = GraftTree(Tree=flatten_tree_39, IncludeEmptyLists=True, IncludeNullItems=True)
graft_tree_22 = GraftTree(Tree=flatten_tree_40, IncludeEmptyLists=True, IncludeNullItems=True)
graft_tree_23 = GraftTree(Tree=flatten_tree_37, IncludeEmptyLists=True, IncludeNullItems=True)
graft_tree_24 = GraftTree(Tree=flatten_tree_38, IncludeEmptyLists=True, IncludeNullItems=True)
unit_z_59 = UnitZ(Factor=Slider(425, range=0..1000))
division_208 = Division(A=length_134, B=Slider(72, range=0..100))
division_209 = Division(A=Slider(75, range=0..100), B=2)
division_210 = Division(A=Slider(290, range=0..1000), B=2)
division_211 = Division(A=Slider(140, range=0..1000), B=2)
division_212 = Division(A=Slider(75, range=0..100), B=2)
division_213 = Division(A=Slider(140, range=0..1000), B=2)
division_214 = Division(A=Slider(290, range=0..1000), B=2)
perp_frames_2 = PerpFrames(Curve=sub_curve_14, Count=division_208, Align=True)  # -> Frames, Parameters
division_215 = Division(A=Slider(75, range=0..100), B=2)
addition_69 = Addition(A=Slider(85, range=0..100), B=division_215)
unit_z_60 = UnitZ(Factor=addition_69)
move1_13 = Move(Geometry=curve_19, Motion=unit_z_60)  # -> Geometry, Transform
length_147 = Length(Curve=move1_13.Geometry)
length_148 = Length(Curve=move1_13.Geometry)
subtraction_51 = Subtraction(A=length_147, B=Slider(1275, range=0..1500))
subtraction_52 = Subtraction(A=length_148, B=Slider(225, range=0..1500))
evaluate_curve_87 = EvaluateCurve(Curve=move1_13.Geometry, Parameter=subtraction_51)  # -> Point, Tangent, Angle
evaluate_curve_88 = EvaluateCurve(Curve=move1_13.Geometry, Parameter=subtraction_52)  # -> Point, Tangent, Angle
end_points_35 = EndPoints(Curve=move1_13.Geometry)  # -> Start, End
end_points_36 = EndPoints(Curve=move1_13.Geometry)  # -> Start, End
line_149 = Line(StartPoint=end_points_35.Start, EndPoint=evaluate_curve_87.Point)
line_150 = Line(StartPoint=end_points_36.End, EndPoint=evaluate_curve_88.Point)
offset_curve_121 = OffsetCurve(Curve=line_149, Distance=Slider(75, range=0..100), Plane=PlaneXY(0, 0, 0), Corners=1)
offset_curve_122 = OffsetCurve(Curve=line_150, Distance=Slider(75, range=0..100), Plane=PlaneXY(0, 0, 0), Corners=1)
offset_curve_123 = OffsetCurve(Curve=line_149, Distance=Slider(0, range=-75..0), Plane=PlaneXY(0, 0, 0), Corners=1)
offset_curve_124 = OffsetCurve(Curve=line_150, Distance=Slider(0, range=-75..0), Plane=PlaneXY(0, 0, 0), Corners=1)
length_149 = Length(Curve=offset_curve_121)
length_150 = Length(Curve=offset_curve_123)
length_151 = Length(Curve=offset_curve_122)
length_152 = Length(Curve=offset_curve_124)
division_216 = Division(A=length_149, B=Slider(300, range=0..1000))
division_217 = Division(A=length_150, B=Slider(300, range=0..1000))
division_218 = Division(A=length_151, B=Slider(300, range=0..1000))
division_219 = Division(A=length_152, B=Slider(300, range=0..1000))
divide_curve_121 = DivideCurve(Curve=offset_curve_121, Count=division_216, Kinks=False)  # -> Points, Tangents, Parameters
divide_curve_122 = DivideCurve(Curve=offset_curve_122, Count=division_218, Kinks=False)  # -> Points, Tangents, Parameters
divide_curve_123 = DivideCurve(Curve=offset_curve_123, Count=division_217, Kinks=False)  # -> Points, Tangents, Parameters
divide_curve_124 = DivideCurve(Curve=offset_curve_124, Count=division_219, Kinks=False)  # -> Points, Tangents, Parameters
line_151 = Line(StartPoint=divide_curve_123.Points, EndPoint=divide_curve_121.Points)
line_152 = Line(StartPoint=divide_curve_124.Points, EndPoint=divide_curve_122.Points)
loft_97 = Loft(Curves=line_152, Options={Adjust=False, Closed=False, LoftEnds=0, LoftSimp=0, LoftType=0, Rebuild=10, Refit=0.01})
loft_98 = Loft(Curves=line_151, Options={Adjust=False, Closed=False, LoftEnds=0, LoftSimp=0, LoftType=0, Rebuild=10, Refit=0.01})
surface_closest_point_81 = SurfaceClosestPoint(Point=divide_curve_123.Points, Surface=loft_98)  # -> Point, UVPoint, Distance
surface_closest_point_82 = SurfaceClosestPoint(Point=divide_curve_124.Points, Surface=loft_97)  # -> Point, UVPoint, Distance
evaluate_surface_81 = EvaluateSurface(Surface=loft_98, Point=surface_closest_point_81.UVPoint)  # -> Point, Normal, UDirection, VDirection, Frame
evaluate_surface_82 = EvaluateSurface(Surface=loft_97, Point=surface_closest_point_82.UVPoint)  # -> Point, Normal, UDirection, VDirection, Frame
rotate_plane_81 = RotatePlane(Plane=evaluate_surface_81.Frame, Angle=radians_88)
rotate_plane_82 = RotatePlane(Plane=evaluate_surface_82.Frame, Angle=radians_89)
panel_8 = Panel(rotate_plane_81)
list_item_41 = ListItem(List=rotate_plane_81, Index=1, Wrap=True)
list_item_42 = ListItem(List=rotate_plane_82, Index=1, Wrap=True)
division_220 = Division(A=Slider(290, range=0..1000), B=2)
division_221 = Division(A=Slider(140, range=0..1000), B=2)
unit_z_61 = UnitZ(Factor=Slider(85, range=0..1000))
division_222 = Division(A=number_slider_62, B=2)
unit_z_62 = UnitZ(Factor=division_222)
move1_14 = Move(Geometry=curve_19, Motion=unit_z_62)  # -> Geometry, Transform
length_153 = Length(Curve=move1_14.Geometry)
length_154 = Length(Curve=move1_14.Geometry)
subtraction_53 = Subtraction(A=length_153, B=Slider(1237.5, range=0..1500))
subtraction_54 = Subtraction(A=length_154, B=Slider(262.5, range=0..1500))
evaluate_curve_89 = EvaluateCurve(Curve=move1_14.Geometry, Parameter=subtraction_53)  # -> Point, Tangent, Angle
evaluate_curve_90 = EvaluateCurve(Curve=move1_14.Geometry, Parameter=subtraction_54)  # -> Point, Tangent, Angle
end_points_37 = EndPoints(Curve=move1_14.Geometry)  # -> Start, End
end_points_38 = EndPoints(Curve=move1_14.Geometry)  # -> Start, End
line_153 = Line(StartPoint=end_points_38.End, EndPoint=evaluate_curve_90.Point)
line_154 = Line(StartPoint=end_points_37.Start, EndPoint=evaluate_curve_89.Point)
offset_curve_125 = OffsetCurve(Curve=line_154, Distance=Slider(75, range=0..100), Plane=PlaneXY(0, 0, 0), Corners=1)
offset_curve_126 = OffsetCurve(Curve=line_153, Distance=Slider(75, range=0..100), Plane=PlaneXY(0, 0, 0), Corners=1)
offset_curve_127 = OffsetCurve(Curve=line_154, Distance=Slider(0, range=-75..0), Plane=PlaneXY(0, 0, 0), Corners=1)
offset_curve_128 = OffsetCurve(Curve=line_153, Distance=Slider(0, range=-75..0), Plane=PlaneXY(0, 0, 0), Corners=1)
length_155 = Length(Curve=offset_curve_125)
length_156 = Length(Curve=offset_curve_127)
length_157 = Length(Curve=offset_curve_126)
length_158 = Length(Curve=offset_curve_128)
division_223 = Division(A=length_155, B=Slider(300, range=0..1000))
division_224 = Division(A=length_156, B=Slider(300, range=0..1000))
division_225 = Division(A=length_157, B=Slider(300, range=0..1000))
division_226 = Division(A=length_158, B=Slider(300, range=0..1000))
divide_curve_125 = DivideCurve(Curve=offset_curve_125, Count=division_223, Kinks=False)  # -> Points, Tangents, Parameters
divide_curve_126 = DivideCurve(Curve=offset_curve_126, Count=division_225, Kinks=False)  # -> Points, Tangents, Parameters
divide_curve_127 = DivideCurve(Curve=offset_curve_127, Count=division_224, Kinks=False)  # -> Points, Tangents, Parameters
divide_curve_128 = DivideCurve(Curve=offset_curve_128, Count=division_226, Kinks=False)  # -> Points, Tangents, Parameters
line_155 = Line(StartPoint=divide_curve_127.Points, EndPoint=divide_curve_125.Points)
line_156 = Line(StartPoint=divide_curve_128.Points, EndPoint=divide_curve_126.Points)
loft_99 = Loft(Curves=line_155, Options={Adjust=False, Closed=False, LoftEnds=0, LoftSimp=0, LoftType=0, Rebuild=10, Refit=0.01})
loft_100 = Loft(Curves=line_156, Options={Adjust=False, Closed=False, LoftEnds=0, LoftSimp=0, LoftType=0, Rebuild=10, Refit=0.01})
surface_closest_point_83 = SurfaceClosestPoint(Point=divide_curve_127.Points, Surface=loft_99)  # -> Point, UVPoint, Distance
surface_closest_point_84 = SurfaceClosestPoint(Point=divide_curve_128.Points, Surface=loft_100)  # -> Point, UVPoint, Distance
evaluate_surface_83 = EvaluateSurface(Surface=loft_99, Point=surface_closest_point_83.UVPoint)  # -> Point, Normal, UDirection, VDirection, Frame
evaluate_surface_84 = EvaluateSurface(Surface=loft_100, Point=surface_closest_point_84.UVPoint)  # -> Point, Normal, UDirection, VDirection, Frame
rotate_plane_83 = RotatePlane(Plane=evaluate_surface_83.Frame, Angle=radians_90)
rotate_plane_84 = RotatePlane(Plane=evaluate_surface_84.Frame, Angle=radians_92)
list_item_43 = ListItem(List=rotate_plane_83, Index=1, Wrap=True)
list_item_44 = ListItem(List=rotate_plane_84, Index=1, Wrap=True)
division_227 = Division(A=Slider(290, range=0..1000), B=2)
division_228 = Division(A=Slider(65, range=0..1000), B=2)
division_229 = Division(A=number_slider_61, B=2)
division_230 = Division(A=Slider(290, range=0..1000), B=2)
division_231 = Division(A=Slider(290, range=0..1000), B=2)
graft_tree_25 = GraftTree(Tree=flatten_tree_42, IncludeEmptyLists=True, IncludeNullItems=True)
graft_tree_26 = GraftTree(Tree=flatten_tree_41, IncludeEmptyLists=True, IncludeNullItems=True)
graft_tree_27 = GraftTree(Tree=flatten_tree_44, IncludeEmptyLists=True, IncludeNullItems=True)
graft_tree_28 = GraftTree(Tree=flatten_tree_43, IncludeEmptyLists=True, IncludeNullItems=True)
division_232 = Division(A=number_slider_63, B=2)
division_233 = Division(A=Slider(290, range=0..1000), B=2)
division_234 = Division(A=Slider(290, range=0..1000), B=2)
graft_tree_29 = GraftTree(Tree=flatten_tree_46, IncludeEmptyLists=True, IncludeNullItems=True)
graft_tree_30 = GraftTree(Tree=flatten_tree_45, IncludeEmptyLists=True, IncludeNullItems=True)
graft_tree_31 = GraftTree(Tree=flatten_tree_48, IncludeEmptyLists=True, IncludeNullItems=True)
graft_tree_32 = GraftTree(Tree=flatten_tree_50, IncludeEmptyLists=True, IncludeNullItems=True)
graft_tree_33 = GraftTree(Tree=flatten_tree_47, IncludeEmptyLists=True, IncludeNullItems=True)
graft_tree_34 = GraftTree(Tree=flatten_tree_49, IncludeEmptyLists=True, IncludeNullItems=True)
graft_tree_35 = GraftTree(Tree=flatten_tree_52, IncludeEmptyLists=True, IncludeNullItems=True)
loft_101 = Loft(
    Curves=[graft_tree_10, graft_tree_9],
    Options={Adjust=False, Closed=False, LoftEnds=0, LoftSimp=0, LoftType=0, Rebuild=10, Refit=0.01})
graft_tree_36 = GraftTree(Tree=flatten_tree_51, IncludeEmptyLists=True, IncludeNullItems=True)
loft_102 = Loft(
    Curves=[graft_tree_12, graft_tree_11],
    Options={Adjust=False, Closed=False, LoftEnds=0, LoftSimp=0, LoftType=0, Rebuild=10, Refit=0.01})
graft_tree_37 = GraftTree(Tree=flatten_tree_55, IncludeEmptyLists=True, IncludeNullItems=True)
graft_tree_38 = GraftTree(Tree=flatten_tree_56, IncludeEmptyLists=True, IncludeNullItems=True)
graft_tree_39 = GraftTree(Tree=flatten_tree_53, IncludeEmptyLists=True, IncludeNullItems=True)
graft_tree_40 = GraftTree(Tree=flatten_tree_54, IncludeEmptyLists=True, IncludeNullItems=True)
loft_103 = Loft(
    Curves=[graft_tree_14, graft_tree_13],
    Options={Adjust=False, Closed=False, LoftEnds=0, LoftSimp=0, LoftType=0, Rebuild=10, Refit=0.01})
loft_104 = Loft(
    Curves=[graft_tree_17, graft_tree_15],
    Options={Adjust=False, Closed=False, LoftEnds=0, LoftSimp=0, LoftType=0, Rebuild=10, Refit=0.01})
loft_105 = Loft(
    Curves=[graft_tree_18, graft_tree_16],
    Options={Adjust=False, Closed=False, LoftEnds=0, LoftSimp=0, LoftType=0, Rebuild=10, Refit=0.01})
loft_106 = Loft(
    Curves=[graft_tree_20, graft_tree_19],
    Options={Adjust=False, Closed=False, LoftEnds=0, LoftSimp=0, LoftType=0, Rebuild=10, Refit=0.01})
loft_107 = Loft(
    Curves=[graft_tree_24, graft_tree_21],
    Options={Adjust=False, Closed=False, LoftEnds=0, LoftSimp=0, LoftType=0, Rebuild=10, Refit=0.01})
loft_108 = Loft(
    Curves=[graft_tree_23, graft_tree_22],
    Options={Adjust=False, Closed=False, LoftEnds=0, LoftSimp=0, LoftType=0, Rebuild=10, Refit=0.01})
radians_113 = Radians(Degrees=Slider(90, range=0..100))
unit_z_63 = UnitZ(Factor=Slider(170, range=0..1000))
division_235 = Division(A=Slider(75, range=0..100), B=2)
division_236 = Division(A=Slider(140, range=0..1000), B=2)
division_237 = Division(A=Slider(290, range=0..1000), B=2)
unit_z_64 = UnitZ(Factor=Slider(170, range=0..1000))
unit_z_65 = UnitZ(Factor=Slider(170, range=0..1000))
division_238 = Division(A=Slider(75, range=0..100), B=2)
addition_70 = Addition(A=Slider(85, range=0..100), B=division_238)
unit_z_66 = UnitZ(Factor=addition_70)
move1_15 = Move(Geometry=curve_18, Motion=unit_z_66)  # -> Geometry, Transform
length_159 = Length(Curve=move1_15.Geometry)
length_160 = Length(Curve=move1_15.Geometry)
subtraction_55 = Subtraction(A=length_159, B=Slider(1125, range=0..1500))
subtraction_56 = Subtraction(A=length_160, B=Slider(225, range=0..1500))
evaluate_curve_91 = EvaluateCurve(Curve=move1_15.Geometry, Parameter=subtraction_55)  # -> Point, Tangent, Angle
evaluate_curve_92 = EvaluateCurve(Curve=move1_15.Geometry, Parameter=subtraction_56)  # -> Point, Tangent, Angle
end_points_39 = EndPoints(Curve=move1_15.Geometry)  # -> Start, End
end_points_40 = EndPoints(Curve=move1_15.Geometry)  # -> Start, End
line_157 = Line(StartPoint=end_points_39.Start, EndPoint=evaluate_curve_91.Point)
line_158 = Line(StartPoint=end_points_40.End, EndPoint=evaluate_curve_92.Point)
offset_curve_129 = OffsetCurve(Curve=line_157, Distance=Slider(75, range=0..100), Plane=PlaneXY(0, 0, 0), Corners=1)
offset_curve_130 = OffsetCurve(Curve=line_158, Distance=Slider(75, range=0..100), Plane=PlaneXY(0, 0, 0), Corners=1)
offset_curve_131 = OffsetCurve(Curve=line_157, Distance=Slider(0, range=-75..0), Plane=PlaneXY(0, 0, 0), Corners=1)
offset_curve_132 = OffsetCurve(Curve=line_158, Distance=Slider(0, range=-75..0), Plane=PlaneXY(0, 0, 0), Corners=1)
length_161 = Length(Curve=offset_curve_129)
length_162 = Length(Curve=offset_curve_131)
length_163 = Length(Curve=offset_curve_130)
length_164 = Length(Curve=offset_curve_132)
division_239 = Division(A=length_161, B=Slider(300, range=0..1000))
division_240 = Division(A=length_162, B=Slider(300, range=0..1000))
division_241 = Division(A=length_163, B=Slider(300, range=0..1000))
division_242 = Division(A=length_164, B=Slider(300, range=0..1000))
divide_curve_129 = DivideCurve(Curve=offset_curve_129, Count=division_239, Kinks=False)  # -> Points, Tangents, Parameters
divide_curve_130 = DivideCurve(Curve=offset_curve_130, Count=division_241, Kinks=False)  # -> Points, Tangents, Parameters
divide_curve_131 = DivideCurve(Curve=offset_curve_131, Count=division_240, Kinks=False)  # -> Points, Tangents, Parameters
divide_curve_132 = DivideCurve(Curve=offset_curve_132, Count=division_242, Kinks=False)  # -> Points, Tangents, Parameters
line_159 = Line(StartPoint=divide_curve_131.Points, EndPoint=divide_curve_129.Points)
line_160 = Line(StartPoint=divide_curve_132.Points, EndPoint=divide_curve_130.Points)
loft_109 = Loft(Curves=line_160, Options={Adjust=False, Closed=False, LoftEnds=0, LoftSimp=0, LoftType=0, Rebuild=10, Refit=0.01})
loft_110 = Loft(Curves=line_159, Options={Adjust=False, Closed=False, LoftEnds=0, LoftSimp=0, LoftType=0, Rebuild=10, Refit=0.01})
surface_closest_point_85 = SurfaceClosestPoint(Point=divide_curve_131.Points, Surface=loft_110)  # -> Point, UVPoint, Distance
surface_closest_point_86 = SurfaceClosestPoint(Point=divide_curve_132.Points, Surface=loft_109)  # -> Point, UVPoint, Distance
evaluate_surface_85 = EvaluateSurface(Surface=loft_110, Point=surface_closest_point_85.UVPoint)  # -> Point, Normal, UDirection, VDirection, Frame
evaluate_surface_86 = EvaluateSurface(Surface=loft_109, Point=surface_closest_point_86.UVPoint)  # -> Point, Normal, UDirection, VDirection, Frame
rotate_plane_85 = RotatePlane(Plane=evaluate_surface_85.Frame, Angle=radians_98)
rotate_plane_86 = RotatePlane(Plane=evaluate_surface_86.Frame, Angle=radians_99)
list_item_45 = ListItem(List=rotate_plane_85, Index=1, Wrap=True)
list_item_46 = ListItem(List=rotate_plane_86, Index=1, Wrap=True)
division_243 = Division(A=Slider(290, range=0..1000), B=2)
division_244 = Division(A=Slider(140, range=0..1000), B=2)
unit_z_67 = UnitZ(Factor=Slider(170, range=0..1000))
unit_z_68 = UnitZ(Factor=Slider(85, range=0..1000))
division_245 = Division(A=number_slider_68, B=2)
unit_z_69 = UnitZ(Factor=division_245)
move1_16 = Move(Geometry=curve_18, Motion=unit_z_69)  # -> Geometry, Transform
length_165 = Length(Curve=move1_16.Geometry)
length_166 = Length(Curve=move1_16.Geometry)
subtraction_57 = Subtraction(A=length_165, B=Slider(1087.5, range=0..1500))
subtraction_58 = Subtraction(A=length_166, B=Slider(262.5, range=0..1500))
evaluate_curve_93 = EvaluateCurve(Curve=move1_16.Geometry, Parameter=subtraction_57)  # -> Point, Tangent, Angle
evaluate_curve_94 = EvaluateCurve(Curve=move1_16.Geometry, Parameter=subtraction_58)  # -> Point, Tangent, Angle
end_points_41 = EndPoints(Curve=move1_16.Geometry)  # -> Start, End
end_points_42 = EndPoints(Curve=move1_16.Geometry)  # -> Start, End
line_161 = Line(StartPoint=end_points_42.End, EndPoint=evaluate_curve_94.Point)
line_162 = Line(StartPoint=end_points_41.Start, EndPoint=evaluate_curve_93.Point)
offset_curve_133 = OffsetCurve(Curve=line_162, Distance=Slider(75, range=0..100), Plane=PlaneXY(0, 0, 0), Corners=1)
offset_curve_134 = OffsetCurve(Curve=line_161, Distance=Slider(75, range=0..100), Plane=PlaneXY(0, 0, 0), Corners=1)
offset_curve_135 = OffsetCurve(Curve=line_162, Distance=Slider(0, range=-75..0), Plane=PlaneXY(0, 0, 0), Corners=1)
offset_curve_136 = OffsetCurve(Curve=line_161, Distance=Slider(0, range=-75..0), Plane=PlaneXY(0, 0, 0), Corners=1)
length_167 = Length(Curve=offset_curve_133)
length_168 = Length(Curve=offset_curve_135)
length_169 = Length(Curve=offset_curve_134)
length_170 = Length(Curve=offset_curve_136)
division_246 = Division(A=length_167, B=Slider(300, range=0..1000))
division_247 = Division(A=length_168, B=Slider(300, range=0..1000))
division_248 = Division(A=length_169, B=Slider(300, range=0..1000))
division_249 = Division(A=length_170, B=Slider(300, range=0..1000))
divide_curve_133 = DivideCurve(Curve=offset_curve_133, Count=division_246, Kinks=False)  # -> Points, Tangents, Parameters
divide_curve_134 = DivideCurve(Curve=offset_curve_134, Count=division_248, Kinks=False)  # -> Points, Tangents, Parameters
divide_curve_135 = DivideCurve(Curve=offset_curve_135, Count=division_247, Kinks=False)  # -> Points, Tangents, Parameters
divide_curve_136 = DivideCurve(Curve=offset_curve_136, Count=division_249, Kinks=False)  # -> Points, Tangents, Parameters
line_163 = Line(StartPoint=divide_curve_135.Points, EndPoint=divide_curve_133.Points)
line_164 = Line(StartPoint=divide_curve_136.Points, EndPoint=divide_curve_134.Points)
loft_111 = Loft(Curves=line_163, Options={Adjust=False, Closed=False, LoftEnds=0, LoftSimp=0, LoftType=0, Rebuild=10, Refit=0.01})
loft_112 = Loft(Curves=line_164, Options={Adjust=False, Closed=False, LoftEnds=0, LoftSimp=0, LoftType=0, Rebuild=10, Refit=0.01})
surface_closest_point_87 = SurfaceClosestPoint(Point=divide_curve_135.Points, Surface=loft_111)  # -> Point, UVPoint, Distance
surface_closest_point_88 = SurfaceClosestPoint(Point=divide_curve_136.Points, Surface=loft_112)  # -> Point, UVPoint, Distance
evaluate_surface_87 = EvaluateSurface(Surface=loft_111, Point=surface_closest_point_87.UVPoint)  # -> Point, Normal, UDirection, VDirection, Frame
evaluate_surface_88 = EvaluateSurface(Surface=loft_112, Point=surface_closest_point_88.UVPoint)  # -> Point, Normal, UDirection, VDirection, Frame
rotate_plane_87 = RotatePlane(Plane=evaluate_surface_87.Frame, Angle=radians_100)
rotate_plane_88 = RotatePlane(Plane=evaluate_surface_88.Frame, Angle=radians_102)
list_item_47 = ListItem(List=rotate_plane_87, Index=1, Wrap=True)
list_item_48 = ListItem(List=rotate_plane_88, Index=1, Wrap=True)
division_250 = Division(A=Slider(290, range=0..1000), B=2)
division_251 = Division(A=Slider(65, range=0..1000), B=2)
division_252 = Division(A=number_slider_67, B=2)
division_253 = Division(A=Slider(290, range=0..1000), B=2)
division_254 = Division(A=Slider(290, range=0..1000), B=2)
unit_z_70 = UnitZ(Factor=Slider(85, range=0..1000))
division_255 = Division(A=Slider(75, range=0..100), B=2)
division_256 = Division(A=Slider(290, range=0..1000), B=2)
division_257 = Division(A=Slider(140, range=0..1000), B=2)
division_258 = Division(A=number_slider_69, B=2)
division_259 = Division(A=Slider(75, range=0..100), B=2)
division_260 = Division(A=Slider(290, range=0..1000), B=2)
division_261 = Division(A=Slider(290, range=0..1000), B=2)
division_262 = Division(A=Slider(140, range=0..1000), B=2)
division_263 = Division(A=Slider(290, range=0..1000), B=2)
division_264 = Division(A=Slider(75, range=0..100), B=2)
division_265 = Division(A=Slider(140, range=0..1000), B=2)
division_266 = Division(A=Slider(290, range=0..1000), B=2)
move_37 = Move(Geometry=center_box_29, Motion=unit_z_59)  # -> Geometry, Transform
unit_z_71 = UnitZ(Factor=Slider(170, range=0..1000))
loft_113 = Loft(
    Curves=[graft_tree_26, graft_tree_25],
    Options={Adjust=False, Closed=False, LoftEnds=0, LoftSimp=0, LoftType=0, Rebuild=10, Refit=0.01})
loft_114 = Loft(
    Curves=[graft_tree_28, graft_tree_27],
    Options={Adjust=False, Closed=False, LoftEnds=0, LoftSimp=0, LoftType=0, Rebuild=10, Refit=0.01})
loft_115 = Loft(
    Curves=[graft_tree_30, graft_tree_29],
    Options={Adjust=False, Closed=False, LoftEnds=0, LoftSimp=0, LoftType=0, Rebuild=10, Refit=0.01})
loft_116 = Loft(
    Curves=[graft_tree_33, graft_tree_31],
    Options={Adjust=False, Closed=False, LoftEnds=0, LoftSimp=0, LoftType=0, Rebuild=10, Refit=0.01})
loft_117 = Loft(
    Curves=[graft_tree_34, graft_tree_32],
    Options={Adjust=False, Closed=False, LoftEnds=0, LoftSimp=0, LoftType=0, Rebuild=10, Refit=0.01})
loft_118 = Loft(
    Curves=[graft_tree_36, graft_tree_35],
    Options={Adjust=False, Closed=False, LoftEnds=0, LoftSimp=0, LoftType=0, Rebuild=10, Refit=0.01})
linear_array_25 = LinearArray(Geometry=center_box_33, Direction=unit_z_61, Count=Slider(1, range=0..10))  # -> Geometry, Transform
loft_119 = Loft(
    Curves=[graft_tree_40, graft_tree_37],
    Options={Adjust=False, Closed=False, LoftEnds=0, LoftSimp=0, LoftType=0, Rebuild=10, Refit=0.01})
loft_120 = Loft(
    Curves=[graft_tree_39, graft_tree_38],
    Options={Adjust=False, Closed=False, LoftEnds=0, LoftSimp=0, LoftType=0, Rebuild=10, Refit=0.01})
unit_z_72 = UnitZ(Factor=Slider(170, range=0..1000))
center_box_39 = CenterBox(Base=[list_item_41, list_item_42], X=division_220, Y=division_221, Z=division_215)
rotate_plane_89 = RotatePlane(Plane=perp_frames.Frames, Angle=radians_113)
number_slider_71 = Slider(9, range=0..10)
number_slider_72 = Slider(9, range=0..10)
addition_71 = Addition(A=number_slider_72, B=number_slider_71)
multiplication_17 = Multiplication(A=addition_71, B=addition_56)
addition_72 = Addition(A=Slider(207.5, range=0..1000), B=multiplication_17)
unit_z_73 = UnitZ(Factor=addition_72)
move1_17 = Move(Geometry=curve_19, Motion=unit_z_73)  # -> Geometry, Transform
addition_73 = Addition(A=Slider(425, range=0..1000), B=addition_72)
addition_74 = Addition(A=Slider(85, range=0..1000), B=addition_73)
unit_z_74 = UnitZ(Factor=addition_74)
move_38 = Move(Geometry=curve_19, Motion=unit_z_74)  # -> Geometry, Transform
addition_75 = Addition(A=number_slider_71, B=number_slider_72)
unit_z_75 = UnitZ(Factor=addition_73)
move_39 = Move(Geometry=curve_19, Motion=unit_z_75)  # -> Geometry, Transform
multiplication_18 = Multiplication(A=addition_75, B=addition_57)
length_171 = Length(Curve=move_38.Geometry)
length_172 = Length(Curve=move_38.Geometry)
length_173 = Length(Curve=move1_17.Geometry)
length_174 = Length(Curve=move1_17.Geometry)
unit_z_76 = UnitZ(Factor=multiplication_18)
move_40 = Move(Geometry=evaluate_curve_53.Point, Motion=unit_z_76)  # -> Geometry, Transform
move_41 = Move(Geometry=evaluate_curve_54.Point, Motion=unit_z_76)  # -> Geometry, Transform
subtraction_59 = Subtraction(A=length_171, B=number_slider_39)
length_175 = Length(Curve=move_39.Geometry)
subtraction_60 = Subtraction(A=length_172, B=addition_35)
subtraction_61 = Subtraction(A=length_173, B=Slider(1200, range=0..1500))
subtraction_62 = Subtraction(A=length_174, B=Slider(300, range=0..1500))
move_42 = Move(Geometry=evaluate_curve_59.Point, Motion=unit_z_76)  # -> Geometry, Transform
move_43 = Move(Geometry=curve_middle_7, Motion=unit_z_76)  # -> Geometry, Transform
line_165 = Line(StartPoint=move_40.Geometry, EndPoint=move_43.Geometry)
line_166 = Line(StartPoint=move_41.Geometry, EndPoint=move_43.Geometry)
offset_curve_137 = OffsetCurve(Curve=line_165, Distance=Slider(0, range=0..145), Plane=PlaneXY(0, 0, 0), Corners=1)
offset_curve_138 = OffsetCurve(Curve=line_165, Distance=Slider(145, range=0..1000), Plane=PlaneXY(0, 0, 0), Corners=1)
offset_curve_139 = OffsetCurve(Curve=line_166, Distance=Slider(-145, range=-150..0), Plane=PlaneXY(0, 0, 0), Corners=1)
offset_curve_140 = OffsetCurve(Curve=line_166, Distance=Slider(145, range=0..1000), Plane=PlaneXY(0, 0, 0), Corners=1)
evaluate_curve_95 = EvaluateCurve(Curve=move_38.Geometry, Parameter=subtraction_59)  # -> Point, Tangent, Angle
evaluate_curve_96 = EvaluateCurve(Curve=move_38.Geometry, Parameter=subtraction_60)  # -> Point, Tangent, Angle
divide_curve_137 = DivideCurve(Curve=offset_curve_137, Count=number_slider_40, Kinks=False)  # -> Points, Tangents, Parameters
evaluate_curve_97 = EvaluateCurve(Curve=move_38.Geometry, Parameter=Slider(375, range=0..1500))  # -> Point, Tangent, Angle
divide_curve_138 = DivideCurve(Curve=offset_curve_138, Count=number_slider_40, Kinks=False)  # -> Points, Tangents, Parameters
divide_curve_139 = DivideCurve(Curve=offset_curve_139, Count=number_slider_41, Kinks=False)  # -> Points, Tangents, Parameters
divide_curve_140 = DivideCurve(Curve=offset_curve_140, Count=number_slider_41, Kinks=False)  # -> Points, Tangents, Parameters
evaluate_curve_98 = EvaluateCurve(Curve=move1_17.Geometry, Parameter=subtraction_61)  # -> Point, Tangent, Angle
subtraction_63 = Subtraction(A=length_175, B=Slider(300, range=0..1500))
evaluate_curve_99 = EvaluateCurve(Curve=move1_17.Geometry, Parameter=subtraction_62)  # -> Point, Tangent, Angle
end_points_43 = EndPoints(Curve=move_38.Geometry)  # -> Start, End
end_points_44 = EndPoints(Curve=move1_17.Geometry)  # -> Start, End
end_points_45 = EndPoints(Curve=move1_17.Geometry)  # -> Start, End
line_167 = Line(StartPoint=move_42.Geometry, EndPoint=move_43.Geometry)
evaluate_curve_100 = EvaluateCurve(Curve=move_39.Geometry, Parameter=subtraction_63)  # -> Point, Tangent, Angle
evaluate_curve_101 = EvaluateCurve(Curve=move_39.Geometry, Parameter=Slider(300, range=0..1500))  # -> Point, Tangent, Angle
line_168 = Line(StartPoint=divide_curve_138.Points, EndPoint=divide_curve_137.Points)
line_169 = Line(StartPoint=divide_curve_140.Points, EndPoint=divide_curve_139.Points)
line_170 = Line(StartPoint=end_points_43.End, EndPoint=evaluate_curve_95.Point)
line_171 = Line(StartPoint=evaluate_curve_97.Point, EndPoint=evaluate_curve_96.Point)
line_172 = Line(StartPoint=end_points_44.Start, EndPoint=evaluate_curve_98.Point)
line_173 = Line(StartPoint=end_points_45.End, EndPoint=evaluate_curve_99.Point)
loft_121 = Loft(Curves=line_168, Options={Adjust=False, Closed=False, LoftEnds=0, LoftSimp=0, LoftType=0, Rebuild=10, Refit=0.01})
loft_122 = Loft(Curves=line_169, Options={Adjust=False, Closed=False, LoftEnds=0, LoftSimp=0, LoftType=0, Rebuild=10, Refit=0.01})
offset_curve_141 = OffsetCurve(Curve=line_167, Distance=Slider(0, range=0..100), Plane=PlaneXY(0, 0, 0), Corners=1)
offset_curve_142 = OffsetCurve(Curve=line_167, Distance=Slider(75, range=0..100), Plane=PlaneXY(0, 0, 0), Corners=1)
line_174 = Line(StartPoint=evaluate_curve_101.Point, EndPoint=evaluate_curve_100.Point)
surface_closest_point_89 = SurfaceClosestPoint(Point=divide_curve_138.Points, Surface=loft_121)  # -> Point, UVPoint, Distance
surface_closest_point_90 = SurfaceClosestPoint(Point=divide_curve_139.Points, Surface=loft_122)  # -> Point, UVPoint, Distance
offset_curve_143 = OffsetCurve(Curve=line_171, Distance=Slider(-75, range=-75..0), Plane=PlaneXY(0, 0, 0), Corners=1)
offset_curve_144 = OffsetCurve(Curve=line_171, Distance=Slider(75, range=0..100), Plane=PlaneXY(0, 0, 0), Corners=1)
offset_curve_145 = OffsetCurve(Curve=line_170, Distance=Slider(75, range=0..100), Plane=PlaneXY(0, 0, 0), Corners=1)
offset_curve_146 = OffsetCurve(Curve=line_170, Distance=Slider(0, range=-75..0), Plane=PlaneXY(0, 0, 0), Corners=1)
offset_curve_147 = OffsetCurve(Curve=line_172, Distance=Slider(75, range=0..100), Plane=PlaneXY(0, 0, 0), Corners=1)
offset_curve_148 = OffsetCurve(Curve=line_173, Distance=Slider(75, range=0..100), Plane=PlaneXY(0, 0, 0), Corners=1)
offset_curve_149 = OffsetCurve(Curve=line_172, Distance=Slider(0, range=-75..0), Plane=PlaneXY(0, 0, 0), Corners=1)
offset_curve_150 = OffsetCurve(Curve=line_173, Distance=Slider(0, range=-75..0), Plane=PlaneXY(0, 0, 0), Corners=1)
evaluate_surface_89 = EvaluateSurface(Surface=loft_121, Point=surface_closest_point_89.UVPoint)  # -> Point, Normal, UDirection, VDirection, Frame
evaluate_surface_90 = EvaluateSurface(Surface=loft_122, Point=surface_closest_point_90.UVPoint)  # -> Point, Normal, UDirection, VDirection, Frame
offset_curve_151 = OffsetCurve(Curve=line_174, Distance=Slider(-75, range=-75..0), Plane=PlaneXY(0, 0, 0), Corners=1)
offset_curve_152 = OffsetCurve(Curve=line_174, Distance=Slider(75, range=0..100), Plane=PlaneXY(0, 0, 0), Corners=1)
divide_curve_141 = DivideCurve(Curve=offset_curve_141, Count=number_slider_47, Kinks=False)  # -> Points, Tangents, Parameters
divide_curve_142 = DivideCurve(Curve=offset_curve_142, Count=number_slider_47, Kinks=False)  # -> Points, Tangents, Parameters
rotate_plane_90 = RotatePlane(Plane=evaluate_surface_89.Frame, Angle=radians_53)
rotate_plane_91 = RotatePlane(Plane=evaluate_surface_90.Frame, Angle=radians_54)
length_176 = Length(Curve=offset_curve_143)
length_177 = Length(Curve=offset_curve_146)
length_178 = Length(Curve=offset_curve_144)
length_179 = Length(Curve=offset_curve_145)
length_180 = Length(Curve=offset_curve_147)
length_181 = Length(Curve=offset_curve_149)
length_182 = Length(Curve=offset_curve_148)
length_183 = Length(Curve=offset_curve_150)
length_184 = Length(Curve=offset_curve_151)
line_175 = Line(StartPoint=divide_curve_142.Points, EndPoint=divide_curve_141.Points)
deconstruct_plane_15 = DeconstructPlane(Plane=rotate_plane_90)  # -> Origin, XAxis, YAxis, ZAxis
division_267 = Division(A=length_176, B=Slider(300, range=0..1000))
division_268 = Division(A=length_178, B=Slider(300, range=0..1000))
deconstruct_plane_16 = DeconstructPlane(Plane=rotate_plane_91)  # -> Origin, XAxis, YAxis, ZAxis
division_269 = Division(A=length_177, B=Slider(300, range=0..1000))
division_270 = Division(A=length_179, B=Slider(300, range=0..1000))
length_185 = Length(Curve=offset_curve_152)
division_271 = Division(A=length_180, B=Slider(300, range=0..1000))
division_272 = Division(A=length_181, B=Slider(300, range=0..1000))
division_273 = Division(A=length_182, B=Slider(300, range=0..1000))
division_274 = Division(A=length_183, B=Slider(300, range=0..1000))
divide_curve_143 = DivideCurve(Curve=offset_curve_143, Count=division_267, Kinks=False)  # -> Points, Tangents, Parameters
divide_curve_144 = DivideCurve(Curve=offset_curve_146, Count=division_269, Kinks=False)  # -> Points, Tangents, Parameters
divide_curve_145 = DivideCurve(Curve=offset_curve_144, Count=division_268, Kinks=False)  # -> Points, Tangents, Parameters
divide_curve_146 = DivideCurve(Curve=offset_curve_145, Count=division_270, Kinks=False)  # -> Points, Tangents, Parameters
rotate_3d_15 = Rotate3D(Geometry=rotate_plane_90, Angle=1.570796327, Center=deconstruct_plane_15.Origin, Axis=deconstruct_plane_15.YAxis)  # -> Geometry, Transform
division_275 = Division(A=length_184, B=Slider(300, range=0..1000))
division_276 = Division(A=length_185, B=Slider(300, range=0..1000))
rotate_3d_16 = Rotate3D(Geometry=rotate_plane_91, Angle=1.570796327, Center=deconstruct_plane_16.Origin, Axis=deconstruct_plane_16.YAxis)  # -> Geometry, Transform
loft_123 = Loft(Curves=line_175, Options={Adjust=False, Closed=False, LoftEnds=0, LoftSimp=0, LoftType=0, Rebuild=10, Refit=0.01})
divide_curve_147 = DivideCurve(Curve=offset_curve_147, Count=division_271, Kinks=False)  # -> Points, Tangents, Parameters
divide_curve_148 = DivideCurve(Curve=offset_curve_148, Count=division_273, Kinks=False)  # -> Points, Tangents, Parameters
divide_curve_149 = DivideCurve(Curve=offset_curve_149, Count=division_272, Kinks=False)  # -> Points, Tangents, Parameters
divide_curve_150 = DivideCurve(Curve=offset_curve_150, Count=division_274, Kinks=False)  # -> Points, Tangents, Parameters
divide_curve_151 = DivideCurve(Curve=offset_curve_151, Count=division_275, Kinks=False)  # -> Points, Tangents, Parameters
divide_curve_152 = DivideCurve(Curve=offset_curve_152, Count=division_276, Kinks=False)  # -> Points, Tangents, Parameters
surface_closest_point_91 = SurfaceClosestPoint(Point=divide_curve_141.Points, Surface=loft_123)  # -> Point, UVPoint, Distance
list_item_49 = ListItem(List=rotate_3d_15.Geometry, Index=1, Wrap=True)
list_item_50 = ListItem(List=rotate_3d_16.Geometry, Index=1, Wrap=True)
line_176 = Line(StartPoint=divide_curve_145.Points, EndPoint=divide_curve_143.Points)
line_177 = Line(StartPoint=divide_curve_143.Points, EndPoint=divide_curve_145.Points)
line_178 = Line(StartPoint=divide_curve_144.Points, EndPoint=divide_curve_146.Points)
line_179 = Line(StartPoint=divide_curve_149.Points, EndPoint=divide_curve_147.Points)
line_180 = Line(StartPoint=divide_curve_150.Points, EndPoint=divide_curve_148.Points)
evaluate_surface_91 = EvaluateSurface(Surface=loft_123, Point=surface_closest_point_91.UVPoint)  # -> Point, Normal, UDirection, VDirection, Frame
ellipse_15 = Ellipse(Plane=list_item_49, Radius1=addition_45, Radius2=line_165)  # -> Ellipse, Focus1, Focus2
ellipse_16 = Ellipse(Plane=list_item_50, Radius1=addition_46, Radius2=line_166)  # -> Ellipse, Focus1, Focus2
line_181 = Line(StartPoint=divide_curve_152.Points, EndPoint=divide_curve_151.Points)
line_182 = Line(StartPoint=divide_curve_151.Points, EndPoint=divide_curve_152.Points)
loft_124 = Loft(Curves=line_176, Options={Adjust=False, Closed=False, LoftEnds=0, LoftSimp=0, LoftType=0, Rebuild=10, Refit=0.01})
loft_125 = Loft(Curves=line_177, Options={Adjust=False, Closed=False, LoftEnds=0, LoftSimp=0, LoftType=0, Rebuild=10, Refit=0.01})
loft_126 = Loft(Curves=line_178, Options={Adjust=False, Closed=False, LoftEnds=0, LoftSimp=0, LoftType=0, Rebuild=10, Refit=0.01})
loft_127 = Loft(Curves=line_180, Options={Adjust=False, Closed=False, LoftEnds=0, LoftSimp=0, LoftType=0, Rebuild=10, Refit=0.01})
loft_128 = Loft(Curves=line_179, Options={Adjust=False, Closed=False, LoftEnds=0, LoftSimp=0, LoftType=0, Rebuild=10, Refit=0.01})
rotate_plane_92 = RotatePlane(Plane=evaluate_surface_91.Frame, Angle=radians_70)
sub_curve_15 = SubCurve(BaseCurve=reparameterize(ellipse_15.Ellipse), Domain="0.2592 to  0.7408")
sub_curve_16 = SubCurve(BaseCurve=reparameterize(ellipse_16.Ellipse), Domain="0.2592 to  0.7408")
loft_129 = Loft(Curves=line_181, Options={Adjust=False, Closed=False, LoftEnds=0, LoftSimp=0, LoftType=0, Rebuild=10, Refit=0.01})
loft_130 = Loft(Curves=line_182, Options={Adjust=False, Closed=False, LoftEnds=0, LoftSimp=0, LoftType=0, Rebuild=10, Refit=0.01})
surface_closest_point_92 = SurfaceClosestPoint(Point=divide_curve_145.Points, Surface=loft_124)  # -> Point, UVPoint, Distance
surface_closest_point_93 = SurfaceClosestPoint(Point=divide_curve_143.Points, Surface=loft_125)  # -> Point, UVPoint, Distance
surface_closest_point_94 = SurfaceClosestPoint(Point=divide_curve_144.Points, Surface=loft_126)  # -> Point, UVPoint, Distance
surface_closest_point_95 = SurfaceClosestPoint(Point=divide_curve_149.Points, Surface=loft_128)  # -> Point, UVPoint, Distance
surface_closest_point_96 = SurfaceClosestPoint(Point=divide_curve_150.Points, Surface=loft_127)  # -> Point, UVPoint, Distance
deconstruct_plane_17 = DeconstructPlane(Plane=rotate_plane_92)  # -> Origin, XAxis, YAxis, ZAxis
surface_closest_point_97 = SurfaceClosestPoint(Point=divide_curve_152.Points, Surface=loft_129)  # -> Point, UVPoint, Distance
surface_closest_point_98 = SurfaceClosestPoint(Point=divide_curve_151.Points, Surface=loft_130)  # -> Point, UVPoint, Distance
evaluate_surface_92 = EvaluateSurface(Surface=loft_124, Point=surface_closest_point_92.UVPoint)  # -> Point, Normal, UDirection, VDirection, Frame
evaluate_surface_93 = EvaluateSurface(Surface=loft_125, Point=surface_closest_point_93.UVPoint)  # -> Point, Normal, UDirection, VDirection, Frame
evaluate_surface_94 = EvaluateSurface(Surface=loft_126, Point=surface_closest_point_94.UVPoint)  # -> Point, Normal, UDirection, VDirection, Frame
evaluate_surface_95 = EvaluateSurface(Surface=loft_128, Point=surface_closest_point_95.UVPoint)  # -> Point, Normal, UDirection, VDirection, Frame
evaluate_surface_96 = EvaluateSurface(Surface=loft_127, Point=surface_closest_point_96.UVPoint)  # -> Point, Normal, UDirection, VDirection, Frame
rotate_3d_17 = Rotate3D(Geometry=rotate_plane_92, Angle=1.570796327, Center=deconstruct_plane_17.Origin, Axis=deconstruct_plane_17.YAxis)  # -> Geometry, Transform
evaluate_surface_97 = EvaluateSurface(Surface=loft_129, Point=surface_closest_point_97.UVPoint)  # -> Point, Normal, UDirection, VDirection, Frame
evaluate_surface_98 = EvaluateSurface(Surface=loft_130, Point=surface_closest_point_98.UVPoint)  # -> Point, Normal, UDirection, VDirection, Frame
rotate_plane_93 = RotatePlane(Plane=evaluate_surface_94.Frame, Angle=radians_87)
rotate_plane_94 = RotatePlane(Plane=evaluate_surface_95.Frame, Angle=radians_91)
rotate_plane_95 = RotatePlane(Plane=evaluate_surface_96.Frame, Angle=radians_93)
rotate_plane_96 = RotatePlane(Plane=evaluate_surface_92.Frame, Angle=radians_96)
rotate_plane_97 = RotatePlane(Plane=evaluate_surface_93.Frame, Angle=radians_97)
list_item_51 = ListItem(List=rotate_3d_17.Geometry, Index=1, Wrap=True)
rotate_plane_98 = RotatePlane(Plane=evaluate_surface_97.Frame, Angle=radians_107)
rotate_plane_99 = RotatePlane(Plane=evaluate_surface_98.Frame, Angle=radians_108)
ellipse_17 = Ellipse(Plane=list_item_51, Radius1=number_slider_57, Radius2=line_167)  # -> Ellipse, Focus1, Focus2
sub_curve_17 = SubCurve(BaseCurve=reparameterize(ellipse_17.Ellipse), Domain="0.2592 to  0.7408")
split_tree_33 = SplitTree(Data=sub_curve_15, Masks=flatten("{0;7;0}"))  # -> Positive, Negative
split_tree_34 = SplitTree(Data=sub_curve_15, Masks=flatten("{0;6;0}"))  # -> Positive, Negative
split_tree_35 = SplitTree(Data=sub_curve_16, Masks=flatten("{0;7;0}"))  # -> Positive, Negative
split_tree_36 = SplitTree(Data=sub_curve_16, Masks=flatten("{0;6;0}"))  # -> Positive, Negative
split_tree_37 = SplitTree(Data=sub_curve_15, Masks=flatten("{0;5;0}"))  # -> Positive, Negative
split_tree_38 = SplitTree(Data=sub_curve_15, Masks=flatten("{0;4;0}"))  # -> Positive, Negative
split_tree_39 = SplitTree(Data=sub_curve_16, Masks=flatten("{0;5;0}"))  # -> Positive, Negative
split_tree_40 = SplitTree(Data=sub_curve_15, Masks=flatten("{0;3;0}"))  # -> Positive, Negative
split_tree_41 = SplitTree(Data=sub_curve_16, Masks=flatten("{0;4;0}"))  # -> Positive, Negative
split_tree_42 = SplitTree(Data=sub_curve_16, Masks=flatten("{0;3;0}"))  # -> Positive, Negative
split_tree_43 = SplitTree(Data=sub_curve_15, Masks=flatten("{0;2;0}"))  # -> Positive, Negative
split_tree_44 = SplitTree(Data=sub_curve_16, Masks=flatten("{0;2;0}"))  # -> Positive, Negative
split_tree_45 = SplitTree(Data=sub_curve_15, Masks=flatten("{0;0;0}"))  # -> Positive, Negative
split_tree_46 = SplitTree(Data=sub_curve_15, Masks=flatten("{0;1;0}"))  # -> Positive, Negative
split_tree_47 = SplitTree(Data=sub_curve_16, Masks=flatten("{0;0;0}"))  # -> Positive, Negative
split_tree_48 = SplitTree(Data=sub_curve_16, Masks=flatten("{0;1;0}"))  # -> Positive, Negative
list_item_52 = ListItem(List=rotate_plane_93, Index=1, Wrap=True)
list_item_53 = ListItem(List=rotate_plane_94, Index=1, Wrap=True)
list_item_54 = ListItem(List=rotate_plane_95, Index=1, Wrap=True)
center_box_40 = CenterBox(Base=list_item_52, X=division_210, Y=division_211, Z=division_209)
center_box_41 = CenterBox(Base=[rotate_plane_96, rotate_plane_97], X=division_213, Y=division_214, Z=division_212)
length_186 = Length(Curve=sub_curve_17)
center_box_42 = CenterBox(Base=[list_item_43, list_item_44], X=division_227, Y=division_228, Z=division_222)
radians_114 = Radians(Degrees=Slider(90, range=0..100))
center_box_43 = CenterBox(Base=[list_item_53, list_item_54], X=division_230, Y=division_231, Z=division_229)
unit_z_77 = UnitZ(Factor=Slider(170, range=0..1000))
unit_z_78 = UnitZ(Factor=Slider(170, range=0..1000))
unit_z_79 = UnitZ(Factor=Slider(85, range=0..1000))
unit_z_80 = UnitZ(Factor=Slider(170, range=0..1000))
unit_z_81 = UnitZ(Factor=Slider(85, range=0..1000))
linear_array_26 = LinearArray(Geometry=[center_box_27, center_box_26], Direction=unit_z_63, Count=Slider(1, range=0..10))  # -> Geometry, Transform
unit_z_82 = UnitZ(Factor=Slider(170, range=0..1000))
unit_z_83 = UnitZ(Factor=Slider(425, range=0..1000))
center_box_44 = CenterBox(Base=[rotate_plane_98, rotate_plane_99], X=division_236, Y=division_237, Z=division_235)
linear_array_27 = LinearArray(Geometry=center_box_25, Direction=unit_z_65, Count=number_slider_59)  # -> Geometry, Transform
linear_array_28 = LinearArray(Geometry=center_box_28, Direction=unit_z_67, Count=number_slider_60)  # -> Geometry, Transform
linear_array_29 = LinearArray(Geometry=center_box_29, Direction=unit_z_68, Count=number_slider_66)  # -> Geometry, Transform
linear_array_30 = LinearArray(Geometry=center_box_37, Direction=unit_z_70, Count=Slider(1, range=0..10))  # -> Geometry, Transform
move_44 = Move(Geometry=linear_array_30.Geometry, Motion=unit_z_64)  # -> Geometry, Transform
flatten_tree_57 = FlattenTree(Tree=split_tree_35.Positive, Path="{0}")
flatten_tree_58 = FlattenTree(Tree=split_tree_33.Positive, Path="{0}")
center_box_45 = CenterBox(Base=[list_item_45, list_item_46], X=division_243, Y=division_244, Z=division_238)
flatten_tree_59 = FlattenTree(Tree=split_tree_36.Positive, Path="{0}")
flatten_tree_60 = FlattenTree(Tree=split_tree_34.Positive, Path="{0}")
center_box_46 = CenterBox(Base=[list_item_47, list_item_48], X=division_250, Y=division_251, Z=division_245)
number_slider_73 = Slider(9, range=0..10)
number_slider_74 = Slider(9, range=0..10)
addition_76 = Addition(A=number_slider_74, B=number_slider_73)
multiplication_19 = Multiplication(A=addition_76, B=addition_65)
addition_77 = Addition(A=Slider(207.5, range=0..1000), B=multiplication_19)
addition_78 = Addition(A=Slider(595, range=0..1000), B=addition_77)
subtraction_64 = Subtraction(A=addition_78, B=Slider(85, range=0..100))
unit_z_84 = UnitZ(Factor=addition_77)
unit_z_85 = UnitZ(Factor=subtraction_64)
unit_z_86 = UnitZ(Factor=addition_78)
move1_18 = Move(Geometry=curve_18, Motion=unit_z_84)  # -> Geometry, Transform
move_45 = Move(Geometry=curve_18, Motion=unit_z_86)  # -> Geometry, Transform
move_46 = Move(Geometry=curve_18, Motion=unit_z_85)  # -> Geometry, Transform
addition_79 = Addition(A=number_slider_73, B=number_slider_74)
multiplication_20 = Multiplication(A=addition_79, B=addition_66)
length_187 = Length(Curve=move1_18.Geometry)
length_188 = Length(Curve=move1_18.Geometry)
length_189 = Length(Curve=move_45.Geometry)
length_190 = Length(Curve=move_45.Geometry)
length_191 = Length(Curve=move_46.Geometry)
unit_z_87 = UnitZ(Factor=multiplication_20)
move_47 = Move(Geometry=evaluate_curve_55.Point, Motion=unit_z_87)  # -> Geometry, Transform
move_48 = Move(Geometry=evaluate_curve_56.Point, Motion=unit_z_87)  # -> Geometry, Transform
subtraction_65 = Subtraction(A=length_187, B=Slider(750, range=0..1500))
subtraction_66 = Subtraction(A=length_188, B=Slider(300, range=0..1500))
subtraction_67 = Subtraction(A=length_189, B=number_slider_42)
subtraction_68 = Subtraction(A=length_190, B=addition_36)
subtraction_69 = Subtraction(A=length_191, B=Slider(375, range=0..1500))
move_49 = Move(Geometry=evaluate_curve_62.Point, Motion=unit_z_87)  # -> Geometry, Transform
move_50 = Move(Geometry=curve_middle_8, Motion=unit_z_87)  # -> Geometry, Transform
line_183 = Line(StartPoint=move_47.Geometry, EndPoint=move_50.Geometry)
line_184 = Line(StartPoint=move_48.Geometry, EndPoint=move_50.Geometry)
offset_curve_153 = OffsetCurve(Curve=line_183, Distance=Slider(0, range=0..145), Plane=PlaneXY(0, 0, 0), Corners=1)
offset_curve_154 = OffsetCurve(Curve=line_183, Distance=Slider(145, range=0..1000), Plane=PlaneXY(0, 0, 0), Corners=1)
offset_curve_155 = OffsetCurve(Curve=line_184, Distance=Slider(-145, range=-150..0), Plane=PlaneXY(0, 0, 0), Corners=1)
offset_curve_156 = OffsetCurve(Curve=line_184, Distance=Slider(145, range=0..1000), Plane=PlaneXY(0, 0, 0), Corners=1)
divide_curve_153 = DivideCurve(Curve=offset_curve_153, Count=number_slider_43, Kinks=False)  # -> Points, Tangents, Parameters
divide_curve_154 = DivideCurve(Curve=offset_curve_154, Count=number_slider_43, Kinks=False)  # -> Points, Tangents, Parameters
divide_curve_155 = DivideCurve(Curve=offset_curve_155, Count=number_slider_44, Kinks=False)  # -> Points, Tangents, Parameters
divide_curve_156 = DivideCurve(Curve=offset_curve_156, Count=number_slider_44, Kinks=False)  # -> Points, Tangents, Parameters
evaluate_curve_102 = EvaluateCurve(Curve=move1_18.Geometry, Parameter=subtraction_65)  # -> Point, Tangent, Angle
evaluate_curve_103 = EvaluateCurve(Curve=move1_18.Geometry, Parameter=subtraction_66)  # -> Point, Tangent, Angle
evaluate_curve_104 = EvaluateCurve(Curve=move_45.Geometry, Parameter=subtraction_67)  # -> Point, Tangent, Angle
evaluate_curve_105 = EvaluateCurve(Curve=move_45.Geometry, Parameter=subtraction_68)  # -> Point, Tangent, Angle
evaluate_curve_106 = EvaluateCurve(Curve=move_45.Geometry, Parameter=Slider(300, range=0..1500))  # -> Point, Tangent, Angle
end_points_46 = EndPoints(Curve=move1_18.Geometry)  # -> Start, End
end_points_47 = EndPoints(Curve=move1_18.Geometry)  # -> Start, End
end_points_48 = EndPoints(Curve=move_45.Geometry)  # -> Start, End
evaluate_curve_107 = EvaluateCurve(Curve=move_46.Geometry, Parameter=subtraction_69)  # -> Point, Tangent, Angle
evaluate_curve_108 = EvaluateCurve(Curve=move_46.Geometry, Parameter=Slider(375, range=0..1500))  # -> Point, Tangent, Angle
line_185 = Line(StartPoint=move_49.Geometry, EndPoint=move_50.Geometry)
line_186 = Line(StartPoint=divide_curve_154.Points, EndPoint=divide_curve_153.Points)
line_187 = Line(StartPoint=divide_curve_156.Points, EndPoint=divide_curve_155.Points)
line_188 = Line(StartPoint=end_points_46.Start, EndPoint=evaluate_curve_102.Point)
line_189 = Line(StartPoint=end_points_47.End, EndPoint=evaluate_curve_103.Point)
line_190 = Line(StartPoint=end_points_48.End, EndPoint=evaluate_curve_104.Point)
line_191 = Line(StartPoint=evaluate_curve_106.Point, EndPoint=evaluate_curve_105.Point)
loft_131 = Loft(Curves=line_186, Options={Adjust=False, Closed=False, LoftEnds=0, LoftSimp=0, LoftType=0, Rebuild=10, Refit=0.01})
loft_132 = Loft(Curves=line_187, Options={Adjust=False, Closed=False, LoftEnds=0, LoftSimp=0, LoftType=0, Rebuild=10, Refit=0.01})
line_192 = Line(StartPoint=evaluate_curve_108.Point, EndPoint=evaluate_curve_107.Point)
offset_curve_157 = OffsetCurve(Curve=line_185, Distance=Slider(0, range=0..100), Plane=PlaneXY(0, 0, 0), Corners=1)
offset_curve_158 = OffsetCurve(Curve=line_185, Distance=Slider(75, range=0..100), Plane=PlaneXY(0, 0, 0), Corners=1)
surface_closest_point_99 = SurfaceClosestPoint(Point=divide_curve_154.Points, Surface=loft_131)  # -> Point, UVPoint, Distance
surface_closest_point_100 = SurfaceClosestPoint(Point=divide_curve_155.Points, Surface=loft_132)  # -> Point, UVPoint, Distance
offset_curve_159 = OffsetCurve(Curve=line_188, Distance=Slider(75, range=0..100), Plane=PlaneXY(0, 0, 0), Corners=1)
offset_curve_160 = OffsetCurve(Curve=line_189, Distance=Slider(75, range=0..100), Plane=PlaneXY(0, 0, 0), Corners=1)
offset_curve_161 = OffsetCurve(Curve=line_188, Distance=Slider(0, range=-75..0), Plane=PlaneXY(0, 0, 0), Corners=1)
offset_curve_162 = OffsetCurve(Curve=line_189, Distance=Slider(0, range=-75..0), Plane=PlaneXY(0, 0, 0), Corners=1)
offset_curve_163 = OffsetCurve(Curve=line_191, Distance=Slider(-75, range=-75..0), Plane=PlaneXY(0, 0, 0), Corners=1)
offset_curve_164 = OffsetCurve(Curve=line_191, Distance=Slider(75, range=0..100), Plane=PlaneXY(0, 0, 0), Corners=1)
offset_curve_165 = OffsetCurve(Curve=line_190, Distance=Slider(75, range=0..100), Plane=PlaneXY(0, 0, 0), Corners=1)
offset_curve_166 = OffsetCurve(Curve=line_190, Distance=Slider(0, range=-75..0), Plane=PlaneXY(0, 0, 0), Corners=1)
offset_curve_167 = OffsetCurve(Curve=line_192, Distance=Slider(-75, range=-75..0), Plane=PlaneXY(0, 0, 0), Corners=1)
evaluate_surface_99 = EvaluateSurface(Surface=loft_131, Point=surface_closest_point_99.UVPoint)  # -> Point, Normal, UDirection, VDirection, Frame
offset_curve_168 = OffsetCurve(Curve=line_192, Distance=Slider(75, range=0..100), Plane=PlaneXY(0, 0, 0), Corners=1)
evaluate_surface_100 = EvaluateSurface(Surface=loft_132, Point=surface_closest_point_100.UVPoint)  # -> Point, Normal, UDirection, VDirection, Frame
divide_curve_157 = DivideCurve(Curve=offset_curve_157, Count=number_slider_48, Kinks=False)  # -> Points, Tangents, Parameters
divide_curve_158 = DivideCurve(Curve=offset_curve_158, Count=number_slider_48, Kinks=False)  # -> Points, Tangents, Parameters
rotate_plane_100 = RotatePlane(Plane=evaluate_surface_99.Frame, Angle=radians_55)
rotate_plane_101 = RotatePlane(Plane=evaluate_surface_100.Frame, Angle=radians_56)
length_192 = Length(Curve=offset_curve_159)
length_193 = Length(Curve=offset_curve_161)
length_194 = Length(Curve=offset_curve_160)
length_195 = Length(Curve=offset_curve_162)
length_196 = Length(Curve=offset_curve_163)
length_197 = Length(Curve=offset_curve_166)
length_198 = Length(Curve=offset_curve_164)
length_199 = Length(Curve=offset_curve_167)
length_200 = Length(Curve=offset_curve_165)
length_201 = Length(Curve=offset_curve_168)
line_193 = Line(StartPoint=divide_curve_158.Points, EndPoint=divide_curve_157.Points)
deconstruct_plane_18 = DeconstructPlane(Plane=rotate_plane_100)  # -> Origin, XAxis, YAxis, ZAxis
deconstruct_plane_19 = DeconstructPlane(Plane=rotate_plane_101)  # -> Origin, XAxis, YAxis, ZAxis
division_277 = Division(A=length_196, B=Slider(300, range=0..1000))
division_278 = Division(A=length_198, B=Slider(300, range=0..1000))
division_279 = Division(A=length_192, B=Slider(300, range=0..1000))
division_280 = Division(A=length_193, B=Slider(300, range=0..1000))
division_281 = Division(A=length_197, B=Slider(300, range=0..1000))
division_282 = Division(A=length_194, B=Slider(300, range=0..1000))
division_283 = Division(A=length_195, B=Slider(300, range=0..1000))
division_284 = Division(A=length_200, B=Slider(300, range=0..1000))
division_285 = Division(A=length_199, B=Slider(300, range=0..1000))
division_286 = Division(A=length_201, B=Slider(300, range=0..1000))
rotate_3d_18 = Rotate3D(Geometry=rotate_plane_100, Angle=1.570796327, Center=deconstruct_plane_18.Origin, Axis=deconstruct_plane_18.YAxis)  # -> Geometry, Transform
rotate_3d_19 = Rotate3D(Geometry=rotate_plane_101, Angle=1.570796327, Center=deconstruct_plane_19.Origin, Axis=deconstruct_plane_19.YAxis)  # -> Geometry, Transform
divide_curve_159 = DivideCurve(Curve=offset_curve_163, Count=division_277, Kinks=False)  # -> Points, Tangents, Parameters
loft_133 = Loft(Curves=line_193, Options={Adjust=False, Closed=False, LoftEnds=0, LoftSimp=0, LoftType=0, Rebuild=10, Refit=0.01})
divide_curve_160 = DivideCurve(Curve=offset_curve_166, Count=division_281, Kinks=False)  # -> Points, Tangents, Parameters
divide_curve_161 = DivideCurve(Curve=offset_curve_164, Count=division_278, Kinks=False)  # -> Points, Tangents, Parameters
divide_curve_162 = DivideCurve(Curve=offset_curve_159, Count=division_279, Kinks=False)  # -> Points, Tangents, Parameters
divide_curve_163 = DivideCurve(Curve=offset_curve_160, Count=division_282, Kinks=False)  # -> Points, Tangents, Parameters
divide_curve_164 = DivideCurve(Curve=offset_curve_165, Count=division_284, Kinks=False)  # -> Points, Tangents, Parameters
divide_curve_165 = DivideCurve(Curve=offset_curve_161, Count=division_280, Kinks=False)  # -> Points, Tangents, Parameters
divide_curve_166 = DivideCurve(Curve=offset_curve_162, Count=division_283, Kinks=False)  # -> Points, Tangents, Parameters
divide_curve_167 = DivideCurve(Curve=offset_curve_167, Count=division_285, Kinks=False)  # -> Points, Tangents, Parameters
divide_curve_168 = DivideCurve(Curve=offset_curve_168, Count=division_286, Kinks=False)  # -> Points, Tangents, Parameters
surface_closest_point_101 = SurfaceClosestPoint(Point=divide_curve_157.Points, Surface=loft_133)  # -> Point, UVPoint, Distance
list_item_55 = ListItem(List=rotate_3d_18.Geometry, Index=1, Wrap=True)
list_item_56 = ListItem(List=rotate_3d_19.Geometry, Index=1, Wrap=True)
line_194 = Line(StartPoint=divide_curve_165.Points, EndPoint=divide_curve_162.Points)
line_195 = Line(StartPoint=divide_curve_166.Points, EndPoint=divide_curve_163.Points)
line_196 = Line(StartPoint=divide_curve_161.Points, EndPoint=divide_curve_159.Points)
line_197 = Line(StartPoint=divide_curve_159.Points, EndPoint=divide_curve_161.Points)
line_198 = Line(StartPoint=divide_curve_160.Points, EndPoint=divide_curve_164.Points)
line_199 = Line(StartPoint=divide_curve_168.Points, EndPoint=divide_curve_167.Points)
evaluate_surface_101 = EvaluateSurface(Surface=loft_133, Point=surface_closest_point_101.UVPoint)  # -> Point, Normal, UDirection, VDirection, Frame
line_200 = Line(StartPoint=divide_curve_167.Points, EndPoint=divide_curve_168.Points)
ellipse_18 = Ellipse(Plane=list_item_55, Radius1=addition_48, Radius2=line_183)  # -> Ellipse, Focus1, Focus2
ellipse_19 = Ellipse(Plane=list_item_56, Radius1=addition_49, Radius2=line_184)  # -> Ellipse, Focus1, Focus2
loft_134 = Loft(Curves=line_195, Options={Adjust=False, Closed=False, LoftEnds=0, LoftSimp=0, LoftType=0, Rebuild=10, Refit=0.01})
loft_135 = Loft(Curves=line_194, Options={Adjust=False, Closed=False, LoftEnds=0, LoftSimp=0, LoftType=0, Rebuild=10, Refit=0.01})
loft_136 = Loft(Curves=line_196, Options={Adjust=False, Closed=False, LoftEnds=0, LoftSimp=0, LoftType=0, Rebuild=10, Refit=0.01})
loft_137 = Loft(Curves=line_197, Options={Adjust=False, Closed=False, LoftEnds=0, LoftSimp=0, LoftType=0, Rebuild=10, Refit=0.01})
loft_138 = Loft(Curves=line_198, Options={Adjust=False, Closed=False, LoftEnds=0, LoftSimp=0, LoftType=0, Rebuild=10, Refit=0.01})
loft_139 = Loft(Curves=line_199, Options={Adjust=False, Closed=False, LoftEnds=0, LoftSimp=0, LoftType=0, Rebuild=10, Refit=0.01})
loft_140 = Loft(Curves=line_200, Options={Adjust=False, Closed=False, LoftEnds=0, LoftSimp=0, LoftType=0, Rebuild=10, Refit=0.01})
rotate_plane_102 = RotatePlane(Plane=evaluate_surface_101.Frame, Angle=radians_84)
sub_curve_18 = SubCurve(BaseCurve=reparameterize(ellipse_18.Ellipse), Domain="0.2592 to  0.7408")
sub_curve_19 = SubCurve(BaseCurve=reparameterize(ellipse_19.Ellipse), Domain="0.2592 to  0.7408")
surface_closest_point_102 = SurfaceClosestPoint(Point=divide_curve_165.Points, Surface=loft_135)  # -> Point, UVPoint, Distance
surface_closest_point_103 = SurfaceClosestPoint(Point=divide_curve_166.Points, Surface=loft_134)  # -> Point, UVPoint, Distance
surface_closest_point_104 = SurfaceClosestPoint(Point=divide_curve_161.Points, Surface=loft_136)  # -> Point, UVPoint, Distance
surface_closest_point_105 = SurfaceClosestPoint(Point=divide_curve_159.Points, Surface=loft_137)  # -> Point, UVPoint, Distance
surface_closest_point_106 = SurfaceClosestPoint(Point=divide_curve_160.Points, Surface=loft_138)  # -> Point, UVPoint, Distance
surface_closest_point_107 = SurfaceClosestPoint(Point=divide_curve_168.Points, Surface=loft_139)  # -> Point, UVPoint, Distance
surface_closest_point_108 = SurfaceClosestPoint(Point=divide_curve_167.Points, Surface=loft_140)  # -> Point, UVPoint, Distance
deconstruct_plane_20 = DeconstructPlane(Plane=rotate_plane_102)  # -> Origin, XAxis, YAxis, ZAxis
evaluate_surface_102 = EvaluateSurface(Surface=loft_135, Point=surface_closest_point_102.UVPoint)  # -> Point, Normal, UDirection, VDirection, Frame
evaluate_surface_103 = EvaluateSurface(Surface=loft_134, Point=surface_closest_point_103.UVPoint)  # -> Point, Normal, UDirection, VDirection, Frame
evaluate_surface_104 = EvaluateSurface(Surface=loft_136, Point=surface_closest_point_104.UVPoint)  # -> Point, Normal, UDirection, VDirection, Frame
evaluate_surface_105 = EvaluateSurface(Surface=loft_137, Point=surface_closest_point_105.UVPoint)  # -> Point, Normal, UDirection, VDirection, Frame
evaluate_surface_106 = EvaluateSurface(Surface=loft_138, Point=surface_closest_point_106.UVPoint)  # -> Point, Normal, UDirection, VDirection, Frame
rotate_3d_20 = Rotate3D(Geometry=rotate_plane_102, Angle=1.570796327, Center=deconstruct_plane_20.Origin, Axis=deconstruct_plane_20.YAxis)  # -> Geometry, Transform
evaluate_surface_107 = EvaluateSurface(Surface=loft_139, Point=surface_closest_point_107.UVPoint)  # -> Point, Normal, UDirection, VDirection, Frame
evaluate_surface_108 = EvaluateSurface(Surface=loft_140, Point=surface_closest_point_108.UVPoint)  # -> Point, Normal, UDirection, VDirection, Frame
rotate_plane_103 = RotatePlane(Plane=evaluate_surface_102.Frame, Angle=radians_101)
rotate_plane_104 = RotatePlane(Plane=evaluate_surface_103.Frame, Angle=radians_103)
rotate_plane_105 = RotatePlane(Plane=evaluate_surface_106.Frame, Angle=radians_105)
rotate_plane_106 = RotatePlane(Plane=evaluate_surface_104.Frame, Angle=radians_109)
rotate_plane_107 = RotatePlane(Plane=evaluate_surface_105.Frame, Angle=radians_110)
list_item_57 = ListItem(List=rotate_3d_20.Geometry, Index=1, Wrap=True)
rotate_plane_108 = RotatePlane(Plane=evaluate_surface_107.Frame, Angle=radians_111)
rotate_plane_109 = RotatePlane(Plane=evaluate_surface_108.Frame, Angle=radians_112)
ellipse_20 = Ellipse(Plane=list_item_57, Radius1=number_slider_58, Radius2=line_185)  # -> Ellipse, Focus1, Focus2
sub_curve_20 = SubCurve(BaseCurve=reparameterize(ellipse_20.Ellipse), Domain="0.2592 to  0.7408")
split_tree_49 = SplitTree(Data=sub_curve_18, Masks=flatten("{0;7;0}"))  # -> Positive, Negative
split_tree_50 = SplitTree(Data=sub_curve_18, Masks=flatten("{0;6;0}"))  # -> Positive, Negative
split_tree_51 = SplitTree(Data=sub_curve_19, Masks=flatten("{0;7;0}"))  # -> Positive, Negative
split_tree_52 = SplitTree(Data=sub_curve_19, Masks=flatten("{0;6;0}"))  # -> Positive, Negative
split_tree_53 = SplitTree(Data=sub_curve_18, Masks=flatten("{0;5;0}"))  # -> Positive, Negative
split_tree_54 = SplitTree(Data=sub_curve_18, Masks=flatten("{0;4;0}"))  # -> Positive, Negative
split_tree_55 = SplitTree(Data=sub_curve_19, Masks=flatten("{0;5;0}"))  # -> Positive, Negative
split_tree_56 = SplitTree(Data=sub_curve_18, Masks=flatten("{0;3;0}"))  # -> Positive, Negative
split_tree_57 = SplitTree(Data=sub_curve_19, Masks=flatten("{0;4;0}"))  # -> Positive, Negative
split_tree_58 = SplitTree(Data=sub_curve_19, Masks=flatten("{0;3;0}"))  # -> Positive, Negative
split_tree_59 = SplitTree(Data=sub_curve_18, Masks=flatten("{0;2;0}"))  # -> Positive, Negative
split_tree_60 = SplitTree(Data=sub_curve_19, Masks=flatten("{0;2;0}"))  # -> Positive, Negative
split_tree_61 = SplitTree(Data=sub_curve_18, Masks=flatten("{0;0;0}"))  # -> Positive, Negative
split_tree_62 = SplitTree(Data=sub_curve_18, Masks=flatten("{0;1;0}"))  # -> Positive, Negative
split_tree_63 = SplitTree(Data=sub_curve_19, Masks=flatten("{0;0;0}"))  # -> Positive, Negative
split_tree_64 = SplitTree(Data=sub_curve_19, Masks=flatten("{0;1;0}"))  # -> Positive, Negative
list_item_58 = ListItem(List=rotate_plane_103, Index=1, Wrap=True)
list_item_59 = ListItem(List=rotate_plane_104, Index=1, Wrap=True)
list_item_60 = ListItem(List=rotate_plane_105, Index=1, Wrap=True)
center_box_47 = CenterBox(Base=[list_item_58, list_item_59], X=division_253, Y=division_254, Z=division_252)
flatten_tree_61 = FlattenTree(Tree=split_tree_39.Positive, Path="{0}")
flatten_tree_62 = FlattenTree(Tree=split_tree_37.Positive, Path="{0}")
center_box_48 = CenterBox(Base=[rotate_plane_108, rotate_plane_109], X=division_262, Y=division_263, Z=division_259)
length_202 = Length(Curve=sub_curve_20)
rotate_plane_110 = RotatePlane(Plane=perp_frames_2.Frames, Angle=radians_114)
flatten_tree_63 = FlattenTree(Tree=split_tree_41.Positive, Path="{0}")
flatten_tree_64 = FlattenTree(Tree=split_tree_38.Positive, Path="{0}")
flatten_tree_65 = FlattenTree(Tree=split_tree_42.Positive, Path="{0}")
flatten_tree_66 = FlattenTree(Tree=split_tree_40.Positive, Path="{0}")
center_box_49 = CenterBox(Base=list_item_60, X=division_256, Y=division_257, Z=division_255)
center_box_50 = CenterBox(Base=[rotate_plane_106, rotate_plane_107], X=division_265, Y=division_266, Z=division_264)
flatten_tree_67 = FlattenTree(Tree=split_tree_44.Positive, Path="{0}")
flatten_tree_68 = FlattenTree(Tree=split_tree_43.Positive, Path="{0}")
flatten_tree_69 = FlattenTree(Tree=split_tree_47.Positive, Path="{0}")
flatten_tree_70 = FlattenTree(Tree=split_tree_48.Positive, Path="{0}")
flatten_tree_71 = FlattenTree(Tree=split_tree_46.Positive, Path="{0}")
flatten_tree_72 = FlattenTree(Tree=split_tree_45.Positive, Path="{0}")
division_287 = Division(A=length_186, B=Slider(72, range=0..100))
number_slider_75 = Slider(4, range=0..10)
multiplication_21 = Multiplication(A=number_slider_75, B=number_slider_63)
multiplication_22 = Multiplication(A=Slider(10, range=0..100), B=number_slider_75)
addition_80 = Addition(A=multiplication_21, B=multiplication_22)
addition_81 = Addition(A=addition_72, B=addition_80)
unit_z_88 = UnitZ(Factor=addition_81)
move1_19 = Move(Geometry=curve_19, Motion=unit_z_88)  # -> Geometry, Transform
length_203 = Length(Curve=move1_19.Geometry)
length_204 = Length(Curve=move1_19.Geometry)
subtraction_70 = Subtraction(A=length_203, B=Slider(1125, range=0..1500))
subtraction_71 = Subtraction(A=length_204, B=Slider(375, range=0..1500))
evaluate_curve_109 = EvaluateCurve(Curve=move1_19.Geometry, Parameter=subtraction_70)  # -> Point, Tangent, Angle
evaluate_curve_110 = EvaluateCurve(Curve=move1_19.Geometry, Parameter=subtraction_71)  # -> Point, Tangent, Angle
end_points_49 = EndPoints(Curve=move1_19.Geometry)  # -> Start, End
end_points_50 = EndPoints(Curve=move1_19.Geometry)  # -> Start, End
line_201 = Line(StartPoint=end_points_49.Start, EndPoint=evaluate_curve_109.Point)
line_202 = Line(StartPoint=end_points_50.End, EndPoint=evaluate_curve_110.Point)
offset_curve_169 = OffsetCurve(Curve=line_201, Distance=Slider(75, range=0..100), Plane=PlaneXY(0, 0, 0), Corners=1)
offset_curve_170 = OffsetCurve(Curve=line_202, Distance=Slider(75, range=0..100), Plane=PlaneXY(0, 0, 0), Corners=1)
offset_curve_171 = OffsetCurve(Curve=line_201, Distance=Slider(0, range=-75..0), Plane=PlaneXY(0, 0, 0), Corners=1)
offset_curve_172 = OffsetCurve(Curve=line_202, Distance=Slider(0, range=-75..0), Plane=PlaneXY(0, 0, 0), Corners=1)
length_205 = Length(Curve=offset_curve_169)
length_206 = Length(Curve=offset_curve_171)
length_207 = Length(Curve=offset_curve_170)
length_208 = Length(Curve=offset_curve_172)
division_288 = Division(A=length_205, B=Slider(300, range=0..1000))
division_289 = Division(A=length_206, B=Slider(300, range=0..1000))
division_290 = Division(A=length_207, B=Slider(300, range=0..1000))
division_291 = Division(A=length_208, B=Slider(300, range=0..1000))
divide_curve_169 = DivideCurve(Curve=offset_curve_169, Count=division_288, Kinks=False)  # -> Points, Tangents, Parameters
divide_curve_170 = DivideCurve(Curve=offset_curve_170, Count=division_290, Kinks=False)  # -> Points, Tangents, Parameters
divide_curve_171 = DivideCurve(Curve=offset_curve_171, Count=division_289, Kinks=False)  # -> Points, Tangents, Parameters
divide_curve_172 = DivideCurve(Curve=offset_curve_172, Count=division_291, Kinks=False)  # -> Points, Tangents, Parameters
line_203 = Line(StartPoint=divide_curve_171.Points, EndPoint=divide_curve_169.Points)
line_204 = Line(StartPoint=divide_curve_172.Points, EndPoint=divide_curve_170.Points)
loft_141 = Loft(Curves=line_204, Options={Adjust=False, Closed=False, LoftEnds=0, LoftSimp=0, LoftType=0, Rebuild=10, Refit=0.01})
loft_142 = Loft(Curves=line_203, Options={Adjust=False, Closed=False, LoftEnds=0, LoftSimp=0, LoftType=0, Rebuild=10, Refit=0.01})
surface_closest_point_109 = SurfaceClosestPoint(Point=divide_curve_171.Points, Surface=loft_142)  # -> Point, UVPoint, Distance
surface_closest_point_110 = SurfaceClosestPoint(Point=divide_curve_172.Points, Surface=loft_141)  # -> Point, UVPoint, Distance
evaluate_surface_109 = EvaluateSurface(Surface=loft_142, Point=surface_closest_point_109.UVPoint)  # -> Point, Normal, UDirection, VDirection, Frame
evaluate_surface_110 = EvaluateSurface(Surface=loft_141, Point=surface_closest_point_110.UVPoint)  # -> Point, Normal, UDirection, VDirection, Frame
rotate_plane_111 = RotatePlane(Plane=evaluate_surface_109.Frame, Angle=radians_94)
rotate_plane_112 = RotatePlane(Plane=evaluate_surface_110.Frame, Angle=radians_95)
list_item_61 = ListItem(List=rotate_plane_111, Index=1, Wrap=True)
list_item_62 = ListItem(List=rotate_plane_112, Index=1, Wrap=True)
center_box_51 = CenterBox(Base=[list_item_61, list_item_62], X=division_233, Y=division_234, Z=division_232)
linear_array_31 = LinearArray(Geometry=center_box_30, Direction=unit_z_71, Count=Slider(1, range=0..10))  # -> Geometry, Transform
deconstruct_plane_21 = DeconstructPlane(Plane=rotate_plane_89)  # -> Origin, XAxis, YAxis, ZAxis
move_51 = Move(Geometry=linear_array_25.Geometry, Motion=unit_z_83)  # -> Geometry, Transform
linear_array_32 = LinearArray(Geometry=center_box_31, Direction=unit_z_77, Count=number_slider_64)  # -> Geometry, Transform
linear_array_33 = LinearArray(Geometry=center_box_32, Direction=unit_z_78, Count=number_slider_65)  # -> Geometry, Transform
linear_array_34 = LinearArray(Geometry=center_box_33, Direction=unit_z_79, Count=number_slider_70)  # -> Geometry, Transform
linear_array_35 = LinearArray(Geometry=center_box_34, Direction=unit_z_72, Count=Slider(1, range=0..10))  # -> Geometry, Transform
linear_array_36 = LinearArray(Geometry=center_box_38, Direction=unit_z_81, Count=Slider(1, range=0..10))  # -> Geometry, Transform
move_52 = Move(Geometry=linear_array_36.Geometry, Motion=unit_z_82)  # -> Geometry, Transform
perp_frames_3 = PerpFrames(Curve=sub_curve_17, Count=division_287, Align=True)  # -> Frames, Parameters
flatten_tree_73 = FlattenTree(Tree=split_tree_51.Positive, Path="{0}")
flatten_tree_74 = FlattenTree(Tree=split_tree_49.Positive, Path="{0}")
flatten_tree_75 = FlattenTree(Tree=split_tree_52.Positive, Path="{0}")
flatten_tree_76 = FlattenTree(Tree=split_tree_50.Positive, Path="{0}")
flatten_tree_77 = FlattenTree(Tree=split_tree_55.Positive, Path="{0}")
flatten_tree_78 = FlattenTree(Tree=split_tree_53.Positive, Path="{0}")
flatten_tree_79 = FlattenTree(Tree=split_tree_57.Positive, Path="{0}")
flatten_tree_80 = FlattenTree(Tree=split_tree_54.Positive, Path="{0}")
flatten_tree_81 = FlattenTree(Tree=split_tree_58.Positive, Path="{0}")
flatten_tree_82 = FlattenTree(Tree=split_tree_56.Positive, Path="{0}")
number_slider_76 = Slider(4, range=0..10)
multiplication_23 = Multiplication(A=number_slider_76, B=number_slider_69)
multiplication_24 = Multiplication(A=Slider(10, range=0..100), B=number_slider_76)
addition_82 = Addition(A=multiplication_23, B=multiplication_24)
addition_83 = Addition(A=addition_77, B=addition_82)
unit_z_89 = UnitZ(Factor=addition_83)
move1_20 = Move(Geometry=curve_18, Motion=unit_z_89)  # -> Geometry, Transform
length_209 = Length(Curve=move1_20.Geometry)
length_210 = Length(Curve=move1_20.Geometry)
subtraction_72 = Subtraction(A=length_209, B=Slider(975, range=0..1500))
subtraction_73 = Subtraction(A=length_210, B=Slider(375, range=0..1500))
evaluate_curve_111 = EvaluateCurve(Curve=move1_20.Geometry, Parameter=subtraction_72)  # -> Point, Tangent, Angle
evaluate_curve_112 = EvaluateCurve(Curve=move1_20.Geometry, Parameter=subtraction_73)  # -> Point, Tangent, Angle
end_points_51 = EndPoints(Curve=move1_20.Geometry)  # -> Start, End
end_points_52 = EndPoints(Curve=move1_20.Geometry)  # -> Start, End
line_205 = Line(StartPoint=end_points_51.Start, EndPoint=evaluate_curve_111.Point)
line_206 = Line(StartPoint=end_points_52.End, EndPoint=evaluate_curve_112.Point)
offset_curve_173 = OffsetCurve(Curve=line_205, Distance=Slider(75, range=0..100), Plane=PlaneXY(0, 0, 0), Corners=1)
offset_curve_174 = OffsetCurve(Curve=line_206, Distance=Slider(75, range=0..100), Plane=PlaneXY(0, 0, 0), Corners=1)
offset_curve_175 = OffsetCurve(Curve=line_205, Distance=Slider(0, range=-75..0), Plane=PlaneXY(0, 0, 0), Corners=1)
offset_curve_176 = OffsetCurve(Curve=line_206, Distance=Slider(0, range=-75..0), Plane=PlaneXY(0, 0, 0), Corners=1)
length_211 = Length(Curve=offset_curve_173)
length_212 = Length(Curve=offset_curve_175)
length_213 = Length(Curve=offset_curve_174)
length_214 = Length(Curve=offset_curve_176)
division_292 = Division(A=length_211, B=Slider(300, range=0..1000))
division_293 = Division(A=length_212, B=Slider(300, range=0..1000))
division_294 = Division(A=length_213, B=Slider(300, range=0..1000))
division_295 = Division(A=length_214, B=Slider(300, range=0..1000))
divide_curve_173 = DivideCurve(Curve=offset_curve_173, Count=division_292, Kinks=False)  # -> Points, Tangents, Parameters
divide_curve_174 = DivideCurve(Curve=offset_curve_174, Count=division_294, Kinks=False)  # -> Points, Tangents, Parameters
divide_curve_175 = DivideCurve(Curve=offset_curve_175, Count=division_293, Kinks=False)  # -> Points, Tangents, Parameters
divide_curve_176 = DivideCurve(Curve=offset_curve_176, Count=division_295, Kinks=False)  # -> Points, Tangents, Parameters
line_207 = Line(StartPoint=divide_curve_175.Points, EndPoint=divide_curve_173.Points)
line_208 = Line(StartPoint=divide_curve_176.Points, EndPoint=divide_curve_174.Points)
loft_143 = Loft(Curves=line_208, Options={Adjust=False, Closed=False, LoftEnds=0, LoftSimp=0, LoftType=0, Rebuild=10, Refit=0.01})
loft_144 = Loft(Curves=line_207, Options={Adjust=False, Closed=False, LoftEnds=0, LoftSimp=0, LoftType=0, Rebuild=10, Refit=0.01})
surface_closest_point_111 = SurfaceClosestPoint(Point=divide_curve_175.Points, Surface=loft_144)  # -> Point, UVPoint, Distance
surface_closest_point_112 = SurfaceClosestPoint(Point=divide_curve_176.Points, Surface=loft_143)  # -> Point, UVPoint, Distance
evaluate_surface_111 = EvaluateSurface(Surface=loft_144, Point=surface_closest_point_111.UVPoint)  # -> Point, Normal, UDirection, VDirection, Frame
evaluate_surface_112 = EvaluateSurface(Surface=loft_143, Point=surface_closest_point_112.UVPoint)  # -> Point, Normal, UDirection, VDirection, Frame
rotate_plane_113 = RotatePlane(Plane=evaluate_surface_111.Frame, Angle=radians_104)
rotate_plane_114 = RotatePlane(Plane=evaluate_surface_112.Frame, Angle=radians_106)
list_item_63 = ListItem(List=rotate_plane_113, Index=1, Wrap=True)
list_item_64 = ListItem(List=rotate_plane_114, Index=1, Wrap=True)
center_box_52 = CenterBox(Base=[list_item_63, list_item_64], X=division_260, Y=division_261, Z=division_258)
graft_tree_41 = GraftTree(Tree=flatten_tree_58, IncludeEmptyLists=True, IncludeNullItems=True)
graft_tree_42 = GraftTree(Tree=flatten_tree_57, IncludeEmptyLists=True, IncludeNullItems=True)
graft_tree_43 = GraftTree(Tree=flatten_tree_60, IncludeEmptyLists=True, IncludeNullItems=True)
flatten_tree_83 = FlattenTree(Tree=split_tree_60.Positive, Path="{0}")
flatten_tree_84 = FlattenTree(Tree=split_tree_59.Positive, Path="{0}")
graft_tree_44 = GraftTree(Tree=flatten_tree_59, IncludeEmptyLists=True, IncludeNullItems=True)
graft_tree_45 = GraftTree(Tree=flatten_tree_62, IncludeEmptyLists=True, IncludeNullItems=True)
flatten_tree_85 = FlattenTree(Tree=split_tree_63.Positive, Path="{0}")
flatten_tree_86 = FlattenTree(Tree=split_tree_64.Positive, Path="{0}")
flatten_tree_87 = FlattenTree(Tree=split_tree_62.Positive, Path="{0}")
flatten_tree_88 = FlattenTree(Tree=split_tree_61.Positive, Path="{0}")
graft_tree_46 = GraftTree(Tree=flatten_tree_61, IncludeEmptyLists=True, IncludeNullItems=True)
graft_tree_47 = GraftTree(Tree=flatten_tree_64, IncludeEmptyLists=True, IncludeNullItems=True)
graft_tree_48 = GraftTree(Tree=flatten_tree_66, IncludeEmptyLists=True, IncludeNullItems=True)
graft_tree_49 = GraftTree(Tree=flatten_tree_63, IncludeEmptyLists=True, IncludeNullItems=True)
graft_tree_50 = GraftTree(Tree=flatten_tree_65, IncludeEmptyLists=True, IncludeNullItems=True)
graft_tree_51 = GraftTree(Tree=flatten_tree_68, IncludeEmptyLists=True, IncludeNullItems=True)
graft_tree_52 = GraftTree(Tree=flatten_tree_67, IncludeEmptyLists=True, IncludeNullItems=True)
graft_tree_53 = GraftTree(Tree=flatten_tree_71, IncludeEmptyLists=True, IncludeNullItems=True)
graft_tree_54 = GraftTree(Tree=flatten_tree_72, IncludeEmptyLists=True, IncludeNullItems=True)
graft_tree_55 = GraftTree(Tree=flatten_tree_69, IncludeEmptyLists=True, IncludeNullItems=True)
graft_tree_56 = GraftTree(Tree=flatten_tree_70, IncludeEmptyLists=True, IncludeNullItems=True)
division_296 = Division(A=length_202, B=Slider(72, range=0..100))
deconstruct_plane_22 = DeconstructPlane(Plane=rotate_plane_110)  # -> Origin, XAxis, YAxis, ZAxis
linear_array_37 = LinearArray(Geometry=[center_box_36, center_box_35], Direction=unit_z_80, Count=Slider(1, range=0..10))  # -> Geometry, Transform
perp_frames_4 = PerpFrames(Curve=sub_curve_20, Count=division_296, Align=True)  # -> Frames, Parameters
unit_z_90 = UnitZ(Factor=Slider(85, range=0..1000))
graft_tree_57 = GraftTree(Tree=flatten_tree_74, IncludeEmptyLists=True, IncludeNullItems=True)
graft_tree_58 = GraftTree(Tree=flatten_tree_73, IncludeEmptyLists=True, IncludeNullItems=True)
graft_tree_59 = GraftTree(Tree=flatten_tree_76, IncludeEmptyLists=True, IncludeNullItems=True)
graft_tree_60 = GraftTree(Tree=flatten_tree_75, IncludeEmptyLists=True, IncludeNullItems=True)
graft_tree_61 = GraftTree(Tree=flatten_tree_78, IncludeEmptyLists=True, IncludeNullItems=True)
graft_tree_62 = GraftTree(Tree=flatten_tree_77, IncludeEmptyLists=True, IncludeNullItems=True)
graft_tree_63 = GraftTree(Tree=flatten_tree_80, IncludeEmptyLists=True, IncludeNullItems=True)
graft_tree_64 = GraftTree(Tree=flatten_tree_82, IncludeEmptyLists=True, IncludeNullItems=True)
graft_tree_65 = GraftTree(Tree=flatten_tree_79, IncludeEmptyLists=True, IncludeNullItems=True)
graft_tree_66 = GraftTree(Tree=flatten_tree_81, IncludeEmptyLists=True, IncludeNullItems=True)
graft_tree_67 = GraftTree(Tree=flatten_tree_84, IncludeEmptyLists=True, IncludeNullItems=True)
loft_145 = Loft(
    Curves=[graft_tree_42, graft_tree_41],
    Options={Adjust=False, Closed=False, LoftEnds=0, LoftSimp=0, LoftType=0, Rebuild=10, Refit=0.01})
graft_tree_68 = GraftTree(Tree=flatten_tree_83, IncludeEmptyLists=True, IncludeNullItems=True)
loft_146 = Loft(
    Curves=[graft_tree_44, graft_tree_43],
    Options={Adjust=False, Closed=False, LoftEnds=0, LoftSimp=0, LoftType=0, Rebuild=10, Refit=0.01})
graft_tree_69 = GraftTree(Tree=flatten_tree_87, IncludeEmptyLists=True, IncludeNullItems=True)
graft_tree_70 = GraftTree(Tree=flatten_tree_88, IncludeEmptyLists=True, IncludeNullItems=True)
graft_tree_71 = GraftTree(Tree=flatten_tree_85, IncludeEmptyLists=True, IncludeNullItems=True)
graft_tree_72 = GraftTree(Tree=flatten_tree_86, IncludeEmptyLists=True, IncludeNullItems=True)
loft_147 = Loft(
    Curves=[graft_tree_46, graft_tree_45],
    Options={Adjust=False, Closed=False, LoftEnds=0, LoftSimp=0, LoftType=0, Rebuild=10, Refit=0.01})
loft_148 = Loft(
    Curves=[graft_tree_49, graft_tree_47],
    Options={Adjust=False, Closed=False, LoftEnds=0, LoftSimp=0, LoftType=0, Rebuild=10, Refit=0.01})
loft_149 = Loft(
    Curves=[graft_tree_50, graft_tree_48],
    Options={Adjust=False, Closed=False, LoftEnds=0, LoftSimp=0, LoftType=0, Rebuild=10, Refit=0.01})
loft_150 = Loft(
    Curves=[graft_tree_52, graft_tree_51],
    Options={Adjust=False, Closed=False, LoftEnds=0, LoftSimp=0, LoftType=0, Rebuild=10, Refit=0.01})
flatten_tree_89 = FlattenTree(Tree=[loft_108, loft_107, loft_106, loft_105, loft_104, loft_103, loft_102, loft_101], Path="{0}")
line_sdl = LineSDL(Start=rotate_plane_89, Direction=deconstruct_plane_21.ZAxis, Length=Slider(-31, range=-50..50))
line_sdl_2 = LineSDL(Start=rotate_plane_89, Direction=deconstruct_plane_21.YAxis, Length=Slider(140, range=0..200))
loft_151 = Loft(
    Curves=[graft_tree_56, graft_tree_53],
    Options={Adjust=False, Closed=False, LoftEnds=0, LoftSimp=0, LoftType=0, Rebuild=10, Refit=0.01})
line_sdl_3 = LineSDL(Start=rotate_plane_89, Direction=deconstruct_plane_21.ZAxis, Length=Slider(31, range=-50..50))
loft_152 = Loft(
    Curves=[graft_tree_55, graft_tree_54],
    Options={Adjust=False, Closed=False, LoftEnds=0, LoftSimp=0, LoftType=0, Rebuild=10, Refit=0.01})
radians_115 = Radians(Degrees=Slider(90, range=0..100))
unit_z_91 = UnitZ(Factor=Slider(170, range=0..1000))
unit_z_92 = UnitZ(Factor=Slider(170, range=0..1000))
unit_z_93 = UnitZ(Factor=Slider(170, range=0..1000))
unit_z_94 = UnitZ(Factor=Slider(85, range=0..1000))
unit_z_95 = UnitZ(Factor=Slider(85, range=0..1000))
unit_z_96 = UnitZ(Factor=Slider(170, range=0..1000))
loft_153 = Loft(
    Curves=[graft_tree_58, graft_tree_57],
    Options={Adjust=False, Closed=False, LoftEnds=0, LoftSimp=0, LoftType=0, Rebuild=10, Refit=0.01})
loft_154 = Loft(
    Curves=[graft_tree_60, graft_tree_59],
    Options={Adjust=False, Closed=False, LoftEnds=0, LoftSimp=0, LoftType=0, Rebuild=10, Refit=0.01})
loft_155 = Loft(
    Curves=[graft_tree_62, graft_tree_61],
    Options={Adjust=False, Closed=False, LoftEnds=0, LoftSimp=0, LoftType=0, Rebuild=10, Refit=0.01})
loft_156 = Loft(
    Curves=[graft_tree_65, graft_tree_63],
    Options={Adjust=False, Closed=False, LoftEnds=0, LoftSimp=0, LoftType=0, Rebuild=10, Refit=0.01})
loft_157 = Loft(
    Curves=[graft_tree_66, graft_tree_64],
    Options={Adjust=False, Closed=False, LoftEnds=0, LoftSimp=0, LoftType=0, Rebuild=10, Refit=0.01})
loft_158 = Loft(
    Curves=[graft_tree_68, graft_tree_67],
    Options={Adjust=False, Closed=False, LoftEnds=0, LoftSimp=0, LoftType=0, Rebuild=10, Refit=0.01})
linear_array_38 = LinearArray(Geometry=center_box_47, Direction=unit_z_90, Count=Slider(1, range=0..10))  # -> Geometry, Transform
flatten_tree_90 = FlattenTree(Tree=[loft_120, loft_119, loft_118, loft_117, loft_116, loft_115, loft_114, loft_113], Path="{0}")
loft_159 = Loft(
    Curves=[graft_tree_72, graft_tree_69],
    Options={Adjust=False, Closed=False, LoftEnds=0, LoftSimp=0, LoftType=0, Rebuild=10, Refit=0.01})
loft_160 = Loft(
    Curves=[graft_tree_71, graft_tree_70],
    Options={Adjust=False, Closed=False, LoftEnds=0, LoftSimp=0, LoftType=0, Rebuild=10, Refit=0.01})
unit_z_97 = UnitZ(Factor=Slider(170, range=0..1000))
line_sdl_4 = LineSDL(Start=rotate_plane_110, Direction=deconstruct_plane_22.ZAxis, Length=Slider(-31, range=-50..50))
line_sdl_5 = LineSDL(Start=rotate_plane_110, Direction=deconstruct_plane_22.YAxis, Length=Slider(140, range=0..200))
line_sdl_6 = LineSDL(Start=rotate_plane_110, Direction=deconstruct_plane_22.ZAxis, Length=Slider(31, range=-50..50))
rotate_plane_115 = RotatePlane(Plane=perp_frames_3.Frames, Angle=radians_115)
radians_116 = Radians(Degrees=Slider(90, range=0..100))
clean_tree_13 = CleanTree(RemoveNulls=True, RemoveInvalid=True, RemoveEmpty=False, Tree=flatten_tree_89)
end_points_53 = EndPoints(Curve=line_sdl_2)  # -> Start, End
unit_z_98 = UnitZ(Factor=Slider(170, range=0..1000))
unit_z_99 = UnitZ(Factor=Slider(170, range=0..1000))
unit_z_100 = UnitZ(Factor=Slider(85, range=0..1000))
unit_z_101 = UnitZ(Factor=Slider(170, range=0..1000))
unit_z_102 = UnitZ(Factor=Slider(85, range=0..1000))
linear_array_39 = LinearArray(Geometry=[center_box_41, center_box_40], Direction=unit_z_91, Count=Slider(1, range=0..10))  # -> Geometry, Transform
unit_z_103 = UnitZ(Factor=Slider(425, range=0..1000))
linear_array_40 = LinearArray(Geometry=center_box_39, Direction=unit_z_92, Count=number_slider_71)  # -> Geometry, Transform
linear_array_41 = LinearArray(Geometry=center_box_42, Direction=unit_z_93, Count=number_slider_72)  # -> Geometry, Transform
linear_array_42 = LinearArray(Geometry=center_box_43, Direction=unit_z_94, Count=number_slider_75)  # -> Geometry, Transform
linear_array_43 = LinearArray(Geometry=center_box_51, Direction=unit_z_95, Count=Slider(1, range=0..10))  # -> Geometry, Transform
rotate_plane_116 = RotatePlane(Plane=perp_frames_4.Frames, Angle=radians_116)
clean_tree_14 = CleanTree(RemoveNulls=True, RemoveInvalid=True, RemoveEmpty=False, Tree=flatten_tree_90)
end_points_54 = EndPoints(Curve=line_sdl_5)  # -> Start, End
construct_plane = ConstructPlane(Origin=end_points_53.End, XAxis=deconstruct_plane_21.XAxis, YAxis=deconstruct_plane_21.YAxis)
linear_array_44 = LinearArray(Geometry=center_box_44, Direction=unit_z_96, Count=Slider(2, range=0..10))  # -> Geometry, Transform
deconstruct_plane_23 = DeconstructPlane(Plane=rotate_plane_115)  # -> Origin, XAxis, YAxis, ZAxis
move_53 = Move(Geometry=linear_array_38.Geometry, Motion=unit_z_103)  # -> Geometry, Transform
linear_array_45 = LinearArray(Geometry=center_box_45, Direction=unit_z_98, Count=number_slider_73)  # -> Geometry, Transform
linear_array_46 = LinearArray(Geometry=center_box_46, Direction=unit_z_99, Count=number_slider_74)  # -> Geometry, Transform
linear_array_47 = LinearArray(Geometry=center_box_47, Direction=unit_z_100, Count=number_slider_76)  # -> Geometry, Transform
linear_array_48 = LinearArray(Geometry=center_box_48, Direction=unit_z_97, Count=Slider(1, range=0..10))  # -> Geometry, Transform
linear_array_49 = LinearArray(Geometry=center_box_52, Direction=unit_z_102, Count=Slider(1, range=0..10))  # -> Geometry, Transform
brep_5 = Brep([linear_array_31.Geometry, linear_array_26.Geometry, linear_array_29.Geometry, linear_array_30.Geometry, move_44.Geometry, move_37.Geometry])
construct_plane_2 = ConstructPlane(Origin=end_points_54.End, XAxis=deconstruct_plane_22.XAxis, YAxis=deconstruct_plane_22.YAxis)
deconstruct_plane_24 = DeconstructPlane(Plane=rotate_plane_116)  # -> Origin, XAxis, YAxis, ZAxis
deconstruct_plane_25 = DeconstructPlane(Plane=construct_plane)  # -> Origin, XAxis, YAxis, ZAxis
linear_array_50 = LinearArray(Geometry=[center_box_50, center_box_49], Direction=unit_z_101, Count=Slider(1, range=0..10))  # -> Geometry, Transform
flatten_tree_91 = FlattenTree(Tree=[loft_152, loft_151, loft_150, loft_149, loft_148, loft_147, loft_146, loft_145], Path="{0}")
line_sdl_7 = LineSDL(Start=rotate_plane_115, Direction=deconstruct_plane_23.ZAxis, Length=Slider(-31, range=-50..50))
line_sdl_8 = LineSDL(Start=rotate_plane_115, Direction=deconstruct_plane_23.YAxis, Length=Slider(140, range=0..200))
line_sdl_9 = LineSDL(Start=rotate_plane_115, Direction=deconstruct_plane_23.ZAxis, Length=Slider(31, range=-50..50))
deconstruct_plane_26 = DeconstructPlane(Plane=construct_plane_2)  # -> Origin, XAxis, YAxis, ZAxis
brep_6 = Brep([linear_array_35.Geometry, linear_array_37.Geometry, linear_array_34.Geometry, linear_array_36.Geometry, move_51.Geometry, move_52.Geometry])
flatten_tree_92 = FlattenTree(Tree=[loft_160, loft_159, loft_158, loft_157, loft_156, loft_155, loft_154, loft_153], Path="{0}")
line_sdl_10 = LineSDL(Start=rotate_plane_116, Direction=deconstruct_plane_24.ZAxis, Length=Slider(-31, range=-50..50))
line_sdl_11 = LineSDL(Start=rotate_plane_116, Direction=deconstruct_plane_24.YAxis, Length=Slider(140, range=0..200))
line_sdl_12 = LineSDL(Start=rotate_plane_116, Direction=deconstruct_plane_24.ZAxis, Length=Slider(31, range=-50..50))
clean_tree_15 = CleanTree(RemoveNulls=True, RemoveInvalid=True, RemoveEmpty=False, Tree=flatten_tree_91)
end_points_55 = EndPoints(Curve=line_sdl_8)  # -> Start, End
line_sdl_13 = LineSDL(Start=construct_plane, Direction=deconstruct_plane_25.ZAxis, Length=Slider(-37.5, range=-50..50))
line_sdl_14 = LineSDL(Start=construct_plane, Direction=deconstruct_plane_25.ZAxis, Length=Slider(37.5, range=-50..50))
solid_difference = SolidDifference(BrepsA=brep_5, BrepsB=clean_tree_13)
clean_tree_16 = CleanTree(RemoveNulls=True, RemoveInvalid=True, RemoveEmpty=False, Tree=flatten_tree_92)
solid_difference_2 = SolidDifference(BrepsA=brep_6, BrepsB=clean_tree_14)
end_points_56 = EndPoints(Curve=line_sdl_11)  # -> Start, End
construct_plane_3 = ConstructPlane(Origin=end_points_55.End, XAxis=deconstruct_plane_23.XAxis, YAxis=deconstruct_plane_23.YAxis)
line_sdl_15 = LineSDL(Start=construct_plane_2, Direction=deconstruct_plane_26.ZAxis, Length=Slider(-37.5, range=-50..50))
line_sdl_16 = LineSDL(Start=construct_plane_2, Direction=deconstruct_plane_26.ZAxis, Length=Slider(37.5, range=-50..50))
end_points_57 = EndPoints(Curve=line_sdl_13)  # -> Start, End
end_points_58 = EndPoints(Curve=line_sdl_14)  # -> Start, End
end_points_59 = EndPoints(Curve=line_sdl)  # -> Start, End
end_points_60 = EndPoints(Curve=line_sdl_3)  # -> Start, End
brep_7 = Brep([linear_array_44.Geometry, linear_array_39.Geometry, linear_array_42.Geometry, linear_array_43.Geometry])
construct_plane_4 = ConstructPlane(Origin=end_points_56.End, XAxis=deconstruct_plane_24.XAxis, YAxis=deconstruct_plane_24.YAxis)
deconstruct_plane_27 = DeconstructPlane(Plane=construct_plane_3)  # -> Origin, XAxis, YAxis, ZAxis
end_points_61 = EndPoints(Curve=line_sdl_15)  # -> Start, End
end_points_62 = EndPoints(Curve=line_sdl_16)  # -> Start, End
end_points_63 = EndPoints(Curve=line_sdl_4)  # -> Start, End
end_points_64 = EndPoints(Curve=line_sdl_6)  # -> Start, End
line_209 = Line(StartPoint=end_points_57.End, EndPoint=end_points_58.End)
line_210 = Line(StartPoint=end_points_59.End, EndPoint=end_points_60.End)
number_slider_77 = Slider(-145, range=-200..0)
number_slider_78 = Slider(145, range=0..1000)
deconstruct_plane_28 = DeconstructPlane(Plane=construct_plane_4)  # -> Origin, XAxis, YAxis, ZAxis
line_211 = Line(StartPoint=end_points_61.End, EndPoint=end_points_62.End)
line_212 = Line(StartPoint=end_points_63.End, EndPoint=end_points_64.End)
number_slider_79 = Slider(-145, range=-200..0)
number_slider_80 = Slider(145, range=0..1000)
brep_8 = Brep([linear_array_48.Geometry, linear_array_50.Geometry, linear_array_47.Geometry, linear_array_49.Geometry, move_53.Geometry])
offset_curve_177 = OffsetCurve(Curve=line_210, Distance=number_slider_78, Plane=PlaneXY(0, 0, 0), Corners=1)
offset_curve_178 = OffsetCurve(Curve=line_210, Distance=number_slider_77, Plane=PlaneXY(0, 0, 0), Corners=1)
offset_curve_179 = OffsetCurve(Curve=line_209, Distance=number_slider_78, Plane=PlaneXY(0, 0, 0), Corners=1)
offset_curve_180 = OffsetCurve(Curve=line_209, Distance=number_slider_77, Plane=PlaneXY(0, 0, 0), Corners=1)
line_sdl_17 = LineSDL(Start=construct_plane_3, Direction=deconstruct_plane_27.ZAxis, Length=Slider(-37.5, range=-50..50))
line_sdl_18 = LineSDL(Start=construct_plane_3, Direction=deconstruct_plane_27.ZAxis, Length=Slider(37.5, range=-50..50))
solid_difference_3 = SolidDifference(BrepsA=brep_7, BrepsB=clean_tree_15)
solid_difference_4 = SolidDifference(BrepsA=brep_8, BrepsB=clean_tree_16)
offset_curve_181 = OffsetCurve(Curve=line_212, Distance=number_slider_80, Plane=PlaneXY(0, 0, 0), Corners=1)
offset_curve_182 = OffsetCurve(Curve=line_212, Distance=number_slider_79, Plane=PlaneXY(0, 0, 0), Corners=1)
offset_curve_183 = OffsetCurve(Curve=line_211, Distance=number_slider_80, Plane=PlaneXY(0, 0, 0), Corners=1)
offset_curve_184 = OffsetCurve(Curve=line_211, Distance=number_slider_79, Plane=PlaneXY(0, 0, 0), Corners=1)
line_sdl_19 = LineSDL(Start=construct_plane_4, Direction=deconstruct_plane_28.ZAxis, Length=Slider(-37.5, range=-50..50))
line_sdl_20 = LineSDL(Start=construct_plane_4, Direction=deconstruct_plane_28.ZAxis, Length=Slider(37.5, range=-50..50))
end_points_65 = EndPoints(Curve=offset_curve_180)  # -> Start, End
end_points_66 = EndPoints(Curve=line_sdl_17)  # -> Start, End
end_points_67 = EndPoints(Curve=line_sdl_18)  # -> Start, End
end_points_68 = EndPoints(Curve=offset_curve_179)  # -> Start, End
end_points_69 = EndPoints(Curve=offset_curve_178)  # -> Start, End
end_points_70 = EndPoints(Curve=offset_curve_177)  # -> Start, End
end_points_71 = EndPoints(Curve=line_sdl_7)  # -> Start, End
end_points_72 = EndPoints(Curve=line_sdl_9)  # -> Start, End
end_points_73 = EndPoints(Curve=offset_curve_184)  # -> Start, End
end_points_74 = EndPoints(Curve=line_sdl_19)  # -> Start, End
end_points_75 = EndPoints(Curve=line_sdl_20)  # -> Start, End
end_points_76 = EndPoints(Curve=offset_curve_183)  # -> Start, End
end_points_77 = EndPoints(Curve=offset_curve_182)  # -> Start, End
end_points_78 = EndPoints(Curve=offset_curve_181)  # -> Start, End
end_points_79 = EndPoints(Curve=line_sdl_10)  # -> Start, End
end_points_80 = EndPoints(Curve=line_sdl_12)  # -> Start, End
line_213 = Line(StartPoint=end_points_66.End, EndPoint=end_points_67.End)
line_214 = Line(StartPoint=end_points_71.End, EndPoint=end_points_72.End)
number_slider_81 = Slider(-145, range=-200..0)
number_slider_82 = Slider(145, range=0..1000)
line_215 = Line(StartPoint=end_points_68.End, EndPoint=end_points_65.End)
line_216 = Line(StartPoint=end_points_68.Start, EndPoint=end_points_65.Start)
line_217 = Line(StartPoint=end_points_70.End, EndPoint=end_points_69.End)
line_218 = Line(StartPoint=end_points_70.Start, EndPoint=end_points_69.Start)
line_219 = Line(StartPoint=end_points_74.End, EndPoint=end_points_75.End)
line_220 = Line(StartPoint=end_points_79.End, EndPoint=end_points_80.End)
number_slider_83 = Slider(-145, range=-200..0)
number_slider_84 = Slider(145, range=0..1000)
line_221 = Line(StartPoint=end_points_76.End, EndPoint=end_points_73.End)
line_222 = Line(StartPoint=end_points_76.Start, EndPoint=end_points_73.Start)
line_223 = Line(StartPoint=end_points_78.End, EndPoint=end_points_77.End)
line_224 = Line(StartPoint=end_points_78.Start, EndPoint=end_points_77.Start)
offset_curve_185 = OffsetCurve(Curve=line_214, Distance=number_slider_82, Plane=PlaneXY(0, 0, 0), Corners=1)
offset_curve_186 = OffsetCurve(Curve=line_214, Distance=number_slider_81, Plane=PlaneXY(0, 0, 0), Corners=1)
offset_curve_187 = OffsetCurve(Curve=line_213, Distance=number_slider_82, Plane=PlaneXY(0, 0, 0), Corners=1)
offset_curve_188 = OffsetCurve(Curve=line_213, Distance=number_slider_81, Plane=PlaneXY(0, 0, 0), Corners=1)
offset_curve_189 = OffsetCurve(Curve=line_220, Distance=number_slider_84, Plane=PlaneXY(0, 0, 0), Corners=1)
offset_curve_190 = OffsetCurve(Curve=line_220, Distance=number_slider_83, Plane=PlaneXY(0, 0, 0), Corners=1)
offset_curve_191 = OffsetCurve(Curve=line_219, Distance=number_slider_84, Plane=PlaneXY(0, 0, 0), Corners=1)
offset_curve_192 = OffsetCurve(Curve=line_219, Distance=number_slider_83, Plane=PlaneXY(0, 0, 0), Corners=1)
loft_161 = Loft(
    Curves=[line_216, line_215],
    Options={Adjust=False, Closed=False, LoftEnds=0, LoftSimp=0, LoftType=0, Rebuild=10, Refit=0.01})
loft_162 = Loft(
    Curves=[line_216, line_218],
    Options={Adjust=False, Closed=False, LoftEnds=0, LoftSimp=0, LoftType=0, Rebuild=10, Refit=0.01})
loft_163 = Loft(
    Curves=[line_218, line_217],
    Options={Adjust=False, Closed=False, LoftEnds=0, LoftSimp=0, LoftType=0, Rebuild=10, Refit=0.01})
loft_164 = Loft(
    Curves=[offset_curve_178, offset_curve_180],
    Options={Adjust=False, Closed=False, LoftEnds=0, LoftSimp=0, LoftType=0, Rebuild=10, Refit=0.01})
loft_165 = Loft(
    Curves=[offset_curve_179, offset_curve_177],
    Options={Adjust=False, Closed=False, LoftEnds=0, LoftSimp=0, LoftType=0, Rebuild=10, Refit=0.01})
loft_166 = Loft(
    Curves=[line_215, line_217],
    Options={Adjust=False, Closed=False, LoftEnds=0, LoftSimp=0, LoftType=0, Rebuild=10, Refit=0.01})
end_points_81 = EndPoints(Curve=offset_curve_188)  # -> Start, End
end_points_82 = EndPoints(Curve=offset_curve_187)  # -> Start, End
end_points_83 = EndPoints(Curve=offset_curve_186)  # -> Start, End
end_points_84 = EndPoints(Curve=offset_curve_185)  # -> Start, End
loft_167 = Loft(
    Curves=[line_222, line_221],
    Options={Adjust=False, Closed=False, LoftEnds=0, LoftSimp=0, LoftType=0, Rebuild=10, Refit=0.01})
loft_168 = Loft(
    Curves=[line_222, line_224],
    Options={Adjust=False, Closed=False, LoftEnds=0, LoftSimp=0, LoftType=0, Rebuild=10, Refit=0.01})
loft_169 = Loft(
    Curves=[line_224, line_223],
    Options={Adjust=False, Closed=False, LoftEnds=0, LoftSimp=0, LoftType=0, Rebuild=10, Refit=0.01})
loft_170 = Loft(
    Curves=[offset_curve_182, offset_curve_184],
    Options={Adjust=False, Closed=False, LoftEnds=0, LoftSimp=0, LoftType=0, Rebuild=10, Refit=0.01})
loft_171 = Loft(
    Curves=[offset_curve_183, offset_curve_181],
    Options={Adjust=False, Closed=False, LoftEnds=0, LoftSimp=0, LoftType=0, Rebuild=10, Refit=0.01})
loft_172 = Loft(
    Curves=[line_221, line_223],
    Options={Adjust=False, Closed=False, LoftEnds=0, LoftSimp=0, LoftType=0, Rebuild=10, Refit=0.01})
end_points_85 = EndPoints(Curve=offset_curve_192)  # -> Start, End
end_points_86 = EndPoints(Curve=offset_curve_191)  # -> Start, End
end_points_87 = EndPoints(Curve=offset_curve_190)  # -> Start, End
end_points_88 = EndPoints(Curve=offset_curve_189)  # -> Start, End
line_225 = Line(StartPoint=end_points_82.End, EndPoint=end_points_81.End)
line_226 = Line(StartPoint=end_points_82.Start, EndPoint=end_points_81.Start)
line_227 = Line(StartPoint=end_points_84.End, EndPoint=end_points_83.End)
line_228 = Line(StartPoint=end_points_84.Start, EndPoint=end_points_83.Start)
geometry_11 = Geometry([loft_166, loft_165, loft_161, loft_162, loft_163, loft_164])
line_229 = Line(StartPoint=end_points_86.End, EndPoint=end_points_85.End)
line_230 = Line(StartPoint=end_points_86.Start, EndPoint=end_points_85.Start)
line_231 = Line(StartPoint=end_points_88.End, EndPoint=end_points_87.End)
line_232 = Line(StartPoint=end_points_88.Start, EndPoint=end_points_87.Start)
geometry_12 = Geometry([loft_172, loft_171, loft_167, loft_168, loft_169, loft_170])
loft_173 = Loft(
    Curves=[line_226, line_225],
    Options={Adjust=False, Closed=False, LoftEnds=0, LoftSimp=0, LoftType=0, Rebuild=10, Refit=0.01})
loft_174 = Loft(
    Curves=[line_226, line_228],
    Options={Adjust=False, Closed=False, LoftEnds=0, LoftSimp=0, LoftType=0, Rebuild=10, Refit=0.01})
loft_175 = Loft(
    Curves=[line_228, line_227],
    Options={Adjust=False, Closed=False, LoftEnds=0, LoftSimp=0, LoftType=0, Rebuild=10, Refit=0.01})
loft_176 = Loft(
    Curves=[offset_curve_186, offset_curve_188],
    Options={Adjust=False, Closed=False, LoftEnds=0, LoftSimp=0, LoftType=0, Rebuild=10, Refit=0.01})
loft_177 = Loft(
    Curves=[offset_curve_187, offset_curve_185],
    Options={Adjust=False, Closed=False, LoftEnds=0, LoftSimp=0, LoftType=0, Rebuild=10, Refit=0.01})
loft_178 = Loft(
    Curves=[line_225, line_227],
    Options={Adjust=False, Closed=False, LoftEnds=0, LoftSimp=0, LoftType=0, Rebuild=10, Refit=0.01})
loft_179 = Loft(
    Curves=[line_230, line_229],
    Options={Adjust=False, Closed=False, LoftEnds=0, LoftSimp=0, LoftType=0, Rebuild=10, Refit=0.01})
loft_180 = Loft(
    Curves=[line_230, line_232],
    Options={Adjust=False, Closed=False, LoftEnds=0, LoftSimp=0, LoftType=0, Rebuild=10, Refit=0.01})
loft_181 = Loft(
    Curves=[line_232, line_231],
    Options={Adjust=False, Closed=False, LoftEnds=0, LoftSimp=0, LoftType=0, Rebuild=10, Refit=0.01})
loft_182 = Loft(
    Curves=[offset_curve_190, offset_curve_192],
    Options={Adjust=False, Closed=False, LoftEnds=0, LoftSimp=0, LoftType=0, Rebuild=10, Refit=0.01})
loft_183 = Loft(
    Curves=[offset_curve_191, offset_curve_189],
    Options={Adjust=False, Closed=False, LoftEnds=0, LoftSimp=0, LoftType=0, Rebuild=10, Refit=0.01})
loft_184 = Loft(
    Curves=[line_229, line_231],
    Options={Adjust=False, Closed=False, LoftEnds=0, LoftSimp=0, LoftType=0, Rebuild=10, Refit=0.01})
geometry_13 = Geometry([loft_178, loft_177, loft_173, loft_174, loft_175, loft_176])
geometry_14 = Geometry([loft_184, loft_183, loft_179, loft_180, loft_181, loft_182])
geometry_15 = Geometry([linear_array_33.Geometry, linear_array_32.Geometry, geometry_12, solid_difference_2])
geometry_16 = Geometry([linear_array_28.Geometry, linear_array_27.Geometry, geometry_11, solid_difference])
geometry_17 = Geometry([geometry_16, geometry_15])
geometry_18 = Geometry([linear_array_46.Geometry, linear_array_45.Geometry, geometry_14, solid_difference_4])
geometry_19 = Geometry([linear_array_41.Geometry, linear_array_40.Geometry, geometry_13, solid_difference_3])
geometry_20 = Geometry([geometry_19, geometry_18])

# ---- group: Wall with arch opening / Output
geometry_21 = Geometry([geometry_17, geometry_20])
